vi "Keithley 2450 Sweep and Acquire Measurements.gvi"   [LabVIEW NXG 3.1.0]
# Configures a sweep and takes voltage and current readings at each point.
panel controls:
  "Limit Level (0.1)": f64 = 0.1  # Sets the maximum value for the value not regulated by the Source Mode control. For instance, if the instrument was suppling a voltage, the compliance value would be in amps. Valid Range: Voltage: +/- 210V Current: +/- 1A
  "VISA resource name": "VISA Instr"
    # Specifies which instrument to use.  Instruments that are powered on and connected to your computer are visible in the VISA resource name pull-down menu.  Select the resource name from the VISA resource name pull-down menu.  If your instrument does not appear in this list, enter the instrument descriptor using the following format:
    # Interface Type[board index]::Address::INSTR.
    # Examples:
    # GPIB:  GPIB::22::INSTR,  GPIB board 0, primary address 22
    # Serial:  COM1
    # VISA Alias:  "SampleInstr" - Alias names are configured in MAX
    # Refer to the LabVIEW Help for more information about specifying a VISA resource name.
  "Source Mode (0: Voltage)": u16 = "Voltage"(0)  # Selects the voltage or current source mode to be configured.
  "Sweep Points": T1 = {"Start "=1, "Stop "=0, "Number of Points (5)"=5}
  "Delay (0) in Sec": f64 = 0.001  # The amount of delay between source and measure.
  "Measurement Speed (1 PLC)": f64 = 1  # The number of power line cycles the instrument spends taking a measurement. This setting is global for voltage, current, and resistance measurements. Valid Range: 0.01 to 10 PLC
panel indicators:
  "Waveform Graph": f64[][]
types:
  T1 = cluster{"Start ": f64, "Stop ": f64, "Number of Points (5)": u32}
uses:
  Keithley 2450 NXG Library::Public::Initialize.gvi
  Keithley 2450 NXG Library::Public::Configure::Configure Measurement Range.gvi
  Keithley 2450 NXG Library::Public::Configure::Configure Output.gvi
  Keithley 2450 NXG Library::Public::Configure::Configure Source Function.gvi
  Keithley 2450 NXG Library::Public::Configure::Configure Measurement Function.gvi
  Keithley 2450 NXG Library::Public::Configure::Configure Integration Filter.gvi
  Keithley 2450 NXG Library::Public::Configure::Configure Linear Mode Sweep.gvi
  Keithley 2450 NXG Library::Public::Action Status::Enable Output.gvi
  Keithley 2450 NXG Library::Public::Data::Low Level::Initiate.gvi
  Keithley 2450 NXG Library::Public::Data::Low Level::Wait for Operation Complete.gvi
  Keithley 2450 NXG Library::Public::Data::Read (Multiple Points).gvi
  Keithley 2450 NXG Library::Public::Close.gvi
  NI::G Core::Error::Display Error.gvi
diagram:
  # Configure the sweep with the amplitude and source settings.
  Property Node(instance in=$"Sweep Points") -> ("Number of Points (5)"=w1)
  call "Initialize.gvi"(VISA resource name=$"VISA resource name") -> (VISA resource name out=w2, error out=w3)
  call "Configure Measurement Range.gvi"(VISA resource name=w2, Function (0: Volts)="Volts"(0), Enable Auto Range (T:Enable)=TRUE, error in (no error)=w3) -> (VISA resource name out=w4, error out=w5)
  # Configure the measurements and output.
  call "Configure Measurement Range.gvi"(VISA resource name=w4, Function (0: Volts)="Current"(1), Enable Auto Range (T:Enable)=TRUE, error in (no error)=w5) -> (VISA resource name out=w6, error out=w7)
  call "Configure Output.gvi"(VISA resource name=w6, Source Mode (0: Voltage)=$"Source Mode (0: Voltage)", Source Limit Level (0.1)=$"Limit Level (0.1)", error in (no error)=w7) -> (VISA resource name out=w8, error out=w9)
  call "Configure Source Function.gvi"(VISA resource name=w8, Function (0: Volts)=$"Source Mode (0: Voltage)", error in (no error)=w9) -> (VISA resource name out=w10, error out=w11)
  case ($"Source Mode (0: Voltage)") {
    frame 0, Default {
      w13 = "Current"(1)  # Function (0: Volts)
      w12 = w13
    }
    frame 1 {
      w14 = "Volts"(0)  # Function (0: Volts)
      w12 = w14
    }
  }
  call "Configure Measurement Function.gvi"(VISA resource name=w10, Function (0: Volts)=w12, error in (no error)=w11) -> (VISA resource name out=w15, error out=w16)
  call "Configure Integration Filter.gvi"(VISA resource name=w15, Function (0: Volts)="Current"(1), Measurement Speed (1 PLC)=$"Measurement Speed (1 PLC)", error in (no error)=w16) -> (VISA resource name out=w17, error out=w18)
  call "Configure Linear Mode Sweep.gvi"(VISA resource name=w17, Source Mode (0: Voltage)=$"Source Mode (0: Voltage)", Sweep Points=$"Sweep Points", Delay (0)=$"Delay (0) in Sec", error in (no error)=w18) -> (VISA resource name out=w19, error out=w20)
  call "Enable Output.gvi"(VISA resource name=w19, Enable Output (T: Enable)=TRUE, error in (no error)=w20) -> (VISA resource name out=w21, error out=w22)
  call "Initiate.gvi"(VISA resource name=w21, error in (no error)=w22) -> (VISA resource name out=w23, error out=w24)
  call "Wait for Operation Complete.gvi"(VISA resource name=w23, Timeout (10000 ms)=100000, error in (no error)=w24) -> (VISA resource name out=w25, error out=w26)
  # Read the raw data.
  case ($"Source Mode (0: Voltage)") {
    frame 0, Default {
      sequence {
        frame 0 {
          Wait(time to wait=2000)
        }
        frame 1 {
          call "Read (Multiple Points).gvi"(VISA resource name=w25, Start Index (1)=1, End Index (1)=w1, error in (no error)=w26, Buffer Elements="SOUR, READ") -> (VISA resource name out=w27, Data out=w29, error out=w28)
        }
      }
    }
    frame 1 {
      sequence {
        frame 0 {
          Wait(time to wait=2000)
        }
        frame 1 {
          call "Read (Multiple Points).gvi"(VISA resource name=w25, Start Index (1)=1, End Index (1)=w1, error in (no error)=w26, Buffer Elements="READ, SOUR") -> (VISA resource name out=w27, Data out=w29, error out=w28)
        }
      }
    }
  }
  Spreadsheet String To Array(array type=f64[] [], delimiter=",", format string="%s", spreadsheet string=w29) -> (array=w30)
  Decimate Array(array=w30) -> (out0=w31, out1=w32)
  Build Array(w31, w32) -> w33
  $"Waveform Graph" <- w33
  call "Enable Output.gvi"(VISA resource name=w27, Enable Output (T: Enable)=FALSE, error in (no error)=w28) -> (VISA resource name out=w34, error out=w35)
  call "Close.gvi"(VISA resource name=w34, error in (no error)=w35) -> (error out=w36)
  call "Display Error.gvi"(error in=w36)
