vi "Wait for Operation Complete.gvi"   [LabVIEW NXG 3.1.0]
# Waits for an operation to complete.  This is useful for synchronizing instrument code with other code.
# Note: When taking measurements, this VI will hold until the instrument has armed and triggered all of the times specified in Configure Multipoint.  This VI won't function correctly if the triggering has occured but the instrument is set to arm after those triggered measurements have finished.
# Use this VI only with other low-level VIs.  The high-level VIs automatically incorporate this functionality.  This VI does not check the instrument status.   If you want to check the instrument status, call the Error Query VI at the conclusion of the sequence.
inputs:
  "VISA resource name": "VISA Instr", required
    # A reference to the instrument in use.  The reference to the resource name is created in the Initialize VI.  Therefore, before calling this VI, you need to call the Initialize VI.  To run this VI interactively, select the previously initialized resource name from the pull-down menu.  To run this VI programmatically, wire the VISA resource name out terminal of the Initialize VI to subsequent VISA resource name input terminals.  You chain instrument driver VIs together by wiring the VISA resource name out terminal to subsequent VISA resource name input terminals.
  "Timeout (10000 ms)": u32 = 10000  # The maximum length of time, in milliseconds, in which to allow the operation to complete. Valid Range: 0 - 4,294,967,295 ms
  "error in (no error)": error
outputs:
  "VISA resource name out": "VISA Instr"  # A copy of the reference to the instrument in use. The reference to the resource name is created in the Initialize VI. Wire the VISA resource name out terminal of the Initialize VI to subsequent VISA resource name input terminals. You chain instrument driver VIs together by wiring the VISA resource name out terminal to subsequent VISA resource name input terminals.
  "error out": error
uses:
  NI::VISA::Write (Instr, String).gvi
  NI::G Core::Error::Legacy::Error Cluster From Error Code.gvi
  NI::VISA::Read STB (Instr).gvi
  NI::VISA::Synchronous Write (Instr, Compatibility).gvi
  NI::VISA::Synchronous Read (Instr, Compatibility).gvi
diagram:
  Property Node(instance in=$"VISA resource name") -> ("Intf Type"=w1)
  Is Equal(x=w1, y=4) -> w2
  case (w2) {
    frame False, Default {
      # GPIB
      call "Write (Instr, String).gvi"(session in=$"VISA resource name", error in=$"error in (no error)", write buffer="*OPC;") -> (session out=w5, error out=w6)
      Tick Count() -> (timer value=w7)
      w8 = "The instrument has timed out while waiting for the acquisition to complete."
      call "Error Cluster From Error Code.gvi"(error code=-1073999873, error message=w8, show call chain?=TRUE) -> (error out=w9)
      # Note: Initialize MUST be run for this VI to work, otherwise the status register masks never get set correctly and the OPC flag is masked.
      s1 = w6  # shift register
      while {
        Wait(time to wait=10)
        call "Read STB (Instr).gvi"(session in=w5, error in=s1) -> (session out=w4, error out=w10, status byte=w11)
        Tick Count() -> (timer value=w12)
        Subtract(x=w12, y=w7) -> w13
        Is Greater(x=w13, y=$"Timeout (10000 ms)") -> w14
        Select(s=w14, t=w9, f=no error) -> w15
        Build Array(w10, w15) -> w16
        Build Array(w16) -> w17
        Build Array(w17) -> w18
        Merge Errors(w18) -> (error out=w19)
        Logical And(w11, 32) -> w20
        Is Not Equal To 0(x=w20) -> w21
        Property Node(instance in=w10) -> ("status"=w22)
        Logical Or(w22, w21, w14) -> w23
        next s1 = w19
        stop if w23
      }
      w3 = s1
    }
    frame True {
      Property Node(instance in=$"VISA resource name", "Timeout"=$"Timeout (10000 ms)", error in=$"error in (no error)") -> ("Timeout"=w24, error out=w25, instance out=w26)
      call "Synchronous Write (Instr, Compatibility).gvi"(session in=w26, error in=w25, write buffer="*OPC?;") -> (session out=w27, error out=w28)
      call "Synchronous Read (Instr, Compatibility).gvi"(session in=w27, error in=w28, byte count=12) -> (session out=w29, error out=w30)
      # Serial, STB isn't supported so we wait for the 1
      # from OPC? to appear in the read buffer.
      Property Node(instance in=w29, "Timeout"=w24, error in=w30) -> (error out=w3, instance out=w4)
    }
  }
  $"VISA resource name out" <- w4
  $"error out" <- w3
