vi "Revision Query.gvi"   [LabVIEW Conversion 3.1.0]
# Queries the current instrument firmware revision and instrument driver revision.
# Refer to the Readme file for detailed driver information including modification history.
inputs:
  "VISA resource name": "VISA Instr", required
    # A reference to the instrument in use.  The reference to the resource name is created in the Initialize VI.  Therefore, before calling this VI, you need to call the Initialize VI.  To run this VI interactively, select the previously initialized resource name from the pull-down menu.  To run this VI programmatically, wire the VISA resource name out terminal of the Initialize VI to subsequent VISA resource name input terminals.  You chain instrument driver VIs together by wiring the VISA resource name out terminal to subsequent VISA resource name input terminals.
  "error in (no error)": error
outputs:
  "VISA resource name out": "VISA Instr"  # A copy of the reference to the instrument in use. The reference to the resource name is created in the Initialize VI. Wire the VISA resource name out terminal of the Initialize VI to subsequent VISA resource name input terminals. You chain instrument driver VIs together by wiring the VISA resource name out terminal to subsequent VISA resource name input terminals.
  "Instrument Driver Revision": string  # Returns the instrument driver software revision in the form of a string.
  "Instrument Firmware Revision": string  # Returns the instrument firmware revision numbers in the form of a string. This version and its capabilities are set by the instrument manufacturer.
  "error out": error
uses:
  NI::VISA::Synchronous Write (Instr, Compatibility).gvi
  NI::VISA::Synchronous Read (Instr, Compatibility).gvi
diagram:
  w1 = 100  # Bytes to Read
  Property Node() -> ("App.Kind"=w2)
  Is Equal(x=w2, y="Run Time System") -> w3
  case (w3) {
    frame False, Default {
      Property Node(error in=$"error in (no error)") -> ("Library"=w6, error out=w7, instance out=w8)
      Is Not A Number Or Path Or Refnum(number=w6) -> w9
      case (w9) {
        frame False, Default {
          Property Node[IsPlaceholderNodeForConversion=True](instance in=w6, error in=w7) -> ("Version"=w10, error out=w11, instance out=w12)
          Close Reference(error in=w11, reference=w12) -> (error out=w13)
          Close Reference(error in=w13, reference=w8) -> (error out=w5)
          Property Node(instance in=w10) -> ("Major"=w14, "Minor"=w15, "Fix"=w16, "Build"=w17)
          Format Into String(formatString="%d.%d", w14, w15) -> w18
          Is Equal To 0(x=w16) -> w19
          Is Equal To 0(x=w17) -> w20
          Logical And(w19, w20) -> w21
          Format Into String(formatString=".%d", w16) -> w22
          Select(s=w21, t="", f=w22) -> w23
          # Retrieve version information from VI library
          Format Into String(formatString=".%d", w17) -> w24
          Select(s=w20, t="", f=w24) -> w25
          Concatenate Strings(w18, w23, w25) -> w4
        }
        frame True {
          w5 = w7
          w4 = "Driver Not in a Project Library"
        }
      }
    }
    frame True {
      w4 = "1.1.1"
      w5 = $"error in (no error)"
    }
  }
  w26 = "*IDN?"  # Revision Query Command
  call "Synchronous Write (Instr, Compatibility).gvi"(session in=$"VISA resource name", error in=w5, write buffer=w26) -> (session out=w27, error out=w28)
  call "Synchronous Read (Instr, Compatibility).gvi"(session in=w27, error in=w28, byte count=w1) -> (session out=w29, error out=w30, read buffer=w31)
  Error Query(VISA resource name Input 0=w29, error in (no error) Input 1=w30) -> (VISA resource name out Output 2=w32, error out Output 5=w33)  # Error Query (Placeholder)
  $"VISA resource name out" <- w32
  $"error out" <- w33
  Scan From String(formatString="%[^,], %[^,], %[^,],%[^\\r\\n]", inputString=w31) -> (out3=w34)
  $"Instrument Firmware Revision" <- w34
  $"Instrument Driver Revision" <- w4
