vi "VI Tree.gvi"   [LabVIEW NXG 3.1.0]
# This is the instrument driver for the Keithley 2400 Series SourceMeter. The VI Tree displays all the user-callable VIs of the instrument driver in an organized table.
diagram:
  # Initialize
  call "Initialize.gvi"()
  # Close
  call "Close.gvi"()
  call "Create Math Operation.gvi"()
  # Data
  call "Fetch Read Buffer Statistics.gvi"()
  call "Get Number of Readings in the Buffer.gvi"()
  call "Make Reading and Store in Buffer.gvi"()
  # Action-Status
  call "Enable Output.gvi"()
  call "Enable Remote Sensing.gvi"()
  call "Get Digital IO Pins Mode.gvi"()
  call "Get Digital IO Pins State.gvi"()
  call "Query Limit Test Data.gvi"()
  # Utility
  call "Clear Display.gvi"()
  call "Clear System Event Log.gvi"()
  call "Set Display Screen.gvi"()
  call "In Compliance Query.gvi"()
  call "Read all Digital IO Pins.gvi"()
  call "Set Digital IO Mode.gvi"()
  call "Read (Multiple Points).gvi"()
  call "Read (Single Point).gvi"()
  call "Read (Digitize).gvi"()
  call "Display Message.gvi"()
  call "Emit Beep.gvi"()
  call "Enable Operation Event Register.gvi"()
  call "Enable Questionable Event Register.gvi"()
  call "Set or Reset Digital IO Pins.gvi"()
  call "Write to all Digital IO Pins.gvi"()
  call "Error Query.gvi"()
  call "Get Active Terminals.gvi"()
  call "Self-Test.gvi"()
  call "Get Event Id Mapped to Bit Number in Operation Event Register.gvi"()
  call "Fetch (Measurements).gvi"()
  call "Measure Lowlevel.gvi"()
  # Data, Low Level
  call "Abort.gvi"()
  call "Initiate.gvi"()
  call "Get Event Id Mapped to Bit Number in Questionable Event Register.gvi"()
  call "Get Min-Max Ranges.gvi"()
  call "Get Trigger Block List.gvi"()
  call "Map Event Id to Bit number in Operation Event Register.gvi"()
  call "Map Event Id to Bit number in Questionable Event Register.gvi"()
  call "Preset Status.gvi"()
  call "Read Operation Condition Register.gvi"()
  call "Read Operation Event Register Status.gvi"()
  call "Send Software Trigger.gvi"()
  call "Wait for Operation Complete.gvi"()
  # Configure
  call "Configure Brightness of Display.gvi"()
  call "Configure Digits for Display.gvi"()
  call "Configure Reading Format of Display.gvi"()
  call "Get System Access Permission.gvi"()
  call "Create Configuration List.gvi"()
  call "Read Operation Event Register.gvi"()
  call "Read Questionable Condition Register.gvi"()
  call "Read Questionable Event Register Status.gvi"()
  call "Read Questionable Event Register.gvi"()
  call "Delete Configuration List.gvi"()
  call "Enable Logging.gvi"()
  call "Get Time.gvi"()
  call "Get GPIB Address.gvi"()
  call "Get Line Frequency.gvi"()
  call "Reset.gvi"()
  call "Revision Query.gvi"()
  call "Select Active Terminals.gvi"()
  call "Selected Range Query.gvi"()
  call "Get Log State.gvi"()
  call "Get System Access Permission.gvi"()
  call "Get Version.gvi"()
  call "Getting Powered ON Setup.gvi"()
  call "Recall Configuration List.gvi"()
  call "Save Message from Event Log.gvi"()
  call "Set Absolute Time.gvi"()
  call "Set GPIB Address.gvi"()
  call "Setting Powered ON Setup.gvi"()
  call "Store Configuration List.gvi"()
  # Configure, Source
  call "Configure Linear Mode Sweep.gvi"()
  call "Configure Linear Step Mode Sweep.gvi"()
  call "Configure Log Mode Sweep.gvi"()
  call "Configure Filter.gvi"()
  call "Configure List Mode Sweep.gvi"()
  call "Configure Trigger Model Branch Counter Block.gvi"()
  # Configure, Buffer
  call "Append Buffer to File in the USB.gvi"()
  call "Clear Buffer Statistics.gvi"()
  call "Clear Buffer.gvi"()
  call "Delete User Buffer.gvi"()
  # Configure, Measure
  call "Configure Autozero Once.gvi"()
  call "Configure Autozero.gvi"()
  call "Configure Integration Filter.gvi"()
  # Configure, Trigger
  call "Clear Trigger timer.gvi"()
  call "Configure Trigger Model Always Block.gvi"()
  call "Configure Trigger Model Blender Mode.gvi"()
  call "Configure Trigger Model Buffer Clear Block.gvi"()
  call "Configure Trigger Model Clear Blender.gvi"()
  call "Configure Trigger Model Clear Digital Input Line.gvi"()
  call "Configure Trigger Model Clear LAN.gvi"()
  call "Create User Buffer.gvi"()
  call "Get Buffer Filling Mode.gvi"()
  call "Get Buffer Size.gvi"()
  call "Get Byte Order.gvi"()
  call "Configure Output List.gvi"()
  call "Configure Output Off Behavior.gvi"()
  call "Configure Output Sweep.gvi"()
  call "Configure Output.gvi"()
  call "Configure Limit Test Auto Clear.gvi"()
  call "Configure Limit Test Clear.gvi"()
  call "Configure Limit Test Lower Limit.gvi"()
  call "Enable Limit Test.gvi"()
  call "Configure Trigger Model Configuration List Next Index Block.gvi"()
  call "Configure Trigger Model Configuration List Previous index Block.gvi"()
  call "Configure Trigger Model Constant Delay Block.gvi"()
  call "Configure Trigger Model Delta Block.gvi"()
  call "Get Data Format.gvi"()
  call "Save Buffer to File in the USB.gvi"()
  call "Set Buffer Filling Mode.gvi"()
  call "Set Buffer Size.gvi"()
  call "Configure Over Voltage Protection.gvi"()
  call "Configure Source Function.gvi"()
  call "Configure Source Level.gvi"()
  call "Configure Source Limit Level.gvi"()
  call "Configure Limit Test Upper Limit.gvi"()
  call "Configure Math.gvi"()
  call "Configure Measurement Auto Range Lower Limit.gvi"()
  call "Configure Measurement Auto Range Upper Limit.gvi"()
  call "Configure Source Range.gvi"()
  call "Enable High Capacitance.gvi"()
  call "Enable Source Auto Range.gvi"()
  call "Enable Source Read Back.gvi"()
  call "Configure Trigger Model Digital Input Mode.gvi"()
  call "Configure Trigger Model Digital Output Mode.gvi"()
  call "Configure Trigger Model Digital Output Pulse Width.gvi"()
  call "Configure Trigger Model LAN IP Address.gvi"()
  call "Configure Byte Order.gvi"()
  call "Configure Measurement Manual Range.gvi"()
  call "Configure Measurement Range.gvi"()
  call "Configure Offset Compensation.gvi"()
  call "Configure Measurement Function.gvi"()
  call "Configure Trigger Model LAN Output Logic Mode.gvi"()
  call "Configure Trigger Model LAN Output Protocol.gvi"()
  call "Configure Trigger Model LAN Trigger Mode.gvi"()
  call "Configure Trigger Model Measure Block.gvi"()
  call "Get High Capacitance State.gvi"()
  call "Get Interlock Status.gvi"()
  call "Get Source Auto Delay State.gvi"()
  call "Get Source Auto Range.gvi"()
  call "Configure Settling Delay.gvi"()
  call "Configure Specific Limit Test.gvi"()
  call "Configure Unit of Current.gvi"()
  call "Configure Relative Offset.gvi"()
  call "Configure Trigger Model Once Block.gvi"()
  call "Configure Trigger Model Once Excluded Block.gvi"()
  call "Configure Trigger Model Recall Configuration List Block.gvi"()
  call "Configure Trigger Model Source Output Block.gvi"()
  call "Get Source Configuration List Catalog.gvi"()
  call "Get Source Configuration List Settings.gvi"()
  call "Get Source Configuration List Size.gvi"()
  call "Get Source Delay.gvi"()
  call "Configure Unit of Voltage.gvi"()
  call "Enable Math Operation.gvi"()
  call "Enable Measurement Auto Range.gvi"()
  call "Get Limit Test Enabled State.gvi"()
  call "Configure Trigger Model.gvi"()
  call "Get Trigger Model Blender Mode.gvi"()
  call "Get Trigger Model Blender Overrun Status.gvi"()
  call "Get Trigger Model Digital Input Mode.gvi"()
  call "Get Source Function.gvi"()
  call "Get Source Level.gvi"()
  call "Get Source Limit.gvi"()
  call "Get Source List Points.gvi"()
  call "Get Limit Test Upper Limit.gvi"()
  call "Get Measure Configuration List Catalog.gvi"()
  call "Get Measure Configuration List Settings.gvi"()
  call "Get Limit Test Lower Limit.gvi"()
  call "Get Trigger Model Digital Output Mode.gvi"()
  call "Get Trigger Model Digital Output Pulse Width.gvi"()
  call "Get Trigger Model Digital Overrun Status.gvi"()
  call "Get Trigger Model LAN Input Logic Mode.gvi"()
  call "Get Over Voltage Protection State.gvi"()
  call "Get Source Range.gvi"()
  call "Get Source User Delay.gvi"()
  call "Get Source Read Back State.gvi"()
  call "Get Measurement Auto Range Lower Limit.gvi"()
  call "Get Measurement Auto Range.gvi"()
  call "Get Measurement Count.gvi"()
  call "Get Measure Configuration List Size.gvi"()
  call "Get Trigger Model LAN IP Address.gvi"()
  call "Get Trigger Model LAN Mode.gvi"()
  call "Get Trigger Model LAN Output Logic Mode.gvi"()
  call "Get Trigger Model LAN Output Protocol.gvi"()
  call "Get Measurement Manual Range.gvi"()
  call "Get Measure User Delay.gvi"()
  call "Set Measurement Count.gvi"()
  call "Get Measurement Function.gvi"()
  # 2461 Specific VIs
  call "Configure Contact Check.gvi"()
  call "Get Conact Check State.gvi"()
  call "Configure Pulse Limit.gvi"()
  call "Set Pulse Amplitude.gvi"()
  call "Get Trigger Model LAN Overrun Status.gvi"()
  call "Get Trigger Model State.gvi"()
  call "Get Trigger Timer Count.gvi"()
  call "Get Trigger Timer Delay.gvi"()
  call "Configure Pulse Train.gvi"()
  call "Configure Pulse Sweep.gvi"()
  call "Configure Pulse List Sweep.gvi"()
  # 2461 Specific VIs
  call "Digitizer Sample Rate.gvi"()
  call "Digitizer Aperture.gvi"()
  call "Digitizer Voltage Units.gvi"()
  call "Digitizer Current Units.gvi"()
  call "Get Trigger Timer Overrun Status.gvi"()
  call "Get Trigger Timer State.gvi"()
  call "Set Trigger Timer Count.gvi"()
  call "Set Trigger Timer Delay.gvi"()
  call "Set Trigger Timer State.gvi"()
  call "Enable LAN Connect State.gvi"()
  call "Get LAN Connect State.gvi"()
  call "Calibrate Adjust Sense Data Query.gvi"()
  # Calibration
  call "Calibrate Adjust Sense.gvi"()
  call "Calibrate Adjust Source Data Query.gvi"()
  call "Calibrate Adjust Source.gvi"()
  call "Calibration Adjust Count Query.gvi"()
  call "Calibration Adjust Date Query.gvi"()
  call "Calibration Adjust Date.gvi"()
  call "Calibration Lock.gvi"()
  call "Calibration Unlock.gvi"()
  call "Calibration Password.gvi"()
  call "Calibration Save.gvi"()
  call "Calibration Verify Date.gvi"()
  call "Calibration Verify Date Query.gvi"()
