vi "Photodetector initialization Sequence with prompt.gvi"   [LabVIEW NXG 3.1.0]
inputs:
  "Error In": error
outputs:
  "Photodetector IVI session": "Ivi IviDefault"
  "Error Out": error
uses:
  Main::Miscelaneous::TLPM Find Resources.gvi
  NI::G Core::Error::Clear Error Cluster.gvi
  Main::Get Parameters::TLPM Get Resource Name.gvi
  Main::Miscelaneous::TLPM Initialize.gvi
diagram:
  case ($"Error In") {
    frame Error, Default {
      w1 = $"Error In"
    }
    frame No Error {
      while {
        Wait Until Next Multiple(multiple to wait=500)
        call "TLPM Find Resources.gvi"(IVI session in="", error in (no error)=$"Error In") -> (Resource Count=w2, error out=w3)
        Is Greater Or Equal(x=w2, y=1) -> w4
        case (w4) {
          frame False, Default {
            call "Clear Error Cluster.gvi"(error in=w3) -> (error out=w1)
            w7 = "The PM100 thorlabs photodetector\nhas not been detected, do you want\nto reconnect it and try again?"
            Two Button Dialog(F button name ("Cancel")="Yes please", T button name ("OK")="No thanks,\nI would like to\ncontinue without it", message=w7) -> (T Button?=w6)
            w5 = ""
          }
          frame True {
            # Select first Device
            # (Device Index 0)
            call "TLPM Get Resource Name.gvi"(Index (0)=0, error in (no error)=w3) -> (error out=w8, Resource Name=w9)
            # Initialize
            call "TLPM Initialize.gvi"(resource name=w9, ID Query (Do Query)=FALSE, Reset Device (Reset Device)=FALSE, error in (no error)=w8) -> (IVI session out=w5, error out=w1)
            w6 = TRUE
          }
        }
        $"Photodetector IVI session" <- w5
        stop if w6
      }
    }
  }
  $"Error Out" <- w1
