vi "TLPM VI Tree.gvi"   [LabVIEW NXG 3.1.0]
# The VI Tree displays all the user-callable VIs of the instrument driver in an organized table.
uses:
  Main::Miscelaneous::TLPM Initialize.gvi
  Main::Miscelaneous::TLPM Close.gvi
  Main::Miscelaneous::TLPM Find Resources.gvi
  Main::Get Parameters::TLPM Get Resource Name.gvi
  Main::Get Parameters::TLPM Get Resource Information.gvi
  Main::Miscelaneous::TLPM Write Register.gvi
  Main::Miscelaneous::TLPM Read Register.gvi
  Main::Miscelaneous::TLPM Preset Registers.gvi
  Main::Set Parameters::TLPM Set Date And Time.gvi
  Main::Get Parameters::TLPM Get Date And Time.gvi
  Main::Set Parameters::TLPM Set Line Frequency.gvi
  Main::Get Parameters::TLPM Get Line Frequency.gvi
  Main::Get Parameters::TLPM Get Battery Voltage.gvi
  Main::Set Parameters::TLPM Set Display Brightness.gvi
  Main::Get Parameters::TLPM Get Display Brightness.gvi
  Main::Set Parameters::TLPM Set Display Contrast.gvi
  Main::Get Parameters::TLPM Get Display Contrast.gvi
  Main::Set Parameters::TLPM Set Photodiode Input Filter State.gvi
  Main::Get Parameters::TLPM Get Photodiode Input Filter State.gvi
  Main::Set Parameters::TLPM Set Thermopile Accelerator State.gvi
  Main::Get Parameters::TLPM Get Thermopile Accelerator State.gvi
  Main::Set Parameters::TLPM Set Thermopile Accelerator Mode.gvi
  Main::Get Parameters::TLPM Get Thermopile Accelerator Mode.gvi
  Main::Set Parameters::TLPM Set Thermopile Accelerator Tau.gvi
  Main::Get Parameters::TLPM Get Thermopile Accelerator Tau.gvi
  Main::Set Parameters::TLPM Set Custom Sensor Input Adapter Type.gvi
  Main::Get Parameters::TLPM Get Custom Sensor Input Adapter Type.gvi
  Main::Set Parameters::TLPM Set Average Time.gvi
  Main::Get Parameters::TLPM Get Average Time.gvi
  Main::Set Parameters::TLPM Set Average Count.gvi
  Main::Get Parameters::TLPM Get Average Count.gvi
  Main::Set Parameters::TLPM Set Attenuation.gvi
  Main::Get Parameters::TLPM Get Attenuation.gvi
  Main::Miscelaneous::TLPM Start Dark Offset Adjustment.gvi
  Main::Miscelaneous::TLPM Cancel Dark Adjustment.gvi
  Main::Get Parameters::TLPM Get Dark Adjustment State.gvi
  Main::Get Parameters::TLPM Get Dark Offset.gvi
  Main::Set Parameters::TLPM Set Beam Diameter.gvi
  Main::Get Parameters::TLPM Get Beam Diameter.gvi
  Main::Set Parameters::TLPM Set Wavelength.gvi
  Main::Get Parameters::TLPM Get Wavelength.gvi
  Main::Set Parameters::TLPM Set Photodiode Responsivity.gvi
  Main::Get Parameters::TLPM Get Photodiode Responsivity.gvi
  Main::Set Parameters::TLPM Set Thermopile Responsivity.gvi
  Main::Get Parameters::TLPM Get Thermopile Responsivity.gvi
  Main::Set Parameters::TLPM Set Pyrosensor Responsivity.gvi
  Main::Get Parameters::TLPM Get Pyrosensor Responsivity.gvi
  Main::Set Parameters::TLPM Set Current Autorange Mode.gvi
  Main::Get Parameters::TLPM Get Current Autorange Mode.gvi
  Main::Set Parameters::TLPM Set Current Range.gvi
  Main::Get Parameters::TLPM Get Current Range.gvi
  Main::Set Parameters::TLPM Set Current Reference.gvi
  Main::Get Parameters::TLPM Get Current Reference.gvi
  Main::Set Parameters::TLPM Set Current Reference State.gvi
  Main::Get Parameters::TLPM Get Current Reference State.gvi
  Main::Set Parameters::TLPM Set Energy Range.gvi
  Main::Get Parameters::TLPM Get Energy Range.gvi
  Main::Set Parameters::TLPM Set Energy Reference.gvi
  Main::Get Parameters::TLPM Get Energy Reference.gvi
  Main::Set Parameters::TLPM Set Energy Reference State.gvi
  Main::Get Parameters::TLPM Get Energy Reference State.gvi
  Main::Get Parameters::TLPM Get Frequency Range.gvi
  Main::Set Parameters::TLPM Set Power Autorange Mode.gvi
  Main::Get Parameters::TLPM Get Power Autorange Mode.gvi
  Main::Set Parameters::TLPM Set Power Range.gvi
  Main::Get Parameters::TLPM Get Power Range.gvi
  Main::Set Parameters::TLPM Set Power Reference.gvi
  Main::Get Parameters::TLPM Get Power Reference.gvi
  Main::Set Parameters::TLPM Set Power Reference State.gvi
  Main::Get Parameters::TLPM Get Power Reference State.gvi
  Main::Set Parameters::TLPM Set Power Unit.gvi
  Main::Get Parameters::TLPM Get Power Unit.gvi
  Main::Set Parameters::TLPM Set Voltage Autorange Mode.gvi
  Main::Get Parameters::TLPM Get Voltage Autorange Mode.gvi
  Main::Set Parameters::TLPM Set Voltage Range.gvi
  Main::Get Parameters::TLPM Get Voltage Range.gvi
  Main::Set Parameters::TLPM Set Voltage Reference.gvi
  Main::Get Parameters::TLPM Get Voltage Reference.gvi
  Main::Set Parameters::TLPM Set Voltage Reference State.gvi
  Main::Get Parameters::TLPM Get Voltage Reference State.gvi
  Main::Set Parameters::TLPM Set Peak Detector Threshold.gvi
  Main::Get Parameters::TLPM Get Peak Detector Threshold.gvi
  Main::Set Parameters::TLPM Set External NTC Parameter.gvi
  Main::Get Parameters::TLPM Get External NTC Parameter.gvi
  Main::Measure::TLPM Measure Current.gvi
  Main::Measure::TLPM Measure Voltage.gvi
  Main::Measure::TLPM Measure Power.gvi
  Main::Measure::TLPM Measure Energy.gvi
  Main::Measure::TLPM Measure Power Density.gvi
  Main::Measure::TLPM Measure Energy Density.gvi
  Main::Measure::TLPM Measure Frequency.gvi
  Main::Measure::TLPM Measure Auxiliary AD0 Voltage.gvi
  Main::Measure::TLPM Measure Auxiliary AD1 Voltage.gvi
  Main::Measure::TLPM Measure Environmental Humidity.gvi
  Main::Measure::TLPM Measure Environmental Temperature.gvi
  Main::Measure::TLPM Measure External NTC Temperature.gvi
  Main::Measure::TLPM Measure External NTC Resistance.gvi
  Main::Set Parameters::TLPM Set Digital I  O Direction.gvi
  Main::Get Parameters::TLPM Get Digital I  O Direction.gvi
  Main::Set Parameters::TLPM Set Digital I  O Output.gvi
  Main::Get Parameters::TLPM Get Digital I  O Output.gvi
  Main::Get Parameters::TLPM Get Digital I  O Port.gvi
  Main::Miscelaneous::TLPM Error Message.gvi
  Main::Miscelaneous::TLPM Error-Query.gvi
  Main::Miscelaneous::TLPM Reset.gvi
  Main::Miscelaneous::TLPM Self-Test.gvi
  Main::Miscelaneous::TLPM Revision Query.gvi
  Main::Miscelaneous::TLPM Identification Query.gvi
  Main::Miscelaneous::TLPM Calibration Message.gvi
  Main::Miscelaneous::TLPM Sensor Information.gvi
  Main::Miscelaneous::TLPM Error Query Mode.gvi
  Main::Miscelaneous::TLPM Raw Write To Instrument.gvi
  Main::Miscelaneous::TLPM Raw Read From Instrument.gvi
  Main::Set Parameters::TLPM Set Communication Timeout.gvi
  Main::Get Parameters::TLPM Get Communication Timeout.gvi
  Main::Examples::TLPM_PowerMeter_Sample.gvi
diagram:
  # Initialize & Close
  call "TLPM Initialize.gvi"()
  call "TLPM Close.gvi"()
  # Resource Functions
  call "TLPM Find Resources.gvi"()
  call "TLPM Get Resource Name.gvi"()
  call "TLPM Get Resource Information.gvi"()
  # Status Register
  # System
  call "TLPM Write Register.gvi"()
  call "TLPM Read Register.gvi"()
  call "TLPM Preset Registers.gvi"()
  # Date Time
  call "TLPM Set Date And Time.gvi"()
  call "TLPM Get Date And Time.gvi"()
  # Line Frequency
  call "TLPM Set Line Frequency.gvi"()
  call "TLPM Get Line Frequency.gvi"()
  # Battery
  call "TLPM Get Battery Voltage.gvi"()
  # Display
  # Measure
  # Configure
  call "TLPM Set Display Brightness.gvi"()
  call "TLPM Get Display Brightness.gvi"()
  call "TLPM Set Display Contrast.gvi"()
  call "TLPM Get Display Contrast.gvi"()
  # Input
  call "TLPM Set Photodiode Input Filter State.gvi"()
  call "TLPM Get Photodiode Input Filter State.gvi"()
  call "TLPM Set Thermopile Accelerator State.gvi"()
  call "TLPM Get Thermopile Accelerator State.gvi"()
  call "TLPM Set Thermopile Accelerator Mode.gvi"()
  call "TLPM Get Thermopile Accelerator Mode.gvi"()
  call "TLPM Set Thermopile Accelerator Tau.gvi"()
  call "TLPM Get Thermopile Accelerator Tau.gvi"()
  call "TLPM Set Custom Sensor Input Adapter Type.gvi"()
  call "TLPM Get Custom Sensor Input Adapter Type.gvi"()
  # Average
  call "TLPM Set Average Time.gvi"()
  call "TLPM Get Average Time.gvi"()
  call "TLPM Set Average Count.gvi"()
  call "TLPM Get Average Count.gvi"()
  # Correction
  call "TLPM Set Attenuation.gvi"()
  call "TLPM Get Attenuation.gvi"()
  call "TLPM Start Dark Offset Adjustment.gvi"()
  call "TLPM Cancel Dark Adjustment.gvi"()
  call "TLPM Get Dark Adjustment State.gvi"()
  call "TLPM Get Dark Offset.gvi"()
  call "TLPM Set Beam Diameter.gvi"()
  call "TLPM Get Beam Diameter.gvi"()
  call "TLPM Set Wavelength.gvi"()
  call "TLPM Get Wavelength.gvi"()
  call "TLPM Set Photodiode Responsivity.gvi"()
  call "TLPM Get Photodiode Responsivity.gvi"()
  call "TLPM Set Thermopile Responsivity.gvi"()
  call "TLPM Get Thermopile Responsivity.gvi"()
  call "TLPM Set Pyrosensor Responsivity.gvi"()
  call "TLPM Get Pyrosensor Responsivity.gvi"()
  # Current Measurement
  call "TLPM Set Current Autorange Mode.gvi"()
  call "TLPM Get Current Autorange Mode.gvi"()
  call "TLPM Set Current Range.gvi"()
  call "TLPM Get Current Range.gvi"()
  call "TLPM Set Current Reference.gvi"()
  call "TLPM Get Current Reference.gvi"()
  call "TLPM Set Current Reference State.gvi"()
  call "TLPM Get Current Reference State.gvi"()
  # Energy Measurement
  call "TLPM Set Energy Range.gvi"()
  call "TLPM Get Energy Range.gvi"()
  call "TLPM Set Energy Reference.gvi"()
  call "TLPM Get Energy Reference.gvi"()
  call "TLPM Set Energy Reference State.gvi"()
  call "TLPM Get Energy Reference State.gvi"()
  # Frequency Measurement
  call "TLPM Get Frequency Range.gvi"()
  # Power Measurement
  call "TLPM Set Power Autorange Mode.gvi"()
  call "TLPM Get Power Autorange Mode.gvi"()
  call "TLPM Set Power Range.gvi"()
  call "TLPM Get Power Range.gvi"()
  call "TLPM Set Power Reference.gvi"()
  call "TLPM Get Power Reference.gvi"()
  call "TLPM Set Power Reference State.gvi"()
  call "TLPM Get Power Reference State.gvi"()
  call "TLPM Set Power Unit.gvi"()
  call "TLPM Get Power Unit.gvi"()
  # Voltage Measurement
  call "TLPM Set Voltage Autorange Mode.gvi"()
  call "TLPM Get Voltage Autorange Mode.gvi"()
  call "TLPM Set Voltage Range.gvi"()
  call "TLPM Get Voltage Range.gvi"()
  call "TLPM Set Voltage Reference.gvi"()
  call "TLPM Get Voltage Reference.gvi"()
  call "TLPM Set Voltage Reference State.gvi"()
  call "TLPM Get Voltage Reference State.gvi"()
  # Peak Detector
  call "TLPM Set Peak Detector Threshold.gvi"()
  call "TLPM Get Peak Detector Threshold.gvi"()
  call "TLPM Set External NTC Parameter.gvi"()
  call "TLPM Get External NTC Parameter.gvi"()
  # External Temperature Sensor
  # Read
  call "TLPM Measure Current.gvi"()
  call "TLPM Measure Voltage.gvi"()
  call "TLPM Measure Power.gvi"()
  call "TLPM Measure Energy.gvi"()
  call "TLPM Measure Power Density.gvi"()
  call "TLPM Measure Energy Density.gvi"()
  call "TLPM Measure Frequency.gvi"()
  call "TLPM Measure Auxiliary AD0 Voltage.gvi"()
  call "TLPM Measure Auxiliary AD1 Voltage.gvi"()
  call "TLPM Measure Environmental Humidity.gvi"()
  call "TLPM Measure Environmental Temperature.gvi"()
  call "TLPM Measure External NTC Temperature.gvi"()
  call "TLPM Measure External NTC Resistance.gvi"()
  # Digital I/O
  call "TLPM Set Digital I  O Direction.gvi"()
  call "TLPM Get Digital I  O Direction.gvi"()
  call "TLPM Set Digital I  O Output.gvi"()
  call "TLPM Get Digital I  O Output.gvi"()
  call "TLPM Get Digital I  O Port.gvi"()
  # Utility Functions
  # Raw I/O
  call "TLPM Error Message.gvi"()
  call "TLPM Error-Query.gvi"()
  call "TLPM Reset.gvi"()
  call "TLPM Self-Test.gvi"()
  call "TLPM Revision Query.gvi"()
  call "TLPM Identification Query.gvi"()
  call "TLPM Calibration Message.gvi"()
  call "TLPM Sensor Information.gvi"()
  call "TLPM Error Query Mode.gvi"()
  call "TLPM Raw Write To Instrument.gvi"()
  call "TLPM Raw Read From Instrument.gvi"()
  # Timeout
  call "TLPM Set Communication Timeout.gvi"()
  call "TLPM Get Communication Timeout.gvi"()
  # Example
  call "TLPM_PowerMeter_Sample.gvi"()
