vi "TLPM_PowerMeter_Sample.gvi"   [LabVIEW NXG 3.1.0]
panel controls:
  "Stop measurement": bool
  "Parameter to measure": enum{"Photocurrent", "Power"} = "Photocurrent"
  "Stop App": bool
panel indicators:
  "Power Value": f64  # This parameter returns the last measured temperature value in °C.
  "Active": bool
  "Current": f64
uses:
  Main::Miscelaneous::TLPM Find Resources.gvi
  Main::Get Parameters::TLPM Get Resource Name.gvi
  Main::Miscelaneous::TLPM Initialize.gvi
  Main::Measure::TLPM Measure Power.gvi
  Main::Measure::TLPM Measure Current.gvi
  Main::Miscelaneous::TLPM Close.gvi
diagram:
  # TLPM LabVIEW Example
  while {
    Wait Until Next Multiple(multiple to wait=50)
    # Check for TLPM Devices
    # Returns Number of
    # found Devices
    $Active <- FALSE
    call "TLPM Find Resources.gvi"(IVI session in="") -> (Resource Count=w1, error out=w2)
    Is Greater Or Equal(x=w1, y=1) -> w3
    case (w3) {
      frame False, Default { }
      frame True {
        # Initialize
        # Select first Device
        # (Device Index 0)
        call "TLPM Get Resource Name.gvi"(Index (0)=0, error in (no error)=w2) -> (error out=w4, Resource Name=w5)
        call "TLPM Initialize.gvi"(resource name=w5, ID Query (Do Query)=FALSE, Reset Device (Reset Device)=FALSE, error in (no error)=w4) -> (IVI session out=w6, error out=w7)
        # Close
        case ($"Parameter to measure") {
          frame "Power", Default {
            s1 = w6  # shift register
            s2 = w7  # shift register
            while {
              Wait(time to wait=10)
              call "TLPM Measure Power.gvi"(IVI session in=s1, error in (no error)=s2) -> (IVI session out=w11, Power=w12, error out=w13)
              $"Power Value" <- w12
              # Get Power
              $Active <- TRUE
              next s1 = w11
              next s2 = w13
              stop if $"Stop measurement"
            }
            w8 = s1
            w9 = s2
            w10 = FALSE
          }
          frame "Photocurrent" {
            s3 = w6  # shift register
            s4 = w7  # shift register
            while {
              Wait Until Next Multiple(multiple to wait=10)
              # Get Current
              call "TLPM Measure Current.gvi"(IVI session in=s3, error in (no error)=s4) -> (IVI session out=w14, Current=w15, error out=w16)
              $Current <- w15
              $Active <- TRUE
              next s3 = w14
              next s4 = w16
              stop if $"Stop measurement"
            }
            w8 = s3
            w9 = s4
            w10 = FALSE
          }
        }
        $Active <- w10
        call "TLPM Close.gvi"(IVI session in=w8, error in (no error)=w9)
      }
    }
    stop if $"Stop App"
  }
