vi "TLPM Get Average Count.gvi"   [LabVIEW NXG 3.1.0]
# This VI returns the average count for measurement value generation.
# Notes:
# (1) The VI is only available on PM100A, PM100D, PM100USB, PM200, PM400.
# (2) The VI is deprecated and kept for legacy reasons. Its recommended to use TLPM Get Average Time.vi() instead.
inputs:
  "IVI session in": "Ivi IviDefault"
  "error in (no error)": error
outputs:
  "IVI session out": "Ivi IviDefault"
  "Average Count": i16  # This parameter returns the actual Average Count. Remark: Depending on the powermeter model internal there are taken up to 3000 measurements per second. In this example Average Time = Average Count / 3000 [s]. To get an measurement value from the device the timeout in your application has to be longer than the calculated average time.
  "error out": error
uses:
  Main::Miscelaneous::TLPM_64.sli::TLPM_getAvgCnt
  NI::G Core::File IO (General)::Legacy::Parse Component Path.gvi
  Main::Miscelaneous::TLPM VXIpnp Error Converter.gvi
diagram:
  $"IVI session out" <- $"IVI session in"
  case ($"error in (no error)") {
    frame No Error {
      Ivi Refnum To Session Node(IviSession=$"IVI session in", error in=$"error in (no error)") -> (IviSessionHandle=w3, error out=w4)
      call "TLPM_getAvgCnt"(Instrument Handle in=w3, Average Count in=0, error in=w4) -> (return=w5, Instrument Handle out=w6, Average Count out=w2, error out=w7)
      Get Component Directory() -> (Path=w8)
      call "Parse Component Path.gvi"(component directory=w8) -> (calling VI path=w9)
      Strip Path(path=w9) -> (name=w10)
      call "TLPM VXIpnp Error Converter.gvi"(instrument handle=w6, CVI Error Code (0)=w5, Name Of VI ("")=w10, error in (no error)=w7) -> (error out=w1)
    }
    frame Error {
      w1 = $"error in (no error)"
      w2 = default
    }
  }
  $"Average Count" <- w2
  $"error out" <- w1
