vi "TLPM Get Battery Voltage.gvi"   [LabVIEW NXG 3.1.0]
# This VI is used to obtain the battery voltage readings from the instrument.
# Remark:
# (1) This VI is only supported with the PM160 and PM160T.
# (2) This VI obtains the latest battery voltage measurement result.
# (3) With the USB cable connected this VI will obtain the loading voltage. Only with USB cable disconnected (Bluetooth connection) the actual battery voltage can be read.
inputs:
  "IVI session in": "Ivi IviDefault"
  "error in (no error)": error
outputs:
  "IVI session out": "Ivi IviDefault"
  "Voltage": f64  # This parameter returns the battery voltage in volts [V].
  "error out": error
uses:
  Main::Miscelaneous::TLPM_64.sli::TLPM_getBatteryVoltage
  NI::G Core::File IO (General)::Legacy::Parse Component Path.gvi
  Main::Miscelaneous::TLPM VXIpnp Error Converter.gvi
diagram:
  $"IVI session out" <- $"IVI session in"
  case ($"error in (no error)") {
    frame No Error {
      Ivi Refnum To Session Node(IviSession=$"IVI session in", error in=$"error in (no error)") -> (IviSessionHandle=w3, error out=w4)
      call "TLPM_getBatteryVoltage"(Instrument Handle in=w3, Voltage in=0, error in=w4) -> (return=w5, Instrument Handle out=w6, Voltage out=w2, error out=w7)
      Get Component Directory() -> (Path=w8)
      call "Parse Component Path.gvi"(component directory=w8) -> (calling VI path=w9)
      Strip Path(path=w9) -> (name=w10)
      call "TLPM VXIpnp Error Converter.gvi"(instrument handle=w6, CVI Error Code (0)=w5, Name Of VI ("")=w10, error in (no error)=w7) -> (error out=w1)
    }
    frame Error {
      w1 = $"error in (no error)"
      w2 = default
    }
  }
  $Voltage <- w2
  $"error out" <- w1
