vi "TLPM Get Current Autorange Mode.gvi"   [LabVIEW NXG 3.1.0]
# This VI returns the current auto range mode.
# Notes:
# (1) The VI is only available on PM100A, PM100D, PM100USB, PM160, PM200, PM400.
inputs:
  "IVI session in": "Ivi IviDefault"
  "error in (no error)": error
outputs:
  "IVI session out": "Ivi IviDefault"
  "Current Autorange Mode": bool  # This parameter returns the current auto range mode. Return values: TLPM_AUTORANGE_CURRENT_OFF (0): current auto range disabled TLPM_AUTORANGE_CURRENT_ON (1): current auto range enabled
  "error out": error
uses:
  Main::Miscelaneous::TLPM_64.sli::TLPM_getCurrentAutorange
  NI::G Core::File IO (General)::Legacy::Parse Component Path.gvi
  Main::Miscelaneous::TLPM VXIpnp Error Converter.gvi
diagram:
  $"IVI session out" <- $"IVI session in"
  case ($"error in (no error)") {
    frame No Error {
      Ivi Refnum To Session Node(IviSession=$"IVI session in", error in=$"error in (no error)") -> (IviSessionHandle=w3, error out=w4)
      call "TLPM_getCurrentAutorange"(Instrument Handle in=w3, Current Autorange Mode in=0, error in=w4) -> (return=w5, Instrument Handle out=w6, Current Autorange Mode out=w2, error out=w7)
      Get Component Directory() -> (Path=w8)
      call "Parse Component Path.gvi"(component directory=w8) -> (calling VI path=w9)
      Strip Path(path=w9) -> (name=w10)
      call "TLPM VXIpnp Error Converter.gvi"(instrument handle=w6, CVI Error Code (0)=w5, Name Of VI ("")=w10, error in (no error)=w7) -> (error out=w1)
    }
    frame Error {
      w1 = $"error in (no error)"
      w2 = default
    }
  }
  Is Not Equal To 0(x=w2) -> w11
  $"Current Autorange Mode" <- w11
  $"error out" <- w1
