vi "TLPM Get Custom Sensor Input Adapter Type.gvi"   [LabVIEW NXG 3.1.0]
# This VI returns the assumed sensor type for custom sensors without calibration data memory connected to the instrument.
# Notes:
# (1) The VI is only available on PM100D, PM100A, PM100USB, PM200, PM400.
inputs:
  "IVI session in": "Ivi IviDefault"
  "error in (no error)": error
outputs:
  "IVI session out": "Ivi IviDefault"
  "Custom Sensor Type": i16  # This parameter returns the custom sensor type. Remark: The meanings of the obtained sensor type are: Sensor Types: SENSOR_TYPE_PD_SINGLE (1): Photodiode sensor SENSOR_TYPE_THERMO (2): Thermopile sensor SENSOR_TYPE_PYRO (3): Pyroelectric sensor
  "error out": error
uses:
  Main::Miscelaneous::TLPM_64.sli::TLPM_getInputAdapterType
  NI::G Core::File IO (General)::Legacy::Parse Component Path.gvi
  Main::Miscelaneous::TLPM VXIpnp Error Converter.gvi
diagram:
  case ($"error in (no error)") {
    frame No Error {
      Ivi Refnum To Session Node(IviSession=$"IVI session in", error in=$"error in (no error)") -> (IviSessionHandle=w3, error out=w4)
      call "TLPM_getInputAdapterType"(Instrument Handle in=w3, Custom Sensor Type in=0, error in=w4) -> (return=w5, Instrument Handle out=w6, Custom Sensor Type out=w2, error out=w7)
      Get Component Directory() -> (Path=w8)
      call "Parse Component Path.gvi"(component directory=w8) -> (calling VI path=w9)
      Strip Path(path=w9) -> (name=w10)
      call "TLPM VXIpnp Error Converter.gvi"(instrument handle=w6, CVI Error Code (0)=w5, Name Of VI ("")=w10, error in (no error)=w7) -> (error out=w1)
    }
    frame Error {
      w1 = $"error in (no error)"
      w2 = default
    }
  }
  $"error out" <- w1
  $"Custom Sensor Type" <- w2
  $"IVI session out" <- $"IVI session in"
