vi "TLPM Get Dark Adjustment State.gvi"   [LabVIEW NXG 3.1.0]
# This VI returns the state of a dark current/zero offset adjustment procedure previously initiated by <Start Dark Adjust>.
inputs:
  "IVI session in": "Ivi IviDefault"
  "error in (no error)": error
outputs:
  "IVI session out": "Ivi IviDefault"
  "State": i16  # This parameter returns the dark adjustment state. Possible return values are: TLPM_STAT_DARK_ADJUST_FINISHED (0) : no dark adjustment running TLPM_STAT_DARK_ADJUST_RUNNING (1) : dark adjustment is running
  "error out": error
uses:
  Main::Miscelaneous::TLPM_64.sli::TLPM_getDarkAdjustState
  NI::G Core::File IO (General)::Legacy::Parse Component Path.gvi
  Main::Miscelaneous::TLPM VXIpnp Error Converter.gvi
diagram:
  $"IVI session out" <- $"IVI session in"
  case ($"error in (no error)") {
    frame No Error {
      Ivi Refnum To Session Node(IviSession=$"IVI session in", error in=$"error in (no error)") -> (IviSessionHandle=w3, error out=w4)
      call "TLPM_getDarkAdjustState"(Instrument Handle in=w3, State in=0, error in=w4) -> (return=w5, Instrument Handle out=w6, State out=w2, error out=w7)
      Get Component Directory() -> (Path=w8)
      call "Parse Component Path.gvi"(component directory=w8) -> (calling VI path=w9)
      Strip Path(path=w9) -> (name=w10)
      call "TLPM VXIpnp Error Converter.gvi"(instrument handle=w6, CVI Error Code (0)=w5, Name Of VI ("")=w10, error in (no error)=w7) -> (error out=w1)
    }
    frame Error {
      w1 = $"error in (no error)"
      w2 = default
    }
  }
  $State <- w2
  $"error out" <- w1
