vi "TLPM Get Date And Time.gvi"   [LabVIEW NXG 3.1.0]
# This VI returns the system date and time of the powermeter.
# Notes:
# (1) Date and time are displayed on instruments screen and are used as timestamp for data saved to memory card.
# (2) The VI is only available on PM100D, PM200, PM400.
inputs:
  "IVI session in": "Ivi IviDefault"
  "error in (no error)": error
outputs:
  "IVI session out": "Ivi IviDefault"
  "Minute": i16  # This parameter specifies the actual minute in the format mm.
  "Day": i16  # This parameter specifies the actual day in the format dd.
  "Year": i16  # This parameter specifies the actual year in the format yyyy.
  "Month": i16  # This parameter specifies the actual month in the format mm.
  "error out": error
  "Second": i16  # This parameter specifies the actual second in the format ss.
  "Hour": i16  # This parameter specifies the actual hour in the format hh.
uses:
  Main::Miscelaneous::TLPM_64.sli::TLPM_getTime
  NI::G Core::File IO (General)::Legacy::Parse Component Path.gvi
  Main::Miscelaneous::TLPM VXIpnp Error Converter.gvi
diagram:
  $"IVI session out" <- $"IVI session in"
  case ($"error in (no error)") {
    frame No Error {
      Ivi Refnum To Session Node(IviSession=$"IVI session in", error in=$"error in (no error)") -> (IviSessionHandle=w8, error out=w9)
      call "TLPM_getTime"(Instrument Handle in=w8, Year in=0, Month in=0, Day in=0, Hour in=0, Minute in=0, Second in=0, error in=w9) -> (return=w10, Instrument Handle out=w11, Year out=w2, Month out=w3, Day out=w4, Hour out=w5, Minute out=w6, Second out=w7, error out=w12)
      Get Component Directory() -> (Path=w13)
      call "Parse Component Path.gvi"(component directory=w13) -> (calling VI path=w14)
      Strip Path(path=w14) -> (name=w15)
      call "TLPM VXIpnp Error Converter.gvi"(instrument handle=w11, CVI Error Code (0)=w10, Name Of VI ("")=w15, error in (no error)=w12) -> (error out=w1)
    }
    frame Error {
      w1 = $"error in (no error)"
      w2 = default
      w3 = default
      w4 = default
      w5 = default
      w6 = default
      w7 = default
    }
  }
  $"error out" <- w1
  $Year <- w2
  $Month <- w3
  $Day <- w4
  $Hour <- w5
  $Minute <- w6
  $Second <- w7
