vi "TLPM Get Digital I  O Output.gvi"   [LabVIEW NXG 3.1.0]
# This VI returns the digital I/O output settings.
# Note: The VI is only available on PM200 and PM400.
inputs:
  "IVI session in": "Ivi IviDefault"
  "error in (no error)": error
outputs:
  "IVI session out": "Ivi IviDefault"
  "IO 2": bool  # This parameter returns the I/O port #2 output where VI_OFF (0) indicates low level and VI_ON (1) indicates high level. Note: You may pass VI_NULL (0) if you don't need this value.
  "IO 0": bool  # This parameter returns the I/O port #0 output where VI_OFF (0) indicates low level and VI_ON (1) indicates high level. Note: You may pass VI_NULL (0) if you don't need this value.
  "IO 1": bool  # This parameter returns the I/O port #1 output where VI_OFF (0) indicates low level and VI_ON (1) indicates high level. Note: You may pass VI_NULL (0) if you don't need this value.
  "error out": error
  "IO 3": bool  # This parameter returns the I/O port #3 output where VI_OFF (0) indicates low level and VI_ON (1) indicates high level. Note: You may pass VI_NULL (0) if you don't need this value.
uses:
  Main::Miscelaneous::TLPM_64.sli::TLPM_getDigIoOutput
  NI::G Core::File IO (General)::Legacy::Parse Component Path.gvi
  Main::Miscelaneous::TLPM VXIpnp Error Converter.gvi
diagram:
  $"IVI session out" <- $"IVI session in"
  case ($"error in (no error)") {
    frame No Error {
      Ivi Refnum To Session Node(IviSession=$"IVI session in", error in=$"error in (no error)") -> (IviSessionHandle=w6, error out=w7)
      call "TLPM_getDigIoOutput"(Instrument Handle in=w6, IO 0 in=0, IO 1 in=0, IO 2 in=0, IO 3 in=0, error in=w7) -> (return=w8, Instrument Handle out=w9, IO 0 out=w2, IO 1 out=w3, IO 2 out=w4, IO 3 out=w5, error out=w10)
      Get Component Directory() -> (Path=w11)
      call "Parse Component Path.gvi"(component directory=w11) -> (calling VI path=w12)
      Strip Path(path=w12) -> (name=w13)
      call "TLPM VXIpnp Error Converter.gvi"(instrument handle=w9, CVI Error Code (0)=w8, Name Of VI ("")=w13, error in (no error)=w10) -> (error out=w1)
    }
    frame Error {
      w1 = $"error in (no error)"
      w2 = default
      w3 = default
      w4 = default
      w5 = default
    }
  }
  $"error out" <- w1
  Is Not Equal To 0(x=w2) -> w14
  $"IO 0" <- w14
  Is Not Equal To 0(x=w3) -> w15
  $"IO 1" <- w15
  Is Not Equal To 0(x=w4) -> w16
  $"IO 2" <- w16
  Is Not Equal To 0(x=w5) -> w17
  $"IO 3" <- w17
