vi "TLPM Get Energy Reference State.gvi"   [LabVIEW NXG 3.1.0]
# This VI returns the instrument's energy reference state.
# Notes:
# (1) The VI is only available on PM100D, PM100USB, PM200, PM400.
inputs:
  "IVI session in": "Ivi IviDefault"
  "error in (no error)": error
outputs:
  "IVI session out": "Ivi IviDefault"
  "Energy Reference State": bool  # This parameter returns the energy reference state. Return values: TLPM_ENERGY_REF_OFF (0): Energy reference disabled. Absolute measurement. TLPM_ENERGY_REF_ON (1): Energy reference enabled. Relative measurement.
  "error out": error
uses:
  Main::Miscelaneous::TLPM_64.sli::TLPM_getEnergyRefState
  NI::G Core::File IO (General)::Legacy::Parse Component Path.gvi
  Main::Miscelaneous::TLPM VXIpnp Error Converter.gvi
diagram:
  $"IVI session out" <- $"IVI session in"
  case ($"error in (no error)") {
    frame No Error {
      Ivi Refnum To Session Node(IviSession=$"IVI session in", error in=$"error in (no error)") -> (IviSessionHandle=w3, error out=w4)
      call "TLPM_getEnergyRefState"(Instrument Handle in=w3, Energy Reference State in=0, error in=w4) -> (return=w5, Instrument Handle out=w6, Energy Reference State out=w2, error out=w7)
      Get Component Directory() -> (Path=w8)
      call "Parse Component Path.gvi"(component directory=w8) -> (calling VI path=w9)
      Strip Path(path=w9) -> (name=w10)
      call "TLPM VXIpnp Error Converter.gvi"(instrument handle=w6, CVI Error Code (0)=w5, Name Of VI ("")=w10, error in (no error)=w7) -> (error out=w1)
    }
    frame Error {
      w1 = $"error in (no error)"
      w2 = default
    }
  }
  Is Not Equal To 0(x=w2) -> w11
  $"Energy Reference State" <- w11
  $"error out" <- w1
