vi "TLPM Get Energy Reference.gvi"   [LabVIEW NXG 3.1.0]
# This VI returns the specified pyro sensor's energy reference value.
# Notes:
# (1) The VI is only available on PM100D, PM100USB, PM200, PM400.
# (2) The set value is used for calculating differences between the actual energy value and this energy reference value.
inputs:
  "IVI session in": "Ivi IviDefault"
  "Attribute (Set value)": i16 = "Set value"(0)  # This parameter specifies the value to be queried. Acceptable values: TLPM_ATTR_SET_VAL (0): Set value TLPM_ATTR_MIN_VAL (1): Minimum value TLPM_ATTR_MAX_VAL (2): Maximum value TLPM_ATTR_DFLT_VAL (3): Default value
  "error in (no error)": error
outputs:
  "IVI session out": "Ivi IviDefault"
  "Energy Reference Value": f64  # This parameter returns the specified pyro sensor's energy reference value in joule [J]. Remark: The set value is used for calculating differences between the actual energy value and this energy reference value if Energy Reference State is ON.
  "error out": error
uses:
  Main::Miscelaneous::TLPM_64.sli::TLPM_getEnergyRef
  NI::G Core::File IO (General)::Legacy::Parse Component Path.gvi
  Main::Miscelaneous::TLPM VXIpnp Error Converter.gvi
diagram:
  $"IVI session out" <- $"IVI session in"
  case ($"error in (no error)") {
    frame No Error {
      Ivi Refnum To Session Node(IviSession=$"IVI session in", error in=$"error in (no error)") -> (IviSessionHandle=w3, error out=w4)
      call "TLPM_getEnergyRef"(Instrument Handle in=w3, Attribute in=$"Attribute (Set value)", Energy Reference Value in=0, error in=w4) -> (return=w5, Instrument Handle out=w6, Energy Reference Value out=w2, error out=w7)
      Get Component Directory() -> (Path=w8)
      call "Parse Component Path.gvi"(component directory=w8) -> (calling VI path=w9)
      Strip Path(path=w9) -> (name=w10)
      call "TLPM VXIpnp Error Converter.gvi"(instrument handle=w6, CVI Error Code (0)=w5, Name Of VI ("")=w10, error in (no error)=w7) -> (error out=w1)
    }
    frame Error {
      w1 = $"error in (no error)"
      w2 = default
    }
  }
  $"error out" <- w1
  $"Energy Reference Value" <- w2
