vi "TLPM Get External NTC Parameter.gvi"   [LabVIEW NXG 3.1.0]
# This VI gets the temperature calculation coefficients for the NTC sensor externally connected to the instrument (NTC IN).
# Notes:
# (1) The VI is only available on PM400.
inputs:
  "IVI session in": "Ivi IviDefault"
  "Attribute (Set value)": i16 = "Set value"(0)  # This parameter specifies the values to be queried. Acceptable values: TLPM_ATTR_SET_VAL (0): Set value TLPM_ATTR_MIN_VAL (1): Minimum value TLPM_ATTR_MAX_VAL (2): Maximum value TLPM_ATTR_DFLT_VAL (3): Default value
  "error in (no error)": error
outputs:
  "IVI session out": "Ivi IviDefault"
  "R0 Coefficient": f64  # This parameter returns the specified R0 coefficient in [Ohm].
  "Beta Coefficient": f64  # This parameter returns the specified B coefficient in [K].
  "error out": error
uses:
  Main::Miscelaneous::TLPM_64.sli::TLPM_getExtNtcParameter
  NI::G Core::File IO (General)::Legacy::Parse Component Path.gvi
  Main::Miscelaneous::TLPM VXIpnp Error Converter.gvi
diagram:
  $"IVI session out" <- $"IVI session in"
  case ($"error in (no error)") {
    frame No Error {
      Ivi Refnum To Session Node(IviSession=$"IVI session in", error in=$"error in (no error)") -> (IviSessionHandle=w4, error out=w5)
      call "TLPM_getExtNtcParameter"(Instrument Handle in=w4, Attribute in=$"Attribute (Set value)", R0 Coefficient in=0, Beta Coefficient in=0, error in=w5) -> (return=w6, Instrument Handle out=w7, R0 Coefficient out=w2, Beta Coefficient out=w3, error out=w8)
      Get Component Directory() -> (Path=w9)
      call "Parse Component Path.gvi"(component directory=w9) -> (calling VI path=w10)
      Strip Path(path=w10) -> (name=w11)
      call "TLPM VXIpnp Error Converter.gvi"(instrument handle=w7, CVI Error Code (0)=w6, Name Of VI ("")=w11, error in (no error)=w8) -> (error out=w1)
    }
    frame Error {
      w1 = $"error in (no error)"
      w2 = default
      w3 = default
    }
  }
  $"error out" <- w1
  $"R0 Coefficient" <- w2
  $"Beta Coefficient" <- w3
