vi "TLPM Get Frequency Range.gvi"   [LabVIEW NXG 3.1.0]
# This VI returns the instruments frequency measurement range.
# Remark:
# The frequency of the input signal is calculated over at least 0.3s. So it takes at least 0.3s to get a new frequency value from the instrument.
# Notes:
# (1) The VI is only available on PM100D, PM100A, and PM100USB.
inputs:
  "IVI session in": "Ivi IviDefault"
  "error in (no error)": error
outputs:
  "IVI session out": "Ivi IviDefault"
  "Lower Frequency": f64  # This parameter returns the lower instruments frequency in [Hz].
  "Upper Frequency": f64  # This parameter returns the upper instruments frequency in [Hz].
  "error out": error
uses:
  Main::Miscelaneous::TLPM_64.sli::TLPM_getFreqRange
  NI::G Core::File IO (General)::Legacy::Parse Component Path.gvi
  Main::Miscelaneous::TLPM VXIpnp Error Converter.gvi
diagram:
  $"IVI session out" <- $"IVI session in"
  case ($"error in (no error)") {
    frame No Error {
      Ivi Refnum To Session Node(IviSession=$"IVI session in", error in=$"error in (no error)") -> (IviSessionHandle=w4, error out=w5)
      call "TLPM_getFreqRange"(Instrument Handle in=w4, Lower Frequency in=0, Upper Frequency in=0, error in=w5) -> (return=w6, Instrument Handle out=w7, Lower Frequency out=w2, Upper Frequency out=w3, error out=w8)
      Get Component Directory() -> (Path=w9)
      call "Parse Component Path.gvi"(component directory=w9) -> (calling VI path=w10)
      Strip Path(path=w10) -> (name=w11)
      call "TLPM VXIpnp Error Converter.gvi"(instrument handle=w7, CVI Error Code (0)=w6, Name Of VI ("")=w11, error in (no error)=w8) -> (error out=w1)
    }
    frame Error {
      w1 = $"error in (no error)"
      w2 = default
      w3 = default
    }
  }
  $"error out" <- w1
  $"Lower Frequency" <- w2
  $"Upper Frequency" <- w3
