vi "TLPM Get Photodiode Input Filter State.gvi"   [LabVIEW NXG 3.1.0]
# This VI returns the instrument's photodiode input filter state.
# Notes:
# (1) The VI is only available on PM100D, PM100A, PM100USB, PM200, PM400.
inputs:
  "IVI session in": "Ivi IviDefault"
  "error in (no error)": error
outputs:
  "IVI session out": "Ivi IviDefault"
  "Photodiode Input Filter State": bool  # This parameter returns the input filter state. Return values: TLPM_INPUT_FILTER_STATE_OFF (0) input filter off TLPM_INPUT_FILTER_STATE_ON (1) input filter on
  "error out": error
uses:
  Main::Miscelaneous::TLPM_64.sli::TLPM_getInputFilterState
  NI::G Core::File IO (General)::Legacy::Parse Component Path.gvi
  Main::Miscelaneous::TLPM VXIpnp Error Converter.gvi
diagram:
  $"IVI session out" <- $"IVI session in"
  case ($"error in (no error)") {
    frame No Error {
      Ivi Refnum To Session Node(IviSession=$"IVI session in", error in=$"error in (no error)") -> (IviSessionHandle=w3, error out=w4)
      call "TLPM_getInputFilterState"(Instrument Handle in=w3, Photodiode Input Filter State in=0, error in=w4) -> (return=w5, Instrument Handle out=w6, Photodiode Input Filter State out=w2, error out=w7)
      Get Component Directory() -> (Path=w8)
      call "Parse Component Path.gvi"(component directory=w8) -> (calling VI path=w9)
      Strip Path(path=w9) -> (name=w10)
      call "TLPM VXIpnp Error Converter.gvi"(instrument handle=w6, CVI Error Code (0)=w5, Name Of VI ("")=w10, error in (no error)=w7) -> (error out=w1)
    }
    frame Error {
      w1 = $"error in (no error)"
      w2 = default
    }
  }
  Is Not Equal To 0(x=w2) -> w11
  $"Photodiode Input Filter State" <- w11
  $"error out" <- w1
