vi "TLPM Get Power Range.gvi"   [LabVIEW NXG 3.1.0]
# This VI returns the actual power range value.
inputs:
  "IVI session in": "Ivi IviDefault"
  "Attribute (Set value)": i16 = "Set value"(0)  # This parameter specifies the value to be queried. Acceptable values: TLPM_ATTR_SET_VAL (0): Set value TLPM_ATTR_MIN_VAL (1): Minimum value TLPM_ATTR_MAX_VAL (2): Maximum value
  "error in (no error)": error
outputs:
  "IVI session out": "Ivi IviDefault"
  "Power Value": f64  # This parameter returns the specified power range value in watt [W].
  "error out": error
uses:
  Main::Miscelaneous::TLPM_64.sli::TLPM_getPowerRange
  NI::G Core::File IO (General)::Legacy::Parse Component Path.gvi
  Main::Miscelaneous::TLPM VXIpnp Error Converter.gvi
diagram:
  $"IVI session out" <- $"IVI session in"
  case ($"error in (no error)") {
    frame No Error {
      Ivi Refnum To Session Node(IviSession=$"IVI session in", error in=$"error in (no error)") -> (error out=w3)
      call "TLPM_getPowerRange"(Attribute in=$"Attribute (Set value)", Power Value in=0, error in=w3) -> (return=w4, Instrument Handle out=w5, Power Value out=w2, error out=w6)
      Get Component Directory() -> (Path=w7)
      call "Parse Component Path.gvi"(component directory=w7) -> (calling VI path=w8)
      Strip Path(path=w8) -> (name=w9)
      call "TLPM VXIpnp Error Converter.gvi"(instrument handle=w5, CVI Error Code (0)=w4, Name Of VI ("")=w9, error in (no error)=w6) -> (error out=w1)
    }
    frame Error {
      w1 = $"error in (no error)"
      w2 = default
    }
  }
  $"error out" <- w1
  $"Power Value" <- w2
