vi "TLPM Get Power Reference State.gvi"   [LabVIEW NXG 3.1.0]
# This VI returns the power reference state.
inputs:
  "IVI session in": "Ivi IviDefault"
  "error in (no error)": error
outputs:
  "IVI session out": "Ivi IviDefault"
  "Power Reference State": bool  # This parameter returns the power reference state. Return values: TLPM_POWER_REF_OFF (0): Power reference disabled. Absolute measurement. TLPM_POWER_REF_ON (1): Power reference enabled. Relative measurement.
  "error out": error
uses:
  Main::Miscelaneous::TLPM_64.sli::TLPM_getPowerRefState
  NI::G Core::File IO (General)::Legacy::Parse Component Path.gvi
  Main::Miscelaneous::TLPM VXIpnp Error Converter.gvi
diagram:
  $"IVI session out" <- $"IVI session in"
  case ($"error in (no error)") {
    frame No Error {
      Ivi Refnum To Session Node(IviSession=$"IVI session in", error in=$"error in (no error)") -> (IviSessionHandle=w3, error out=w4)
      call "TLPM_getPowerRefState"(Instrument Handle in=w3, Power Reference State in=0, error in=w4) -> (return=w5, Instrument Handle out=w6, Power Reference State out=w2, error out=w7)
      Get Component Directory() -> (Path=w8)
      call "Parse Component Path.gvi"(component directory=w8) -> (calling VI path=w9)
      Strip Path(path=w9) -> (name=w10)
      call "TLPM VXIpnp Error Converter.gvi"(instrument handle=w6, CVI Error Code (0)=w5, Name Of VI ("")=w10, error in (no error)=w7) -> (error out=w1)
    }
    frame Error {
      w1 = $"error in (no error)"
      w2 = default
    }
  }
  Is Not Equal To 0(x=w2) -> w11
  $"Power Reference State" <- w11
  $"error out" <- w1
