vi "TLPM Get Resource Information.gvi"   [LabVIEW NXG 3.1.0]
# This VI gets information about a connected resource.
# Notes:
# (1) The data provided by this VI was updated at the last call of <Find Resources>.
inputs:
  "IVI session in": "Ivi IviDefault"
  "Index (0)": u32  # This parameter accepts the index of the device to get the resource descriptor from. Notes: (1) The index is zero based. The maximum index to be used here is one less than the number of devices found by the last call of <Find Resources>.
  "error in (no error)": error
outputs:
  "IVI session out": "Ivi IviDefault"
  "Manufacturer": string  # This parameter returns the manufacturer name of the device. Notes: (1) The array must contain at least TLPM_BUFFER_SIZE (256) elements character[256]. (2) You may pass VI_NULL (0) if you do not need this parameter. (3) The manufacturer name is not available for serial interfaces over Bluetooth.
  "Model Name": string  # This parameter returns the model name of the device. Notes: (1) The array must contain at least TLPM_BUFFER_SIZE (256) elements character[256]. (2) You may pass VI_NULL (0) if you do not need this parameter. (3) Serial interfaces over Bluetooth will return the interface name instead of the device model name.
  "Serial Number": string  # This parameter returns the serial number of the device. Notes: (1) The array must contain at least TLPM_BUFFER_SIZE (256) elements character[256]. (2) You may pass VI_NULL (0) if you do not need this parameter. (3) The serial number is not available for serial interfaces over Bluetooth.
  "error out": error
  "Device Available": bool  # Returns the information if the device is available. Devices that are not available are used by other applications. Notes: (1) You may pass VI_NULL (0) if you do not need this parameter.
uses:
  Main::Miscelaneous::TLPM_64.sli::TLPM_getRsrcInfo
  NI::G Core::File IO (General)::Legacy::Parse Component Path.gvi
  Main::Miscelaneous::TLPM VXIpnp Error Converter.gvi
diagram:
  $"IVI session out" <- $"IVI session in"
  case ($"error in (no error)") {
    frame No Error {
      Ivi Refnum To Session Node(IviSession=$"IVI session in", error in=$"error in (no error)") -> (IviSessionHandle=w6, error out=w7)
      Initialize Array(element=0, size=2048) -> w8
      Byte Array To String(encoding="Extended ASCII", unsigned byte array=w8) -> (string=w9)
      Initialize Array(element=0, size=2048) -> w10
      Byte Array To String(encoding="Extended ASCII", unsigned byte array=w10) -> (string=w11)
      Initialize Array(element=0, size=2048) -> w12
      Byte Array To String(encoding="Extended ASCII", unsigned byte array=w12) -> (string=w13)
      call "TLPM_getRsrcInfo"(Instrument Handle in=w6, Index in=$"Index (0)", Model Name in=w9, Serial Number in=w11, Manufacturer in=w13, Device Available in=0, error in=w7) -> (return=w14, Instrument Handle out=w15, Model Name out=w2, Serial Number out=w3, Manufacturer out=w4, Device Available out=w5, error out=w16)
      Get Component Directory() -> (Path=w17)
      call "Parse Component Path.gvi"(component directory=w17) -> (calling VI path=w18)
      Strip Path(path=w18) -> (name=w19)
      call "TLPM VXIpnp Error Converter.gvi"(instrument handle=w15, CVI Error Code (0)=w14, Name Of VI ("")=w19, error in (no error)=w16) -> (error out=w1)
    }
    frame Error {
      w1 = $"error in (no error)"
      w2 = default
      w3 = default
      w4 = default
      w5 = default
    }
  }
  $"error out" <- w1
  $"Model Name" <- w2
  $"Serial Number" <- w3
  $Manufacturer <- w4
  Is Not Equal To 0(x=w5) -> w20
  $"Device Available" <- w20
