vi "TLPM Get Resource Name.gvi"   [LabVIEW NXG 3.1.0]
# This VI gets the resource name string needed to open a device with <Initialize>.
# Notes:
# (1) The data provided by this VI was updated at the last call of <Find Resources>.
inputs:
  "IVI session in": "Ivi IviDefault"
  "Index (0)": u32  # This parameter accepts the index of the device to get the resource descriptor from. Notes: (1) The index is zero based. The maximum index to be used here is one less than the number of devices found by the last call of <Find Resources>.
  "error in (no error)": error
outputs:
  "IVI session out": "Ivi IviDefault"
  "error out": error
  "Resource Name": string  # This parameter returns the resource descriptor. Use this descriptor to specify the device in <Initialize>. Notes: (1) The array must contain at least TLPM_BUFFER_SIZE (256) elements character[256].
uses:
  Main::Miscelaneous::TLPM_64.sli::TLPM_getRsrcName
  NI::G Core::File IO (General)::Legacy::Parse Component Path.gvi
  Main::Miscelaneous::TLPM VXIpnp Error Converter.gvi
diagram:
  case ($"error in (no error)") {
    frame No Error {
      Initialize Array(element=0, size=2048) -> w3
      Byte Array To String(encoding="Extended ASCII", unsigned byte array=w3) -> (string=w4)
      call "TLPM_getRsrcName"(Index in=$"Index (0)", Resource Name in=w4, error in=$"error in (no error)") -> (return=w5, Instrument Handle out=w6, Resource Name out=w2, error out=w7)
      Get Component Directory() -> (Path=w8)
      call "Parse Component Path.gvi"(component directory=w8) -> (calling VI path=w9)
      Strip Path(path=w9) -> (name=w10)
      call "TLPM VXIpnp Error Converter.gvi"(instrument handle=w6, CVI Error Code (0)=w5, Name Of VI ("")=w10, error in (no error)=w7) -> (error out=w1)
    }
    frame Error {
      w1 = $"error in (no error)"
      w2 = default
    }
  }
  $"error out" <- w1
  $"Resource Name" <- w2
  $"IVI session out" <- $"IVI session in"
