vi "TLPM Get Thermopile Accelerator Mode.gvi"   [LabVIEW NXG 3.1.0]
# This VI returns the thermopile acceleration mode.
# Notes:
# (1) The VI is only available on PM100D, PM100A, PM100USB, PM160T, PM200, PM400.
inputs:
  "IVI session in": "Ivi IviDefault"
  "error in (no error)": error
outputs:
  "IVI session out": "Ivi IviDefault"
  "Thermopile Accelerator Mode": bool  # This parameter returns the thermopile acceleration mode. Return values: TLPM_ACCELERATION_MANUAL (0): auto acceleration off TLPM_ACCELERATION_AUTO (1): auto acceleration on
  "error out": error
uses:
  Main::Miscelaneous::TLPM_64.sli::TLPM_getAccelMode
  NI::G Core::File IO (General)::Legacy::Parse Component Path.gvi
  Main::Miscelaneous::TLPM VXIpnp Error Converter.gvi
diagram:
  $"IVI session out" <- $"IVI session in"
  case ($"error in (no error)") {
    frame No Error {
      Ivi Refnum To Session Node(IviSession=$"IVI session in", error in=$"error in (no error)") -> (IviSessionHandle=w3, error out=w4)
      call "TLPM_getAccelMode"(Instrument Handle in=w3, Thermopile Accelerator Mode in=0, error in=w4) -> (return=w5, Instrument Handle out=w6, Thermopile Accelerator Mode out=w2, error out=w7)
      Get Component Directory() -> (Path=w8)
      call "Parse Component Path.gvi"(component directory=w8) -> (calling VI path=w9)
      Strip Path(path=w9) -> (name=w10)
      call "TLPM VXIpnp Error Converter.gvi"(instrument handle=w6, CVI Error Code (0)=w5, Name Of VI ("")=w10, error in (no error)=w7) -> (error out=w1)
    }
    frame Error {
      w1 = $"error in (no error)"
      w2 = default
    }
  }
  Is Not Equal To 0(x=w2) -> w11
  $"Thermopile Accelerator Mode" <- w11
  $"error out" <- w1
