vi "TLPM Get Thermopile Accelerator Tau.gvi"   [LabVIEW NXG 3.1.0]
# This VI returns the thermopile acceleration time constant in seconds [s].
# Notes:
# (1) The VI is only available on PM100D, PM100A, PM100USB, PM200, PM400.
inputs:
  "IVI session in": "Ivi IviDefault"
  "Attribute (Set value)": i16 = "Set value"(0)  # This parameter specifies the value to be queried. Acceptable values: TLPM_ATTR_SET_VAL (0): Set value TLPM_ATTR_MIN_VAL (1): Minimum value TLPM_ATTR_MAX_VAL (2): Maximum value TLPM_ATTR_DFLT_VAL (3): Default value
  "error in (no error)": error
outputs:
  "IVI session out": "Ivi IviDefault"
  "Thermopile Accelerator Tau": f64  # This parameter returns the thermopile acceleration time constant in seconds [s].
  "error out": error
uses:
  Main::Miscelaneous::TLPM_64.sli::TLPM_getAccelTau
  NI::G Core::File IO (General)::Legacy::Parse Component Path.gvi
  Main::Miscelaneous::TLPM VXIpnp Error Converter.gvi
diagram:
  $"IVI session out" <- $"IVI session in"
  case ($"error in (no error)") {
    frame No Error {
      Ivi Refnum To Session Node(IviSession=$"IVI session in", error in=$"error in (no error)") -> (IviSessionHandle=w3, error out=w4)
      call "TLPM_getAccelTau"(Instrument Handle in=w3, Attribute in=$"Attribute (Set value)", Thermopile Accelerator Tau in=0, error in=w4) -> (return=w5, Instrument Handle out=w6, Thermopile Accelerator Tau out=w2, error out=w7)
      Get Component Directory() -> (Path=w8)
      call "Parse Component Path.gvi"(component directory=w8) -> (calling VI path=w9)
      Strip Path(path=w9) -> (name=w10)
      call "TLPM VXIpnp Error Converter.gvi"(instrument handle=w6, CVI Error Code (0)=w5, Name Of VI ("")=w10, error in (no error)=w7) -> (error out=w1)
    }
    frame Error {
      w1 = $"error in (no error)"
      w2 = default
    }
  }
  $"error out" <- w1
  $"Thermopile Accelerator Tau" <- w2
