vi "TLPM Measure Auxiliary AD1 Voltage.gvi"   [LabVIEW NXG 3.1.0]
# This VI is used to obtain voltage readings from the instrument's auxiliary AD1 input.
# Notes:
# (1) The VI is only available on PM200, PM400.
inputs:
  "IVI session in": "Ivi IviDefault"
  "error in (no error)": error
outputs:
  "IVI session out": "Ivi IviDefault"
  "Voltage": f64  # This parameter returns the voltage in volt.
  "error out": error
uses:
  Main::Miscelaneous::TLPM_64.sli::TLPM_measAuxAD1
  NI::G Core::File IO (General)::Legacy::Parse Component Path.gvi
  Main::Miscelaneous::TLPM VXIpnp Error Converter.gvi
diagram:
  $"IVI session out" <- $"IVI session in"
  case ($"error in (no error)") {
    frame No Error {
      Ivi Refnum To Session Node(IviSession=$"IVI session in", error in=$"error in (no error)") -> (IviSessionHandle=w3, error out=w4)
      call "TLPM_measAuxAD1"(Instrument Handle in=w3, Voltage in=0, error in=w4) -> (return=w5, Instrument Handle out=w6, Voltage out=w2, error out=w7)
      Get Component Directory() -> (Path=w8)
      call "Parse Component Path.gvi"(component directory=w8) -> (calling VI path=w9)
      Strip Path(path=w9) -> (name=w10)
      call "TLPM VXIpnp Error Converter.gvi"(instrument handle=w6, CVI Error Code (0)=w5, Name Of VI ("")=w10, error in (no error)=w7) -> (error out=w1)
    }
    frame Error {
      w1 = $"error in (no error)"
      w2 = default
    }
  }
  $Voltage <- w2
  $"error out" <- w1
