vi "TLPM Measure Environmental Temperature.gvi"   [LabVIEW NXG 3.1.0]
# This VI is used to obtain temperature readings from the Environment Monitor Module (EMM) connected to the instrument.
# Notes:
# (1) The VI is only available on PM200, PM400.
# (2) The VI will return an error when no EMM is connected.
inputs:
  "IVI session in": "Ivi IviDefault"
  "error in (no error)": error
outputs:
  "IVI session out": "Ivi IviDefault"
  "Temperature": f64  # This parameter returns the temperature in °C
  "error out": error
uses:
  Main::Miscelaneous::TLPM_64.sli::TLPM_measEmmTemperature
  NI::G Core::File IO (General)::Legacy::Parse Component Path.gvi
  Main::Miscelaneous::TLPM VXIpnp Error Converter.gvi
diagram:
  $"IVI session out" <- $"IVI session in"
  case ($"error in (no error)") {
    frame No Error {
      Ivi Refnum To Session Node(IviSession=$"IVI session in", error in=$"error in (no error)") -> (IviSessionHandle=w3, error out=w4)
      call "TLPM_measEmmTemperature"(Instrument Handle in=w3, Temperature in=0, error in=w4) -> (return=w5, Instrument Handle out=w6, Temperature out=w2, error out=w7)
      Get Component Directory() -> (Path=w8)
      call "Parse Component Path.gvi"(component directory=w8) -> (calling VI path=w9)
      Strip Path(path=w9) -> (name=w10)
      call "TLPM VXIpnp Error Converter.gvi"(instrument handle=w6, CVI Error Code (0)=w5, Name Of VI ("")=w10, error in (no error)=w7) -> (error out=w1)
    }
    frame Error {
      w1 = $"error in (no error)"
      w2 = default
    }
  }
  $Temperature <- w2
  $"error out" <- w1
