vi "TLPM Measure Power Density.gvi"   [LabVIEW NXG 3.1.0]
# This VI is used to obtain power density readings from the instrument.
# Notes:
# (1) The VI is only available on PM100D, PM100A, PM100USB, PM200, PM400.
inputs:
  "IVI session in": "Ivi IviDefault"
  "error in (no error)": error
outputs:
  "IVI session out": "Ivi IviDefault"
  "Power Density": f64  # This parameter returns the actual measured power density in watt per square centimeter [W/cm²]. Remark: This VI starts a new measurement cycle and after finishing measurement the result is received. Subject to the actual Average Count this may take up to seconds. Refer to <Set/Get Average Count>.
  "error out": error
uses:
  Main::Miscelaneous::TLPM_64.sli::TLPM_measPowerDens
  NI::G Core::File IO (General)::Legacy::Parse Component Path.gvi
  Main::Miscelaneous::TLPM VXIpnp Error Converter.gvi
diagram:
  $"IVI session out" <- $"IVI session in"
  case ($"error in (no error)") {
    frame No Error {
      Ivi Refnum To Session Node(IviSession=$"IVI session in", error in=$"error in (no error)") -> (IviSessionHandle=w3, error out=w4)
      call "TLPM_measPowerDens"(Instrument Handle in=w3, Power Density in=0, error in=w4) -> (return=w5, Instrument Handle out=w6, Power Density out=w2, error out=w7)
      Get Component Directory() -> (Path=w8)
      call "Parse Component Path.gvi"(component directory=w8) -> (calling VI path=w9)
      Strip Path(path=w9) -> (name=w10)
      call "TLPM VXIpnp Error Converter.gvi"(instrument handle=w6, CVI Error Code (0)=w5, Name Of VI ("")=w10, error in (no error)=w7) -> (error out=w1)
    }
    frame Error {
      w1 = $"error in (no error)"
      w2 = default
    }
  }
  $"Power Density" <- w2
  $"error out" <- w1
