vi "TLPM Measure Power.gvi"   [LabVIEW NXG 3.1.0]
# This VI is used to obtain power readings from the instrument.
# Remark:
# This VI starts a new measurement cycle and after finishing measurement the result is received. Subject to the actual Average Count this may take up to seconds. Refer to <Set/Get Average Count>.
inputs:
  "IVI session in": "Ivi IviDefault"
  "error in (no error)": error
outputs:
  "IVI session out": "Ivi IviDefault"
  "Power": f64  # This parameter returns the power in the selected unit. Remark: (1) This VI starts a new measurement cycle and after finishing measurement the result is received. Subject to the actual Average Count this may take up to seconds. Refer to <Set/Get Average Count>. (2) Select the unit with <Set Power Unit>.
  "error out": error
uses:
  Main::Miscelaneous::TLPM_64.sli::TLPM_measPower
  NI::G Core::File IO (General)::Legacy::Parse Component Path.gvi
  Main::Miscelaneous::TLPM VXIpnp Error Converter.gvi
diagram:
  $"IVI session out" <- $"IVI session in"
  case ($"error in (no error)") {
    frame No Error {
      Ivi Refnum To Session Node(IviSession=$"IVI session in", error in=$"error in (no error)") -> (IviSessionHandle=w3, error out=w4)
      call "TLPM_measPower"(Instrument Handle in=w3, Power in=0, error in=w4) -> (return=w5, Instrument Handle out=w6, Power out=w2, error out=w7)
      Get Component Directory() -> (Path=w8)
      call "Parse Component Path.gvi"(component directory=w8) -> (calling VI path=w9)
      Strip Path(path=w9) -> (name=w10)
      call "TLPM VXIpnp Error Converter.gvi"(instrument handle=w6, CVI Error Code (0)=w5, Name Of VI ("")=w10, error in (no error)=w7) -> (error out=w1)
    }
    frame Error {
      w1 = $"error in (no error)"
      w2 = default
    }
  }
  $Power <- w2
  $"error out" <- w1
