vi "TLPM Calibration Message.gvi"   [LabVIEW NXG 3.1.0]
# This VI returns a human readable calibration message.
inputs:
  "IVI session in": "Ivi IviDefault"
  "error in (no error)": error
outputs:
  "IVI session out": "Ivi IviDefault"
  "Message": string  # This parameter returns the calibration message. Notes: (1) The array must contain at least TLPM_BUFFER_SIZE (256) elements character[256].
  "error out": error
uses:
  Main::Miscelaneous::TLPM_64.sli::TLPM_getCalibrationMsg
  NI::G Core::File IO (General)::Legacy::Parse Component Path.gvi
  Main::Miscelaneous::TLPM VXIpnp Error Converter.gvi
diagram:
  $"IVI session out" <- $"IVI session in"
  case ($"error in (no error)") {
    frame No Error {
      Ivi Refnum To Session Node(IviSession=$"IVI session in", error in=$"error in (no error)") -> (IviSessionHandle=w3, error out=w4)
      Initialize Array(element=0, size=2048) -> w5
      Byte Array To String(encoding="Extended ASCII", unsigned byte array=w5) -> (string=w6)
      call "TLPM_getCalibrationMsg"(Instrument Handle in=w3, Message in=w6, error in=w4) -> (return=w7, Instrument Handle out=w8, Message out=w2, error out=w9)
      Get Component Directory() -> (Path=w10)
      call "Parse Component Path.gvi"(component directory=w10) -> (calling VI path=w11)
      Strip Path(path=w11) -> (name=w12)
      call "TLPM VXIpnp Error Converter.gvi"(instrument handle=w8, CVI Error Code (0)=w7, Name Of VI ("")=w12, error in (no error)=w9) -> (error out=w1)
    }
    frame Error {
      w1 = $"error in (no error)"
      w2 = default
    }
  }
  $"error out" <- w1
  $Message <- w2
