vi "TLPM Close.gvi"   [LabVIEW NXG 3.1.0]
# This VI closes the instrument driver session.
# Note: The instrument must be reinitialized to use it again.
inputs:
  "IVI session in": "Ivi IviDefault"
  "error in (no error)": error
outputs:
  "error out": error
uses:
  Main::Miscelaneous::TLPM_64.sli::TLPM_close
  NI::G Core::File IO (General)::Legacy::Parse Component Path.gvi
  Main::Miscelaneous::TLPM VXIpnp Error Converter.gvi
diagram:
  Ivi Refnum To Session Node(IviSession=$"IVI session in") -> (IviSessionHandle=w1)
  call "TLPM_close"(instrument handle in=w1) -> (status=w2)
  Get Component Directory() -> (Path=w3)
  call "Parse Component Path.gvi"(component directory=w3) -> (calling VI path=w4)
  Strip Path(path=w4) -> (name=w5)
  call "TLPM VXIpnp Error Converter.gvi"(instrument handle=0, CVI Error Code (0)=w2, Name Of VI ("")=w5, error in (no error)=$"error in (no error)") -> (error out=w6)
  $"error out" <- w6
