vi "TLPM Error Message.gvi"   [LabVIEW NXG 3.1.0]
# This VI takes the error code returned by the instrument driver VIs interprets it and returns it as an user readable string.
# Status/error codes and description:
# --- Instrument Driver Errors and Warnings ---
# Status      Description
# -------------------------------------------------
#          0  No error (the call was successful).
# 0x3FFF0085  Unknown Status Code     - VI_WARN_UNKNOWN_STATUS
# 0x3FFC0901  WARNING: Value overflow - VI_INSTR_WARN_OVERFLOW (1073481985)
# 0x3FFC0902  WARNING: Value underrun - VI_INSTR_WARN_UNDERRUN (1073481986)
# 0x3FFC0903  WARNING: Value is NaN   - VI_INSTR_WARN_NAN (1073481987)
# 0xBFFC0001  Parameter 1 out of range.
# 0xBFFC0002  Parameter 2 out of range.
# 0xBFFC0003  Parameter 3 out of range.
# 0xBFFC0004  Parameter 4 out of range.
# 0xBFFC0005  Parameter 5 out of range.
# 0xBFFC0006  Parameter 6 out of range.
# 0xBFFC0007  Parameter 7 out of range.
# 0xBFFC0008  Parameter 8 out of range.
# 0xBFFC0012  Error Interpreting instrument response.
# --- Instrument Errors ---
# Range: 0xBFFC0700 .. 0xBFFC0CFF.
# Calculation: Device error code + 0xBFFC0900.
# Please see your device documentation for details.
# --- VISA Errors ---
# Please see your VISA documentation for details.
inputs:
  "IVI session in": "Ivi IviDefault"
  "Error Code (0)": i32  # This parameter accepts the error codes returned from the instrument driver VIs. Default Value: 0 - VI_SUCCESS
  "error in (no error)": error
outputs:
  "IVI session out": "Ivi IviDefault"
  "Error Message": string  # This parameter returns the interpreted code as an user readable message string. Notes: (1) The array must contain at least 512 elements character[512].
  "error out": error
uses:
  Main::Miscelaneous::TLPM_64.sli::TLPM_errorMessage
  NI::G Core::File IO (General)::Legacy::Parse Component Path.gvi
diagram:
  $"IVI session out" <- $"IVI session in"
  Ivi Refnum To Session Node(IviSession=$"IVI session in", error in=$"error in (no error)") -> (IviSessionHandle=w1, error out=w2)
  Initialize Array(element=0, size=2048) -> w3
  Byte Array To String(encoding="Extended ASCII", unsigned byte array=w3) -> (string=w4)
  call "TLPM_errorMessage"(instrument handle in=w1, error code in=$"Error Code (0)", error message in=w4, error in=w2) -> (Status=w5, error message out=w6, error out=w7)
  Is Less Than 0(x=w5) -> w8
  case (w7) {
    frame No Error {
      Is Not Equal To 0(x=w5) -> w10
      Get Component Directory() -> (Path=w11)
      call "Parse Component Path.gvi"(component directory=w11) -> (calling VI path=w12)
      Strip Path(path=w12) -> (name=w13)
      Select(s=w10, t=w13, f="") -> w14
      Property Node(instance in=w7, "status"=w8, "code"=w5, "source"=w14) -> (instance out=w9)
    }
    frame Error {
      w9 = w7
    }
  }
  $"error out" <- w9
  $"Error Message" <- w6
