vi "TLPM Error Query Mode.gvi"   [LabVIEW NXG 3.1.0]
# This VI selects the driver's error query mode.
inputs:
  "IVI session in": "Ivi IviDefault"
  "Mode (Automatic)": bool = TRUE  # This parameter specifies the driver's error query mode. If set to Automatic each driver VI queries the instrument's error queue and in case an error occured returns the error number. If set to Manual the driver does not query the instrument for errors and therefore a driver VI does not return instrument errors. You should use <Error Query> to manually query the instrument's error queue. VI_OFF (0): Manual error query. VI_ON (1): Automatic error query (default).
  "error in (no error)": error
outputs:
  "IVI session out": "Ivi IviDefault"
  "error out": error
uses:
  Main::Miscelaneous::TLPM_64.sli::TLPM_errorQueryMode
  NI::G Core::File IO (General)::Legacy::Parse Component Path.gvi
  Main::Miscelaneous::TLPM VXIpnp Error Converter.gvi
diagram:
  Select(s=$"Mode (Automatic)", t=1, f=0) -> w1
  case ($"error in (no error)") {
    frame No Error {
      Ivi Refnum To Session Node(IviSession=$"IVI session in", error in=$"error in (no error)") -> (IviSessionHandle=w3, error out=w4)
      call "TLPM_errorQueryMode"(Instrument Handle in=w3, Mode in=w1, error in=w4) -> (return=w5, Instrument Handle out=w6, error out=w7)
      Get Component Directory() -> (Path=w8)
      call "Parse Component Path.gvi"(component directory=w8) -> (calling VI path=w9)
      Strip Path(path=w9) -> (name=w10)
      call "TLPM VXIpnp Error Converter.gvi"(instrument handle=w6, CVI Error Code (0)=w5, Name Of VI ("")=w10, error in (no error)=w7) -> (error out=w2)
    }
    frame Error {
      w2 = $"error in (no error)"
    }
  }
  $"error out" <- w2
  $"IVI session out" <- $"IVI session in"
