vi "TLPM Error-Query.gvi"   [LabVIEW NXG 3.1.0]
# This VI queries the instrument's error queue manually.
# Use this VI to query the instrument's error queue if the driver's error query mode is set to manual query.
# Notes:
# (1) The returned values are stored in the drivers error store. You may use <Error Message> to get a descriptive text at a later point of time.
inputs:
  "IVI session in": "Ivi IviDefault"
  "error in (no error)": error
outputs:
  "IVI session out": "Ivi IviDefault"
  "Error Code": i32  # This parameter returns the instrument error number. Notes: (1) You may pass VI_NULL (0) if you don't need this value.
  "Error Message": string  # This parameter returns the instrument error message. Notes: (1) The array must contain at least TLPM_ERR_DESCR_BUFFER_SIZE (512) elements character[512]. (2) You may pass VI_NULL (0) if you do not need this value.
  "error out": error
uses:
  Main::Miscelaneous::TLPM_64.sli::TLPM_errorQuery
  NI::G Core::File IO (General)::Legacy::Parse Component Path.gvi
  Main::Miscelaneous::TLPM VXIpnp Error Converter.gvi
diagram:
  $"IVI session out" <- $"IVI session in"
  Ivi Refnum To Session Node(IviSession=$"IVI session in", error in=$"error in (no error)") -> (IviSessionHandle=w1, error out=w2)
  Initialize Array(element=0, size=2048) -> w3
  Byte Array To String(encoding="Extended ASCII", unsigned byte array=w3) -> (string=w4)
  call "TLPM_errorQuery"(instrument handle in=w1, error code in=$"Error Code", error message in=w4, error in=w2) -> (Status=w5, instrument handle out=w6, error code out=w7, error message out=w8, error out=w9)
  Get Component Directory() -> (Path=w10)
  call "Parse Component Path.gvi"(component directory=w10) -> (calling VI path=w11)
  Strip Path(path=w11) -> (name=w12)
  call "TLPM VXIpnp Error Converter.gvi"(instrument handle=w6, CVI Error Code (0)=w5, Name Of VI ("")=w12, error in (no error)=w9) -> (error out=w13)
  $"error out" <- w13
  $"Error Code" <- w7
  $"Error Message" <- w8
