vi "TLPM Find Resources.gvi"   [LabVIEW NXG 3.1.0]
# This VI finds all driver compatible devices attached to the PC and returns the number of found devices.
# Note:
# (1) The VI additionally stores information like system name about the found resources internally. This information can be retrieved with further VIs from the class, e.g. <Get Resource Description> and <Get Resource Information>.
inputs:
  "IVI session in": "Ivi IviDefault"
  "error in (no error)": error
outputs:
  "IVI session out": "Ivi IviDefault"
  "Resource Count": u32  # The number of connected devices that are supported by this driver.
  "error out": error
uses:
  Main::Miscelaneous::TLPM_64.sli::TLPM_findRsrc
  NI::G Core::File IO (General)::Legacy::Parse Component Path.gvi
  Main::Miscelaneous::TLPM VXIpnp Error Converter.gvi
diagram:
  $"IVI session out" <- $"IVI session in"
  case ($"error in (no error)") {
    frame No Error {
      call "TLPM_findRsrc"(Resource Count in=0, error in=$"error in (no error)") -> (return=w3, Instrument Handle out=w4, Resource Count out=w2, error out=w5)
      Get Component Directory() -> (Path=w6)
      call "Parse Component Path.gvi"(component directory=w6) -> (calling VI path=w7)
      Strip Path(path=w7) -> (name=w8)
      call "TLPM VXIpnp Error Converter.gvi"(instrument handle=w4, CVI Error Code (0)=w3, Name Of VI ("")=w8, error in (no error)=w5) -> (error out=w1)
    }
    frame Error {
      w1 = $"error in (no error)"
      w2 = default
    }
  }
  $"error out" <- w1
  $"Resource Count" <- w2
