vi "TLPM Identification Query.gvi"   [LabVIEW NXG 3.1.0]
# This VI returns the device identification information.
inputs:
  "IVI session in": "Ivi IviDefault"
  "error in (no error)": error
outputs:
  "IVI session out": "Ivi IviDefault"
  "Serial Number": string  # This parameter returns the device serial number. Notes: (1) The array must contain at least 256 elements character[256]. (2) You may pass VI_NULL (0) if you do not need this value.
  "Manufacturer Name": string  # This parameter returns the manufacturer name. Notes: (1) The array must contain at least 256 elements character[256]. (2) You may pass VI_NULL (0) if you do not need this value.
  "Device Name": string  # This parameter returns the device name. Notes: (1) The array must contain at least 256 elements character[256]. (2) You may pass VI_NULL (0) if you do not need this value.
  "error out": error
  "Firmware Revision": string  # This parameter returns the device firmware revision. Notes: (1) The array must contain at least 256 elements character[256]. (2) You may pass VI_NULL (0) if you do not need this value.
uses:
  Main::Miscelaneous::TLPM_64.sli::TLPM_identificationQuery
  NI::G Core::File IO (General)::Legacy::Parse Component Path.gvi
  Main::Miscelaneous::TLPM VXIpnp Error Converter.gvi
diagram:
  $"IVI session out" <- $"IVI session in"
  case ($"error in (no error)") {
    frame No Error {
      Ivi Refnum To Session Node(IviSession=$"IVI session in", error in=$"error in (no error)") -> (IviSessionHandle=w6, error out=w7)
      Initialize Array(element=0, size=2048) -> w8
      Byte Array To String(encoding="Extended ASCII", unsigned byte array=w8) -> (string=w9)
      Initialize Array(element=0, size=2048) -> w10
      Byte Array To String(encoding="Extended ASCII", unsigned byte array=w10) -> (string=w11)
      Initialize Array(element=0, size=2048) -> w12
      Byte Array To String(encoding="Extended ASCII", unsigned byte array=w12) -> (string=w13)
      Initialize Array(element=0, size=2048) -> w14
      Byte Array To String(encoding="Extended ASCII", unsigned byte array=w14) -> (string=w15)
      call "TLPM_identificationQuery"(Instrument Handle in=w6, Manufacturer Name in=w11, Device Name in=w13, Serial Number in=w9, Firmware Revision in=w15, error in=w7) -> (return=w16, Instrument Handle out=w17, Manufacturer Name out=w2, Device Name out=w3, Serial Number out=w4, Firmware Revision out=w5, error out=w18)
      Get Component Directory() -> (Path=w19)
      call "Parse Component Path.gvi"(component directory=w19) -> (calling VI path=w20)
      Strip Path(path=w20) -> (name=w21)
      call "TLPM VXIpnp Error Converter.gvi"(instrument handle=w17, CVI Error Code (0)=w16, Name Of VI ("")=w21, error in (no error)=w18) -> (error out=w1)
    }
    frame Error {
      w1 = $"error in (no error)"
      w2 = default
      w3 = default
      w4 = default
      w5 = default
    }
  }
  $"error out" <- w1
  $"Manufacturer Name" <- w2
  $"Device Name" <- w3
  $"Serial Number" <- w4
  $"Firmware Revision" <- w5
