vi "TLPM Initialize.gvi"   [LabVIEW NXG 3.1.0]
# This VI initializes the instrument driver session and performs the following initialization actions:
# (1) Opens a session to the Default Resource Manager resource and a session to the specified device using the Resource Name.
# (2) Performs an identification query on the instrument.
# (3) Resets the instrument to a known state.
# (4) Sends initialization commands to the instrument.
# (5) Returns an instrument handle which is used to distinguish between different sessions of this instrument driver.
# Notes:
# (1) Each time this VI is invoked a unique session is opened.
inputs:
  "IVI session in": "Ivi IviDefault"
  "resource name": string, required
  "ID Query (Do Query)": bool = TRUE  # This parameter specifies whether an identification query is performed during the initialization process. VI_OFF (0): Skip query. VI_ON (1): Do query (default).
  "Reset Device (Reset Device)": bool = TRUE  # This parameter specifies whether the instrument is reset during the initialization process. VI_OFF (0) - no reset VI_ON (1) - instrument is reset (default)
  "error in (no error)": error
outputs:
  "IVI session out": "Ivi IviDefault"
  "error out": error
uses:
  Main::Miscelaneous::TLPM_64.sli::TLPM_init
  NI::G Core::File IO (General)::Legacy::Parse Component Path.gvi
  Main::Miscelaneous::TLPM VXIpnp Error Converter.gvi
diagram:
  case ($"error in (no error)") {
    frame No Error {
      Boolean To Integer(Boolean=$"ID Query (Do Query)") -> (0, 1=w3)
      To Unsigned Word Integer(number=w3) -> w4
      Boolean To Integer(Boolean=$"Reset Device (Reset Device)") -> (0, 1=w5)
      To Unsigned Word Integer(number=w5) -> w6
      call "TLPM_init"(resource name in=$"resource name", id query in=w4, reset device in=w6, instrument handle in=0, error in=$"error in (no error)") -> (status=w7, instrument handle out=w8, error out=w9)
      Get Component Directory() -> (Path=w10)
      call "Parse Component Path.gvi"(component directory=w10) -> (calling VI path=w11)
      Strip Path(path=w11) -> (name=w12)
      call "TLPM VXIpnp Error Converter.gvi"(instrument handle=w8, CVI Error Code (0)=w7, Name Of VI ("")=w12, error in (no error)=w9) -> (error out=w1)
      Ivi New Session Node(IviSessionHandle=w8, IviSessionIn=$"IVI session in", ResourceName=$"resource name") -> (IviSessionOut=w2)
    }
    frame Error {
      w1 = $"error in (no error)"
      w2 = ""
    }
  }
  $"error out" <- w1
  $"IVI session out" <- w2
