vi "TLPM Raw Read From Instrument.gvi"   [LabVIEW NXG 3.1.0]
# This VI reads directly from the instrument.
inputs:
  "IVI session in": "Ivi IviDefault"
  "Size": u32  # This parameter specifies the buffer size.
  "error in (no error)": error
outputs:
  "IVI session out": "Ivi IviDefault"
  "Buffer": string  # Byte buffer that receives the data read from the instrument. Notes: (1) If received data is less than buffer size, the buffer is additionaly terminated with a '\0' character. (2) If received data is same as buffer size no '\0' character is appended. Its the caller's responsibility to make sure a buffer is '\0' terminated if the caller wants to interprete the buffer as string.
  "Return Count (0)": u32  # Number of bytes actually transferred and filled into Buffer. This number doesn't count the additional termination '\0' character. If Return Count == size the buffer content will not be '\0' terminated. Notes: (1) You may pass VI_NULL (0) if you don't need this value.
  "error out": error
uses:
  Main::Miscelaneous::TLPM_64.sli::TLPM_readRaw
  NI::G Core::File IO (General)::Legacy::Parse Component Path.gvi
  Main::Miscelaneous::TLPM VXIpnp Error Converter.gvi
diagram:
  $"IVI session out" <- $"IVI session in"
  case ($"error in (no error)") {
    frame No Error {
      Ivi Refnum To Session Node(IviSession=$"IVI session in", error in=$"error in (no error)") -> (IviSessionHandle=w4, error out=w5)
      Initialize Array(element=0, size=2048) -> w6
      Byte Array To String(encoding="Extended ASCII", unsigned byte array=w6) -> (string=w7)
      call "TLPM_readRaw"(Instrument Handle in=w4, Buffer in=w7, Size in=$Size, Return Count in=0, error in=w5) -> (return=w8, Instrument Handle out=w9, Buffer out=w2, Return Count out=w3, error out=w10)
      Get Component Directory() -> (Path=w11)
      call "Parse Component Path.gvi"(component directory=w11) -> (calling VI path=w12)
      Strip Path(path=w12) -> (name=w13)
      call "TLPM VXIpnp Error Converter.gvi"(instrument handle=w9, CVI Error Code (0)=w8, Name Of VI ("")=w13, error in (no error)=w10) -> (error out=w1)
    }
    frame Error {
      w1 = $"error in (no error)"
      w2 = default
      w3 = default
    }
  }
  $Buffer <- w2
  $"Return Count (0)" <- w3
  $"error out" <- w1
