vi "TLPM Raw Write To Instrument.gvi"   [LabVIEW NXG 3.1.0]
# This VI writes directly to the instrument.
inputs:
  "IVI session in": "Ivi IviDefault"
  "Command (\"*RST\")": string = "*rst"  # Null terminated command string to send to the instrument.
  "error in (no error)": error
outputs:
  "IVI session out": "Ivi IviDefault"
  "error out": error
uses:
  Main::Miscelaneous::TLPM_64.sli::TLPM_writeRaw
  NI::G Core::File IO (General)::Legacy::Parse Component Path.gvi
  Main::Miscelaneous::TLPM VXIpnp Error Converter.gvi
diagram:
  $"IVI session out" <- $"IVI session in"
  case ($"error in (no error)") {
    frame No Error {
      Ivi Refnum To Session Node(IviSession=$"IVI session in", error in=$"error in (no error)") -> (IviSessionHandle=w2, error out=w3)
      call "TLPM_writeRaw"(Instrument Handle in=w2, Command in=$"Command (\"*RST\")", error in=w3) -> (return=w4, Instrument Handle out=w5, error out=w6)
      Get Component Directory() -> (Path=w7)
      call "Parse Component Path.gvi"(component directory=w7) -> (calling VI path=w8)
      Strip Path(path=w8) -> (name=w9)
      call "TLPM VXIpnp Error Converter.gvi"(instrument handle=w5, CVI Error Code (0)=w4, Name Of VI ("")=w9, error in (no error)=w6) -> (error out=w1)
    }
    frame Error {
      w1 = $"error in (no error)"
    }
  }
  $"error out" <- w1
