vi "TLPM Read Register.gvi"   [LabVIEW NXG 3.1.0]
# This VI reads the content of any readable instrument register. Refer to your instrument's user's manual for more details on status structure registers.
inputs:
  "IVI session in": "Ivi IviDefault"
  "Register ID (Status Byte Register)": i16 = "Status Byte Register"(0)
    # Specifies the register to be used for operation. This parameter can be any of the following constants:
    # TLPM_REG_STB         (0): Status Byte Register
    # TLPM_REG_SRE         (1): Service Request Enable
    # TLPM_REG_ESB         (2): Standard Event Status Register
    # TLPM_REG_ESE         (3): Standard Event Enable
    # TLPM_REG_OPER_COND   (4): Operation Condition Register
    # TLPM_REG_OPER_EVENT  (5): Operation Event Register
    # TLPM_REG_OPER_ENAB   (6): Operation Event Enable Register
    # TLPM_REG_OPER_PTR    (7): Operation Positive Transition
    # TLPM_REG_OPER_NTR    (8): Operation Negative Transition
    # TLPM_REG_QUES_COND   (9): Questionable Condition Register
    # TLPM_REG_QUES_EVENT (10): Questionable Event Register
    # TLPM_REG_QUES_ENAB  (11): Questionable Event Enable Reg.
    # TLPM_REG_QUES_PTR   (12): Questionable Positive Transition
    # TLPM_REG_QUES_NTR   (13): Questionable Negative Transition
    # TLPM_REG_MEAS_COND  (14): Measurement Condition Register
    # TLPM_REG_MEAS_EVENT (15): Measurement Event Register
    # TLPM_REG_MEAS_ENAB  (16): Measurement Event Enable Register
    # TLPM_REG_MEAS_PTR   (17): Measurement Positive Transition
    # TLPM_REG_MEAS_NTR   (18): Measurement Negative Transition
    # TLPM_REG_AUX_COND   (19): Auxiliary Condition Register
    # TLPM_REG_AUX_EVENT  (20): Auxiliary Event Register
    # TLPM_REG_AUX_ENAB   (21): Auxiliary Event Enable Register
    # TLPM_REG_AUX_PTR    (22): Auxiliary Positive Transition
    # TLPM_REG_AUX_NTR    (23): Auxiliary Negative Transition
  "error in (no error)": error
outputs:
  "IVI session out": "Ivi IviDefault"
  "Value": i16
    # This parameter returns the value of the selected register.
    # These register bits are defined:
    # STATUS BYTE bits (see IEEE488.2-1992 §11.2)
    # TLPM_STATBIT_STB_AUX (1)         (0x01): Auxiliary summary
    # TLPM_STATBIT_STB_MEAS (2)        (0x02): Device Measurement Summary
    # TLPM_STATBIT_STB_EAV (4)         (0x04): Error available
    # TLPM_STATBIT_STB_QUES (8)        (0x08): Questionable Status Summary
    # TLPM_STATBIT_STB_MAV (16)         (0x10): Message available
    # TLPM_STATBIT_STB_ESB (32)         (0x20): Event Status Bit
    # TLPM_STATBIT_STB_MSS (64)         (0x40): Master summary status
    # TLPM_STATBIT_STB_OPER (128)        (0x80): Operation Status Summary
    # STANDARD EVENT STATUS REGISTER bits (see IEEE488.2-1992 §11.5.1)
    # TLPM_STATBIT_ESR_OPC (1)         (0x01): Operation complete
    # TLPM_STATBIT_ESR_RQC (2)         (0x02): Request control
    # TLPM_STATBIT_ESR_QYE (4)         (0x04): Query error
    # TLPM_STATBIT_ESR_DDE (8)         (0x08): Device-Specific error
    # TLPM_STATBIT_ESR_EXE (16)         (0x10): Execution error
    # TLPM_STATBIT_ESR_CME (32)         (0x20): Command error
    # TLPM_STATBIT_ESR_URQ (64)         (0x40): User request
    # TLPM_STATBIT_ESR_PON (128)         (0x80): Power on
    # QUESTIONABLE STATUS REGISTER bits (see SCPI 99.0 §9)
    # TLPM_STATBIT_QUES_VOLT (1)       (0x0001): Questionable voltage measurement
    # TLPM_STATBIT_QUES_CURR (2)       (0x0002): Questionable current measurement
    # TLPM_STATBIT_QUES_TIME (4)       (0x0004): Questionable time measurement
    # TLPM_STATBIT_QUES_POW (8)        (0x0008): Questionable power measurement
    # TLPM_STATBIT_QUES_TEMP (16)       (0x0010): Questionable temperature measurement
    # TLPM_STATBIT_QUES_FREQ (32)       (0x0020): Questionable frequency measurement
    # TLPM_STATBIT_QUES_PHAS (64)       (0x0040): Questionable phase measurement
    # TLPM_STATBIT_QUES_MOD (128)        (0x0080): Questionable modulation measurement
    # TLPM_STATBIT_QUES_CAL (256)        (0x0100): Questionable calibration
    # TLPM_STATBIT_QUES_ENER (512)       (0x0200): Questionable energy measurement
    # TLPM_STATBIT_QUES_10 (1024)         (0x0400): Reserved
    # TLPM_STATBIT_QUES_11 (2048)         (0x0800): Reserved
    # TLPM_STATBIT_QUES_12 (4096)         (0x1000): Reserved
    # TLPM_STATBIT_QUES_INST (8192)       (0x2000): Instrument summary
    # TLPM_STATBIT_QUES_WARN (16384)       (0x4000): Command warning
    # TLPM_STATBIT_QUES_15 (32768)         (0x8000): Reserved
    # OPERATION STATUS REGISTER bits (see SCPI 99.0 §9)
    # TLPM_STATBIT_OPER_CAL (1)        (0x0001): The instrument is currently performing a calibration.
    # TLPM_STATBIT_OPER_SETT (2)       (0x0002): The instrument is waiting for signals to stabilize for measurements.
    # TLPM_STATBIT_OPER_RANG (4)       (0x0004): The instrument is currently changing its range.
    # TLPM_STATBIT_OPER_SWE (8)        (0x0008): A sweep is in progress.
    # TLPM_STATBIT_OPER_MEAS (16)       (0x0010): The instrument is actively measuring.
    # TLPM_STATBIT_OPER_TRIG (32)       (0x0020): The instrument is in a “wait for trigger” state of the trigger model.
    # TLPM_STATBIT_OPER_ARM (64)        (0x0040): The instrument is in a “wait for arm” state of the trigger model.
    # TLPM_STATBIT_OPER_CORR (128)       (0x0080): The instrument is currently performing a correction (Auto-PID tune).
    # TLPM_STATBIT_OPER_SENS (256)       (0x0100): Optical powermeter sensor connected and operable.
    # TLPM_STATBIT_OPER_DATA (512)       (0x0200): Measurement data ready for fetch.
    # TLPM_STATBIT_OPER_THAC (1024)       (0x0400): Thermopile accelerator active.
    # TLPM_STATBIT_OPER_11 (2048)         (0x0800): Reserved
    # TLPM_STATBIT_OPER_12 (4096)         (0x1000): Reserved
    # TLPM_STATBIT_OPER_INST (8192)       (0x2000): One of n multiple logical instruments is reporting OPERational status.
    # TLPM_STATBIT_OPER_PROG (16384)       (0x4000): A user-defined programming is currently in the run state.
    # TLPM_STATBIT_OPER_15 (32768)         (0x8000): Reserved
    # Thorlabs defined MEASRUEMENT STATUS REGISTER bits
    # TLPM_STATBIT_MEAS_0 (1)          (0x0001): Reserved
    # TLPM_STATBIT_MEAS_1 (2)          (0x0002): Reserved
    # TLPM_STATBIT_MEAS_2 (4)          (0x0004): Reserved
    # TLPM_STATBIT_MEAS_3 (8)          (0x0008): Reserved
    # TLPM_STATBIT_MEAS_4 (16)          (0x0010): Reserved
    # TLPM_STATBIT_MEAS_5 (32)          (0x0020): Reserved
    # TLPM_STATBIT_MEAS_6 (64)          (0x0040): Reserved
    # TLPM_STATBIT_MEAS_7 (128)          (0x0080): Reserved
    # TLPM_STATBIT_MEAS_8 (256)          (0x0100): Reserved
    # TLPM_STATBIT_MEAS_9 (512)          (0x0200): Reserved
    # TLPM_STATBIT_MEAS_10 (1024)         (0x0400): Reserved
    # TLPM_STATBIT_MEAS_11 (2048)         (0x0800): Reserved
    # TLPM_STATBIT_MEAS_12 (4096)         (0x1000): Reserved
    # TLPM_STATBIT_MEAS_13 (8192)         (0x2000): Reserved
    # TLPM_STATBIT_MEAS_14 (16384)         (0x4000): Reserved
    # TLPM_STATBIT_MEAS_15 (32768)         (0x8000): Reserved
    # Thorlabs defined Auxiliary STATUS REGISTER bits
    # TLPM_STATBIT_AUX_NTC (1)         (0x0001): Auxiliary NTC temperature sensor connected.
    # TLPM_STATBIT_AUX_EMM (2)         (0x0002): External measurement module connected.
    # TLPM_STATBIT_AUX_2 (4)           (0x0004): Reserved
    # TLPM_STATBIT_AUX_3 (8)           (0x0008): Reserved
    # TLPM_STATBIT_AUX_EXPS (16)        (0x0010): External power supply connected
    # TLPM_STATBIT_AUX_BATC (32)        (0x0020): Battery charging
    # TLPM_STATBIT_AUX_BATL (64)        (0x0040): Battery low
    # TLPM_STATBIT_AUX_IPS (128)         (0x0080): Apple(tm) authentification supported.
    # TLPM_STATBIT_AUX_IPF (256)         (0x0100): Apple(tm) authentification failed.
    # TLPM_STATBIT_AUX_9 (512)           (0x0200): Reserved
    # TLPM_STATBIT_AUX_10 (1024)          (0x0400): Reserved
    # TLPM_STATBIT_AUX_11 (2048)          (0x0800): Reserved
    # TLPM_STATBIT_AUX_12 (4096)          (0x1000): Reserved
    # TLPM_STATBIT_AUX_13 (8192)          (0x2000): Reserved
    # TLPM_STATBIT_AUX_14 (16384)          (0x4000): Reserved
    # TLPM_STATBIT_AUX_15 (32768)          (0x8000): Reserved
  "error out": error
uses:
  Main::Miscelaneous::TLPM_64.sli::TLPM_readRegister
  NI::G Core::File IO (General)::Legacy::Parse Component Path.gvi
  Main::Miscelaneous::TLPM VXIpnp Error Converter.gvi
diagram:
  case ($"error in (no error)") {
    frame No Error {
      Ivi Refnum To Session Node(IviSession=$"IVI session in", error in=$"error in (no error)") -> (IviSessionHandle=w3, error out=w4)
      call "TLPM_readRegister"(Instrument Handle in=w3, Register ID in=$"Register ID (Status Byte Register)", Value in=0, error in=w4) -> (return=w5, Instrument Handle out=w6, Value out=w2, error out=w7)
      Get Component Directory() -> (Path=w8)
      call "Parse Component Path.gvi"(component directory=w8) -> (calling VI path=w9)
      Strip Path(path=w9) -> (name=w10)
      call "TLPM VXIpnp Error Converter.gvi"(instrument handle=w6, CVI Error Code (0)=w5, Name Of VI ("")=w10, error in (no error)=w7) -> (error out=w1)
    }
    frame Error {
      w1 = $"error in (no error)"
      w2 = default
    }
  }
  $"error out" <- w1
  $Value <- w2
  $"IVI session out" <- $"IVI session in"
