vi "TLPM Revision Query.gvi"   [LabVIEW NXG 3.1.0]
# This VI returns the revision numbers of the instrument driver and the device firmware.
inputs:
  "IVI session in": "Ivi IviDefault"
  "error in (no error)": error
outputs:
  "IVI session out": "Ivi IviDefault"
  "Instrument Driver Revision": string  # This parameter returns the Instrument Driver revision. Notes: (1) The array must contain at least 256 elements character[256]. (2) You may pass VI_NULL (0) if you do not need this value.
  "Firmware Revision": string  # This parameter returns the device firmware revision. Notes: (1) The array must contain at least 256 elements character[256]. (2) You may pass VI_NULL (0) if you do not need this value.
  "error out": error
uses:
  Main::Miscelaneous::TLPM_64.sli::TLPM_revisionQuery
  NI::G Core::File IO (General)::Legacy::Parse Component Path.gvi
  Main::Miscelaneous::TLPM VXIpnp Error Converter.gvi
diagram:
  $"IVI session out" <- $"IVI session in"
  case ($"error in (no error)") {
    frame No Error {
      Ivi Refnum To Session Node(IviSession=$"IVI session in", error in=$"error in (no error)") -> (IviSessionHandle=w4, error out=w5)
      Initialize Array(element=0, size=2048) -> w6
      Byte Array To String(encoding="Extended ASCII", unsigned byte array=w6) -> (string=w7)
      Initialize Array(element=0, size=2048) -> w8
      Byte Array To String(encoding="Extended ASCII", unsigned byte array=w8) -> (string=w9)
      call "TLPM_revisionQuery"(instrument handle in=w4, instrument driver revision in=w7, firmware revision in=w9, error in=w5) -> (Status=w10, instrument handle out=w11, instrument driver revision out=w2, firmware revision out=w3, error out=w12)
      Get Component Directory() -> (Path=w13)
      call "Parse Component Path.gvi"(component directory=w13) -> (calling VI path=w14)
      Strip Path(path=w14) -> (name=w15)
      call "TLPM VXIpnp Error Converter.gvi"(instrument handle=w11, CVI Error Code (0)=w10, Name Of VI ("")=w15, error in (no error)=w12) -> (error out=w1)
    }
    frame Error {
      w1 = $"error in (no error)"
      w2 = default
      w3 = default
    }
  }
  $"error out" <- w1
  $"Instrument Driver Revision" <- w2
  $"Firmware Revision" <- w3
