vi "TLPM Self-Test.gvi"   [LabVIEW NXG 3.1.0]
# This VI runs the device self test routine and returns the test result.
inputs:
  "IVI session in": "Ivi IviDefault"
  "error in (no error)": error
outputs:
  "IVI session out": "Ivi IviDefault"
  "Self Test Result": i16  # This parameter contains the value returned from the device self test routine. A retured zero value indicates a successful run, a value other than zero indicates failure.
  "Self-Test Message": string  # This parameter returns the interpreted code as an user readable message string. Notes: (1) The array must contain at least 256 elements character[256].
  "error out": error
uses:
  Main::Miscelaneous::TLPM_64.sli::TLPM_selfTest
  NI::G Core::File IO (General)::Legacy::Parse Component Path.gvi
  Main::Miscelaneous::TLPM VXIpnp Error Converter.gvi
diagram:
  $"IVI session out" <- $"IVI session in"
  case ($"error in (no error)") {
    frame No Error {
      Ivi Refnum To Session Node(IviSession=$"IVI session in", error in=$"error in (no error)") -> (IviSessionHandle=w4, error out=w5)
      Initialize Array(element=0, size=2048) -> w6
      Byte Array To String(encoding="Extended ASCII", unsigned byte array=w6) -> (string=w7)
      call "TLPM_selfTest"(instrument handle in=w4, self test result in=0, self-test message in=w7, error in=w5) -> (Status=w8, instrument handle out=w9, self test result out=w2, self-test message out=w3, error out=w10)
      Get Component Directory() -> (Path=w11)
      call "Parse Component Path.gvi"(component directory=w11) -> (calling VI path=w12)
      Strip Path(path=w12) -> (name=w13)
      call "TLPM VXIpnp Error Converter.gvi"(instrument handle=w9, CVI Error Code (0)=w8, Name Of VI ("")=w13, error in (no error)=w10) -> (error out=w1)
    }
    frame Error {
      w1 = $"error in (no error)"
      w2 = default
      w3 = default
    }
  }
  $"error out" <- w1
  $"Self Test Result" <- w2
  $"Self-Test Message" <- w3
