vi "TLPM Sensor Information.gvi"   [LabVIEW NXG 3.1.0]
# This VI is used to obtain informations from the connected sensor like sensor name, serial number, calibration message, sensor type, sensor subtype and sensor flags.
# Remark:
# The meanings of the obtained sensor type, subtype and flags are:
# Sensor Types:
#  SENSOR_TYPE_NONE (0)                0x00 // No sensor
#  SENSOR_TYPE_PD_SINGLE (1)           0x01 // Photodiode sensor
#  SENSOR_TYPE_THERMO (2)              0x02 // Thermopile sensor
#  SENSOR_TYPE_PYRO (3)                0x03 // Pyroelectric sensor
# Sensor Subtypes:
#  SENSOR_SUBTYPE_NONE (0)             0x00 // No sensor
# Sensor Subtypes Photodiode:
#  SENSOR_SUBTYPE_PD_ADAPTER (1)       0x01 // Photodiode adapter
#  SENSOR_SUBTYPE_PD_SINGLE_STD (2)    0x02 // Photodiode sensor
#  SENSOR_SUBTYPE_PD_SINGLE_FSR (3)    0x03 // Photodiode sensor with
#                                         integrated filter
#                                         identified by position
#  SENSOR_SUBTYPE_PD_SINGLE_STD_T (18)  0x12 // Photodiode sensor with
#                                         temperature sensor
# Sensor Subtypes Thermopile:
#  SENSOR_SUBTYPE_THERMO_ADAPTER (1)   0x01 // Thermopile adapter
#  SENSOR_SUBTYPE_THERMO_STD (2)       0x02 // Thermopile sensor
#  SENSOR_SUBTYPE_THERMO_STD_T (18)     0x12 // Thermopile sensor with
#                                         temperature sensor
# Sensor Subtypes Pyroelectric Sensor:
#  SENSOR_SUBTYPE_PYRO_ADAPTER (1)     0x01 // Pyroelectric adapter
#  SENSOR_SUBTYPE_PYRO_STD (2)         0x02 // Pyroelectric sensor
#  SENSOR_SUBTYPE_PYRO_STD_T (18)       0x12 // Pyroelectric sensor with
#                                         temperature sensor
# Sensor Flags:
#  TLPM_SENS_FLAG_IS_POWER (1)      0x0001 // Power sensor
#  TLPM_SENS_FLAG_IS_ENERGY (2)     0x0002 // Energy sensor
#  TLPM_SENS_FLAG_IS_RESP_SET (16)   0x0010 // Responsivity settable
#  TLPM_SENS_FLAG_IS_WAVEL_SET (32)  0x0020 // Wavelength settable
#  TLPM_SENS_FLAG_IS_TAU_SET (64)    0x0040 // Time constant settable
#  TLPM_SENS_FLAG_HAS_TEMP (256)      0x0100 // With Temperature sensor
inputs:
  "IVI session in": "Ivi IviDefault"
  "error in (no error)": error
outputs:
  "IVI session out": "Ivi IviDefault"
  "Sensor Subtype": i16
    # This parameter returns the subtype of the connected sensor.
    # Remark:
    # The meanings of the obtained sensor subtype are:
    # Sensor Subtypes:
    # SENSOR_SUBTYPE_NONE (0)             0x00 // No sensor
    # Sensor Subtypes Photodiode:
    # SENSOR_SUBTYPE_PD_ADAPTER (1)       0x01 // Photodiode adapter
    # SENSOR_SUBTYPE_PD_SINGLE_STD (2)    0x02 // Photodiode sensor
    # SENSOR_SUBTYPE_PD_SINGLE_FSR (3)    0x03 // Photodiode sensor with
    # integrated filter
    # identified by position
    # SENSOR_SUBTYPE_PD_SINGLE_STD_T (18)  0x12 // Photodiode sensor with
    # temperature sensor
    # Sensor Subtypes Thermopile:
    # SENSOR_SUBTYPE_THERMO_ADAPTER (1)   0x01 // Thermopile adapter
    # SENSOR_SUBTYPE_THERMO_STD (2)       0x02 // Thermopile sensor
    # SENSOR_SUBTYPE_THERMO_STD_T (18)     0x12 // Thermopile sensor with
    # temperature sensor
    # Sensor Subtypes Pyroelectric Sensor:
    # SENSOR_SUBTYPE_PYRO_ADAPTER (1)     0x01 // Pyroelectric adapter
    # SENSOR_SUBTYPE_PYRO_STD (2)         0x02 // Pyroelectric sensor
    # SENSOR_SUBTYPE_PYRO_STD_T (18)       0x12 // Pyroelectric sensor with
    # temperature sensor
  "Sensor Calibration Message": string  # This parameter returns the calibration message of the connected sensor.
  "Sensor Name": string  # This parameter returns the name of the connected sensor.
  "Sensor Serial Number": string  # This parameter returns the serial number of the connected sensor.
  "error out": error
  "Sensor Flags": i16
    # This parameter returns the flags of the connected sensor.
    # Remark:
    # The meanings of the obtained sensor flags are:
    # Sensor Flags:
    # TLPM_SENS_FLAG_IS_POWER (1)      0x0001 // Power sensor
    # TLPM_SENS_FLAG_IS_ENERGY (2)     0x0002 // Energy sensor
    # TLPM_SENS_FLAG_IS_RESP_SET (16)   0x0010 // Responsivity settable
    # TLPM_SENS_FLAG_IS_WAVEL_SET (32)  0x0020 // Wavelength settable
    # TLPM_SENS_FLAG_IS_TAU_SET (64)    0x0040 // Time constant settable
    # TLPM_SENS_FLAG_HAS_TEMP (256)      0x0100 // With Temperature sensor
  "Sensor Type": i16  # This parameter returns the sensor type of the connected sensor. Remark: The meanings of the obtained sensor type are: Sensor Types: SENSOR_TYPE_NONE (0) 0x00 // No sensor SENSOR_TYPE_PD_SINGLE (1) 0x01 // Photodiode sensor SENSOR_TYPE_THERMO (2) 0x02 // Thermopile sensor SENSOR_TYPE_PYRO (3) 0x03 // Pyroelectric sensor
uses:
  Main::Miscelaneous::TLPM_64.sli::TLPM_getSensorInfo
  NI::G Core::File IO (General)::Legacy::Parse Component Path.gvi
  Main::Miscelaneous::TLPM VXIpnp Error Converter.gvi
diagram:
  $"IVI session out" <- $"IVI session in"
  case ($"error in (no error)") {
    frame No Error {
      Ivi Refnum To Session Node(IviSession=$"IVI session in", error in=$"error in (no error)") -> (IviSessionHandle=w8, error out=w9)
      Initialize Array(element=0, size=2048) -> w10
      Byte Array To String(encoding="Extended ASCII", unsigned byte array=w10) -> (string=w11)
      Initialize Array(element=0, size=2048) -> w12
      Byte Array To String(encoding="Extended ASCII", unsigned byte array=w12) -> (string=w13)
      Initialize Array(element=0, size=2048) -> w14
      Byte Array To String(encoding="Extended ASCII", unsigned byte array=w14) -> (string=w15)
      call "TLPM_getSensorInfo"(Instrument Handle in=w8, Sensor Name in=w11, Sensor Serial Number in=w13, Sensor Calibration Message in=w15, Sensor Type in=0, Sensor Subtype in=0, Sensor Flags in=0, error in=w9) -> (return=w16, Instrument Handle out=w17, Sensor Name out=w2, Sensor Serial Number out=w3, Sensor Calibration Message out=w4, Sensor Type out=w5, Sensor Subtype out=w6, Sensor Flags out=w7, error out=w18)
      Get Component Directory() -> (Path=w19)
      call "Parse Component Path.gvi"(component directory=w19) -> (calling VI path=w20)
      Strip Path(path=w20) -> (name=w21)
      call "TLPM VXIpnp Error Converter.gvi"(instrument handle=w17, CVI Error Code (0)=w16, Name Of VI ("")=w21, error in (no error)=w18) -> (error out=w1)
    }
    frame Error {
      w1 = $"error in (no error)"
      w2 = default
      w3 = default
      w4 = default
      w5 = default
      w6 = default
      w7 = default
    }
  }
  $"error out" <- w1
  $"Sensor Name" <- w2
  $"Sensor Serial Number" <- w3
  $"Sensor Calibration Message" <- w4
  $"Sensor Type" <- w5
  $"Sensor Subtype" <- w6
  $"Sensor Flags" <- w7
