vi "TLPM VXIpnp Error Converter.gvi"   [LabVIEW NXG 3.1.0]
# This VI converts error codes from VXIPnp instrument driver to standard LabVIEW error codes.  If an error is detected the VI builds the appropriate error cluster that is readable by one of the error handlers supplied with LabVIEW.
inputs:
  "instrument handle": u32
  "CVI Error Code (0)": i32  # I32 Error code returned from a VXIPnp instrument driver operation.
  "Name Of VI (\"\")": string  # The name of the VI or function that produced the error.
  "error in (no error)": error
outputs:
  "instrument handle out": u32
  "error out": error
uses:
  Main::Miscelaneous::TLPM_64.sli::TLPM_errorMessage_2
diagram:
  $"instrument handle out" <- $"instrument handle"
  Is Not Equal To 0(x=$"CVI Error Code (0)") -> w1
  Property Node(instance in=$"error in (no error)") -> ("status"=w2)
  Not(x=w2) -> w3
  Logical And(w1, w3) -> w4
  case (w4) {
    frame False, Default {
      w5 = $"error in (no error)"
    }
    frame True {
      Initialize Array(element=0, size=256) -> w6
      Byte Array To String(encoding="Extended ASCII", unsigned byte array=w6) -> (string=w7)
      call "TLPM_errorMessage_2"(arg_2 in=$"instrument handle", arg_3 in=$"CVI Error Code (0)", arg in=w7) -> (return=w8, arg_3 out=w9, arg out=w10)
      Is Less Than 0(x=w9) -> w11
      # error_message
      Is Equal(x=0x3FFF0085, y=w8) -> w12
      case (w12) {
        frame False, Default {
          Format Into String(formatString="<ERR>Driver Status:  (Hex 0x%x) %s", initString=$"Name Of VI (\"\")", w9, w10) -> w13
        }
        frame True {
          w13 = $"Name Of VI (\"\")"
        }
      }
      Property Node(instance in=$"error in (no error)", "status"=w11, "code"=w9, "source"=w13) -> (instance out=w5)
    }
  }
  $"error out" <- w5
