vi "TLPM Set Average Count.gvi"   [LabVIEW NXG 3.1.0]
# This VI sets the average count for measurement value generation.
# Notes:
# (1) The VI is only available on PM100A, PM100D, PM100USB, PM200, PM400.
# (2) The VI is deprecated and kept for legacy reasons. Its recommended to use TLPM Set Average Time.vi() instead.
inputs:
  "IVI session in": "Ivi IviDefault"
  "Average Count (1)": i16 = 1  # This parameter specifies the average count. The default value is 1. Remark: Depending on the powermeter model internal there are taken up to 3000 measurements per second. In this example Average Time = Average Count / 3000 [s]. To get an measurement value from the device the timeout in your application has to be longer than the calculated average time.
  "error in (no error)": error
outputs:
  "IVI session out": "Ivi IviDefault"
  "error out": error
uses:
  Main::Miscelaneous::TLPM_64.sli::TLPM_setAvgCnt
  NI::G Core::File IO (General)::Legacy::Parse Component Path.gvi
  Main::Miscelaneous::TLPM VXIpnp Error Converter.gvi
diagram:
  $"IVI session out" <- $"IVI session in"
  case ($"error in (no error)") {
    frame No Error {
      Ivi Refnum To Session Node(IviSession=$"IVI session in", error in=$"error in (no error)") -> (IviSessionHandle=w2, error out=w3)
      call "TLPM_setAvgCnt"(Instrument Handle in=w2, Average Count in=$"Average Count (1)", error in=w3) -> (return=w4, Instrument Handle out=w5, error out=w6)
      Get Component Directory() -> (Path=w7)
      call "Parse Component Path.gvi"(component directory=w7) -> (calling VI path=w8)
      Strip Path(path=w8) -> (name=w9)
      call "TLPM VXIpnp Error Converter.gvi"(instrument handle=w5, CVI Error Code (0)=w4, Name Of VI ("")=w9, error in (no error)=w6) -> (error out=w1)
    }
    frame Error {
      w1 = $"error in (no error)"
    }
  }
  $"error out" <- w1
