vi "TLPM Set Average Time.gvi"   [LabVIEW NXG 3.1.0]
# This VI sets the average time for measurement value generation.
inputs:
  "IVI session in": "Ivi IviDefault"
  "Average Time (0.0)": f64  # This parameter specifies the average time in seconds. The value will be rounded to the closest multiple of the device's internal sampling rate. Remark: To get an measurement value from the device the timeout in your application has to be longer than the average time.
  "error in (no error)": error
outputs:
  "IVI session out": "Ivi IviDefault"
  "error out": error
uses:
  Main::Miscelaneous::TLPM_64.sli::TLPM_setAvgTime
  NI::G Core::File IO (General)::Legacy::Parse Component Path.gvi
  Main::Miscelaneous::TLPM VXIpnp Error Converter.gvi
diagram:
  $"IVI session out" <- $"IVI session in"
  case ($"error in (no error)") {
    frame No Error {
      Ivi Refnum To Session Node(IviSession=$"IVI session in", error in=$"error in (no error)") -> (IviSessionHandle=w2, error out=w3)
      call "TLPM_setAvgTime"(Instrument Handle in=w2, Average Time in=$"Average Time (0.0)", error in=w3) -> (return=w4, Instrument Handle out=w5, error out=w6)
      Get Component Directory() -> (Path=w7)
      call "Parse Component Path.gvi"(component directory=w7) -> (calling VI path=w8)
      Strip Path(path=w8) -> (name=w9)
      call "TLPM VXIpnp Error Converter.gvi"(instrument handle=w5, CVI Error Code (0)=w4, Name Of VI ("")=w9, error in (no error)=w6) -> (error out=w1)
    }
    frame Error {
      w1 = $"error in (no error)"
    }
  }
  $"error out" <- w1
