vi "TLPM Set Current Reference State.gvi"   [LabVIEW NXG 3.1.0]
# This VI sets the current reference state.
# Notes:
# (1) The VI is only available on PM100A, PM100D, PM100USB, PM160, PM200, PM400.
inputs:
  "IVI session in": "Ivi IviDefault"
  "Current Reference State (OFF)": u16 = "OFF"(0)  # This parameter specifies the current reference state. Acceptable values: TLPM_CURRENT_REF_OFF (0): Current reference disabled. Absolute measurement. TLPM_CURRENT_REF_ON (1): Current reference enabled. Relative measurement.
  "error in (no error)": error
outputs:
  "IVI session out": "Ivi IviDefault"
  "error out": error
uses:
  Main::Miscelaneous::TLPM_64.sli::TLPM_setCurrentRefState
  NI::G Core::File IO (General)::Legacy::Parse Component Path.gvi
  Main::Miscelaneous::TLPM VXIpnp Error Converter.gvi
diagram:
  case ($"error in (no error)") {
    frame No Error {
      Ivi Refnum To Session Node(IviSession=$"IVI session in", error in=$"error in (no error)") -> (IviSessionHandle=w2, error out=w3)
      call "TLPM_setCurrentRefState"(Instrument Handle in=w2, Current Reference State in=$"Current Reference State (OFF)", error in=w3) -> (return=w4, Instrument Handle out=w5, error out=w6)
      Get Component Directory() -> (Path=w7)
      call "Parse Component Path.gvi"(component directory=w7) -> (calling VI path=w8)
      Strip Path(path=w8) -> (name=w9)
      call "TLPM VXIpnp Error Converter.gvi"(instrument handle=w5, CVI Error Code (0)=w4, Name Of VI ("")=w9, error in (no error)=w6) -> (error out=w1)
    }
    frame Error {
      w1 = $"error in (no error)"
    }
  }
  $"error out" <- w1
  $"IVI session out" <- $"IVI session in"
