vi "TLPM Set Custom Sensor Input Adapter Type.gvi"   [LabVIEW NXG 3.1.0]
# This VI sets the sensor type to assume for custom sensors without calibration data memory connected to the instrument.
# Notes:
# (1) The VI is only available on PM100D, PM100A, PM100USB, PM200, PM400.
inputs:
  "IVI session in": "Ivi IviDefault"
  "Custom Sensor Type (Photodiode)": i16 = "Photodiode"(1)  # This parameter specifies the custom sensor type. Acceptable values: SENSOR_TYPE_PD_SINGLE (1): Photodiode sensor SENSOR_TYPE_THERMO (2): Thermopile sensor SENSOR_TYPE_PYRO (3): Pyroelectric sensor Value SENSOR_TYPE_PYRO is only available for energy meter instruments.
  "error in (no error)": error
outputs:
  "IVI session out": "Ivi IviDefault"
  "error out": error
uses:
  Main::Miscelaneous::TLPM_64.sli::TLPM_setInputAdapterType
  NI::G Core::File IO (General)::Legacy::Parse Component Path.gvi
  Main::Miscelaneous::TLPM VXIpnp Error Converter.gvi
diagram:
  case ($"error in (no error)") {
    frame No Error {
      Ivi Refnum To Session Node(IviSession=$"IVI session in", error in=$"error in (no error)") -> (IviSessionHandle=w2, error out=w3)
      call "TLPM_setInputAdapterType"(Instrument Handle in=w2, Custom Sensor Type in=$"Custom Sensor Type (Photodiode)", error in=w3) -> (return=w4, Instrument Handle out=w5, error out=w6)
      Get Component Directory() -> (Path=w7)
      call "Parse Component Path.gvi"(component directory=w7) -> (calling VI path=w8)
      Strip Path(path=w8) -> (name=w9)
      call "TLPM VXIpnp Error Converter.gvi"(instrument handle=w5, CVI Error Code (0)=w4, Name Of VI ("")=w9, error in (no error)=w6) -> (error out=w1)
    }
    frame Error {
      w1 = $"error in (no error)"
    }
  }
  $"error out" <- w1
  $"IVI session out" <- $"IVI session in"
