vi "TLPM Set Date And Time.gvi"   [LabVIEW NXG 3.1.0]
# This VI sets the system date and time of the powermeter.
# Notes:
# (1) Date and time are displayed on instruments screen and are used as timestamp for data saved to memory card.
# (2) The VI is only available on PM100D, PM200, PM400.
inputs:
  "IVI session in": "Ivi IviDefault"
  "Hour (14)": i16 = 14  # This parameter specifies the actual hour in the format hh e.g. 14.
  "Second (0)": i16  # This parameter specifies the actual second in the format ss e.g. 50.
  "Year (2009)": i16 = 2009  # This parameter specifies the actual year in the format yyyy e.g. 2009.
  "Month (1)": i16 = 1  # This parameter specifies the actual month in the format mm e.g. 01.
  "error in (no error)": error
  "Day (1)": i16 = 1  # This parameter specifies the actual day in the format dd e.g. 15.
  "Minute (0)": i16  # This parameter specifies the actual minute in the format mm e.g. 43.
outputs:
  "IVI session out": "Ivi IviDefault"
  "error out": error
uses:
  Main::Miscelaneous::TLPM_64.sli::TLPM_setTime
  NI::G Core::File IO (General)::Legacy::Parse Component Path.gvi
  Main::Miscelaneous::TLPM VXIpnp Error Converter.gvi
diagram:
  $"IVI session out" <- $"IVI session in"
  case ($"error in (no error)") {
    frame No Error {
      Ivi Refnum To Session Node(IviSession=$"IVI session in", error in=$"error in (no error)") -> (IviSessionHandle=w2, error out=w3)
      call "TLPM_setTime"(Instrument Handle in=w2, Year in=$"Year (2009)", Month in=$"Month (1)", Day in=$"Day (1)", Hour in=$"Hour (14)", Minute in=$"Minute (0)", Second in=$"Second (0)", error in=w3) -> (return=w4, Instrument Handle out=w5, error out=w6)
      Get Component Directory() -> (Path=w7)
      call "Parse Component Path.gvi"(component directory=w7) -> (calling VI path=w8)
      Strip Path(path=w8) -> (name=w9)
      call "TLPM VXIpnp Error Converter.gvi"(instrument handle=w5, CVI Error Code (0)=w4, Name Of VI ("")=w9, error in (no error)=w6) -> (error out=w1)
    }
    frame Error {
      w1 = $"error in (no error)"
    }
  }
  $"error out" <- w1
