vi "TLPM Set Digital I  O Output.gvi"   [LabVIEW NXG 3.1.0]
# This VI sets the digital I/O outputs.
# Notes:
# (1) Only ports configured as outputs are affected by this VI. Use <Set Digital I/O Direction> to configure ports as outputs.
# (2) The VI is only available on PM200 and PM400.
inputs:
  "IVI session in": "Ivi IviDefault"
  "IO 3 (High)": bool = TRUE  # This parameter specifies the I/O port #3 output. Low level: VI_OFF (0) High level: VI_ON (1)
  "IO 0 (High)": bool = TRUE  # This parameter specifies the I/O port #0 output. Low level: VI_OFF (0) High level: VI_ON (1)
  "IO 1 (High)": bool = TRUE  # This parameter specifies the I/O port #1 output. Low level: VI_OFF (0) High level: VI_ON (1)
  "error in (no error)": error
  "IO 2 (High)": bool = TRUE  # This parameter specifies the I/O port #2 output. Low level: VI_OFF (0) High level: VI_ON (1)
outputs:
  "IVI session out": "Ivi IviDefault"
  "error out": error
uses:
  Main::Miscelaneous::TLPM_64.sli::TLPM_setDigIoOutput
  NI::G Core::File IO (General)::Legacy::Parse Component Path.gvi
  Main::Miscelaneous::TLPM VXIpnp Error Converter.gvi
diagram:
  $"IVI session out" <- $"IVI session in"
  Select(s=$"IO 0 (High)", t=1, f=0) -> w1
  Select(s=$"IO 1 (High)", t=1, f=0) -> w2
  Select(s=$"IO 2 (High)", t=1, f=0) -> w3
  Select(s=$"IO 3 (High)", t=1, f=0) -> w4
  case ($"error in (no error)") {
    frame No Error {
      Ivi Refnum To Session Node(IviSession=$"IVI session in", error in=$"error in (no error)") -> (IviSessionHandle=w6, error out=w7)
      call "TLPM_setDigIoOutput"(Instrument Handle in=w6, IO 0 in=w1, IO 1 in=w2, IO 2 in=w3, IO 3 in=w4, error in=w7) -> (return=w8, Instrument Handle out=w9, error out=w10)
      Get Component Directory() -> (Path=w11)
      call "Parse Component Path.gvi"(component directory=w11) -> (calling VI path=w12)
      Strip Path(path=w12) -> (name=w13)
      call "TLPM VXIpnp Error Converter.gvi"(instrument handle=w9, CVI Error Code (0)=w8, Name Of VI ("")=w13, error in (no error)=w10) -> (error out=w5)
    }
    frame Error {
      w5 = $"error in (no error)"
    }
  }
  $"error out" <- w5
