vi "TLPM Set External NTC Parameter.gvi"   [LabVIEW NXG 3.1.0]
# This VI sets the temperature calculation coefficients for the NTC sensor externally connected to the instrument (NTC IN).
# Notes:
# (1) The VI is only available on PM400.
inputs:
  "IVI session in": "Ivi IviDefault"
  "R0 Coefficient (10000.0)": f64 = 10000  # This parameter specifies the R0 coefficient in [Ohm] for calculating the temperature from the sensor's resistance by the beta parameter equation. R0 is the NTC's resistance at T0 (25 °C = 298.15 K).
  "Beta Coefficient (3988.0)": f64 = 3988  # This parameter specifies the B coefficient in [K] for calculating the temperature from the sensor's resistance by the beta parameter equation.
  "error in (no error)": error
outputs:
  "IVI session out": "Ivi IviDefault"
  "error out": error
uses:
  Main::Miscelaneous::TLPM_64.sli::TLPM_setExtNtcParameter
  NI::G Core::File IO (General)::Legacy::Parse Component Path.gvi
  Main::Miscelaneous::TLPM VXIpnp Error Converter.gvi
diagram:
  $"IVI session out" <- $"IVI session in"
  case ($"error in (no error)") {
    frame No Error {
      Ivi Refnum To Session Node(IviSession=$"IVI session in", error in=$"error in (no error)") -> (IviSessionHandle=w2, error out=w3)
      call "TLPM_setExtNtcParameter"(Instrument Handle in=w2, R0 Coefficient in=$"R0 Coefficient (10000.0)", Beta Coefficient in=$"Beta Coefficient (3988.0)", error in=w3) -> (return=w4, Instrument Handle out=w5, error out=w6)
      Get Component Directory() -> (Path=w7)
      call "Parse Component Path.gvi"(component directory=w7) -> (calling VI path=w8)
      Strip Path(path=w8) -> (name=w9)
      call "TLPM VXIpnp Error Converter.gvi"(instrument handle=w5, CVI Error Code (0)=w4, Name Of VI ("")=w9, error in (no error)=w6) -> (error out=w1)
    }
    frame Error {
      w1 = $"error in (no error)"
    }
  }
  $"error out" <- w1
