vi "TLPM Set Power Unit.gvi"   [LabVIEW NXG 3.1.0]
# This VI sets the unit of the power value.
inputs:
  "IVI session in": "Ivi IviDefault"
  "Power Unit (Watt)": i16 = "Watt"(0)  # This parameter specifies the unit of the pover value. Acceptable values: TLPM_POWER_UNIT_WATT (0): power in Watt TLPM_POWER_UNIT_DBM (1): power in dBm
  "error in (no error)": error
outputs:
  "IVI session out": "Ivi IviDefault"
  "error out": error
uses:
  Main::Miscelaneous::TLPM_64.sli::TLPM_setPowerUnit
  NI::G Core::File IO (General)::Legacy::Parse Component Path.gvi
  Main::Miscelaneous::TLPM VXIpnp Error Converter.gvi
diagram:
  $"IVI session out" <- $"IVI session in"
  case ($"error in (no error)") {
    frame No Error {
      Ivi Refnum To Session Node(IviSession=$"IVI session in", error in=$"error in (no error)") -> (IviSessionHandle=w2, error out=w3)
      call "TLPM_setPowerUnit"(Instrument Handle in=w2, Power Unit in=$"Power Unit (Watt)", error in=w3) -> (return=w4, Instrument Handle out=w5, error out=w6)
      Get Component Directory() -> (Path=w7)
      call "Parse Component Path.gvi"(component directory=w7) -> (calling VI path=w8)
      Strip Path(path=w8) -> (name=w9)
      call "TLPM VXIpnp Error Converter.gvi"(instrument handle=w5, CVI Error Code (0)=w4, Name Of VI ("")=w9, error in (no error)=w6) -> (error out=w1)
    }
    frame Error {
      w1 = $"error in (no error)"
    }
  }
  $"error out" <- w1
