vi "TLPM Set Thermopile Accelerator Mode.gvi"   [LabVIEW NXG 3.1.0]
# This VI sets the thermopile acceleration auto mode.
# While thermopile acceleration improves displaying changing measurement values it unfortunately adds extra noise which can become noticeable on constant values measurements. With acceleration mode set to AUTO the instrument enables the acceleration circuitry after big measurement value changes for five times of "Tau". See also VIs <Set Thermopile Accelerator Tau> and <Set Thermopile Accelerator State>.
# With calling <Set Thermopile Accelerator State> the accelerator mode will always be reset to MANUAL.
# Notes:
# (1) The VI is only available on PM100D, PM100A, PM100USB, PM160T, PM200, PM400.
inputs:
  "IVI session in": "Ivi IviDefault"
  "Thermopile Accelerator Mode (ON)": u16 = "ON"(1)  # This parameter specifies the thermopile acceleration mode. Acceptable values: TLPM_ACCELERATION_MANUAL (0): auto acceleration off TLPM_ACCELERATION_AUTO (1): auto acceleration on
  "error in (no error)": error
outputs:
  "IVI session out": "Ivi IviDefault"
  "error out": error
uses:
  Main::Miscelaneous::TLPM_64.sli::TLPM_setAccelMode
  NI::G Core::File IO (General)::Legacy::Parse Component Path.gvi
  Main::Miscelaneous::TLPM VXIpnp Error Converter.gvi
diagram:
  case ($"error in (no error)") {
    frame No Error {
      Ivi Refnum To Session Node(IviSession=$"IVI session in", error in=$"error in (no error)") -> (IviSessionHandle=w2, error out=w3)
      call "TLPM_setAccelMode"(Instrument Handle in=w2, Thermopile Accelerator Mode in=$"Thermopile Accelerator Mode (ON)", error in=w3) -> (return=w4, Instrument Handle out=w5, error out=w6)
      Get Component Directory() -> (Path=w7)
      call "Parse Component Path.gvi"(component directory=w7) -> (calling VI path=w8)
      Strip Path(path=w8) -> (name=w9)
      call "TLPM VXIpnp Error Converter.gvi"(instrument handle=w5, CVI Error Code (0)=w4, Name Of VI ("")=w9, error in (no error)=w6) -> (error out=w1)
    }
    frame Error {
      w1 = $"error in (no error)"
    }
  }
  $"error out" <- w1
  $"IVI session out" <- $"IVI session in"
