vi "TLPM Set Voltage Autorange Mode.gvi"   [LabVIEW NXG 3.1.0]
# This VI sets the voltage auto range mode.
# Notes:
# (1) The VI is only available on PM100D, PM100A, PM100USB, PM160T, PM200, PM400.
inputs:
  "IVI session in": "Ivi IviDefault"
  "Voltage Autorange Mode (ON)": u16 = "ON"(1)  # This parameter specifies the voltage auto range mode. Acceptable values: TLPM_AUTORANGE_VOLTAGE_OFF (0): voltage auto range disabled TLPM_AUTORANGE_VOLTAGE_ON (1): voltage auto range enabled
  "error in (no error)": error
outputs:
  "IVI session out": "Ivi IviDefault"
  "error out": error
uses:
  Main::Miscelaneous::TLPM_64.sli::TLPM_setVoltageAutoRange
  NI::G Core::File IO (General)::Legacy::Parse Component Path.gvi
  Main::Miscelaneous::TLPM VXIpnp Error Converter.gvi
diagram:
  case ($"error in (no error)") {
    frame No Error {
      Ivi Refnum To Session Node(IviSession=$"IVI session in", error in=$"error in (no error)") -> (IviSessionHandle=w2, error out=w3)
      call "TLPM_setVoltageAutoRange"(Instrument Handle in=w2, Voltage Autorange Mode in=$"Voltage Autorange Mode (ON)", error in=w3) -> (return=w4, Instrument Handle out=w5, error out=w6)
      Get Component Directory() -> (Path=w7)
      call "Parse Component Path.gvi"(component directory=w7) -> (calling VI path=w8)
      Strip Path(path=w8) -> (name=w9)
      call "TLPM VXIpnp Error Converter.gvi"(instrument handle=w5, CVI Error Code (0)=w4, Name Of VI ("")=w9, error in (no error)=w6) -> (error out=w1)
    }
    frame Error {
      w1 = $"error in (no error)"
    }
  }
  $"error out" <- w1
  $"IVI session out" <- $"IVI session in"
