vi "Keithley 2450 Output List and Acquire.gvi"   [LabVIEW NXG 3.1.0]
# Outputs a sequence of voltages based on a list and takes readings at each point.
panel controls:
  "Limit Level (0.1)": f64 = 0.1  # Sets the maximum value for the value not regulated by the Source Mode control. For instance, if the instrument was suppling a voltage, the compliance value would be in amps.
  "VISA resource name": "VISA Instr"
    # Specifies which instrument to use.  Instruments that are powered on and connected to your computer are visible in the VISA resource name pull-down menu.  Select the resource name from the VISA resource name pull-down menu.  If your instrument does not appear in this list, enter the instrument descriptor using the following format:
    # Interface Type[board index]::Address::INSTR.
    # Examples:
    # GPIB:  GPIB::22::INSTR,  GPIB board 0, primary address 22
    # Serial:  COM1
    # VISA Alias:  "SampleInstr" - Alias names are configured in MAX
    # Refer to the LabVIEW Help for more information about specifying a VISA resource name.
  "Output List": f64[] = [0.1, 0.2, 0.3]
  "Source Mode (0: Voltage)": u16 = "Voltage"(0)  # Selects the voltage or current source mode to be configured.
panel indicators:
  "Waveform Graph": f64[][]
uses:
  Keithley 2450 NXG Library::Public::Initialize.gvi
  Keithley 2450 NXG Library::Public::Configure::Configure Measurement Function.gvi
  Keithley 2450 NXG Library::Public::Configure::Configure Measurement Range.gvi
  Keithley 2450 NXG Library::Public::Configure::Configure Source Function.gvi
  Keithley 2450 NXG Library::Public::Configure::Configure Source Limit Level.gvi
  Keithley 2450 NXG Library::Public::Configure::Configure Output List.gvi
  Keithley 2450 NXG Library::Public::Action Status::Enable Output.gvi
  Keithley 2450 NXG Library::Public::Configure::Configure List Mode Sweep.gvi
  Keithley 2450 NXG Library::Public::Data::Low Level::Initiate.gvi
  Keithley 2450 NXG Library::Public::Data::Low Level::Wait for Operation Complete.gvi
  Keithley 2450 NXG Library::Public::Data::Read (Multiple Points).gvi
  Keithley 2450 NXG Library::Public::Close.gvi
  NI::G Core::Error::Display Error.gvi
diagram:
  Array Size(array=$"Output List") -> (size(s)=w1)
  To Unsigned Long Integer(number=w1) -> w2
  call "Initialize.gvi"(VISA resource name=$"VISA resource name") -> (VISA resource name out=w3, error out=w4)
  # Configure the measurements and output.  Configure Output must be called to set the compliance level.
  call "Configure Measurement Function.gvi"(VISA resource name=w3, Function (0: Volts)="Volts"(0), error in (no error)=w4) -> (VISA resource name out=w5, error out=w6)
  call "Configure Measurement Range.gvi"(VISA resource name=w5, error in (no error)=w6) -> (VISA resource name out=w7, error out=w8)
  call "Configure Measurement Range.gvi"(VISA resource name=w7, error in (no error)=w8) -> (VISA resource name out=w9, error out=w10)
  call "Configure Source Function.gvi"(VISA resource name=w9, Function (0: Volts)=$"Source Mode (0: Voltage)", error in (no error)=w10) -> (VISA resource name out=w11, error out=w12)
  case ($"Source Mode (0: Voltage)") {
    frame 0, Default {
      w14 = "Current"(1)  # Function (0: Volts)
      w13 = w14
    }
    frame 1 {
      w15 = "Volts"(0)  # Function (0: Volts)
      w13 = w15
    }
  }
  # Configure the list with the amplitude array and source settings.
  call "Configure Measurement Function.gvi"(VISA resource name=w11, Function (0: Volts)=w13, error in (no error)=w12) -> (VISA resource name out=w16, error out=w17)
  # Read the raw data.  For the output list to work correctly, the Output Mode must be set to List.  Also, the size of the list needs to be passed to Sample Count.
  call "Configure Source Limit Level.gvi"(VISA resource name=w16, Function (0: Volts)="Volts"(0), Source Limit (1.0)=$"Limit Level (0.1)", error in (no error)=w17) -> (VISA resource name out=w18, error out=w19)
  call "Configure Output List.gvi"(VISA resource name=w18, Output List=$"Output List", Source Mode (0: Voltage)=$"Source Mode (0: Voltage)", error in (no error)=w19) -> (VISA resource name out=w20, error out=w21)
  call "Enable Output.gvi"(VISA resource name=w20, error in (no error)=w21) -> (VISA resource name out=w22, error out=w23)
  call "Configure List Mode Sweep.gvi"(VISA resource name=w22, Start Index=1, Delay (0)=0, error in (no error)=w23, Source Mode (0: Voltage)=$"Source Mode (0: Voltage)") -> (VISA resource name out=w24, error out=w25)
  call "Initiate.gvi"(VISA resource name=w24, error in (no error)=w25) -> (VISA resource name out=w26, error out=w27)
  call "Wait for Operation Complete.gvi"(VISA resource name=w26, Timeout (10000 ms)=100000, error in (no error)=w27) -> (VISA resource name out=w28, error out=w29)
  case ($"Source Mode (0: Voltage)") {
    frame 0, Default {
      sequence {
        frame 0 {
          Wait(time to wait=2000)
        }
        frame 1 {
          call "Read (Multiple Points).gvi"(VISA resource name=w28, Start Index (1)=1, End Index (1)=w2, error in (no error)=w29, Buffer Elements="SOUR, READ") -> (VISA resource name out=w30, Data out=w32, error out=w31)
        }
      }
    }
    frame 1 {
      sequence {
        frame 0 {
          Wait(time to wait=2000)
        }
        frame 1 {
          call "Read (Multiple Points).gvi"(VISA resource name=w28, Start Index (1)=1, End Index (1)=w2, error in (no error)=w29, Buffer Elements="READ, SOUR") -> (VISA resource name out=w30, Data out=w32, error out=w31)
        }
      }
    }
  }
  Spreadsheet String To Array(array type=f64[] [], delimiter=",", format string="%s", spreadsheet string=w32) -> (array=w33)
  Decimate Array(array=w33) -> (out0=w34, out1=w35)
  Build Array(w34, w35) -> w36
  $"Waveform Graph" <- w36
  call "Enable Output.gvi"(VISA resource name=w30, Enable Output (T: Enable)=FALSE, error in (no error)=w31) -> (VISA resource name out=w37, error out=w38)
  call "Close.gvi"(VISA resource name=w37, error in (no error)=w38) -> (error out=w39)
  call "Display Error.gvi"(error in=w39)
