vi "Initialize.gvi"   [LabVIEW NXG 3.1.0]
# Establishes communication with the instrument and optionally performs an instrument identification query and/or an instrument reset.  It also places the instrument in a default state needed for other instrument driver operations.  Therefore, call this VI before calling other instrument driver VIs for this instrument.  Generally, you need to call the Initialize VI only once at the beginning of an application.
inputs:
  "VISA resource name": "VISA Instr", required
    # Specifies which instrument to use.  Instruments that are powered on and connected to your computer are visible in the VISA resource name pull-down menu.  Select the resource name from the VISA resource name pull-down menu.  If your instrument does not appear in this list, enter the instrument descriptor using the following format:
    # Interface Type[board index]::Address::INSTR.
    # Examples:
    # GPIB:  GPIB::22::INSTR,  GPIB board 0, primary address 22
    # Serial:  COM1
    # VISA Alias:  "SampleInstr" - Alias names are configured in MAX
    # Refer to the LabVIEW Help for more information about specifying a VISA resource name.
  "ID Query (True)": bool = TRUE  # Specify whether you want the instrument driver to perform an ID Query.
  "Reset (True)": bool = TRUE  # Specify whether you want the instrument driver to reset the instrument during the initialization procedure.
  "error in (no error)": error
outputs:
  "VISA resource name out": "VISA Instr"  # A copy of the reference to the instrument in use. The reference to the resource name is created in the Initialize VI. Wire the VISA resource name out terminal of the Initialize VI to subsequent VISA resource name input terminals. You chain instrument driver VIs together by wiring the VISA resource name out terminal to subsequent VISA resource name input terminals.
  "error out": error
uses:
  NI::VISA::Open (Instr).gvi
  NI::VISA::Clear (Instr).gvi
  NI::VISA::Write (Instr, String).gvi
  NI::VISA::Read (Instr, String).gvi
  NI::G Core::Error::Legacy::Error Cluster From Error Code.gvi
  Keithley 2450 NXG Library::Private::Default Instrument Setup.gvi
  Keithley 2450 NXG Library::Public::Utility::Reset.gvi
  Keithley 2450 NXG Library::Public::Utility::Error Query.gvi
  Keithley 2450 NXG Library::Public::Close.gvi
diagram:
  call "Open (Instr).gvi"(resource name=$"VISA resource name", error in=$"error in (no error)", access mode=0) -> (session out=w1, error out=w2)
  # Open instrument
  call "Clear (Instr).gvi"(session in=w1, error in=w2) -> (session out=w3, error out=w4)
  Property Node(instance in=w3, "Timeout"=60000, error in=w4) -> (error out=w5, instance out=w6)
  # Query Instrument ID
  # Reset Instrument/
  # Default Setup
  case ($"ID Query (True)") {
    frame False, Default {
      w7 = w5
      w8 = w6
    }
    frame True {
      w9 = "*IDN?"  # ID Query
      call "Write (Instr, String).gvi"(session in=w6, error in=w5, write buffer=w9) -> (session out=w10, error out=w11)
      call "Read (Instr, String).gvi"(session in=w10, error in=w11, byte count=256) -> (session out=w8, error out=w12, read buffer=w13)
      w14 = "The ID Query failed.  This may mean that you selected the wrong instrument or your instrument did not respond.  You may also be using a model that is not officially supported by this driver.  If you are sure that you have selected the correct instrument and it is responding, try disabling the ID Query."
      call "Error Cluster From Error Code.gvi"(error code=-1074003951, error message=w14, show call chain?=TRUE) -> (error out=w15)
      Property Node(instance in=w12) -> ("status"=w16)
      Match Pattern(regular expression="KEITHLEY INSTRUMENTS.*24", string=w13) -> (offset past match=w17)
      Is Greater Or Equal To 0(x=w17) -> w18
      Logical Or(w16, w18) -> w19
      Select(s=w19, t=w12, f=w15) -> w7
    }
  }
  case ($"Reset (True)") {
    frame False, Default {
      call "Default Instrument Setup.gvi"(VISA resource name=w8, error in (no error)=w7) -> (VISA resource name out=w21, error out=w20)
    }
    frame True {
      call "Reset.gvi"(VISA resource name=w8, error in (no error)=w7) -> (VISA resource name out=w21, error out=w20)
    }
  }
  # Close if Error
  case (w20) {
    frame No Error {
      call "Error Query.gvi"(VISA resource name=w21, error in (no error)=w20) -> (VISA resource name out=w22, error out=w23)
    }
    frame Error {
      call "Close.gvi"(VISA resource name=w21, error in (no error)=w20) -> (error out=w23)
      w22 = ""
    }
  }
  $"VISA resource name out" <- w22
  $"error out" <- w23
