vi "Error Query.gvi"   [LabVIEW NXG 3.1.0]
# Queries the instrument for any errors in the instrument's error queue.  It will continue to read errors until all errors have been read from the instrument.  Any errors will be returned in the error out control.
# Note:
# This VI is called automatically by most driver VIs so it is not usually necessary to call this in an application.
inputs:
  "VISA resource name": "VISA Instr", required
    # A reference to the instrument in use.  The reference to the resource name is created in the Initialize VI.  Therefore, before calling this VI, you need to call the Initialize VI.  To run this VI interactively, select the previously initialized resource name from the pull-down menu.  To run this VI programmatically, wire the VISA resource name out terminal of the Initialize VI to subsequent VISA resource name input terminals.  You chain instrument driver VIs together by wiring the VISA resource name out terminal to subsequent VISA resource name input terminals.
  "error in (no error)": error
outputs:
  "VISA resource name out": "VISA Instr"  # A copy of the reference to the instrument in use. The reference to the resource name is created in the Initialize VI. Wire the VISA resource name out terminal of the Initialize VI to subsequent VISA resource name input terminals. You chain instrument driver VIs together by wiring the VISA resource name out terminal to subsequent VISA resource name input terminals.
  "Error Code": i32[]  # The instrument-specific error code(s) returned by the instrument.
  "Error Message": string  # Message returned by the instrument describing the instrument error(s).
  "error out": error
uses:
  NI::VISA::Write (Instr, String).gvi
  NI::VISA::Read (Instr, String).gvi
  NI::G Core::Error::Legacy::Error Cluster From Error Code.gvi
diagram:
  Property Node(instance in=$"error in (no error)") -> ("status"=w1, "code"=w2)
  w3 = -1073807339  # Timeout error
  Is Equal(x=w2, y=w3) -> w4
  Logical Or(not w1, w4) -> w5
  case (w5) {
    frame False, Default {
      w6 = $"VISA resource name"
      w7 = $"error in (no error)"
      w8 = ""
      w9 = i32[] []
    }
    frame True {
      s1 = ""  # shift register
      s2 = 0  # shift register
      s3 = no error  # shift register
      while {
        w10 = ":SYST:ERR?"  # Error Query Command
        call "Write (Instr, String).gvi"(session in=$"VISA resource name", error in=s3, write buffer=w10) -> (session out=w11, error out=w12)
        w13 = 256  # Bytes
        call "Read (Instr, String).gvi"(session in=w11, error in=w12, byte count=w13) -> (session out=w6, error out=w14, read buffer=w15)
        Scan From String(formatString="%[^\\r\\n]", inputString=w15, errIn=w14) -> (errOut=w16, out0=w17)
        Scan From String(formatString="%d", inputString=w15, errIn=w16) -> (errOut=w18, out0=w19)
        Is Equal To 0(x=w19) -> w20
        Select(s=w20, t=s2, f=w19) -> w21
        Property Node(instance in=w18) -> ("status"=w22)
        Logical Or(w22, w20) -> w23
        Concatenate Strings(s1, w17, "\r\n") -> w24
        append w19 to w9
        next s1 = w24
        next s2 = w21
        next s3 = w18
        stop if w23
      }
      Is Not Equal To 0(x=s2) -> w25
      case (w25) {
        frame False, Default {
          w26 = s3
        }
        frame True {
          # If code ever non-zero
          # then set error out to
          # be instrument error
          Concatenate Strings("Instrument reports:\n", s1) -> w27
          call "Error Cluster From Error Code.gvi"(error code=-1074000000, error message=w27, show call chain?=TRUE) -> (error out=w26)
        }
      }
      Build Array(w26, $"error in (no error)") -> w28
      Build Array(w28) -> w29
      Build Array(w29) -> w30
      Merge Errors(w30) -> (error out=w7)
      w8 = s1
    }
  }
  $"Error Code" <- w9
  $"VISA resource name out" <- w6
  $"error out" <- w7
  $"Error Message" <- w8
