vi "Set Display Screen.gvi"   [LabVIEW NXG 3.1.0]
# This VI selects which front-panel screen is displayed..
inputs:
  "VISA resource name": "VISA Instr", required
    # A reference to the instrument in use.  The reference to the resource name is created in the Initialize VI.  Therefore, before calling this VI, you need to call the Initialize VI.  To run this VI interactively, select the previously initialized resource name from the pull-down menu.  To run this VI programmatically, wire the VISA resource name out terminal of the Initialize VI to subsequent VISA resource name input terminals.  You chain instrument driver VIs together by wiring the VISA resource name out terminal to subsequent VISA resource name input terminals.
  "Screen Home": u16 = "Home Screen"(0)  # The screen to display: • Home screen • Source screen • Performance screen • Measure screen • Plot screen • User-defined screen • Statistics screen • Settings screen • Graph screen • Data sheet screen
  "error in (no error)": error
outputs:
  "VISA resource name out": "VISA Instr"  # A copy of the reference to the instrument in use. The reference to the resource name is created in the Initialize VI. Wire the VISA resource name out terminal of the Initialize VI to subsequent VISA resource name input terminals. You chain instrument driver VIs together by wiring the VISA resource name out terminal to subsequent VISA resource name input terminals.
  "error out": error
uses:
  NI::VISA::Write (Instr, String).gvi
diagram:
  Pick Line(line index=$"Screen Home", multi-line string="HOME\nSOUR\nPLOT\nUSER\nSTAT\nSETT\nGRAP\nDAT") -> (output string=w1)
  Format Into String(formatString="DISP:SCR %s;", w1) -> w2
  call "Write (Instr, String).gvi"(session in=$"VISA resource name", error in=$"error in (no error)", write buffer=w2) -> (session out=w3, error out=w4)
  $"VISA resource name out" <- w3
  $"error out" <- w4
