vi "VI Tree.gvi"   [LabVIEW NXG 3.1.0]
# This is the instrument driver for the Keithley 2400 Series SourceMeter. The VI Tree displays all the user-callable VIs of the instrument driver in an organized table.
uses:
  Keithley 2450 NXG Library::Public::Initialize.gvi
  Keithley 2450 NXG Library::Public::Close.gvi
  Keithley 2450 NXG Library::Public::Utility::Create Math Operation.gvi
  Keithley 2450 NXG Library::Public::Data::Fetch Read Buffer Statistics.gvi
  Keithley 2450 NXG Library::Public::Data::Get Number of Readings in the Buffer.gvi
  Keithley 2450 NXG Library::Public::Data::Make Reading and Store in Buffer.gvi
  Keithley 2450 NXG Library::Public::Action Status::Enable Output.gvi
  Keithley 2450 NXG Library::Public::Action Status::Enable Remote Sensing.gvi
  Keithley 2450 NXG Library::Public::Action Status::Get Digital IO Pins Mode.gvi
  Keithley 2450 NXG Library::Public::Action Status::Get Digital IO Pins State.gvi
  Keithley 2450 NXG Library::Public::Data::Query Limit Test Data.gvi
  Keithley 2450 NXG Library::Public::Utility::Clear Display.gvi
  Keithley 2450 NXG Library::Public::Utility::Clear System Event Log.gvi
  Keithley 2450 NXG Library::Public::Utility::Set Display Screen.gvi
  Keithley 2450 NXG Library::Public::Action Status::In Compliance Query.gvi
  Keithley 2450 NXG Library::Public::Action Status::Read all Digital IO Pins.gvi
  Keithley 2450 NXG Library::Public::Action Status::Set Digital IO Mode.gvi
  Keithley 2450 NXG Library::Public::Data::Read (Multiple Points).gvi
  Keithley 2450 NXG Library::Public::Data::Read (Single Point).gvi
  Keithley 2450 NXG Library::Public::Data::Read (Digitize).gvi
  Keithley 2450 NXG Library::Public::Utility::Display Message.gvi
  Keithley 2450 NXG Library::Public::Utility::Emit Beep.gvi
  Keithley 2450 NXG Library::Public::Utility::Enable Operation Event Register.gvi
  Keithley 2450 NXG Library::Public::Utility::Enable Questionable Event Register.gvi
  Keithley 2450 NXG Library::Public::Action Status::Set or Reset Digital IO Pins.gvi
  Keithley 2450 NXG Library::Public::Action Status::Write to all Digital IO Pins.gvi
  Keithley 2450 NXG Library::Public::Utility::Error Query.gvi
  Keithley 2450 NXG Library::Public::Utility::Get Active Terminals.gvi
  Keithley 2450 NXG Library::Public::Utility::Self-Test.gvi
  Keithley 2450 NXG Library::Public::Utility::Get Event Id Mapped to Bit Number in Operation Event Register.gvi
  Keithley 2450 NXG Library::Public::Data::Low Level::Fetch (Measurements).gvi
  Keithley 2450 NXG Library::Public::Data::Low Level::Measure Lowlevel.gvi
  Keithley 2450 NXG Library::Public::Data::Low Level::Abort.gvi
  Keithley 2450 NXG Library::Public::Data::Low Level::Initiate.gvi
  Keithley 2450 NXG Library::Public::Utility::Get Event Id Mapped to Bit Number in Questionable Event Register.gvi
  Keithley 2450 NXG Library::Public::Utility::Get Min-Max Ranges.gvi
  Keithley 2450 NXG Library::Public::Utility::Get Trigger Block List.gvi
  Keithley 2450 NXG Library::Public::Utility::Map Event Id to Bit number in Operation Event Register.gvi
  Keithley 2450 NXG Library::Public::Utility::Map Event Id to Bit number in Questionable Event Register.gvi
  Keithley 2450 NXG Library::Public::Utility::Preset Status.gvi
  Keithley 2450 NXG Library::Public::Utility::Read Operation Condition Register.gvi
  Keithley 2450 NXG Library::Public::Utility::Read Operation Event Register Status.gvi
  Keithley 2450 NXG Library::Public::Data::Low Level::Send Software Trigger.gvi
  Keithley 2450 NXG Library::Public::Data::Low Level::Wait for Operation Complete.gvi
  Keithley 2450 NXG Library::Public::Configure::Configure Brightness of Display.gvi
  Keithley 2450 NXG Library::Public::Configure::Configure Digits for Display.gvi
  Keithley 2450 NXG Library::Public::Configure::Configure Reading Format of Display.gvi
  Keithley 2450 NXG Library::Public::Configure::Get System Access Permission.gvi
  Keithley 2450 NXG Library::Public::Configure::Create Configuration List.gvi
  Keithley 2450 NXG Library::Public::Utility::Read Operation Event Register.gvi
  Keithley 2450 NXG Library::Public::Utility::Read Questionable Condition Register.gvi
  Keithley 2450 NXG Library::Public::Utility::Read Questionable Event Register Status.gvi
  Keithley 2450 NXG Library::Public::Utility::Read Questionable Event Register.gvi
  Keithley 2450 NXG Library::Public::Configure::Delete Configuration List.gvi
  Keithley 2450 NXG Library::Public::Configure::Enable Logging.gvi
  Keithley 2450 NXG Library::Public::Configure::Get Time.gvi
  Keithley 2450 NXG Library::Public::Configure::Get GPIB Address.gvi
  Keithley 2450 NXG Library::Public::Configure::Get Line Frequency.gvi
  Keithley 2450 NXG Library::Public::Utility::Reset.gvi
  Keithley 2450 NXG Library::Public::Utility::Revision Query.gvi
  Keithley 2450 NXG Library::Public::Utility::Select Active Terminals.gvi
  Keithley 2450 NXG Library::Public::Utility::Selected Range Query.gvi
  Keithley 2450 NXG Library::Public::Configure::Get Log State.gvi
  Keithley 2450 NXG Library::Public::Configure::Get Version.gvi
  Keithley 2450 NXG Library::Public::Configure::Getting Powered ON Setup.gvi
  Keithley 2450 NXG Library::Public::Utility::Recall Configuration List.gvi
  Keithley 2450 NXG Library::Public::Configure::Save Message from Event Log.gvi
  Keithley 2450 NXG Library::Public::Configure::Set Absolute Time.gvi
  Keithley 2450 NXG Library::Public::Configure::Set GPIB Address.gvi
  Keithley 2450 NXG Library::Public::Configure::Setting Powered ON Setup.gvi
  Keithley 2450 NXG Library::Public::Configure::Store Configuration List.gvi
  Keithley 2450 NXG Library::Public::Configure::Configure Linear Mode Sweep.gvi
  Keithley 2450 NXG Library::Public::Configure::Configure Linear Step Mode Sweep.gvi
  Keithley 2450 NXG Library::Public::Configure::Configure Log Mode Sweep.gvi
  Keithley 2450 NXG Library::Public::Configure::Configure Filter.gvi
  Keithley 2450 NXG Library::Public::Configure::Configure List Mode Sweep.gvi
  Keithley 2450 NXG Library::Public::Configure::Configure Trigger Model Branch Counter Block.gvi
  Keithley 2450 NXG Library::Public::Configure::Append Buffer to File in the USB.gvi
  Keithley 2450 NXG Library::Public::Configure::Clear Buffer Statistics.gvi
  Keithley 2450 NXG Library::Public::Configure::Clear Buffer.gvi
  Keithley 2450 NXG Library::Public::Configure::Delete User Buffer.gvi
  Keithley 2450 NXG Library::Public::Configure::Configure Autozero Once.gvi
  Keithley 2450 NXG Library::Public::Configure::Configure Autozero.gvi
  Keithley 2450 NXG Library::Public::Configure::Configure Integration Filter.gvi
  Keithley 2450 NXG Library::Public::Configure::Clear Trigger timer.gvi
  Keithley 2450 NXG Library::Public::Configure::Configure Trigger Model Always Block.gvi
  Keithley 2450 NXG Library::Public::Configure::Configure Trigger Model Blender Mode.gvi
  Keithley 2450 NXG Library::Public::Configure::Configure Trigger Model Buffer Clear Block.gvi
  Keithley 2450 NXG Library::Public::Configure::Configure Trigger Model Clear Blender.gvi
  Keithley 2450 NXG Library::Public::Configure::Configure Trigger Model Clear Digital Input Line.gvi
  Keithley 2450 NXG Library::Public::Configure::Configure Trigger Model Clear LAN.gvi
  Keithley 2450 NXG Library::Public::Configure::Create User Buffer.gvi
  Keithley 2450 NXG Library::Public::Configure::Get Buffer Filling Mode.gvi
  Keithley 2450 NXG Library::Public::Configure::Get Buffer Size.gvi
  Keithley 2450 NXG Library::Public::Configure::Get Byte Order.gvi
  Keithley 2450 NXG Library::Public::Configure::Configure Output List.gvi
  Keithley 2450 NXG Library::Public::Configure::Configure Output Off Behavior.gvi
  Keithley 2450 NXG Library::Public::Configure::Configure Output Sweep.gvi
  Keithley 2450 NXG Library::Public::Configure::Configure Output.gvi
  Keithley 2450 NXG Library::Public::Configure::Configure Limit Test Auto Clear.gvi
  Keithley 2450 NXG Library::Public::Configure::Configure Limit Test Clear.gvi
  Keithley 2450 NXG Library::Public::Configure::Configure Limit Test Lower Limit.gvi
  Keithley 2450 NXG Library::Public::Configure::Enable Limit Test.gvi
  Keithley 2450 NXG Library::Public::Configure::Configure Trigger Model Configuration List Next Index Block.gvi
  Keithley 2450 NXG Library::Public::Configure::Configure Trigger Model Configuration List Previous index Block.gvi
  Keithley 2450 NXG Library::Public::Configure::Configure Trigger Model Constant Delay Block.gvi
  Keithley 2450 NXG Library::Public::Configure::Configure Trigger Model Delta Block.gvi
  Keithley 2450 NXG Library::Public::Configure::Get Data Format.gvi
  Keithley 2450 NXG Library::Public::Configure::Save Buffer to File in the USB.gvi
  Keithley 2450 NXG Library::Public::Configure::Set Buffer Filling Mode.gvi
  Keithley 2450 NXG Library::Public::Configure::Set Buffer Size.gvi
  Keithley 2450 NXG Library::Public::Configure::Configure Over Voltage Protection.gvi
  Keithley 2450 NXG Library::Public::Configure::Configure Source Function.gvi
  Keithley 2450 NXG Library::Public::Configure::Configure Source Level.gvi
  Keithley 2450 NXG Library::Public::Configure::Configure Source Limit Level.gvi
  Keithley 2450 NXG Library::Public::Configure::Configure Limit Test Upper Limit.gvi
  Keithley 2450 NXG Library::Public::Configure::Configure Math.gvi
  Keithley 2450 NXG Library::Public::Configure::Configure Measurement Auto Range Lower Limit.gvi
  Keithley 2450 NXG Library::Public::Configure::Configure Measurement Auto Range Upper Limit.gvi
  Keithley 2450 NXG Library::Public::Configure::Configure Source Range.gvi
  Keithley 2450 NXG Library::Public::Configure::Enable High Capacitance.gvi
  Keithley 2450 NXG Library::Public::Configure::Enable Source Auto Range.gvi
  Keithley 2450 NXG Library::Public::Configure::Enable Source Read Back.gvi
  Keithley 2450 NXG Library::Public::Configure::Configure Trigger Model Digital Input Mode.gvi
  Keithley 2450 NXG Library::Public::Configure::Configure Trigger Model Digital Output Mode.gvi
  Keithley 2450 NXG Library::Public::Configure::Configure Trigger Model Digital Output Pulse Width.gvi
  Keithley 2450 NXG Library::Public::Configure::Configure Trigger Model LAN IP Address.gvi
  Keithley 2450 NXG Library::Public::Configure::Configure Byte Order.gvi
  Keithley 2450 NXG Library::Public::Configure::Configure Measurement Manual Range.gvi
  Keithley 2450 NXG Library::Public::Configure::Configure Measurement Range.gvi
  Keithley 2450 NXG Library::Public::Configure::Configure Offset Compensation.gvi
  Keithley 2450 NXG Library::Public::Configure::Configure Measurement Function.gvi
  Keithley 2450 NXG Library::Public::Configure::Configure Trigger Model LAN Output Logic Mode.gvi
  Keithley 2450 NXG Library::Public::Configure::Configure Trigger Model LAN Output Protocol.gvi
  Keithley 2450 NXG Library::Public::Configure::Configure Trigger Model LAN Trigger Mode.gvi
  Keithley 2450 NXG Library::Public::Configure::Configure Trigger Model Measure Block.gvi
  Keithley 2450 NXG Library::Public::Configure::Get High Capacitance State.gvi
  Keithley 2450 NXG Library::Public::Configure::Get Interlock Status.gvi
  Keithley 2450 NXG Library::Public::Configure::Get Source Auto Delay State.gvi
  Keithley 2450 NXG Library::Public::Configure::Get Source Auto Range.gvi
  Keithley 2450 NXG Library::Public::Configure::Configure Settling Delay.gvi
  Keithley 2450 NXG Library::Public::Configure::Configure Specific Limit Test.gvi
  Keithley 2450 NXG Library::Public::Configure::Configure Unit of Current.gvi
  Keithley 2450 NXG Library::Public::Configure::Configure Relative Offset.gvi
  Keithley 2450 NXG Library::Public::Configure::Configure Trigger Model Once Block.gvi
  Keithley 2450 NXG Library::Public::Configure::Configure Trigger Model Once Excluded Block.gvi
  Keithley 2450 NXG Library::Public::Configure::Configure Trigger Model Recall Configuration List Block.gvi
  Keithley 2450 NXG Library::Public::Configure::Configure Trigger Model Source Output Block.gvi
  Keithley 2450 NXG Library::Public::Configure::Get Source Configuration List Catalog.gvi
  Keithley 2450 NXG Library::Public::Configure::Get Source Configuration List Settings.gvi
  Keithley 2450 NXG Library::Public::Configure::Get Source Configuration List Size.gvi
  Keithley 2450 NXG Library::Public::Configure::Get Source Delay.gvi
  Keithley 2450 NXG Library::Public::Configure::Configure Unit of Voltage.gvi
  Keithley 2450 NXG Library::Public::Configure::Enable Math Operation.gvi
  Keithley 2450 NXG Library::Public::Configure::Enable Measurement Auto Range.gvi
  Keithley 2450 NXG Library::Public::Configure::Get Limit Test Enabled State.gvi
  Keithley 2450 NXG Library::Public::Configure::Configure Trigger Model.gvi
  Keithley 2450 NXG Library::Public::Configure::Get Trigger Model Blender Mode.gvi
  Keithley 2450 NXG Library::Public::Configure::Get Trigger Model Blender Overrun Status.gvi
  Keithley 2450 NXG Library::Public::Configure::Get Trigger Model Digital Input Mode.gvi
  Keithley 2450 NXG Library::Public::Configure::Get Source Function.gvi
  Keithley 2450 NXG Library::Public::Configure::Get Source Level.gvi
  Keithley 2450 NXG Library::Public::Configure::Get Source Limit.gvi
  Keithley 2450 NXG Library::Public::Configure::Get Source List Points.gvi
  Keithley 2450 NXG Library::Public::Configure::Get Limit Test Upper Limit.gvi
  Keithley 2450 NXG Library::Public::Configure::Get Measure Configuration List Catalog.gvi
  Keithley 2450 NXG Library::Public::Configure::Get Measure Configuration List Settings.gvi
  Keithley 2450 NXG Library::Public::Configure::Get Limit Test Lower Limit.gvi
  Keithley 2450 NXG Library::Public::Configure::Get Trigger Model Digital Output Mode.gvi
  Keithley 2450 NXG Library::Public::Configure::Get Trigger Model Digital Output Pulse Width.gvi
  Keithley 2450 NXG Library::Public::Configure::Get Trigger Model Digital Overrun Status.gvi
  Keithley 2450 NXG Library::Public::Configure::Get Trigger Model LAN Input Logic Mode.gvi
  Keithley 2450 NXG Library::Public::Configure::Get Over Voltage Protection State.gvi
  Keithley 2450 NXG Library::Public::Configure::Get Source Range.gvi
  Keithley 2450 NXG Library::Public::Configure::Get Source User Delay.gvi
  Keithley 2450 NXG Library::Public::Configure::Get Source Read Back State.gvi
  Keithley 2450 NXG Library::Public::Configure::Get Measurement Auto Range Lower Limit.gvi
  Keithley 2450 NXG Library::Public::Configure::Get Measurement Auto Range.gvi
  Keithley 2450 NXG Library::Public::Configure::Get Measurement Count.gvi
  Keithley 2450 NXG Library::Public::Configure::Get Measure Configuration List Size.gvi
  Keithley 2450 NXG Library::Public::Configure::Get Trigger Model LAN IP Address.gvi
  Keithley 2450 NXG Library::Public::Configure::Get Trigger Model LAN Mode.gvi
  Keithley 2450 NXG Library::Public::Configure::Get Trigger Model LAN Output Logic Mode.gvi
  Keithley 2450 NXG Library::Public::Configure::Get Trigger Model LAN Output Protocol.gvi
  Keithley 2450 NXG Library::Public::Configure::Get Measurement Manual Range.gvi
  Keithley 2450 NXG Library::Public::Configure::Get Measure User Delay.gvi
  Keithley 2450 NXG Library::Public::Configure::Set Measurement Count.gvi
  Keithley 2450 NXG Library::Public::Configure::Get Measurement Function.gvi
  Keithley 2450 NXG Library::Public::Configure::Configure Contact Check.gvi
  Keithley 2450 NXG Library::Public::Configure::Get Conact Check State.gvi
  Keithley 2450 NXG Library::Public::Configure::Configure Pulse Limit.gvi
  Keithley 2450 NXG Library::Public::Configure::Set Pulse Amplitude.gvi
  Keithley 2450 NXG Library::Public::Configure::Get Trigger Model LAN Overrun Status.gvi
  Keithley 2450 NXG Library::Public::Configure::Get Trigger Model State.gvi
  Keithley 2450 NXG Library::Public::Configure::Get Trigger Timer Count.gvi
  Keithley 2450 NXG Library::Public::Configure::Get Trigger Timer Delay.gvi
  Keithley 2450 NXG Library::Public::Configure::Configure Pulse Train.gvi
  Keithley 2450 NXG Library::Public::Configure::Configure Pulse Sweep.gvi
  Keithley 2450 NXG Library::Public::Configure::Configure Pulse List Sweep.gvi
  Keithley 2450 NXG Library::Public::Configure::Digitizer Sample Rate.gvi
  Keithley 2450 NXG Library::Public::Configure::Digitizer Aperture.gvi
  Keithley 2450 NXG Library::Public::Configure::Digitizer Voltage Units.gvi
  Keithley 2450 NXG Library::Public::Configure::Digitizer Current Units.gvi
  Keithley 2450 NXG Library::Public::Configure::Get Trigger Timer Overrun Status.gvi
  Keithley 2450 NXG Library::Public::Configure::Get Trigger Timer State.gvi
  Keithley 2450 NXG Library::Public::Configure::Set Trigger Timer Count.gvi
  Keithley 2450 NXG Library::Public::Configure::Set Trigger Timer Delay.gvi
  Keithley 2450 NXG Library::Public::Configure::Set Trigger Timer State.gvi
  Keithley 2450 NXG Library::Public::Configure::Enable LAN Connect State.gvi
  Keithley 2450 NXG Library::Public::Configure::Get LAN Connect State.gvi
  Keithley 2450 NXG Library::Public::Utility::Calibrate Adjust Sense Data Query.gvi
  Keithley 2450 NXG Library::Public::Utility::Calibrate Adjust Sense.gvi
  Keithley 2450 NXG Library::Public::Utility::Calibrate Adjust Source Data Query.gvi
  Keithley 2450 NXG Library::Public::Utility::Calibrate Adjust Source.gvi
  Keithley 2450 NXG Library::Public::Utility::Calibration Adjust Count Query.gvi
  Keithley 2450 NXG Library::Public::Utility::Calibration Adjust Date Query.gvi
  Keithley 2450 NXG Library::Public::Utility::Calibration Adjust Date.gvi
  Keithley 2450 NXG Library::Public::Utility::Calibration Lock.gvi
  Keithley 2450 NXG Library::Public::Utility::Calibration Unlock.gvi
  Keithley 2450 NXG Library::Public::Utility::Calibration Password.gvi
  Keithley 2450 NXG Library::Public::Utility::Calibration Save.gvi
  Keithley 2450 NXG Library::Public::Utility::Calibration Verify Date.gvi
  Keithley 2450 NXG Library::Public::Utility::Calibration Verify Date Query.gvi
diagram:
  # Initialize
  call "Initialize.gvi"()
  # Close
  call "Close.gvi"()
  call "Create Math Operation.gvi"()
  # Data
  call "Fetch Read Buffer Statistics.gvi"()
  call "Get Number of Readings in the Buffer.gvi"()
  call "Make Reading and Store in Buffer.gvi"()
  # Action-Status
  call "Enable Output.gvi"()
  call "Enable Remote Sensing.gvi"()
  call "Get Digital IO Pins Mode.gvi"()
  call "Get Digital IO Pins State.gvi"()
  call "Query Limit Test Data.gvi"()
  # Utility
  call "Clear Display.gvi"()
  call "Clear System Event Log.gvi"()
  call "Set Display Screen.gvi"()
  call "In Compliance Query.gvi"()
  call "Read all Digital IO Pins.gvi"()
  call "Set Digital IO Mode.gvi"()
  call "Read (Multiple Points).gvi"()
  call "Read (Single Point).gvi"()
  call "Read (Digitize).gvi"()
  call "Display Message.gvi"()
  call "Emit Beep.gvi"()
  call "Enable Operation Event Register.gvi"()
  call "Enable Questionable Event Register.gvi"()
  call "Set or Reset Digital IO Pins.gvi"()
  call "Write to all Digital IO Pins.gvi"()
  call "Error Query.gvi"()
  call "Get Active Terminals.gvi"()
  call "Self-Test.gvi"()
  call "Get Event Id Mapped to Bit Number in Operation Event Register.gvi"()
  call "Fetch (Measurements).gvi"()
  call "Measure Lowlevel.gvi"()
  # Data, Low Level
  call "Abort.gvi"()
  call "Initiate.gvi"()
  call "Get Event Id Mapped to Bit Number in Questionable Event Register.gvi"()
  call "Get Min-Max Ranges.gvi"()
  call "Get Trigger Block List.gvi"()
  call "Map Event Id to Bit number in Operation Event Register.gvi"()
  call "Map Event Id to Bit number in Questionable Event Register.gvi"()
  call "Preset Status.gvi"()
  call "Read Operation Condition Register.gvi"()
  call "Read Operation Event Register Status.gvi"()
  call "Send Software Trigger.gvi"()
  call "Wait for Operation Complete.gvi"()
  # Configure
  call "Configure Brightness of Display.gvi"()
  call "Configure Digits for Display.gvi"()
  call "Configure Reading Format of Display.gvi"()
  call "Get System Access Permission.gvi"()
  call "Create Configuration List.gvi"()
  call "Read Operation Event Register.gvi"()
  call "Read Questionable Condition Register.gvi"()
  call "Read Questionable Event Register Status.gvi"()
  call "Read Questionable Event Register.gvi"()
  call "Delete Configuration List.gvi"()
  call "Enable Logging.gvi"()
  call "Get Time.gvi"()
  call "Get GPIB Address.gvi"()
  call "Get Line Frequency.gvi"()
  call "Reset.gvi"()
  call "Revision Query.gvi"()
  call "Select Active Terminals.gvi"()
  call "Selected Range Query.gvi"()
  call "Get Log State.gvi"()
  call "Get System Access Permission.gvi"()
  call "Get Version.gvi"()
  call "Getting Powered ON Setup.gvi"()
  call "Recall Configuration List.gvi"()
  call "Save Message from Event Log.gvi"()
  call "Set Absolute Time.gvi"()
  call "Set GPIB Address.gvi"()
  call "Setting Powered ON Setup.gvi"()
  call "Store Configuration List.gvi"()
  # Configure, Source
  call "Configure Linear Mode Sweep.gvi"()
  call "Configure Linear Step Mode Sweep.gvi"()
  call "Configure Log Mode Sweep.gvi"()
  call "Configure Filter.gvi"()
  call "Configure List Mode Sweep.gvi"()
  call "Configure Trigger Model Branch Counter Block.gvi"()
  # Configure, Buffer
  call "Append Buffer to File in the USB.gvi"()
  call "Clear Buffer Statistics.gvi"()
  call "Clear Buffer.gvi"()
  call "Delete User Buffer.gvi"()
  # Configure, Measure
  call "Configure Autozero Once.gvi"()
  call "Configure Autozero.gvi"()
  call "Configure Integration Filter.gvi"()
  # Configure, Trigger
  call "Clear Trigger timer.gvi"()
  call "Configure Trigger Model Always Block.gvi"()
  call "Configure Trigger Model Blender Mode.gvi"()
  call "Configure Trigger Model Buffer Clear Block.gvi"()
  call "Configure Trigger Model Clear Blender.gvi"()
  call "Configure Trigger Model Clear Digital Input Line.gvi"()
  call "Configure Trigger Model Clear LAN.gvi"()
  call "Create User Buffer.gvi"()
  call "Get Buffer Filling Mode.gvi"()
  call "Get Buffer Size.gvi"()
  call "Get Byte Order.gvi"()
  call "Configure Output List.gvi"()
  call "Configure Output Off Behavior.gvi"()
  call "Configure Output Sweep.gvi"()
  call "Configure Output.gvi"()
  call "Configure Limit Test Auto Clear.gvi"()
  call "Configure Limit Test Clear.gvi"()
  call "Configure Limit Test Lower Limit.gvi"()
  call "Enable Limit Test.gvi"()
  call "Configure Trigger Model Configuration List Next Index Block.gvi"()
  call "Configure Trigger Model Configuration List Previous index Block.gvi"()
  call "Configure Trigger Model Constant Delay Block.gvi"()
  call "Configure Trigger Model Delta Block.gvi"()
  call "Get Data Format.gvi"()
  call "Save Buffer to File in the USB.gvi"()
  call "Set Buffer Filling Mode.gvi"()
  call "Set Buffer Size.gvi"()
  call "Configure Over Voltage Protection.gvi"()
  call "Configure Source Function.gvi"()
  call "Configure Source Level.gvi"()
  call "Configure Source Limit Level.gvi"()
  call "Configure Limit Test Upper Limit.gvi"()
  call "Configure Math.gvi"()
  call "Configure Measurement Auto Range Lower Limit.gvi"()
  call "Configure Measurement Auto Range Upper Limit.gvi"()
  call "Configure Source Range.gvi"()
  call "Enable High Capacitance.gvi"()
  call "Enable Source Auto Range.gvi"()
  call "Enable Source Read Back.gvi"()
  call "Configure Trigger Model Digital Input Mode.gvi"()
  call "Configure Trigger Model Digital Output Mode.gvi"()
  call "Configure Trigger Model Digital Output Pulse Width.gvi"()
  call "Configure Trigger Model LAN IP Address.gvi"()
  call "Configure Byte Order.gvi"()
  call "Configure Measurement Manual Range.gvi"()
  call "Configure Measurement Range.gvi"()
  call "Configure Offset Compensation.gvi"()
  call "Configure Measurement Function.gvi"()
  call "Configure Trigger Model LAN Output Logic Mode.gvi"()
  call "Configure Trigger Model LAN Output Protocol.gvi"()
  call "Configure Trigger Model LAN Trigger Mode.gvi"()
  call "Configure Trigger Model Measure Block.gvi"()
  call "Get High Capacitance State.gvi"()
  call "Get Interlock Status.gvi"()
  call "Get Source Auto Delay State.gvi"()
  call "Get Source Auto Range.gvi"()
  call "Configure Settling Delay.gvi"()
  call "Configure Specific Limit Test.gvi"()
  call "Configure Unit of Current.gvi"()
  call "Configure Relative Offset.gvi"()
  call "Configure Trigger Model Once Block.gvi"()
  call "Configure Trigger Model Once Excluded Block.gvi"()
  call "Configure Trigger Model Recall Configuration List Block.gvi"()
  call "Configure Trigger Model Source Output Block.gvi"()
  call "Get Source Configuration List Catalog.gvi"()
  call "Get Source Configuration List Settings.gvi"()
  call "Get Source Configuration List Size.gvi"()
  call "Get Source Delay.gvi"()
  call "Configure Unit of Voltage.gvi"()
  call "Enable Math Operation.gvi"()
  call "Enable Measurement Auto Range.gvi"()
  call "Get Limit Test Enabled State.gvi"()
  call "Configure Trigger Model.gvi"()
  call "Get Trigger Model Blender Mode.gvi"()
  call "Get Trigger Model Blender Overrun Status.gvi"()
  call "Get Trigger Model Digital Input Mode.gvi"()
  call "Get Source Function.gvi"()
  call "Get Source Level.gvi"()
  call "Get Source Limit.gvi"()
  call "Get Source List Points.gvi"()
  call "Get Limit Test Upper Limit.gvi"()
  call "Get Measure Configuration List Catalog.gvi"()
  call "Get Measure Configuration List Settings.gvi"()
  call "Get Limit Test Lower Limit.gvi"()
  call "Get Trigger Model Digital Output Mode.gvi"()
  call "Get Trigger Model Digital Output Pulse Width.gvi"()
  call "Get Trigger Model Digital Overrun Status.gvi"()
  call "Get Trigger Model LAN Input Logic Mode.gvi"()
  call "Get Over Voltage Protection State.gvi"()
  call "Get Source Range.gvi"()
  call "Get Source User Delay.gvi"()
  call "Get Source Read Back State.gvi"()
  call "Get Measurement Auto Range Lower Limit.gvi"()
  call "Get Measurement Auto Range.gvi"()
  call "Get Measurement Count.gvi"()
  call "Get Measure Configuration List Size.gvi"()
  call "Get Trigger Model LAN IP Address.gvi"()
  call "Get Trigger Model LAN Mode.gvi"()
  call "Get Trigger Model LAN Output Logic Mode.gvi"()
  call "Get Trigger Model LAN Output Protocol.gvi"()
  call "Get Measurement Manual Range.gvi"()
  call "Get Measure User Delay.gvi"()
  call "Set Measurement Count.gvi"()
  call "Get Measurement Function.gvi"()
  # 2461 Specific VIs
  call "Configure Contact Check.gvi"()
  call "Get Conact Check State.gvi"()
  call "Configure Pulse Limit.gvi"()
  call "Set Pulse Amplitude.gvi"()
  call "Get Trigger Model LAN Overrun Status.gvi"()
  call "Get Trigger Model State.gvi"()
  call "Get Trigger Timer Count.gvi"()
  call "Get Trigger Timer Delay.gvi"()
  call "Configure Pulse Train.gvi"()
  call "Configure Pulse Sweep.gvi"()
  call "Configure Pulse List Sweep.gvi"()
  # 2461 Specific VIs
  call "Digitizer Sample Rate.gvi"()
  call "Digitizer Aperture.gvi"()
  call "Digitizer Voltage Units.gvi"()
  call "Digitizer Current Units.gvi"()
  call "Get Trigger Timer Overrun Status.gvi"()
  call "Get Trigger Timer State.gvi"()
  call "Set Trigger Timer Count.gvi"()
  call "Set Trigger Timer Delay.gvi"()
  call "Set Trigger Timer State.gvi"()
  call "Enable LAN Connect State.gvi"()
  call "Get LAN Connect State.gvi"()
  call "Calibrate Adjust Sense Data Query.gvi"()
  # Calibration
  call "Calibrate Adjust Sense.gvi"()
  call "Calibrate Adjust Source Data Query.gvi"()
  call "Calibrate Adjust Source.gvi"()
  call "Calibration Adjust Count Query.gvi"()
  call "Calibration Adjust Date Query.gvi"()
  call "Calibration Adjust Date.gvi"()
  call "Calibration Lock.gvi"()
  call "Calibration Unlock.gvi"()
  call "Calibration Password.gvi"()
  call "Calibration Save.gvi"()
  call "Calibration Verify Date.gvi"()
  call "Calibration Verify Date Query.gvi"()
