vi "TLPM VI Tree.gvi"   [LabVIEW NXG 3.1.0]
# The VI Tree displays all the user-callable VIs of the instrument driver in an organized table.
uses:
  Main::TLPM Initialize.gvi
  Main::TLPM Close.gvi
  Main::TLPM Find Resources.gvi
  Main::TLPM Get Resource Name.gvi
  Main::TLPM Get Resource Information.gvi
  Main::TLPM Write Register.gvi
  Main::TLPM Read Register.gvi
  Main::TLPM Preset Registers.gvi
  Main::TLPM Set Date And Time.gvi
  Main::TLPM Get Date And Time.gvi
  Main::TLPM Set Line Frequency.gvi
  Main::TLPM Get Line Frequency.gvi
  Main::TLPM Get Battery Voltage.gvi
  Main::TLPM Set Display Brightness.gvi
  Main::TLPM Get Display Brightness.gvi
  Main::TLPM Set Display Contrast.gvi
  Main::TLPM Get Display Contrast.gvi
  Main::TLPM Set Photodiode Input Filter State.gvi
  Main::TLPM Get Photodiode Input Filter State.gvi
  Main::TLPM Set Thermopile Accelerator State.gvi
  Main::TLPM Get Thermopile Accelerator State.gvi
  Main::TLPM Set Thermopile Accelerator Mode.gvi
  Main::TLPM Get Thermopile Accelerator Mode.gvi
  Main::TLPM Set Thermopile Accelerator Tau.gvi
  Main::TLPM Get Thermopile Accelerator Tau.gvi
  Main::TLPM Set Custom Sensor Input Adapter Type.gvi
  Main::TLPM Get Custom Sensor Input Adapter Type.gvi
  Main::TLPM Set Average Time.gvi
  Main::TLPM Get Average Time.gvi
  Main::TLPM Set Average Count.gvi
  Main::TLPM Get Average Count.gvi
  Main::TLPM Set Attenuation.gvi
  Main::TLPM Get Attenuation.gvi
  Main::TLPM Start Dark Offset Adjustment.gvi
  Main::TLPM Cancel Dark Adjustment.gvi
  Main::TLPM Get Dark Adjustment State.gvi
  Main::TLPM Get Dark Offset.gvi
  Main::TLPM Set Beam Diameter.gvi
  Main::TLPM Get Beam Diameter.gvi
  Main::TLPM Set Wavelength.gvi
  Main::TLPM Get Wavelength.gvi
  Main::TLPM Set Photodiode Responsivity.gvi
  Main::TLPM Get Photodiode Responsivity.gvi
  Main::TLPM Set Thermopile Responsivity.gvi
  Main::TLPM Get Thermopile Responsivity.gvi
  Main::TLPM Set Pyrosensor Responsivity.gvi
  Main::TLPM Get Pyrosensor Responsivity.gvi
  Main::TLPM Set Current Autorange Mode.gvi
  Main::TLPM Get Current Autorange Mode.gvi
  Main::TLPM Set Current Range.gvi
  Main::TLPM Get Current Range.gvi
  Main::TLPM Set Current Reference.gvi
  Main::TLPM Get Current Reference.gvi
  Main::TLPM Set Current Reference State.gvi
  Main::TLPM Get Current Reference State.gvi
  Main::TLPM Set Energy Range.gvi
  Main::TLPM Get Energy Range.gvi
  Main::TLPM Set Energy Reference.gvi
  Main::TLPM Get Energy Reference.gvi
  Main::TLPM Set Energy Reference State.gvi
  Main::TLPM Get Energy Reference State.gvi
  Main::TLPM Get Frequency Range.gvi
  Main::TLPM Set Power Autorange Mode.gvi
  Main::TLPM Get Power Autorange Mode.gvi
  Main::TLPM Set Power Range.gvi
  Main::TLPM Get Power Range.gvi
  Main::TLPM Set Power Reference.gvi
  Main::TLPM Get Power Reference.gvi
  Main::TLPM Set Power Reference State.gvi
  Main::TLPM Get Power Reference State.gvi
  Main::TLPM Set Power Unit.gvi
  Main::TLPM Get Power Unit.gvi
  Main::TLPM Set Voltage Autorange Mode.gvi
  Main::TLPM Get Voltage Autorange Mode.gvi
  Main::TLPM Set Voltage Range.gvi
  Main::TLPM Get Voltage Range.gvi
  Main::TLPM Set Voltage Reference.gvi
  Main::TLPM Get Voltage Reference.gvi
  Main::TLPM Set Voltage Reference State.gvi
  Main::TLPM Get Voltage Reference State.gvi
  Main::TLPM Set Peak Detector Threshold.gvi
  Main::TLPM Get Peak Detector Threshold.gvi
  Main::TLPM Set External NTC Parameter.gvi
  Main::TLPM Get External NTC Parameter.gvi
  Main::TLPM Measure Current.gvi
  Main::TLPM Measure Voltage.gvi
  Main::TLPM Measure Power.gvi
  Main::TLPM Measure Energy.gvi
  Main::TLPM Measure Power Density.gvi
  Main::TLPM Measure Energy Density.gvi
  Main::TLPM Measure Frequency.gvi
  Main::TLPM Measure Auxiliary AD0 Voltage.gvi
  Main::TLPM Measure Auxiliary AD1 Voltage.gvi
  Main::TLPM Measure Environmental Humidity.gvi
  Main::TLPM Measure Environmental Temperature.gvi
  Main::TLPM Measure External NTC Temperature.gvi
  Main::TLPM Measure External NTC Resistance.gvi
  Main::TLPM Set Digital I  O Direction.gvi
  Main::TLPM Get Digital I  O Direction.gvi
  Main::TLPM Set Digital I  O Output.gvi
  Main::TLPM Get Digital I  O Output.gvi
  Main::TLPM Get Digital I  O Port.gvi
  Main::TLPM Error Message.gvi
  Main::TLPM Error-Query.gvi
  Main::TLPM Reset.gvi
  Main::TLPM Self-Test.gvi
  Main::TLPM Revision Query.gvi
  Main::TLPM Identification Query.gvi
  Main::TLPM Calibration Message.gvi
  Main::TLPM Sensor Information.gvi
  Main::TLPM Error Query Mode.gvi
  Main::TLPM Raw Write To Instrument.gvi
  Main::TLPM Raw Read From Instrument.gvi
  Main::TLPM Set Communication Timeout.gvi
  Main::TLPM Get Communication Timeout.gvi
  Main::TLPM_PowerMeter_Sample.gvi
diagram:
  # Initialize & Close
  call "TLPM Initialize.gvi"()
  call "TLPM Close.gvi"()
  # Resource Functions
  call "TLPM Find Resources.gvi"()
  call "TLPM Get Resource Name.gvi"()
  call "TLPM Get Resource Information.gvi"()
  # Status Register
  # System
  call "TLPM Write Register.gvi"()
  call "TLPM Read Register.gvi"()
  call "TLPM Preset Registers.gvi"()
  # Date Time
  call "TLPM Set Date And Time.gvi"()
  call "TLPM Get Date And Time.gvi"()
  # Line Frequency
  call "TLPM Set Line Frequency.gvi"()
  call "TLPM Get Line Frequency.gvi"()
  # Battery
  call "TLPM Get Battery Voltage.gvi"()
  # Display
  # Measure
  # Configure
  call "TLPM Set Display Brightness.gvi"()
  call "TLPM Get Display Brightness.gvi"()
  call "TLPM Set Display Contrast.gvi"()
  call "TLPM Get Display Contrast.gvi"()
  # Input
  call "TLPM Set Photodiode Input Filter State.gvi"()
  call "TLPM Get Photodiode Input Filter State.gvi"()
  call "TLPM Set Thermopile Accelerator State.gvi"()
  call "TLPM Get Thermopile Accelerator State.gvi"()
  call "TLPM Set Thermopile Accelerator Mode.gvi"()
  call "TLPM Get Thermopile Accelerator Mode.gvi"()
  call "TLPM Set Thermopile Accelerator Tau.gvi"()
  call "TLPM Get Thermopile Accelerator Tau.gvi"()
  call "TLPM Set Custom Sensor Input Adapter Type.gvi"()
  call "TLPM Get Custom Sensor Input Adapter Type.gvi"()
  # Average
  call "TLPM Set Average Time.gvi"()
  call "TLPM Get Average Time.gvi"()
  call "TLPM Set Average Count.gvi"()
  call "TLPM Get Average Count.gvi"()
  # Correction
  call "TLPM Set Attenuation.gvi"()
  call "TLPM Get Attenuation.gvi"()
  call "TLPM Start Dark Offset Adjustment.gvi"()
  call "TLPM Cancel Dark Adjustment.gvi"()
  call "TLPM Get Dark Adjustment State.gvi"()
  call "TLPM Get Dark Offset.gvi"()
  call "TLPM Set Beam Diameter.gvi"()
  call "TLPM Get Beam Diameter.gvi"()
  call "TLPM Set Wavelength.gvi"()
  call "TLPM Get Wavelength.gvi"()
  call "TLPM Set Photodiode Responsivity.gvi"()
  call "TLPM Get Photodiode Responsivity.gvi"()
  call "TLPM Set Thermopile Responsivity.gvi"()
  call "TLPM Get Thermopile Responsivity.gvi"()
  call "TLPM Set Pyrosensor Responsivity.gvi"()
  call "TLPM Get Pyrosensor Responsivity.gvi"()
  # Current Measurement
  call "TLPM Set Current Autorange Mode.gvi"()
  call "TLPM Get Current Autorange Mode.gvi"()
  call "TLPM Set Current Range.gvi"()
  call "TLPM Get Current Range.gvi"()
  call "TLPM Set Current Reference.gvi"()
  call "TLPM Get Current Reference.gvi"()
  call "TLPM Set Current Reference State.gvi"()
  call "TLPM Get Current Reference State.gvi"()
  # Energy Measurement
  call "TLPM Set Energy Range.gvi"()
  call "TLPM Get Energy Range.gvi"()
  call "TLPM Set Energy Reference.gvi"()
  call "TLPM Get Energy Reference.gvi"()
  call "TLPM Set Energy Reference State.gvi"()
  call "TLPM Get Energy Reference State.gvi"()
  # Frequency Measurement
  call "TLPM Get Frequency Range.gvi"()
  # Power Measurement
  call "TLPM Set Power Autorange Mode.gvi"()
  call "TLPM Get Power Autorange Mode.gvi"()
  call "TLPM Set Power Range.gvi"()
  call "TLPM Get Power Range.gvi"()
  call "TLPM Set Power Reference.gvi"()
  call "TLPM Get Power Reference.gvi"()
  call "TLPM Set Power Reference State.gvi"()
  call "TLPM Get Power Reference State.gvi"()
  call "TLPM Set Power Unit.gvi"()
  call "TLPM Get Power Unit.gvi"()
  # Voltage Measurement
  call "TLPM Set Voltage Autorange Mode.gvi"()
  call "TLPM Get Voltage Autorange Mode.gvi"()
  call "TLPM Set Voltage Range.gvi"()
  call "TLPM Get Voltage Range.gvi"()
  call "TLPM Set Voltage Reference.gvi"()
  call "TLPM Get Voltage Reference.gvi"()
  call "TLPM Set Voltage Reference State.gvi"()
  call "TLPM Get Voltage Reference State.gvi"()
  # Peak Detector
  call "TLPM Set Peak Detector Threshold.gvi"()
  call "TLPM Get Peak Detector Threshold.gvi"()
  call "TLPM Set External NTC Parameter.gvi"()
  call "TLPM Get External NTC Parameter.gvi"()
  # External Temperature Sensor
  # Read
  call "TLPM Measure Current.gvi"()
  call "TLPM Measure Voltage.gvi"()
  call "TLPM Measure Power.gvi"()
  call "TLPM Measure Energy.gvi"()
  call "TLPM Measure Power Density.gvi"()
  call "TLPM Measure Energy Density.gvi"()
  call "TLPM Measure Frequency.gvi"()
  call "TLPM Measure Auxiliary AD0 Voltage.gvi"()
  call "TLPM Measure Auxiliary AD1 Voltage.gvi"()
  call "TLPM Measure Environmental Humidity.gvi"()
  call "TLPM Measure Environmental Temperature.gvi"()
  call "TLPM Measure External NTC Temperature.gvi"()
  call "TLPM Measure External NTC Resistance.gvi"()
  # Digital I/O
  call "TLPM Set Digital I  O Direction.gvi"()
  call "TLPM Get Digital I  O Direction.gvi"()
  call "TLPM Set Digital I  O Output.gvi"()
  call "TLPM Get Digital I  O Output.gvi"()
  call "TLPM Get Digital I  O Port.gvi"()
  # Utility Functions
  # Raw I/O
  call "TLPM Error Message.gvi"()
  call "TLPM Error-Query.gvi"()
  call "TLPM Reset.gvi"()
  call "TLPM Self-Test.gvi"()
  call "TLPM Revision Query.gvi"()
  call "TLPM Identification Query.gvi"()
  call "TLPM Calibration Message.gvi"()
  call "TLPM Sensor Information.gvi"()
  call "TLPM Error Query Mode.gvi"()
  call "TLPM Raw Write To Instrument.gvi"()
  call "TLPM Raw Read From Instrument.gvi"()
  # Timeout
  call "TLPM Set Communication Timeout.gvi"()
  call "TLPM Get Communication Timeout.gvi"()
  # Example
  call "TLPM_PowerMeter_Sample.gvi"()
