vi "Move To Position subroutine.gvi"   [LabVIEW NXG 3.1.0]
panel controls:
  "Set position": bool
  "stop": bool
  "Desired Position": i32  # int
panel indicators:
  "Not Homed?": bool
  "Current Position": i32  # int
  "Current Motor Serial nº": string
uses:
  ThorlabsMotionControlKCube::Examples::Scan Available Devices.gvi
  ThorlabsMotionControlKCube::General commands::TLI Initialize Simulations.gvi
  ThorlabsMotionControlKCube::KCube specific commands::CC Open.gvi
  ThorlabsMotionControlKCube::KCube specific commands::CC Needs Homing.gvi
  ThorlabsMotionControlKCube::KCube specific commands::CC Move To Position.gvi
  ThorlabsMotionControlKCube::KCube specific commands::CC Get Position.gvi
  ThorlabsMotionControlKCube::KCube specific commands::CC Close.gvi
  ThorlabsMotionControlKCube::General commands::TLI Uninitialize Simulations.gvi
diagram:
  call "Scan Available Devices.gvi"() -> (Device ID array=w1, Error Out=w2)
  Array Index(array=w1) -> (out0[0]=w3)
  $"Current Motor Serial nº" <- w3
  call "TLI Initialize Simulations.gvi"(error in (no error)=w2) -> (error out=w4)
  call "CC Open.gvi"(serialNo=w3, error in (no error)=w4) -> (error out=w5)
  call "CC Needs Homing.gvi"(serialNo=w3, error in (no error)=w5) -> (function return=w6, error out=w7)
  $"Not Homed?" <- w6
  s1 = w7  # shift register
  while {
    event (timeout = 50) {
      on Timeout {
        Property Node(instance in=reference to "Set position", "Disabled"=FALSE, error in=s1) -> (error out=w10)
        Property Node(instance in=reference to "Desired Position", "Disabled"=FALSE, error in=w10) -> (error out=w8)
        w9 = w3
      }
      on "Set position" Value changed {
        w11 = $"Desired Position"
        call "CC Move To Position.gvi"(serialNo=w3, index=w11, error in (no error)=s1) -> (error out=w12)
        w13 = $"Set position"
        while (after w13) {
          Wait Until Next Multiple(multiple to wait=50)
          Property Node(instance in=reference to "Desired Position", "Disabled"=TRUE, error in=w12) -> (error out=w14)
          Property Node(instance in=reference to "Set position", "Disabled"=TRUE, error in=w14) -> (error out=w15)
          call "CC Get Position.gvi"(serialNo=w3, error in (no error)=w15) -> (function return=w16, error out=w8)
          $"Current Position" <- w16
          Is Equal(x=w16, y=w11) -> w17
          stop if w17
        }
        w9 = w3
      }
    }
    next s1 = w8
    stop if $stop
  }
  call "CC Close.gvi"(serialNo=w9, error in (no error)=s1) -> (error out=w18)
  call "TLI Uninitialize Simulations.gvi"(error in (no error)=w18)
