vi "Scan Available Devices.gvi"   [LabVIEW NXG 3.1.0]
inputs:
  "Error In": error
outputs:
  "Number Of Devices": i16
  "Device ID array": string[]
  "Error Out": error
uses:
  ThorlabsMotionControlKCube::General commands::TLI Initialize Simulations.gvi
  ThorlabsMotionControlKCube::General commands::TLI Build Device List.gvi
  ThorlabsMotionControlKCube::General commands::TLI Get Device List Size.gvi
  ThorlabsMotionControlKCube::General commands::TLI Get Device List Ext.gvi
  ThorlabsMotionControlKCube::Utilities::Device list extractor.gvi
  ThorlabsMotionControlKCube::General commands::TLI Uninitialize Simulations.gvi
diagram:
  # This SubVi detects all the available devices and outputs them on an array
  case ($"Error In") {
    frame Error, Default {
      w1 = $"Error In"
    }
    frame No Error {
      call "TLI Initialize Simulations.gvi"(error in (no error)=$"Error In") -> (error out=w2)
      call "TLI Build Device List.gvi"(error in (no error)=w2) -> (error out=w3)
      call "TLI Get Device List Size.gvi"(error in (no error)=w3) -> (function return=w4, error out=w5)
      $"Number Of Devices" <- w4
      call "TLI Get Device List Ext.gvi"(receiveBuffer="Testbuff", sizeOfBuffer=100, error in (no error)=w5) -> (receiveBuffer out=w6, error out=w7)
      call "Device list extractor.gvi"(Device list array string=w6, Delimiter=",", Error In=w7) -> (Device ID array=w8, Error Out=w9)
      $"Device ID array" <- w8
      call "TLI Uninitialize Simulations.gvi"(error in (no error)=w9) -> (error out=w1)
    }
  }
  $"Error Out" <- w1
