vi "TLI Build Device List.gvi"   [LabVIEW NXG 3.1.0]
# KCUBEDCSERVO_API short __cdecl TLI_BuildDeviceList(void);
inputs:
  "error in (no error)": error
outputs:
  "function return": i16  # short
  "error out": error
uses:
  ThorlabsMotionControlKCube::Utilities::Thorlabs.MotionControl.sli::TLI_BuildDeviceList
  ThorlabsMotionControlKCube::Utilities::Error Converter (ErrCode or Status).gvi
diagram:
  call "TLI_BuildDeviceList"(error in=$"error in (no error)") -> (return=w1, error out=w2)
  # KCUBEDCSERVO_API short __cdecl TLI_BuildDeviceList(void);
  call "Error Converter (ErrCode or Status).gvi"(error code=w1, error in (no error)=w2) -> (error out=w3)
  $"error out" <- w3
  $"function return" <- w1
