vi "TLI Get Device Info.gvi"   [LabVIEW NXG 3.1.0]
# KCUBEDCSERVO_API short __cdecl TLI_GetDeviceInfo(char const * serialNo, TLI_DeviceInfo *info);
inputs:
  "serialNo": string
  "info": T1
  "error in (no error)": error
outputs:
  "function return": i16  # short
  "info out": T1
  "error out": error
types:
  T1 = cluster{"typeID": u32, "description[0]": i8, "description[1]": i8, "description[2]": i8, "description[3]": i8, "description[4]": i8, "description[5]": i8, "description[6]": i8, "description[7]": i8, "description[8]": i8, "description[9]": i8, "description[10]": i8, "description[11]": i8, "description[12]": i8, "description[13]": i8, "description[14]": i8, "description[15]": i8, "description[16]": i8, "description[17]": i8, "description[18]": i8, "description[19]": i8, "description[20]": i8, "description[21]": i8, "description[22]": i8, "description[23]": i8, "description[24]": i8, "description[25]": i8, "description[26]": i8, "description[27]": i8, "description[28]": i8, "description[29]": i8, "description[30]": i8, "description[31]": i8, "description[32]": i8, "description[33]": i8, "description[34]": i8, "description[35]": i8, "description[36]": i8, "description[37]": i8, "description[38]": i8, "description[39]": i8, "description[40]": i8, "description[41]": i8, "description[42]": i8, "description[43]": i8, "description[44]": i8, "description[45]": i8, "description[46]": i8, "description[47]": i8, "description[48]": i8, "description[49]": i8, "description[50]": i8, "description[51]": i8, "description[52]": i8, "description[53]": i8, "description[54]": i8, "description[55]": i8, "description[56]": i8, "description[57]": i8, "description[58]": i8, "description[59]": i8, "description[60]": i8, "description[61]": i8, "description[62]": i8, "description[63]": i8, "description[64]": i8, "serialNo[0]": i8, "serialNo[1]": i8, "serialNo[2]": i8, "serialNo[3]": i8, "serialNo[4]": i8, "serialNo[5]": i8, "serialNo[6]": i8, "serialNo[7]": i8, "serialNo[8]": i8, "serialNo[9]": i8, "serialNo[10]": i8, "serialNo[11]": i8, "serialNo[12]": i8, "serialNo[13]": i8, "serialNo[14]": i8, "serialNo[15]": i8, "PID": u32, "isKnownType": bool, "motorType": u32, "isPiezoDevice": bool, "isLaser": bool, "isCustomType": bool, "isRack": bool, "maxChannels": i16}
uses:
  ThorlabsMotionControlKCube::Utilities::Thorlabs.MotionControl.sli::TLI_GetDeviceInfo
  ThorlabsMotionControlKCube::Utilities::Error Converter (ErrCode or Status).gvi
diagram:
  call "TLI_GetDeviceInfo"(serialNo in=$serialNo, info in=$info, error in=$"error in (no error)") -> (return=w1, info out=w2, error out=w3)
  # KCUBEDCSERVO_API short __cdecl TLI_GetDeviceInfo(char const * serialNo, TLI_DeviceInfo *info);
  call "Error Converter (ErrCode or Status).gvi"(error code=w1, error in (no error)=w3) -> (error out=w4)
  $"error out" <- w4
  $"function return" <- w1
  $"info out" <- w2
