vi "TLI Get Device List By Type Ext.gvi"   [LabVIEW NXG 3.1.0]
# KCUBEDCSERVO_API short __cdecl TLI_GetDeviceListByTypeExt(char *receiveBuffer, DWORD sizeOfBuffer, int typeID);
inputs:
  "receiveBuffer": string
  "sizeOfBuffer": u32  # unsigned long
  "typeID": i32  # int
  "error in (no error)": error
outputs:
  "receiveBuffer out": string
  "function return": i16  # short
  "error out": error
uses:
  ThorlabsMotionControlKCube::Utilities::Thorlabs.MotionControl.sli::TLI_GetDeviceListByTypeExt
  ThorlabsMotionControlKCube::Utilities::Error Converter (ErrCode or Status).gvi
diagram:
  call "TLI_GetDeviceListByTypeExt"(receiveBuffer in=$receiveBuffer, sizeOfBuffer in=$sizeOfBuffer, typeID in=$typeID, error in=$"error in (no error)") -> (return=w1, receiveBuffer out=w2, error out=w3)
  # KCUBEDCSERVO_API short __cdecl TLI_GetDeviceListByTypeExt(char *receiveBuffer, DWORD sizeOfBuffer, int typeID);
  $"function return" <- w1
  $"receiveBuffer out" <- w2
  call "Error Converter (ErrCode or Status).gvi"(error code=w1, error in (no error)=w3) -> (error out=w4)
  $"error out" <- w4
