vi "TLI Get Device List By Types Ext.gvi"   [LabVIEW NXG 3.1.0]
# KCUBEDCSERVO_API short __cdecl TLI_GetDeviceListByTypesExt(char *receiveBuffer, DWORD sizeOfBuffer, int * typeIDs, int length);
inputs:
  "receiveBuffer": string
  "sizeOfBuffer": u32  # unsigned long
  "typeIDs": i32  # int
  "error in (no error)": error
  "length": i32  # int
outputs:
  "receiveBuffer out": string
  "function return": i16  # short
  "typeIDs out": i32  # int
  "error out": error
uses:
  ThorlabsMotionControlKCube::Utilities::Thorlabs.MotionControl.sli::TLI_GetDeviceListByTypesExt
  ThorlabsMotionControlKCube::Utilities::Error Converter (ErrCode or Status).gvi
diagram:
  call "TLI_GetDeviceListByTypesExt"(receiveBuffer in=$receiveBuffer, sizeOfBuffer in=$sizeOfBuffer, typeIDs in=$typeIDs, length in=$length, error in=$"error in (no error)") -> (return=w1, receiveBuffer out=w2, typeIDs out=w3, error out=w4)
  # KCUBEDCSERVO_API short __cdecl TLI_GetDeviceListByTypesExt(char *receiveBuffer, DWORD sizeOfBuffer, int * typeIDs, int length);
  call "Error Converter (ErrCode or Status).gvi"(error code=w1, error in (no error)=w4) -> (error out=w5)
  $"error out" <- w5
  $"function return" <- w1
  $"receiveBuffer out" <- w2
  $"typeIDs out" <- w3
