vi "TLI Get Device List Ext.gvi"   [LabVIEW NXG 3.1.0]
# KCUBEDCSERVO_API short __cdecl TLI_GetDeviceListExt(char *receiveBuffer, DWORD sizeOfBuffer);
inputs:
  "receiveBuffer": string
  "sizeOfBuffer": u32  # unsigned long
  "error in (no error)": error
outputs:
  "receiveBuffer out": string
  "function return": i16  # short
  "error out": error
uses:
  ThorlabsMotionControlKCube::Utilities::Thorlabs.MotionControl.sli::TLI_GetDeviceListExt
  ThorlabsMotionControlKCube::Utilities::Error Converter (ErrCode or Status).gvi
diagram:
  call "TLI_GetDeviceListExt"(receiveBuffer in=$receiveBuffer, sizeOfBuffer in=$sizeOfBuffer, error in=$"error in (no error)") -> (return=w1, receiveBuffer out=w2, error out=w3)
  # KCUBEDCSERVO_API short __cdecl TLI_GetDeviceListExt(char *receiveBuffer, DWORD sizeOfBuffer);
  call "Error Converter (ErrCode or Status).gvi"(error code=w1, error in (no error)=w3) -> (error out=w4)
  $"error out" <- w4
  $"function return" <- w1
  $"receiveBuffer out" <- w2
