vi "TLI Initialize Simulations.gvi"   [LabVIEW NXG 3.1.0]
# KCUBEDCSERVO_API void __cdecl TLI_InitializeSimulations();
inputs:
  "error in (no error)": error
outputs:
  "error out": error
uses:
  ThorlabsMotionControlKCube::Utilities::Thorlabs.MotionControl.sli::TLI_InitializeSimulations
  ThorlabsMotionControlKCube::Utilities::Error Converter (ErrCode or Status).gvi
diagram:
  call "TLI_InitializeSimulations"(error in=$"error in (no error)") -> (error out=w1)
  # KCUBEDCSERVO_API void __cdecl TLI_InitializeSimulations();
  call "Error Converter (ErrCode or Status).gvi"(error in (no error)=w1) -> (error out=w2)
  $"error out" <- w2
