vi "CC Enable Last Msg Timer.gvi"   [LabVIEW NXG 3.1.0]
# KCUBEDCSERVO_API void __cdecl CC_EnableLastMsgTimer(char const * serialNo, bool enable, __int32 lastMsgTimeout);
inputs:
  "serialNo": string
  "enable": bool
  "lastMsgTimeout": i32  # __int32
  "error in (no error)": error
outputs:
  "error out": error
uses:
  ThorlabsMotionControlKCube::Utilities::Thorlabs.MotionControl.sli::CC_EnableLastMsgTimer
  ThorlabsMotionControlKCube::Utilities::Error Converter (ErrCode or Status).gvi
diagram:
  Boolean To Integer(Boolean=$enable) -> (0, 1=w1)
  call "CC_EnableLastMsgTimer"(serialNo in=$serialNo, enable in=w1, lastMsgTimeout in=$lastMsgTimeout, error in=$"error in (no error)") -> (error out=w2)
  # KCUBEDCSERVO_API void __cdecl CC_EnableLastMsgTimer(char const * serialNo, bool enable, __int32 lastMsgTimeout);
  call "Error Converter (ErrCode or Status).gvi"(error in (no error)=w2) -> (error out=w3)
  $"error out" <- w3
