vi "CC Get Device Unit From Real Value.gvi"   [LabVIEW NXG 3.1.0]
# KCUBEDCSERVO_API short __cdecl CC_GetDeviceUnitFromRealValue(char const * serialNo, double real_unit, int *device_unit, int unitType);
inputs:
  "serialNo": string
  "real_unit": f64  # double
  "device_unit": i32  # int
  "error in (no error)": error
  "unitType": i32  # int
outputs:
  "function return": i16  # short
  "device_unit out": i32  # int
  "error out": error
uses:
  ThorlabsMotionControlKCube::Utilities::Thorlabs.MotionControl.sli::CC_GetDeviceUnitFromRealValue
  ThorlabsMotionControlKCube::Utilities::Error Converter (ErrCode or Status).gvi
diagram:
  call "CC_GetDeviceUnitFromRealValue"(serialNo in=$serialNo, real_unit in=$real_unit, device_unit in=$device_unit, unitType in=$unitType, error in=$"error in (no error)") -> (return=w1, device_unit out=w2, error out=w3)
  # KCUBEDCSERVO_API short __cdecl CC_GetDeviceUnitFromRealValue(char const * serialNo, double real_unit, int *device_unit, int unitType);
  call "Error Converter (ErrCode or Status).gvi"(error code=w1, error in (no error)=w3) -> (error out=w4)
  $"error out" <- w4
  $"function return" <- w1
  $"device_unit out" <- w2
