vi "CC Get Digital Outputs.gvi"   [LabVIEW NXG 3.1.0]
# KCUBEDCSERVO_API byte __cdecl CC_GetDigitalOutputs(char const * serialNo);
inputs:
  "serialNo": string
  "error in (no error)": error
outputs:
  "function return": u8  # unsigned char
  "error out": error
uses:
  ThorlabsMotionControlKCube::Utilities::Thorlabs.MotionControl.sli::CC_GetDigitalOutputs
  ThorlabsMotionControlKCube::Utilities::Error Converter (ErrCode or Status).gvi
diagram:
  call "CC_GetDigitalOutputs"(serialNo in=$serialNo, error in=$"error in (no error)") -> (return=w1, error out=w2)
  # KCUBEDCSERVO_API byte __cdecl CC_GetDigitalOutputs(char const * serialNo);
  call "Error Converter (ErrCode or Status).gvi"(error code=w1, error in (no error)=w2) -> (error out=w3)
  $"error out" <- w3
  $"function return" <- w1
