vi "CC Get Hardware Info Block.gvi"   [LabVIEW NXG 3.1.0]
# KCUBEDCSERVO_API short __cdecl CC_GetHardwareInfoBlock(char const * serialNo, TLI_HardwareInformation *hardwareInfo);
inputs:
  "serialNo": string
  "hardwareInfo": T1
  "error in (no error)": error
outputs:
  "function return": i16  # short
  "hardwareInfo out": T1
  "error out": error
types:
  T1 = cluster{"serialNumber": u32, "modelNumber[0]": i8, "modelNumber[1]": i8, "modelNumber[2]": i8, "modelNumber[3]": i8, "modelNumber[4]": i8, "modelNumber[5]": i8, "modelNumber[6]": i8, "modelNumber[7]": i8, "type": u16, "firmwareVersion": u32, "notes[0]": i8, "notes[1]": i8, "notes[2]": i8, "notes[3]": i8, "notes[4]": i8, "notes[5]": i8, "notes[6]": i8, "notes[7]": i8, "notes[8]": i8, "notes[9]": i8, "notes[10]": i8, "notes[11]": i8, "notes[12]": i8, "notes[13]": i8, "notes[14]": i8, "notes[15]": i8, "notes[16]": i8, "notes[17]": i8, "notes[18]": i8, "notes[19]": i8, "notes[20]": i8, "notes[21]": i8, "notes[22]": i8, "notes[23]": i8, "notes[24]": i8, "notes[25]": i8, "notes[26]": i8, "notes[27]": i8, "notes[28]": i8, "notes[29]": i8, "notes[30]": i8, "notes[31]": i8, "notes[32]": i8, "notes[33]": i8, "notes[34]": i8, "notes[35]": i8, "notes[36]": i8, "notes[37]": i8, "notes[38]": i8, "notes[39]": i8, "notes[40]": i8, "notes[41]": i8, "notes[42]": i8, "notes[43]": i8, "notes[44]": i8, "notes[45]": i8, "notes[46]": i8, "notes[47]": i8, "deviceDependantData[0]": u8, "deviceDependantData[1]": u8, "deviceDependantData[2]": u8, "deviceDependantData[3]": u8, "deviceDependantData[4]": u8, "deviceDependantData[5]": u8, "deviceDependantData[6]": u8, "deviceDependantData[7]": u8, "deviceDependantData[8]": u8, "deviceDependantData[9]": u8, "deviceDependantData[10]": u8, "deviceDependantData[11]": u8, "hardwareVersion": u16, "modificationState": u16, "numChannels": i16}
uses:
  ThorlabsMotionControlKCube::Utilities::Thorlabs.MotionControl.sli::CC_GetHardwareInfoBlock
  ThorlabsMotionControlKCube::Utilities::Error Converter (ErrCode or Status).gvi
diagram:
  call "CC_GetHardwareInfoBlock"(serialNo in=$serialNo, hardwareInfo in=$hardwareInfo, error in=$"error in (no error)") -> (return=w1, hardwareInfo out=w2, error out=w3)
  # KCUBEDCSERVO_API short __cdecl CC_GetHardwareInfoBlock(char const * serialNo, TLI_HardwareInformation *hardwareInfo);
  call "Error Converter (ErrCode or Status).gvi"(error code=w1, error in (no error)=w3) -> (error out=w4)
  $"error out" <- w4
  $"function return" <- w1
  $"hardwareInfo out" <- w2
