vi "CC Get Hardware Info.gvi"   [LabVIEW NXG 3.1.0]
# KCUBEDCSERVO_API short __cdecl CC_GetHardwareInfo(char const * serialNo, char * modelNo, DWORD sizeOfModelNo, WORD * type, WORD * numChannels,
# &emsp&emspchar * notes, DWORD sizeOfNotes, DWORD * firmwareVersion, WORD * hardwareVersion, WORD * modificationState);
inputs:
  "hardwareVersion": u16  # unsigned short
  "serialNo": string
  "modelNo": string
  "sizeOfModelNo": u32  # unsigned long
  "type": u16  # unsigned short
  "numChannels": u16  # unsigned short
  "notes": string
  "sizeOfNotes": u32  # unsigned long
  "error in (no error)": error
  "firmwareVersion": u32  # unsigned long
  "modificationState": u16  # unsigned short
outputs:
  "hardwareVersion out": u16  # unsigned short
  "function return": i16  # short
  "modelNo out": string
  "type out": u16  # unsigned short
  "numChannels out": u16  # unsigned short
  "notes out": string
  "error out": error
  "modificationState out": u16  # unsigned short
  "firmwareVersion out": u32  # unsigned long
uses:
  ThorlabsMotionControlKCube::Utilities::Thorlabs.MotionControl.sli::CC_GetHardwareInfo
  ThorlabsMotionControlKCube::Utilities::Error Converter (ErrCode or Status).gvi
diagram:
  call "CC_GetHardwareInfo"(serialNo in=$serialNo, modelNo in=$modelNo, sizeOfModelNo in=$sizeOfModelNo, type in=$type, numChannels in=$numChannels, notes in=$notes, sizeOfNotes in=$sizeOfNotes, firmwareVersion in=$firmwareVersion, hardwareVersion in=$hardwareVersion, modificationState in=$modificationState, error in=$"error in (no error)") -> (return=w1, modelNo out=w2, type out=w3, numChannels out=w4, notes out=w5, firmwareVersion out=w6, hardwareVersion out=w7, modificationState out=w8, error out=w9)
  # KCUBEDCSERVO_API short __cdecl CC_GetHardwareInfo(char const * serialNo, char * modelNo, DWORD sizeOfModelNo, WORD * type, WORD * numChannels,
  # 		char * notes, DWORD sizeOfNotes, DWORD * firmwareVersion, WORD * hardwareVersion, WORD * modificationState);
  $"modelNo out" <- w2
  $"type out" <- w3
  $"numChannels out" <- w4
  $"notes out" <- w5
  call "Error Converter (ErrCode or Status).gvi"(error code=w1, error in (no error)=w9) -> (error out=w10)
  $"error out" <- w10
  $"firmwareVersion out" <- w6
  $"hardwareVersion out" <- w7
  $"function return" <- w1
  $"modificationState out" <- w8
