vi "CC Get Jog Vel Params.gvi"   [LabVIEW NXG 3.1.0]
# KCUBEDCSERVO_API short __cdecl CC_GetJogVelParams(char const * serialNo, int * acceleration, int * maxVelocity);
inputs:
  "serialNo": string
  "acceleration": i32  # int
  "maxVelocity": i32  # int
  "error in (no error)": error
outputs:
  "function return": i16  # short
  "acceleration out": i32  # int
  "maxVelocity out": i32  # int
  "error out": error
uses:
  ThorlabsMotionControlKCube::Utilities::Thorlabs.MotionControl.sli::CC_GetJogVelParams
  ThorlabsMotionControlKCube::Utilities::Error Converter (ErrCode or Status).gvi
diagram:
  call "CC_GetJogVelParams"(serialNo in=$serialNo, acceleration in=$acceleration, maxVelocity in=$maxVelocity, error in=$"error in (no error)") -> (return=w1, acceleration out=w2, maxVelocity out=w3, error out=w4)
  # KCUBEDCSERVO_API short __cdecl CC_GetJogVelParams(char const * serialNo, int * acceleration, int * maxVelocity);
  call "Error Converter (ErrCode or Status).gvi"(error code=w1, error in (no error)=w4) -> (error out=w5)
  $"error out" <- w5
  $"function return" <- w1
  $"acceleration out" <- w2
  $"maxVelocity out" <- w3
