vi "CC Get Motor Params Ext.gvi"   [LabVIEW NXG 3.1.0]
# KCUBEDCSERVO_API short __cdecl CC_GetMotorParamsExt(char const * serialNo, double *stepsPerRev, double *gearBoxRatio, double *pitch);
inputs:
  "serialNo": string
  "stepsPerRev": f64  # double
  "gearBoxRatio": f64  # double
  "error in (no error)": error
  "pitch": f64  # double
outputs:
  "function return": i16  # short
  "stepsPerRev out": f64  # double
  "gearBoxRatio out": f64  # double
  "error out": error
  "pitch out": f64  # double
uses:
  ThorlabsMotionControlKCube::Utilities::Thorlabs.MotionControl.sli::CC_GetMotorParamsExt
  ThorlabsMotionControlKCube::Utilities::Error Converter (ErrCode or Status).gvi
diagram:
  call "CC_GetMotorParamsExt"(serialNo in=$serialNo, stepsPerRev in=$stepsPerRev, gearBoxRatio in=$gearBoxRatio, pitch in=$pitch, error in=$"error in (no error)") -> (return=w1, stepsPerRev out=w2, gearBoxRatio out=w3, pitch out=w4, error out=w5)
  # KCUBEDCSERVO_API short __cdecl CC_GetMotorParamsExt(char const * serialNo, double *stepsPerRev, double *gearBoxRatio, double *pitch);
  call "Error Converter (ErrCode or Status).gvi"(error code=w1, error in (no error)=w5) -> (error out=w6)
  $"error out" <- w6
  $"function return" <- w1
  $"stepsPerRev out" <- w2
  $"gearBoxRatio out" <- w3
  $"pitch out" <- w4
