vi "CC Get Motor Params.gvi"   [LabVIEW NXG 3.1.0]
# KCUBEDCSERVO_API short __cdecl CC_GetMotorParams(char const * serialNo, long *stepsPerRev, long *gearBoxRatio, float *pitch);
inputs:
  "serialNo": string
  "stepsPerRev": i32  # long
  "gearBoxRatio": i32  # long
  "error in (no error)": error
  "pitch": f32  # float
outputs:
  "function return": i16  # short
  "stepsPerRev out": i32  # long
  "gearBoxRatio out": i32  # long
  "error out": error
  "pitch out": f32  # float
uses:
  ThorlabsMotionControlKCube::Utilities::Thorlabs.MotionControl.sli::CC_GetMotorParams
  ThorlabsMotionControlKCube::Utilities::Error Converter (ErrCode or Status).gvi
diagram:
  call "CC_GetMotorParams"(serialNo in=$serialNo, stepsPerRev in=$stepsPerRev, gearBoxRatio in=$gearBoxRatio, pitch in=$pitch, error in=$"error in (no error)") -> (return=w1, stepsPerRev out=w2, gearBoxRatio out=w3, pitch out=w4, error out=w5)
  # KCUBEDCSERVO_API short __cdecl CC_GetMotorParams(char const * serialNo, long *stepsPerRev, long *gearBoxRatio, float *pitch);
  call "Error Converter (ErrCode or Status).gvi"(error code=w1, error in (no error)=w5) -> (error out=w6)
  $"error out" <- w6
  $"function return" <- w1
  $"stepsPerRev out" <- w2
  $"gearBoxRatio out" <- w3
  $"pitch out" <- w4
