vi "CC Get Motor Travel Limits.gvi"   [LabVIEW NXG 3.1.0]
# KCUBEDCSERVO_API short __cdecl CC_GetMotorTravelLimits(char const * serialNo, double *minPosition, double *maxPosition);
inputs:
  "serialNo": string
  "minPosition": f64  # double
  "maxPosition": f64  # double
  "error in (no error)": error
outputs:
  "function return": i16  # short
  "minPosition out": f64  # double
  "maxPosition out": f64  # double
  "error out": error
uses:
  ThorlabsMotionControlKCube::Utilities::Thorlabs.MotionControl.sli::CC_GetMotorTravelLimits
  ThorlabsMotionControlKCube::Utilities::Error Converter (ErrCode or Status).gvi
diagram:
  call "CC_GetMotorTravelLimits"(serialNo in=$serialNo, minPosition in=$minPosition, maxPosition in=$maxPosition, error in=$"error in (no error)") -> (return=w1, minPosition out=w2, maxPosition out=w3, error out=w4)
  # KCUBEDCSERVO_API short __cdecl CC_GetMotorTravelLimits(char const * serialNo, double *minPosition, double *maxPosition);
  call "Error Converter (ErrCode or Status).gvi"(error code=w1, error in (no error)=w4) -> (error out=w5)
  $"error out" <- w5
  $"function return" <- w1
  $"minPosition out" <- w2
  $"maxPosition out" <- w3
