vi "CC Get Motor Velocity Limits.gvi"   [LabVIEW NXG 3.1.0]
# KCUBEDCSERVO_API short __cdecl CC_GetMotorVelocityLimits(char const * serialNo, double *maxVelocity, double *maxAcceleration);
inputs:
  "serialNo": string
  "maxVelocity": f64  # double
  "maxAcceleration": f64  # double
  "error in (no error)": error
outputs:
  "function return": i16  # short
  "maxVelocity out": f64  # double
  "maxAcceleration out": f64  # double
  "error out": error
uses:
  ThorlabsMotionControlKCube::Utilities::Thorlabs.MotionControl.sli::CC_GetMotorVelocityLimits
  ThorlabsMotionControlKCube::Utilities::Error Converter (ErrCode or Status).gvi
diagram:
  call "CC_GetMotorVelocityLimits"(serialNo in=$serialNo, maxVelocity in=$maxVelocity, maxAcceleration in=$maxAcceleration, error in=$"error in (no error)") -> (return=w1, maxVelocity out=w2, maxAcceleration out=w3, error out=w4)
  # KCUBEDCSERVO_API short __cdecl CC_GetMotorVelocityLimits(char const * serialNo, double *maxVelocity, double *maxAcceleration);
  call "Error Converter (ErrCode or Status).gvi"(error code=w1, error in (no error)=w4) -> (error out=w5)
  $"error out" <- w5
  $"function return" <- w1
  $"maxVelocity out" <- w2
  $"maxAcceleration out" <- w3
