vi "CC Get Move Absolute Position.gvi"   [LabVIEW NXG 3.1.0]
# KCUBEDCSERVO_API int __cdecl CC_GetMoveAbsolutePosition(const char * serialNo);
inputs:
  "serialNo": string
  "error in (no error)": error
outputs:
  "function return": i32  # int
  "error out": error
uses:
  ThorlabsMotionControlKCube::Utilities::Thorlabs.MotionControl.sli::CC_GetMoveAbsolutePosition
  ThorlabsMotionControlKCube::Utilities::Error Converter (ErrCode or Status).gvi
diagram:
  call "CC_GetMoveAbsolutePosition"(serialNo in=$serialNo, error in=$"error in (no error)") -> (return=w1, error out=w2)
  # KCUBEDCSERVO_API int __cdecl CC_GetMoveAbsolutePosition(const char * serialNo);
  call "Error Converter (ErrCode or Status).gvi"(error code=w1, error in (no error)=w2) -> (error out=w3)
  $"error out" <- w3
  $"function return" <- w1
