vi "CC Get Real Value From Device Unit.gvi"   [LabVIEW NXG 3.1.0]
# KCUBEDCSERVO_API short __cdecl CC_GetRealValueFromDeviceUnit(char const * serialNo, int device_unit, double *real_unit, int unitType);
inputs:
  "serialNo": string
  "device_unit": i32  # int
  "real_unit": f64  # double
  "error in (no error)": error
  "unitType": i32  # int
outputs:
  "function return": i16  # short
  "real_unit out": f64  # double
  "error out": error
uses:
  ThorlabsMotionControlKCube::Utilities::Thorlabs.MotionControl.sli::CC_GetRealValueFromDeviceUnit
  ThorlabsMotionControlKCube::Utilities::Error Converter (ErrCode or Status).gvi
diagram:
  call "CC_GetRealValueFromDeviceUnit"(serialNo in=$serialNo, device_unit in=$device_unit, real_unit in=$real_unit, unitType in=$unitType, error in=$"error in (no error)") -> (return=w1, real_unit out=w2, error out=w3)
  # KCUBEDCSERVO_API short __cdecl CC_GetRealValueFromDeviceUnit(char const * serialNo, int device_unit, double *real_unit, int unitType);
  call "Error Converter (ErrCode or Status).gvi"(error code=w1, error in (no error)=w3) -> (error out=w4)
  $"error out" <- w4
  $"function return" <- w1
  $"real_unit out" <- w2
