vi "CC Get Status Bits.gvi"   [LabVIEW NXG 3.1.0]
# KCUBEDCSERVO_API DWORD __cdecl CC_GetStatusBits(char const * serialNo);
inputs:
  "serialNo": string
  "error in (no error)": error
outputs:
  "function return": u32  # unsigned long
  "error out": error
uses:
  ThorlabsMotionControlKCube::Utilities::Thorlabs.MotionControl.sli::CC_GetStatusBits
  ThorlabsMotionControlKCube::Utilities::Error Converter (ErrCode or Status).gvi
diagram:
  call "CC_GetStatusBits"(serialNo in=$serialNo, error in=$"error in (no error)") -> (return=w1, error out=w2)
  # KCUBEDCSERVO_API DWORD __cdecl CC_GetStatusBits(char const * serialNo);
  call "Error Converter (ErrCode or Status).gvi"(error code=w1, error in (no error)=w2) -> (error out=w3)
  $"error out" <- w3
  $"function return" <- w1
