vi "CC Get Trigger Params Params Block.gvi"   [LabVIEW NXG 3.1.0]
# KCUBEDCSERVO_API short __cdecl CC_GetTriggerParamsParamsBlock(char const * serialNo, KMOT_TriggerParams *triggerParamsParams);
inputs:
  "serialNo": string
  "triggerParamsParams": T1
  "error in (no error)": error
outputs:
  "function return": i16  # short
  "triggerParamsParams out": T1
  "error out": error
types:
  T1 = cluster{"TriggerStartPositionFwd": i32, "TriggerIntervalFwd": i32, "TriggerPulseCountFwd": i32, "TriggerStartPositionRev": i32, "TriggerIntervalRev": i32, "TriggerPulseCountRev": i32, "TriggerPulseWidth": i32, "CycleCount": i32, "reserved[0]": i32, "reserved[1]": i32, "reserved[2]": i32, "reserved[3]": i32, "reserved[4]": i32, "reserved[5]": i32}
uses:
  ThorlabsMotionControlKCube::Utilities::Thorlabs.MotionControl.sli::CC_GetTriggerParamsParamsBlock
  ThorlabsMotionControlKCube::Utilities::Error Converter (ErrCode or Status).gvi
diagram:
  call "CC_GetTriggerParamsParamsBlock"(serialNo in=$serialNo, triggerParamsParams in=$triggerParamsParams, error in=$"error in (no error)") -> (return=w1, triggerParamsParams out=w2, error out=w3)
  # KCUBEDCSERVO_API short __cdecl CC_GetTriggerParamsParamsBlock(char const * serialNo, KMOT_TriggerParams *triggerParamsParams);
  call "Error Converter (ErrCode or Status).gvi"(error code=w1, error in (no error)=w3) -> (error out=w4)
  $"error out" <- w4
  $"function return" <- w1
  $"triggerParamsParams out" <- w2
