vi "CC Get Trigger Params Params.gvi"   [LabVIEW NXG 3.1.0]
# KCUBEDCSERVO_API  short __cdecl CC_GetTriggerParamsParams(char const * serialNo, __int32 *triggerStartPositionFwd, __int32 *triggerIntervalFwd, __int32 *triggerPulseCountFwd,
# &emsp&emsp__int32 *triggerStartPositionRev, __int32 *triggerIntervalRev, __int32 *triggerPulseCountRev,
# &emsp&emsp__int32 *triggerPulseWidth, __int32 *cycleCount);
inputs:
  "cycleCount": i32  # __int32
  "serialNo": string
  "triggerStartPositionFwd": i32  # __int32
  "triggerIntervalFwd": i32  # __int32
  "triggerPulseCountFwd": i32  # __int32
  "triggerStartPositionRev": i32  # __int32
  "triggerIntervalRev": i32  # __int32
  "triggerPulseCountRev": i32  # __int32
  "error in (no error)": error
  "triggerPulseWidth": i32  # __int32
outputs:
  "cycleCount out": i32  # __int32
  "function return": i16  # short
  "triggerStartPositionFwd out": i32  # __int32
  "triggerIntervalFwd out": i32  # __int32
  "triggerPulseCountFwd out": i32  # __int32
  "triggerStartPositionRev out": i32  # __int32
  "triggerIntervalRev out": i32  # __int32
  "triggerPulseCountRev out": i32  # __int32
  "error out": error
  "triggerPulseWidth out": i32  # __int32
uses:
  ThorlabsMotionControlKCube::Utilities::Thorlabs.MotionControl.sli::CC_GetTriggerParamsParams
  ThorlabsMotionControlKCube::Utilities::Error Converter (ErrCode or Status).gvi
diagram:
  call "CC_GetTriggerParamsParams"(serialNo in=$serialNo, triggerStartPositionFwd in=$triggerStartPositionFwd, triggerIntervalFwd in=$triggerIntervalFwd, triggerPulseCountFwd in=$triggerPulseCountFwd, triggerStartPositionRev in=$triggerStartPositionRev, triggerIntervalRev in=$triggerIntervalRev, triggerPulseCountRev in=$triggerPulseCountRev, triggerPulseWidth in=$triggerPulseWidth, cycleCount in=$cycleCount, error in=$"error in (no error)") -> (return=w1, triggerStartPositionFwd out=w2, triggerIntervalFwd out=w3, triggerPulseCountFwd out=w4, triggerStartPositionRev out=w5, triggerIntervalRev out=w6, triggerPulseCountRev out=w7, triggerPulseWidth out=w8, cycleCount out=w9, error out=w10)
  # KCUBEDCSERVO_API  short __cdecl CC_GetTriggerParamsParams(char const * serialNo, __int32 *triggerStartPositionFwd, __int32 *triggerIntervalFwd, __int32 *triggerPulseCountFwd,
  # 		__int32 *triggerStartPositionRev, __int32 *triggerIntervalRev, __int32 *triggerPulseCountRev,
  # 		__int32 *triggerPulseWidth, __int32 *cycleCount);
  $"function return" <- w1
  $"triggerStartPositionFwd out" <- w2
  call "Error Converter (ErrCode or Status).gvi"(error code=w1, error in (no error)=w10) -> (error out=w11)
  $"error out" <- w11
  $"triggerIntervalFwd out" <- w3
  $"triggerPulseCountFwd out" <- w4
  $"triggerStartPositionRev out" <- w5
  $"triggerIntervalRev out" <- w6
  $"triggerPulseCountRev out" <- w7
  $"triggerPulseWidth out" <- w8
  $"cycleCount out" <- w9
