vi "CC Has Last Msg Timer Overrun.gvi"   [LabVIEW NXG 3.1.0]
# KCUBEDCSERVO_API bool __cdecl CC_HasLastMsgTimerOverrun(char const * serialNo);
inputs:
  "serialNo": string
  "error in (no error)": error
outputs:
  "function return": bool
  "error out": error
uses:
  ThorlabsMotionControlKCube::Utilities::Thorlabs.MotionControl.sli::CC_HasLastMsgTimerOverrun
  ThorlabsMotionControlKCube::Utilities::Error Converter (ErrCode or Status).gvi
diagram:
  call "CC_HasLastMsgTimerOverrun"(serialNo in=$serialNo, error in=$"error in (no error)") -> (return=w1, error out=w2)
  # KCUBEDCSERVO_API bool __cdecl CC_HasLastMsgTimerOverrun(char const * serialNo);
  call "Error Converter (ErrCode or Status).gvi"(error code=w1, error in (no error)=w2) -> (error out=w3)
  $"error out" <- w3
  Is Not Equal To 0(x=w1) -> w4
  $"function return" <- w4
