vi "CC Set DCPID Params.gvi"   [LabVIEW NXG 3.1.0]
# KCUBEDCSERVO_API short __cdecl CC_SetDCPIDParams(const char * serialNo, MOT_DC_PIDParameters *DCproportionalIntegralDerivativeParams);
inputs:
  "serialNo": string
  "DCproportionalIntegralDerivativeParams": T1
  "error in (no error)": error
outputs:
  "function return": i16  # short
  "DCproportionalIntegralDerivativeParams out": T1
  "error out": error
types:
  T1 = cluster{"proportionalGain": i32, "integralGain": i32, "differentialGain": i32, "integralLimit": i32, "parameterFilter": u16}
uses:
  ThorlabsMotionControlKCube::Utilities::Thorlabs.MotionControl.sli::CC_SetDCPIDParams
  ThorlabsMotionControlKCube::Utilities::Error Converter (ErrCode or Status).gvi
diagram:
  call "CC_SetDCPIDParams"(serialNo in=$serialNo, DCproportionalIntegralDerivativeParams in=$DCproportionalIntegralDerivativeParams, error in=$"error in (no error)") -> (return=w1, DCproportionalIntegralDerivativeParams out=w2, error out=w3)
  # KCUBEDCSERVO_API short __cdecl CC_SetDCPIDParams(const char * serialNo, MOT_DC_PIDParameters *DCproportionalIntegralDerivativeParams);
  call "Error Converter (ErrCode or Status).gvi"(error code=w1, error in (no error)=w3) -> (error out=w4)
  $"error out" <- w4
  $"function return" <- w1
  $"DCproportionalIntegralDerivativeParams out" <- w2
