vi "CC Set Digital Outputs.gvi"   [LabVIEW NXG 3.1.0]
# KCUBEDCSERVO_API short __cdecl CC_SetDigitalOutputs(char const * serialNo, byte outputsBits);
inputs:
  "serialNo": string
  "outputsBits": u8  # unsigned char
  "error in (no error)": error
outputs:
  "function return": i16  # short
  "error out": error
uses:
  ThorlabsMotionControlKCube::Utilities::Thorlabs.MotionControl.sli::CC_SetDigitalOutputs
  ThorlabsMotionControlKCube::Utilities::Error Converter (ErrCode or Status).gvi
diagram:
  call "CC_SetDigitalOutputs"(serialNo in=$serialNo, outputsBits in=$outputsBits, error in=$"error in (no error)") -> (return=w1, error out=w2)
  # KCUBEDCSERVO_API short __cdecl CC_SetDigitalOutputs(char const * serialNo, byte outputsBits);
  call "Error Converter (ErrCode or Status).gvi"(error code=w1, error in (no error)=w2) -> (error out=w3)
  $"error out" <- w3
  $"function return" <- w1
