vi "CC Set Direction.gvi"   [LabVIEW NXG 3.1.0]
# KCUBEDCSERVO_API void __cdecl CC_SetDirection(char const * serialNo, bool reverse);
inputs:
  "serialNo": string
  "reverse": bool
  "error in (no error)": error
outputs:
  "error out": error
uses:
  ThorlabsMotionControlKCube::Utilities::Thorlabs.MotionControl.sli::CC_SetDirection
  ThorlabsMotionControlKCube::Utilities::Error Converter (ErrCode or Status).gvi
diagram:
  Boolean To Integer(Boolean=$reverse) -> (0, 1=w1)
  call "CC_SetDirection"(serialNo in=$serialNo, reverse in=w1, error in=$"error in (no error)") -> (error out=w2)
  # KCUBEDCSERVO_API void __cdecl CC_SetDirection(char const * serialNo, bool reverse);
  call "Error Converter (ErrCode or Status).gvi"(error in (no error)=w2) -> (error out=w3)
  $"error out" <- w3
