vi "CC Set Front Panel Lock.gvi"   [LabVIEW NXG 3.1.0]
# KCUBEDCSERVO_API short __cdecl  CC_SetFrontPanelLock(char const * serialNo, bool locked);
inputs:
  "serialNo": string
  "locked": bool
  "error in (no error)": error
outputs:
  "function return": i16  # short
  "error out": error
uses:
  ThorlabsMotionControlKCube::Utilities::Thorlabs.MotionControl.sli::CC_SetFrontPanelLock
  ThorlabsMotionControlKCube::Utilities::Error Converter (ErrCode or Status).gvi
diagram:
  Boolean To Integer(Boolean=$locked) -> (0, 1=w1)
  call "CC_SetFrontPanelLock"(serialNo in=$serialNo, locked in=w1, error in=$"error in (no error)") -> (return=w2, error out=w3)
  # KCUBEDCSERVO_API short __cdecl  CC_SetFrontPanelLock(char const * serialNo, bool locked);
  call "Error Converter (ErrCode or Status).gvi"(error code=w2, error in (no error)=w3) -> (error out=w4)
  $"error out" <- w4
  $"function return" <- w2
