vi "CC Set Homing Velocity.gvi"   [LabVIEW NXG 3.1.0]
# KCUBEDCSERVO_API short __cdecl CC_SetHomingVelocity(char const * serialNo, unsigned int velocity);
inputs:
  "serialNo": string
  "velocity": u32  # unsigned int
  "error in (no error)": error
outputs:
  "function return": i16  # short
  "error out": error
uses:
  ThorlabsMotionControlKCube::Utilities::Thorlabs.MotionControl.sli::CC_SetHomingVelocity
  ThorlabsMotionControlKCube::Utilities::Error Converter (ErrCode or Status).gvi
diagram:
  call "CC_SetHomingVelocity"(serialNo in=$serialNo, velocity in=$velocity, error in=$"error in (no error)") -> (return=w1, error out=w2)
  # KCUBEDCSERVO_API short __cdecl CC_SetHomingVelocity(char const * serialNo, unsigned int velocity);
  call "Error Converter (ErrCode or Status).gvi"(error code=w1, error in (no error)=w2) -> (error out=w3)
  $"error out" <- w3
  $"function return" <- w1
