vi "CC Set Jog Vel Params.gvi"   [LabVIEW NXG 3.1.0]
# KCUBEDCSERVO_API short __cdecl CC_SetJogVelParams(char const * serialNo, int acceleration, int maxVelocity);
inputs:
  "serialNo": string
  "acceleration": i32  # int
  "maxVelocity": i32  # int
  "error in (no error)": error
outputs:
  "function return": i16  # short
  "error out": error
uses:
  ThorlabsMotionControlKCube::Utilities::Thorlabs.MotionControl.sli::CC_SetJogVelParams
  ThorlabsMotionControlKCube::Utilities::Error Converter (ErrCode or Status).gvi
diagram:
  call "CC_SetJogVelParams"(serialNo in=$serialNo, acceleration in=$acceleration, maxVelocity in=$maxVelocity, error in=$"error in (no error)") -> (return=w1, error out=w2)
  # KCUBEDCSERVO_API short __cdecl CC_SetJogVelParams(char const * serialNo, int acceleration, int maxVelocity);
  call "Error Converter (ErrCode or Status).gvi"(error code=w1, error in (no error)=w2) -> (error out=w3)
  $"error out" <- w3
  $"function return" <- w1
