vi "CC Set LE Dswitches.gvi"   [LabVIEW NXG 3.1.0]
# KCUBEDCSERVO_API short __cdecl CC_SetLEDswitches(char const * serialNo, WORD LEDswitches);
inputs:
  "serialNo": string
  "LEDswitches": u16  # unsigned short
  "error in (no error)": error
outputs:
  "function return": i16  # short
  "error out": error
uses:
  ThorlabsMotionControlKCube::Utilities::Thorlabs.MotionControl.sli::CC_SetLEDswitches
  ThorlabsMotionControlKCube::Utilities::Error Converter (ErrCode or Status).gvi
diagram:
  call "CC_SetLEDswitches"(serialNo in=$serialNo, LEDswitches in=$LEDswitches, error in=$"error in (no error)") -> (return=w1, error out=w2)
  # KCUBEDCSERVO_API short __cdecl CC_SetLEDswitches(char const * serialNo, WORD LEDswitches);
  call "Error Converter (ErrCode or Status).gvi"(error code=w1, error in (no error)=w2) -> (error out=w3)
  $"error out" <- w3
  $"function return" <- w1
