vi "CC Set Motor Params Ext.gvi"   [LabVIEW NXG 3.1.0]
# KCUBEDCSERVO_API short __cdecl CC_SetMotorParamsExt(char const * serialNo, double stepsPerRev, double gearBoxRatio, double pitch);
inputs:
  "serialNo": string
  "stepsPerRev": f64  # double
  "gearBoxRatio": f64  # double
  "error in (no error)": error
  "pitch": f64  # double
outputs:
  "function return": i16  # short
  "error out": error
uses:
  ThorlabsMotionControlKCube::Utilities::Thorlabs.MotionControl.sli::CC_SetMotorParamsExt
  ThorlabsMotionControlKCube::Utilities::Error Converter (ErrCode or Status).gvi
diagram:
  call "CC_SetMotorParamsExt"(serialNo in=$serialNo, stepsPerRev in=$stepsPerRev, gearBoxRatio in=$gearBoxRatio, pitch in=$pitch, error in=$"error in (no error)") -> (return=w1, error out=w2)
  # KCUBEDCSERVO_API short __cdecl CC_SetMotorParamsExt(char const * serialNo, double stepsPerRev, double gearBoxRatio, double pitch);
  call "Error Converter (ErrCode or Status).gvi"(error code=w1, error in (no error)=w2) -> (error out=w3)
  $"error out" <- w3
  $"function return" <- w1
