vi "CC Set Motor Params.gvi"   [LabVIEW NXG 3.1.0]
# KCUBEDCSERVO_API short __cdecl CC_SetMotorParams(char const * serialNo, long stepsPerRev, long gearBoxRatio, float pitch);
inputs:
  "serialNo": string
  "stepsPerRev": i32  # long
  "gearBoxRatio": i32  # long
  "error in (no error)": error
  "pitch": f32  # float
outputs:
  "function return": i16  # short
  "error out": error
uses:
  ThorlabsMotionControlKCube::Utilities::Thorlabs.MotionControl.sli::CC_SetMotorParams
  ThorlabsMotionControlKCube::Utilities::Error Converter (ErrCode or Status).gvi
diagram:
  call "CC_SetMotorParams"(serialNo in=$serialNo, stepsPerRev in=$stepsPerRev, gearBoxRatio in=$gearBoxRatio, pitch in=$pitch, error in=$"error in (no error)") -> (return=w1, error out=w2)
  # KCUBEDCSERVO_API short __cdecl CC_SetMotorParams(char const * serialNo, long stepsPerRev, long gearBoxRatio, float pitch);
  call "Error Converter (ErrCode or Status).gvi"(error code=w1, error in (no error)=w2) -> (error out=w3)
  $"error out" <- w3
  $"function return" <- w1
