vi "CC Set Motor Travel Limits.gvi"   [LabVIEW NXG 3.1.0]
# KCUBEDCSERVO_API short __cdecl CC_SetMotorTravelLimits(char const * serialNo, double minPosition, double maxPosition);
inputs:
  "serialNo": string
  "minPosition": f64  # double
  "maxPosition": f64  # double
  "error in (no error)": error
outputs:
  "function return": i16  # short
  "error out": error
uses:
  ThorlabsMotionControlKCube::Utilities::Thorlabs.MotionControl.sli::CC_SetMotorTravelLimits
  ThorlabsMotionControlKCube::Utilities::Error Converter (ErrCode or Status).gvi
diagram:
  call "CC_SetMotorTravelLimits"(serialNo in=$serialNo, minPosition in=$minPosition, maxPosition in=$maxPosition, error in=$"error in (no error)") -> (return=w1, error out=w2)
  # KCUBEDCSERVO_API short __cdecl CC_SetMotorTravelLimits(char const * serialNo, double minPosition, double maxPosition);
  call "Error Converter (ErrCode or Status).gvi"(error code=w1, error in (no error)=w2) -> (error out=w3)
  $"error out" <- w3
  $"function return" <- w1
