vi "CC Set Motor Velocity Limits.gvi"   [LabVIEW NXG 3.1.0]
# KCUBEDCSERVO_API short __cdecl CC_SetMotorVelocityLimits(char const * serialNo, double maxVelocity, double maxAcceleration);
inputs:
  "serialNo": string
  "maxVelocity": f64  # double
  "maxAcceleration": f64  # double
  "error in (no error)": error
outputs:
  "function return": i16  # short
  "error out": error
uses:
  ThorlabsMotionControlKCube::Utilities::Thorlabs.MotionControl.sli::CC_SetMotorVelocityLimits
  ThorlabsMotionControlKCube::Utilities::Error Converter (ErrCode or Status).gvi
diagram:
  call "CC_SetMotorVelocityLimits"(serialNo in=$serialNo, maxVelocity in=$maxVelocity, maxAcceleration in=$maxAcceleration, error in=$"error in (no error)") -> (return=w1, error out=w2)
  # KCUBEDCSERVO_API short __cdecl CC_SetMotorVelocityLimits(char const * serialNo, double maxVelocity, double maxAcceleration);
  call "Error Converter (ErrCode or Status).gvi"(error code=w1, error in (no error)=w2) -> (error out=w3)
  $"error out" <- w3
  $"function return" <- w1
