vi "CC Set Rotation Modes.gvi"   [LabVIEW NXG 3.1.0]
# KCUBEDCSERVO_API short __cdecl CC_SetRotationModes(char const * serialNo, MOT_MovementModes mode, MOT_MovementDirections direction);
inputs:
  "serialNo": string
  "mode": u32 = "LinearRange"(0)  # MOT_MovementModes
  "direction": u32 = "Quickest"(0)  # MOT_MovementDirections
  "error in (no error)": error
outputs:
  "function return": i16  # short
  "error out": error
uses:
  ThorlabsMotionControlKCube::Utilities::Thorlabs.MotionControl.sli::CC_SetRotationModes
  ThorlabsMotionControlKCube::Utilities::Error Converter (ErrCode or Status).gvi
diagram:
  call "CC_SetRotationModes"(serialNo in=$serialNo, mode in=$mode, direction in=$direction, error in=$"error in (no error)") -> (return=w1, error out=w2)
  # KCUBEDCSERVO_API short __cdecl CC_SetRotationModes(char const * serialNo, MOT_MovementModes mode, MOT_MovementDirections direction);
  call "Error Converter (ErrCode or Status).gvi"(error code=w1, error in (no error)=w2) -> (error out=w3)
  $"error out" <- w3
  $"function return" <- w1
