vi "CC Set Stage Axis Limits.gvi"   [LabVIEW NXG 3.1.0]
# KCUBEDCSERVO_API short __cdecl CC_SetStageAxisLimits(char const * serialNo, int minPosition, int maxPosition);
inputs:
  "serialNo": string
  "minPosition": i32  # int
  "maxPosition": i32  # int
  "error in (no error)": error
outputs:
  "function return": i16  # short
  "error out": error
uses:
  ThorlabsMotionControlKCube::Utilities::Thorlabs.MotionControl.sli::CC_SetStageAxisLimits
  ThorlabsMotionControlKCube::Utilities::Error Converter (ErrCode or Status).gvi
diagram:
  call "CC_SetStageAxisLimits"(serialNo in=$serialNo, minPosition in=$minPosition, maxPosition in=$maxPosition, error in=$"error in (no error)") -> (return=w1, error out=w2)
  # KCUBEDCSERVO_API short __cdecl CC_SetStageAxisLimits(char const * serialNo, int minPosition, int maxPosition);
  call "Error Converter (ErrCode or Status).gvi"(error code=w1, error in (no error)=w2) -> (error out=w3)
  $"error out" <- w3
  $"function return" <- w1
