vi "CC Set Trigger Params Params.gvi"   [LabVIEW NXG 3.1.0]
# KCUBEDCSERVO_API short __cdecl CC_SetTriggerParamsParams(char const * serialNo, __int32 triggerStartPositionFwd, __int32 triggerIntervalFwd, __int32 triggerPulseCountFwd,
# &emsp&emsp__int32 triggerStartPositionRev, __int32 triggerIntervalRev, __int32 triggerPulseCountRev,
# &emsp&emsp__int32 triggerPulseWidth, __int32 cycleCount);
inputs:
  "triggerIntervalRev": i32  # __int32
  "triggerPulseWidth": i32  # __int32
  "serialNo": string
  "triggerStartPositionFwd": i32  # __int32
  "triggerIntervalFwd": i32  # __int32
  "triggerPulseCountFwd": i32  # __int32
  "error in (no error)": error
  "triggerStartPositionRev": i32  # __int32
  "triggerPulseCountRev": i32  # __int32
  "cycleCount": i32  # __int32
outputs:
  "function return": i16  # short
  "error out": error
uses:
  ThorlabsMotionControlKCube::Utilities::Thorlabs.MotionControl.sli::CC_SetTriggerParamsParams
  ThorlabsMotionControlKCube::Utilities::Error Converter (ErrCode or Status).gvi
diagram:
  call "CC_SetTriggerParamsParams"(serialNo in=$serialNo, triggerStartPositionFwd in=$triggerStartPositionFwd, triggerIntervalFwd in=$triggerIntervalFwd, triggerPulseCountFwd in=$triggerPulseCountFwd, triggerStartPositionRev in=$triggerStartPositionRev, triggerIntervalRev in=$triggerIntervalRev, triggerPulseCountRev in=$triggerPulseCountRev, triggerPulseWidth in=$triggerPulseWidth, cycleCount in=$cycleCount, error in=$"error in (no error)") -> (return=w1, error out=w2)
  # KCUBEDCSERVO_API short __cdecl CC_SetTriggerParamsParams(char const * serialNo, __int32 triggerStartPositionFwd, __int32 triggerIntervalFwd, __int32 triggerPulseCountFwd,
  # 		__int32 triggerStartPositionRev, __int32 triggerIntervalRev, __int32 triggerPulseCountRev,
  # 		__int32 triggerPulseWidth, __int32 cycleCount);
  call "Error Converter (ErrCode or Status).gvi"(error code=w1, error in (no error)=w2) -> (error out=w3)
  $"error out" <- w3
  $"function return" <- w1
