vi "CC Set Vel Params Block.gvi"   [LabVIEW NXG 3.1.0]
# KCUBEDCSERVO_API short __cdecl CC_SetVelParamsBlock(const char * serialNo, MOT_VelocityParameters *velocityParams);
inputs:
  "serialNo": string
  "velocityParams": T1
  "error in (no error)": error
outputs:
  "function return": i16  # short
  "velocityParams out": T1
  "error out": error
types:
  T1 = cluster{"minVelocity": i32, "acceleration": i32, "maxVelocity": i32}
uses:
  ThorlabsMotionControlKCube::Utilities::Thorlabs.MotionControl.sli::CC_SetVelParamsBlock
  ThorlabsMotionControlKCube::Utilities::Error Converter (ErrCode or Status).gvi
diagram:
  call "CC_SetVelParamsBlock"(serialNo in=$serialNo, velocityParams in=$velocityParams, error in=$"error in (no error)") -> (return=w1, velocityParams out=w2, error out=w3)
  # KCUBEDCSERVO_API short __cdecl CC_SetVelParamsBlock(const char * serialNo, MOT_VelocityParameters *velocityParams);
  call "Error Converter (ErrCode or Status).gvi"(error code=w1, error in (no error)=w3) -> (error out=w4)
  $"error out" <- w4
  $"function return" <- w1
  $"velocityParams out" <- w2
