vi "CC Stop Polling.gvi"   [LabVIEW NXG 3.1.0]
# KCUBEDCSERVO_API void __cdecl CC_StopPolling(char const * serialNo);
inputs:
  "serialNo": string
  "error in (no error)": error
outputs:
  "error out": error
uses:
  ThorlabsMotionControlKCube::Utilities::Thorlabs.MotionControl.sli::CC_StopPolling
  ThorlabsMotionControlKCube::Utilities::Error Converter (ErrCode or Status).gvi
diagram:
  call "CC_StopPolling"(serialNo in=$serialNo, error in=$"error in (no error)") -> (error out=w1)
  # KCUBEDCSERVO_API void __cdecl CC_StopPolling(char const * serialNo);
  call "Error Converter (ErrCode or Status).gvi"(error in (no error)=w1) -> (error out=w2)
  $"error out" <- w2
