vi "CC Time Since Last Msg Received.gvi"   [LabVIEW NXG 3.1.0]
# KCUBEDCSERVO_API bool __cdecl CC_TimeSinceLastMsgReceived(char const * serialNo, __int64 &lastUpdateTimeMS);
inputs:
  "serialNo": string
  "lastUpdateTimeMS": i64  # __int64
  "error in (no error)": error
outputs:
  "function return": bool
  "lastUpdateTimeMS out": i64  # __int64
  "error out": error
uses:
  ThorlabsMotionControlKCube::Utilities::Thorlabs.MotionControl.sli::CC_TimeSinceLastMsgReceived
  ThorlabsMotionControlKCube::Utilities::Error Converter (ErrCode or Status).gvi
diagram:
  call "CC_TimeSinceLastMsgReceived"(serialNo in=$serialNo, lastUpdateTimeMS in=$lastUpdateTimeMS, error in=$"error in (no error)") -> (return=w1, lastUpdateTimeMS out=w2, error out=w3)
  # KCUBEDCSERVO_API bool __cdecl CC_TimeSinceLastMsgReceived(char const * serialNo, __int64 &lastUpdateTimeMS);
  call "Error Converter (ErrCode or Status).gvi"(error code=w1, error in (no error)=w3) -> (error out=w4)
  $"error out" <- w4
  Is Not Equal To 0(x=w1) -> w5
  $"function return" <- w5
  $"lastUpdateTimeMS out" <- w2
