vi "CC Wait For Message.gvi"   [LabVIEW NXG 3.1.0]
# KCUBEDCSERVO_API bool __cdecl CC_WaitForMessage(char const * serialNo, WORD * messageType, WORD * messageID, DWORD *messageData);
inputs:
  "serialNo": string
  "messageType": u16  # unsigned short
  "messageID": u16  # unsigned short
  "error in (no error)": error
  "messageData": u32  # unsigned long
outputs:
  "function return": bool
  "messageType out": u16  # unsigned short
  "messageID out": u16  # unsigned short
  "error out": error
  "messageData out": u32  # unsigned long
uses:
  ThorlabsMotionControlKCube::Utilities::Thorlabs.MotionControl.sli::CC_WaitForMessage
  ThorlabsMotionControlKCube::Utilities::Error Converter (ErrCode or Status).gvi
diagram:
  call "CC_WaitForMessage"(serialNo in=$serialNo, messageType in=$messageType, messageID in=$messageID, messageData in=$messageData, error in=$"error in (no error)") -> (return=w1, messageType out=w2, messageID out=w3, messageData out=w4, error out=w5)
  # KCUBEDCSERVO_API bool __cdecl CC_WaitForMessage(char const * serialNo, WORD * messageType, WORD * messageID, DWORD *messageData);
  call "Error Converter (ErrCode or Status).gvi"(error code=w1, error in (no error)=w5) -> (error out=w6)
  $"error out" <- w6
  Is Not Equal To 0(x=w1) -> w7
  $"function return" <- w7
  $"messageType out" <- w2
  $"messageID out" <- w3
  $"messageData out" <- w4
