vi "Device list extractor.gvi"   [LabVIEW NXG 3.1.0]
inputs:
  "Error In": error
  "Device list array string": string
  "Delimiter": string
outputs:
  "Error Out": error
  "Device ID array": string[]
diagram:
  # This subvi converts the string list generated by the thorlabs Kcube library into
  # a manageable array of serial numbers
  case ($"Error In") {
    frame Error, Default {
      w1 = $"Error In"
    }
    frame No Error {
      String Length(string=$"Device list array string") -> (length=w2)
      s1 = ""  # shift register
      for (N = w2) (iteration -> i1) {
        String Subset(length (rest)=1, offset (0)=i1, string=$"Device list array string") -> w4
        Concatenate Strings(s1, w4) -> w5
        Is Equal(x=w4, y=$Delimiter) -> w6
        Select(s=w6, t="", f=w5) -> w7
        append s1 to w3 if w6
        next s1 = w7
      }
      $"Device ID array" <- w3
      w1 = $"Error In"
    }
  }
  $"Error Out" <- w1
