vi "Error Converter (ErrCode or Status).gvi"   [LabVIEW Conversion 3.1.0]
inputs:
  "error code": i32
  "error in (no error)": error
outputs:
  "error out": error
panel controls:
  "string": string = "This error is returned by the shared library function."
uses:
  NI::G Core::Error::Legacy::Error Cluster From Error Code.gvi
diagram:
  case ($"error in (no error)") {
    frame No Error {
      Is Less Than 0(x=$"error code") -> w2
      case (w2) {
        frame False, Default {
          w1 = $"error in (no error)"
        }
        frame True {
          # Replace the error message string below with a call to the shared library function that returns the appropriate error message based on an error code input.
          call "Error Cluster From Error Code.gvi"(error code=$"error code", error message=$string, error in=$"error in (no error)", show call chain?=TRUE) -> (error out=w1)
        }
      }
    }
    frame Error {
      w1 = $"error in (no error)"
    }
  }
  $"error out" <- w1
