vi "Function_2.gvi"   [LabVIEW NXG 5.0.0]
panel controls:
  "selector": bool
  "Combo Box": string
panel indicators:
  "Graph": f64[][]
  "XAxis": i32
  "Ring Constant": i32
  "Value": string
diagram:
  for (N = 10) (iteration -> i1) {
    Increment(x=i1) -> w1
    Property Node(instance in=reference to "Graph", "ActivePlot"=w1) -> ("Plot"=w2, "Label"=w3)
    Is Greater(x=w1, y=5) -> w4
    Format Into String(w1) -> w5
    Property Node(instance in=w2, "Name"=w5, "Visible"=w4) -> ("XAxisIndex"=w6)
    $XAxis <- w6
    Property Node(instance in=w3, "Visible"=w4, "Text"=w5)
  }
  w7 = [[230, 330, 0, 0, 0, 0, 0, 0, 0], [320, 230, 230, 0, 0, 0, 0, 0, 0], [0, 0, 0, 0, 0, 0, 0, 0, 0], [0, 0, 0, 0, 0, 0, 0, 320, 0], [0, 0, 0, 0, 0, 0, 0, 0, 0], [0, 0, 32320, 0, 0, 0, 0, 0, 0], [0, 0, 0, 0, 320, 0, 0, 0, 0], [32, 0, 0, 0, 0, 0, 0, 0, 0], [0, 0, 0, 0, 0, 0, 0, 0, 320]]
  $Graph <- w7
  case ($selector) {
    frame False, Default {
      w8 = "tata"(4)
    }
    frame True {
      w8 = "Red Sweep Closind"(0)
    }
  }
  $"Ring Constant" <- w8
  Property Node(instance in=reference to "Combo Box", "Items"=["test", "test2"]) -> (instance out=w9)
  Property Node(instance in=w9) -> ("Value"=w10)
  $Value <- w10
