vi "Function.gvi"   [LabVIEW NXG 5.0.0]
panel controls:
  "Error In": error
panel indicators:
  "Visa Log": string
  "Found Resources": string[]
  "Error Out": error
  "logical AND": i32
uses:
  NI::VISA::Find Resource (Search Resources).gvi
  Rainbow Measurement Setup::Main Functions::Instruction Queue::Current State::FGV Current State.gvi
  Rainbow Measurement Setup::Side Functions::Global Abort::FGV Global Abort.gvi
  NI::VISA::Open (Instr).gvi
  NI::VISA::Clear (Instr).gvi
  NI::VISA::Read (Instr, String).gvi
  NI::VISA::Close (Instr).gvi
  NI::G Core::Error::Clear Error Cluster.gvi
  LabView_NXG_Thorlabs_PM100::Examples::TLPM_PowerMeter_Sample.gvi
  NI::VISA::Read STB (Instr).gvi
diagram:
  # This loop scans all the VISA found sources and queries them in search for the arduino VISA addresses.
  # Once it finds the desired arduino it outputs the address into the Predefined cluster and the program finishes.
  case ($"Error In") {
    frame Error, Default {
      w1 = $"Error In"
    }
    frame No Error {
      call "Find Resource (Search Resources).gvi"() -> (found resources=w2)
      $"Found Resources" <- w2
      call "FGV Current State.gvi"(Current State Instructions="Set Current Substate", Current Substate="Detecting Arduinos", Error In=$"Error In") -> (Error Out=w3)
      s1 = ""  # shift register
      for {
        w4 = each element of w2
        call "FGV Global Abort.gvi"(Global Abort Instructions="Read Current State", Error In=w3) -> (Global Abort Out=w5, Error Out=w6)
        Search And Replace String(error in (no error)=w6, input string=w4, search string="ASRL") -> (error out=w7, number of replacements=w8)
        Is Not Equal To 0(x=w8) -> w9
        case (w9) {
          frame False, Default {
            w10 = w7
            w11 = ""
            w12 = ""
          }
          frame True {
            call "Open (Instr).gvi"(resource name=w4, error in=w7, open timeout=300) -> (session out=w13, error out=w14)
            call "Clear (Instr).gvi"(session in=w13, error in=w14) -> (session out=w15, error out=w16)
            call "Read (Instr, String).gvi"(session in=w15, error in=w16, byte count=100) -> (session out=w12, error out=w17, read buffer=w11)
            call "Close (Instr).gvi"(session in=w12, error in=w17) -> (error out=w18)
            call "Clear Error Cluster.gvi"(error in=w18) -> (error out=w10)
          }
        }
        Concatenate Strings(w11, s1, "\r") -> w19
        $"Visa Log" <- s1
        Build Cluster(w12, w11) -> w20
        Search And Replace String(error in (no error)=w10, input string=w11, search string="Arduin") -> (error out=w21, number of replacements=w22)
        Search And Replace String(error in (no error)=w21, input string=w11, search string="XZ") -> (error out=w23, number of replacements=w24)
        Is Not Equal To 0(x=w24) -> w25
        Is Not Equal To 0(x=w22) -> w26
        Logical And(w26, w9) -> w27
        Search And Replace String(error in (no error)=w23, input string=w11, search string="Multiplex") -> (error out=w1, number of replacements=w28)
        Is Not Equal To 0(x=w28) -> w29
        next s1 = w19
        stop if w5
      }
      $"Visa Log" <- s1
    }
  }
  $"Error Out" <- w1
  call "TLPM_PowerMeter_Sample.gvi"()
  Logical And(4, 5) -> w30
  $"logical AND" <- w30
  call "Read STB (Instr).gvi"()
