vi "Function_3.gvi"   [LabVIEW NXG 5.0.0]
inputs:
  "1": "EnumSelector reference"
  "2": "StringControl reference"
  "3": "PathSelector reference"
  "4": "ArrayViewer reference"
  "5": "Graph reference"
  "6": "Cluster reference"
  "7": "Cluster reference"
  "8": "PathSelector reference"
  "9": "Cluster reference"
  "10": "Cluster reference"
  "11": "EnumSelector reference"
  "12": "ComboBoxSelector reference"
  "13": "ComboBoxSelector reference"
  "14": "Cluster reference"
  "15": "Cluster reference"
  "16": "Cluster reference"
  "17": "Cluster reference"
diagram:
  Property Node(instance in=$"7")
  Property Node(instance in=$"1")
  Property Node(instance in=$"2")
  Property Node(instance in=$"4")
  Property Node(instance in=$"3")
  Property Node(instance in=$"8")
  Property Node(instance in=$"5")
  Property Node(instance in=$"6")
  Property Node(instance in=$"9")
  Property Node(instance in=$"10")
  Property Node(instance in=$"14")
  Property Node(instance in=$"17")
  Property Node(instance in=$"11")
  Property Node(instance in=$"13")
  Property Node(instance in=$"12")
  Property Node(instance in=$"15")
  Property Node(instance in=$"16")
