vi "Initialize Detect Insturments SbRt.gvi"   [LabVIEW NXG 5.0.0]
inputs:
  "Initialize App Bundle In": "Initialize App Bundle Cluster.gtype"
  "Error In": error
outputs:
  "Initialize App Bundle Out": "Initialize App Bundle Cluster.gtype"
  "Error Out": error
types:
  "All Paths Cluster.gtype" = cluster{"Thorlabs Motor Serial Number File Path": path}
  "Instrument Coms Info.gtype" = cluster{"Arduino Coms Info": "Arduino Detection cluster control.gtype", "Photodetector Names": string[], "Keythley Address": "VISA Instr", "Photodetector Detected?": bool, "Thorlabs Motors Detected?": bool, "Keithley Detected?": bool, "Thorlabs Motors Serial Number": "Thorlabs Motors Serial Number In.gtype", "Photodetector IVI session": "Ivi IviDefault", "Flame ID": string, "Flame Detected?": bool, "Flame Wrapper ID": u64}
  "Debugging Cluster.gtype" = cluster{"Debugging mode?": bool, "Initialize App": bool, "Insturment Debugging": "Insturment Debugging Cluster.gtype"}
  "Initialize App Bundle Cluster.gtype" = cluster{"All Paths": "All Paths Cluster.gtype", "Instrument Coms Info": "Instrument Coms Info.gtype", "Debugging Cluster": "Debugging Cluster.gtype"}
uses:
  Rainbow Measurement Setup::Side Functions::Instrument Control::Debug Cluster Instrument Extractor.gvi
  Rainbow Measurement Setup::Side Functions::Instrument Control::Instrument Detector.gvi
  Rainbow Measurement Setup::Side Functions::Global Abort::FGV Global Abort.gvi
diagram:
  # This SubVI Initializes all the instruments that the Debugging cluster allows to initialize
  case ($"Error In") {
    frame Error, Default {
      w1 = $"Initialize App Bundle In"
      w2 = $"Error In"
    }
    frame No Error {
      Property Node(instance in=$"Initialize App Bundle In") -> ("Debugging Cluster"=w3, instance out=w4)
      call "Debug Cluster Instrument Extractor.gvi"(Debugging Cluster In=w3, Error In=$"Error In") -> (Debuging Cluster Out=w5, Instruments to Detect=w6, Error Out=w7)
      s1 = w7  # shift register
      s2 = w4  # shift register
      for {
        w8 = each element of w6
        Property Node(instance in=s2) -> ("Instrument Coms Info"=w9, instance out=w10)
        call "Instrument Detector.gvi"(Instruments To Detect control=w8, Instrument Addresses In=w9, Error In=s1) -> (Instrument Addresses Out=w11, Error Out=w12)
        Property Node(instance in=w10, "Instrument Coms Info"=w11) -> (instance out=w13)
        call "FGV Global Abort.gvi"(Global Abort Instructions="Read Current State", Error In=w12) -> (Global Abort Out=w14, Error Out=w15)
        next s1 = w15
        next s2 = w13
        stop if w14
      }
      Property Node(instance in=s2, "Debugging Cluster"=w5) -> (instance out=w1)
      w2 = s1
    }
  }
  $"Initialize App Bundle Out" <- w1
  $"Error Out" <- w2
