vi "Instruction Extractor.gvi"   [LabVIEW NXG 3.1.0]
inputs:
  "Error In": error
  "Initialize app subroutine states": "Initialize app subroutine states.gtype" = "Reset Disabled/Enabled Controls", required
outputs:
  "Error Out": error
  "Initialize app States array": "Initialize app subroutine states.gtype"[]
  "SubStates Output Array": string[]
types:
  "Initialize app subroutine states.gtype" = enum{"Reset Disabled/Enabled Controls", "Reset Doubles", "Reset Booleans", "Reset Strings", "Reset Global Variables", "Detect Instruments"}
diagram:
  case ($"Error In") {
    frame Error, Default {
      w1 = $"Error In"
    }
    frame No Error {
      s1 = uninitialised  # shift register
      s2 = $"Error In"  # shift register
      while (iteration -> i1) {
        To Unsigned Word Integer(number=i1) -> w4
        Type Cast(type=$"Initialize app subroutine states", x=w4) -> w5
        Format Into String(errIn=s2, w5) -> (outString=w6, errOut=w7)
        Is Not Equal To 0(x=i1) -> w8
        # This loop runs through the enum and extracts all
        # the elements storing them as an array.
        # It also stores the name of the instructions so that
        # they can be displayed afttewards for debugging purposes
        case (w8) {
          frame False, Default {
            w9 = FALSE
          }
          frame True {
            Is Equal(x=s1, y=w5) -> w9
          }
        }
        Not(x=w9) -> w10
        append w5 to w2 if w10
        append w6 to w3 if w10
        next s1 = w5
        next s2 = w7
        stop if w9
      }
      $"SubStates Output Array" <- w3
      $"Initialize app States array" <- w2
      w1 = s2
    }
  }
  $"Error Out" <- w1
