vi "Arduino Detection Subroutine.gvi"   [LabVIEW NXG 3.1.0]
inputs:
  "Error In": error
  "Prompt Arduinos?": bool = TRUE
outputs:
  "Error Out": error
  "Arduino Detection Cluster Info Out": "Arduino Detection cluster control.gtype"
  "Detected All?": bool
types:
  T1 = cluster{"Element 1": "VISA Instr", "Element 2": string}
  "Arduino Detection cluster control.gtype" = cluster{"XZ Stage Arduino Address": "VISA Instr", "XZ Stage Arduino Detected?": bool, "Multiplexer Arduino Detected?": bool, "Multiplexer Arduino Address": "VISA Instr", "Arduinos List": T1[]}
uses:
  Rainbow Measurement Setup::Main Functions::Initialize App::Instrument Detection::Arduino::Arduino Detector.gvi
  Rainbow Measurement Setup::Main Functions::Initialize App::Instrument Detection::Arduino::Arduino initialize check connection prompt generator.gvi
diagram:
  # This is the subroutine to detect all the arduinos. It basically scans for arduinos and prompts the
  # user to reconnect them in case they have not been detected.
  case ($"Error In") {
    frame Error, Default {
      w1 = $"Error In"
    }
    frame No Error {
      while (iteration -> i1) {
        call "Arduino Detector.gvi"(Error In=$"Error In") -> (Arduino Detection info Out=w2, Error Out=w3)
        call "Arduino initialize check connection prompt generator.gvi"(Arduino Detection Cluster Info In=w2, Loop iteration=i1, Error In=w3, Prompt Arduinos?=$"Prompt Arduinos?") -> (Detected All?=w4, Proceed?=w5, Error Out=w1)
        stop if w5
      }
      $"Arduino Detection Cluster Info Out" <- w2
      $"Detected All?" <- w4
    }
  }
  $"Error Out" <- w1
