vi "Instrument Detector.gvi"   [LabVIEW NXG 3.1.0]
inputs:
  "Error In": error
  "Instruments To Detect control": "Instruments To Detect control.gtype" = "Photodetector", required
outputs:
  "Error Out": error
  "Instrument Address": "VISA Instr"
  "Detected?": bool
panel indicators:
  "Arduino Connection info": "Arduino Detection cluster control.gtype"
types:
  "Instruments To Detect control.gtype" = enum{"Photodetector", "Keithley", "Arduinos", "Thorlabs Motors"}
  T1 = cluster{"Element 1": "VISA Instr", "Element 2": string}
  "Arduino Detection cluster control.gtype" = cluster{"XZ Stage Arduino Address": "VISA Instr", "XZ Stage Arduino Detected?": bool, "Multiplexer Arduino Detected?": bool, "Multiplexer Arduino Address": "VISA Instr", "Arduinos List": T1[]}
uses:
  Rainbow Measurement Setup::Main Functions::Instruction Queue::Current State::FGV Current State.gvi
  Rainbow Measurement Setup::Main Functions::Initialize App::Instrument Detection::Photodetector Detection Subroutine.gvi
  Rainbow Measurement Setup::Main Functions::Initialize App::Instrument Detection::Keithley Detection Subroutine.gvi
  Rainbow Measurement Setup::Main Functions::Initialize App::Instrument Detection::Arduino Detection Subroutine.gvi
diagram:
  case ($"Error In") {
    frame Error, Default {
      w1 = $"Error In"
    }
    frame No Error {
      case ($"Instruments To Detect control") {
        frame "Photodetector", Default {
          call "FGV Current State.gvi"(Current State Instructions="Set current Substate", Current Substate="Detecting Photodetector", Error In=$"Error In") -> (Error Out=w5)
          call "Photodetector Detection Subroutine.gvi"(Error In=w5) -> (Detected?=w3, Error Out=w1)
          w2 = default
          w4 = default
        }
        frame "Keithley" {
          call "FGV Current State.gvi"(Current State Instructions="Set current Substate", Current Substate="Detecting Keithley", Error In=$"Error In") -> (Error Out=w6)
          call "Keithley Detection Subroutine.gvi"(Error In=w6) -> (Keythley Address Out=w2, Detected?=w3, Error Out=w1)
          w4 = default
        }
        frame "Arduinos" {
          call "FGV Current State.gvi"(Current State Instructions="Set current Substate", Current Substate="Detecting Arduinos", Error In=$"Error In") -> (Error Out=w7)
          call "Arduino Detection Subroutine.gvi"(Error In=w7) -> (Arduino Detection Cluster Info Out=w4, Detected All?=w3, Error Out=w1)
          w2 = default
        }
        frame "Thorlabs Motors" {
          w1 = _
          w2 = default
          w3 = _
          w4 = default
        }
      }
      $"Instrument Address" <- w2
      $"Arduino Connection info" <- w4
      $"Detected?" <- w3
    }
  }
  $"Error Out" <- w1
