vi "Check Current State Idle.gvi"   [LabVIEW NXG 5.0.0]
inputs:
  "Error In": error
outputs:
  "Error Out": error
  "Proceed to enqueue": bool
uses:
  Rainbow Measurement Setup::Main Functions::Instruction Queue::Current State::FGV Current State.gvi
diagram:
  # This SubVI checks that the current State Is Idle and allows you to proceed only if it is.
  # If it is not it prompts you to wait until it is
  case ($"Error In") {
    frame Error, Default {
      w1 = $"Error In"
      w2 = FALSE
    }
    frame No Error {
      call "FGV Current State.gvi"(Current State Instructions="Read Current State and Substate", Error In=$"Error In") -> (Current State Out=w3, Error Out=w4)
      Is Equal(x="Idle", y=w3) -> w2
      case (w2) {
        frame False, Default {
          Format Into String(errIn=w4, w3) -> (outString=w5, errOut=w1)
          w6 = "Please wait until all tasks have been finished.\nCurrent task: "
          Concatenate Strings(w6, w5) -> w7
          One Button Dialog(button name ("OK")="Okay, sorry, I will wait", message=w7)
        }
        frame True {
          w1 = w4
        }
      }
    }
  }
  $"Proceed to enqueue" <- w2
  $"Error Out" <- w1
