vi "Check Queue And Label.gvi"   [LabVIEW NXG 5.0.0]
inputs:
  "Error In": error
  "Is Label Necessary?": bool
  "Label Info Missing Error": bool
  "Label Info Error Label": string
outputs:
  "Error Out": error
  "Proceed to enqueue": bool
uses:
  Rainbow Measurement Setup::Main Functions::Instruction Queue::Current State::FGV Current State.gvi
diagram:
  # This SubVI checks that the current State Is Idle and allows you to proceed only if it is.
  # If it is not it prompts you to wait until it is. It also checks if there is any problem with the
  # labeling, and in case the label is necessary for that specific process it will prompt the user
  # to correct the labeling information before proceeding
  case ($"Error In") {
    frame Error, Default {
      w1 = $"Error In"
      w2 = FALSE
    }
    frame No Error {
      Logical And[output inverted]($"Label Info Missing Error", $"Is Label Necessary?") -> w3
      call "FGV Current State.gvi"(Current State Instructions="Read Current State and Substate", Error In=$"Error In") -> (Current State Out=w4, Error Out=w5)
      Is Equal(x="Idle", y=w4) -> w6
      Logical And(w6, w3) -> w2
      case (w6) {
        frame False, Default {
          Format Into String(errIn=w5, w4) -> (outString=w8, errOut=w7)
          w9 = "Please wait until all tasks have been finished.\nCurrent task: "
          Concatenate Strings(w9, w8) -> w10
          One Button Dialog(button name ("OK")="Okay, sorry, I will wait", message=w10)
        }
        frame True {
          w7 = w5
        }
      }
      case (w3) {
        frame True {
          w1 = w7
        }
        frame False {
          w11 = "By The Way, I'm having some problems\nweeth the naming of your sample:\n"
          Concatenate Strings(w11, $"Label Info Error Label") -> w12
          One Button Dialog(button name ("OK")="Oh sorry, I will \nfix it right away", message=w12)
          w1 = w7
        }
      }
    }
  }
  $"Proceed to enqueue" <- w2
  $"Error Out" <- w1
