vi "Modify Measurement TXT File.gvi"   [LabVIEW NXG 5.0.0]
inputs:
  "Error In": error
  "Misc Data Mega Cluster In": "Misc Data Mega Cluster.gtype"
  "Modify File Operation": "Modify File Operation.gtype" = "Save TXT", required
  "Data To Save": f64[][]
  "Measurement File Type": "Measurement File Type.gtype" = "Single Cell Rainbow Raw"
  "Filename to load/save": path
  "Variable Header Info": string
  "Rainbow Sweep Types": "Rainbow Sweep Types.gtype" = "Red Sweep Closing"
outputs:
  "Error Out": error
  "Loaded Data": f64[][]
  "Folder to save all data": path
  "Header Data": string
  "Misc Data Mega Cluster Out": "Misc Data Mega Cluster.gtype"
types:
  "Modify File Operation.gtype" = enum{"Save TXT", "Load TXT"}
  "Measurement File Type.gtype" = enum{"Single Cell Rainbow Raw", "Single Cell Rainbow Refined", "Multiple Cell Rainbow Raw", "Multiple Cell Rainbow Refined", "Light Calibration Power", "Light Calibration Spectral Density", "Light Calibration Power Density", "Light Calibration Dividing Wavelength Spectrum", "Dividing Wavelength To Motor Position", "Raw Div Wav to Motr Pos Fitik File"}
  "Rainbow Sweep Types.gtype" = enum{"Red Sweep Closing", "Red Sweep Opening", "Blue Sweep Closing", "Blue Sweep Opening"}
  "Full Reference Cluster.gtype" = cluster{"Enum Reference Cluster": "Enum Control Reference Cluster.gtype", "Boolean Reference Cluster": "Boolean Control Reference Cluster.gtype", "Numeric Reference Cluster": "Numeric Control Reference Cluster.gtype", "Numeric Cluster Reference Cluster": "Numeric Cluster Reference Cluster.gtype", "Path Reference Cluster": "Path Reference Cluster.gtype", "Cluster Reference Cluster": "Cluster Reference Cluster.gtype", "XZ Stage Controls Reference Cluster": "XZ Stage Controls Reference Cluster.gtype"}
  "Cell Naming Cluster.gtype" = cluster{"Cell Label": string, "Sample Prefix": string, "Author Initials": string, "Current Date": string, "Batch Name": string}
  T1 = cluster{"X Coordinate (mm)": f64, "Z Coordinate (mm)": f64}
  T2 = cluster{"X Coordinate (mm)": f64, "Z Coordinate (mm)": f64, "Vertical Spacing (mm)": f64}
  "XZ All Position Cluster.gtype" = cluster{"Diffusor Coordinates": T1, "Photodetector Coordinates": T1, "Cell R.01 Coordinates": T2}
  T3 = cluster{"Thorlabs Motor Serial Number File Path": path, "Default Data Saving Location": path}
  "Misc Data Mega Cluster.gtype" = cluster{"Full Reference Cluster": "Full Reference Cluster.gtype", "Cell Naming Cluster": "Cell Naming Cluster.gtype", "All XZ Position Cluster": "XZ All Position Cluster.gtype", "All Paths": T3}
uses:
  Rainbow Measurement Setup::Side Functions::Path Manipulation::Path Check & Generation.gvi
  Rainbow Measurement Setup::Side Functions::Path Manipulation::Path Already Exists prompt.gvi
  Rainbow Measurement Setup::Side Functions::Path Manipulation::Measurement File Header Generator.gvi
  Rainbow Measurement Setup::Side Functions::Path Manipulation::Header info merger.gvi
  Rainbow Measurement Setup::Side Functions::Path Manipulation::Rename Window.gvi
  NI::G Core::Error::Clear Error Cluster.gvi
  Rainbow Measurement Setup::Side Functions::Utilities::Header Extractor.gvi
diagram:
  # This is a macrosubVI that is used for all save and load operations of simple human readable data. It basically handles everything, probably more than needed.
  case ($"Error In") {
    frame Error, Default {
      w1 = $"Error In"
      w2 = $"Misc Data Mega Cluster In"
    }
    frame No Error {
      case ($"Modify File Operation") {
        frame "Save TXT" {
          call "Path Check & Generation.gvi"(Rainbow Sweep Types=$"Rainbow Sweep Types", Misc Data Mega Cluster In=$"Misc Data Mega Cluster In", Filename to load/save=$"Filename to load/save", Error In=$"Error In", Measurement File Type=$"Measurement File Type") -> (Folder to save data=w3, Misc Data Mega Cluster Out=w2, File path=w4, Error Out=w5)
          call "Path Already Exists prompt.gvi"(Path to Check=w4, Error In=w5) -> (Existing File Instruction out=w6, Error Out=w7)
          call "Measurement File Header Generator.gvi"(Measurement File Type=$"Measurement File Type", Error In=w7, Variable Header Info=$"Variable Header Info") -> (Header Items=w8, Error Out=w9)
          case (w6) {
            frame "Replace" {
              Open Or Create Or Replace File(error in=w9, file path (use dialog)=w4, operation (0:open)="replace or create") -> (error out=w10, refnum out=w11)
              Array To Spreadsheet String(array=$"Data To Save", format string="%g") -> (spreadsheet string=w12)
              call "Header info merger.gvi"(Column info array=w8, Spreadsheet String=w12, Error In=w10) -> (Spreadsheet String With Header=w13, Error Out=w14)
              Write To Text File(error in=w14, file (use dialog)=w11, text=w13) -> (error out=w15, refnum out=w16)
              Close File(error in=w15, refnum=w16) -> (error out=w1)
            }
            frame "Rename", Default {
              Strip Path(path=w4) -> (name=w17, stripped path=w18)
              call "Rename Window.gvi"(Original Filename=w17, Error In=w9) -> (Output=w19, Error Out=w20)
              Build Path(base path=w18, name or relative path=w19) -> (appended path=w21)
              Open Or Create Or Replace File(error in=w20, file path (use dialog)=w21, operation (0:open)="replace or create") -> (error out=w22, refnum out=w23)
              Array To Spreadsheet String(array=$"Data To Save", format string="%g") -> (spreadsheet string=w24)
              call "Header info merger.gvi"(Column info array=w8, Spreadsheet String=w24, Error In=w22) -> (Spreadsheet String With Header=w25, Error Out=w26)
              Write To Text File(error in=w26, file (use dialog)=w23, text=w25) -> (error out=w27, refnum out=w28)
              Close File(error in=w27, refnum=w28) -> (error out=w1)
            }
            frame "Do not save" {
              w1 = w9
            }
          }
          $"Folder to save all data" <- w3
        }
        frame "Load TXT", Default {
          Is Empty String Or Path(string/path=$"Filename to load/save") -> w29
          Is Not A Number Or Path Or Refnum(number=$"Filename to load/save") -> w30
          Logical Or(w29, w30) -> w31
          case (w31) {
            frame True {
              Open Or Create Or Replace File(error in=$"Error In", operation (0:open)="open", prompt="Choose or enter path of the file you want to load...") -> (cancelled=w32, error out=w33, refnum out=w34)
            }
            frame False {
              Open Or Create Or Replace File(error in=$"Error In", file path (use dialog)=$"Filename to load/save", operation (0:open)="open", prompt="Choose or enter path of the file you want to load...") -> (cancelled=w32, error out=w33, refnum out=w34)
            }
          }
          case (w32) {
            frame True {
              call "Clear Error Cluster.gvi"(error in=w33) -> (error out=w1)
              w35 = f64[][] []
              w36 = ""
            }
            frame False {
              Read From Text File(error in=w33, file (use dialog)=w34) -> (error out=w37, refnum out=w38, text=w39)
              Close File(error in=w37, refnum=w38) -> (error out=w40)
              call "Header Extractor.gvi"(Spreadsheet String=w39, Error In=w40) -> (Spreadsheet string without header=w41, Header=w36, Error Out=w1)
              Spreadsheet String To Array(format string="%f", spreadsheet string=w41) -> (array=w35)
            }
          }
          $"Loaded Data" <- w35
          $"Header Data" <- w36
          w2 = $"Misc Data Mega Cluster In"
        }
      }
    }
  }
  $"Misc Data Mega Cluster Out" <- w2
  $"Error Out" <- w1
