vi "Beam Power Density Calibration Subroutine.gvi"   [LabVIEW NXG 5.0.0]
inputs:
  "Error In": error
outputs:
  "Error Out": error
panel controls:
  "Stand Alone?": bool
  "XZ Scan Parameters In": "XZ Scan Parameters.gtype" = {"X Scan Range (mm)"=3, "Z Scan Range (mm)"=3, "X Steps"=3, "Z Steps"=3, "Center Coordinate X"=50, "Center Coordinate Z"=50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}
  "Instrument Control Mega Cluster In": "Instrument Control Mega Cluster.gtype"
  "Rainbow Sweep Parameters In": "Rainbow Sweep Param Selector.gtype" = {0, 1100, 300, 1, 1, 0}
panel indicators:
  "Beam Power Density Full Scan Data": "Beam Power Density Full Scan Data Cluster.gtype"[]
  "Instrument Control Mega Cluster Out": "Instrument Control Mega Cluster.gtype"
types:
  "XZ Scan Parameters.gtype" = cluster{"X Scan Range (mm)": f64, "Z Scan Range (mm)": f64, "X Steps": f64, "Z Steps": f64, "Center Coordinate X": f64, "Center Coordinate Z": f64, "Z Step size": f64, "X Step size": f64, "Total Steps": f64, "Z Starting Point": f64, "X Starting Point": f64, "Z End Point": f64, "X End Point": f64}
  "XZ Coordinate Array.gtype" = "XZ Coordinate Cluster.gtype"[]
  "Beam Power Density Single Sweep Data Cluster.gtype" = cluster{"Beam Power Density": f64[][], "Dividing Wavelength": f64, "XZ Array": "XZ Coordinate Array.gtype"}
  "Rainbow Sweep Types.gtype" = enum{"Red Sweep Closing", "Red Sweep Opening", "Blue Sweep Closing", "Blue Sweep Opening"}
  "Beam Power Density Full Scan Data Cluster.gtype" = cluster{"Beam Power Density Single Sweep Data Array": "Beam Power Density Single Sweep Data Cluster.gtype"[], "Rainbow Sweep Types": "Rainbow Sweep Types.gtype"}
  "Instrument Coms Info.gtype" = cluster{"Arduino Coms Info": "Arduino Detection cluster control.gtype", "Photodetector Names": string[], "Keythley Address": "VISA Instr", "Photodetector Detected?": bool, "Thorlabs Motors Detected?": bool, "Keithley Detected?": bool, "Thorlabs Motors Serial Number": "Thorlabs Motors Serial Number In.gtype", "Photodetector IVI session": "Ivi IviDefault", "Flame ID": string, "Flame Detected?": bool, "Flame Wrapper ID": u64}
  "Debugging Cluster.gtype" = cluster{"Debugging mode?": bool, "Initialize App": bool, "Insturment Debugging": "Insturment Debugging Cluster.gtype"}
  "Instrument Control Mega Cluster.gtype" = cluster{"Instruments Coms Info": "Instrument Coms Info.gtype", "Debugging Cluster": "Debugging Cluster.gtype"}
  "Raibow Sweep Selector.gtype" = enum{"Red Sweep", "Blue Sweep", "Full Sweep Red First", "Full Sweep Blue First"}
  T1 = enum{"Red Sweep Closing", "Red Sweep Opening", "Red Sweep Both Ways"}
  T2 = enum{"Blue Sweep Opening", "Blue Sweep Closing", "Blue Sweep Both Ways"}
  "Rainbow Sweep Type Selector.gtype" = cluster{"Red Sweep Mode": T1, "Blue Sweep Mode": T2}
  "Rainbow Sweep Param Selector.gtype" = cluster{"Raibow Sweep Selector": "Raibow Sweep Selector.gtype", "Max Wavelength (nm)": f64, "Min Wavelength (nm)": f64, "Wavelength Step (nm)": f64, "Rainbow Sweep Type Selector": "Rainbow Sweep Type Selector.gtype"}
uses:
  Rainbow Measurement Setup::Side Functions::Global Abort::FGV Global Abort.gvi
  Rainbow Measurement Setup::Side Functions::Scanning Calculations::Scan Points Generator.gvi
  Rainbow Measurement Setup::Main Functions::One Time Calibrations::Beam Power Density::Specific Detect Instruments Subroutine.gvi
  Rainbow Measurement Setup::Side Functions::Instrument Control::Thorlabs Motors::Dividing Wavelength Control::Dividing Wavelength Calibration Data FGV.gvi
  Rainbow Measurement Setup::Side Functions::Instrument Control::Thorlabs Motors::Movement::KCube Move to 0 or Home.gvi
  Rainbow Measurement Setup::Side Functions::Instrument Control::Thorlabs Motors::Movement::KCube Motors Initialize.gvi
  Rainbow Measurement Setup::Side Functions::Instrument Control::Arduino::XZ Stage Arduino::Low Level::XZ Stage Initialize.gvi
  Rainbow Measurement Setup::Side Functions::Instrument Control::Arduino::XZ Stage Arduino::Low Level::XZ Stage Home Sequence.gvi
  LabView_NXG_Thorlabs_PM100::Examples::Photodetector initialization Sequence with prompt.gvi
  Rainbow Measurement Setup::Side Functions::Rainbow Sweep::Rainbow Sweep Param Generator.gvi
  Rainbow Measurement Setup::Main Functions::One Time Calibrations::Beam Power Density::Beam Power Density Full Scan Subroutine.gvi
  LabView_NXG_Thorlabs_PM100::Miscelanous::TLPM Close.gvi
  NI::G Core::Error::Clear Error Cluster.gvi
  NI::VISA::Close (Instr).gvi
  Rainbow Measurement Setup::Side Functions::Instrument Control::Thorlabs Motors::Movement::KCube Motors Close.gvi
  Rainbow Measurement Setup::Main Functions::One Time Calibrations::Beam Power Density::Beam Power Density Visualizer.gvi
diagram:
  w1 = $"Rainbow Sweep Parameters In"
  w2 = $"Stand Alone?"
  # Falta afegir debugging functionalities i fer que la local abort triggereji el close coms abans de petarho tot
  # This subVI performs a scan of the beam. It basically measures the power at several points while also changing the guillotine motors to see how the wavelength division
  # affects the power density output of the beam. Aftewards (still to be implemented) it exposes the data in an understandable way so that the user can extract conclusions from it
  case ($"Error In") {
    frame Error, Default {
      w3 = $"Error In"
      w4 = default
      w5 = $"Instrument Control Mega Cluster In"
    }
    frame No Error {
      s1 = $"Error In"  # shift register
      s2 = $"Instrument Control Mega Cluster In"  # shift register
      s3 = "Check Scan Area Range"  # shift register
      s4 = uninitialised  # shift register
      s5 = $"XZ Scan Parameters In"  # shift register
      s6 = "Beam Power Density Full Scan Data Cluster.gtype"[] []  # shift register
      while {
        call "FGV Global Abort.gvi"(Global Abort Instructions="Read Current State", Error In=s1) -> (Local Abort Out=w6, Global Abort Out=w7, Error Out=w8)
        Select(s=w6, t="Close Coms", f=s3) -> w9
        case (w9) {
          frame "Check Scan Area Range", Default {
            Select(s=w2, t="Detect Instruments", f="Initialize Instruments") -> w17
            call "Scan Points Generator.gvi"(XZ Scan Parameters In=s5, Error In=w8) -> (XZ Scan Parameters Out=w15, XZ Coordinate Array=w13, All In Range?=w18, Error Out=w10)
            Select(s=w18, t=w17, f="Stop App") -> w12
            w11 = s2
            w14 = default
            w16 = s6
          }
          frame "Detect Instruments" {
            call "Specific Detect Instruments Subroutine.gvi"(Instrument Control Mega Cluster In=s2, Error In=w8, Instruments To Detect Array=["Photodetector", "Arduinos", "Thorlabs Motors"], Stand Alone?=w2) -> (Instrument Control Mega Cluster Out=w11, Error Out=w19)
            call "Dividing Wavelength Calibration Data FGV.gvi"(Div Wavelength FGV Instructions="Load Data", Error In=w19) -> (Error Out=w10)
            w12 = "Initialize Instruments"
            w13 = s4
            w14 = default
            w15 = s5
            w16 = s6
          }
          frame "Initialize Instruments" {
            call "KCube Move to 0 or Home.gvi"(Instrument Control Mega Cluster In=s2, Error In=w8) -> (Instrument Control Mega Cluster Out=w20, Error Out=w21)
            call "KCube Motors Initialize.gvi"(Instrument Control Mega Cluster In=w20, Error In=w21) -> (Instrument Control Mega Cluster Out=w22, Error Out=w23)
            Property Node(instance in=w22) -> ("Instruments Coms Info:Arduino Coms Info:XZ Stage Arduino Address"=w24, instance out=w25)
            call "XZ Stage Initialize.gvi"(XZ Carriage Arduino Adress In=w24, Error In=w23) -> (XZ Carriage Arduino Visa Session Out=w26, XZ Carriage Arduino Log=w27, Error Out=w28)
            call "XZ Stage Home Sequence.gvi"(XZ Carriage Arduino Open Visa Session In=w26, XZ Carriage Arduino Log In=w27, Error In=w28) -> (XZ Carriage Arduino Log Out=w29, Error Out=w30)
            call "Photodetector initialization Sequence with prompt.gvi"(Error In=w30) -> (Photodetector IVI session=w31, Error Out=w10)
            Property Node(instance in=w25, "Instruments Coms Info:Photodetector IVI session"=w31, "Instruments Coms Info:Arduino Coms Info:XZ Stage Log"=w29) -> (instance out=w11)
            w12 = "Scan"
            w13 = s4
            w14 = default
            w15 = s5
            w16 = s6
          }
          frame "Scan" {
            call "Rainbow Sweep Param Generator.gvi"(Rainbow Sweep Parameters=w1, Error In=w8) -> (Rainbow Sweep Parameters Array=w32, Error Out=w33)
            call "Beam Power Density Full Scan Subroutine.gvi"(Beam Power Density Full Scan Data Array In=s6, Instrument Control Mega Cluster In=s2, XZ Coordinate Array In=s4, XZ Scan Parameters In=s5, Rainbow Sweep Parameters Array=w32, Error In=w33) -> (Beam Power Density Full Scan Data Array Out=w16, Instrument Control Mega Cluster Out=w11, Error Out=w10)
            w12 = "Close Coms"
            w13 = s4
            w14 = default
            w15 = s5
          }
          frame "Close Coms" {
            Property Node(instance in=s2) -> ("Instruments Coms Info:Arduino Coms Info:XZ Stage Arduino Address"=w34, "Instruments Coms Info:Photodetector IVI session"=w35, instance out=w36)
            call "TLPM Close.gvi"(IVI session in=w35, error in (no error)=w8) -> (error out=w37)
            call "Clear Error Cluster.gvi"(error in=w37) -> (error out=w38)
            call "Close (Instr).gvi"(session in=w34, error in=w38) -> (error out=w39)
            call "KCube Motors Close.gvi"(Instrument Control Mega Cluster In=w36, Error In=w39) -> (Instrument Control Mega Cluster Out=w11, Error Out=w10)
            Select(s=w6, t="Stop App", f="Check Graphs") -> w12
            w13 = s4
            w14 = default
            w15 = s5
            w16 = s6
          }
          frame "Check Graphs" {
            call "Beam Power Density Visualizer.gvi"(Beam Power Density Full Scan Data Array=s6, XZ Scan Parameters In=s5, Error In=w8) -> (Error Out=w10)
            w11 = s2
            w12 = "Stop App"
            w13 = s4
            w14 = default
            w15 = s5
            w16 = s6
          }
          frame "Stop App" {
            w10 = w8
            w11 = s2
            w12 = "Check Scan Area Range"
            w13 = s4
            w14 = TRUE
            w15 = s5
            w16 = s6
          }
        }
        Logical Or(w7, w14) -> w40
        next s1 = w10
        next s2 = w11
        next s3 = w12
        next s4 = w13
        next s5 = w15
        next s6 = w16
        stop if w40
      }
      w3 = s1
      w4 = s6
      w5 = s2
    }
  }
  $"Beam Power Density Full Scan Data" <- w4
  $"Instrument Control Mega Cluster Out" <- w5
  $"Error Out" <- w3
