vi "Beam Power Density Full Scan Subroutine.gvi"   [LabVIEW NXG 5.0.0]
inputs:
  "Beam Power Density Full Scan Data Array In": "Beam Power Density Full Scan Data Cluster.gtype"[]
  "Instrument Control Mega Cluster In": "Instrument Control Mega Cluster.gtype"
  "XZ Coordinate Array In": "XZ Coordinate Array.gtype"
  "XZ Scan Parameters In": "XZ Scan Parameters.gtype" = {"X Scan Range (mm)"=1, "Z Scan Range (mm)"=1, "X Steps"=3, "Z Steps"=3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}
  "Rainbow Sweep Parameters In": "Rainbow Sweep Param Selector.gtype" = {0, 1100, 300, 1, 1, 0}
  "Error In": error
outputs:
  "Beam Power Density Full Scan Data Array Out": "Beam Power Density Full Scan Data Cluster.gtype"[]
  "Instrument Control Mega Cluster Out": "Instrument Control Mega Cluster.gtype"
  "Error Out": error
types:
  "XZ Coordinate Cluster.gtype" = cluster{"X Coordinate (mm)": f64, "Z Coordinate (mm)": f64, "Coordinate Gcode": string, "Beam Power (W)": f64}
  "XZ Coordinate Array.gtype" = "XZ Coordinate Cluster.gtype"[]
  "XZ Scan Parameters.gtype" = cluster{"X Scan Range (mm)": f64, "Z Scan Range (mm)": f64, "X Steps": f64, "Z Steps": f64, "Center Coordinate X": f64, "Center Coordinate Z": f64, "Z Step size": f64, "X Step size": f64, "Total Steps": f64, "Z Starting Point": f64, "X Starting Point": f64, "Z End Point": f64, "X End Point": f64}
  "Beam Power Density Single Sweep Data Cluster.gtype" = cluster{"Beam Power Density": f64[][], "Dividing Wavelength": f64, "XZ Array": "XZ Coordinate Array.gtype"}
  "Rainbow Sweep Types.gtype" = enum{"Red Sweep Closing", "Red Sweep Opening", "Blue Sweep Closing", "Blue Sweep Opening"}
  "Beam Power Density Full Scan Data Cluster.gtype" = cluster{"Beam Power Density Single Sweep Data Array": "Beam Power Density Single Sweep Data Cluster.gtype"[], "Rainbow Sweep Types": "Rainbow Sweep Types.gtype"}
  "Instrument Coms Info.gtype" = cluster{"Arduino Coms Info": "Arduino Detection cluster control.gtype", "Photodetector Names": string[], "Keythley Address": "VISA Instr", "Photodetector Detected?": bool, "Thorlabs Motors Detected?": bool, "Keithley Detected?": bool, "Thorlabs Motors Serial Number": "Thorlabs Motors Serial Number In.gtype", "Photodetector IVI session": "Ivi IviDefault", "Flame ID": string, "Flame Detected?": bool, "Flame Wrapper ID": u64}
  "Debugging Cluster.gtype" = cluster{"Debugging mode?": bool, "Initialize App": bool, "Insturment Debugging": "Insturment Debugging Cluster.gtype"}
  "Instrument Control Mega Cluster.gtype" = cluster{"Instruments Coms Info": "Instrument Coms Info.gtype", "Debugging Cluster": "Debugging Cluster.gtype"}
  "Raibow Sweep Selector.gtype" = enum{"Red Sweep", "Blue Sweep", "Full Sweep Red First", "Full Sweep Blue First"}
  T1 = enum{"Red Sweep Closing", "Red Sweep Opening", "Red Sweep Both Ways"}
  T2 = enum{"Blue Sweep Opening", "Blue Sweep Closing", "Blue Sweep Both Ways"}
  "Rainbow Sweep Type Selector.gtype" = cluster{"Red Sweep Mode": T1, "Blue Sweep Mode": T2}
  "Rainbow Sweep Param Selector.gtype" = cluster{"Raibow Sweep Selector": "Raibow Sweep Selector.gtype", "Max Wavelength (nm)": f64, "Min Wavelength (nm)": f64, "Wavelength Step (nm)": f64, "Rainbow Sweep Type Selector": "Rainbow Sweep Type Selector.gtype"}
uses:
  Rainbow Measurement Setup::Side Functions::Instrument Control::Thorlabs Motors::Dividing Wavelength Control::Dividing Wavelength Calibration Data FGV.gvi
  Rainbow Measurement Setup::Side Functions::Rainbow Sweep::Rainbow Sweep Param Generator.gvi
  Rainbow Measurement Setup::Side Functions::Instrument Control::Thorlabs Motors::Dividing Wavelength Control::KCube Dividing Wavelength Translator.gvi
  Rainbow Measurement Setup::Main Functions::One Time Calibrations::Beam Power Density::Single Scan Subroutine.gvi
  Rainbow Measurement Setup::Main Functions::One Time Calibrations::XZ Array To Intensity Graph.gvi
  Rainbow Measurement Setup::Side Functions::Global Abort::FGV Global Abort.gvi
diagram:
  # This SubVI Loops through the Rainbow Sweep Parameters Array and performs a Beam Power Density Scan for each type of sweep present in the array.
  # For each type of sweep it also performs a scan for each dividing wavelength and stores the resulting beam power density within a sub array of the Beam
  # Power density full scan data array that holds all the measurements performed for each type of sweep. The resulting data is structured as follows:
  # -Beam Power Density Full Scan Data Array (Array with different types of sweeps, red closing blue closing...)
  # 	-Type Of sweep
  # 	-Beam Power density Data Single Sweep Array (Array with all the Beam Power Density maps at each dividing wavelength)
  # 		-Beam Power Density map
  # 		-Specific dividing wavelength of that map
  # 		-XZ Array to have all the coordinates and beam power more accessible
  #
  # I know it's complicated :')
  case ($"Error In") {
    frame Error, Default {
      w1 = $"Error In"
      w2 = $"Beam Power Density Full Scan Data Array In"
      w3 = $"Instrument Control Mega Cluster In"
    }
    frame No Error {
      call "Dividing Wavelength Calibration Data FGV.gvi"(Div Wavelength FGV Instructions="Read Loaded Data", Error In=$"Error In") -> (Dividing Wavelength Calibration Data Out=w4, Error Out=w5)
      case (_) {
        frame False {
          call "Rainbow Sweep Param Generator.gvi"(Rainbow Sweep Parameters=$"Rainbow Sweep Parameters In", Only Full Spectrum?=w6, Error In=w5) -> (Rainbow Sweep Parameters Array=w7, Error Out=w8)
          s1 = $"Instrument Control Mega Cluster In"  # shift register
          s2 = w8  # shift register
          s3 = $"Beam Power Density Full Scan Data Array In"  # shift register
          for (iteration -> i1) {
            w9 = each element of w7
            Array Index(array=s3) -> (out0[i1]=w10)
            Property Node(instance in=w10) -> ("Beam Power Density Single Sweep Data Array"=w11, instance out=w12)
            Property Node(instance in=w9) -> ("Dividing Wavelength Array"=w13, "Rainbow Sweep Types"=w14)
            s4 = s1  # shift register
            s5 = s2  # shift register
            s6 = w11  # shift register
            for (iteration -> i2) (after i1) {
              w15 = each element of w13
              call "KCube Dividing Wavelength Translator.gvi"(Dividing Wavelength=w15, Instrument Control Mega Cluster In=s4, Dividing Wavelength Calibration Data In=w4, Error In=s5, Rainbow Sweep Types=w14) -> (Instrument Control Mega Cluster Out=w16, Error Out=w17)
              call "Single Scan Subroutine.gvi"(Instrument Control Mega Cluster In=w16, XZ Coordinate Array In=$"XZ Coordinate Array In", Error In=w17) -> (Instrument Control Mega Cluster Out=w18, XZ Coordinate Array Out=w19, Error Out=w20)
              Array Index(array=s6) -> (out0[i2]=w21)
              call "XZ Array To Intensity Graph.gvi"(XZ Array=w19, XZ Scan Parameters In=$"XZ Scan Parameters In", Error In=w20) -> (Beam Power Density=w22, Error Out=w23)
              Property Node(instance in=w21, "Beam Power Density"=w22, "Dividing Wavelength"=w15, "XZ Array"=w19) -> (instance out=w24)
              Insert Into Array(inArray=s6, new=w24) -> w25
              call "FGV Global Abort.gvi"(Global Abort Instructions="Read Current State", Error In=w23) -> (Local Abort Out=w26, Global Abort Out=w27, Error Out=w28)
              Logical Or(w26, w27) -> w29
              next s4 = w18
              next s5 = w28
              next s6 = w25
              stop if w29
            }
            Property Node(instance in=w12, "Beam Power Density Single Sweep Data Array"=s6, "Rainbow Sweep Types"=w14) -> (instance out=w30)
            Insert Into Array(inArray=s3, index0=i1, new=w30) -> w31
            next s1 = s4
            next s2 = s5
            next s3 = w31
            stop if w29
          }
          w1 = s2
          w2 = s3
          w3 = s1
        }
        frame True {
          call "Rainbow Sweep Param Generator.gvi"(Rainbow Sweep Parameters=$"Rainbow Sweep Parameters In", Only Full Spectrum?=w32, Error In=w5) -> (Rainbow Sweep Parameters Array=w33, Error Out=w34)
          s7 = $"Instrument Control Mega Cluster In"  # shift register
          s8 = w34  # shift register
          s9 = $"Beam Power Density Full Scan Data Array In"  # shift register
          for (iteration -> i3) {
            w35 = each element of w33
            Array Index(array=s9) -> (out0[i3]=w36)
            Property Node(instance in=w36) -> ("Beam Power Density Single Sweep Data Array"=w37, instance out=w38)
            Property Node(instance in=w35) -> ("Rainbow Sweep Types"=w39)
            call "Single Scan Subroutine.gvi"(Instrument Control Mega Cluster In=s7, XZ Coordinate Array In=$"XZ Coordinate Array In", Error In=s8) -> (Instrument Control Mega Cluster Out=w40, XZ Coordinate Array Out=w41, Error Out=w42)
            call "XZ Array To Intensity Graph.gvi"(XZ Array=w41, XZ Scan Parameters In=$"XZ Scan Parameters In", Error In=w42) -> (Beam Power Density=w43, Error Out=w44)
            Array Index(array=w37) -> (out0[0]=w45)
            Property Node(instance in=w45, "Beam Power Density"=w43, "XZ Array"=w41) -> (instance out=w46)
            Insert Into Array(inArray=w37, new=w46) -> w47
            Property Node(instance in=w38, "Beam Power Density Single Sweep Data Array"=w47, "Rainbow Sweep Types"=w39) -> (instance out=w48)
            Insert Into Array(inArray=s9, index0=i3, new=w48) -> w49
            call "FGV Global Abort.gvi"(Global Abort Instructions="Read Current State", Error In=w44) -> (Local Abort Out=w50, Global Abort Out=w51, Error Out=w52)
            Logical Or(w50, w51) -> w53
            next s7 = w40
            next s8 = w52
            next s9 = w49
            stop if w53
          }
          w1 = s8
          w2 = s9
          w3 = s7
        }
      }
    }
  }
  $"Beam Power Density Full Scan Data Array Out" <- w2
  $"Instrument Control Mega Cluster Out" <- w3
  $"Error Out" <- w1
