vi "Beam Power Density Visualizer.gvi"   [LabVIEW NXG 5.0.0]
inputs:
  "Error In": error
  "Beam Power Density Full Scan Data Array": "Beam Power Density Full Scan Data Cluster.gtype"[]
  "XZ Scan Parameters In": "XZ Scan Parameters.gtype"
outputs:
  "Error Out": error
panel controls:
  "Sweep Type Selector": i32
  "Dividing Wavelength Selector": i32
  "Continue": bool
panel indicators:
  "Rainbow Sweep Type": "Rainbow Sweep Types.gtype"
  "Beam Power Density": f64[][]
  "Dividing Wavelength": f64
types:
  "Rainbow Sweep Types.gtype" = enum{"Red Sweep Closing", "Red Sweep Opening", "Blue Sweep Closing", "Blue Sweep Opening"}
  "XZ Coordinate Array.gtype" = "XZ Coordinate Cluster.gtype"[]
  "Beam Power Density Single Sweep Data Cluster.gtype" = cluster{"Beam Power Density": f64[][], "Dividing Wavelength": f64, "XZ Array": "XZ Coordinate Array.gtype"}
  "Beam Power Density Full Scan Data Cluster.gtype" = cluster{"Beam Power Density Single Sweep Data Array": "Beam Power Density Single Sweep Data Cluster.gtype"[], "Rainbow Sweep Types": "Rainbow Sweep Types.gtype"}
  "XZ Scan Parameters.gtype" = cluster{"X Scan Range (mm)": f64, "Z Scan Range (mm)": f64, "X Steps": f64, "Z Steps": f64, "Center Coordinate X": f64, "Center Coordinate Z": f64, "Z Step size": f64, "X Step size": f64, "Total Steps": f64, "Z Starting Point": f64, "X Starting Point": f64, "Z End Point": f64, "X End Point": f64}
diagram:
  Property Node(instance in=reference to unnamed native front panel, error in=$"Error In") -> ("Window"=w1, error out=w2)
  Open Window(reference in=w1, error in=w2) -> (reference out=w3, error out=w4)
  # This subVI allows us to visualize the data obtained on the Measuring Spot Spectrum Calibration subroutine so that we can
  # extract our own conclusions and elaborate the calibration file.
  case (w4) {
    frame Error, Default {
      w5 = w4
    }
    frame No Error {
      while {
        Property Node(instance in=$"XZ Scan Parameters In") -> ("X End Point"=w6, "Z End Point"=w7, "X Starting Point"=w8, "Z Starting Point"=w9)
        Array Size(array=$"Beam Power Density Full Scan Data Array") -> (size(s)=w10)
        Decrement(x=w10) -> w11
        Property Node(instance in=reference to "Sweep Type Selector", "Maximum"=w11, "Minimum"=0, error in=w4) -> (error out=w12)
        Array Index(array=$"Beam Power Density Full Scan Data Array") -> (out0[$"Sweep Type Selector"]=w13)
        Property Node(instance in=w13) -> ("Beam Power Density Single Sweep Data Array"=w14, "Rainbow Sweep Types"=w15)
        Array Size(array=w14) -> (size(s)=w16)
        Decrement(x=w16) -> w17
        Property Node(instance in=reference to "Dividing Wavelength Selector", "Minimum"=0, "Maximum"=w17, error in=w12) -> (error out=w18)
        Multiply(w7, 10) -> w19
        Multiply(w6, 10) -> w20
        disable {
          frame Disabled {
            w5 = w18
          }
          frame Enabled {
            Multiply(w8, 10) -> w21
            Property Node(instance in=cluster{"Minimum": f64, "Maximum": f64} {all zero or empty}, "Minimum"=w21, "Maximum"=w20) -> (instance out=w22)
            Property Node(instance in=reference to "Beam Power Density", error in=w18) -> ("XScale"=w23, "YScale"=w24, error out=w25)
            Multiply(w9, 10) -> w26
            Property Node(instance in=cluster{"Minimum": f64, "Maximum": f64} {all zero or empty}, "Minimum"=w26, "Maximum"=w19) -> (instance out=w27)
            Property Node(instance in=w24, "Range"=w27, "FitType"="None", error in=w25) -> (error out=w28)
            Property Node(instance in=w23, "Range"=w22, "FitType"="None", error in=w28) -> (error out=w5)
          }
        }
        Array Index(array=w14) -> (out0[$"Dividing Wavelength Selector"]=w29)
        Property Node(instance in=w29) -> ("Beam Power Density"=w30, "Dividing Wavelength"=w31)
        $"Beam Power Density" <- w30
        Wait Until Next Multiple(multiple to wait=50)
        $"Dividing Wavelength" <- w31
        $"Rainbow Sweep Type" <- w15
        stop if $Continue
      }
    }
  }
  Close Window(reference in=w3, error in=w5) -> (error out=w32)
  $"Error Out" <- w32
