vi "Single Scan Subroutine.gvi"   [LabVIEW NXG 5.0.0]
inputs:
  "Error In": error
  "Instrument Address Output Cluster In": "Instrument Coms Info.gtype"
  "XZ Coordinate Array In": "XZ Coordinate Array.gtype"
outputs:
  "Error Out": error
  "Instrument Address Output Cluster Out": "Instrument Coms Info.gtype"
  "XZ Coordinate Array Out": "XZ Coordinate Array.gtype"
types:
  T1 = cluster{"Element 1": "VISA Instr", "Element 2": string}
  "Arduino Detection cluster control.gtype" = cluster{"XZ Stage Arduino Address": "VISA Instr", "XZ Stage Arduino Detected?": bool, "Multiplexer Arduino Detected?": bool, "Multiplexer Arduino Address": "VISA Instr", "Arduinos List": T1[], "XZ Stage Log": string, "Multiplexer Log": string}
  "Thorlabs Motors Serial Number In.gtype" = cluster{"Thorlabs Blue Motor": string, "Thorlabs Red Motor": string, "Blue Motor Homed?": bool, "Red Motor Homed?": bool}
  "Instrument Coms Info.gtype" = cluster{"Arduino Coms Info": "Arduino Detection cluster control.gtype", "Photodetector Names": string[], "Keythley Address": "VISA Instr", "Photodetector Detected?": bool, "Thorlabs Motors Detected?": bool, "Keithley Detected?": bool, "Thorlabs Motors Serial Number": "Thorlabs Motors Serial Number In.gtype", "Photodetector IVI session": "Ivi IviDefault", "Flame ID": string, "Flame Detected?": bool, "Flame Wrapper ID": u64}
  "XZ Coordinate Cluster.gtype" = cluster{"X Coordinate (mm)": f64, "Z Coordinate (mm)": f64, "Coordinate Gcode": string, "Beam Power (W)": f64}
  "XZ Coordinate Array.gtype" = "XZ Coordinate Cluster.gtype"[]
uses:
  Rainbow Measurement Setup::Side Functions::Instrument Control::Arduino::XZ Stage Arduino::Low Level::XZ Stage Move To Location.gvi
  Rainbow Measurement Setup::Side Functions::Instrument Control::Arduino::XZ Stage Arduino::Low Level::XZ Stage Fast Movement.gvi
  LabView_NXG_Thorlabs_PM100::Measure::TLPM Measure Power.gvi
  NI::G Core::Error::Clear Error Cluster.gvi
  Rainbow Measurement Setup::Side Functions::Global Abort::FGV Global Abort.gvi
diagram:
  # This SubVI Reads the XZ Coordinates of the desired map and sweeps the entire area
  # measuring the light power at each point and it saves the value to the XZ Coordinate Array
  case ($"Error In") {
    frame Error, Default {
      w1 = $"Error In"
      w2 = $"XZ Coordinate Array In"
      w3 = $"Instrument Address Output Cluster In"
    }
    frame No Error {
      Array Size(array=$"XZ Coordinate Array In") -> (size(s)=w4)
      Property Node(instance in=$"Instrument Address Output Cluster In") -> ("Arduino Coms Info:XZ Stage Arduino Address"=w5, "Arduino Coms Info:XZ Stage Log"=w6, "Photodetector IVI session"=w7, instance out=w3)
      Array Index(array=$"XZ Coordinate Array In") -> (out0[0]=w8)
      Property Node(instance in=w8) -> ("Coordinate Gcode"=w9)
      call "XZ Stage Move To Location.gvi"(XZ Carriage Arduino open Visa session In=w5, XZ Carriage Arduino Log In=w6, Error In=$"Error In", Input Command=w9) -> (XZ Carriage Arduino open Visa Session Out=w10, XZ Carriage Arduino Log Out=w11, Error Out=w12)
      s1 = w12  # shift register
      s2 = w10  # shift register
      s3 = w11  # shift register
      s4 = $"XZ Coordinate Array In"  # shift register
      s5 = w7  # shift register
      for (N = w4) (iteration -> i1) {
        Array Index(array=s4) -> (out0[i1]=w13)
        Property Node(instance in=w13) -> ("Coordinate Gcode"=w14, instance out=w15)
        Random Number() -> (number (0 to 1)=w16)
        Property Node(instance in=w15, "Beam Power (W)"=w16) -> (instance out=w17)
        Replace Array Subset(inArray=s4, index=i1, new=w17) -> w18
        call "XZ Stage Fast Movement.gvi"(XZ Carriage Arduino open Visa session In=s2, XZ Stage Arduino Log In=s3, Error In=s1, Input Command=w14, ms Wait Fast Movement=10) -> (XZ Carriage Arduino open Visa Session Out=w19, XZ Stage Arduino Log Out=w20, Error Out=w21)
        call "TLPM Measure Power.gvi"(IVI session in=s5, error in (no error)=w21) -> (IVI session out=w22, error out=w23)
        call "Clear Error Cluster.gvi"(error in=w23) -> (error out=w24)
        call "FGV Global Abort.gvi"(Global Abort Instructions="Read Current State", Error In=w24) -> (Local Abort Out=w25, Global Abort Out=w26, Error Out=w27)
        Logical Or(w25, w26) -> w28
        next s1 = w27
        next s2 = w19
        next s3 = w20
        next s4 = w18
        next s5 = w22
        stop if w28
      }
      w1 = s1
      w2 = s4
    }
  }
  $"Instrument Address Output Cluster Out" <- w3
  $"XZ Coordinate Array Out" <- w2
  $"Error Out" <- w1
