vi "Specific Detect Instruments Subroutine.gvi"   [LabVIEW NXG 5.0.0]
inputs:
  "Instrument Coms Info In": "Instrument Coms Info.gtype"
  "Error In": error
  "Instruments To Detect Array": "Instruments To Detect control.gtype"[] = ["Photodetector", "Arduinos"]
  "Stand Alone?": bool
outputs:
  "Instrument Coms Info Out": "Instrument Coms Info.gtype"
  "Error Out": error
types:
  T1 = cluster{"Element 1": "VISA Instr", "Element 2": string}
  "Arduino Detection cluster control.gtype" = cluster{"XZ Stage Arduino Address": "VISA Instr", "XZ Stage Arduino Detected?": bool, "Multiplexer Arduino Detected?": bool, "Multiplexer Arduino Address": "VISA Instr", "Arduinos List": T1[], "XZ Stage Log": string, "Multiplexer Log": string}
  "Thorlabs Motors Serial Number In.gtype" = cluster{"Thorlabs Blue Motor": string, "Thorlabs Red Motor": string, "Blue Motor Homed?": bool, "Red Motor Homed?": bool}
  "Instrument Coms Info.gtype" = cluster{"Arduino Coms Info": "Arduino Detection cluster control.gtype", "Photodetector Names": string[], "Keythley Address": "VISA Instr", "Photodetector Detected?": bool, "Thorlabs Motors Detected?": bool, "Keithley Detected?": bool, "Thorlabs Motors Serial Number": "Thorlabs Motors Serial Number In.gtype", "Photodetector IVI session": "Ivi IviDefault"}
  "Instruments To Detect control.gtype" = enum{"Photodetector", "Keithley", "Arduinos", "Thorlabs Motors"}
uses:
  Rainbow Measurement Setup::Side Functions::Instrument Control::Instrument Detector.gvi
  Rainbow Measurement Setup::Side Functions::Global Abort::FGV Global Abort.gvi
diagram:
  # This subVI Basically detects the arduino and photodetector
  # only if the arduino address is empty. It is basically to prevent long
  # wait times when debugging.
  case ($"Error In") {
    frame Error, Default {
      w1 = $"Error In"
      w2 = $"Instrument Coms Info In"
    }
    frame No Error {
      Property Node(instance in=$"Instrument Coms Info In") -> ("Arduino Coms Info:XZ Stage Arduino Address"=w3, instance out=w4)
      Is Empty String Or Path(string/path=w3) -> w5
      case (w5) {
        frame False, Default {
          w2 = w4
          w1 = $"Error In"
        }
        frame True {
          s1 = $"Error In"  # shift register
          s2 = w4  # shift register
          for {
            w6 = each element of $"Instruments To Detect Array"
            call "Instrument Detector.gvi"(Instruments To Detect control=w6, Instrument Addresses In=s2, Error In=s1, Stand Alone?=$"Stand Alone?") -> (Instrument Addresses Out=w7, Error Out=w8)
            call "FGV Global Abort.gvi"(Global Abort Instructions="Read Current State", Error In=w8) -> (Global Abort Out=w9, Error Out=w10)
            next s1 = w10
            next s2 = w7
            stop if w9
          }
          w2 = s2
          w1 = s1
        }
      }
    }
  }
  $"Instrument Coms Info Out" <- w2
  $"Error Out" <- w1
