vi "Beam Spectrum Rainbow Sweep Subroutine.gvi"   [LabVIEW NXG 5.0.0]
inputs:
  "Instrument Coms Info In": "Instrument Coms Info.gtype"
  "Beam Spectrum Calibration Parameters": "Beam Spectrum Calibration Parameters.gtype"
  "Rainbow Sweep Param Selector": "Rainbow Sweep Param Selector.gtype" = {0, 1100, 300, 1, 1, 0}
  "Error In": error
outputs:
  "Instrument Coms Info Out": "Instrument Coms Info.gtype"
  "Full Beam Multispectral Data Array": "Full Beam Multispectral Data.gtype"[]
  "Error Out": error
types:
  "Raibow Sweep Selector.gtype" = enum{"Red Sweep", "Blue Sweep", "Full Sweep Red First", "Full Sweep Blue First"}
  "Rainbow Sweep Type Selector.gtype" = cluster{"Red Sweep Mode": enum{"Red Sweep Closing", "Red Sweep Opening"}, "Blue Sweep Mode": enum{"Blue Sweep Opening", "Blue Sweep Closing"}}
  "Rainbow Sweep Param Selector.gtype" = cluster{"Raibow Sweep Selector": "Raibow Sweep Selector.gtype", "Max Wavelength (nm)": f64, "Min Wavelength (nm)": f64, "Wavelength Step (nm)": f64, "Rainbow Sweep Types": "Rainbow Sweep Type Selector.gtype"}
  "Beam Spectrum Calibration Parameters.gtype" = cluster{"Min Position (mm)": f64, "Max Position (mm)": f64, "Position step size (mm)": f64}
  "Beam Spectrum Data.gtype" = cluster{"Beam Spectrum": cluster{"Wavelength": f64[], "Counts": f64[]}, "Blue Motor Position (mm)": f64, "Red Motor Position (mm)": f64}
  "Rainbow Sweep Types.gtype" = enum{"Red Sweep Closing", "Red Sweep Opening", "Blue Sweep Closing", "Blue Sweep Opening"}
  "Full Beam Multispectral Data.gtype" = cluster{"Beam Spectrum Data Array": "Beam Spectrum Data.gtype"[], "Rainbow Sweep Types": "Rainbow Sweep Types.gtype"}
  T1 = cluster{"Element 1": "VISA Instr", "Element 2": string}
  "Arduino Detection cluster control.gtype" = cluster{"XZ Stage Arduino Address": "VISA Instr", "XZ Stage Arduino Detected?": bool, "Multiplexer Arduino Detected?": bool, "Multiplexer Arduino Address": "VISA Instr", "Arduinos List": T1[], "XZ Stage Log": string, "Multiplexer Log": string}
  "Thorlabs Motors Serial Number In.gtype" = cluster{"Thorlabs Blue Motor": string, "Thorlabs Red Motor": string, "Blue Motor Homed?": bool, "Red Motor Homed?": bool}
  "Instrument Coms Info.gtype" = cluster{"Arduino Coms Info": "Arduino Detection cluster control.gtype", "Photodetector Names": string[], "Keythley Address": "VISA Instr", "Photodetector Detected?": bool, "Thorlabs Motors Detected?": bool, "Keithley Detected?": bool, "Thorlabs Motors Serial Number": "Thorlabs Motors Serial Number In.gtype", "Photodetector IVI session": "Ivi IviDefault"}
uses:
  Rainbow Measurement Setup::Side Functions::Rainbow Sweep::Rainbow Sweep Type Extractor.gvi
  NXG_KCube_DC_Servo_Control::Utilities::Initialize Motor and Home.gvi
  NXG_KCube_DC_Servo_Control::Utilities::Move To Position.gvi
  NXG_KCube_DC_Servo_Control::Utilities::Disconnect Motor.gvi
diagram:
  # This SubVI Performs a scan of the spectrum of the beam (STILL FLAME CONNECTION MISSING) and then moves the blade motors to perform a full scan of the spectrum with respect to position.
  case ($"Error In") {
    frame Error, Default {
      w1 = default
      w2 = $"Error In"
      w3 = $"Instrument Coms Info In"
    }
    frame No Error {
      Property Node(instance in=$"Beam Spectrum Calibration Parameters") -> ("Min Position (mm)"=w4, "Max Position (mm)"=w5, "Position step size (mm)"=w6)
      call "Rainbow Sweep Type Extractor.gvi"(Rainbow Sweep Parameters=$"Rainbow Sweep Param Selector", Error In=$"Error In") -> (Rainbow Sweep Array=w7, Error Out=w8)
      Subtract(x=w5, y=w4) -> w9
      Divide(x=w9, y=w6) -> w10
      To Signed 32 Bit Integer(number=w10) -> w11
      # w11: Number of Steps
      s1 = "Full Beam Multispectral Data.gtype"[] []  # shift register
      s2 = w8  # shift register
      s3 = $"Instrument Coms Info In"  # shift register
      for (iteration -> i1) {
        w12 = each element of w7
        Array Index(array=s1) -> (out0[i1]=w13)
        case (w12) {
          frame "Red Sweep Opening", Default {
            Property Node(instance in=s3) -> ("Thorlabs Motors Serial Number:Thorlabs Blue Motor"=w17, "Thorlabs Motors Serial Number:Blue Motor Homed?"=w18, instance out=w19)
            call "Initialize Motor and Home.gvi"(Current Motor Serial nº In=w17, Homed? In=w18, Error In=s2) -> (Current Motor Serial nº Out=w20, Homed? Out=w21, Error Out=w22)
            Property Node(instance in=w19, "Thorlabs Motors Serial Number:Blue Motor Homed?"=w21) -> (instance out=w14)
            s4 = w20  # shift register
            s5 = w22  # shift register
            s6 = "Beam Spectrum Data.gtype"[] []  # shift register
            for (N = w11) (iteration -> i2) {
              To Double Precision Float(number=i2) -> w23
              Multiply(w6, w23) -> w24
              Subtract(x=w5, y=w24) -> w25
              call "Move To Position.gvi"(Motor Serial Number In=s4, Position to move in mm=w25, Error In=s5) -> (Current Motor Serial nº=w26, Error Out=w27)
              w28 = cluster{"Wavelength": f64[], "Counts": f64[]} {"Wavelength"=[2, 3, 4], "Counts"=[5, 6, 7]}
              Property Node(instance in="Beam Spectrum Data.gtype" {all zero or empty}, "Beam Spectrum"=w28, "Blue Motor Position (mm)"=w25, "Red Motor Position (mm)"=0) -> (instance out=w29)
              Insert Into Array(inArray=s6, index0=i2, new=w29) -> w30
              next s4 = w26
              next s5 = w27
              next s6 = w30
            }
            call "Disconnect Motor.gvi"(Motor Serial nº=s4, Error In=s5) -> (Error Out=w15)
            Property Node(instance in=w13, "Rainbow Sweep Types"=w12, "Beam Spectrum Data Array"=s6) -> (instance out=w16)
          }
          frame "Red Sweep Closing" {
            Property Node(instance in=s3) -> ("Thorlabs Motors Serial Number:Thorlabs Blue Motor"=w31, "Thorlabs Motors Serial Number:Blue Motor Homed?"=w32, instance out=w33)
            call "Initialize Motor and Home.gvi"(Current Motor Serial nº In=w31, Homed? In=w32, Error In=s2) -> (Current Motor Serial nº Out=w34, Homed? Out=w35, Error Out=w36)
            Property Node(instance in=w33, "Thorlabs Motors Serial Number:Blue Motor Homed?"=w35) -> (instance out=w14)
            s7 = w34  # shift register
            s8 = w36  # shift register
            s9 = "Beam Spectrum Data.gtype"[] []  # shift register
            for (N = w11) (iteration -> i3) (after w5) {
              To Double Precision Float(number=i3) -> w37
              Multiply(w6, w37) -> w38
              Add(w4, w38) -> w39
              call "Move To Position.gvi"(Motor Serial Number In=s7, Position to move in mm=w39, Error In=s8) -> (Current Motor Serial nº=w40, Error Out=w41)
              w42 = cluster{"Wavelength": f64[], "Counts": f64[]} {"Wavelength"=[2, 3, 4], "Counts"=[5, 6, 7]}
              Property Node(instance in="Beam Spectrum Data.gtype" {all zero or empty}, "Beam Spectrum"=w42, "Blue Motor Position (mm)"=w39, "Red Motor Position (mm)"=0) -> (instance out=w43)
              Insert Into Array(inArray=s9, index0=i3, new=w43) -> w44
              next s7 = w40
              next s8 = w41
              next s9 = w44
            }
            call "Disconnect Motor.gvi"(Motor Serial nº=s7, Error In=s8) -> (Error Out=w15)
            Property Node(instance in=w13, "Rainbow Sweep Types"=w12, "Beam Spectrum Data Array"=s9) -> (instance out=w16)
          }
          frame "Blue Sweep Closing" {
            Property Node(instance in=s3) -> ("Thorlabs Motors Serial Number:Thorlabs Red Motor"=w45, "Thorlabs Motors Serial Number:Red Motor Homed?"=w46, instance out=w47)
            call "Initialize Motor and Home.gvi"(Current Motor Serial nº In=w45, Homed? In=w46, Error In=s2) -> (Current Motor Serial nº Out=w48, Homed? Out=w49, Error Out=w50)
            Property Node(instance in=w47, "Thorlabs Motors Serial Number:Red Motor Homed?"=w49) -> (instance out=w14)
            s10 = w48  # shift register
            s11 = w50  # shift register
            s12 = "Beam Spectrum Data.gtype"[] []  # shift register
            for (N = w11) (iteration -> i4) (after w5) {
              To Double Precision Float(number=i4) -> w51
              Multiply(w6, w51) -> w52
              Add(w4, w52) -> w53
              call "Move To Position.gvi"(Motor Serial Number In=s10, Position to move in mm=w53, Error In=s11) -> (Current Motor Serial nº=w54, Error Out=w55)
              w56 = cluster{"Wavelength": f64[], "Counts": f64[]} {"Wavelength"=[2, 3, 4], "Counts"=[5, 6, 7]}
              Property Node(instance in="Beam Spectrum Data.gtype" {all zero or empty}, "Beam Spectrum"=w56, "Red Motor Position (mm)"=w53, "Blue Motor Position (mm)"=0) -> (instance out=w57)
              Insert Into Array(inArray=s12, index0=i4, new=w57) -> w58
              next s10 = w54
              next s11 = w55
              next s12 = w58
            }
            call "Disconnect Motor.gvi"(Motor Serial nº=s10, Error In=s11) -> (Error Out=w15)
            Property Node(instance in=w13, "Rainbow Sweep Types"=w12, "Beam Spectrum Data Array"=s12) -> (instance out=w16)
          }
          frame "Blue Sweep Opening" {
            Property Node(instance in=s3) -> ("Thorlabs Motors Serial Number:Thorlabs Red Motor"=w59, "Thorlabs Motors Serial Number:Red Motor Homed?"=w60, instance out=w61)
            call "Initialize Motor and Home.gvi"(Current Motor Serial nº In=w59, Homed? In=w60, Error In=s2) -> (Current Motor Serial nº Out=w62, Homed? Out=w63, Error Out=w64)
            Property Node(instance in=w61, "Thorlabs Motors Serial Number:Red Motor Homed?"=w63) -> (instance out=w14)
            s13 = w62  # shift register
            s14 = w64  # shift register
            s15 = "Beam Spectrum Data.gtype"[] []  # shift register
            for (N = w11) (iteration -> i5) (after w4) {
              To Double Precision Float(number=i5) -> w65
              Multiply(w6, w65) -> w66
              Subtract(x=w5, y=w66) -> w67
              call "Move To Position.gvi"(Motor Serial Number In=s13, Position to move in mm=w67, Error In=s14) -> (Current Motor Serial nº=w68, Error Out=w69)
              w70 = cluster{"Wavelength": f64[], "Counts": f64[]} {"Wavelength"=[2, 3, 4], "Counts"=[5, 6, 7]}
              Property Node(instance in="Beam Spectrum Data.gtype" {all zero or empty}, "Beam Spectrum"=w70, "Red Motor Position (mm)"=w67, "Blue Motor Position (mm)"=0) -> (instance out=w71)
              Insert Into Array(inArray=s15, index0=i5, new=w71) -> w72
              next s13 = w68
              next s14 = w69
              next s15 = w72
            }
            call "Disconnect Motor.gvi"(Motor Serial nº=s13, Error In=s14) -> (Error Out=w15)
            Property Node(instance in=w13, "Rainbow Sweep Types"=w12, "Beam Spectrum Data Array"=s15) -> (instance out=w16)
          }
        }
        Insert Into Array(inArray=s1, index0=i1, new=w16) -> w73
        next s1 = w73
        next s2 = w15
        next s3 = w14
      }
      w1 = s1
      w2 = s2
      w3 = s3
    }
  }
  $"Instrument Coms Info Out" <- w3
  $"Error Out" <- w2
  $"Full Beam Multispectral Data Array" <- w1
