vi "Function.gvi"   [LabVIEW NXG 5.0.0]
inputs:
  "Input_6": "Instrument Coms Info.gtype"
  "Input_3": i32
  "Input_4": f64
  "Input": f64
  "Input_5": f64
  "element": "Full Beam Multispectral Data.gtype"
  "Input_2": "Rainbow Sweep Types.gtype" = "Red Sweep Closing"
  "Input_7": error
outputs:
  "Output_2": "Instrument Coms Info.gtype"
  "new element/subarray": "Full Beam Multispectral Data.gtype"
  "Output": error
types:
  "Rainbow Sweep Types.gtype" = enum{"Red Sweep Closing", "Red Sweep Opening", "Blue Sweep Closing", "Blue Sweep Opening"}
  T1 = cluster{"Element 1": "VISA Instr", "Element 2": string}
  "Arduino Detection cluster control.gtype" = cluster{"XZ Stage Arduino Address": "VISA Instr", "XZ Stage Arduino Detected?": bool, "Multiplexer Arduino Detected?": bool, "Multiplexer Arduino Address": "VISA Instr", "Arduinos List": T1[], "XZ Stage Log": string, "Multiplexer Log": string}
  "Thorlabs Motors Serial Number In.gtype" = cluster{"Thorlabs Blue Motor": string, "Thorlabs Red Motor": string, "Blue Motor Homed?": bool, "Red Motor Homed?": bool}
  "Instrument Coms Info.gtype" = cluster{"Arduino Coms Info": "Arduino Detection cluster control.gtype", "Photodetector Names": string[], "Keythley Address": "VISA Instr", "Photodetector Detected?": bool, "Thorlabs Motors Detected?": bool, "Keithley Detected?": bool, "Thorlabs Motors Serial Number": "Thorlabs Motors Serial Number In.gtype", "Photodetector IVI session": "Ivi IviDefault"}
  "Beam Spectrum Data.gtype" = cluster{"Beam Spectrum": cluster{"Wavelength": f64[], "Counts": f64[]}, "Blue Motor Position (mm)": f64, "Red Motor Position (mm)": f64}
  "Full Beam Multispectral Data.gtype" = cluster{"Beam Spectrum Data Array": "Beam Spectrum Data.gtype"[], "Rainbow Sweep Types": "Rainbow Sweep Types.gtype"}
uses:
  NXG_KCube_DC_Servo_Control::Utilities::Initialize Motor and Home.gvi
  NXG_KCube_DC_Servo_Control::Utilities::Move To Position.gvi
  NXG_KCube_DC_Servo_Control::Utilities::Disconnect Motor.gvi
diagram:
  case ($Input_2) {
    frame "Red Sweep Opening", Default {
      Property Node(instance in=$Input_6) -> ("Thorlabs Motors Serial Number:Thorlabs Blue Motor"=w4, "Thorlabs Motors Serial Number:Blue Motor Homed?"=w5, instance out=w6)
      call "Initialize Motor and Home.gvi"(Current Motor Serial nº In=w4, Homed? In=w5, Error In=$Input_7) -> (Current Motor Serial nº Out=w7, Homed? Out=w8, Error Out=w9)
      Property Node(instance in=w6, "Thorlabs Motors Serial Number:Blue Motor Homed?"=w8) -> (instance out=w1)
      s1 = w7  # shift register
      s2 = w9  # shift register
      s3 = "Beam Spectrum Data.gtype"[] []  # shift register
      for (N = $Input_3) (iteration -> i1) {
        To Double Precision Float(number=i1) -> w10
        Multiply($Input_5, w10) -> w11
        Subtract(x=$Input_4, y=w11) -> w12
        call "Move To Position.gvi"(Motor Serial Number In=s1, Position to move in mm=w12, Error In=s2) -> (Current Motor Serial nº=w13, Error Out=w14)
        w15 = cluster{"Wavelength": f64[], "Counts": f64[]} {"Wavelength"=[2, 3, 4], "Counts"=[5, 6, 7]}
        Property Node(instance in="Beam Spectrum Data.gtype" {all zero or empty}, "Beam Spectrum"=w15, "Blue Motor Position (mm)"=w12, "Red Motor Position (mm)"=0) -> (instance out=w16)
        Insert Into Array(inArray=s3, index0=i1, new=w16) -> w17
        next s1 = w13
        next s2 = w14
        next s3 = w17
      }
      call "Disconnect Motor.gvi"(Motor Serial nº=s1, Error In=s2) -> (Error Out=w2)
      Property Node(instance in=$element, "Rainbow Sweep Types"=$Input_2, "Beam Spectrum Data Array"=s3) -> (instance out=w3)
    }
    frame "Red Sweep Closing" {
      Property Node(instance in=$Input_6) -> ("Thorlabs Motors Serial Number:Thorlabs Blue Motor"=w18, "Thorlabs Motors Serial Number:Blue Motor Homed?"=w19, instance out=w20)
      call "Initialize Motor and Home.gvi"(Current Motor Serial nº In=w18, Homed? In=w19, Error In=$Input_7) -> (Current Motor Serial nº Out=w21, Homed? Out=w22, Error Out=w23)
      Property Node(instance in=w20, "Thorlabs Motors Serial Number:Blue Motor Homed?"=w22) -> (instance out=w1)
      s4 = w21  # shift register
      s5 = w23  # shift register
      s6 = "Beam Spectrum Data.gtype"[] []  # shift register
      for (N = $Input_3) (iteration -> i2) (after $Input_4) {
        To Double Precision Float(number=i2) -> w24
        Multiply($Input_5, w24) -> w25
        Add($Input, w25) -> w26
        call "Move To Position.gvi"(Motor Serial Number In=s4, Position to move in mm=w26, Error In=s5) -> (Current Motor Serial nº=w27, Error Out=w28)
        w29 = cluster{"Wavelength": f64[], "Counts": f64[]} {"Wavelength"=[2, 3, 4], "Counts"=[5, 6, 7]}
        Property Node(instance in="Beam Spectrum Data.gtype" {all zero or empty}, "Beam Spectrum"=w29, "Blue Motor Position (mm)"=w26, "Red Motor Position (mm)"=0) -> (instance out=w30)
        Insert Into Array(inArray=s6, index0=i2, new=w30) -> w31
        next s4 = w27
        next s5 = w28
        next s6 = w31
      }
      call "Disconnect Motor.gvi"(Motor Serial nº=s4, Error In=s5) -> (Error Out=w2)
      Property Node(instance in=$element, "Rainbow Sweep Types"=$Input_2, "Beam Spectrum Data Array"=s6) -> (instance out=w3)
    }
    frame "Blue Sweep Closing" {
      Property Node(instance in=$Input_6) -> ("Thorlabs Motors Serial Number:Thorlabs Red Motor"=w32, "Thorlabs Motors Serial Number:Red Motor Homed?"=w33, instance out=w34)
      call "Initialize Motor and Home.gvi"(Current Motor Serial nº In=w32, Homed? In=w33, Error In=$Input_7) -> (Current Motor Serial nº Out=w35, Homed? Out=w36, Error Out=w37)
      Property Node(instance in=w34, "Thorlabs Motors Serial Number:Red Motor Homed?"=w36) -> (instance out=w1)
      s7 = w35  # shift register
      s8 = w37  # shift register
      s9 = "Beam Spectrum Data.gtype"[] []  # shift register
      for (N = $Input_3) (iteration -> i3) (after $Input_4) {
        To Double Precision Float(number=i3) -> w38
        Multiply($Input_5, w38) -> w39
        Add($Input, w39) -> w40
        call "Move To Position.gvi"(Motor Serial Number In=s7, Position to move in mm=w40, Error In=s8) -> (Current Motor Serial nº=w41, Error Out=w42)
        w43 = cluster{"Wavelength": f64[], "Counts": f64[]} {"Wavelength"=[2, 3, 4], "Counts"=[5, 6, 7]}
        Property Node(instance in="Beam Spectrum Data.gtype" {all zero or empty}, "Beam Spectrum"=w43, "Red Motor Position (mm)"=w40, "Blue Motor Position (mm)"=0) -> (instance out=w44)
        Insert Into Array(inArray=s9, index0=i3, new=w44) -> w45
        next s7 = w41
        next s8 = w42
        next s9 = w45
      }
      call "Disconnect Motor.gvi"(Motor Serial nº=s7, Error In=s8) -> (Error Out=w2)
      Property Node(instance in=$element, "Rainbow Sweep Types"=$Input_2, "Beam Spectrum Data Array"=s9) -> (instance out=w3)
    }
    frame "Blue Sweep Opening" {
      Property Node(instance in=$Input_6) -> ("Thorlabs Motors Serial Number:Thorlabs Red Motor"=w46, "Thorlabs Motors Serial Number:Red Motor Homed?"=w47, instance out=w48)
      call "Initialize Motor and Home.gvi"(Current Motor Serial nº In=w46, Homed? In=w47, Error In=$Input_7) -> (Current Motor Serial nº Out=w49, Homed? Out=w50, Error Out=w51)
      Property Node(instance in=w48, "Thorlabs Motors Serial Number:Red Motor Homed?"=w50) -> (instance out=w1)
      s10 = w49  # shift register
      s11 = w51  # shift register
      s12 = "Beam Spectrum Data.gtype"[] []  # shift register
      for (N = $Input_3) (iteration -> i4) (after $Input) {
        To Double Precision Float(number=i4) -> w52
        Multiply($Input_5, w52) -> w53
        Subtract(x=$Input_4, y=w53) -> w54
        call "Move To Position.gvi"(Motor Serial Number In=s10, Position to move in mm=w54, Error In=s11) -> (Current Motor Serial nº=w55, Error Out=w56)
        w57 = cluster{"Wavelength": f64[], "Counts": f64[]} {"Wavelength"=[2, 3, 4], "Counts"=[5, 6, 7]}
        Property Node(instance in="Beam Spectrum Data.gtype" {all zero or empty}, "Beam Spectrum"=w57, "Red Motor Position (mm)"=w54, "Blue Motor Position (mm)"=0) -> (instance out=w58)
        Insert Into Array(inArray=s12, index0=i4, new=w58) -> w59
        next s10 = w55
        next s11 = w56
        next s12 = w59
      }
      call "Disconnect Motor.gvi"(Motor Serial nº=s10, Error In=s11) -> (Error Out=w2)
      Property Node(instance in=$element, "Rainbow Sweep Types"=$Input_2, "Beam Spectrum Data Array"=s12) -> (instance out=w3)
    }
  }
  $Output_2 <- w1
  $Output <- w2
  $"new element/subarray" <- w3
