vi "Find Correlative Spectra.gvi"   [LabVIEW NXG 5.0.0]
inputs:
  "Blue Spectra": "Full MSpot Multispectral Data.gtype"
  "Red Spectra": "Full MSpot Multispectral Data.gtype"
  "Error In": error
outputs:
  "Error Out": error
  "Matching Index Array": cluster{"Blue Index": i32, "Red Index": i32}[]
panel indicators:
  "value": f64
  "Output": f64[][]
  "Graph": cluster{"Element 1": f64[], "Element 2": f64[]}[]
  "Corelative Motor Positions": T1[]
  "Motor Position for corelative Plots": f64[][]
  "slope": f64
  "intercept": f64
types:
  "MSpot Spectrum Data.gtype" = cluster{"M Spot Spectrum": cluster{"Wavelength": f64[], "Counts": f64[]}, "Blue Motor Position (mm)": f64, "Red Motor Position (mm)": f64, "Dividing Wavelength (nm)": f64}
  "Rainbow Sweep Types.gtype" = enum{"Red Sweep Closing", "Red Sweep Opening", "Blue Sweep Closing", "Blue Sweep Opening"}
  "Full MSpot Multispectral Data.gtype" = cluster{"MSpot Spectrum Data Array": "MSpot Spectrum Data.gtype"[], "Rainbow Sweep Types": "Rainbow Sweep Types.gtype"}
  T1 = cluster{"Blue Motor Position": f64, "Red Motor Position": f64}
uses:
  Rainbow Measurement Setup::Main Functions::One Time Calibrations::MSpot Spectrum::Data Visualization::Substract Background Spectra.gvi
  Rainbow Measurement Setup::Main Functions::One Time Calibrations::MSpot Spectrum::Data Visualization::Max Spectra Averageing.gvi
  Rainbow Measurement Setup::Side Functions::Utilities::Array Operations::Array Zero Element Remover.gvi
  NI::Analysis::Fitting::Linear Fit.gvi
diagram:
  # This SubVI adds each and every spectrum from the red and blue sweeps seeking to find the sum that most closely resembles the full solar spectrum.
  # It outputs it as a list of indexes so that it can be later visualized
  case ($"Error In") {
    frame Error, Default {
      w1 = $"Error In"
      w2 = default
      w3 = default
    }
    frame No Error {
      call "Substract Background Spectra.gvi"(With Background Spectra=$"Red Spectra", Error In=$"Error In") -> (W/o Background Spectra=w4, Error Out=w5)
      Property Node(instance in=w4) -> ("MSpot Spectrum Data Array"=w6, instance out=w7)
      call "Substract Background Spectra.gvi"(With Background Spectra=$"Blue Spectra", Error In=w5) -> (W/o Background Spectra=w8, Error Out=w9)
      Property Node(instance in=w8) -> ("MSpot Spectrum Data Array"=w10, instance out=w11)
      call "Max Spectra Averageing.gvi"(Red Spectra=w7, Blue Spectra=w11, Error In=w9) -> (Max Spectra Counts=w12, Error Out=w1)
      for (iteration -> i1) {
        w13 = each element of w6
        Property Node(instance in=w13) -> ("M Spot Spectrum:Counts"=w18, "Blue Motor Position (mm)"=w19)
        call "Array Zero Element Remover.gvi"(Input 1D array=w18) -> (No zero 1D array Out=w20)
        s1 = 9999999999  # shift register
        for (iteration -> i2) {
          w21 = each element of w10
          Property Node(instance in=w21) -> ("M Spot Spectrum:Counts"=w27, "M Spot Spectrum:Wavelength"=w28, "Red Motor Position (mm)"=w29)
          Add(w18, w27) -> w30
          Subtract(x=w12, y=w30) -> w31
          Absolute Value(x=w31) -> w32
          Add Array Elements(numeric array=w32) -> (sum=w33)
          $value <- w33
          Is Less(x=w33, y=s1) -> w34
          Select(s=w34, t=w33, f=s1) -> w35
          call "Array Zero Element Remover.gvi"(Input 1D array=w28) -> (No zero 1D array Out=w36)
          Build Cluster(w36, w20) -> w37
          Build Cluster(w36, w12) -> w38
          call "Array Zero Element Remover.gvi"(Input 1D array=w27) -> (No zero 1D array Out=w39)
          Build Cluster(w36, w39) -> w40
          Build Array(w40, w37, w38) -> w41
          $Graph <- w41
          Property Node(instance in=T1 {all zero or empty}, "Blue Motor Position"=w19, "Red Motor Position"=w29) -> (instance out=w42)
          w43 = cluster{"Blue Index": i32, "Red Index": i32} {all zero or empty}
          Property Node(instance in=w43, "Blue Index"=i2, "Red Index"=i1) -> (instance out=w44)
          w22 = w44 if w34
          append w35 to w23
          w24 = w42 if w34
          w25 = w19 if w34
          w26 = w29 if w34
          next s1 = w35
        }
        append w22 to w2
        append w23 to w14
        append w24 to w3
        append w25 to w15
        append w26 to w16
        append i1 to w17
      }
      Array Subset(array=w16, index0=100, length0=300) -> w45
      Array Subset(array=w17, index0=100, length0=300) -> w46
      call "Linear Fit.gvi"(method="Least Square"(0), y=w45, x=w46) -> (best linear fit=w47, slope=w48, intercept=w49)
      Build Array(w15, w16, w47) -> w50
      $"Motor Position for corelative Plots" <- w50
      Multiply(w48, 10) -> w51
      $slope <- w51
      $intercept <- w49
      $Output <- w14
    }
  }
  $"Error Out" <- w1
  $"Matching Index Array" <- w2
  $"Corelative Motor Positions" <- w3
