vi "MSpot Spectrum Visualizer.gvi"   [LabVIEW NXG 5.0.0]
inputs:
  "Error In": error
  "MSpot Mega Cluster In": "MSpot Mega Cluster.gtype"
outputs:
  "Error Out": error
panel controls:
  "Sweep Type Selector": i32
  "Graph (position) Selector": i32
  "Continue": bool
  "Divide?": bool
  "Smooth Peaks?": bool
  "Graph (position) Selector 2": i32
  "Add Two Spectra": bool
  "Full Spectrum": bool
  "Complementary Graphs": bool
panel indicators:
  "Rainbow Sweep Type": "Rainbow Sweep Types.gtype"
  "M Spot Spectrum": cluster{"Element 1": f64[], "Element 2": f64[]}[]
  "MSpot Spectrum Data": "MSpot Spectrum Data.gtype"
  "Blue Motor Position (mm)": f64
  "Red Motor Position (mm)": f64
types:
  "Rainbow Sweep Types.gtype" = enum{"Red Sweep Closing", "Red Sweep Opening", "Blue Sweep Closing", "Blue Sweep Opening"}
  "MSpot Spectrum Data.gtype" = cluster{"M Spot Spectrum": cluster{"Wavelength": f64[], "Counts": f64[]}, "Blue Motor Position (mm)": f64, "Red Motor Position (mm)": f64, "Dividing Wavelength (nm)": f64}
  "Raibow Sweep Selector.gtype" = enum{"Red Sweep", "Blue Sweep", "Full Sweep Red First", "Full Sweep Blue First"}
  "Rainbow Sweep Param Selector.gtype" = cluster{"Raibow Sweep Selector": "Raibow Sweep Selector.gtype", "Max Wavelength (nm)": f64, "Min Wavelength (nm)": f64, "Wavelength Step (nm)": f64, "Rainbow Sweep Type Selector": "Rainbow Sweep Type Selector.gtype"}
  "MSpot Spectrum Calibration Parameters.gtype" = cluster{"Min Position (mm)": f64, "Max Position (mm)": f64, "Position step size (mm)": f64, "Manual Spectra?": bool, "Flame Integration Time (us)": f64, "Flame Scans to Average": u32}
  "Full MSpot Multispectral Data.gtype" = cluster{"MSpot Spectrum Data Array": "MSpot Spectrum Data.gtype"[], "Rainbow Sweep Types": "Rainbow Sweep Types.gtype"}
  "MSpot Mega Cluster.gtype" = cluster{"Rainbow Sweep Parameters MSpot": "Rainbow Sweep Param Selector.gtype", "MSpot Sperctrum Calibration Parameters": "MSpot Spectrum Calibration Parameters.gtype", "Full Beam Multispectral Data Array": "Full MSpot Multispectral Data.gtype"[]}
uses:
  NI::G Core::Error::Multiplex Errors.gvi
  Rainbow Measurement Setup::Side Functions::Instrument Control::Thorlabs Motors::Dividing Wavelength Control::Dividing Wavelength Calibration Data FGV.gvi
  Rainbow Measurement Setup::Main Functions::One Time Calibrations::MSpot Spectrum::Data Visualization::Two Different Sweep Type Check and extract.gvi
  Rainbow Measurement Setup::Main Functions::One Time Calibrations::MSpot Spectrum::Data Visualization::Spectra Adder.gvi
  Rainbow Measurement Setup::Main Functions::One Time Calibrations::MSpot Spectrum::Dividing Wavelength Calculations::Spectra Operator.gvi
  Rainbow Measurement Setup::Side Functions::Messages And Prompts::General Simple Prompt.gvi
  Rainbow Measurement Setup::Main Functions::One Time Calibrations::MSpot Spectrum::Data Visualization::Find Correlative Spectra.gvi
diagram:
  Property Node(instance in=reference to unnamed native front panel, error in=$"Error In") -> ("Window"=w1, error out=w2)
  Open Window(reference in=w1, error in=w2) -> (reference out=w3, error out=w4)
  Property Node(instance in=reference to "Full Spectrum", "Visible"=FALSE, error in=w4) -> (error out=w5)
  Property Node(instance in=reference to "Graph (position) Selector 2", "Visible"=FALSE, error in=w4) -> (error out=w6)
  Property Node(instance in=reference to "Complementary Graphs", "Value"=FALSE, error in=w4) -> (error out=w7)
  Property Node(instance in=reference to "Add Two Spectra", "ValueSignaling"=FALSE, error in=w7) -> (error out=w8)
  Build Array(w6, w5, w8) -> w9
  call "Multiplex Errors.gvi"(error array in=w9) -> (error out=w10)
  # This subVI allows us to visualize the data obtained on the Measuring Spot Spectrum Calibration subroutine so that we can
  # extract our own conclusions and elaborate the calibration file.
  case (w10) {
    frame Error, Default {
      w11 = w10
      w12 = w3
    }
    frame No Error {
      Property Node(instance in=$"MSpot Mega Cluster In") -> ("Full Beam Multispectral Data Array"=w13)
      Is Empty Array(array=w13) -> w14
      case (w14) {
        frame True {
          One Button Dialog(button name ("OK")="Oh, sorry", message="No Calibration Found")
          w11 = w10
        }
        frame False {
          Array Index(array=w13) -> (out0[$"Sweep Type Selector"]=w15)
          call "Dividing Wavelength Calibration Data FGV.gvi"(Div Wavelength FGV Instructions="Read Loaded Data", Error In=w10) -> (Dividing Wavelength Calibration Data Out=w16, Error Out=w17)
          s1 = w15  # shift register
          s2 = uninitialised  # shift register
          while {
            event (timeout = 50) {
              on "Timeout" {
                call "Two Different Sweep Type Check and extract.gvi"(Full Beam Multispectral data Array In=w13, Error In=w17) -> (Red Spectra=w20, Blue Spectra=w21, Error Out=w22)
                Array Size(array=w13) -> (size(s)=w23)
                Decrement(x=w23) -> w24
                Is Not Equal To 0(x=w24) -> w25
                Logical And(w25, not $"Add Two Spectra") -> w26
                Property Node(instance in=reference to "Sweep Type Selector", "Maximum"=w24, "Minimum"=0, "Visible"=w26, error in=w22) -> (error out=w27)
                Not(x=$"Add Two Spectra") -> w28
                Property Node(instance in=reference to "Rainbow Sweep Type", "Visible"=w28, error in=w27) -> (error out=w29)
                case ($"Add Two Spectra") {
                  frame False {
                    Property Node(instance in=s1) -> ("MSpot Spectrum Data Array"=w30, "Rainbow Sweep Types"=w31, instance out=w18)
                    Array Index(array=w30) -> (out0[$"Graph (position) Selector"]=w32)
                    Property Node(instance in=w32) -> ("M Spot Spectrum"=w33, "Dividing Wavelength (nm)"=w34)
                    Property Node(instance in=w33) -> ("Wavelength"=w35, "Counts"=w36)
                    Is Empty Array(array=w36) -> w37
                    case (w37) {
                      frame True { }
                      frame False {
                        Build Cluster(w35, w36) -> w38
                        Build Array(w38) -> w39
                        $"M Spot Spectrum" <- w39
                      }
                    }
                    $"MSpot Spectrum Data" <- w32
                    $"Rainbow Sweep Type" <- w31
                    Property Node(instance in=reference to "M Spot Spectrum") -> ("Cursor"=w40)
                    Property Node(instance in=w40, "XPosition"=w34, "Visible"=TRUE)
                    Array Size(array=w30) -> (size(s)=w41)
                    Decrement(x=w41) -> w42
                    Property Node(instance in=reference to "Graph (position) Selector", "Minimum"=0, "Maximum"=w42, error in=w29) -> (error out=w11)
                    w19 = s2
                  }
                  frame True {
                    call "Spectra Adder.gvi"(Graph reference=reference to "M Spot Spectrum", Graph position Selector reference=reference to "Graph (position) Selector", Graph position Selector reference 2=reference to "Graph (position) Selector 2", Full Spectrum=$"Full Spectrum", Blue Spectra=w21, Graph position Selector=$"Graph (position) Selector", Red Spectra=w20, Graph position Selector 2=$"Graph (position) Selector 2", Dividing Wavelegth Calibration Data=w16, Error In=w29, Complementary Graphs=$"Complementary Graphs", Complementary Graphs Index Array=s2) -> (M Spot Spectrum=w43, Blue Motor Position (mm)=w44, Red Motor Position (mm)=w45, Error Out=w11)
                    $"M Spot Spectrum" <- w43
                    $"Blue Motor Position (mm)" <- w44
                    $"Red Motor Position (mm)" <- w45
                    w18 = s1
                    w19 = s2
                  }
                }
              }
              on "Divide?" Value changed; "Smooth Peaks?" Value changed; "Sweep Type Selector" Value changed {
                Array Index(array=w13) -> (out0[$"Sweep Type Selector"]=w46)
                case ($"Divide?") {
                  frame False, Default {
                    w47 = w46
                    w48 = w17
                  }
                  frame True {
                    call "Spectra Operator.gvi"(Full MSpot Multispectral Data=w46, Error In=w17, Spectra Operator control="Divide Spectra") -> (Operated Data=w47, Error Out=w48)
                  }
                }
                case ($"Smooth Peaks?") {
                  frame False, Default {
                    w18 = w47
                    w11 = w48
                  }
                  frame True {
                    call "Spectra Operator.gvi"(Full MSpot Multispectral Data=w47, Error In=w48, Spectra Operator control="Smooth Peaks") -> (Operated Data=w18, Error Out=w11)
                  }
                }
                w19 = s2
              }
              on "Add Two Spectra" Value changed; "Complementary Graphs" Value changed {
                Event Data() -> ("New Value"=w49)
                call "Two Different Sweep Type Check and extract.gvi"(Full Beam Multispectral data Array In=w13, Error In=w17) -> (Two Different Sweep Types?=w50, Red Spectra=w51, Blue Spectra=w52, Error Out=w53)
                case (w50) {
                  frame False, Default {
                    $"Add Two Spectra" <- FALSE
                    Property Node(instance in=reference to "Graph (position) Selector 2", "Visible"=FALSE)
                    w54 = "To add two spectra you need to perform at least a red sweep and a blue sweep calibration. Please perform the needed calibrations and try again."
                    One Button Dialog(button name ("OK")="Oh sorry I will", message=w54)
                    w11 = w53
                    w19 = default
                  }
                  frame True {
                    Property Node(instance in=reference to "Complementary Graphs", "Visible"=w49) -> ("Value"=w55)
                    Logical And(w49, not w55) -> w56
                    Property Node(instance in=reference to "Graph (position) Selector 2", "Visible"=w56)
                    Property Node(instance in=reference to "Full Spectrum", "Visible"=w49)
                    case (w55) {
                      frame False, Default {
                        w11 = w53
                        w19 = s2
                      }
                      frame True {
                        call "General Simple Prompt.gvi"(Prompt Message="Please wait until the calculations have finished", Okay Button Message="Okay I'll wait", Error In=w53, Prompt?=TRUE) -> (Error Out=w57)
                        call "Find Correlative Spectra.gvi"(Red Spectra=w51, Blue Spectra=w52, Error In=w57) -> (Matching Index Array=w19, Error Out=w58)
                        call "General Simple Prompt.gvi"(Prompt Message="The calculations have finished", Okay Button Message="Okay thanks", Error In=w58, Prompt?=TRUE) -> (Error Out=w11)
                      }
                    }
                    Not(x=w49) -> w59
                    Property Node(instance in=reference to "Divide?", "Visible"=w59)
                    Property Node(instance in=reference to "Smooth Peaks?", "Visible"=w59)
                    Property Node(instance in=reference to "MSpot Spectrum Data", "Visible"=w59)
                  }
                }
                w18 = s1
              }
            }
            next s1 = w18
            next s2 = w19
            stop if $Continue
          }
        }
      }
      w12 = w3
    }
  }
  Close Window(reference in=w12, error in=w11) -> (error out=w60)
  $"Error Out" <- w60
