vi "Max Spectra Averageing.gvi"   [LabVIEW NXG 5.0.0]
inputs:
  "Error In": error
  "Red Spectra": "Full MSpot Multispectral Data.gtype"
  "Blue Spectra": "Full MSpot Multispectral Data.gtype"
outputs:
  "Error Out": error
  "Max Spectra Counts": f64[]
types:
  "MSpot Spectrum Data.gtype" = cluster{"M Spot Spectrum": cluster{"Wavelength": f64[], "Counts": f64[]}, "Blue Motor Position (mm)": f64, "Red Motor Position (mm)": f64, "Dividing Wavelength (nm)": f64}
  "Rainbow Sweep Types.gtype" = enum{"Red Sweep Closing", "Red Sweep Opening", "Blue Sweep Closing", "Blue Sweep Opening"}
  "Full MSpot Multispectral Data.gtype" = cluster{"MSpot Spectrum Data Array": "MSpot Spectrum Data.gtype"[], "Rainbow Sweep Types": "Rainbow Sweep Types.gtype"}
uses:
  Rainbow Measurement Setup::Main Functions::One Time Calibrations::MSpot Spectrum::Data Visualization::Max_Min Spectra Extractor.gvi
diagram:
  # This SubVI Averages the maximum spectra of the two sweeps
  # and outputs an array with just the count values
  case ($"Error In") {
    frame Error, Default {
      w1 = $"Error In"
      w2 = default
    }
    frame No Error {
      call "Max_Min Spectra Extractor.gvi"(Full MSpot Multispectral Data=$"Red Spectra", Error In=$"Error In") -> (Max Open Spectra=w3, Error Out=w4)
      call "Max_Min Spectra Extractor.gvi"(Full MSpot Multispectral Data=$"Blue Spectra", Error In=w4) -> (Max Open Spectra=w5, Error Out=w1)
      Property Node(instance in=w5) -> ("M Spot Spectrum:Counts"=w6)
      Property Node(instance in=w3) -> ("M Spot Spectrum:Counts"=w7)
      Add(w6, w7) -> w8
      Divide(x=w8, y=2) -> w2
    }
  }
  $"Max Spectra Counts" <- w2
  $"Error Out" <- w1
