vi "Max Spectra Extractor.gvi"   [LabVIEW NXG 5.0.0]
inputs:
  "Error In": error
  "Full MSpot Multispectral Data": "Full MSpot Multispectral Data.gtype"
outputs:
  "Error Out": error
  "Max Open Spectra": "MSpot Spectrum Data.gtype"
  "Max Open Spectra Graph": cluster{"Element 1": f64[], "Element 2": f64[]}
types:
  "MSpot Spectrum Data.gtype" = cluster{"M Spot Spectrum": cluster{"Wavelength": f64[], "Counts": f64[]}, "Blue Motor Position (mm)": f64, "Red Motor Position (mm)": f64, "Dividing Wavelength (nm)": f64}
  "Rainbow Sweep Types.gtype" = enum{"Red Sweep Closing", "Red Sweep Opening", "Blue Sweep Closing", "Blue Sweep Opening"}
  "Full MSpot Multispectral Data.gtype" = cluster{"MSpot Spectrum Data Array": "MSpot Spectrum Data.gtype"[], "Rainbow Sweep Types": "Rainbow Sweep Types.gtype"}
diagram:
  # This SubVI Extracts the Maximum Open Spectra for each type of sweep
  case ($"Error In") {
    frame Error, Default {
      w1 = $"Error In"
      w2 = default
      w3 = default
    }
    frame No Error {
      Property Node(instance in=$"Full MSpot Multispectral Data") -> ("MSpot Spectrum Data Array"=w4, "Rainbow Sweep Types"=w5)
      case (w5) {
        frame "Red Sweep Opening" {
          Array Size(array=w4) -> (size(s)=w6)
          Decrement(x=w6) -> w7
          Array Index(array=w4) -> (out0[w7]=w2)
        }
        frame "Blue Sweep Opening" {
          Array Size(array=w4) -> (size(s)=w8)
          Decrement(x=w8) -> w9
          Array Index(array=w4) -> (out0[w9]=w2)
        }
        frame "Blue Sweep Closing" {
          Array Index(array=w4) -> (out0[0]=w2)
        }
        frame "Red Sweep Closing", Default {
          Array Index(array=w4) -> (out0[0]=w2)
        }
      }
      Property Node(instance in=w2) -> ("M Spot Spectrum:Wavelength"=w10, "M Spot Spectrum:Counts"=w11)
      Build Cluster(w10, w11) -> w3
      w1 = $"Error In"
    }
  }
  $"Error Out" <- w1
  $"Max Open Spectra" <- w2
  $"Max Open Spectra Graph" <- w3
