vi "Max_Min Spectra Extractor.gvi"   [LabVIEW NXG 5.0.0]
inputs:
  "Error In": error
  "Full MSpot Multispectral Data": "Full MSpot Multispectral Data.gtype"
outputs:
  "Error Out": error
  "Max Open Spectra": "MSpot Spectrum Data.gtype"
  "Max Open Spectra Graph": cluster{"Element 1": f64[], "Element 2": f64[]}
  "Min Closed Spectra": "MSpot Spectrum Data.gtype"
types:
  "MSpot Spectrum Data.gtype" = cluster{"M Spot Spectrum": cluster{"Wavelength": f64[], "Counts": f64[]}, "Blue Motor Position (mm)": f64, "Red Motor Position (mm)": f64, "Dividing Wavelength (nm)": f64}
  "Rainbow Sweep Types.gtype" = enum{"Red Sweep Closing", "Red Sweep Opening", "Blue Sweep Closing", "Blue Sweep Opening"}
  "Full MSpot Multispectral Data.gtype" = cluster{"MSpot Spectrum Data Array": "MSpot Spectrum Data.gtype"[], "Rainbow Sweep Types": "Rainbow Sweep Types.gtype"}
diagram:
  # This SubVI Extracts the Maximum Open Spectra for each type of sweep. It also substracts the minimum spectrum (the background)
  # and outputs the background so that it can be used to substract each graph.
  case ($"Error In") {
    frame Error, Default {
      w1 = $"Error In"
      w2 = default
      w3 = default
      w4 = default
    }
    frame No Error {
      Property Node(instance in=$"Full MSpot Multispectral Data") -> ("MSpot Spectrum Data Array"=w5, "Rainbow Sweep Types"=w6)
      case (w6) {
        frame "Red Sweep Opening" {
          Array Size(array=w5) -> (size(s)=w8)
          Decrement(x=w8) -> w9
          Array Index(array=w5) -> (out0[w9]=w2)
          Array Index(array=w5) -> (out0[0]=w7)
        }
        frame "Blue Sweep Opening" {
          Array Size(array=w5) -> (size(s)=w10)
          Decrement(x=w10) -> w11
          Array Index(array=w5) -> (out0[w11]=w2)
          Array Index(array=w5) -> (out0[0]=w7)
        }
        frame "Blue Sweep Closing" {
          Array Index(array=w5) -> (out0[0]=w2)
          Array Size(array=w5) -> (size(s)=w12)
          Decrement(x=w12) -> w13
          Array Index(array=w5) -> (out0[w13]=w7)
        }
        frame "Red Sweep Closing", Default {
          Array Index(array=w5) -> (out0[0]=w2)
          Array Size(array=w5) -> (size(s)=w14)
          Decrement(x=w14) -> w15
          Array Index(array=w5) -> (out0[w15]=w7)
        }
      }
      Property Node(instance in=w2) -> ("M Spot Spectrum:Wavelength"=w16, "M Spot Spectrum:Counts"=w17)
      Property Node(instance in=w7) -> ("M Spot Spectrum:Counts"=w18, instance out=w4)
      Subtract(x=w17, y=w18) -> w19
      Build Cluster(w16, w19) -> w3
      w1 = $"Error In"
    }
  }
  $"Error Out" <- w1
  $"Max Open Spectra" <- w2
  $"Max Open Spectra Graph" <- w3
  $"Min Closed Spectra" <- w4
