vi "Spectra Adder.gvi"   [LabVIEW NXG 5.0.0]
inputs:
  "Graph reference": "Graph reference"
  "Graph position Selector reference": "NumericTextBoxInt32 reference"
  "Graph position Selector reference 2": "NumericTextBoxInt32 reference"
  "Full Spectrum": bool
  "Blue Spectra": "Full MSpot Multispectral Data.gtype"
  "Graph position Selector": i32
  "Red Spectra": "Full MSpot Multispectral Data.gtype"
  "Graph position Selector 2": i32
  "Dividing Wavelegth Calibration Data": "Dividing Wavelength Calibration Data.gtype"
  "Error In": error
  "Complementary Graphs": bool
  "Complementary Graphs Index Array": cluster{"Blue Index": i32, "Red Index": i32}[]
outputs:
  "M Spot Spectrum": cluster{"Element 1": f64[], "Element 2": f64[]}[]
  "Error Out": error
  "Blue Motor Position (mm)": f64
  "Red Motor Position (mm)": f64
types:
  "Dividing Wavelength Calibration Data.gtype" = cluster{"Dividing Wavelength (nm) Array": f64[], "Blue Motor Position (mm) Array": f64[], "Red Motor Position (mm) Array": f64[]}
  "MSpot Spectrum Data.gtype" = cluster{"M Spot Spectrum": cluster{"Wavelength": f64[], "Counts": f64[]}, "Blue Motor Position (mm)": f64, "Red Motor Position (mm)": f64, "Dividing Wavelength (nm)": f64}
  "Rainbow Sweep Types.gtype" = enum{"Red Sweep Closing", "Red Sweep Opening", "Blue Sweep Closing", "Blue Sweep Opening"}
  "Full MSpot Multispectral Data.gtype" = cluster{"MSpot Spectrum Data Array": "MSpot Spectrum Data.gtype"[], "Rainbow Sweep Types": "Rainbow Sweep Types.gtype"}
uses:
  Rainbow Measurement Setup::Main Functions::One Time Calibrations::MSpot Spectrum::Data Visualization::Substract Background Spectra.gvi
  Rainbow Measurement Setup::Main Functions::One Time Calibrations::MSpot Spectrum::Data Visualization::Max_Min Spectra Extractor.gvi
  Rainbow Measurement Setup::Side Functions::Instrument Control::Thorlabs Motors::Dividing Wavelength Control::Dividing Wavelength Basic Translator.gvi
  NI::G Core::Error::Multiplex Errors.gvi
diagram:
  case ($"Error In") {
    frame Error, Default {
      w1 = default
      w2 = $"Error In"
      w3 = default
      w4 = default
    }
    frame No Error {
      call "Substract Background Spectra.gvi"(With Background Spectra=$"Red Spectra", Error In=$"Error In") -> (W/o Background Spectra=w5, Error Out=w6)
      call "Substract Background Spectra.gvi"(With Background Spectra=$"Blue Spectra", Error In=w6) -> (W/o Background Spectra=w7, Error Out=w8)
      Property Node(instance in=w5) -> ("MSpot Spectrum Data Array"=w9, instance out=w10)
      call "Max_Min Spectra Extractor.gvi"(Full MSpot Multispectral Data=w10, Error In=w8) -> (Max Open Spectra Graph=w11, Error Out=w12)
      Property Node(instance in=w7) -> ("MSpot Spectrum Data Array"=w13, instance out=w14)
      call "Max_Min Spectra Extractor.gvi"(Full MSpot Multispectral Data=w14, Error In=w12) -> (Max Open Spectra Graph=w15, Error Out=w16)
      case ($"Complementary Graphs") {
        frame False, Default {
          w17 = $"Graph position Selector 2"
          w18 = $"Graph position Selector"
        }
        frame True {
          Array Index(array=$"Complementary Graphs Index Array") -> (out0[$"Graph position Selector"]=w19)
          Property Node(instance in=w19) -> ("Blue Index"=w18, "Red Index"=w17)
        }
      }
      Array Index(array=w13) -> (out0[w18]=w20)
      Property Node(instance in=w20) -> ("M Spot Spectrum"=w21, "Red Motor Position (mm)"=w4)
      Property Node(instance in=w21) -> ("Wavelength"=w22, "Counts"=w23)
      Build Cluster(w22, w23) -> w24
      Array Index(array=w9) -> (out0[w17]=w25)
      Property Node(instance in=w25) -> ("M Spot Spectrum"=w26, "Blue Motor Position (mm)"=w3)
      Property Node(instance in=w26) -> ("Wavelength"=w27, "Counts"=w28)
      Build Cluster(w27, w28) -> w29
      Add(w23, w28) -> w30
      Build Cluster(w27, w30) -> w31
      case ($"Full Spectrum") {
        frame True {
          Build Array(w29, w24, w31, w15, w11) -> w1
        }
        frame False {
          Build Array(w29, w24, w31) -> w1
        }
      }
      Property Node(instance in=$"Graph reference") -> ("Cursor"=w32)
      call "Dividing Wavelength Basic Translator.gvi"(Dividing Wavelength Calibration Data In=$"Dividing Wavelegth Calibration Data", Blue Motor Position=w3, Error In=w16) -> (Blue Motor Dividing Wavelength=w33, Error Out=w34)
      Property Node(instance in=w32, "XPosition"=w33, "Visible"=TRUE)
      Array Size(array=w13) -> (size(s)=w35)
      Decrement(x=w35) -> w36
      Property Node(instance in=$"Graph position Selector reference", "Minimum"=0, "Maximum"=w36, error in=w34) -> (error out=w37)
      Array Size(array=w9) -> (size(s)=w38)
      Property Node(instance in=$"Graph position Selector reference 2", "Minimum"=0, "Maximum"=w38, error in=w34) -> (error out=w39)
      call "Multiplex Errors.gvi"(error in 1=w37, error in 2=w39) -> (error out=w2)
    }
  }
  $"Red Motor Position (mm)" <- w4
  $"M Spot Spectrum" <- w1
  $"Blue Motor Position (mm)" <- w3
  $"Error Out" <- w2
