vi "Substract Background Spectra.gvi"   [LabVIEW NXG 5.0.0]
inputs:
  "With Background Spectra": "Full MSpot Multispectral Data.gtype"
  "Error In": error
outputs:
  "W/o Background Spectra": "Full MSpot Multispectral Data.gtype"
  "Error Out": error
types:
  "MSpot Spectrum Data.gtype" = cluster{"M Spot Spectrum": cluster{"Wavelength": f64[], "Counts": f64[]}, "Blue Motor Position (mm)": f64, "Red Motor Position (mm)": f64, "Dividing Wavelength (nm)": f64}
  "Rainbow Sweep Types.gtype" = enum{"Red Sweep Closing", "Red Sweep Opening", "Blue Sweep Closing", "Blue Sweep Opening"}
  "Full MSpot Multispectral Data.gtype" = cluster{"MSpot Spectrum Data Array": "MSpot Spectrum Data.gtype"[], "Rainbow Sweep Types": "Rainbow Sweep Types.gtype"}
uses:
  Rainbow Measurement Setup::Main Functions::One Time Calibrations::MSpot Spectrum::Data Visualization::Max_Min Spectra Extractor.gvi
diagram:
  # This SubVI Substracts the Background of a set of spectra
  case ($"Error In") {
    frame Error, Default {
      w1 = $"Error In"
      w2 = $"With Background Spectra"
    }
    frame No Error {
      Property Node(instance in=$"With Background Spectra") -> ("MSpot Spectrum Data Array"=w3, instance out=w4)
      call "Max_Min Spectra Extractor.gvi"(Full MSpot Multispectral Data=$"With Background Spectra", Error In=$"Error In") -> (Min Closed Spectra=w5, Error Out=w1)
      Property Node(instance in=w5) -> ("M Spot Spectrum:Counts"=w6)
      for {
        w7 = each element of w3
        Property Node(instance in=w7) -> ("M Spot Spectrum:Counts"=w9, instance out=w10)
        Subtract(x=w9, y=w6) -> w11
        Property Node(instance in=w10, "M Spot Spectrum:Counts"=w11) -> (instance out=w12)
        append w12 to w8
      }
      Property Node(instance in=w4, "MSpot Spectrum Data Array"=w8) -> (instance out=w2)
    }
  }
  $"W/o Background Spectra" <- w2
  $"Error Out" <- w1
