vi "Two Different Sweep Type Check and extract.gvi"   [LabVIEW NXG 5.0.0]
inputs:
  "Error In": error
  "Full Beam Multispectral data Array In": "Full MSpot Multispectral Data.gtype"[]
outputs:
  "Error Out": error
  "Two Different Sweep Types?": bool
  "Red Spectra": "Full MSpot Multispectral Data.gtype"
  "Blue Spectra": "Full MSpot Multispectral Data.gtype"
types:
  "MSpot Spectrum Data.gtype" = cluster{"M Spot Spectrum": cluster{"Wavelength": f64[], "Counts": f64[]}, "Blue Motor Position (mm)": f64, "Red Motor Position (mm)": f64, "Dividing Wavelength (nm)": f64}
  "Rainbow Sweep Types.gtype" = enum{"Red Sweep Closing", "Red Sweep Opening", "Blue Sweep Closing", "Blue Sweep Opening"}
  "Full MSpot Multispectral Data.gtype" = cluster{"MSpot Spectrum Data Array": "MSpot Spectrum Data.gtype"[], "Rainbow Sweep Types": "Rainbow Sweep Types.gtype"}
diagram:
  # This SubVI Extracts any blue sweep and any red sweep spectra set to perform.
  # It also checks that there is at least one of each and if there isnt it sets the two
  # different sweep types flag to false.
  case ($"Error In") {
    frame Error, Default {
      w1 = $"Error In"
      w2 = default
      w3 = default
      w4 = default
    }
    frame No Error {
      for {
        w5 = each element of $"Full Beam Multispectral data Array In"
        Property Node(instance in=w5) -> ("Rainbow Sweep Types"=w8, instance out=w9)
        Is Equal(x="Blue Sweep Closing", y=w8) -> w10
        Is Equal(x="Blue Sweep Opening", y=w8) -> w11
        Logical Or(w10, w11) -> w12
        Is Equal(x="Red Sweep Closing", y=w8) -> w13
        Is Equal(x="Red Sweep Opening", y=w8) -> w14
        Logical Or(w13, w14) -> w15
        append w15 to w6
        append w12 to w7
        w3 = w9 if w12
        w4 = w9 if w15
      }
      Or Array Elements(Boolean array=w7) -> (logical OR=w16)
      Or Array Elements(Boolean array=w6) -> (logical OR=w17)
      Logical And(w16, w17) -> w2
      w1 = $"Error In"
    }
  }
  $"Red Spectra" <- w4
  $"Two Different Sweep Types?" <- w2
  $"Error Out" <- w1
  $"Blue Spectra" <- w3
