vi "Dividing Wavelength Calculator.gvi"   [LabVIEW NXG 5.0.0]
inputs:
  "Error In": error
  "Full MSpot Multispectral Data Array In": "Full MSpot Multispectral Data.gtype"[]
  "Dividing Wavelength Threshold": f64 = 0.85
  "Load File?": bool
outputs:
  "Error Out": error
  "Full MSpot Multispectral Data Array Out": "Full MSpot Multispectral Data.gtype"[]
  "Interpolation error": bool
panel controls:
  "Continue": bool
panel indicators:
  "Dividing Wavelength Graph": cluster{"Element 1": f64[], "Element 2": f64[]}[]
types:
  "MSpot Spectrum Data.gtype" = cluster{"M Spot Spectrum": cluster{"Wavelength": f64[], "Counts": f64[]}, "Blue Motor Position (mm)": f64, "Red Motor Position (mm)": f64, "Dividing Wavelength (nm)": f64}
  "Rainbow Sweep Types.gtype" = enum{"Red Sweep Closing", "Red Sweep Opening", "Blue Sweep Closing", "Blue Sweep Opening"}
  "Full MSpot Multispectral Data.gtype" = cluster{"MSpot Spectrum Data Array": "MSpot Spectrum Data.gtype"[], "Rainbow Sweep Types": "Rainbow Sweep Types.gtype"}
  "Dividing Wavelength Calibration Data.gtype" = cluster{"Dividing Wavelength (nm) Array": f64[], "Blue Motor Position (mm) Array": f64[], "Red Motor Position (mm) Array": f64[]}
uses:
  Rainbow Measurement Setup::Main Functions::One Time Calibrations::MSpot Spectrum::Dividing Wavelength Calculations::Spectra Operator.gvi
  Rainbow Measurement Setup::Side Functions::Utilities::Array Operations::Custom Number Array Generator.gvi
  NI::Analysis::Interpolation::Hermite Interpolation 1D.gvi
  Rainbow Measurement Setup::Side Functions::Instrument Control::Thorlabs Motors::Dividing Wavelength Control::Dividing Wavelength Calibration Data FGV.gvi
  NI::G Core::Error::Is Error Or Warning.gvi
  Rainbow Measurement Setup::Main Functions::One Time Calibrations::MSpot Spectrum::File Handling::MSpot Fitik Folder Scan.gvi
  Rainbow Measurement Setup::Side Functions::Path Manipulation::File_FolderName Scan For Sweep.gvi
  Rainbow Measurement Setup::Main Functions::Modify TXT file::Modify Measurement TXT File.gvi
  Rainbow Measurement Setup::Side Functions::Utilities::Array Operations::Array Zero Element Remover.gvi
diagram:
  # This SubVI Takes the Input Data Array from the MSpot spectra calibration
  # and divides the spectra to extract the difference and then smoothes out the
  # peaks to extract the dividing wavelength. To do so it searches for the first value that
  # is below or above a certain threshold either from one end of the array in the case
  # of the red sweeps or from the other end in the case of the blue sweeps.
  case ($"Error In") {
    frame Error, Default {
      w1 = $"Error In"
      w2 = $"Full MSpot Multispectral Data Array In"
    }
    frame No Error {
      case ($"Load File?") {
        frame False {
          s1 = $"Error In"  # shift register
          for {
            w3 = each element of $"Full MSpot Multispectral Data Array In"
            call "Spectra Operator.gvi"(Full MSpot Multispectral Data=w3, Error In=s1, Spectra Operator control="Divide Spectra") -> (Operated Data=w4, Error Out=w5)
            call "Spectra Operator.gvi"(Full MSpot Multispectral Data=w4, Error In=w5, Spectra Operator control="Smooth Peaks") -> (Operated Data=w6, Error Out=w7)
            call "Custom Number Array Generator.gvi"(Start Value=385, End Value=917, Step Value=0.1, Error In=w7) -> (Generated Array=w8, Error Out=w9)
            Property Node(instance in=w3) -> ("MSpot Spectrum Data Array"=w10, "Rainbow Sweep Types"=w11, instance out=w12)
            Property Node(instance in=w6) -> ("MSpot Spectrum Data Array"=w13)
            # Interpolate for a ton of positions
            for {
              w14 = each element of w13
              w15 = each element of w10
              Property Node(instance in=w14) -> ("M Spot Spectrum"=w19, "Blue Motor Position (mm)"=w20, "Red Motor Position (mm)"=w21)
              Property Node(instance in=w19) -> ("Wavelength"=w22, "Counts"=w23)
              case (w11) {
                frame "Red Sweep Closing" {
                  # Find Dividing wavelength
                  for {
                    w26 = each element of w22
                    w27 = each element of w23
                    Is Greater(x=w27, y=$"Dividing Wavelength Threshold") -> w28
                    w24 = w26 if w28
                    stop if w28
                  }
                  w25 = w20
                }
                frame "Blue Sweep Opening" {
                  for {
                    w29 = each element of w22
                    w30 = each element of w23
                    Is Greater(x=w30, y=$"Dividing Wavelength Threshold") -> w31
                    w24 = w29 if w31
                  }
                  w25 = w21
                }
                frame "Blue Sweep Closing" {
                  for {
                    w32 = each element of w22
                    w33 = each element of w23
                    Is Greater(x=w33, y=$"Dividing Wavelength Threshold") -> w34
                    w24 = w32 if w34
                  }
                  w25 = w21
                }
                frame "Red Sweep Opening" {
                  for {
                    w35 = each element of w22
                    w36 = each element of w23
                    Is Greater(x=w36, y=$"Dividing Wavelength Threshold") -> w37
                    w24 = w35 if w37
                    stop if w37
                  }
                  w25 = w20
                }
              }
              Property Node(instance in=w15) -> (instance out=w38)
              Property Node(instance in=w38, "Dividing Wavelength (nm)"=w24) -> (instance out=w39)
              append w39 to w16
              append w25 to w17
              append w24 to w18
            }
            Property Node(instance in=w12, "MSpot Spectrum Data Array"=w16) -> ("Rainbow Sweep Types"=w40, instance out=w41)
            call "Hermite Interpolation 1D.gvi"(y=w17, x=w18, xi=w8) -> (yi=w42, xi used=w43, error out=w44)
            case (w40) {
              frame "Red Sweep Opening" {
                w46 = "Dividing Wavelength Calibration Data.gtype" {all zero or empty}
                Property Node(instance in=w46, "Dividing Wavelength (nm) Array"=w43, "Blue Motor Position (mm) Array"=w42) -> (instance out=w45)
              }
              frame "Blue Sweep Closing" {
                w47 = "Dividing Wavelength Calibration Data.gtype" {all zero or empty}
                Property Node(instance in=w47, "Dividing Wavelength (nm) Array"=w43, "Red Motor Position (mm) Array"=w42) -> (instance out=w45)
              }
              frame "Blue Sweep Opening" {
                w48 = "Dividing Wavelength Calibration Data.gtype" {all zero or empty}
                Property Node(instance in=w48, "Dividing Wavelength (nm) Array"=w43, "Red Motor Position (mm) Array"=w42) -> (instance out=w45)
              }
              frame "Red Sweep Closing" {
                w49 = "Dividing Wavelength Calibration Data.gtype" {all zero or empty}
                Property Node(instance in=w49, "Dividing Wavelength (nm) Array"=w43, "Blue Motor Position (mm) Array"=w42) -> (instance out=w45)
              }
            }
            call "Dividing Wavelength Calibration Data FGV.gvi"(Div Wavelength FGV Instructions="Acquire New Data", Div Wavelength New Data In=w45, Error In=w9) -> (Error Out=w50)
            Build Cluster(w43, w42) -> w51
            Build Array(w51) -> w52
            $"Dividing Wavelength Graph" <- w52
            call "Is Error Or Warning.gvi"(error in=w44) -> (error or warning?=w53)
            $"Interpolation error" <- w53
            append w41 to w2
            next s1 = w50
          }
          w1 = s1
        }
        frame True {
          call "MSpot Fitik Folder Scan.gvi"(Error In=$"Error In") -> (Folder Path=w54, File Names=w55, Error Out=w56)
          s2 = w56  # shift register
          for {
            w57 = each element of w55
            call "File_FolderName Scan For Sweep.gvi"(FileName/FolderName In=w57, Error In=s2) -> (Is File/Folder sweep type?=w59, Sweep Type=w60, Error Out=w61)
            case (w59) {
              frame False, Default {
                w62 = w61
                w63 = default
                w64 = default
              }
              frame True {
                Build Path(base path=w54, name or relative path=w57) -> (appended path=w65)
                call "Modify Measurement TXT File.gvi"(Filename to load/save=w65, Modify File Operation="Load TXT", Error In=w61, Measurement File Type="Raw Div Wav to Motr Pos Fitik File") -> (Loaded Data=w66, Error Out=w67)
                call "Array Zero Element Remover.gvi"(Input 2d Array=w66, Error In=w67) -> (No Empty Row Output Array 2D=w68, Error Out=w69)
                Array Index(array=w68) -> (out0[_, 0]=w70, out1[_, 1]=w71)
                Build Cluster(w71, w70) -> w72
                Array Max And Min(array=w71) -> (max value=w73, min value=w74)
                Round Toward Positive Infinity(x=w74) -> w75
                Round Toward Negative Infinity(x=w73) -> w76
                call "Custom Number Array Generator.gvi"(Start Value=w75, End Value=w76, Step Value=0.1, Error In=w69) -> (Generated Array=w77, Error Out=w62)
                # Interpolate for a ton of positions
                call "Hermite Interpolation 1D.gvi"(y=w70, x=w71, xi=w77) -> (yi=w78, xi used=w79, error out=w80)
                Build Cluster(w79, w78) -> w81
                Build Array(w72, w81) -> w63
                case (w60) {
                  frame "Red Sweep Opening" {
                    w83 = "Dividing Wavelength Calibration Data.gtype" {all zero or empty}
                    Property Node(instance in=w83, "Dividing Wavelength (nm) Array"=w79, "Blue Motor Position (mm) Array"=w78) -> (instance out=w82)
                  }
                  frame "Blue Sweep Closing" {
                    w84 = "Dividing Wavelength Calibration Data.gtype" {all zero or empty}
                    Property Node(instance in=w84, "Dividing Wavelength (nm) Array"=w79, "Red Motor Position (mm) Array"=w78) -> (instance out=w82)
                  }
                  frame "Blue Sweep Opening" {
                    w85 = "Dividing Wavelength Calibration Data.gtype" {all zero or empty}
                    Property Node(instance in=w85, "Dividing Wavelength (nm) Array"=w79, "Red Motor Position (mm) Array"=w78) -> (instance out=w82)
                  }
                  frame "Red Sweep Closing" {
                    w86 = "Dividing Wavelength Calibration Data.gtype" {all zero or empty}
                    Property Node(instance in=w86, "Dividing Wavelength (nm) Array"=w79, "Blue Motor Position (mm) Array"=w78) -> (instance out=w82)
                  }
                }
                call "Dividing Wavelength Calibration Data FGV.gvi"(Div Wavelength FGV Instructions="Acquire New Data", Div Wavelength New Data In=w82)
                call "Is Error Or Warning.gvi"(error in=w80) -> (error or warning?=w87)
                $"Interpolation error" <- w87
                w64 = w59
              }
            }
            concatenate w63 onto w58 if w64
            next s2 = w62
          }
          $"Dividing Wavelength Graph" <- w58
          Property Node(instance in=reference to unnamed native front panel, error in=s2) -> ("Window"=w88, error out=w89)
          Open Window(reference in=w88, error in=w89) -> (reference out=w90, error out=w91)
          while {
            Wait Until Next Multiple(multiple to wait=100)
            stop if $Continue
          }
          Close Window(reference in=w90, error in=w91) -> (error out=w1)
          w2 = $"Full MSpot Multispectral Data Array In"
        }
      }
    }
  }
  $"Full MSpot Multispectral Data Array Out" <- w2
  $"Error Out" <- w1
