vi "Spectra Operator.gvi"   [LabVIEW NXG 5.0.0]
inputs:
  "Error In": error
  "Full MSpot Multispectral Data": "Full MSpot Multispectral Data.gtype"
  "Spectra Operator control": "Spectra Operator control.gtype" = "Divide Spectra", required
outputs:
  "Error Out": error
  "Operated Data": "Full MSpot Multispectral Data.gtype"
types:
  "MSpot Spectrum Data.gtype" = cluster{"M Spot Spectrum": cluster{"Wavelength": f64[], "Counts": f64[]}, "Blue Motor Position (mm)": f64, "Red Motor Position (mm)": f64, "Dividing Wavelength (nm)": f64}
  "Rainbow Sweep Types.gtype" = enum{"Red Sweep Closing", "Red Sweep Opening", "Blue Sweep Closing", "Blue Sweep Opening"}
  "Full MSpot Multispectral Data.gtype" = cluster{"MSpot Spectrum Data Array": "MSpot Spectrum Data.gtype"[], "Rainbow Sweep Types": "Rainbow Sweep Types.gtype"}
  "Spectra Operator control.gtype" = enum{"Divide Spectra", "Erase Peaks", "Smooth Peaks"}
uses:
  NI::Analysis::IntegralDifferentiation::Derivative x(t).gvi
  NI::Analysis::Filtering::Butterworth Bandpass Filter (DBL).gvi
  Rainbow Measurement Setup::Main Functions::One Time Calibrations::MSpot Spectrum::Dividing Wavelength Calculations::Spectra Peak Eraser.gvi
  Rainbow Measurement Setup::Side Functions::Utilities::Generate tanh Function.gvi
  NI::Analysis::Fitting::Cubic Spline Fit.gvi
diagram:
  # This SubVI takes the "blank spectrum" of each type of sweep and substracts it to all the spectrums to have a normalized spectrum.
  case ($"Error In") {
    frame Error, Default {
      w1 = $"Error In"
      w2 = $"Full MSpot Multispectral Data"
    }
    frame No Error {
      case ($"Spectra Operator control") {
        frame "Divide Spectra" {
          Property Node(instance in=$"Full MSpot Multispectral Data") -> ("MSpot Spectrum Data Array"=w3, "Rainbow Sweep Types"=w4, instance out=w5)
          case (w4) {
            frame "Red Sweep Closing", Default {
              Array Size(array=w3) -> (size(s)=w7)
              Decrement(x=w7) -> w8
              Array Index(array=w3) -> (out0[w8]=w6)
            }
            frame "Blue Sweep Closing" {
              Array Size(array=w3) -> (size(s)=w9)
              Decrement(x=w9) -> w10
              Array Index(array=w3) -> (out0[w10]=w6)
            }
            frame "Blue Sweep Opening" {
              Array Index(array=w3) -> (out0[0]=w6)
            }
            frame "Red Sweep Opening" {
              Array Index(array=w3) -> (out0[0]=w6)
            }
          }
          for {
            w11 = each element of w3
            Property Node(instance in=w11) -> ("M Spot Spectrum"=w13, instance out=w14)
            # Divide Blank Spectrum
            Property Node(instance in=w13) -> ("Counts"=w15, "Wavelength"=w16, instance out=w17)
            Property Node(instance in=w6) -> ("M Spot Spectrum"=w18)
            Property Node(instance in=w18) -> ("Counts"=w19)
            Subtract(x=w15, y=w19) -> w20
            Property Node(instance in=w17, "Wavelength"=w16, "Counts"=w20) -> (instance out=w21)
            Property Node(instance in=w14, "M Spot Spectrum"=w21) -> (instance out=w22)
            append w22 to w12
          }
          s1 = 0  # shift register
          for {
            w23 = each element of w12
            # Find Biggest Value
            Property Node(instance in=w23) -> ("M Spot Spectrum:Counts"=w25, instance out=w26)
            Array Max And Min(array=w25) -> (max value=w27)
            Max And Min(x=w27, y=s1) -> (max(x,y)=w28: f64)
            append w26 to w24
            next s1 = w28
          }
          for {
            w29 = each element of w24
            Property Node(instance in=w29) -> ("M Spot Spectrum"=w31, instance out=w32)
            # Normalize to 1
            Property Node(instance in=w31) -> ("Counts"=w33, instance out=w34)
            Divide(x=w33, y=s1) -> w35
            Property Node(instance in=w34, "Counts"=w35) -> (instance out=w36)
            Property Node(instance in=w32, "M Spot Spectrum"=w36) -> (instance out=w37)
            append w37 to w30
          }
          Property Node(instance in=w5, "MSpot Spectrum Data Array"=w30) -> (instance out=w2)
          w1 = $"Error In"
        }
        frame "Erase Peaks", Default {
          Property Node(instance in=$"Full MSpot Multispectral Data") -> ("MSpot Spectrum Data Array"=w38, instance out=w39)
          s2 = $"Error In"  # shift register
          for {
            w40 = each element of w38
            Property Node(instance in=w40) -> ("M Spot Spectrum"=w42, instance out=w43)
            Property Node(instance in=w42) -> ("Wavelength"=w44, "Counts"=w45, instance out=w46)
            call "Derivative x(t).gvi"(x(t)=w45) -> (dx(t)/dt=w47)
            Absolute Value(x=w47) -> w48
            call "Butterworth Bandpass Filter (DBL).gvi"(signal=w48, low cutoff frequency=0.0001, high cutoff frequency=0.04) -> (filtered signal=w49)
            Multiply(w49, 10) -> w50
            In Range And Coerce(lower limit=0, upper limit=1, x=w50) -> (coerced(x)=w51)
            call "Spectra Peak Eraser.gvi"(Wavelength Array=w44, Derivative to erase points=w51, Division Points=w45, Error In=s2) -> (Wavelength Without Peaks=w52, Counts Without Peaks=w53, Error Out=w54)
            Property Node(instance in=w46, "Wavelength"=w52, "Counts"=w53) -> (instance out=w55)
            Property Node(instance in=w43, "M Spot Spectrum"=w55) -> (instance out=w56)
            append w56 to w41
            next s2 = w54
          }
          Property Node(instance in=w39, "MSpot Spectrum Data Array"=w41) -> (instance out=w2)
          w1 = s2
        }
        frame "Smooth Peaks" {
          Property Node(instance in=$"Full MSpot Multispectral Data") -> ("MSpot Spectrum Data Array"=w57, "Rainbow Sweep Types"=w58, instance out=w59)
          s3 = $"Error In"  # shift register
          for (N -> w60) (iteration -> i1) {
            w61 = each element of w57
            Property Node(instance in=w61) -> ("M Spot Spectrum"=w63, instance out=w64)
            Property Node(instance in=w63) -> ("Wavelength"=w65, "Counts"=w66, instance out=w67)
            To Double Precision Float(number=w60) -> w68
            To Double Precision Float(number=i1) -> w69
            case (w58) {
              frame "Red Sweep Opening", Default {
                Multiply(w68, 0.3) -> w71
                # Old function no longer used
                call "Generate tanh Function.gvi"(-Infinity Value=100000000, +Infinity Value=100000, X single Value In=w69, Error In=s3, Inflexion Point X Value=w71, Transition Steepness=0.05) -> (Tanh Single Value Out=w72, Error Out=w70)
              }
              frame "Blue Sweep Opening" {
                Multiply(w68, 0.3) -> w73
                call "Generate tanh Function.gvi"(-Infinity Value=100000000, +Infinity Value=100000, X single Value In=w69, Error In=s3, Inflexion Point X Value=w73, Transition Steepness=0.05) -> (Tanh Single Value Out=w74, Error Out=w70)
              }
              frame "Red Sweep Closing" {
                Multiply(w68, 0.6) -> w75
                call "Generate tanh Function.gvi"(-Infinity Value=100000, +Infinity Value=100000000, X single Value In=w69, Error In=s3, Inflexion Point X Value=w75, Transition Steepness=0.05) -> (Tanh Single Value Out=w76, Error Out=w70)
              }
              frame "Blue Sweep Closing" {
                Multiply(w68, 0.6) -> w77
                call "Generate tanh Function.gvi"(-Infinity Value=100000, +Infinity Value=100000000, X single Value In=w69, Error In=s3, Inflexion Point X Value=w77, Transition Steepness=0.05) -> (Tanh Single Value Out=w78, Error Out=w70)
              }
            }
            Array Size(array=w65) -> (size(s)=w79)
            Decrement(x=w79) -> w80
            Initialize Array(element=1000000, size=w80) -> w81
            call "Cubic Spline Fit.gvi"(y=w66, x=w65, smoothness=w81, error in=w70) -> (best cubic spline fit=w82, error out=w83)
            Property Node(instance in=w67, "Wavelength"=w65, "Counts"=w82) -> (instance out=w84)
            Property Node(instance in=w64, "M Spot Spectrum"=w84) -> (instance out=w85)
            append w85 to w62
            next s3 = w83
          }
          Property Node(instance in=w59, "MSpot Spectrum Data Array"=w62) -> (instance out=w2)
          w1 = s3
        }
      }
    }
  }
  $"Operated Data" <- w2
  $"Error Out" <- w1
