vi "Spectra Peak Eraser.gvi"   [LabVIEW NXG 5.0.0]
inputs:
  "Wavelength Array": f64[]
  "Derivative to erase points": f64[]
  "Division Points": f64[]
  "Peak Threshold": f64 = 0.01
  "Erase Length": i32 = 1
  "Error In": error
outputs:
  "Graph": cluster{"Element 1": f64[], "Element 2": f64[]}
  "Error Out": error
  "Wavelength Without Peaks": f64[]
  "Counts Without Peaks": f64[]
diagram:
  # This SubVI Erases the peaks in the IR Region for the fitik to fit better the curves
  case ($"Error In") {
    frame Error, Default {
      w1 = default
      w2 = default
      w3 = default
      w4 = $"Error In"
    }
    frame No Error {
      Array Size(array=$"Division Points") -> (size(s)=w5)
      for (iteration -> i1) {
        w6 = each element of $"Derivative to erase points"
        for (N = $"Erase Length") (iteration -> i2) {
          Divide(x=$"Erase Length", y=2) -> w9
          Round Toward Negative Infinity(x=w9) -> w10
          Subtract(x=i1, y=w10) -> w11
          Add(w11, i2) -> w12
          In Range And Coerce(lower limit=0, upper limit=w5, x=w12) -> (coerced(x)=w13)
          append w13 to w8
        }
        Is Greater Or Equal(x=w6, y=$"Peak Threshold") -> w14
        concatenate w8 onto w7 if w14
      }
      Sort 1D Array(array=w7) -> (sorted array=w15)
      Reverse 1D Array(array=w15) -> (reversed array=w16)
      s1 = 0  # shift register
      for {
        w17 = each element of w16
        Is Not Equal(x=s1, y=w17) -> w19
        append w17 to w18 if w19
        next s1 = w17
      }
      s2 = $"Division Points"  # shift register
      s3 = $"Wavelength Array"  # shift register
      for {
        w20 = each element of w18
        Delete From Array(inArray=s2, index0=w20) -> w21
        Delete From Array(inArray=s3, index0=w20) -> w22
        next s2 = w21
        next s3 = w22
      }
      Build Cluster(s3, s2) -> w1
      w2 = s2
      w3 = s3
      w4 = $"Error In"
    }
  }
  $"Counts Without Peaks" <- w2
  $Graph <- w1
  $"Wavelength Without Peaks" <- w3
  $"Error Out" <- w4
