vi "Spectrum Blank Correction.gvi"   [LabVIEW NXG 5.0.0]
inputs:
  "Error In": error
  "Full MSpot Multispectral Data": "Full MSpot Multispectral Data.gtype"
outputs:
  "Error Out": error
  "Corrected Data": "Full MSpot Multispectral Data.gtype"
types:
  "MSpot Spectrum Data.gtype" = cluster{"M Spot Spectrum": cluster{"Wavelength": f64[], "Counts": f64[]}, "Blue Motor Position (mm)": f64, "Red Motor Position (mm)": f64, "Dividing Wavelength (nm)": f64}
  "Rainbow Sweep Types.gtype" = enum{"Red Sweep Closing", "Red Sweep Opening", "Blue Sweep Closing", "Blue Sweep Opening"}
  "Full MSpot Multispectral Data.gtype" = cluster{"MSpot Spectrum Data Array": "MSpot Spectrum Data.gtype"[], "Rainbow Sweep Types": "Rainbow Sweep Types.gtype"}
diagram:
  # This SubVI takes the "blank spectrum" of each type of sweep and substracts it to all the spectrums to have a normalized spectrum.
  case ($"Error In") {
    frame Error, Default {
      w1 = $"Error In"
      w2 = $"Full MSpot Multispectral Data"
    }
    frame No Error {
      Property Node(instance in=$"Full MSpot Multispectral Data") -> ("MSpot Spectrum Data Array"=w3, "Rainbow Sweep Types"=w4, instance out=w5)
      case (w4) {
        frame "Red Sweep Closing", Default {
          Array Size(array=w3) -> (size(s)=w7)
          Decrement(x=w7) -> w8
          Array Index(array=w3) -> (out0[w8]=w6)
        }
        frame "Blue Sweep Closing" {
          Array Size(array=w3) -> (size(s)=w9)
          Decrement(x=w9) -> w10
          Array Index(array=w3) -> (out0[w10]=w6)
        }
        frame "Blue Sweep Opening" {
          Array Index(array=w3) -> (out0[0]=w6)
        }
        frame "Red Sweep Opening" {
          Array Index(array=w3) -> (out0[0]=w6)
        }
      }
      for {
        w11 = each element of w3
        Property Node(instance in=w11) -> ("M Spot Spectrum"=w13, instance out=w14)
        Property Node(instance in=w13) -> ("Counts"=w15, "Wavelength"=w16, instance out=w17)
        Property Node(instance in=w6) -> ("M Spot Spectrum"=w18)
        Property Node(instance in=w18) -> ("Counts"=w19)
        Subtract(x=w15, y=w19) -> w20
        In Range And Coerce(lower limit=0, upper limit=1000000000, x=w20) -> (coerced(x)=w21)
        Property Node(instance in=w17, "Wavelength"=w16, "Counts"=w21) -> (instance out=w22)
        Property Node(instance in=w14, "M Spot Spectrum"=w22) -> (instance out=w23)
        append w23 to w12
      }
      Property Node(instance in=w5, "MSpot Spectrum Data Array"=w12) -> (instance out=w2)
      w1 = $"Error In"
    }
  }
  $"Error Out" <- w1
  $"Corrected Data" <- w2
