vi "File number Sorter.gvi"   [LabVIEW NXG 5.0.0]
inputs:
  "Error In": error
  "Sweep Type": "Rainbow Sweep Types.gtype" = "Red Sweep Closing"
  "File Names": string[] = ["MSpot_Spectrum_Calibration_Position_0.100000_0.000000.txt", "MSpot_Spectrum_Calibration_Position_0.200000_0.000000.txt", "MSpot_Spectrum_Calibration_Position_0.300000_0.000000.txt", "MSpot_Spectrum_Calibration_Position_0.400000_0.000000.txt", "MSpot_Spectrum_Calibration_Position_0.500000_0.000000.txt", "MSpot_Spectrum_Calibration_Position_0.600000_0.000000.txt", "MSpot_Spectrum_Calibration_Position_0.700000_0.000000.txt", "MSpot_Spectrum_Calibration_Position_0.800000_0.000000.txt", "MSpot_Spectrum_Calibration_Position_0.900000_0.000000.txt", "MSpot_Spectrum_Calibration_Position_1.000000_0.000000.txt", "MSpot_Spectrum_Calibration_Position_1.100000_0.000000.txt", "MSpot_Spectrum_Calibration_Position_1.200000_0.000000.txt", "MSpot_Spectrum_Calibration_Position_1.300000_0.000000.txt", "MSpot_Spectrum_Calibration_Position_1.400000_0.000000.txt", "MSpot_Spectrum_Calibration_Position_1.500000_0.000000.txt", "MSpot_Spectrum_Calibration_Position_1.600000_0.000000.txt", "MSpot_Spectrum_Calibration_Position_1.700000_0.000000.txt", "MSpot_Spectrum_Calibration_Position_1.800000_0.000000.txt", "MSpot_Spectrum_Calibration_Position_1.900000_0.000000.txt", "MSpot_Spectrum_Calibration_Position_10.000000_0.000000.txt", "MSpot_Spectrum_Calibration_Position_10.100000_0.000000.txt", "MSpot_Spectrum_Calibration_Position_10.200000_0.000000.txt", "MSpot_Spectrum_Calibration_Position_10.300000_0.000000.txt", "MSpot_Spectrum_Calibration_Position_10.400000_0.000000.txt", "MSpot_Spectrum_Calibration_Po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
outputs:
  "Error Out": error
  "Sorted Files Array": string[]
types:
  "Rainbow Sweep Types.gtype" = enum{"Red Sweep Closing", "Red Sweep Opening", "Blue Sweep Closing", "Blue Sweep Opening"}
  T1 = cluster{"Blue Motor Position": f64, "Filename": string}
  T2 = cluster{"Red Motor Position": f64, "Filename": string}
diagram:
  # This subVI sorts the filenames according to the position of the red or blue motor depending on which type of sweep it's trying to load.
  # It outputs the sorted array for further processing.
  case ($"Error In") {
    frame Error, Default {
      w1 = $"Error In"
      w2 = $"File Names"
    }
    frame No Error {
      s1 = $"Error In"  # shift register
      for {
        w3 = each element of $"File Names"
        Search And Replace String(error in (no error)=s1, input string=w3, replace string ("")="", search string="MSpot_Spectrum_Calibration_Position_") -> (error out=w6, result string=w7)
        Search And Replace String(error in (no error)=w6, input string=w7, replace string ("")="", search string=".txt") -> (error out=w8, result string=w9)
        Search Or Split String(search string/char="_", string=w9) -> (match + rest of string=w10, substring before match=w11)
        Floating Point String To Number(string=w11) -> (number=w12)
        Property Node(instance in=T1 {all zero or empty}, "Filename"=w3, "Blue Motor Position"=w12) -> (instance out=w13)
        Search And Replace String(error in (no error)=w8, input string=w10, replace string ("")="", search string="_") -> (error out=w14, result string=w15)
        Floating Point String To Number(string=w15) -> (number=w16)
        Property Node(instance in=T2 {all zero or empty}, "Filename"=w3, "Red Motor Position"=w16) -> (instance out=w17)
        append w13 to w4
        append w17 to w5
        next s1 = w14
      }
      Sort 1D Array(array=w4) -> (sorted array=w18)
      Sort 1D Array(array=w5) -> (sorted array=w19)
      case ($"Sweep Type") {
        frame "Red Sweep Closing", Default {
          for {
            w20 = each element of w18
            Property Node(instance in=w20) -> ("Filename"=w21)
            append w21 to w2
          }
        }
        frame "Red Sweep Opening" {
          for {
            w22 = each element of w18
            Property Node(instance in=w22) -> ("Filename"=w23)
            append w23 to w2
          }
        }
        frame "Blue Sweep Closing" {
          for {
            w24 = each element of w19
            Property Node(instance in=w24) -> ("Filename"=w25)
            append w25 to w2
          }
        }
        frame "Blue Sweep Opening" {
          for {
            w26 = each element of w19
            Property Node(instance in=w26) -> ("Filename"=w27)
            append w27 to w2
          }
        }
      }
      w1 = s1
    }
  }
  $"Sorted Files Array" <- w2
  $"Error Out" <- w1
