vi "Folder Scan Sweep type.gvi"   [LabVIEW NXG 5.0.0]
inputs:
  "Folder Name In": string
  "Error In": error
outputs:
  "Foldername Out": string
  "Sweep Type": "Rainbow Sweep Types.gtype"
  "Is folder sweep type?": bool
  "Error Out": error
types:
  "Rainbow Sweep Types.gtype" = enum{"Red Sweep Closing", "Red Sweep Opening", "Blue Sweep Closing", "Blue Sweep Opening"}
uses:
  Rainbow Measurement Setup::Side Functions::Rainbow Sweep::Rainbow Types Extract_Compare.gvi
diagram:
  # This subVI takes a folder name and checks if it
  # coincides with any of the sweep type names. If it does
  # it outputs the sweep type and also a true statement.
  case ($"Error In") {
    frame Error, Default {
      w1 = default
      w2 = $"Folder Name In"
      w3 = default
      w4 = $"Error In"
    }
    frame No Error {
      call "Rainbow Types Extract_Compare.gvi"(Rainbow Sweep Types="Red Sweep Closing", Error In=$"Error In") -> (Rainbow Sweep Types Array=w5, Error Out=w6)
      s1 = w6  # shift register
      for {
        w7 = each element of w5
        Format Into String(errIn=s1, w7) -> (outString=w10, errOut=w11)
        Is Equal(x=w10, y=$"Folder Name In") -> w12
        append w12 to w8
        append w7 to w9 if w12
        next s1 = w11
      }
      Array Index(array=w9) -> (out0[0]=w1)
      Or Array Elements(Boolean array=w8) -> (logical OR=w3)
      w2 = $"Folder Name In"
      w4 = s1
    }
  }
  $"Foldername Out" <- w2
  $"Sweep Type" <- w1
  $"Is folder sweep type?" <- w3
  $"Error Out" <- w4
