vi "Load Fytic Data Subroutine.gvi"   [LabVIEW NXG 5.0.0]
inputs:
  "Error In": error
  "Current State": "MSpot Spectrum Calibration State Machine Instructions.gtype" = "Stop App"
outputs:
  "Error Out": error
  "Selected State": "MSpot Spectrum Calibration State Machine Instructions.gtype"
types:
  "MSpot Spectrum Calibration State Machine Instructions.gtype" = enum{"Start App", "Detect Instruments", "Initialize Instruments", "Rainbow Sweep", "Close Coms", "Load Calibration", "Load Fityc Data", "Check Graphs", "Save Graphs", "Save Dividing Wavelength", "Save Divided Graphs", "Stop App"}
uses:
  Rainbow Measurement Setup::Main Functions::One Time Calibrations::MSpot Spectrum::Dividing Wavelength Calculations::Dividing Wavelength Calculator.gvi
  Rainbow Measurement Setup::Main Functions::One Time Calibrations::MSpot Spectrum::File Handling::MSpot Calibration Save Graphs Prompt.gvi
diagram:
  case ($"Error In") {
    frame Error, Default {
      w1 = $"Error In"
      w2 = "Stop App"
    }
    frame No Error {
      call "Dividing Wavelength Calculator.gvi"(Error In=$"Error In", Load File?=TRUE) -> (Error Out=w3)
      call "MSpot Calibration Save Graphs Prompt.gvi"(M Spot Spectrum Calibration State Machine Instructions=$"Current State", Error In=w3) -> (Selected State=w2, Error Out=w1)
    }
  }
  # This SubVI loads the txt data into the Dividing wavelength
  # FGV And prompts the user if he wants to save it into a file
  # (the new interpolated values)
  $"Selected State" <- w2
  $"Error Out" <- w1
