vi "MSpot Calibration Save Graphs Prompt.gvi"   [LabVIEW NXG 5.0.0]
inputs:
  "M Spot Spectrum Calibration State Machine Instructions": "MSpot Spectrum Calibration State Machine Instructions.gtype" = "Stop App"
  "Error In": error
  "Instrument Control Mega Cluster In": "Instrument Control Mega Cluster.gtype"
outputs:
  "Selected State": "MSpot Spectrum Calibration State Machine Instructions.gtype"
  "Error Out": error
  "Instrument Control Mega Cluster Out": "Instrument Control Mega Cluster.gtype"
types:
  "MSpot Spectrum Calibration State Machine Instructions.gtype" = enum{"Start App", "Detect Instruments", "Initialize Instruments", "Rainbow Sweep", "Close Coms", "Load Calibration", "Load Fityc Data", "Check Graphs", "Save Graphs", "Save Dividing Wavelength", "Save Divided Graphs", "Stop App"}
  "Instrument Coms Info.gtype" = cluster{"Arduino Coms Info": "Arduino Detection cluster control.gtype", "Photodetector Names": string[], "Keythley Address": "VISA Instr", "Photodetector Detected?": bool, "Thorlabs Motors Detected?": bool, "Keithley Detected?": bool, "Thorlabs Motors Serial Number": "Thorlabs Motors Serial Number In.gtype", "Photodetector IVI session": "Ivi IviDefault", "Flame ID": string, "Flame Detected?": bool, "Flame Wrapper ID": u64}
  "Debugging Cluster.gtype" = cluster{"Debugging mode?": bool, "Initialize App": bool, "Insturment Debugging": "Insturment Debugging Cluster.gtype"}
  "Instrument Control Mega Cluster.gtype" = cluster{"Instruments Coms Info": "Instrument Coms Info.gtype", "Debugging Cluster": "Debugging Cluster.gtype"}
diagram:
  # This subVI Prompts the user to save or discard the calibration files in case
  # we are coming from close coms wich means that a new calibration has been
  # performed. Otherwise it does not
  case ($"Error In") {
    frame Error, Default {
      w1 = "Stop App"
      w2 = $"Error In"
      w3 = $"Instrument Control Mega Cluster In"
    }
    frame No Error {
      case ($"M Spot Spectrum Calibration State Machine Instructions") {
        frame "Load Calibration" {
          w1 = "Stop App"
          w3 = $"Instrument Control Mega Cluster In"
        }
        frame "Close Coms" {
          w4 = "Do you wish to save the current\ncalibration files?\nThey will be saved on the Extra \ninstallers folder."
          Three Button Dialog(Allow user to close window? (TRUE)=FALSE, Center Button Text ("No")="Save both the graphs\nand their divided \nversions please.", Left Button Text ("Yes")="Yes please save all\nthe calibration files :D", Right Button Text ("Cancel")="Oh, don't bother\nI was just testing.", Window Title (" ")="Save Graphs?", message=w4) -> (Which Button?=w5)
          case (w5) {
            frame "left button", Default {
              w1 = "Save Graphs"
            }
            frame "center button" {
              w1 = "Save Divided Graphs"
            }
            frame "right button" {
              w1 = "Stop App"
            }
            frame "window close" {
              w1 = "Stop App"
            }
          }
          w3 = $"Instrument Control Mega Cluster In"
        }
        frame "Start App", Default {
          Property Node(instance in=$"Instrument Control Mega Cluster In") -> ("Debugging Cluster:Debugging mode?"=w6, instance out=w3)
          case (w6) {
            frame False, Default {
              w1 = "Stop App"
            }
            frame True {
              w7 = "Do you wish to save the current\ncalibration files?\nThey will be saved on the Extra \ninstallers folder."
              Three Button Dialog(Allow user to close window? (TRUE)=FALSE, Center Button Text ("No")="Save both the graphs\nand their divided \nversions please.", Left Button Text ("Yes")="Yes please save all\nthe calibration files :D", Right Button Text ("Cancel")="Oh, don't bother\nI was just testing.", Window Title (" ")="Save Graphs?", message=w7) -> (Which Button?=w8)
              case (w8) {
                frame "left button", Default {
                  w1 = "Save Graphs"
                }
                frame "center button" {
                  w1 = "Save Divided Graphs"
                }
                frame "right button" {
                  w1 = "Stop App"
                }
                frame "window close" {
                  w1 = "Stop App"
                }
              }
            }
          }
        }
        frame "Load Fityc Data" {
          w9 = """Do you wish to save the current
Dividing Wavelength to motor
position into files?
They will be saved on the Extra 
installers folder."""
          Two Button Dialog(F button name ("Cancel")="Oh, don't bother\nI was just testing.", T button name ("OK")="Yes please save all\nthe data into files :D", message=w9) -> (T Button?=w10)
          case (w10) {
            frame False, Default {
              w1 = "Stop App"
            }
            frame True {
              w1 = "Save Dividing Wavelength"
            }
          }
          w3 = $"Instrument Control Mega Cluster In"
        }
      }
      w2 = $"Error In"
    }
  }
  $"Error Out" <- w2
  $"Instrument Control Mega Cluster Out" <- w3
  $"Selected State" <- w1
