vi "MSpot Data Extractor.gvi"   [LabVIEW NXG 5.0.0]
inputs:
  "Filepath to load": path
  "Sub Array Index In": i32
  "M Spot Spectrum Sub Array In": "MSpot Spectrum Data.gtype"[]
  "Modify file operation": "Modify File Operation.gtype" = "Save TXT"
  "Calibration file?": bool
  "Error In": error
outputs:
  "Sub Array Index Out": i32
  "M Spot Spectrum Sub Array Out": "MSpot Spectrum Data.gtype"[]
  "File Found?": bool
  "Error Out": error
types:
  "Modify File Operation.gtype" = enum{"Save TXT", "Load TXT"}
  "MSpot Spectrum Data.gtype" = cluster{"M Spot Spectrum": cluster{"Wavelength": f64[], "Counts": f64[]}, "Blue Motor Position (mm)": f64, "Red Motor Position (mm)": f64, "Dividing Wavelength (nm)": f64}
uses:
  Rainbow Measurement Setup::Main Functions::Modify TXT file::Modify Measurement TXT File.gvi
  Rainbow Measurement Setup::Side Functions::Messages And Prompts::FGV Repeat Operation for all following files.gvi
diagram:
  # This subVI takes the data from the calibration file we specify and converts it into the Mspot Spectrum format, storing it within the M Spot Spectrum Sub Array which will
  # be later appended to the full M Spot Spectrum array. To do so we load the file and we store the data as wavelength and counts. We also scan the header data where we find the
  # motors position for each spectrum. Then we bundle everything and we store it within the array.
  case ($"Error In") {
    frame Error, Default {
      w1 = $"Error In"
      w2 = $"Sub Array Index In"
      w3 = $"M Spot Spectrum Sub Array In"
      w4 = default
    }
    frame No Error {
      case ($"Calibration file?") {
        frame False, Default {
          w2 = $"Sub Array Index In"
          w5 = $"Error In"
          w3 = $"M Spot Spectrum Sub Array In"
          w4 = default
        }
        frame True {
          Increment(x=$"Sub Array Index In") -> w2
          Array Index(array=$"M Spot Spectrum Sub Array In") -> (out0[$"Sub Array Index In"]=w6)
          call "Modify Measurement TXT File.gvi"(Filename to load/save=$"Filepath to load", Modify File Operation=$"Modify file operation", Error In=$"Error In", Measurement File Type="Light Calibration Dividing Wavelength Spectrum") -> (Loaded Data=w7, Header Data=w8, Error Out=w9)
          Array Index(array=w7) -> (out0[_, 0]=w10, out1[_, 1]=w11)
          w12 = cluster{"Wavelength": f64[], "Counts": f64[]} {all zero or empty}
          Property Node(instance in=w12, "Wavelength"=w10, "Counts"=w11) -> (instance out=w13)
          String Length(string="Blue Motor Position (mm): ") -> (length=w14)
          Search And Replace String(error in (no error)=w9, input string=w8, search string="Blue Motor Position (mm): ") -> (error out=w5, offset past replacement=w15)
          Add(w15, w14) -> w16
          String Subset(length (rest)=8, offset (0)=w16, string=w8) -> w17
          Floating Point String To Number(string=w17) -> (number=w18)
          Search And Replace String(input string=w8, search string="Red Motor Position (mm): ") -> (offset past replacement=w19)
          String Length(string="Red Motor Position (mm): ") -> (length=w20)
          Add(w19, w20) -> w21
          String Subset(length (rest)=8, offset (0)=w21, string=w8) -> w22
          Floating Point String To Number(string=w22) -> (number=w23)
          Property Node(instance in=w6, "M Spot Spectrum"=w13, "Blue Motor Position (mm)"=w18, "Red Motor Position (mm)"=w23) -> (instance out=w24)
          Insert Into Array(inArray=$"M Spot Spectrum Sub Array In", new=w24) -> w3
          w4 = TRUE
        }
      }
      call "FGV Repeat Operation for all following files.gvi"(FGV Instructions="Reset State", Error In=w5) -> (Error Out=w1)
    }
  }
  $"Sub Array Index Out" <- w2
  $"M Spot Spectrum Sub Array Out" <- w3
  $"Error Out" <- w1
  $"File Found?" <- w4
