vi "MSpot Fitik Folder Scan.gvi"   [LabVIEW NXG 5.0.0]
inputs:
  "Error In": error
outputs:
  "Folder Path": path
  "File Names": string[]
  "Error Out": error
diagram:
  Get Component Directory() -> (Path=w1)
  Strip Path(path=w1) -> (stripped path=w2)
  w3 = "Extra installers\\Calibration_Files\\Div_Wav_To_Motor_Pos\\Raw_Fitik_Files"
  # This SubVI Scans all the available folders within the specified directory
  Build Path(base path=w2, name or relative path=w3) -> (appended path=w4)
  List Folder(error in=$"Error In", path=w4) -> (error out=w5, file names=w6, path out=w7)
  $"Folder Path" <- w7
  $"File Names" <- w6
  $"Error Out" <- w5
