vi "MSpot Folder Check.gvi"   [LabVIEW NXG 5.0.0]
inputs:
  "Rainbow Sweep Types": "Rainbow Sweep Types.gtype" = "Red Sweep Closing"
  "Error In": error
  "Create New Folders?": bool
  "Divided Graphs?": bool
outputs:
  "Folder Out": path
  "Error Out": error
  "Calibration Files Folder": path
types:
  "Rainbow Sweep Types.gtype" = enum{"Red Sweep Closing", "Red Sweep Opening", "Blue Sweep Closing", "Blue Sweep Opening"}
uses:
  NI::G Core::File IO (General)::Check if File or Folder Exists.gvi
  NI::G Core::File IO (General)::Create Directory Recursive.gvi
diagram:
  # This SubVI Makes sure that the folder where we want to save our data
  # exists. If it does not exist it creates it and any folders that are required for
  # it to exist.
  case ($"Error In") {
    frame Error, Default {
      w1 = $"Error In"
      w2 = default
      w3 = default
    }
    frame No Error {
      Format Into String($"Rainbow Sweep Types") -> w4
      Get Component Directory() -> (Path=w5)
      Strip Path(path=w5) -> (stripped path=w6)
      Build Path(base path=w6, name or relative path="Extra installers\\Calibration_Files\\Div_Wav_Spectra") -> (appended path=w3)
      Build Path(base path=w3, name or relative path=w4) -> (appended path=w7)
      Build Path(base path=w7, name or relative path="Divided Graphs") -> (appended path=w8)
      Select(s=$"Divided Graphs?", t=w8, f=w7) -> w9
      call "Check if File or Folder Exists.gvi"(file or folder=w9, error in=$"Error In") -> (file or folder exists?=w10, error out=w11)
      Is Empty String Or Path(string/path=w9) -> w12
      Logical Or(w12, not w10) -> w13
      Logical And(w13, $"Create New Folders?") -> w14
      case (w14) {
        frame False {
          w2 = w9
          w1 = w11
        }
        frame True {
          call "Create Directory Recursive.gvi"(folder=w9, error in=w11) -> (error out=w1)
          w2 = w9
        }
      }
    }
  }
  $"Calibration Files Folder" <- w3
  $"Folder Out" <- w2
  $"Error Out" <- w1
