vi "MSpot Folder Scan.gvi"   [LabVIEW NXG 5.0.0]
inputs:
  "Error In": error
outputs:
  "Folder Path": path
  "Folder Names": string[]
  "Error Out": error
diagram:
  Get Component Directory() -> (Path=w1)
  Strip Path(path=w1) -> (stripped path=w2)
  # This SubVI Scans all the available folders within the specified directory
  Build Path(base path=w2, name or relative path="Extra installers\\Calibration_Files\\Div_Wav_Spectra") -> (appended path=w3)
  List Folder(error in=$"Error In", path=w3) -> (error out=w4, folder names=w5, path out=w6)
  $"Folder Path" <- w6
  $"Folder Names" <- w5
  $"Error Out" <- w4
