vi "MSpot Spectra file handling.gvi"   [LabVIEW NXG 5.0.0]
inputs:
  "Error In": error
  "MSpot Mega Cluster In": "MSpot Mega Cluster.gtype"
  "Modify File Operation": "Modify File Operation.gtype" = "Save TXT"
outputs:
  "Error Out": error
  "MSpot Mega Cluster Out": "MSpot Mega Cluster.gtype"
  "Found Any File?": bool
types:
  "Modify File Operation.gtype" = enum{"Save TXT", "Load TXT"}
  "Raibow Sweep Selector.gtype" = enum{"Red Sweep", "Blue Sweep", "Full Sweep Red First", "Full Sweep Blue First"}
  "Rainbow Sweep Param Selector.gtype" = cluster{"Raibow Sweep Selector": "Raibow Sweep Selector.gtype", "Max Wavelength (nm)": f64, "Min Wavelength (nm)": f64, "Wavelength Step (nm)": f64, "Rainbow Sweep Type Selector": "Rainbow Sweep Type Selector.gtype"}
  "MSpot Spectrum Calibration Parameters.gtype" = cluster{"Min Position (mm)": f64, "Max Position (mm)": f64, "Position step size (mm)": f64, "Manual Spectra?": bool, "Flame Integration Time (us)": f64, "Flame Scans to Average": u32}
  "Rainbow Sweep Types.gtype" = enum{"Red Sweep Closing", "Red Sweep Opening", "Blue Sweep Closing", "Blue Sweep Opening"}
  "Full MSpot Multispectral Data.gtype" = cluster{"MSpot Spectrum Data Array": "MSpot Spectrum Data.gtype"[], "Rainbow Sweep Types": "Rainbow Sweep Types.gtype"}
  "MSpot Mega Cluster.gtype" = cluster{"Rainbow Sweep Parameters MSpot": "Rainbow Sweep Param Selector.gtype", "MSpot Sperctrum Calibration Parameters": "MSpot Spectrum Calibration Parameters.gtype", "Full Beam Multispectral Data Array": "Full MSpot Multispectral Data.gtype"[]}
  "MSpot Spectrum Data.gtype" = cluster{"M Spot Spectrum": cluster{"Wavelength": f64[], "Counts": f64[]}, "Blue Motor Position (mm)": f64, "Red Motor Position (mm)": f64, "Dividing Wavelength (nm)": f64}
uses:
  Rainbow Measurement Setup::Main Functions::One Time Calibrations::MSpot Spectrum::Dividing Wavelength Calculations::Spectra Operator.gvi
  Rainbow Measurement Setup::Main Functions::One Time Calibrations::MSpot Spectrum::File Handling::MSpot Folder Scan.gvi
  Rainbow Measurement Setup::Main Functions::One Time Calibrations::MSpot Spectrum::File Handling::Folder Scan Sweep type.gvi
  Rainbow Measurement Setup::Main Functions::One Time Calibrations::MSpot Spectrum::File Handling::File number Sorter.gvi
  Rainbow Measurement Setup::Main Functions::One Time Calibrations::MSpot Spectrum::File Handling::MSpot Data Extractor.gvi
  Rainbow Measurement Setup::Main Functions::One Time Calibrations::MSpot Spectrum::File Handling::MSpot Folder Check.gvi
  Rainbow Measurement Setup::Side Functions::Sample Naming::txt Extension adder.gvi
  Rainbow Measurement Setup::Main Functions::Modify TXT file::Modify Measurement TXT File.gvi
  Rainbow Measurement Setup::Side Functions::Messages And Prompts::FGV Repeat Operation for all following files.gvi
diagram:
  # This subVI Handles the Saving of all the MSpot Spectra Calibration Files
  case ($"Error In") {
    frame Error, Default {
      w1 = $"Error In"
      w2 = default
      w3 = $"MSpot Mega Cluster In"
    }
    frame No Error {
      Property Node(instance in=$"MSpot Mega Cluster In") -> ("Full Beam Multispectral Data Array"=w4, instance out=w5)
      case (FALSE) {
        frame False, Default {
          w6 = w4
          w7 = $"Error In"
        }
        frame True {
          s1 = $"Error In"  # shift register
          for {
            w8 = each element of w4
            call "Spectra Operator.gvi"(Full MSpot Multispectral Data=w8, Error In=s1, Spectra Operator control="Divide Spectra") -> (Operated Data=w9, Error Out=w10)
            call "Spectra Operator.gvi"(Full MSpot Multispectral Data=w9, Error In=w10, Spectra Operator control="Smooth Peaks") -> (Operated Data=w11, Error Out=w12)
            append w11 to w6
            next s1 = w12
          }
          w7 = s1
        }
      }
      case ($"Modify File Operation") {
        frame "Load TXT" {
          call "MSpot Folder Scan.gvi"(Error In=w7) -> (Folder Path=w15, Folder Names=w16, Error Out=w17)
          s2 = w17  # shift register
          s3 = "Full MSpot Multispectral Data.gtype"[] []  # shift register
          s4 = 0  # shift register
          for {
            w18 = each element of w16
            call "Folder Scan Sweep type.gvi"(Folder Name In=w18, Error In=s2) -> (Foldername Out=w20, Sweep Type=w21, Is folder sweep type?=w22, Error Out=w23)
            case (w22) {
              frame False, Default {
                w24 = s4
                w25 = s3
                w26 = w23
                w27 = default
              }
              frame True {
                Increment(x=s4) -> w24
                Array Index(array=s3) -> (out0[s4]=w28)
                Build Path(base path=w15, name or relative path=w20) -> (appended path=w29)
                List Folder(error in=w23, path=w29) -> (error out=w30, file names=w31, path out=w32)
                call "File number Sorter.gvi"(Sweep Type=w21, File Names=w31, Error In=w30) -> (Sorted Files Array=w33, Error Out=w34)
                s5 = w34  # shift register
                s6 = "MSpot Spectrum Data.gtype"[] []  # shift register
                s7 = 0  # shift register
                for {
                  w35 = each element of w33
                  Build Path(base path=w32, name or relative path=w35) -> (appended path=w37)
                  Search And Replace String(input string=w35, search string="MSpot_Spectrum_Calibration") -> (number of replacements=w38)
                  Is Not Equal To 0(x=w38) -> w39
                  call "MSpot Data Extractor.gvi"(Filepath to load=w37, Sub Array Index In=s7, M Spot Spectrum Sub Array In=s6, Modify file operation=$"Modify File Operation", Calibration file?=w39, Error In=s5) -> (Sub Array Index Out=w40, M Spot Spectrum Sub Array Out=w41, File Found?=w42, Error Out=w43)
                  append w42 to w36
                  next s5 = w43
                  next s6 = w41
                  next s7 = w40
                }
                Property Node(instance in=w28, "MSpot Spectrum Data Array"=s6, "Rainbow Sweep Types"=w21) -> (instance out=w44)
                Insert Into Array(inArray=s3, new=w44) -> w25
                Or Array Elements(Boolean array=w36) -> (logical OR=w27)
                w26 = s5
              }
            }
            append w27 to w19
            next s2 = w26
            next s3 = w25
            next s4 = w24
          }
          Or Array Elements(Boolean array=w19) -> (logical OR=w2)
          w13 = s2
          w14 = s3
        }
        frame "Save TXT", Default {
          s8 = w7  # shift register
          for {
            w45 = each element of w6
            Property Node(instance in=w45) -> ("MSpot Spectrum Data Array"=w46, "Rainbow Sweep Types"=w47)
            call "MSpot Folder Check.gvi"(Rainbow Sweep Types=w47, Error In=s8, Create New Folders?=TRUE) -> (Folder Out=w48, Error Out=w49)
            s9 = w49  # shift register
            for {
              w50 = each element of w46
              Property Node(instance in=w50) -> ("M Spot Spectrum"=w51, "Blue Motor Position (mm)"=w52, "Red Motor Position (mm)"=w53)
              Format Into String(w52) -> w54
              Format Into String(w53) -> w55
              Concatenate Strings("Blue Motor Position (mm): ", w54, "\t", "Red Motor Position (mm): ", w55) -> w56
              Format Into String(initString="MSpot_Spectrum_Calibration_Position_", w52) -> w57
              Concatenate Strings(w57, "_") -> w58
              Format Into String(initString=w58, w53) -> w59
              call "txt Extension adder.gvi"(Name without .txt=w59, Error In=s9) -> (Name with .txt=w60, Error Out=w61)
              Property Node(instance in=w51) -> ("Wavelength"=w62, "Counts"=w63)
              Build Array(w62, w63) -> w64
              Transpose 2D Array(2D array=w64) -> (transposed array=w65)
              Build Path(base path=w48, name or relative path=w60) -> (appended path=w66)
              call "Modify Measurement TXT File.gvi"(Filename to load/save=w66, Variable Header Info=w56, Modify File Operation=$"Modify File Operation", Data To Save=w65, Error In=w61, Measurement File Type="Light Calibration Dividing Wavelength Spectrum") -> (Error Out=w67)
              next s9 = w67
            }
            next s8 = s9
          }
          w13 = s8
          w14 = w6
          w2 = default
        }
      }
      Property Node(instance in=w5, "Full Beam Multispectral Data Array"=w14) -> (instance out=w3)
      call "FGV Repeat Operation for all following files.gvi"(FGV Instructions="Reset State", Error In=w13) -> (Error Out=w1)
    }
  }
  $"MSpot Mega Cluster Out" <- w3
  $"Found Any File?" <- w2
  $"Error Out" <- w1
