vi "MSpot Calibration Operation Translator.gvi"   [LabVIEW NXG 5.0.0]
inputs:
  "Error In": error
  "Check Dividing Wavelength Calibration": bool
  "New Dividing Wavelength Calibration": bool
  "Load Dividing Wavelength Calibration": bool
  "Load Dividing Wavelength Fitted Data": bool
outputs:
  "Error Out": error
uses:
  Rainbow Measurement Setup::Main Functions::One Time Calibrations::MSpot Spectrum::FGV MSpot Operation.gvi
diagram:
  # This SubVI Checks which button has been pressed and
  # decides the operation that needs to be done.
  # If more than one button was pressed it prompts the user
  # to not press so many buttons at the same time
  case ($"Error In") {
    frame Error, Default {
      w1 = $"Error In"
    }
    frame No Error {
      Build Array($"Load Dividing Wavelength Fitted Data", $"New Dividing Wavelength Calibration", $"Check Dividing Wavelength Calibration", $"Load Dividing Wavelength Calibration") -> w2
      Boolean Array To Number(Boolean array=w2) -> (number=w3)
      Boolean To 0 Or 1(Boolean=$"Load Dividing Wavelength Fitted Data") -> (0, 1=w4)
      Boolean To 0 Or 1(Boolean=$"New Dividing Wavelength Calibration") -> (0, 1=w5)
      Boolean To 0 Or 1(Boolean=$"Check Dividing Wavelength Calibration") -> (0, 1=w6)
      Boolean To 0 Or 1(Boolean=$"Load Dividing Wavelength Calibration") -> (0, 1=w7)
      Add(w4, w5, w6, w7) -> w8
      Is Greater(x=w8, y=1) -> w9
      case (w9) {
        frame False, Default {
          case (w3) {
            frame 0, Default {
              w10 = "Check Calibration"
            }
            frame 1 {
              w10 = "Load Fityc Data"
            }
            frame 2 {
              w10 = "New Calibration"
            }
            frame 4 {
              w10 = "Check Calibration"
            }
            frame 8 {
              w10 = "Load Calibration"
            }
          }
        }
        frame True {
          w11 = "Please do not Press all the buttons\nat once, otherwise I do not know what\nyou want me to do first :("
          w12 = "Oh, sorry I will press them\none by one, while waiting for\nyou to finish."
          One Button Dialog(button name ("OK")=w12, message=w11)
          w10 = "Check Calibration"
        }
      }
      call "FGV MSpot Operation.gvi"(FGV Instructions="Set State", MSpot Calibration Operation Control=w10, Error In=$"Error In") -> (Error Out=w1)
    }
  }
  $"Error Out" <- w1
