vi "MSpot Spectrum Calibration Subroutine.gvi"   [LabVIEW NXG 5.0.0]
inputs:
  "Error In": error
  "Stand Alone?": bool
  "Instrument Coms Info In": "Instrument Coms Info.gtype"
  "Rainbow Sweep Param Selector": "Rainbow Sweep Param Selector.gtype" = {0, 1100, 300, 1, 1, 0}
  "MSpot Spectrum Calibration Parameters In": "MSpot Spectrum Calibration Parameters.gtype" = {"Min Position (mm)"=0, "Max Position (mm)"=10, "Position step size (mm)"=0.1, "Manual Spectra?"=FALSE, "Flame Integration Time (us)"=1000, "Flame Scans to Average"=1}
  "Debugging Cluster In": "Debugging Cluster.gtype"
  "Full Beam Multispectral Data Array In": "Full MSpot Multispectral Data.gtype"[]
outputs:
  "Error Out": error
  "Instrument Coms Info Out": "Instrument Coms Info.gtype"
  "Debugging Cluster Out": "Debugging Cluster.gtype"
  "Full Beam Multispectral Data Array Out": "Full MSpot Multispectral Data.gtype"[]
panel controls:
  "Misc Data Mega Cluster": "Misc Data Mega Cluster.gtype"
  "Instrument Control Mega Cluster": "Instrument Control Mega Cluster.gtype"
  "MSpot Mega Cluster": "MSpot Mega Cluster.gtype"
  "Calibration Operation Control": "Calibration Operation Control.gtype" = "Check Calibration"
types:
  T1 = cluster{"Element 1": "VISA Instr", "Element 2": string}
  "Arduino Detection cluster control.gtype" = cluster{"XZ Stage Arduino Address": "VISA Instr", "XZ Stage Arduino Detected?": bool, "Multiplexer Arduino Detected?": bool, "Multiplexer Arduino Address": "VISA Instr", "Arduinos List": T1[], "XZ Stage Log": string, "Multiplexer Log": string}
  "Thorlabs Motors Serial Number In.gtype" = cluster{"Thorlabs Blue Motor": string, "Thorlabs Red Motor": string, "Blue Motor Homed?": bool, "Red Motor Homed?": bool}
  "Instrument Coms Info.gtype" = cluster{"Arduino Coms Info": "Arduino Detection cluster control.gtype", "Photodetector Names": string[], "Keythley Address": "VISA Instr", "Photodetector Detected?": bool, "Thorlabs Motors Detected?": bool, "Keithley Detected?": bool, "Thorlabs Motors Serial Number": "Thorlabs Motors Serial Number In.gtype", "Photodetector IVI session": "Ivi IviDefault", "Flame ID": string, "Flame Detected?": bool, "Flame Wrapper ID": u64}
  "Raibow Sweep Selector.gtype" = enum{"Red Sweep", "Blue Sweep", "Full Sweep Red First", "Full Sweep Blue First"}
  T2 = enum{"Red Sweep Closing", "Red Sweep Opening", "Red Sweep Both Ways"}
  T3 = enum{"Blue Sweep Opening", "Blue Sweep Closing", "Blue Sweep Both Ways"}
  "Rainbow Sweep Type Selector.gtype" = cluster{"Red Sweep Mode": T2, "Blue Sweep Mode": T3}
  "Rainbow Sweep Param Selector.gtype" = cluster{"Raibow Sweep Selector": "Raibow Sweep Selector.gtype", "Max Wavelength (nm)": f64, "Min Wavelength (nm)": f64, "Wavelength Step (nm)": f64, "Rainbow Sweep Type Selector": "Rainbow Sweep Type Selector.gtype"}
  "MSpot Spectrum Data.gtype" = cluster{"M Spot Spectrum": cluster{"Wavelength": f64[], "Counts": f64[]}, "Blue Motor Position (mm)": f64, "Red Motor Position (mm)": f64, "Dividing Wavelength (nm)": f64}
  "Rainbow Sweep Types.gtype" = enum{"Red Sweep Closing", "Red Sweep Opening", "Blue Sweep Closing", "Blue Sweep Opening"}
  "Full MSpot Multispectral Data.gtype" = cluster{"MSpot Spectrum Data Array": "MSpot Spectrum Data.gtype"[], "Rainbow Sweep Types": "Rainbow Sweep Types.gtype"}
  "Insturment Debugging Cluster.gtype" = cluster{"Keithley": bool, "Arduinos": bool, "Thorlabs Motors": bool, "Photodetector": bool, "Flame Spectr": bool}
  "Debugging Cluster.gtype" = cluster{"Debugging mode?": bool, "Initialize App": bool, "Insturment Debugging": "Insturment Debugging Cluster.gtype"}
  "Calibration Operation Control.gtype" = enum{"Check Calibration", "Load Calibration", "New Calibration"}
  "MSpot Spectrum Calibration Parameters.gtype" = cluster{"Min Position (mm)": f64, "Max Position (mm)": f64, "Position step size (mm)": f64, "Manual Spectra?": bool, "Flame Integration Time (us)": f64, "Flame Scans to Average": u32}
  "Full Reference Cluster.gtype" = cluster{"Enum Reference Cluster": "Enum Control Reference Cluster.gtype", "Boolean Reference Cluster": "Boolean Control Reference Cluster.gtype", "Numeric Reference Cluster": "Numeric Control Reference Cluster.gtype", "Numeric Cluster Reference Cluster": "Numeric Cluster Reference Cluster.gtype", "Path Reference Cluster": "Path Reference Cluster.gtype", "Cluster Reference Cluster": "Cluster Reference Cluster.gtype", "XZ Stage Controls Reference Cluster": "XZ Stage Controls Reference Cluster.gtype"}
  "Cell Naming Cluster.gtype" = cluster{"Cell Label": string, "Sample Prefix": string, "Author Initials": string, "Current Date": string, "Batch Name": string}
  T4 = cluster{"X Coordinate (mm)": f64, "Z Coordinate (mm)": f64}
  T5 = cluster{"X Coordinate (mm)": f64, "Z Coordinate (mm)": f64, "Vertical Spacing (mm)": f64}
  "XZ All Position Cluster.gtype" = cluster{"Diffusor Coordinates": T4, "Photodetector Coordinates": T4, "Cell R.01 Coordinates": T5}
  T6 = cluster{"Thorlabs Motor Serial Number File Path": path, "Default Data Saving Location": path}
  "Misc Data Mega Cluster.gtype" = cluster{"Full Reference Cluster": "Full Reference Cluster.gtype", "Cell Naming Cluster": "Cell Naming Cluster.gtype", "All XZ Position Cluster": "XZ All Position Cluster.gtype", "All Paths": T6}
  "Instrument Control Mega Cluster.gtype" = cluster{"Instruments Coms Info": "Instrument Coms Info.gtype", "Debugging Cluster": "Debugging Cluster.gtype"}
  "MSpot Mega Cluster.gtype" = cluster{"Rainbow Sweep Parameters MSpot": "Rainbow Sweep Param Selector.gtype", "MSpot Sperctrum Calibration Parameters": "MSpot Spectrum Calibration Parameters.gtype", "Full Beam Multispectral Data Array": "Full MSpot Multispectral Data.gtype"[]}
uses:
  Rainbow Measurement Setup::Main Functions::Instruction Queue::Current State::FGV Current State.gvi
  Rainbow Measurement Setup::Main Functions::One Time Calibrations::MSpot Spectrum::FGV MSpot Operation.gvi
  Rainbow Measurement Setup::Side Functions::Global Abort::FGV Global Abort.gvi
  Rainbow Measurement Setup::Main Functions::One Time Calibrations::MSpot Spectrum::MSpot Start App Handler.gvi
  Rainbow Measurement Setup::Side Functions::Instrument Control::Debug Cluster Instrument Extractor.gvi
  Rainbow Measurement Setup::Main Functions::One Time Calibrations::Beam Power Density::Specific Detect Instruments Subroutine.gvi
  Rainbow Measurement Setup::Side Functions::Instrument Control::Thorlabs Motors::Movement::KCube Move to 0 or Home.gvi
  Rainbow Measurement Setup::Side Functions::Instrument Control::Arduino::XZ Stage Arduino::XZ Stage Initialize And Home.gvi
  Rainbow Measurement Setup::Side Functions::Instrument Control::Arduino::XZ Stage Arduino::XZ Stage Move to Position.gvi
  Rainbow Measurement Setup::Side Functions::Instrument Control::Flame Spectrometer::Flame Initialize.gvi
  Rainbow Measurement Setup::Main Functions::One Time Calibrations::MSpot Spectrum::MSpot Spectrum Rainbow Sweep Subroutine.gvi
  Rainbow Measurement Setup::Side Functions::Instrument Control::Arduino::XZ Stage Arduino::XZ Stage Close Coms.gvi
  Rainbow Measurement Setup::Side Functions::Instrument Control::Flame Spectrometer::Flame Close.gvi
  Rainbow Measurement Setup::Main Functions::One Time Calibrations::MSpot Spectrum::File Handling::MSpot Spectra file handling.gvi
  Rainbow Measurement Setup::Main Functions::One Time Calibrations::MSpot Spectrum::File Handling::MSpot Load Prompt.gvi
  Rainbow Measurement Setup::Main Functions::One Time Calibrations::MSpot Spectrum::MSpot Spectrum Visualizer.gvi
  Rainbow Measurement Setup::Main Functions::One Time Calibrations::MSpot Spectrum::File Handling::MSpot Calibration Save Graphs Prompt.gvi
  Rainbow Measurement Setup::Side Functions::Instrument Control::Thorlabs Motors::Dividing Wavelength Control::Dividing Wavelength Calibration Data FGV.gvi
diagram:
  # This subVI takes a full spectrum for each guillotine motor position and then changes the guillotine position and continues on taking spectra.
  # After all the spectra have been taken we are presented with the results to determine the dividing wavelength for each position and then we can
  # write down the dividing wavelength file.
  case ($"Error In") {
    frame Error, Default {
      w1 = $"Error In"
      w2 = default
      w3 = $"Instrument Coms Info In"
      w4 = $"Debugging Cluster In"
    }
    frame No Error {
      call "FGV Current State.gvi"(Current State Instructions="Set Current State and Substate", Current State="MSpot Spectrum Calibration", Current Substate="", Error In=$"Error In") -> (Error Out=w5)
      call "FGV MSpot Operation.gvi"(FGV Instructions="Read State", Error In=w5) -> (Mspot Calibration Operation Control Out=w6, Error Out=w7)
      Select(s=$"Stand Alone?", t=$"Calibration Operation Control", f=w6) -> w8
      s1 = w7  # shift register
      s2 = "Start App"  # shift register
      s2.prev1 = uninitialised  # shift register
      s3 = $"Instrument Coms Info In"  # shift register
      s4 = $"Full Beam Multispectral Data Array In"  # shift register
      s5 = $"Debugging Cluster In"  # shift register
      s6 = $"Misc Data Mega Cluster"  # shift register
      s7 = $"Instrument Control Mega Cluster"  # shift register
      while {
        call "FGV Global Abort.gvi"(Global Abort Instructions="Read Current State") -> (Local Abort Out=w9, Global Abort Out=w10)
        Is Not Equal(x=s2, y="Stop App") -> w11
        Logical And(w9, w11) -> w12
        Select(s=w12, t="Close Coms", f=s2) -> w13
        case (w13) {
          frame "Start App", Default {
            call "MSpot Start App Handler.gvi"(Stand Alone?=$"Stand Alone?", Operatin Control=w8) -> (Desired State=w14)
            call "FGV Current State.gvi"(Current State Instructions="Set Current Substate", Current Substate="Starting MSpot Calibration", Error In=s1) -> (Error Out=w15)
            w16 = s3
            w17 = s4
            w18 = default
            w19 = s5
            w20 = s7
          }
          frame "Detect Instruments" {
            Property Node(instance in=s7) -> ("Debugging Cluster"=w21, "Instruments Coms Info"=w22, instance out=w23)
            call "FGV Current State.gvi"(Current State Instructions="Set Current Substate", Current Substate="Detecting Instruments", Error In=s1) -> (Error Out=w24)
            call "Debug Cluster Instrument Extractor.gvi"(Debugging Cluster In=w21, Error In=w24) -> (Debuging Cluster Out=w25, Instruments to Detect=w26, Error Out=w27)
            call "Specific Detect Instruments Subroutine.gvi"(Instrument Coms Info In=w22, Error In=w27, Instruments To Detect Array=w26, Stand Alone?=$"Stand Alone?") -> (Instrument Coms Info Out=w28, Error Out=w15)
            Property Node(instance in=w23, "Debugging Cluster"=w25, "Instruments Coms Info"=w28) -> (instance out=w20)
            w14 = "Initialize Instruments"
            w16 = _
            w17 = s4
            w18 = default
            w19 = _
          }
          frame "Initialize Instruments" {
            Property Node(instance in=s6) -> ("All XZ Position Cluster:Diffusor Coordinates"=w29)
            call "FGV Current State.gvi"(Current State Instructions="Set Current Substate", Current Substate="Initializing Instruments", Error In=s1) -> (Error Out=w30)
            call "KCube Move to 0 or Home.gvi"(Instrument Control Mega Cluster=s7, Error In=w30) -> (Error Out=w31)
            call "XZ Stage Initialize And Home.gvi"(Error In=w31) -> (Instrument Coms Info Out=w32, Debugging Cluster Out=w33, Error Out=w34)
            call "XZ Stage Move to Position.gvi"(Instrument Coms Info In=w32, Debugging Cluster In=w33, Error In=w34, XZ Coordinate Cluster In=w29) -> (Instrument Coms Info Out=w35, Debugging Cluster Out=w36, Error Out=w37)
            call "Flame Initialize.gvi"(Instrument Coms Info In=w35, Debugging Cluster In=w36, Error In=w37) -> (Instrument Coms Info Out=w38, Debugging Cluster Out=w39, Error Out=w15)
            Property Node("Instruments Coms Info"=w38, "Debugging Cluster"=w39) -> (instance out=w20)
            w14 = "Rainbow Sweep"
            w16 = _
            w17 = s4
            w18 = default
            w19 = _
          }
          frame "Rainbow Sweep" {
            $"Full Beam Multispectral Data Array Out" <- "Full MSpot Multispectral Data.gtype"[] []
            call "FGV Current State.gvi"(Current State Instructions="Set Current Substate", Current Substate="Acquiring Spectra", Error In=s1) -> (Error Out=w40)
            call "MSpot Spectrum Rainbow Sweep Subroutine.gvi"(Instrument Coms Info In=s3, MSpot Spectrum Calibration Parameters In=$"MSpot Spectrum Calibration Parameters In", Rainbow Sweep Param Selector=$"Rainbow Sweep Param Selector", Debugging Cluster In=s5, Error In=w40) -> (Instrument Coms Info Out=w16, Full MSpot Multispectral Data Array=w17, Debugging Cluster Out=w19, Error Out=w15)
            w14 = "Close Coms"
            w18 = default
            w20 = s7
          }
          frame "Close Coms" {
            Select(s=w9, t="Stop App", f="Check Graphs") -> w14
            call "FGV Current State.gvi"(Current State Instructions="Set Current Substate", Current Substate="Closing Coms", Error In=s1) -> (Error Out=w41)
            call "XZ Stage Close Coms.gvi"(Instrument Coms Info In=s3, Error In=w41) -> (Instrument Coms Info Out=w42, Error Out=w43)
            call "Flame Close.gvi"(Instrument Coms Info In=w42, Debugging Cluster In=s5, Error In=w43) -> (Instrument Coms Info Out=w16, Debugging Cluster Out=w19, Error Out=w15)
            w17 = s4
            w18 = default
            w20 = s7
          }
          frame "Load Calibration" {
            call "FGV Current State.gvi"(Current State Instructions="Set Current Substate", Current Substate="Loading Calibration", Error In=s1) -> (Error Out=w44)
            call "MSpot Spectra file handling.gvi"(Full MSpot Multispectral Data Array In=s4, Modify File Operation="Load TXT", Error In=w44) -> (Full MSpot Multispectral Data Array Out=w17, Found Any File?=w45, Error Out=w46)
            call "MSpot Load Prompt.gvi"(Found Any File?=w45, Stand Alone=$"Stand Alone?", Error In=w46) -> (Desired State=w14, Error Out=w15)
            w16 = s3
            w18 = default
            w19 = s5
            w20 = s7
          }
          frame "Check Graphs" {
            call "FGV Current State.gvi"(Current State Instructions="Set Current Substate", Current Substate="Checking Graphs", Error In=s1) -> (Error Out=w47)
            call "MSpot Spectrum Visualizer.gvi"(Full MSpot Multispectral Data Array=s4, Error In=w47) -> (Error Out=w48)
            call "MSpot Calibration Save Graphs Prompt.gvi"(M Spot Spectrum Calibration State Machine Instructions=s2.prev1, Debugging Cluster In=s5, Error In=w48) -> (Selected State=w14, Debugging Cluster In Out=w19, Error Out=w15)
            w16 = s3
            w17 = s4
            w18 = default
            w20 = s7
          }
          frame "Save Graphs" {
            call "FGV Current State.gvi"(Current State Instructions="Set Current Substate", Current Substate="Saving Graphs", Error In=s1) -> (Error Out=w49)
            call "MSpot Spectra file handling.gvi"(Full MSpot Multispectral Data Array In=s4, Modify File Operation="Save TXT", Error In=w49) -> (Full MSpot Multispectral Data Array Out=w17, Error Out=w15)
            w14 = "Save Dividing Wavelength"
            w16 = s3
            w18 = default
            w19 = s5
            w20 = s7
          }
          frame "Save Dividing Wavelength" {
            call "Dividing Wavelength Calibration Data FGV.gvi"(Div Wavelength FGV Instructions="File Save Data", Error In=s1) -> (Error Out=w15)
            w14 = "Stop App"
            w16 = s3
            w17 = s4
            w18 = default
            w19 = s5
            w20 = s7
          }
          frame "Stop App" {
            call "FGV Current State.gvi"(Current State Instructions="Set Current Substate", Current Substate="Finishing MSpot Calibration", Error In=s1) -> (Error Out=w15)
            w14 = "Start App"
            w16 = s3
            w17 = s4
            w18 = TRUE
            w19 = s5
            w20 = s7
          }
        }
        Logical Or(w10, w18) -> w50
        next s1 = w15
        next s2 = w14
        next s3 = w16
        next s4 = w17
        next s5 = w19
        next s6 = _
        next s7 = w20
        stop if w50
      }
      w1 = s1
      w2 = s4
      w3 = s3
      w4 = s5
    }
  }
  $"Debugging Cluster Out" <- w4
  $"Error Out" <- w1
  $"Full Beam Multispectral Data Array Out" <- w2
  $"Instrument Coms Info Out" <- w3
