vi "MSpot Spectrum Rainbow Sweep Subroutine.gvi"   [LabVIEW NXG 5.0.0]
inputs:
  "Instrument Coms Info In": "Instrument Coms Info.gtype"
  "MSpot Spectrum Calibration Parameters In": "MSpot Spectrum Calibration Parameters.gtype" = {"Min Position (mm)"=0, "Max Position (mm)"=10, "Position step size (mm)"=0.1, "Manual Spectra?"=FALSE, "Flame Integration Time (us)"=1000, "Flame Scans to Average"=1}
  "Rainbow Sweep Param Selector": "Rainbow Sweep Param Selector.gtype" = {0, 1100, 300, 1, 1, 0}
  "Error In": error
  "Debugging Cluster In": "Debugging Cluster.gtype"
outputs:
  "Instrument Coms Info Out": "Instrument Coms Info.gtype"
  "Full MSpot Multispectral Data Array": "Full MSpot Multispectral Data.gtype"[]
  "Debugging Cluster Out": "Debugging Cluster.gtype"
  "Error Out": error
types:
  "Raibow Sweep Selector.gtype" = enum{"Red Sweep", "Blue Sweep", "Full Sweep Red First", "Full Sweep Blue First"}
  T1 = enum{"Red Sweep Closing", "Red Sweep Opening", "Red Sweep Both Ways"}
  T2 = enum{"Blue Sweep Opening", "Blue Sweep Closing", "Blue Sweep Both Ways"}
  "Rainbow Sweep Type Selector.gtype" = cluster{"Red Sweep Mode": T1, "Blue Sweep Mode": T2}
  "Rainbow Sweep Param Selector.gtype" = cluster{"Raibow Sweep Selector": "Raibow Sweep Selector.gtype", "Max Wavelength (nm)": f64, "Min Wavelength (nm)": f64, "Wavelength Step (nm)": f64, "Rainbow Sweep Type Selector": "Rainbow Sweep Type Selector.gtype"}
  "MSpot Spectrum Data.gtype" = cluster{"M Spot Spectrum": cluster{"Wavelength": f64[], "Counts": f64[]}, "Blue Motor Position (mm)": f64, "Red Motor Position (mm)": f64}
  "Rainbow Sweep Types.gtype" = enum{"Red Sweep Closing", "Red Sweep Opening", "Blue Sweep Closing", "Blue Sweep Opening"}
  "Full MSpot Multispectral Data.gtype" = cluster{"MSpot Spectrum Data Array": "MSpot Spectrum Data.gtype"[], "Rainbow Sweep Types": "Rainbow Sweep Types.gtype"}
  T3 = cluster{"Element 1": "VISA Instr", "Element 2": string}
  "Arduino Detection cluster control.gtype" = cluster{"XZ Stage Arduino Address": "VISA Instr", "XZ Stage Arduino Detected?": bool, "Multiplexer Arduino Detected?": bool, "Multiplexer Arduino Address": "VISA Instr", "Arduinos List": T3[], "XZ Stage Log": string, "Multiplexer Log": string}
  "Thorlabs Motors Serial Number In.gtype" = cluster{"Thorlabs Blue Motor": string, "Thorlabs Red Motor": string, "Blue Motor Homed?": bool, "Red Motor Homed?": bool}
  "Instrument Coms Info.gtype" = cluster{"Arduino Coms Info": "Arduino Detection cluster control.gtype", "Photodetector Names": string[], "Keythley Address": "VISA Instr", "Photodetector Detected?": bool, "Thorlabs Motors Detected?": bool, "Keithley Detected?": bool, "Thorlabs Motors Serial Number": "Thorlabs Motors Serial Number In.gtype", "Photodetector IVI session": "Ivi IviDefault", "Flame ID": string, "Flame Detected?": bool, "Flame Wrapper ID": u64}
  "Insturment Debugging Cluster.gtype" = cluster{"Keithley": bool, "Arduinos": bool, "Thorlabs Motors": bool, "Photodetector": bool, "Flame Spectr": bool}
  "Debugging Cluster.gtype" = cluster{"Debugging mode?": bool, "Initialize App": bool, "Insturment Debugging": "Insturment Debugging Cluster.gtype"}
  "MSpot Spectrum Calibration Parameters.gtype" = cluster{"Min Position (mm)": f64, "Max Position (mm)": f64, "Position step size (mm)": f64, "Manual Spectra?": bool, "Flame Integration Time (us)": f64, "Flame Scans to Average": u32}
uses:
  Rainbow Measurement Setup::Side Functions::Rainbow Sweep::Rainbow Sweep Type Extractor.gvi
  Rainbow Measurement Setup::Main Functions::One Time Calibrations::MSpot Spectrum::MSpot Step Calculator.gvi
  Rainbow Measurement Setup::Side Functions::Instrument Control::Thorlabs Motors::Movement::KCube Initialize and Home.gvi
  Rainbow Measurement Setup::Main Functions::One Time Calibrations::MSpot Spectrum::MSpot parameter Extractor.gvi
  Rainbow Measurement Setup::Side Functions::Global Abort::FGV Global Abort.gvi
  Rainbow Measurement Setup::Side Functions::Instrument Control::Thorlabs Motors::Movement::KCube Motor Single Move to Position.gvi
  Rainbow Measurement Setup::Side Functions::Instrument Control::Flame Spectrometer::Flame Set Scans to Average.gvi
  Rainbow Measurement Setup::Side Functions::Instrument Control::Flame Spectrometer::Flame Set Integration Time.gvi
  Rainbow Measurement Setup::Side Functions::Instrument Control::Flame Spectrometer::Flame Get Spectra.gvi
  Rainbow Measurement Setup::Side Functions::Instrument Control::Thorlabs Motors::Movement::KCube Motors Close.gvi
diagram:
  # This SubVI Performs a scan of the spectrum of the beam (STILL FLAME CONNECTION MISSING) and then moves the blade motors to perform a full scan of the spectrum with respect to position.
  case ($"Error In") {
    frame Error, Default {
      w1 = default
      w2 = $"Error In"
      w3 = $"Instrument Coms Info In"
      w4 = $"Debugging Cluster In"
    }
    frame No Error {
      call "Rainbow Sweep Type Extractor.gvi"(Rainbow Sweep Parameters=$"Rainbow Sweep Param Selector", Error In=$"Error In") -> (Rainbow Sweep Array=w5, Error Out=w6)
      call "MSpot Step Calculator.gvi"(MSpot Spectrum Calibration Parameters In=$"MSpot Spectrum Calibration Parameters In") -> (Manual Spectra?=w7, Number of steps=w8)
      s1 = "Full MSpot Multispectral Data.gtype"[] []  # shift register
      s2 = w6  # shift register
      s3 = $"Instrument Coms Info In"  # shift register
      s4 = $"Debugging Cluster In"  # shift register
      for (iteration -> i1) {
        w9 = each element of w5
        Array Index(array=s1) -> (out0[i1]=w10)
        case (w9) {
          frame "Red Sweep Opening", Default {
            call "KCube Initialize and Home.gvi"(Instrument Coms Info In=s3, Debugging Cluster In=s4, Error In=s2, KCube Motor Selector="Blue Motor") -> (Instrument Coms Info Out=w15, Debugging Cluster Out=w16, Error Out=w17)
            s5 = w17  # shift register
            s6 = "MSpot Spectrum Data.gtype"[] []  # shift register
            s7 = w15  # shift register
            s8 = w16  # shift register
            for (N = w8) (iteration -> i2) {
              call "MSpot parameter Extractor.gvi"(Current Step=i2, MSpot Spectrum Calibration Parameters In=$"MSpot Spectrum Calibration Parameters In", Rainbow Sweep Type=w9, Error In=s5) -> (Flame Integration Time=w18, Flame Scans to Average=w19, Motor Position to move to (mm)=w20, Error Out=w21)
              call "FGV Global Abort.gvi"(Global Abort Instructions="Read Current State", Error In=w21) -> (Local Abort Out=w22, Global Abort Out=w23, Error Out=w24)
              call "KCube Motor Single Move to Position.gvi"(Instrument Coms Info In=s7, Debugging Cluster In=s8, Motor Position to move to (mm)=w20, Error In=w24, KCube Motor Selector="Blue Motor") -> (Instrument Coms Info Out=w25, Debugging Cluster Out=w26, Error Out=w27)
              case (w7) {
                frame False, Default {
                  call "Flame Set Scans to Average.gvi"(Instrument Coms Info In=w25, Debugging Cluster In=w26, Scans to Average=w19, Error In=w27) -> (Instrument Coms Info Out=w32, Debugging Cluster Out=w33, Error Out=w34)
                  call "Flame Set Integration Time.gvi"(Instrument Coms Info In=w32, Debugging Cluster In=w33, Integration Time=w18, Error In=w34) -> (Instrument Coms Info Out=w35, Debugging Cluster Out=w36, Error Out=w37)
                  call "Flame Get Spectra.gvi"(Instrument Coms Info In=w35, Debugging Cluster In=w36, Error In=w37) -> (Instrument Coms Info Out=w31, Debugging Cluster Out=w29, Beam Spectrum=w28, Error Out=w30)
                }
                frame True {
                  w38 = cluster{"Wavelength": f64[], "Counts": f64[]} {all zero or empty}
                  Wait Until Next Multiple(multiple to wait=300)
                  w39 = "Please Save the spectrum file\non the oceanview software\nbefore continuing."
                  One Button Dialog(button name ("OK")="Okay, I will", message=w39)
                  w28 = w38
                  w29 = w26
                  w30 = w27
                  w31 = w25
                }
              }
              Property Node(instance in="MSpot Spectrum Data.gtype" {all zero or empty}, "M Spot Spectrum"=w28, "Blue Motor Position (mm)"=w20, "Red Motor Position (mm)"=0) -> (instance out=w40)
              Insert Into Array(inArray=s6, index0=i2, new=w40) -> w41
              Logical Or(w22, w23) -> w42
              next s5 = w30
              next s6 = w41
              next s7 = w31
              next s8 = w29
              stop if w42
            }
            call "KCube Motor Single Move to Position.gvi"(Instrument Coms Info In=s7, Debugging Cluster In=s8, Motor Position to move to (mm)=50, Error In=s5, KCube Motor Selector="Blue Motor") -> (Instrument Coms Info Out=w43, Debugging Cluster Out=w14, Error Out=w44)
            call "KCube Motors Close.gvi"(Instrument Coms Info In=w43, Error In=w44) -> (Instrument Coms Info Out=w11, Error Out=w12)
            Property Node(instance in=w10, "Rainbow Sweep Types"=w9, "MSpot Spectrum Data Array"=s6) -> (instance out=w13)
          }
          frame "Red Sweep Closing" {
            call "KCube Initialize and Home.gvi"(Instrument Coms Info In=s3, Debugging Cluster In=s4, Error In=s2, KCube Motor Selector="Blue Motor") -> (Instrument Coms Info Out=w45, Debugging Cluster Out=w46, Error Out=w47)
            s9 = w47  # shift register
            s10 = "MSpot Spectrum Data.gtype"[] []  # shift register
            s11 = w45  # shift register
            s12 = w46  # shift register
            for (N = w8) (iteration -> i3) {
              call "MSpot parameter Extractor.gvi"(Current Step=i3, MSpot Spectrum Calibration Parameters In=$"MSpot Spectrum Calibration Parameters In", Rainbow Sweep Type=w9, Error In=s9) -> (Flame Integration Time=w48, Flame Scans to Average=w49, Motor Position to move to (mm)=w50, Error Out=w51)
              call "FGV Global Abort.gvi"(Global Abort Instructions="Read Current State", Error In=w51) -> (Local Abort Out=w52, Global Abort Out=w53, Error Out=w54)
              call "KCube Motor Single Move to Position.gvi"(Instrument Coms Info In=s11, Debugging Cluster In=s12, Motor Position to move to (mm)=w50, Error In=w54, KCube Motor Selector="Blue Motor") -> (Instrument Coms Info Out=w55, Debugging Cluster Out=w56, Error Out=w57)
              case (w7) {
                frame False, Default {
                  call "Flame Set Scans to Average.gvi"(Instrument Coms Info In=w55, Debugging Cluster In=w56, Scans to Average=w49, Error In=w57) -> (Instrument Coms Info Out=w61, Debugging Cluster Out=w62, Error Out=w63)
                  call "Flame Set Integration Time.gvi"(Instrument Coms Info In=w61, Debugging Cluster In=w62, Integration Time=w48, Error In=w63) -> (Instrument Coms Info Out=w64, Debugging Cluster Out=w65, Error Out=w66)
                  call "Flame Get Spectra.gvi"(Instrument Coms Info In=w64, Debugging Cluster In=w65, Error In=w66) -> (Instrument Coms Info Out=w60, Debugging Cluster Out=w59, Beam Spectrum=w58, Error Out=w67)
                }
                frame True {
                  w68 = cluster{"Wavelength": f64[], "Counts": f64[]} {all zero or empty}
                  w69 = "Please Save the spectrum file\non the oceanview software\nbefore continuing."
                  One Button Dialog(button name ("OK")="Okay, I will", message=w69)
                  Wait Until Next Multiple(multiple to wait=300)
                  w58 = w68
                  w59 = w56
                  w60 = w55
                }
              }
              Property Node(instance in="MSpot Spectrum Data.gtype" {all zero or empty}, "M Spot Spectrum"=w58, "Blue Motor Position (mm)"=w50, "Red Motor Position (mm)"=0) -> (instance out=w70)
              Insert Into Array(inArray=s10, index0=i3, new=w70) -> w71
              Logical Or(w52, w53) -> w72
              next s9 = w57
              next s10 = w71
              next s11 = w60
              next s12 = w59
              stop if w72
            }
            call "KCube Motor Single Move to Position.gvi"(Instrument Coms Info In=s11, Debugging Cluster In=s12, Motor Position to move to (mm)=50, Error In=s9, KCube Motor Selector="Blue Motor") -> (Instrument Coms Info Out=w73, Debugging Cluster Out=w14, Error Out=w74)
            call "KCube Motors Close.gvi"(Instrument Coms Info In=w73, Error In=w74) -> (Instrument Coms Info Out=w11, Error Out=w12)
            Property Node(instance in=w10, "Rainbow Sweep Types"=w9, "MSpot Spectrum Data Array"=s10) -> (instance out=w13)
          }
          frame "Blue Sweep Closing" {
            call "KCube Initialize and Home.gvi"(Instrument Coms Info In=s3, Debugging Cluster In=s4, Error In=s2, KCube Motor Selector="Red Motor") -> (Instrument Coms Info Out=w75, Debugging Cluster Out=w76, Error Out=w77)
            s13 = w77  # shift register
            s14 = "MSpot Spectrum Data.gtype"[] []  # shift register
            s15 = w76  # shift register
            s16 = w75  # shift register
            for (N = w8) (iteration -> i4) {
              call "MSpot parameter Extractor.gvi"(Current Step=i4, MSpot Spectrum Calibration Parameters In=$"MSpot Spectrum Calibration Parameters In", Rainbow Sweep Type=w9, Error In=s13) -> (Flame Integration Time=w78, Flame Scans to Average=w79, Motor Position to move to (mm)=w80, Error Out=w81)
              call "FGV Global Abort.gvi"(Global Abort Instructions="Read Current State", Error In=w81) -> (Local Abort Out=w82, Global Abort Out=w83, Error Out=w84)
              call "KCube Motor Single Move to Position.gvi"(Instrument Coms Info In=s16, Debugging Cluster In=s15, Motor Position to move to (mm)=w80, Error In=w84, KCube Motor Selector="Red Motor") -> (Instrument Coms Info Out=w85, Debugging Cluster Out=w86, Error Out=w87)
              case (w7) {
                frame False, Default {
                  call "Flame Set Scans to Average.gvi"(Instrument Coms Info In=w85, Debugging Cluster In=w86, Scans to Average=w79, Error In=w87) -> (Instrument Coms Info Out=w92, Debugging Cluster Out=w93, Error Out=w94)
                  call "Flame Set Integration Time.gvi"(Instrument Coms Info In=w92, Debugging Cluster In=w93, Integration Time=w78, Error In=w94) -> (Instrument Coms Info Out=w95, Debugging Cluster Out=w96, Error Out=w97)
                  call "Flame Get Spectra.gvi"(Instrument Coms Info In=w95, Debugging Cluster In=w96, Error In=w97) -> (Instrument Coms Info Out=w91, Debugging Cluster Out=w89, Beam Spectrum=w88, Error Out=w90)
                }
                frame True {
                  w98 = "Please Save the spectrum file\non the oceanview software\nbefore continuing."
                  One Button Dialog(button name ("OK")="Okay, I will", message=w98)
                  Wait Until Next Multiple(multiple to wait=300)
                  w99 = cluster{"Wavelength": f64[], "Counts": f64[]} {all zero or empty}
                  w88 = w99
                  w89 = w86
                  w90 = w87
                  w91 = w85
                }
              }
              Property Node(instance in="MSpot Spectrum Data.gtype" {all zero or empty}, "M Spot Spectrum"=w88, "Red Motor Position (mm)"=w80, "Blue Motor Position (mm)"=0) -> (instance out=w100)
              Insert Into Array(inArray=s14, index0=i4, new=w100) -> w101
              Logical Or(w82, w83) -> w102
              next s13 = w90
              next s14 = w101
              next s15 = w89
              next s16 = w91
              stop if w102
            }
            call "KCube Motor Single Move to Position.gvi"(Instrument Coms Info In=s16, Debugging Cluster In=s15, Motor Position to move to (mm)=50, Error In=s13, KCube Motor Selector="Red Motor") -> (Instrument Coms Info Out=w103, Debugging Cluster Out=w14, Error Out=w104)
            call "KCube Motors Close.gvi"(Instrument Coms Info In=w103, Error In=w104) -> (Instrument Coms Info Out=w11, Error Out=w12)
            Property Node(instance in=w10, "Rainbow Sweep Types"=w9, "MSpot Spectrum Data Array"=s14) -> (instance out=w13)
          }
          frame "Blue Sweep Opening" {
            call "KCube Initialize and Home.gvi"(Instrument Coms Info In=s3, Debugging Cluster In=s4, Error In=s2, KCube Motor Selector="Red Motor") -> (Instrument Coms Info Out=w105, Debugging Cluster Out=w106, Error Out=w107)
            s17 = w107  # shift register
            s18 = "MSpot Spectrum Data.gtype"[] []  # shift register
            s19 = w106  # shift register
            s20 = w105  # shift register
            for (N = w8) (iteration -> i5) {
              call "MSpot parameter Extractor.gvi"(Current Step=i5, MSpot Spectrum Calibration Parameters In=$"MSpot Spectrum Calibration Parameters In", Rainbow Sweep Type=w9, Error In=s17) -> (Flame Integration Time=w108, Flame Scans to Average=w109, Motor Position to move to (mm)=w110, Error Out=w111)
              call "FGV Global Abort.gvi"(Global Abort Instructions="Read Current State", Error In=w111) -> (Local Abort Out=w112, Global Abort Out=w113, Error Out=w114)
              call "KCube Motor Single Move to Position.gvi"(Instrument Coms Info In=s20, Debugging Cluster In=s19, Motor Position to move to (mm)=w110, Error In=w114, KCube Motor Selector="Red Motor") -> (Instrument Coms Info Out=w115, Debugging Cluster Out=w116, Error Out=w117)
              case (w7) {
                frame False, Default {
                  call "Flame Set Scans to Average.gvi"(Instrument Coms Info In=w115, Debugging Cluster In=w116, Scans to Average=w109, Error In=w117) -> (Instrument Coms Info Out=w122, Debugging Cluster Out=w123, Error Out=w124)
                  call "Flame Set Integration Time.gvi"(Instrument Coms Info In=w122, Debugging Cluster In=w123, Integration Time=w108, Error In=w124) -> (Instrument Coms Info Out=w125, Debugging Cluster Out=w126, Error Out=w127)
                  call "Flame Get Spectra.gvi"(Instrument Coms Info In=w125, Debugging Cluster In=w126, Error In=w127) -> (Instrument Coms Info Out=w121, Debugging Cluster Out=w119, Beam Spectrum=w118, Error Out=w120)
                }
                frame True {
                  w128 = cluster{"Wavelength": f64[], "Counts": f64[]} {all zero or empty}
                  w129 = "Please Save the spectrum file\non the oceanview software\nbefore continuing."
                  One Button Dialog(button name ("OK")="Okay, I will", message=w129)
                  Wait Until Next Multiple(multiple to wait=300)
                  w118 = w128
                  w119 = w116
                  w120 = w117
                  w121 = w115
                }
              }
              Property Node(instance in="MSpot Spectrum Data.gtype" {all zero or empty}, "M Spot Spectrum"=w118, "Red Motor Position (mm)"=w110, "Blue Motor Position (mm)"=0) -> (instance out=w130)
              Insert Into Array(inArray=s18, index0=i5, new=w130) -> w131
              Logical Or(w112, w113) -> w132
              next s17 = w120
              next s18 = w131
              next s19 = w119
              next s20 = w121
              stop if w132
            }
            call "KCube Motor Single Move to Position.gvi"(Instrument Coms Info In=s20, Debugging Cluster In=s19, Motor Position to move to (mm)=50, Error In=s17, KCube Motor Selector="Red Motor") -> (Instrument Coms Info Out=w133, Debugging Cluster Out=w14, Error Out=w134)
            call "KCube Motors Close.gvi"(Instrument Coms Info In=w133, Error In=w134) -> (Instrument Coms Info Out=w11, Error Out=w12)
            Property Node(instance in=w10, "Rainbow Sweep Types"=w9, "MSpot Spectrum Data Array"=s18) -> (instance out=w13)
          }
        }
        Insert Into Array(inArray=s1, index0=i1, new=w13) -> w135
        next s1 = w135
        next s2 = w12
        next s3 = w11
        next s4 = w14
      }
      w1 = s1
      w2 = s2
      w3 = s3
      w4 = s4
    }
  }
  $"Instrument Coms Info Out" <- w3
  $"Debugging Cluster Out" <- w4
  $"Error Out" <- w2
  $"Full MSpot Multispectral Data Array" <- w1
