vi "MSpot Spectrum Visualizer.gvi"   [LabVIEW NXG 5.0.0]
inputs:
  "Error In": error
  "MSpot Mega Cluster In": "MSpot Mega Cluster.gtype"
outputs:
  "Error Out": error
panel controls:
  "Sweep Type Selector": i32
  "Graph (position) Selector": i32
  "Continue": bool
  "Div Wavelength Threshold": f64 = 0.85
  "Divide?": bool
  "Smooth Peaks?": bool
panel indicators:
  "Rainbow Sweep Type": "Rainbow Sweep Types.gtype"
  "M Spot Spectrum": cluster{"Element 1": f64[], "Element 2": f64[]}
  "MSpot Spectrum Data": "MSpot Spectrum Data.gtype"
types:
  "Rainbow Sweep Types.gtype" = enum{"Red Sweep Closing", "Red Sweep Opening", "Blue Sweep Closing", "Blue Sweep Opening"}
  "MSpot Spectrum Data.gtype" = cluster{"M Spot Spectrum": cluster{"Wavelength": f64[], "Counts": f64[]}, "Blue Motor Position (mm)": f64, "Red Motor Position (mm)": f64, "Dividing Wavelength (nm)": f64}
  "Raibow Sweep Selector.gtype" = enum{"Red Sweep", "Blue Sweep", "Full Sweep Red First", "Full Sweep Blue First"}
  "Rainbow Sweep Param Selector.gtype" = cluster{"Raibow Sweep Selector": "Raibow Sweep Selector.gtype", "Max Wavelength (nm)": f64, "Min Wavelength (nm)": f64, "Wavelength Step (nm)": f64, "Rainbow Sweep Type Selector": "Rainbow Sweep Type Selector.gtype"}
  "MSpot Spectrum Calibration Parameters.gtype" = cluster{"Min Position (mm)": f64, "Max Position (mm)": f64, "Position step size (mm)": f64, "Manual Spectra?": bool, "Flame Integration Time (us)": f64, "Flame Scans to Average": u32}
  "Full MSpot Multispectral Data.gtype" = cluster{"MSpot Spectrum Data Array": "MSpot Spectrum Data.gtype"[], "Rainbow Sweep Types": "Rainbow Sweep Types.gtype"}
  "MSpot Mega Cluster.gtype" = cluster{"Rainbow Sweep Parameters MSpot": "Rainbow Sweep Param Selector.gtype", "MSpot Sperctrum Calibration Parameters": "MSpot Spectrum Calibration Parameters.gtype", "Full Beam Multispectral Data Array": "Full MSpot Multispectral Data.gtype"[]}
uses:
  Rainbow Measurement Setup::Main Functions::One Time Calibrations::MSpot Spectrum::Dividing Wavelength Calculations::Dividing Wavelength Calculator.gvi
  Rainbow Measurement Setup::Main Functions::One Time Calibrations::MSpot Spectrum::Dividing Wavelength Calculations::Spectra Operator.gvi
diagram:
  Property Node(instance in=reference to unnamed native front panel, error in=$"Error In") -> ("Window"=w1, error out=w2)
  Open Window(reference in=w1, error in=w2) -> (reference out=w3, error out=w4)
  # This subVI allows us to visualize the data obtained on the Measuring Spot Spectrum Calibration subroutine so that we can
  # extract our own conclusions and elaborate the calibration file.
  case (w4) {
    frame Error, Default {
      w5 = w4
      w6 = w3
    }
    frame No Error {
      Property Node(instance in=$"MSpot Mega Cluster In") -> ("Full Beam Multispectral Data Array"=w7)
      Is Empty Array(array=w7) -> w8
      case (w8) {
        frame True {
          One Button Dialog(button name ("OK")="Oh, sorry", message="No Calibration Found")
          w5 = w4
        }
        frame False {
          call "Dividing Wavelength Calculator.gvi"(Full MSpot Multispectral Data Array In=w7, Error In=w4) -> (Full MSpot Multispectral Data Array Out=w9, Error Out=w10)
          Array Index(array=w7) -> (out0[$"Sweep Type Selector"]=w11)
          s1 = w11  # shift register
          while {
            event (timeout = 50) {
              on "Timeout" {
                Property Node(instance in=s1) -> ("MSpot Spectrum Data Array"=w13, "Rainbow Sweep Types"=w14, instance out=w12)
                Array Index(array=w13) -> (out0[$"Graph (position) Selector"]=w15)
                Property Node(instance in=w15) -> ("M Spot Spectrum"=w16, "Dividing Wavelength (nm)"=w17)
                Property Node(instance in=w16) -> ("Wavelength"=w18, "Counts"=w19)
                Is Empty Array(array=w19) -> w20
                case (w20) {
                  frame True { }
                  frame False {
                    Build Cluster(w18, w19) -> w21
                    $"M Spot Spectrum" <- w21
                  }
                }
                $"MSpot Spectrum Data" <- w15
                Property Node(instance in=reference to "M Spot Spectrum") -> ("Cursor"=w22)
                Property Node(instance in=w22, "XPosition"=w17, "Visible"=TRUE)
                $"Rainbow Sweep Type" <- w14
                Array Size(array=w9) -> (size(s)=w23)
                Decrement(x=w23) -> w24
                Is Equal To 0(x=w24) -> w25
                Not(x=w25) -> w26
                Property Node(instance in=reference to "Sweep Type Selector", "Maximum"=w24, "Minimum"=0, "Visible"=w26) -> (error out=w27)
                Array Size(array=w13) -> (size(s)=w28)
                Decrement(x=w28) -> w29
                Property Node(instance in=reference to "Graph (position) Selector", "Minimum"=0, "Maximum"=w29, error in=w27) -> (error out=w5)
              }
              on "Div Wavelength Threshold" Value changed; "Divide?" Value changed; "Smooth Peaks?" Value changed; "Sweep Type Selector" Value changed {
                call "Dividing Wavelength Calculator.gvi"(Full MSpot Multispectral Data Array In=w9, Error In=w10, Dividing Wavelength Threshold=$"Div Wavelength Threshold") -> (Full MSpot Multispectral Data Array Out=w30, Interpolation error=w31, Error Out=w32)
                case (w31) {
                  frame False, Default {
                    w33 = w32
                  }
                  frame True {
                    Add($"Div Wavelength Threshold", 0.1) -> w34
                    $"Div Wavelength Threshold" <- w34
                    w35 = "Dividing wavelength threshold too low, automatically raised it by 0.1"
                    One Button Dialog(button name ("OK")="Oops sorry :3", message=w35)
                    w33 = w32
                  }
                }
                Array Index(array=w30) -> (out0[$"Sweep Type Selector"]=w36)
                case ($"Divide?") {
                  frame False, Default {
                    w37 = w36
                    w38 = w33
                  }
                  frame True {
                    call "Spectra Operator.gvi"(Full MSpot Multispectral Data=w36, Error In=w33, Spectra Operator control="Divide Spectra") -> (Operated Data=w37, Error Out=w38)
                  }
                }
                case ($"Smooth Peaks?") {
                  frame False, Default {
                    w12 = w37
                    w5 = w38
                  }
                  frame True {
                    call "Spectra Operator.gvi"(Full MSpot Multispectral Data=w37, Error In=w38, Spectra Operator control="Smooth Peaks") -> (Operated Data=w12, Error Out=w5)
                  }
                }
              }
            }
            next s1 = w12
            stop if $Continue
          }
        }
      }
      w6 = w3
    }
  }
  Close Window(reference in=w6, error in=w5) -> (error out=w39)
  $"Error Out" <- w39
