vi "MSpot Start App Handler.gvi"   [LabVIEW NXG 5.0.0]
inputs:
  "Stand Alone?": bool
  "Operatin Control": "Calibration Operation Control.gtype" = "Check Calibration"
outputs:
  "Desired State": "MSpot Spectrum Calibration State Machine Instructions.gtype"
types:
  "MSpot Spectrum Calibration State Machine Instructions.gtype" = enum{"Start App", "Detect Instruments", "Initialize Instruments", "Rainbow Sweep", "Close Coms", "Load Calibration", "Check Graphs", "Save Graphs", "Save Dividing Wavelength", "Stop App"}
  "Calibration Operation Control.gtype" = enum{"Check Calibration", "Load Calibration", "New Calibration"}
diagram:
  Is Equal(x="Check Calibration", y=$"Operatin Control") -> w1
  Select(s=w1, t="Check Graphs", f="Load Calibration") -> w2
  Is Equal(x="Load Calibration", y=$"Operatin Control") -> w3
  Logical Or(w1, w3) -> w4
  Select(s=$"Stand Alone?", t="Detect Instruments", f="Initialize Instruments") -> w5
  Select(s=w4, t=w2, f=w5) -> w6
  $"Desired State" <- w6
