vi "MSpot Step Calculator.gvi"   [LabVIEW NXG 5.0.0]
inputs:
  "MSpot Spectrum Calibration Parameters In": "MSpot Spectrum Calibration Parameters.gtype" = {"Min Position (mm)"=0, "Max Position (mm)"=10, "Position step size (mm)"=0.1, "Manual Spectra?"=FALSE, "Flame Integration Time (us)"=1000, "Flame Scans to Average"=1}
outputs:
  "Manual Spectra?": bool
  "Number of steps": i32
types:
  "MSpot Spectrum Calibration Parameters.gtype" = cluster{"Min Position (mm)": f64, "Max Position (mm)": f64, "Position step size (mm)": f64, "Manual Spectra?": bool, "Flame Integration Time (us)": f64, "Flame Scans to Average": u32}
diagram:
  Property Node(instance in=$"MSpot Spectrum Calibration Parameters In") -> ("Min Position (mm)"=w1, "Max Position (mm)"=w2, "Position step size (mm)"=w3, "Manual Spectra?"=w4)
  # This SubVI Calculates the number of steps necessary for the calibration.
  # It also coerces the number of steps to a maximum of 500 to prevent infinite looping
  Subtract(x=w2, y=w1) -> w5
  Divide(x=w5, y=w3) -> w6
  Increment(x=w6) -> w7
  # w8: Number of Steps
  To Signed 32 Bit Integer(number=w7) -> w8
  In Range And Coerce[IncludeHighLimit=True](lower limit=0, upper limit=500, x=w8) -> (coerced(x)=w9)
  $"Number of steps" <- w9
  $"Manual Spectra?" <- w4
