vi "MSpot parameter Extractor.gvi"   [LabVIEW NXG 5.0.0]
inputs:
  "Current Step": i32
  "MSpot Spectrum Calibration Parameters In": "MSpot Spectrum Calibration Parameters.gtype" = {"Min Position (mm)"=0, "Max Position (mm)"=10, "Position step size (mm)"=0.1, "Manual Spectra?"=FALSE, "Flame Integration Time (us)"=1000, "Flame Scans to Average"=1}
  "Error In": error
  "Rainbow Sweep Type": "Rainbow Sweep Types.gtype" = "Red Sweep Closing"
outputs:
  "Flame Integration Time": i32
  "Flame Scans to Average": i32
  "Motor Position to move to (mm)": f64
  "Error Out": error
types:
  "MSpot Spectrum Calibration Parameters.gtype" = cluster{"Min Position (mm)": f64, "Max Position (mm)": f64, "Position step size (mm)": f64, "Manual Spectra?": bool, "Flame Integration Time (us)": f64, "Flame Scans to Average": u32}
  "Rainbow Sweep Types.gtype" = enum{"Red Sweep Closing", "Red Sweep Opening", "Blue Sweep Closing", "Blue Sweep Opening"}
diagram:
  # This SubVI Extracts the parameters for the MSpot Spectrum Calibration measurement
  # and outputs them as they are needed.
  case ($"Error In") {
    frame Error, Default {
      w1 = default
      w2 = default
      w3 = default
      w4 = $"Error In"
    }
    frame No Error {
      Property Node(instance in=$"MSpot Spectrum Calibration Parameters In") -> ("Position step size (mm)"=w5, "Max Position (mm)"=w6, "Min Position (mm)"=w7, "Flame Scans to Average"=w8, "Flame Integration Time (us)"=w9)
      To Signed 32 Bit Integer(number=w8) -> w10
      In Range And Coerce[IncludeHighLimit=True](lower limit=1, upper limit=10000, x=w10) -> (coerced(x)=w3)
      To Signed 32 Bit Integer(number=w9) -> w11
      In Range And Coerce[IncludeHighLimit=True](lower limit=1000, upper limit=1000000000, x=w11) -> (coerced(x)=w1)
      To Double Precision Float(number=$"Current Step") -> w12
      case ($"Rainbow Sweep Type") {
        frame "Red Sweep Opening" {
          Multiply(w5, w12) -> w13
          Add(w7, w13) -> w2
        }
        frame "Red Sweep Closing", Default {
          Multiply(w5, w12) -> w14
          Subtract(x=w6, y=w14) -> w2
        }
        frame "Blue Sweep Opening" {
          Multiply(w5, w12) -> w15
          Add(w7, w15) -> w2
        }
        frame "Blue Sweep Closing" {
          Multiply(w5, w12) -> w16
          Subtract(x=w6, y=w16) -> w2
        }
      }
      w4 = $"Error In"
    }
  }
  $"Error Out" <- w4
  $"Flame Scans to Average" <- w3
  $"Flame Integration Time" <- w1
  $"Motor Position to move to (mm)" <- w2
