vi "MSpot Mask Calibration Subroutine.gvi"   [LabVIEW NXG 5.0.0]
inputs:
  "Error In": error
  "Instrument Control Mega Cluster In": "Instrument Control Mega Cluster.gtype"
outputs:
  "Error Out": error
panel controls:
  "MSpot Mask Calibration Parameters": "MSpot Mask Calibration Parameters.gtype" = {"Flame Integration Time (us)"=1000, "Flame Scans to Average "=3, "Number of Calibration Slits"=40}
  "Current Slit Number Selector": f64 = 1
  "MSpot Mask Data": "MSpot Mask Data.gtype"
  "Accquire": bool
  "Stop App": bool
  "Mask calibretion setup": i32
panel indicators:
  "Graph": cluster{"Wavelength": f64[], "Counts": f64[]}[]
types:
  "MSpot Mask Calibration Parameters.gtype" = cluster{"Flame Integration Time (us)": f64, "Flame Scans to Average ": f64, "Number of Calibration Slits": f64}
  "Instrument Coms Info.gtype" = cluster{"Arduino Coms Info": "Arduino Detection cluster control.gtype", "Photodetector Names": string[], "Keythley Address": "VISA Instr", "Photodetector Detected?": bool, "Thorlabs Motors Detected?": bool, "Keithley Detected?": bool, "Thorlabs Motors Serial Number": "Thorlabs Motors Serial Number In.gtype", "Photodetector IVI session": "Ivi IviDefault", "Flame ID": string, "Flame Detected?": bool, "Flame Wrapper ID": u64}
  "Debugging Cluster.gtype" = cluster{"Debugging mode?": bool, "Initialize App": bool, "Insturment Debugging": "Insturment Debugging Cluster.gtype"}
  "Instrument Control Mega Cluster.gtype" = cluster{"Instruments Coms Info": "Instrument Coms Info.gtype", "Debugging Cluster": "Debugging Cluster.gtype"}
  "MSpot Mask Data.gtype" = cluster{"MSpot Spectrum": cluster{"Wavelenghts": f64[], "Counts": f64[]}, "Slit Number": f64}
uses:
  NI::G Core::File IO (General)::Check if File or Folder Exists.gvi
  NI::G Core::File IO (General)::Create Directory Recursive.gvi
  Rainbow Measurement Setup::Side Functions::Instrument Control::Flame Spectrometer::Flame Initialize.gvi
  Rainbow Measurement Setup::Main Functions::One Time Calibrations::MSpot Spectrum::Mask calibration::MSpot Mask Calibration flame instructions.gvi
  Rainbow Measurement Setup::Side Functions::Instrument Control::Flame Spectrometer::Flame Set Scans to Average.gvi
  Rainbow Measurement Setup::Side Functions::Instrument Control::Flame Spectrometer::Flame Set Integration Time.gvi
  Rainbow Measurement Setup::Side Functions::Instrument Control::Flame Spectrometer::Flame Get Spectra.gvi
  Rainbow Measurement Setup::Side Functions::Sample Naming::txt Extension adder.gvi
  Rainbow Measurement Setup::Side Functions::Path Manipulation::Path Already Exists prompt.gvi
  Rainbow Measurement Setup::Side Functions::Path Manipulation::Header info merger.gvi
  Rainbow Measurement Setup::Side Functions::Path Manipulation::Rename Window.gvi
  Rainbow Measurement Setup::Side Functions::Instrument Control::Flame Spectrometer::Flame Close.gvi
diagram:
  case ($"Error In") {
    frame Error, Default {
      w1 = $"Error In"
    }
    frame No Error {
      s1 = $"Error In"  # shift register
      s2 = "Finestra Nova"  # shift register
      s3 = uninitialised  # shift register
      s4 = $"Instrument Control Mega Cluster In"  # shift register
      s5 = $"MSpot Mask Data"  # shift register
      s6 = uninitialised  # shift register
      while {
        case (s2) {
          frame "Finestra Nova", Default {
            Property Node(instance in=reference to unnamed native front panel, error in=s1) -> ("Window"=w9, error out=w10)
            Open Window(reference in=w9, error in=w10) -> (error out=w2)
            w3 = s3
            w4 = "Inicializar Flame"
            w5 = s4
            w6 = s5
            w7 = s6
            w8 = default
          }
          frame "Agafar Parametres" {
            Get Component Directory() -> (Path=w11)
            Strip Path(path=w11) -> (stripped path=w12)
            Build Path(base path=w12, name or relative path="Extra installers\\Calibration_Files\\Mask_Calibration") -> (appended path=w13)
            call "Check if File or Folder Exists.gvi"(file or folder=w13, error in=s1) -> (file or folder exists?=w14, error out=w15)
            Is Empty String Or Path(string/path=w13) -> w16
            Logical Or(w16, not w14) -> w17
            case (w17) {
              frame False {
                w7 = w13
                w2 = w15
              }
              frame True {
                call "Create Directory Recursive.gvi"(folder=w13, error in=w15) -> (error out=w2)
                w7 = w13
              }
            }
            Select(s=$"Stop App", t="Tancar El Flame", f="Pweview") -> w4
            w3 = $"MSpot Mask Calibration Parameters"
            w5 = s4
            w6 = s5
            w8 = default
          }
          frame "Inicializar Flame" {
            call "Flame Initialize.gvi"(Instrument Control Mega Cluster In=s4, Error In=s1) -> (Instrument Control Mega Cluster Out=w5, Error Out=w2)
            w3 = s3
            w4 = "Agafar Parametres"
            w6 = s5
            w7 = s6
            w8 = default
          }
          frame "Pweview" {
            call "MSpot Mask Calibration flame instructions.gvi"(Error In=s1, MSpot Mask Calibration Parameters=s3) -> (Error Out=w18, Number of Calibration Slits=w19, Flame Integration Time (us)=w20, Flame Scans to Average=w21)
            Property Node(instance in=reference to "Current Slit Number Selector", "Maximum"=w19, error in=w18) -> (error out=w22)
            call "Flame Set Scans to Average.gvi"(Instrument Control Mega Cluster In=s4, Scans to Average=w21, Error In=w22) -> (Instrument Control Mega Cluster Out=w23, Error Out=w24)
            call "Flame Set Integration Time.gvi"(Instrument Control Mega Cluster In=w23, Integration Time=w20, Error In=w24) -> (Instrument Control Mega Cluster Out=w25, Error Out=w26)
            call "Flame Get Spectra.gvi"(Instrument Control Mega Cluster In=w25, Error In=w26) -> (Instrument Control Mega Cluster Out=w5, Beam Spectrum=w27, Error Out=w2)
            Build Array(w27) -> w28
            $Graph <- w28
            Select(s=$Accquire, t="Mesurar", f="Agafar Parametres") -> w4
            w3 = s3
            w6 = s5
            w7 = s6
            w8 = default
          }
          frame "Mesurar" {
            call "MSpot Mask Calibration flame instructions.gvi"(Error In=s1, MSpot Mask Calibration Parameters=s3) -> (Error Out=w29, Number of Calibration Slits=w30, Flame Integration Time (us)=w31, Flame Scans to Average=w32)
            In Range And Coerce(lower limit=0, upper limit=w30, x=$"Current Slit Number Selector") -> (coerced(x)=w33)
            call "Flame Set Scans to Average.gvi"(Instrument Control Mega Cluster In=s4, Scans to Average=w32, Error In=w29) -> (Instrument Control Mega Cluster Out=w34, Error Out=w35)
            call "Flame Set Integration Time.gvi"(Instrument Control Mega Cluster In=w34, Integration Time=w31, Error In=w35) -> (Instrument Control Mega Cluster Out=w36, Error Out=w37)
            call "Flame Get Spectra.gvi"(Instrument Control Mega Cluster In=w36, Error In=w37) -> (Instrument Control Mega Cluster Out=w5, Beam Spectrum=w38, Error Out=w2)
            Property Node(instance in=s5, "MSpot Spectrum"=w38, "Slit Number"=w33) -> (instance out=w6)
            Build Array(w38) -> w39
            $Graph <- w39
            w3 = s3
            w4 = "Peguntar"
            w7 = s6
            w8 = default
          }
          frame "Peguntar" {
            w40 = "The spectra measure of the current slit has been taken! Do you want to save it?"
            Two Button Dialog(F button name ("Cancel")="No. Please, let me change the parameters.", T button name ("OK")="Yes, please.", message=w40) -> (T Button?=w41)
            Select(s=w41, t="Emmagatzemar", f="Pweview") -> w4
            w2 = s1
            w3 = s3
            w5 = s4
            w6 = s5
            w7 = s6
            w8 = default
          }
          frame "Emmagatzemar" {
            Property Node(instance in=s5) -> ("MSpot Spectrum:Wavelenghts"=w42, "MSpot Spectrum:Counts"=w43, "Slit Number"=w44)
            Build Array(w42, w43) -> w45
            Transpose 2D Array(2D array=w45) -> (transposed array=w46)
            Format Into String(formatString="%d", initString="Slit_number_", errIn=s1, w44) -> (outString=w47, errOut=w48)
            call "txt Extension adder.gvi"(Name without .txt=w47, Error In=w48) -> (Name with .txt=w49, Error Out=w50)
            Build Path(base path=s6, name or relative path=w49) -> (appended path=w51)
            Property Node(instance in=s3) -> ("Number of Calibration Slits"=w52)
            Concatenate Strings(w47, "_of_a_total_of_") -> w53
            Format Into String(formatString="%d", initString=w53, errIn=w50, w52) -> (outString=w54, errOut=w55)
            call "Path Already Exists prompt.gvi"(Path to Check=w51, Error In=w55) -> (Existing File Instruction out=w56, Error Out=w57)
            Build Array(["Dividing Wavelength (nm)", "Counts (n)"], w54) -> w58
            case (w56) {
              frame "Replace" {
                Open Or Create Or Replace File(error in=w57, file path (use dialog)=w51, operation (0:open)="replace or create") -> (error out=w59, refnum out=w60)
                Array To Spreadsheet String(array=w46, format string="%g") -> (spreadsheet string=w61)
                call "Header info merger.gvi"(Column info array=w58, Spreadsheet String=w61, Error In=w59) -> (Spreadsheet String With Header=w62, Error Out=w63)
                Write To Text File(error in=w63, file (use dialog)=w60, text=w62) -> (error out=w64, refnum out=w65)
                Close File(error in=w64, refnum=w65) -> (error out=w2)
              }
              frame "Rename", Default {
                Strip Path(path=w51) -> (name=w66, stripped path=w67)
                call "Rename Window.gvi"(Original Filename=w66, Error In=w57) -> (Output=w68, Error Out=w69)
                Build Path(base path=w67, name or relative path=w68) -> (appended path=w70)
                Open Or Create Or Replace File(error in=w69, file path (use dialog)=w70, operation (0:open)="replace or create") -> (error out=w71, refnum out=w72)
                Array To Spreadsheet String(array=w46, format string="%g") -> (spreadsheet string=w73)
                call "Header info merger.gvi"(Column info array=w58, Spreadsheet String=w73, Error In=w71) -> (Spreadsheet String With Header=w74, Error Out=w75)
                Write To Text File(error in=w75, file (use dialog)=w72, text=w74) -> (error out=w76, refnum out=w77)
                Close File(error in=w76, refnum=w77) -> (error out=w2)
              }
              frame "Do not save" {
                w2 = w57
              }
            }
            w3 = s3
            w4 = "Avisar Seguent Slit"
            w5 = s4
            w6 = s5
            w7 = s6
            w8 = default
          }
          frame "Avisar Seguent Slit" {
            w78 = "Measure saved! Now put the next slide and press the OK button."
            One Button Dialog(button name ("OK")="OK. Go to the next slit :)", message=w78) -> (true=w79)
            case (TRUE) {
              frame False, Default {
                w4 = "Pweview"
              }
              frame True {
                w4 = "Pweview"
              }
            }
            Increment(x=$"Current Slit Number Selector") -> w80
            Property Node(instance in=reference to "Current Slit Number Selector", "Value"=w80, error in=s1) -> (error out=w2)
            w3 = s3
            w5 = s4
            w6 = s5
            w7 = s6
            w8 = default
          }
          frame "Tancar El Flame" {
            call "Flame Close.gvi"(Instrument Control Mega Cluster In=s4, Error In=s1) -> (Instrument Control Mega Cluster Out=w5, Error Out=w2)
            w3 = s3
            w4 = "Finalitzar"
            w6 = s5
            w7 = s6
            w8 = default
          }
          frame "Finalitzar" {
            Property Node(instance in=reference to unnamed native front panel) -> ("Window"=w81)
            Close Window(reference in=w81, error in=s1) -> (error out=w2)
            w3 = s3
            w4 = "Finestra Nova"
            w5 = s4
            w6 = s5
            w7 = s6
            w8 = TRUE
          }
        }
        next s1 = w2
        next s2 = w4
        next s3 = w3
        next s4 = w5
        next s5 = w6
        next s6 = w7
        stop if w8
      }
      w1 = s1
    }
  }
  $"Error Out" <- w1
