vi "MSpot Mask Calibration flame instructions.gvi"   [LabVIEW NXG 5.0.0]
inputs:
  "Error In": error
  "MSpot Mask Calibration Parameters": "MSpot Mask Calibration Parameters.gtype" = {"Flame Integration Time (us)"=1000, "Flame Scans to Average "=3, "Number of Calibration Slits"=40}
outputs:
  "Error Out": error
  "Number of Calibration Slits": f64
  "Flame Integration Time (us)": f64
  "Flame Scans to Average": f64
types:
  "MSpot Mask Calibration Parameters.gtype" = cluster{"Flame Integration Time (us)": f64, "Flame Scans to Average ": f64, "Number of Calibration Slits": f64}
diagram:
  # This sub VI is completely useless right now. It just takes the MSpot Mask Calibration parameters and checks that the values are in a concrete range
  case ($"Error In") {
    frame Error, Default {
      w1 = $"Error In"
      w2 = default
      w3 = default
      w4 = default
    }
    frame No Error {
      Property Node(instance in=$"MSpot Mask Calibration Parameters") -> ("Flame Integration Time (us)"=w5, "Flame Scans to Average "=w6, "Number of Calibration Slits"=w7)
      In Range And Coerce(lower limit=1000, upper limit=1000000, x=w5) -> (coerced(x)=w2)
      In Range And Coerce(lower limit=1, upper limit=100, x=w6) -> (coerced(x)=w3)
      In Range And Coerce(lower limit=1, upper limit=1000, x=w7) -> (coerced(x)=w4)
      w1 = $"Error In"
    }
  }
  $"Error Out" <- w1
  $"Flame Integration Time (us)" <- w2
  $"Flame Scans to Average" <- w3
  $"Number of Calibration Slits" <- w4
