vi "Mask Calibration Subroutine Debug Check.gvi"   [LabVIEW NXG 5.0.0]
inputs:
  "Error In": error
  "Instrument Control Mega Cluster In": "Instrument Control Mega Cluster.gtype"
outputs:
  "Error Out": error
types:
  "Instrument Coms Info.gtype" = cluster{"Arduino Coms Info": "Arduino Detection cluster control.gtype", "Photodetector Names": string[], "Keythley Address": "VISA Instr", "Photodetector Detected?": bool, "Thorlabs Motors Detected?": bool, "Keithley Detected?": bool, "Thorlabs Motors Serial Number": "Thorlabs Motors Serial Number In.gtype", "Photodetector IVI session": "Ivi IviDefault", "Flame ID": string, "Flame Detected?": bool, "Flame Wrapper ID": u64}
  "Debugging Cluster.gtype" = cluster{"Debugging mode?": bool, "Initialize App": bool, "Insturment Debugging": "Insturment Debugging Cluster.gtype"}
  "Instrument Control Mega Cluster.gtype" = cluster{"Instruments Coms Info": "Instrument Coms Info.gtype", "Debugging Cluster": "Debugging Cluster.gtype"}
uses:
  Rainbow Measurement Setup::Main Functions::One Time Calibrations::MSpot Spectrum::Mask calibration::MSpot Mask Calibration Subroutine.gvi
diagram:
  case ($"Error In") {
    frame Error, Default {
      w1 = $"Error In"
    }
    frame No Error {
      Property Node(instance in=$"Instrument Control Mega Cluster In") -> ("Debugging Cluster:Debugging mode?"=w2, "Debugging Cluster:Insturment Debugging:Flame Spectr"=w3, instance out=w4)
      Logical And[output inverted](w2, not w3) -> w5
      case (w5) {
        frame False, Default {
          w1 = $"Error In"
        }
        frame True {
          call "MSpot Mask Calibration Subroutine.gvi"(Instrument Control Mega Cluster In=w4, Error In=$"Error In") -> (Error Out=w1)
        }
      }
    }
  }
  $"Error Out" <- w1
