vi "Mspot Abort Handler.gvi"   [LabVIEW NXG 5.0.0]
inputs:
  "Local Abort Out": bool
  "Previous State": "MSpot Spectrum Calibration State Machine Instructions.gtype" = "Detect Instruments"
outputs:
  "Resulting State": "MSpot Spectrum Calibration State Machine Instructions.gtype"
types:
  "MSpot Spectrum Calibration State Machine Instructions.gtype" = enum{"Start App", "Detect Instruments", "Initialize Instruments", "Rainbow Sweep", "Close Coms", "Load Calibration", "Check Graphs", "Save Graphs", "Save Dividing Wavelength", "Stop App"}
diagram:
  Is Not Equal(x=$"Previous State", y="Stop App") -> w1
  Logical And($"Local Abort Out", w1) -> w2
  Select(s=w2, t="Close Coms", f=$"Previous State") -> w3
  $"Resulting State" <- w3
