vi "Random Data Generator.gvi"   [LabVIEW NXG 5.0.0]
outputs:
  "Beam Spectrum": cluster{"Wavelength": f64[], "Counts": f64[]}
uses:
  NI::G Core::Numeric::Random Number (Range) DBL.gvi
diagram:
  # This subVI generates a random set of data for testing the Measuring Spot functionality
  for (N = 20) {
    call "Random Number (Range) DBL.gvi"(upper bound=800, lower bound=300) -> (number=w3)
    Round To Nearest(number=w3) -> w4
    call "Random Number (Range) DBL.gvi"(upper bound=100, lower bound=0) -> (number=w5)
    Round To Nearest(number=w5) -> w6
    append w4 to w1
    append w6 to w2
  }
  Sort 1D Array(array=w1) -> (sorted array=w7)
  w8 = cluster{"Wavelength": f64[], "Counts": f64[]} {all zero or empty}
  Property Node(instance in=w8, "Wavelength"=w7, "Counts"=w2) -> (instance out=w9)
  $"Beam Spectrum" <- w9
