vi "Photodetector Drift Measurement.gvi"   [LabVIEW NXG 5.0.0]
inputs:
  "Error In": error
outputs:
  "Error Out": error
  "Graph": cluster{"Element 1": f64, "Element 2": f64}[]
panel controls:
  "Reset measurement": bool
  "Parameter to measure": enum{"Photocurrent", "Power"} = "Photocurrent"
  "Stop App": bool
  "Data Array": f64[][]
  "MSpot Spectrum Calibration Parameters In": "MSpot Spectrum Calibration Parameters.gtype" = {"Min Position (mm)"=0, "Max Position (mm)"=10, "Position step size (mm)"=0.1, "Manual Spectra?"=FALSE, "Flame Integration Time (us)"=1000, "Flame Scans to Average"=1}
  "Motor Index": i32
  "Simulation?": bool
  "Rainbow Sweep Type": "Rainbow Sweep Types.gtype" = "Red Sweep Closing"
  "Kronos to wait": f64
  "Stop Measurement": bool
  "Folder Save Data": path
panel indicators:
  "Power Value": f64  # This parameter returns the last measured temperature value in °C.
  "Active": bool
  "Current": f64
  "Elapsed Time": f64
  "Stopped?": bool
  "Wait for save?": bool
  "Current Motor Serial nº": string
  "Homed?": bool
  "Estimated time (Kr)": f64
  "Current Position (mm)": f64
  "Elapsed Kronos": f64
  "Finished?": bool
types:
  "MSpot Spectrum Calibration Parameters.gtype" = cluster{"Min Position (mm)": f64, "Max Position (mm)": f64, "Position step size (mm)": f64, "Manual Spectra?": bool, "Flame Integration Time (us)": f64, "Flame Scans to Average": u32}
  "Rainbow Sweep Types.gtype" = enum{"Red Sweep Closing", "Red Sweep Opening", "Blue Sweep Closing", "Blue Sweep Opening"}
uses:
  NXG_KCube_DC_Servo_Control::Examples::Scan Available Devices.gvi
  NXG_KCube_DC_Servo_Control::Utilities::Initialize Motor.gvi
  NXG_KCube_DC_Servo_Control::Utilities::Home Subroutine.gvi
  LabView_NXG_Thorlabs_PM100::Miscelanous::TLPM Find Resources.gvi
  LabView_NXG_Thorlabs_PM100::Get Parameters::TLPM Get Resource Name.gvi
  LabView_NXG_Thorlabs_PM100::Miscelanous::TLPM Initialize.gvi
  LabView_NXG_Thorlabs_PM100::Miscelanous::TLPM Timer.gvi
  LabView_NXG_Thorlabs_PM100::Measure::TLPM Measure Power.gvi
  LabView_NXG_Thorlabs_PM100::Measure::TLPM Measure Current.gvi
  Rainbow Measurement Setup::Side Functions::Utilities::Time Related Operations::Seconds Kronos Calculator.gvi
  LabView_NXG_Thorlabs_PM100::Miscelanous::TLPM Close.gvi
  NI::G Core::File IO (General)::Create File with Incrementing Suffix.gvi
  Rainbow Measurement Setup::Main Functions::One Time Calibrations::MSpot Spectrum::MSpot Step Calculator.gvi
  Rainbow Measurement Setup::Main Functions::One Time Calibrations::MSpot Spectrum::MSpot parameter Extractor.gvi
  NXG_KCube_DC_Servo_Control::Utilities::Move To Position.gvi
  NXG_KCube_DC_Servo_Control::Utilities::Disconnect Motor.gvi
  NI::G Core::Error::Multiplex Errors.gvi
diagram:
  case (TRUE) {
    frame False, Default {
      w1 = $"Error In"
    }
    frame True {
      $"Stopped?" <- FALSE
      $"Wait for save?" <- FALSE
      $"Finished?" <- FALSE
      w1 = $"Error In"
    }
  }
  call "Scan Available Devices.gvi"(Error In=w1) -> (Device ID array=w2, Error Out=w3)
  Array Index(array=w2) -> (out0[$"Motor Index"]=w4)
  Is Empty String Or Path(string/path=w4) -> w5
  w6 = $"MSpot Spectrum Calibration Parameters In"
  case (w5) {
    frame True {
      w7 = w3
    }
    frame False {
      call "Initialize Motor.gvi"(Current Motor Serial nº In=w4, Error In=w3, Simulation?=$"Simulation?") -> (Current Motor Serial nº Out=w8, Error Out=w9)
      call "Home Subroutine.gvi"(Motor Serial Number In=w8, Error In=w9) -> (Current Motor Serial nº=w10, Homed?=w11, Error Out=w12)
      # TLPM LabVIEW Example
      $"Homed?" <- w11
      while {
        # Check for TLPM Devices
        # Returns Number of
        # found Devices
        Wait Until Next Multiple(multiple to wait=50)
        $Active <- FALSE
        call "TLPM Find Resources.gvi"(IVI session in="", error in (no error)=w12) -> (Resource Count=w13, error out=w14)
        Is Greater Or Equal(x=w13, y=1) -> w15
        case (w15) {
          frame False, Default {
            w16 = TRUE
            w17 = w14
          }
          frame True {
            # Initialize
            call "TLPM Get Resource Name.gvi"(Index (0)=0, error in (no error)=w14) -> (error out=w18, Resource Name=w19)
            # Select first Device
            # (Device Index 0)
            call "TLPM Initialize.gvi"(resource name=w19, ID Query (Do Query)=FALSE, Reset Device (Reset Device)=FALSE, error in (no error)=w18) -> (IVI session out=w20, error out=w21)
            w22 = $"Parameter to measure"
            s1 = w21  # shift register
            s2 = w20  # shift register
            s3 = cluster{"Element 1": f64, "Element 2": f64}[] []  # shift register
            s4 = uninitialised  # shift register
            s5 = f64[][] []  # shift register
            s6 = "Reset Timer"  # shift register
            s7 = 0  # shift register
            while {
              call "TLPM Timer.gvi"(Timer Commands=s6, Error In=s1) -> (Elapsed Time (Seconds)=w23, Paused?=w24, Error Out=w25)
              case (w22) {
                frame "Power", Default {
                  $Active <- TRUE
                  # Get Power
                  Wait(time to wait=10)
                  call "TLPM Measure Power.gvi"(IVI session in=s2, error in (no error)=w25) -> (IVI session out=w26, Power=w29, error out=w27)
                  $"Power Value" <- w29
                  w28 = FALSE
                }
                frame "Photocurrent" {
                  Wait Until Next Multiple(multiple to wait=10)
                  $Active <- TRUE
                  call "TLPM Measure Current.gvi"(IVI session in=s2, error in (no error)=w25) -> (IVI session out=w26, Current=w29, error out=w27)
                  # Get Current
                  $Current <- w29
                  w28 = FALSE
                }
              }
              call "Seconds Kronos Calculator.gvi"(Seconds In=w23) -> (Kronos Out=w30)
              Build Cluster(w30, w29) -> w31
              Build Array(w30, w29, $"Current Position (mm)") -> w32
              case (w24) {
                frame True {
                  w33 = s3
                  w34 = s5
                  w35 = s7
                }
                frame False {
                  Insert Into Array(inArray=s3, index0=s7, new=w31) -> w33
                  Increment(x=s7) -> w35
                  Insert Into Array(inArray=s5, index0=s7, new=w32) -> w34
                }
              }
              $Graph <- w33
              $"Data Array" <- w34
              $"Elapsed Time" <- w23
              Property Node(instance in=reference to "Parameter to measure") -> ("Value"=w36)
              Is Not Equal(x=w36, y=s4) -> w37
              w38 = $"Stop App"
              Logical Or($"Reset measurement", w38, w37, $"Finished?") -> w39
              next s1 = w27
              next s2 = w26
              next s3 = w33
              next s4 = w36
              next s5 = w34
              next s6 = "Check Timer"
              next s7 = w35
              stop if w39
            }
            # Close
            $Active <- w28
            call "TLPM Close.gvi"(IVI session in=s2, error in (no error)=s1) -> (error out=w17)
            w16 = w38
          }
        }
        $"Stopped?" <- w16
        Logical Or(w16, $"Finished?") -> w40
        stop if w40
      }
      s8 = w12  # shift register
      while {
        case ($"Finished?") {
          frame False, Default {
            w41 = s8
            w42 = FALSE
          }
          frame True {
            Array To Spreadsheet String(array=$"Data Array", format string="%g") -> (spreadsheet string=w43)
            Concatenate Strings("Elapsed Time (Kr)    Power (W)    Motor Position (mm)", "\r\n", w43) -> w44
            call "TLPM Timer.gvi"(Timer Commands="Pause Timer", Error In=s8) -> (Error Out=w45)
            Property Node(instance in=$"MSpot Spectrum Calibration Parameters In") -> ("Position step size (mm)"=w46)
            Number To Decimal String(number=w46) -> (decimal integer string=w47)
            Concatenate Strings("Photodetector Drift Calibration Step ", w47, " mm.txt") -> w48
            Build Path(base path=$"Folder Save Data", name or relative path=w48) -> (appended path=w49)
            call "Create File with Incrementing Suffix.gvi"(file=w49, error in=w45) -> (reference=w50, error out=w51)
            Write To Text File(error in=w51, file (use dialog)=w50, text=w44) -> (error out=w52, refnum out=w53)
            Close File(error in=w52, refnum=w53) -> (error out=w54)
            call "TLPM Timer.gvi"(Timer Commands="Resume Timer", Error In=w54) -> (Error Out=w41)
            w42 = TRUE
          }
        }
        Logical Or(w41, $"Stopped?", w42) -> w55
        Wait Until Next Multiple(multiple to wait=50)
        next s8 = w41
        stop if w55
      }
      call "MSpot Step Calculator.gvi"(MSpot Spectrum Calibration Parameters In=w6) -> (Number of steps=w56)
      s9 = w12  # shift register
      s10 = w10  # shift register
      for (N = w56) (iteration -> i1) {
        Divide(x=i1, y=w56) -> w57
        call "TLPM Timer.gvi"(Timer Commands="Check Timer", Error In=s9) -> (Elapsed Time (Seconds)=w58, Error Out=w59)
        call "Seconds Kronos Calculator.gvi"(Seconds In=w58) -> (Kronos Out=w60)
        Multiply(w57, w60) -> w61
        Multiply($"Kronos to wait", w56) -> w62
        Add(w61, w62) -> w63
        Divide(x=w63, y=2) -> w64
        $"Estimated time (Kr)" <- w64
        $"Elapsed Kronos" <- w60
        call "MSpot parameter Extractor.gvi"(Current Step=i1, MSpot Spectrum Calibration Parameters In=w6, Rainbow Sweep Type=$"Rainbow Sweep Type", Error In=w59) -> (Motor Position to move to (mm)=w65, Error Out=w66)
        $"Current Position (mm)" <- w65
        call "TLPM Timer.gvi"(Timer Commands="Pause Timer", Error In=w66) -> (Error Out=w67)
        call "Move To Position.gvi"(Motor Serial Number In=s10, Position to move in mm=w65, Error In=w67) -> (Current Motor Serial nº=w68, Error Out=w69)
        call "TLPM Timer.gvi"(Timer Commands="Resume Timer", Error In=w69) -> (Error Out=w70)
        case (FALSE) {
          frame True {
            One Button Dialog(button name ("OK")="next", message="Next?") -> (true=w72)
            w71 = w70
            w73 = FALSE
          }
          frame False {
            call "Seconds Kronos Calculator.gvi"(Kronos In=$"Kronos to wait", Error In=w70) -> (Seconds Out=w74, Error Out=w71)
            while (iteration -> i2) {
              Logical Or($"Stop Measurement", $"Stopped?") -> w73
              Wait Until Next Multiple(multiple to wait=w74)
              Is Greater(x=i2, y=1000) -> w75
              Logical Or($"Stop Measurement", w75, $"Stopped?") -> w76
              stop if w76
            }
            w72 = default
          }
        }
        next s9 = w71
        next s10 = w68
        stop if w73
      }
      call "Disconnect Motor.gvi"(Simulation?=$"Simulation?", Motor Serial nº=s10, Error In=s9) -> (Error Out=w77)
      call "Multiplex Errors.gvi"(error in 1=w17, error in 2=s8, error in 3=w77) -> (error out=w7)
      $"Finished?" <- TRUE
    }
  }
  $"Error Out" <- w7
  $"Current Motor Serial nº" <- w4
