vi "Photodetector drift measurement2.gvi"   [LabVIEW NXG 5.0.0]
panel controls:
  "Current Motor Serial nº In": string = "27005043"
  "Simulation?": bool
  "MSpot Spectrum Calibration Parameters In": "MSpot Spectrum Calibration Parameters.gtype" = {"Min Position (mm)"=0, "Max Position (mm)"=10, "Position step size (mm)"=0.1, "Manual Spectra?"=FALSE, "Flame Integration Time (us)"=1000, "Flame Scans to Average"=1}
  "Rainbow Sweep Type": "Rainbow Sweep Types.gtype" = "Red Sweep Closing"
  "Stop Measurement": bool
  "Kronos to wait": f64
panel indicators:
  "Estimated time (Kr)": f64
  "Current Position (mm)": f64
types:
  "MSpot Spectrum Calibration Parameters.gtype" = cluster{"Min Position (mm)": f64, "Max Position (mm)": f64, "Position step size (mm)": f64, "Manual Spectra?": bool, "Flame Integration Time (us)": f64, "Flame Scans to Average": u32}
  "Rainbow Sweep Types.gtype" = enum{"Red Sweep Closing", "Red Sweep Opening", "Blue Sweep Closing", "Blue Sweep Opening"}
uses:
  Rainbow Measurement Setup::Side Functions::Utilities::Time Related Operations::Timer.gvi
  NXG_KCube_DC_Servo_Control::Utilities::Initialize Motor.gvi
  NXG_KCube_DC_Servo_Control::Utilities::Home Subroutine.gvi
  Rainbow Measurement Setup::Main Functions::One Time Calibrations::MSpot Spectrum::MSpot Step Calculator.gvi
  Rainbow Measurement Setup::Main Functions::One Time Calibrations::MSpot Spectrum::MSpot parameter Extractor.gvi
  NXG_KCube_DC_Servo_Control::Utilities::Move To Position.gvi
  Rainbow Measurement Setup::Side Functions::Utilities::Time Related Operations::Seconds Kronos Calculator.gvi
  NXG_KCube_DC_Servo_Control::Utilities::Disconnect Motor.gvi
diagram:
  w1 = $"MSpot Spectrum Calibration Parameters In"
  call "Timer.gvi"(Timer Commands="Reset Timer") -> (Error Out=w2)
  call "Initialize Motor.gvi"(Current Motor Serial nº In=$"Current Motor Serial nº In", Error In=w2, Simulation?=$"Simulation?") -> (Current Motor Serial nº Out=w3, Error Out=w4)
  call "Home Subroutine.gvi"(Motor Serial Number In=w3, Error In=w4) -> (Current Motor Serial nº=w5, Error Out=w6)
  call "MSpot Step Calculator.gvi"(MSpot Spectrum Calibration Parameters In=w1) -> (Number of steps=w7)
  s1 = w6  # shift register
  s2 = w5  # shift register
  for (N = w7) (iteration -> i1) {
    call "Timer.gvi"(Timer Commands="Check Timer", Error In=s1) -> (Elapsed Time (Seconds)=w8, Error Out=w9)
    call "MSpot parameter Extractor.gvi"(Current Step=i1, MSpot Spectrum Calibration Parameters In=w1, Rainbow Sweep Type=$"Rainbow Sweep Type", Error In=w9) -> (Motor Position to move to (mm)=w10, Error Out=w11)
    $"Current Position (mm)" <- w10
    Divide(x=i1, y=w7) -> w12
    Multiply(w12, w8) -> w13
    $"Estimated time (Kr)" <- w13
    call "Move To Position.gvi"(Motor Serial Number In=s2, Position to move in mm=w10, Error In=w11) -> (Current Motor Serial nº=w14, Error Out=w15)
    case (FALSE) {
      frame True {
        One Button Dialog(button name ("OK")="next", message="Next?") -> (true=w17)
        w16 = w15
        w18 = FALSE
      }
      frame False {
        call "Seconds Kronos Calculator.gvi"(Kronos In=$"Kronos to wait", Error In=w15) -> (Seconds Out=w19, Error Out=w16)
        while (iteration -> i2) {
          Wait(time to wait=w19)
          w20 = $"Stop Measurement"
          Is Greater(x=i2, y=1000) -> w21
          Logical Or(w20, w21) -> w22
          stop if w22
        }
        w17 = default
        w18 = w20
      }
    }
    next s1 = w16
    next s2 = w14
    stop if w18
  }
  call "Disconnect Motor.gvi"(Simulation?=$"Simulation?", Motor Serial nº=s2, Error In=s1)
