vi "Sun Simulator Spectra Match.gvi"   [LabVIEW NXG 5.0.0]
panel controls:
  "Set Integration Time": bool
  "Spectrometer index": i32
  "Integration Time": i32 = 1000
  "Acquire Spectra": bool
  "Stop Application": bool
  "Sun Spectrum": bool
  "Sun Multiplier": f64 = 1
  "Sun Offset": f64 = 2000
  "Path": path = path "C:\\Users\\admin\\Documents\\GitHub\\Rainbow_NXG\\Extra installers\\RainbowMarianov2.txt"
panel indicators:
  "Graph": cluster{"Element 1": f64[], "Element 2": f64[]}[]
  "Number of Spectrometers": i32
  "Version": u64
  "Firmware": string
  "Spectrometer Name": string
uses:
  Shared::Wrapper::Wrapper_Create.gvi
  Shared::Wrapper::Wrapper_openAllSpectrometers.gvi
  Shared::Wrapper::Wrapper_getFeatureControllerVersion.gvi
  Shared::Wrapper::Wrapper_getFirmwareVersion.gvi
  Shared::Wrapper::Wrapper_getName.gvi
  Shared::Wrapper::Wrapper_setIntegrationTime.gvi
  Shared::Wrapper::Wrapper_getWavelengths.gvi
  Shared::Wrapper::Wrapper_getSpectrum.gvi
  Rainbow Measurement Setup::Main Functions::One Time Calibrations::Physical Setup Calibration::Sun Simulator data.gvi
  Shared::Wrapper::Wrapper_closeAllSpectrometers.gvi
  Shared::Wrapper::Wrapper_Destroy.gvi
  NI::G Core::Error::Display Error.gvi
diagram:
  call "Wrapper_Create.gvi"() -> (Wrapper Out=w1, Error Out=w2)
  call "Wrapper_openAllSpectrometers.gvi"(Wrapper In=w1, Error In=w2) -> (Wrapper Out=w3, Number of Spectrometers=w4, Error Out=w5)
  call "Wrapper_getFeatureControllerVersion.gvi"(Wrapper In=w3, Error In=w5) -> (Wrapper Out=w6, Version=w7, Error Out=w8)
  call "Wrapper_getFirmwareVersion.gvi"(Wrapper In=w6, Error In=w8) -> (Wrapper Out=w9, Firmware=w10, Error Out=w11)
  call "Wrapper_getName.gvi"(Wrapper In=w9, Error In=w11) -> (Wrapper Out=w12, Spectrometer Name=w13, Error Out=w14)
  $"Spectrometer Name" <- w13
  s1 = w14  # shift register
  s2 = w12  # shift register
  while {
    event (timeout = 50) {
      on "Set Integration Time" Value changed {
        case ($"Set Integration Time") {
          frame False, Default { }
          frame True { }
        }
        call "Wrapper_setIntegrationTime.gvi"(Wrapper In=s2, Index=$"Spectrometer index", Integration Time=$"Integration Time", Error In=s1) -> (Wrapper Out=w16, Error Out=w15)
      }
      on "Acquire Spectra" Value changed {
        w17 = $"Spectrometer index"
        call "Wrapper_getWavelengths.gvi"(Wrapper In=s2, Index=w17, Error In=s1) -> (Wrapper Out=w18, WL Values=w19, Error Out=w20)
        s3 = w20  # shift register
        s4 = w18  # shift register
        while {
          call "Wrapper_getSpectrum.gvi"(Wrapper In=s4, Index=w17, Error In=s3) -> (Wrapper Out=w21, Spectrum Values=w22, Error Out=w23)
          Build Cluster(w19, w22) -> w24
          call "Sun Simulator data.gvi"(Operation Control="Load File", Multiplier=$"Sun Multiplier", Offset=$"Sun Offset", Path=$Path) -> (Sun Simulator Data=w25)
          case ($"Sun Spectrum") {
            frame False, Default {
              w27 = cluster{"Element 1": f64[], "Element 2": f64[]} {all zero or empty}
              Build Array(w24, w27) -> w26
            }
            frame True {
              Build Array(w24, w25) -> w26
            }
          }
          $Graph <- w26
          Not(x=$"Acquire Spectra") -> w28
          next s3 = w23
          next s4 = w21
          stop if w28
        }
        w15 = s3
        w16 = s4
      }
      on "Timeout" {
        w15 = s1
        w16 = s2
      }
    }
    next s1 = w15
    next s2 = w16
    stop if $"Stop Application"
  }
  call "Wrapper_closeAllSpectrometers.gvi"(Wrapper In=s2, Error In=s1) -> (Wrapper Out=w29, Error Out=w30)
  call "Wrapper_Destroy.gvi"(Wrapper In=w29, Error In=w30) -> (Error Out=w31)
  call "Display Error.gvi"(error in=w31)
  $Version <- w7
  $Firmware <- w10
  $"Number of Spectrometers" <- w4
