vi "Sun Simulator data.gvi"   [LabVIEW NXG 5.0.0]
inputs:
  "Operation Control": enum{"Load File", "Load Data"} = "Load File"
  "Multiplier": f64
  "Offset": f64
outputs:
  "Sun Simulator Data": cluster{"Wavelength": f64[], "Counts": f64[]}
panel indicators:
  "Extracted TExt": string
  "Extracted Array": f64[][]
diagram:
  case ($"Operation Control") {
    frame "Load File", Default {
      w3 = path "C:\\Users\\admin\\Documents\\GitHub\\Rainbow_NXG\\Extra installers\\Sun Simulator Spectrum.txt"
      Open Or Create Or Replace File(file path (use dialog)=w3) -> (error out=w4, refnum out=w5)
      Read From Text File(error in=w4, file (use dialog)=w5) -> (error out=w6, refnum out=w7, text=w8)
      $"Extracted TExt" <- w8
      Spreadsheet String To Array(format string="%g", spreadsheet string=w8) -> (array=w9)
      $"Extracted Array" <- w9
      Array Index(array=w9) -> (out0[_, 0]=w2, out1[_, 1]=w1)
      Close File(error in=w6, refnum=w7)
    }
    frame "Load Data" {
      w10 = [341.279, 341.662, 342.045, 342.429, 342.812, 343.195, 343.578, 343.962, 344.345, 344.728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]
      w11 = [-48.05, -51.02, -54.67, -56.41, -53.69, -53.4, -55.78, -57.13, -55.64, -47.92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]
      w1 = w11
      w2 = w10
    }
  }
  w12 = cluster{"Wavelength": f64[], "Counts": f64[]} {all zero or empty}
  Multiply($Multiplier, w1) -> w13
  Add(w13, $Offset) -> w14
  Property Node(instance in=w12, "Wavelength"=w2, "Counts"=w14) -> (instance out=w15)
  $"Sun Simulator Data" <- w15
