vi "XZ Array To Intensity Graph.gvi"   [LabVIEW NXG 5.0.0]
inputs:
  "Error In": error
  "XZ Array": "XZ Coordinate Array.gtype"
  "XZ Scan Parameters In": "XZ Scan Parameters.gtype"
  "Graph Reference": "IntensityGraph reference"[][]
outputs:
  "Error Out": error
  "Beam Power Density": f64[][]
types:
  "XZ Coordinate Cluster.gtype" = cluster{"X Coordinate (mm)": f64, "Z Coordinate (mm)": f64, "Coordinate Gcode": string, "Beam Power (W)": f64}
  "XZ Coordinate Array.gtype" = "XZ Coordinate Cluster.gtype"[]
  "XZ Scan Parameters.gtype" = cluster{"X Scan Range (mm)": f64, "Z Scan Range (mm)": f64, "X Steps": f64, "Z Steps": f64, "Center Coordinate X": f64, "Center Coordinate Z": f64, "Z Step size": f64, "X Step size": f64, "Total Steps": f64, "Z Starting Point": f64, "X Starting Point": f64, "Z End Point": f64, "X End Point": f64}
diagram:
  # This SubVI Takes the XZ Array and adapts it to map a 2D array. To do so it initializes an array with as many points as the X and Z point for each dimension multiplied by 10 (we only have one decimal point so that
  # will englobe all the points). Aftewards it takes this initialized array which is full of -0.01 (to prevent the confusion with 0) and it populates it with the data from the XZ Array. To do so it takes the XZ coordinate, mutiplies
  # it by 10 and that will be the index where it will be stored. The only problem with that is that the image will be almost empty unless we map every 0.1 mm. To compensate for that loss we extrapolate the value of the XZ array
  # pixels to all the sorounding pixels by taking into account the step size. This way we get a low resolution image with increased resolution (by extrapolation) of the map.
  # In order to plot this correctly within Labview we need to specify the range of the measurement using property nodes, and also constrain the fitting because otherwise the map tries to go all the way to the 0th coordinate which
  # is usually empty.
  case ($"Error In") {
    frame Error, Default {
      w1 = $"Error In"
      w2 = f64[][] []
    }
    frame No Error {
      Property Node(instance in=$"XZ Scan Parameters In") -> ("X End Point"=w3, "Z End Point"=w4, "X Starting Point"=w5, "Z Starting Point"=w6)
      Multiply(w3, 10) -> w7
      Multiply(w4, 10) -> w8
      disable {
        frame Enabled {
          w1 = $"Error In"
        }
        frame Disabled {
          Property Node(instance in=$"Graph Reference", error in=$"Error In") -> ("XScale"=w9, "YScale"=w10, error out=w11)
          Multiply(w5, 10) -> w12
          Property Node(instance in=cluster{"Minimum": f64, "Maximum": f64} {all zero or empty}, "Minimum"=w12, "Maximum"=w7) -> (instance out=w13)
          Multiply(w6, 10) -> w14
          Property Node(instance in=cluster{"Minimum": f64, "Maximum": f64} {all zero or empty}, "Minimum"=w14, "Maximum"=w8) -> (instance out=w15)
          Property Node(instance in=w10, "Range"=w15, "FitType"="None", error in=w11) -> (error out=w16)
          Property Node(instance in=w9, "Range"=w13, "FitType"="None", error in=w16) -> (error out=w1)
        }
      }
      To Signed 32 Bit Integer(number=w7) -> w17
      To Signed 32 Bit Integer(number=w8) -> w18
      Initialize Array(element=-0.01, size=w17, size=w18) -> w19
      s1 = w19  # shift register
      for {
        w20 = each element of $"XZ Array"
        Property Node(instance in=$"XZ Scan Parameters In") -> ("X Step size"=w21, "Z Step size"=w22)
        Multiply(w22, 10) -> w23
        Property Node(instance in=w20) -> ("X Coordinate (mm)"=w24, "Z Coordinate (mm)"=w25, "Beam Power (W)"=w26)
        Multiply(w21, 10) -> w27
        To Signed 32 Bit Integer(number=w27) -> w28
        Divide(x=w27, y=2) -> w29
        Round Toward Positive Infinity(x=w29) -> w30
        Multiply(w24, 10) -> w31
        Subtract(x=w31, y=w30) -> w32
        Divide(x=w23, y=2) -> w33
        Round Toward Positive Infinity(x=w33) -> w34
        Multiply(w25, 10) -> w35
        Subtract(x=w35, y=w34) -> w36
        s2 = s1  # shift register
        for (N = w28) (iteration -> i1) {
          To Signed 32 Bit Integer(number=w23) -> w37
          To Signed 32 Bit Integer(number=w32) -> w38
          Add(w38, i1) -> w39
          s3 = s2  # shift register
          for (N = w37) (iteration -> i2) {
            To Signed 32 Bit Integer(number=w36) -> w40
            Add(w40, i2) -> w41
            Replace Array Subset(inArray=s3, index=w39, index=w41, new=w26) -> w42
            next s3 = w42
          }
          next s2 = s3
        }
        next s1 = s2
      }
      w2 = s1
    }
  }
  $"Error Out" <- w1
  $"Beam Power Density" <- w2
