vi "MRM Single File Save.gvi"   [LabVIEW NXG 5.0.0]
inputs:
  "Misc Data Mega Cluster In": "Misc Data Mega Cluster.gtype"
  "MRM Data Cluster In": "MRM Full Data From SRM Cluster.gtype"
  "Error In": error
outputs:
  "Misc Data Mega Cluster Out": "Misc Data Mega Cluster.gtype"
  "Error Out": error
types:
  "Full Reference Cluster.gtype" = cluster{"Enum Reference Cluster": "Enum Control Reference Cluster.gtype", "Boolean Reference Cluster": "Boolean Control Reference Cluster.gtype", "Numeric Reference Cluster": "Numeric Control Reference Cluster.gtype", "Numeric Cluster Reference Cluster": "Numeric Cluster Reference Cluster.gtype", "Path Reference Cluster": "Path Reference Cluster.gtype", "Cluster Reference Cluster": "Cluster Reference Cluster.gtype", "XZ Stage Controls Reference Cluster": "XZ Stage Controls Reference Cluster.gtype"}
  "Cell Naming Cluster.gtype" = cluster{"Cell Label": string, "Sample Prefix": string, "Author Initials": string, "Current Date": string, "Batch Name": string}
  T1 = cluster{"X Coordinate (mm)": f64, "Z Coordinate (mm)": f64, "Aprch Distance (mm)": f64}
  T2 = cluster{"X Coordinate (mm)": f64, "Z Coordinate (mm)": f64, "Vertical Spacing (mm)": f64, "Aprch Distance (mm)": f64, "Aprch Dstnc L.12 (mm)": f64}
  "XZ All Position Cluster.gtype" = cluster{"Diffusor Coordinates": T1, "Photodetector Coordinates": T1, "Cell R.01 Coordinates": T2}
  T3 = cluster{"Thorlabs Motor Serial Number File Path": path, "Default Data Saving Location": path}
  "Misc Data Mega Cluster.gtype" = cluster{"Full Reference Cluster": "Full Reference Cluster.gtype", "Cell Naming Cluster": "Cell Naming Cluster.gtype", "All XZ Position Cluster": "XZ All Position Cluster.gtype", "All Paths": T3}
  "SRM Mega Cluster.gtype" = cluster{"SRM Specific Parameters": "SRM Specific Parameters.gtype", "Rainbow Sweep Parameters SRM": "Rainbow Sweep Param Selector.gtype", "SRM Full IV data Array": "IV Full Data Cluster.gtype"[], "Full IV Curve Raw Data": "IV Full Raw Data.gtype"[]}
  T4 = enum{"L.01", "L.02", "L.03", "L.04", "L.05", "L.06", "L.07", "L.08", "L.09", "L.10", "L.11", "L.12", "R.01", "R.02", "R.03", "R.04", "R.05", "R.06", "R.07", "R.08", "R.09", "R.10", "R.11", "R.12"}
  "MRM Full Data From SRM Cluster.gtype" = cluster{"SRM Mega Cluster": "SRM Mega Cluster.gtype", "Cell Label": T4}
uses:
  Rainbow Measurement Setup::Main Functions::Modify TXT file::Modify Measurement TXT File.gvi
diagram:
  # This subVI Takes one MRM Data cluster element and saves all the measured IV curves and processed data.
  # It is separated so that it can be applied after every measurement instead of after all the measurements to prevent
  # data loss.
  case ($"Error In") {
    frame Error, Default {
      w1 = $"Error In"
      w2 = $"Misc Data Mega Cluster In"
    }
    frame No Error {
      Property Node(instance in=$"MRM Data Cluster In") -> ("SRM Mega Cluster:SRM Full IV data Array"=w3, "Cell Label"=w4)
      Format Into String(errIn=$"Error In", w4) -> (outString=w5, errOut=w6)
      Property Node(instance in=$"Misc Data Mega Cluster In", "Cell Naming Cluster:Cell Label"=w5) -> (instance out=w7)
      s1 = w6  # shift register
      s2 = w7  # shift register
      for {
        w8 = each element of w3
        Property Node(instance in=w8) -> ("IV Measurements Array"=w9, "Rainbow Sweep Types"=w10, "IV Refined Data"=w11)
        Property Node(instance in=w7) -> ("Cell Naming Cluster:Sample Prefix"=w12)
        s3 = s1  # shift register
        s4 = s2  # shift register
        for {
          w13 = each element of w9
          Property Node(instance in=w13) -> ("Voltage (V)"=w14, "Current (A)"=w15, "Current Density (A/m^2)"=w16, "Dividing Wavelength (nm)"=w17, "Light Power Density (W/m^2)"=w18, "Total Light Power Density (W/m^2)"=w19)
          Format Into String(formatString="%d", errIn=s3, w17) -> (outString=w20, errOut=w21)
          Concatenate Strings(w12, w20, "nm") -> w22
          Property Node(instance in=s4, "Cell Naming Cluster:Sample Prefix"=w22) -> (instance out=w23)
          Build Array(w14, w15, w16) -> w24
          Transpose 2D Array(2D array=w24) -> (transposed array=w25)
          Concatenate Strings(" Dividing Wavelength (nm) = ", w20, "  Light Power Density (W/m^2) = ") -> w26
          Format Into String(initString=w26, errIn=w21, w18) -> (outString=w27, errOut=w28)
          Concatenate Strings(w27, "  Total Light Power Density (W/m^2) = ") -> w29
          Format Into String(initString=w29, errIn=w28, w19) -> (outString=w30, errOut=w31)
          call "Modify Measurement TXT File.gvi"(Variable Header Info=w30, Rainbow Sweep Types=w10, Misc Data Mega Cluster In=w23, Modify File Operation="Save TXT", Data To Save=w25, Error In=w31, Measurement File Type="Single Cell Rainbow Raw") -> (Error Out=w32)
          next s3 = w32
        }
        Property Node(instance in=w11) -> ("Dividing Wavelength (nm)"=w33, "Light Power Density (W/m^2)"=w34, "Jsc (A/m^2)"=w35, "Voc (V)"=w36, "FF (%)"=w37, "Efficiency (%)"=w38, "Rs (Ω · m^2)"=w39, "Rsh (Ω · m^2)"=w40)
        Build Array(w33, w34, w35, w36, w37, w38, w39, w40) -> w41
        Transpose 2D Array(2D array=w41) -> (transposed array=w42)
        call "Modify Measurement TXT File.gvi"(Rainbow Sweep Types=w10, Misc Data Mega Cluster In=s4, Modify File Operation="Save TXT", Data To Save=w42, Error In=s3, Measurement File Type="Single Cell Rainbow Refined") -> (Error Out=w43, Misc Data Mega Cluster Out=w44)
        next s1 = w43
        next s2 = w44
      }
      w1 = s1
      w2 = s2
    }
  }
  $"Misc Data Mega Cluster Out" <- w2
  $"Error Out" <- w1
