vi "MRM file handling.gvi"   [LabVIEW NXG 5.0.0]
inputs:
  "Error In": error
  "Misc Data Mega Cluster In": "Misc Data Mega Cluster.gtype"
  "MRM Mega Cluster In": "MRM Mega Cluster.gtype" = {"MRM Specific Parameters"={"Max (V)"=1.2, "Min (V)"=-0.5, "V Points"=100, "Curr Range (A)"=0, "Sweep Dir"=FALSE, "Current Avg"=3, "Max (A)"=0.1, "Integration Time"=0.5, "Cell Area (m^2)"=8e-06, "Autorange"=TRUE, "Full Spctr Ref"=TRUE}, "Cell Selector"={FALSE, FALSE, FALSE, FALSE, FALSE, FALSE, FALSE, FALSE, FALSE, FALSE, FALSE, FALSE, FALSE, FALSE, FALSE, FALSE, FALSE, FALSE, FALSE, FALSE, FALSE, FALSE, FALSE, FALSE, FALSE, FALSE, FALSE, FALSE}, "Cells to Measure Array"=[], "Rainbow Sweep Parameters MRM"={0, 900, 400, 1, 1, 0}, "MRM Data Array"=[]}
  "Modify File Operation": "Modify File Operation.gtype" = "Save TXT"
outputs:
  "Error Out": error
  "MRM Mega Cluster Out": "MRM Mega Cluster.gtype"
  "Boolean Handler Out": "SRM Load Boolean Handler.gtype"
  "Loaded Files": string[]
panel indicators:
  "Misc Data Mega Cluster Out": "Misc Data Mega Cluster.gtype"
types:
  "Modify File Operation.gtype" = enum{"Save TXT", "Load TXT"}
  "SRM Load Boolean Handler.gtype" = cluster{"Canceled Loading?": bool, "Found Any Folder?": bool, "Found Files Within all Folders?": bool, "Duplicate Measurement Files?": bool}
  "Full Reference Cluster.gtype" = cluster{"Enum Reference Cluster": "Enum Control Reference Cluster.gtype", "Boolean Reference Cluster": "Boolean Control Reference Cluster.gtype", "Numeric Reference Cluster": "Numeric Control Reference Cluster.gtype", "Numeric Cluster Reference Cluster": "Numeric Cluster Reference Cluster.gtype", "Path Reference Cluster": "Path Reference Cluster.gtype", "Cluster Reference Cluster": "Cluster Reference Cluster.gtype", "XZ Stage Controls Reference Cluster": "XZ Stage Controls Reference Cluster.gtype"}
  "Cell Naming Cluster.gtype" = cluster{"Cell Label": string, "Sample Prefix": string, "Author Initials": string, "Current Date": string, "Batch Name": string}
  T1 = cluster{"X Coordinate (mm)": f64, "Z Coordinate (mm)": f64}
  T2 = cluster{"X Coordinate (mm)": f64, "Z Coordinate (mm)": f64, "Vertical Spacing (mm)": f64}
  "XZ All Position Cluster.gtype" = cluster{"Diffusor Coordinates": T1, "Photodetector Coordinates": T1, "Cell R.01 Coordinates": T2}
  T3 = cluster{"Thorlabs Motor Serial Number File Path": path, "Default Data Saving Location": path}
  "Misc Data Mega Cluster.gtype" = cluster{"Full Reference Cluster": "Full Reference Cluster.gtype", "Cell Naming Cluster": "Cell Naming Cluster.gtype", "All XZ Position Cluster": "XZ All Position Cluster.gtype", "All Paths": T3}
  "MRM Specific Parameters.gtype" = cluster{"Max (V)": f64, "Min (V)": f64, "V Points": u32, "Curr Range (A)": f64, "Sweep Dir": bool, "Current Avg": u32, "Max (A)": f64, "Integration Time": f64, "Cell Area (m^2)": f64, "Autorange": bool, "Full Spctr Ref": bool}
  T4 = cluster{"L.01": bool, "R.01": bool, "L.02": bool, "R.02": bool, "L.03": bool, "R.03": bool, "L.04": bool, "R.04": bool, "L.05": bool, "R.05": bool, "L.06": bool, "R.06": bool, "L.07": bool, "R.07": bool, "L.08": bool, "R.08": bool, "L.09": bool, "R.09": bool, "L.10": bool, "R.10": bool, "L.11": bool, "R.11": bool, "L.12": bool, "R.12": bool}
  "MRM Cell Selector.gtype" = cluster{"All": bool, "Left": bool, "Right": bool, "Cell Cluster": T4, "Reset": bool}
  "XZ Stage Cell.gtype" = enum{"L.01", "L.02", "L.03", "L.04", "L.05", "L.06", "L.07", "L.08", "L.09", "L.10", "L.11", "L.12", "R.01", "R.02", "R.03", "R.04", "R.05", "R.06", "R.07", "R.08", "R.09", "R.10", "R.11", "R.12"}
  "Selected Cells Array.gtype" = "XZ Stage Cell.gtype"[]
  "Raibow Sweep Selector.gtype" = enum{"Red Sweep", "Blue Sweep", "Full Sweep Red First", "Full Sweep Blue First"}
  "Rainbow Sweep Param Selector.gtype" = cluster{"Raibow Sweep Selector": "Raibow Sweep Selector.gtype", "Max Wavelength (nm)": f64, "Min Wavelength (nm)": f64, "Wavelength Step (nm)": f64, "Rainbow Sweep Type Selector": "Rainbow Sweep Type Selector.gtype"}
  T5 = enum{"L.01", "L.02", "L.03", "L.04", "L.05", "L.06", "L.07", "L.08", "L.09", "L.10", "L.11", "L.12", "R.01", "R.02", "R.03", "R.04", "R.05", "R.06", "R.07", "R.08", "R.09", "R.10", "R.11", "R.12"}
  "MRM Full Data From SRM Cluster.gtype" = cluster{"SRM Mega Cluster": "SRM Mega Cluster.gtype", "Cell Label": T5}
  "MRM Mega Cluster.gtype" = cluster{"MRM Specific Parameters": "MRM Specific Parameters.gtype", "Cell Selector": "MRM Cell Selector.gtype", "Cells to Measure Array": "Selected Cells Array.gtype", "Rainbow Sweep Parameters MRM": "Rainbow Sweep Param Selector.gtype", "MRM Data Array": "MRM Full Data From SRM Cluster.gtype"[]}
  "Rainbow Sweep Types.gtype" = enum{"Red Sweep Closing", "Red Sweep Opening", "Blue Sweep Closing", "Blue Sweep Opening"}
  "IV Single Measurement.gtype" = cluster{"Voltage (V)": f64[], "Current (A)": f64[], "Current Density (A/m^2)": f64[], "Dividing Wavelength (nm)": f64, "Light Power Density (W/m^2)": f64, "Total Light Power Density (W/m^2)": f64}
  "IV Full Raw Data.gtype" = cluster{"Rainbow Sweep Types": "Rainbow Sweep Types.gtype", "IV Raw Data Array": "IV Single Measurement.gtype"[]}
uses:
  Rainbow Measurement Setup::Side Functions::Messages And Prompts::Select path prompt.gvi
  Rainbow Measurement Setup::Side Functions::Path Manipulation::File_FolderName Scan For Sweep.gvi
  Rainbow Measurement Setup::Main Functions::Modify TXT file::Modify Measurement TXT File.gvi
  Rainbow Measurement Setup::Main Functions::Rainbow Measurement::Cell Single Rainbow Measurement::File Handling::SRM Header Info Extractor.gvi
  Rainbow Measurement Setup::Side Functions::Utilities::Array Operations::Array Detect Duplicates.gvi
  Rainbow Measurement Setup::Side Functions::Messages And Prompts::FGV Repeat Operation for all following files.gvi
diagram:
  # This subVI Handles the Saving of all the Single Rainbow Measurement files. It can both save and load the files from a specified folder and to the user folder respectively
  case ($"Error In") {
    frame Error, Default {
      w1 = $"Error In"
      w2 = default
      w3 = default
      w4 = $"MRM Mega Cluster In"
      w5 = $"Misc Data Mega Cluster In"
    }
    frame No Error {
      case ($"Modify File Operation") {
        frame "Load TXT" {
          w12 = "Please Select the folder with the Rainbow Measurement Files you want to Load. "
          w13 = "Please select the cell folder within the device you want to analyze (i.e. L12)"
          call "Select path prompt.gvi"(Main Message=w12, Sub message=w13, Error In=$"Error In", Cancel Available?=TRUE) -> (New Path=w14, Cancelled?=w15, Error Out=w16)
          case (w15) {
            frame True {
              w17 = default
              w6 = w16
              w8 = TRUE
              w2 = default
              w7 = TRUE
              w9 = default
              w10 = default
            }
            frame False {
              List Folder(error in=w16, path=w14) -> (error out=w18, folder names=w19, path out=w20)
              s1 = w18  # shift register
              s2 = 0  # shift register
              s3 = "IV Full Raw Data.gtype"[] []  # shift register
              for {
                w21 = each element of w19
                Build Path(base path=w20, name or relative path=w21) -> (appended path=w25)
                Search And Replace String(error in (no error)=s1, input string=w21, search string="Raw IV Curves") -> (error out=w26, number of replacements=w27)
                call "File_FolderName Scan For Sweep.gvi"(FileName/FolderName In=w21, Error In=w26) -> (Is File/Folder sweep type?=w28, Sweep Type=w29, Error Out=w30)
                Is Not Equal To 0(x=w27) -> w31
                Logical And(w31, w28) -> w32
                case (w32) {
                  frame False, Default {
                    w33 = s2
                    w34 = s3
                    w35 = w30
                    w36 = default
                    w37 = "Red Sweep Closing"
                    w38 = default
                  }
                  frame True {
                    Array Index(array=s3) -> (out0[s2]=w39)
                    Property Node(instance in=w39) -> ("IV Raw Data Array"=w40)
                    List Folder(error in=w30, path=w25) -> (error out=w41, file names=w42, path out=w43)
                    s4 = w41  # shift register
                    s5 = w40  # shift register
                    s6 = 0  # shift register
                    for {
                      w44 = each element of w42
                      Build Path(base path=w43, name or relative path=w44) -> (appended path=w46)
                      Search And Replace String(input string=w44, search string=".txt") -> (number of replacements=w47)
                      Is Not Equal To 0(x=w47) -> w48
                      case (w48) {
                        frame False, Default {
                          w49 = s4
                          w50 = s5
                          w51 = s6
                          w52 = default
                        }
                        frame True {
                          call "Modify Measurement TXT File.gvi"(Filename to load/save=w46, Modify File Operation="Load TXT", Error In=s4, Measurement File Type="Single Cell Rainbow Raw") -> (Loaded Data=w53, Header Data=w54, Error Out=w55)
                          Array Index(array=w53) -> (out0[_, 0]=w56, out1[_, 1]=w57, out2[_, 2]=w58)
                          call "SRM Header Info Extractor.gvi"(Header Data=w54, Error In=w55) -> (Dividing Wavelength=w59, Light Power Density=w60, Total Light Power Density=w61, Error Out=w49)
                          Property Node(instance in="IV Single Measurement.gtype" {all zero or empty}, "Voltage (V)"=w56, "Current (A)"=w57, "Current Density (A/m^2)"=w58, "Dividing Wavelength (nm)"=w59, "Light Power Density (W/m^2)"=w60, "Total Light Power Density (W/m^2)"=w61) -> (instance out=w62)
                          Insert Into Array(inArray=s5, index0=s6, new=w62) -> w50
                          Increment(x=s6) -> w51
                          w52 = TRUE
                        }
                      }
                      append w52 to w45
                      next s4 = w49
                      next s5 = w50
                      next s6 = w51
                    }
                    Property Node(instance in=w39, "IV Raw Data Array"=s5, "Rainbow Sweep Types"=w29) -> (instance out=w63)
                    Insert Into Array(inArray=s3, new=w63) -> w34
                    Or Array Elements(Boolean array=w45) -> (logical OR=w38)
                    Increment(x=s2) -> w33
                    w35 = s4
                    w36 = TRUE
                    w37 = w29
                  }
                }
                append w36 to w22
                append w21 to w2 if w32
                append w37 to w23 if w32
                append w38 to w24
                next s1 = w35
                next s2 = w33
                next s3 = w34
              }
              call "Array Detect Duplicates.gvi"(Array In=w23, Error In=s1) -> (Repeated?=w9, Error Out=w6)
              Or Array Elements(Boolean array=w22) -> (logical OR=w7)
              Or Array Elements(Boolean array=w24) -> (logical OR=w10)
              w17 = s3
              w8 = default
            }
          }
          w11 = $"MRM Mega Cluster In"
          w5 = $"Misc Data Mega Cluster In"
        }
        frame "Save TXT", Default {
          Property Node(instance in=$"MRM Mega Cluster In") -> ("MRM Data Array"=w64, instance out=w65)
          s7 = $"Error In"  # shift register
          s8 = w65  # shift register
          s9 = $"Misc Data Mega Cluster In"  # shift register
          for {
            w66 = each element of w64
            Property Node(instance in=w66) -> ("SRM Mega Cluster:SRM Full IV data Array"=w67, "Cell Label"=w68)
            Format Into String(errIn=s7, w68) -> (outString=w69, errOut=w70)
            Property Node(instance in=s9, "Cell Naming Cluster:Cell Label"=w69) -> (instance out=w71)
            s10 = w70  # shift register
            s11 = w71  # shift register
            for {
              w72 = each element of w67
              Property Node(instance in=w72) -> ("IV Measurements Array"=w73, "Rainbow Sweep Types"=w74, "IV Refined Data"=w75)
              Property Node(instance in=w71) -> ("Cell Naming Cluster:Sample Prefix"=w76)
              s12 = s10  # shift register
              s13 = s11  # shift register
              for {
                w77 = each element of w73
                Property Node(instance in=w77) -> ("Voltage (V)"=w78, "Current (A)"=w79, "Current Density (A/m^2)"=w80, "Dividing Wavelength (nm)"=w81, "Light Power Density (W/m^2)"=w82, "Total Light Power Density (W/m^2)"=w83)
                Format Into String(formatString="%d", errIn=s12, w81) -> (outString=w84, errOut=w85)
                Concatenate Strings(w76, w84, "nm") -> w86
                Property Node(instance in=s13, "Cell Naming Cluster:Sample Prefix"=w86) -> (instance out=w87)
                Build Array(w78, w79, w80) -> w88
                Transpose 2D Array(2D array=w88) -> (transposed array=w89)
                Concatenate Strings(" Dividing Wavelength (nm) = ", w84, "  Light Power Density (W/m^2) = ") -> w90
                Format Into String(initString=w90, errIn=w85, w82) -> (outString=w91, errOut=w92)
                Concatenate Strings(w91, "  Total Light Power Density (W/m^2) = ") -> w93
                Format Into String(initString=w93, errIn=w92, w83) -> (outString=w94, errOut=w95)
                call "Modify Measurement TXT File.gvi"(Variable Header Info=w94, Rainbow Sweep Types=w74, Misc Data Mega Cluster In=w87, Modify File Operation="Save TXT", Data To Save=w89, Error In=w95, Measurement File Type="Single Cell Rainbow Raw") -> (Error Out=w96)
                next s12 = w96
              }
              Property Node(instance in=w75) -> ("Dividing Wavelength (nm)"=w97, "Light Power Density (W/m^2)"=w98, "Jsc (A/m^2)"=w99, "Voc (V)"=w100, "FF (%)"=w101, "Efficiency (%)"=w102, "Rs (Ω · m^2)"=w103, "Rsh (Ω · m^2)"=w104)
              Build Array(w97, w98, w99, w100, w101, w102, w103, w104) -> w105
              Transpose 2D Array(2D array=w105) -> (transposed array=w106)
              call "Modify Measurement TXT File.gvi"(Rainbow Sweep Types=w74, Misc Data Mega Cluster In=s13, Modify File Operation="Save TXT", Data To Save=w106, Error In=s12, Measurement File Type="Single Cell Rainbow Refined") -> (Error Out=w107, Misc Data Mega Cluster Out=w108)
              next s10 = w107
              next s11 = w108
            }
            next s7 = s10
            next s9 = s11
          }
          w6 = s7
          w7 = default
          w8 = default
          w2 = default
          w9 = default
          w10 = default
          w11 = s8
          w5 = s9
        }
      }
      call "FGV Repeat Operation for all following files.gvi"(FGV Instructions="Reset State", Error In=w6) -> (Error Out=w1)
      Property Node(instance in=w11, "MRM Data Array"="MRM Full Data From SRM Cluster.gtype"[] []) -> (instance out=w4)
      Property Node(instance in="SRM Load Boolean Handler.gtype" {all zero or empty}, "Canceled Loading?"=w8, "Found Any Folder?"=w7, "Found Files Within all Folders?"=w10, "Duplicate Measurement Files?"=w9) -> (instance out=w3)
    }
  }
  $"Misc Data Mega Cluster Out" <- w5
  $"Error Out" <- w1
  $"MRM Mega Cluster Out" <- w4
  $"Boolean Handler Out" <- w3
  $"Loaded Files" <- w2
