vi "MRM Cell Updater.gvi"   [LabVIEW NXG 5.0.0]
inputs:
  "Error In": error
  "Misc Data Mega Cluster In": "Misc Data Mega Cluster.gtype"
outputs:
  "Error Out": error
types:
  T1 = cluster{"IV Extracted Parameter Plot ": "Graph reference", "MRM Cell Selector Ref": "Cluster reference", "IV Plot Out Multiple Reference": "Graph reference", "Rainbow Sweep Parameters MRM Ref": "Cluster reference", "MRM Specific Parameters Ref": "Cluster reference", "MRM Cell Refined Plot Selector ref": "ComboBoxSelector reference", "MRM Current Raw Cell Plot": "ComboBoxSelector reference", "MRM Raw Plot Rainbow Sweep Relector Ref": "ComboBoxSelector reference"}
  T2 = cluster{"SRM Light Power Density Ref": "NumericTextBoxDouble reference", "Rainbow Sweep Parameters RSM": "Cluster reference", "SRM Refined Plot Rainbow Sweep Types": "ComboBoxSelector reference", "SRM Specific Parameters": "Cluster reference", "Sweep Live Parameters RSM": "Cluster reference", "SRM Raw Plot Rainbow Sweep Selector": "ComboBoxSelector reference", "SRM Plot Parameter Selector Ref": "EnumSelector reference", "IV Plot Out Ref": "Graph reference"}
  T3 = cluster{"Calibration Files Path": "PathSelector reference", "Default Data Saving Location": "PathSelector reference"}
  T4 = cluster{"Main Tab": "TabControl reference", "Rainbow Measurement tab": "TabControl reference", "Configuration tab": "TabControl reference", "Light Calibration tab": "TabControl reference"}
  T5 = cluster{"Custom date": "CheckBox reference", "Batch Name": "StringControl reference", "Author Initials": "ComboBoxSelector reference", "Cell Number": "StringControl reference", "Current Date": "StringControl reference", "Sample Comments": "StringControl reference", "Sample Prefix": "StringControl reference", "Label Info Missing Error": "BooleanControl reference", "Label Info Error Label": "StringControl reference"}
  T6 = cluster{"Beam Power Density": "IntensityGraph reference"[][], "Irradiance Calibration": "Graph reference"[], "MSpot Spectrum Calibration Parameters": "Cluster reference", "Rainbow Sweep Param Selector MSpot": "Cluster reference"}
  T7 = cluster{"LPC Parameters Ref": "Cluster reference", "Sweep Live Parameters LPC ref": "Cluster reference", "Light Power Calibration": "Graph reference", "Light Power Calibration Data Ref": "ArrayViewer reference", "Rainbow Sweep Parameters LPC": "Cluster reference"}
  T8 = cluster{"Current State Ref": "EnumSelector reference", "Substate": "StringControl reference", "State": "StringControl reference", "Current Substate": "StringControl reference"}
  T9 = cluster{"Custom Position": "BooleanControl reference", "Set Position": "BooleanControl reference", "XZ Stage Active": "BooleanControl reference", "Release XZ Stage": "BooleanControl reference", "XZ Coordinates": "Cluster reference", "Activate XZ Stage": "BooleanControl reference", "XZ Stage Cell Reference": "EnumSelector reference", "XZ All Position Cluster Ref": "Cluster reference"}
  "Full Reference Cluster.gtype" = cluster{"MRM Reference Cluster": T1, "SRM Reference Cluster": T2, "Path Reference Cluster": T3, "Tab Reference Cluster": T4, "Cell Naming Parameters Ref Cluster": T5, "One Time Calibrations Ref Cluster": T6, "LPC Controls Reference Cluster": T7, "System Parameters Ref Cluster": T8, "XZ Stage Controls Reference Cluster": T9}
  T10 = cluster{"X Coordinate (mm)": f64, "Z Coordinate (mm)": f64, "Aprch Distance (mm)": f64}
  T11 = cluster{"X Coordinate (mm)": f64, "Z Coordinate (mm)": f64, "Vertical Spacing (mm)": f64, "Aprch Distance (mm)": f64, "Aprch Dstnc L.12 (mm)": f64}
  "XZ All Position Cluster.gtype" = cluster{"Diffusor Coordinates": T10, "Photodetector Coordinates": T10, "Cell R.01 Coordinates": T11}
  T12 = cluster{"Thorlabs Motor Serial Number File Path": path, "Default Data Saving Location": path}
  "Cell Naming Cluster.gtype" = cluster{"Cell Label": string, "Sample Prefix": string, "Author Initials": string, "Current Date": string, "Batch Name": string}
  "Misc Data Mega Cluster.gtype" = cluster{"Full Reference Cluster": "Full Reference Cluster.gtype", "All XZ Position Cluster": "XZ All Position Cluster.gtype", "All Paths": T12, "Cell Naming Cluster": "Cell Naming Cluster.gtype"}
  T13 = cluster{"L.01": bool, "R.01": bool, "L.02": bool, "R.02": bool, "L.03": bool, "R.03": bool, "L.04": bool, "R.04": bool, "L.05": bool, "R.05": bool, "L.06": bool, "R.06": bool, "L.07": bool, "R.07": bool, "L.08": bool, "R.08": bool, "L.09": bool, "R.09": bool, "L.10": bool, "R.10": bool, "L.11": bool, "R.11": bool, "L.12": bool, "R.12": bool}
diagram:
  # This SubVI Takes care of the control of the MRM Cell Selector update process. It reads the multiple states and sets the controls
  # accordingly to ease the selection of the cells.
  case ($"Error In") {
    frame Error, Default {
      w1 = $"Error In"
    }
    frame No Error {
      Property Node(instance in=$"Misc Data Mega Cluster In") -> ("Full Reference Cluster:MRM Reference Cluster:MRM Cell Selector Ref"=w2)
      Property Node(instance in=w2, error in=$"Error In") -> ("Value"=w3, error out=w4, instance out=w5)
      Property Node(instance in=w3) -> ("All"=w6, "Left"=w7, "Right"=w8, "Cell Cluster"=w9, "Reset"=w10, instance out=w11)
      case (w10) {
        frame True {
          Property Node(instance in=w11, "All"=FALSE, "Left"=FALSE, "Right"=FALSE, "Cell Cluster"=T13 {all zero or empty}, "Reset"=FALSE) -> (instance out=w12)
        }
        frame False {
          case (w6) {
            frame False, Default {
              case (w8) {
                frame False, Default {
                  w14 = w9
                }
                frame True {
                  Property Node(instance in=w9, "R.01"=TRUE, "R.02"=TRUE, "R.03"=TRUE, "R.04"=TRUE, "R.05"=TRUE, "R.06"=TRUE, "R.07"=TRUE, "R.08"=TRUE, "R.09"=TRUE, "R.10"=TRUE, "R.11"=TRUE, "R.12"=TRUE) -> (instance out=w14)
                }
              }
              case (w7) {
                frame False, Default {
                  w13 = w14
                }
                frame True {
                  Property Node(instance in=w14, "L.01"=TRUE, "L.02"=TRUE, "L.03"=TRUE, "L.04"=TRUE, "L.05"=TRUE, "L.06"=TRUE, "L.07"=TRUE, "L.08"=TRUE, "L.09"=TRUE, "L.10"=TRUE, "L.11"=TRUE, "L.12"=TRUE) -> (instance out=w13)
                }
              }
            }
            frame True {
              Property Node(instance in=w9, "R.05"=TRUE, "L.06"=TRUE, "R.06"=TRUE, "L.07"=TRUE, "R.07"=TRUE, "L.08"=TRUE, "R.08"=TRUE, "L.09"=TRUE, "R.09"=TRUE, "L.10"=TRUE, "R.10"=TRUE, "L.11"=TRUE, "R.11"=TRUE, "L.12"=TRUE, "R.12"=TRUE) -> (instance out=w15)
              Property Node(instance in=w15, "L.01"=TRUE, "R.01"=TRUE, "L.02"=TRUE, "R.02"=TRUE, "L.03"=TRUE, "R.03"=TRUE, "L.04"=TRUE, "R.04"=TRUE, "L.05"=TRUE) -> (instance out=w13)
            }
          }
          Property Node(instance in=w11, "Cell Cluster"=w13) -> (instance out=w12)
        }
      }
      Property Node(instance in=w5, "Value"=w12, error in=w4) -> (error out=w1)
    }
  }
  $"Error Out" <- w1
