vi "MRM Array Replace If it Exists.gvi"   [LabVIEW NXG 5.0.0]
inputs:
  "Error In": error
  "All Cell Measurements In": T1[]
  "Array Index": i32
  "New Element": T1
outputs:
  "Error Out": error
  "All Cell Measurements Out": T1[]
types:
  "IV Single Measurement.gtype" = cluster{"Voltage (V)": f64[], "Current (A)": f64[], "Current Density (A/m^2)": f64[], "Dividing Wavelength (nm)": f64, "Light Power Density (W/m^2)": f64, "Total Light Power Density (W/m^2)": f64}
  "SRM Single Plot Cluster.gtype" = cluster{"Voltage (V)": f64[], "Current Density (A/m^2)": f64[]}
  "Rainbow Sweep Types.gtype" = enum{"Red Sweep Closing", "Red Sweep Opening", "Blue Sweep Closing", "Blue Sweep Opening"}
  "IV Full Raw Data.gtype" = cluster{"Rainbow Sweep Types": "Rainbow Sweep Types.gtype", "IV Raw Data Array": "IV Single Measurement.gtype"[]}
  "XZ Stage Cell.gtype" = enum{"L.01", "L.02", "L.03", "L.04", "L.05", "L.06", "L.07", "L.08", "L.09", "L.10", "L.11", "L.12", "R.01", "R.02", "R.03", "R.04", "R.05", "R.06", "R.07", "R.08", "R.09", "R.10", "R.11", "R.12"}
  T1 = cluster{"IV Single Measurement Array": "IV Single Measurement.gtype"[], "IV Single Measurement Plot Array": "SRM Single Plot Cluster.gtype"[], "Full IV Data Array": "IV Full Raw Data.gtype"[], "Measured Cell": "XZ Stage Cell.gtype"}
diagram:
  # This SubVI Checks if the input array is empty and if it is
  # it inserts the new data, if it itsn't it replaces the existing data
  case ($"Error In") {
    frame Error, Default {
      w1 = $"Error In"
      w2 = $"All Cell Measurements In"
    }
    frame No Error {
      Insert Into Array(inArray=$"All Cell Measurements In", index0=$"Array Index", new=$"New Element") -> w3
      Replace Array Subset(inArray=$"All Cell Measurements In", index=$"Array Index", new=$"New Element") -> w4
      Array Index(array=$"All Cell Measurements In") -> (out0[$"Array Index"]=w5)
      Property Node(instance in=w5) -> ("IV Single Measurement Array"=w6)
      Is Empty Array(array=w6) -> w7
      Select(s=w7, t=w3, f=w4) -> w2
      w1 = $"Error In"
    }
  }
  $"Error Out" <- w1
  $"All Cell Measurements Out" <- w2
