vi "MRM Data Array IV Processor.gvi"   [LabVIEW NXG 5.0.0]
inputs:
  "MRM Data Cluster In": "MRM Full Data From SRM Cluster.gtype"
  "Error In": error
outputs:
  "MRM Data Cluster Out": "MRM Full Data From SRM Cluster.gtype"
  "Error Out": error
types:
  "SRM Mega Cluster.gtype" = cluster{"SRM Specific Parameters": "SRM Specific Parameters.gtype", "Rainbow Sweep Parameters SRM": "Rainbow Sweep Param Selector.gtype", "SRM Full IV data Array": "IV Full Data Cluster.gtype"[], "Full IV Curve Raw Data": "IV Full Raw Data.gtype"[]}
  T1 = enum{"L.01", "L.02", "L.03", "L.04", "L.05", "L.06", "L.07", "L.08", "L.09", "L.10", "L.11", "L.12", "R.01", "R.02", "R.03", "R.04", "R.05", "R.06", "R.07", "R.08", "R.09", "R.10", "R.11", "R.12"}
  "MRM Full Data From SRM Cluster.gtype" = cluster{"SRM Mega Cluster": "SRM Mega Cluster.gtype", "Cell Label": T1}
  "IV Refined Full Sweep Data.gtype" = cluster{"Rs (Ω · m^2)": f64[], "Rsh (Ω · m^2)": f64[], "Jsc (A/m^2)": f64[], "Voc (V)": f64[], "FF (%)": f64[], "Efficiency (%)": f64[], "Dividing Wavelength (nm)": f64[], "Light Power Density (W/m^2)": f64[]}
  "IV Single Measurement.gtype" = cluster{"Voltage (V)": f64[], "Current (A)": f64[], "Current Density (A/m^2)": f64[], "Dividing Wavelength (nm)": f64, "Light Power Density (W/m^2)": f64, "Total Light Power Density (W/m^2)": f64}
  "Rainbow Sweep Types.gtype" = enum{"Red Sweep Closing", "Red Sweep Opening", "Blue Sweep Closing", "Blue Sweep Opening"}
  "IV Full Data Cluster.gtype" = cluster{"IV Measurements Array": "IV Single Measurement.gtype"[], "Rainbow Sweep Types": "Rainbow Sweep Types.gtype", "IV Refined Data": "IV Refined Full Sweep Data.gtype", "Total Light Power Density (W/m^2)": f64}
uses:
  Rainbow Measurement Setup::Main Functions::Rainbow Measurement::Cell Single Rainbow Measurement::IV Calculations::Jsc and Voc.gvi
  Rainbow Measurement Setup::Main Functions::Rainbow Measurement::Cell Single Rainbow Measurement::IV Calculations::FF and Efficiency.gvi
diagram:
  # This subVI Takes one element from the MRM Data cluster array and processes it to add all the individual
  # SRM IV Parameters. It is a separate subVI so that it can be used in several places.
  case ($"Error In") {
    frame Error, Default {
      w1 = $"Error In"
      w2 = $"MRM Data Cluster In"
    }
    frame No Error {
      Property Node(instance in=$"MRM Data Cluster In") -> ("SRM Mega Cluster"=w3, instance out=w4)
      Property Node(instance in=w3) -> ("Full IV Curve Raw Data"=w5, "SRM Specific Parameters:Full Spctr Ref"=w6, instance out=w7)
      s1 = $"Error In"  # shift register
      s2 = w7  # shift register
      for {
        w8 = each element of w5
        Property Node(instance in=w8) -> ("Rainbow Sweep Types"=w10, "IV Raw Data Array"=w11)
        s3 = s1  # shift register
        for {
          w12 = each element of w11
          call "Jsc and Voc.gvi"(IV Single Measurement=w12, Points For Average=5, Error In=s3) -> (IV Sweep Data Out=w21, Error Out=w22)
          call "FF and Efficiency.gvi"(IV Sweep Data In=w21, IV Single Measurement=w12, Full Spectrum Reference?=w6, Error In=w22) -> (IV Sweep Data Out=w23, Error Out=w24)
          Property Node(instance in=w23) -> ("Rs (Ω · m^2)"=w25, "Rsh (Ω · m^2)"=w26, "Jsc (A/m^2)"=w27, "Voc (V)"=w28, "FF (%)"=w29, "Efficiency (%)"=w30, "Dividing Wavelength (nm)"=w31, "Light Power Density (W/m^2)"=w32)
          Property Node(instance in=w12) -> ("Total Light Power Density (W/m^2)"=w33)
          append w32 to w13
          append w31 to w14
          append w30 to w15
          append w29 to w16
          append w28 to w17
          append w27 to w18
          append w26 to w19
          append w25 to w20
          next s3 = w24
        }
        Property Node(instance in="IV Refined Full Sweep Data.gtype" {all zero or empty}, "Rs (Ω · m^2)"=w20, "Rsh (Ω · m^2)"=w19, "Jsc (A/m^2)"=w18, "Voc (V)"=w17, "FF (%)"=w16, "Efficiency (%)"=w15, "Dividing Wavelength (nm)"=w14, "Light Power Density (W/m^2)"=w13) -> (instance out=w34)
        Property Node(instance in="IV Full Data Cluster.gtype" {all zero or empty}, "IV Measurements Array"=w11, "Rainbow Sweep Types"=w10, "IV Refined Data"=w34, "Total Light Power Density (W/m^2)"=w33) -> (instance out=w35)
        append w35 to w9
        next s1 = s3
      }
      Property Node(instance in=s2, "SRM Full IV data Array"=w9) -> (instance out=w36)
      Property Node(instance in=w4, "SRM Mega Cluster"=w36) -> (instance out=w2)
      w1 = s1
    }
  }
  $"Error Out" <- w1
  $"MRM Data Cluster Out" <- w2
