vi "MRM Data Array Initialize.gvi"   [LabVIEW NXG 5.0.0]
inputs:
  "Error In": error
  "MRM Operation FGV": "S_MRM Operation Control.gtype" = "New Measurement"
  "MRM Mega Cluster In": "MRM Mega Cluster.gtype" = {"MRM Specific Parameters"={"V Points"=1, "Current Avg"=1, "Sweep Speed"="Smart Sweep"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}, "Cell Selector"={FALSE, FALSE, FALSE, FALSE, FALSE, FALSE, FALSE, FALSE, FALSE, FALSE, FALSE, FALSE, FALSE, FALSE, FALSE, FALSE, FALSE, FALSE, FALSE, FALSE, FALSE, FALSE, FALSE, FALSE, FALSE, FALSE, FALSE, FALSE}, "Cells to Measure Array"=[], "Rainbow Sweep Parameters MRM"={0, 900, 400, 1, 1, 0}, "MRM Data Array"=[]}
outputs:
  "Error Out": error
  "MRM Mega Cluster Out": "MRM Mega Cluster.gtype"
types:
  "S_MRM Operation Control.gtype" = enum{"New Measurement", "Load Measurement", "Save Measurement"}
  "Sweep Speed Selector.gtype" = enum{"Smart Sweep", "Fast Sweep", "Normal Sweep"}
  "MRM Specific Parameters.gtype" = cluster{"Max (V)": f64, "Min (V)": f64, "V Points": u32, "Curr Range (A)": f64, "Sweep Dir": bool, "Current Avg": u32, "Max (A)": f64, "PLC Speed": f64, "Cell Area (m^2)": f64, "Autorange": bool, "Full Spctr Ref": bool, "Sweep Speed": "Sweep Speed Selector.gtype"}
  T1 = cluster{"L.01": bool, "R.01": bool, "L.02": bool, "R.02": bool, "L.03": bool, "R.03": bool, "L.04": bool, "R.04": bool, "L.05": bool, "R.05": bool, "L.06": bool, "R.06": bool, "L.07": bool, "R.07": bool, "L.08": bool, "R.08": bool, "L.09": bool, "R.09": bool, "L.10": bool, "R.10": bool, "L.11": bool, "R.11": bool, "L.12": bool, "R.12": bool}
  "MRM Cell Selector.gtype" = cluster{"All": bool, "Left": bool, "Right": bool, "Cell Cluster": T1, "Reset": bool}
  "XZ Stage Cell.gtype" = enum{"L.01", "L.02", "L.03", "L.04", "L.05", "L.06", "L.07", "L.08", "L.09", "L.10", "L.11", "L.12", "R.01", "R.02", "R.03", "R.04", "R.05", "R.06", "R.07", "R.08", "R.09", "R.10", "R.11", "R.12"}
  "Selected Cells Array.gtype" = "XZ Stage Cell.gtype"[]
  "Raibow Sweep Selector.gtype" = enum{"Red Sweep", "Blue Sweep", "Full Sweep Red First", "Full Sweep Blue First"}
  "Rainbow Sweep Param Selector.gtype" = cluster{"Raibow Sweep Selector": "Raibow Sweep Selector.gtype", "Max Wavelength (nm)": f64, "Min Wavelength (nm)": f64, "Wavelength Step (nm)": f64, "Rainbow Sweep Type Selector": "Rainbow Sweep Type Selector.gtype"}
  T2 = enum{"L.01", "L.02", "L.03", "L.04", "L.05", "L.06", "L.07", "L.08", "L.09", "L.10", "L.11", "L.12", "R.01", "R.02", "R.03", "R.04", "R.05", "R.06", "R.07", "R.08", "R.09", "R.10", "R.11", "R.12"}
  "MRM Full Data From SRM Cluster.gtype" = cluster{"SRM Mega Cluster": "SRM Mega Cluster.gtype", "Cell Label": T2}
  "MRM Mega Cluster.gtype" = cluster{"MRM Specific Parameters": "MRM Specific Parameters.gtype", "Cell Selector": "MRM Cell Selector.gtype", "Cells to Measure Array": "Selected Cells Array.gtype", "Rainbow Sweep Parameters MRM": "Rainbow Sweep Param Selector.gtype", "MRM Data Array": "MRM Full Data From SRM Cluster.gtype"[]}
uses:
  Rainbow Measurement Setup::Main Functions::Rainbow Measurement::Cell Multiple Rainbow Measurement::MRM Cell Selector::Cell Array Creator.gvi
  Rainbow Measurement Setup::Main Functions::Rainbow Measurement::Cell Multiple Rainbow Measurement::MRM Data Array::MRM To SRM Specific Parameters.gvi
diagram:
  # This SubVI Initializes the MRM Full data array with all the cell labels that will be needed to measure
  # the multiple solar cells. It sets them within the array and it also sets the MRM Rainbow parameters
  # as well as the sweep parameters for each and every one of the single cells so that to the further
  # software down the line it appears as if it was measuring single cells (this allows us to reuse most of the software.
  case ($"Error In") {
    frame Error, Default {
      w1 = $"Error In"
      w2 = $"MRM Mega Cluster In"
    }
    frame No Error {
      call "Cell Array Creator.gvi"(MRM Mega Cluster In=$"MRM Mega Cluster In", Error In=$"Error In") -> (MRM Mega Cluster Out=w3, Error Out=w4)
      case ($"MRM Operation FGV") {
        frame "Load Measurement" {
          Property Node(instance in=w3, "MRM Data Array"="MRM Full Data From SRM Cluster.gtype"[] []) -> (instance out=w2)
          w1 = w4
        }
        frame "Save Measurement" {
          w2 = w3
          w1 = w4
        }
        frame "New Measurement", Default {
          Property Node(instance in=w3) -> ("Cells to Measure Array"=w5, "Rainbow Sweep Parameters MRM"=w6, "MRM Specific Parameters"=w7, instance out=w8)
          call "MRM To SRM Specific Parameters.gvi"(MRM Specific Parameters=w7, Error In=w4) -> (SRM Specific Parameters=w9, Error Out=w1)
          for {
            w10 = each element of w5
            Property Node(instance in="MRM Full Data From SRM Cluster.gtype" {all zero or empty}, "Cell Label"=w10, "SRM Mega Cluster:Rainbow Sweep Parameters SRM"=w6, "SRM Mega Cluster:SRM Specific Parameters"=w9) -> (instance out=w12)
            append w12 to w11
          }
          Property Node(instance in=w8, "MRM Data Array"=w11) -> (instance out=w2)
        }
      }
    }
  }
  $"MRM Mega Cluster Out" <- w2
  $"Error Out" <- w1
