vi "MRM To SRM Specific Parameters.gvi"   [LabVIEW NXG 5.0.0]
inputs:
  "Error In": error
  "MRM Specific Parameters": "MRM Specific Parameters.gtype" = {"Max (V)"=1.2, "Min (V)"=-0.5, "V Points"=100, "Curr Range (A)"=0, "Sweep Dir"=FALSE, "Current Avg"=3, "Max (A)"=0.1, "Integration Time"=0.5, "Cell Area (m^2)"=8e-06, "Autorange"=TRUE, "Full Spctr Ref"=TRUE}
outputs:
  "Error Out": error
  "SRM Specific Parameters": "SRM Specific Parameters.gtype"
types:
  "MRM Specific Parameters.gtype" = cluster{"Max (V)": f64, "Min (V)": f64, "V Points": u32, "Curr Range (A)": f64, "Sweep Dir": bool, "Current Avg": u32, "Max (A)": f64, "Integration Time": f64, "Cell Area (m^2)": f64, "Autorange": bool, "Full Spctr Ref": bool}
  "SRM Specific Parameters.gtype" = cluster{"Max (V)": f64, "Min (V)": f64, "V Points": u32, "Current Range (A)": f64, "Autorange": bool, "Sweep Dir": bool, "Current Averages": u32, "Max (A)": f64, "Integration Time": f64, "Cell Area (m^2)": f64, "Full Spctr Ref": bool}
diagram:
  # This subVI transforms MRM specific
  # to SRM specific parameters
  case ($"Error In") {
    frame Error, Default {
      w1 = $"Error In"
      w2 = default
    }
    frame No Error {
      Property Node(instance in=$"MRM Specific Parameters") -> ("Max (V)"=w3, "Min (V)"=w4, "V Points"=w5, "Curr Range (A)"=w6, "Sweep Dir"=w7, "Current Avg"=w8, "Max (A)"=w9, "Integration Time"=w10, "Cell Area (m^2)"=w11, "Autorange"=w12, "Full Spctr Ref"=w13)
      w14 = "SRM Specific Parameters.gtype" {"Max (V)"=1.2, "Min (V)"=-0.5, "V Points"=100, "Current Range (A)"=0, "Autorange"=TRUE, "Sweep Dir"=FALSE, "Current Averages"=3, "Max (A)"=0.1, "Integration Time"=0.5, "Cell Area (m^2)"=8e-06, "Full Spctr Ref"=TRUE}
      Property Node(instance in=w14, "Max (V)"=w3, "Min (V)"=w4, "V Points"=w5, "Current Range (A)"=w6, "Autorange"=w12, "Sweep Dir"=w7, "Current Averages"=w8, "Max (A)"=w9, "Integration Time"=w10, "Cell Area (m^2)"=w11, "Full Spctr Ref"=w13) -> (instance out=w2)
      w1 = $"Error In"
    }
  }
  $"Error Out" <- w1
  $"SRM Specific Parameters" <- w2
