vi "MRM FGV Read Handler.gvi"   [LabVIEW NXG 5.0.0]
inputs:
  "MRM sweep live parameters FGV Cluster In": "MRM Sweep Live Parameters FGV Cluster.gtype"
  "Misc Data Mega Cluster In": "Misc Data Mega Cluster.gtype"
  "Error In": error
outputs:
  "MRM sweep live parameters FGV Cluster Out": "MRM Sweep Live Parameters FGV Cluster.gtype"
  "Misc Data Mega Cluster Out": "Misc Data Mega Cluster.gtype"
  "Error Out": error
types:
  "XZ Stage Cell.gtype" = enum{"L.01", "L.02", "L.03", "L.04", "L.05", "L.06", "L.07", "L.08", "L.09", "L.10", "L.11", "L.12", "R.01", "R.02", "R.03", "R.04", "R.05", "R.06", "R.07", "R.08", "R.09", "R.10", "R.11", "R.12"}
  T1 = cluster{"IV Single Measurement Array": "IV Single Measurement.gtype"[], "IV Single Measurement Plot Array": "SRM Single Plot Cluster.gtype"[], "Full IV Data Array": "IV Full Raw Data.gtype"[], "Measured Cell": "XZ Stage Cell.gtype"}
  "SRM Single Plot Cluster.gtype" = cluster{"Voltage (V)": f64[], "Current Density (A/m^2)": f64[]}
  "MRM Sweep Live Parameters FGV Cluster.gtype" = cluster{"Refresh now": bool, "All Cell Measurements": T1[], "IV Current Selected Cell Plot": "SRM Single Plot Cluster.gtype"[], "Counter": f64}
  T2 = cluster{"IV Extracted Parameter Plot ": "Graph reference", "MRM Cell Selector Ref": "Cluster reference", "IV Plot Out Multiple Reference": "Graph reference", "Rainbow Sweep Parameters MRM Ref": "Cluster reference", "MRM Specific Parameters Ref": "Cluster reference", "MRM Cell Refined Plot Selector ref": "ComboBoxSelector reference", "MRM Current Raw Cell Plot": "ComboBoxSelector reference", "MRM Raw Plot Rainbow Sweep Relector Ref": "ComboBoxSelector reference"}
  T3 = cluster{"SRM Light Power Density Ref": "NumericTextBoxDouble reference", "Rainbow Sweep Parameters RSM": "Cluster reference", "SRM Refined Plot Rainbow Sweep Types": "ComboBoxSelector reference", "SRM Specific Parameters": "Cluster reference", "Sweep Live Parameters RSM": "Cluster reference", "SRM Raw Plot Rainbow Sweep Selector": "ComboBoxSelector reference", "SRM Plot Parameter Selector Ref": "EnumSelector reference", "IV Plot Out Ref": "Graph reference"}
  T4 = cluster{"Calibration Files Path": "PathSelector reference", "Default Data Saving Location": "PathSelector reference"}
  T5 = cluster{"Main Tab": "TabControl reference", "Rainbow Measurement tab": "TabControl reference", "Configuration tab": "TabControl reference", "Light Calibration tab": "TabControl reference"}
  T6 = cluster{"Custom date": "CheckBox reference", "Batch Name": "StringControl reference", "Author Initials": "ComboBoxSelector reference", "Cell Number": "StringControl reference", "Current Date": "StringControl reference", "Sample Comments": "StringControl reference", "Sample Prefix": "StringControl reference", "Label Info Missing Error": "BooleanControl reference", "Label Info Error Label": "StringControl reference"}
  T7 = cluster{"Beam Power Density": "IntensityGraph reference"[][], "Irradiance Calibration": "Graph reference"[], "MSpot Spectrum Calibration Parameters": "Cluster reference", "Rainbow Sweep Param Selector MSpot": "Cluster reference"}
  T8 = cluster{"LPC Parameters Ref": "Cluster reference", "Sweep Live Parameters LPC ref": "Cluster reference", "Light Power Calibration": "Graph reference", "Light Power Calibration Data Ref": "ArrayViewer reference", "Rainbow Sweep Parameters LPC": "Cluster reference"}
  T9 = cluster{"Current State Ref": "EnumSelector reference", "Substate": "StringControl reference", "State": "StringControl reference", "Current Substate": "StringControl reference"}
  T10 = cluster{"Custom Position": "BooleanControl reference", "Set Position": "BooleanControl reference", "XZ Stage Active": "BooleanControl reference", "Release XZ Stage": "BooleanControl reference", "XZ Coordinates": "Cluster reference", "Activate XZ Stage": "BooleanControl reference", "XZ Stage Cell Reference": "EnumSelector reference", "XZ All Position Cluster Ref": "Cluster reference"}
  "Full Reference Cluster.gtype" = cluster{"MRM Reference Cluster": T2, "SRM Reference Cluster": T3, "Path Reference Cluster": T4, "Tab Reference Cluster": T5, "Cell Naming Parameters Ref Cluster": T6, "One Time Calibrations Ref Cluster": T7, "LPC Controls Reference Cluster": T8, "System Parameters Ref Cluster": T9, "XZ Stage Controls Reference Cluster": T10}
  T11 = cluster{"X Coordinate (mm)": f64, "Z Coordinate (mm)": f64, "Aprch Distance (mm)": f64}
  T12 = cluster{"X Coordinate (mm)": f64, "Z Coordinate (mm)": f64, "Vertical Spacing (mm)": f64, "Aprch Distance (mm)": f64, "Aprch Dstnc L.12 (mm)": f64}
  "XZ All Position Cluster.gtype" = cluster{"Diffusor Coordinates": T11, "Photodetector Coordinates": T11, "Cell R.01 Coordinates": T12}
  T13 = cluster{"Thorlabs Motor Serial Number File Path": path, "Default Data Saving Location": path}
  "Cell Naming Cluster.gtype" = cluster{"Cell Label": string, "Sample Prefix": string, "Author Initials": string, "Current Date": string, "Batch Name": string}
  "Misc Data Mega Cluster.gtype" = cluster{"Full Reference Cluster": "Full Reference Cluster.gtype", "All XZ Position Cluster": "XZ All Position Cluster.gtype", "All Paths": T13, "Cell Naming Cluster": "Cell Naming Cluster.gtype"}
uses:
  Rainbow Measurement Setup::Main Functions::Rainbow Measurement::Cell Multiple Rainbow Measurement::MRM Live Parameters::FGV Controls Raw Plat Changed Value.gvi
  Rainbow Measurement Setup::Main Functions::Rainbow Measurement::Cell Multiple Rainbow Measurement::Plotting::MRM Raw Data Graph Adapter.gvi
diagram:
  # This SubVI Takes care of selecting the right set of data to plot from the SRM Sweep Raw Data and it also sets both the name of the available plots and the dividing wavelength that corresponds to each and
  # every plot within the graph. It does so every now and then to prevent being too wasteful on resources.
  case ($"Error In") {
    frame Error, Default {
      w1 = $"Error In"
      w2 = $"MRM sweep live parameters FGV Cluster In"
      w3 = $"Misc Data Mega Cluster In"
    }
    frame No Error {
      Property Node(instance in=$"MRM sweep live parameters FGV Cluster In") -> ("All Cell Measurements"=w4, "Refresh now"=w5, "Counter"=w6, "IV Current Selected Cell Plot"=w7, instance out=w8)
      Property Node(instance in=$"Misc Data Mega Cluster In") -> ("Full Reference Cluster:MRM Reference Cluster:MRM Current Raw Cell Plot"=w9, "Full Reference Cluster:MRM Reference Cluster:IV Plot Out Multiple Reference"=w10, "Full Reference Cluster:MRM Reference Cluster:MRM Raw Plot Rainbow Sweep Relector Ref"=w11, instance out=w3)
      Property Node(instance in=w9, error in=$"Error In") -> ("Value"=w12, error out=w13)
      call "FGV Controls Raw Plat Changed Value.gvi"(FGV Instructions="Read State", Misc Data Mega Cluster In=w3, Error In=w13) -> (Changed?=w14, Error Out=w15)
      Logical Or(w14, w5) -> w16
      s1 = uninitialised  # shift register
      for {
        w17 = each element of w4
        Property Node(instance in=w17) -> ("Measured Cell"=w19, instance out=w20)
        Format Into String(errIn=s1, w19) -> (outString=w21, errOut=w22)
        Is Equal(x=w12, y=w21) -> w23
        w18 = w20 if w23
        next s1 = w22
        stop if w23
      }
      Property Node(instance in=w18) -> ("IV Single Measurement Array"=w24, "Full IV Data Array"=w25)
      Property Node(instance in=w11, error in=w15) -> ("Value"=w26, error out=w27, instance out=w28)
      case (w16) {
        frame False, Default {
          w29 = w7
          w30 = w27
          w31 = w24
          w32 = w28
          w33 = default
        }
        frame True {
          for {
            w34 = each element of w25
            Property Node(instance in=w34) -> ("Rainbow Sweep Types"=w35, "IV Raw Data Array"=w36)
            Format Into String(w35) -> w37
            Is Equal(x=w26, y=w37) -> w38
            w31 = w36 if w38
          }
          call "MRM Raw Data Graph Adapter.gvi"(IV Single Measurement Array=w31, Error In=w27, Latest Measurement?=FALSE) -> (IV Plot Out=w29, Error Out=w30)
          w32 = w28
          w33 = TRUE
        }
      }
      Increment(x=w6) -> w39
      Is Greater(x=w39, y=50) -> w40
      Logical Or(w40, w5) -> w41
      case (w41) {
        frame False, Default {
          w1 = w30
          w42 = w39
          w43 = default
        }
        frame True {
          s2 = w30  # shift register
          for (iteration -> i1) {
            w44 = each element of w31
            Property Node(instance in=w10, "ActivePlot"=i1, error in=s2) -> ("Plot"=w45, error out=w46)
            Property Node(instance in=w44) -> ("Dividing Wavelength (nm)"=w47)
            Format Into String(formatString="%d", w47) -> w48
            Concatenate Strings(w48, " nm") -> w49
            Property Node(instance in=w45, "Name"=w49, error in=w46) -> (error out=w50, instance out=w51)
            next s2 = w50
          }
          for {
            w52 = each element of w25
            Property Node(instance in=w52) -> ("Rainbow Sweep Types"=w54)
            Format Into String(w54) -> w55
            append w55 to w53
          }
          Property Node(instance in=w32, "Items"=w53, error in=s2) -> (error out=w1)
          w42 = 0
          w43 = TRUE
        }
      }
      Logical And[output inverted](w43, w33) -> w56
      Select(s=w5, t=w56, f=FALSE) -> w57
      Property Node(instance in=w8, "Counter"=w42, "IV Current Selected Cell Plot"=w29, "Refresh now"=w57) -> (instance out=w2)
    }
  }
  $"Misc Data Mega Cluster Out" <- w3
  $"MRM sweep live parameters FGV Cluster Out" <- w2
  $"Error Out" <- w1
