vi "MRM Sweep Live Parameters Extractor.gvi"   [LabVIEW NXG 5.0.0]
inputs:
  "Error In": error
  "MRM sweep live parameters FGV Cluster New State": "MRM Sweep Live Parameters FGV Cluster.gtype"
  "MRM sweep live parameters FGV Cluster Previous State": "MRM Sweep Live Parameters FGV Cluster.gtype"
  "Misc Data Mega Cluster In": "Misc Data Mega Cluster.gtype"
outputs:
  "Error Out": error
  "MRM sweep live parameters FGV Cluster Out": "MRM Sweep Live Parameters FGV Cluster.gtype"
  "Misc Data Mega Cluster Out": "Misc Data Mega Cluster.gtype"
types:
  "XZ Stage Cell.gtype" = enum{"L.01", "L.02", "L.03", "L.04", "L.05", "L.06", "L.07", "L.08", "L.09", "L.10", "L.11", "L.12", "R.01", "R.02", "R.03", "R.04", "R.05", "R.06", "R.07", "R.08", "R.09", "R.10", "R.11", "R.12"}
  T1 = cluster{"IV Single Measurement Array": "IV Single Measurement.gtype"[], "IV Single Measurement Plot Array": "SRM Single Plot Cluster.gtype"[], "Full IV Data Array": "IV Full Raw Data.gtype"[], "Measured Cell": "XZ Stage Cell.gtype"}
  "SRM Single Plot Cluster.gtype" = cluster{"Voltage (V)": f64[], "Current Density (A/m^2)": f64[]}
  "MRM Sweep Live Parameters FGV Cluster.gtype" = cluster{"Refresh now": bool, "All Cell Measurements": T1[], "IV Current Selected Cell Plot": "SRM Single Plot Cluster.gtype"[], "Counter": f64}
  T2 = cluster{"IV Extracted Parameter Plot ": "Graph reference", "MRM Cell Selector Ref": "Cluster reference", "IV Plot Out Multiple Reference": "Graph reference", "Rainbow Sweep Parameters MRM Ref": "Cluster reference", "MRM Specific Parameters Ref": "Cluster reference", "MRM Cell Refined Plot Selector ref": "ComboBoxSelector reference", "MRM Current Raw Cell Plot": "ComboBoxSelector reference", "MRM Raw Plot Rainbow Sweep Relector Ref": "ComboBoxSelector reference"}
  T3 = cluster{"SRM Light Power Density Ref": "NumericTextBoxDouble reference", "Rainbow Sweep Parameters RSM": "Cluster reference", "SRM Refined Plot Rainbow Sweep Types": "ComboBoxSelector reference", "SRM Specific Parameters": "Cluster reference", "Sweep Live Parameters RSM": "Cluster reference", "SRM Raw Plot Rainbow Sweep Selector": "ComboBoxSelector reference", "SRM Plot Parameter Selector Ref": "EnumSelector reference", "IV Plot Out Ref": "Graph reference"}
  T4 = cluster{"Calibration Files Path": "PathSelector reference", "Default Data Saving Location": "PathSelector reference"}
  T5 = cluster{"Main Tab": "TabControl reference", "Rainbow Measurement tab": "TabControl reference", "Configuration tab": "TabControl reference", "Light Calibration tab": "TabControl reference"}
  T6 = cluster{"Custom date": "CheckBox reference", "Batch Name": "StringControl reference", "Author Initials": "ComboBoxSelector reference", "Cell Number": "StringControl reference", "Current Date": "StringControl reference", "Sample Comments": "StringControl reference", "Sample Prefix": "StringControl reference", "Label Info Missing Error": "BooleanControl reference", "Label Info Error Label": "StringControl reference"}
  T7 = cluster{"Beam Power Density": "IntensityGraph reference"[][], "Irradiance Calibration": "Graph reference"[], "MSpot Spectrum Calibration Parameters": "Cluster reference", "Rainbow Sweep Param Selector MSpot": "Cluster reference"}
  T8 = cluster{"LPC Parameters Ref": "Cluster reference", "Sweep Live Parameters LPC ref": "Cluster reference", "Light Power Calibration": "Graph reference", "Light Power Calibration Data Ref": "ArrayViewer reference", "Rainbow Sweep Parameters LPC": "Cluster reference"}
  T9 = cluster{"Current State Ref": "EnumSelector reference", "Substate": "StringControl reference", "State": "StringControl reference", "Current Substate": "StringControl reference"}
  T10 = cluster{"Custom Position": "BooleanControl reference", "Set Position": "BooleanControl reference", "XZ Stage Active": "BooleanControl reference", "Release XZ Stage": "BooleanControl reference", "XZ Coordinates": "Cluster reference", "Activate XZ Stage": "BooleanControl reference", "XZ Stage Cell Reference": "EnumSelector reference", "XZ All Position Cluster Ref": "Cluster reference"}
  "Full Reference Cluster.gtype" = cluster{"MRM Reference Cluster": T2, "SRM Reference Cluster": T3, "Path Reference Cluster": T4, "Tab Reference Cluster": T5, "Cell Naming Parameters Ref Cluster": T6, "One Time Calibrations Ref Cluster": T7, "LPC Controls Reference Cluster": T8, "System Parameters Ref Cluster": T9, "XZ Stage Controls Reference Cluster": T10}
  T11 = cluster{"X Coordinate (mm)": f64, "Z Coordinate (mm)": f64, "Aprch Distance (mm)": f64}
  T12 = cluster{"X Coordinate (mm)": f64, "Z Coordinate (mm)": f64, "Vertical Spacing (mm)": f64, "Aprch Distance (mm)": f64, "Aprch Dstnc L.12 (mm)": f64}
  "XZ All Position Cluster.gtype" = cluster{"Diffusor Coordinates": T11, "Photodetector Coordinates": T11, "Cell R.01 Coordinates": T12}
  T13 = cluster{"Thorlabs Motor Serial Number File Path": path, "Default Data Saving Location": path}
  "Cell Naming Cluster.gtype" = cluster{"Cell Label": string, "Sample Prefix": string, "Author Initials": string, "Current Date": string, "Batch Name": string}
  "Misc Data Mega Cluster.gtype" = cluster{"Full Reference Cluster": "Full Reference Cluster.gtype", "All XZ Position Cluster": "XZ All Position Cluster.gtype", "All Paths": T13, "Cell Naming Cluster": "Cell Naming Cluster.gtype"}
uses:
  Rainbow Measurement Setup::Main Functions::Rainbow Measurement::Cell Multiple Rainbow Measurement::Plotting::MRM Raw Data Graph Adapter.gvi
diagram:
  # This SubVI Checks if the input cluster has some empty values and for each empty value it keeps the value it had before.
  # Otherwise it changes to the new value
  case ($"Error In") {
    frame Error, Default {
      w1 = $"Error In"
      w2 = $"MRM sweep live parameters FGV Cluster Previous State"
      w3 = $"Misc Data Mega Cluster In"
    }
    frame No Error {
      Property Node(instance in=$"MRM sweep live parameters FGV Cluster Previous State") -> ("All Cell Measurements"=w4, "IV Current Selected Cell Plot"=w5, "Refresh now"=w6, instance out=w7)
      Property Node(instance in=$"MRM sweep live parameters FGV Cluster New State") -> ("All Cell Measurements"=w8, "IV Current Selected Cell Plot"=w9, "Refresh now"=w10)
      Is Empty Array(array=w8) -> w11
      Select(s=w11, t=w4, f=w8) -> w12
      Logical Or(w10, w6) -> w13
      call "MRM Raw Data Graph Adapter.gvi"(All Cell Measurements=w12, Error In=$"Error In", Latest Measurement?=TRUE) -> (IV Plot Out=w14, Error Out=w15)
      Array Index(array=w12) -> (out0[0]=w16)
      Property Node(instance in=w16) -> ("Full IV Data Array"=w17)
      Property Node(instance in=$"Misc Data Mega Cluster In") -> ("Full Reference Cluster:MRM Reference Cluster:MRM Raw Plot Rainbow Sweep Relector Ref"=w18, instance out=w3)
      case (w13) {
        frame False, Default {
          w1 = w15
          w19 = w13
        }
        frame True {
          for {
            w20 = each element of w17
            Property Node(instance in=w20) -> ("Rainbow Sweep Types"=w21)
            Format Into String(w21) -> w22
          }
          Property Node(instance in=w18, "ValueSignaling"=w22, error in=w15) -> (error out=w1)
          w19 = w13
        }
      }
      Is Empty Array(array=w9) -> w23
      Select(s=w23, t=w5, f=w9) -> w24
      Is Empty Array(array=w14) -> w25
      Select(s=w25, t=w24, f=w14) -> w26
      Property Node(instance in=w7, "All Cell Measurements"=w12, "IV Current Selected Cell Plot"=w26, "Refresh now"=w19) -> (instance out=w2)
    }
  }
  $"Misc Data Mega Cluster Out" <- w3
  $"Error Out" <- w1
  $"MRM sweep live parameters FGV Cluster Out" <- w2
