vi "MRM Sweep Live Parameters FGV.gvi"   [LabVIEW NXG 5.0.0]
inputs:
  "Error In": error
  "FGV Instructions": "General FGV Instructions.gtype" = "Read State", required
  "MRM sweep live parameters FGV Cluster In": "MRM Sweep Live Parameters FGV Cluster.gtype"
  "Misc Data Mega Cluster In": "Misc Data Mega Cluster.gtype"
outputs:
  "Error Out": error
  "IV Plot Out": "SRM Single Plot Cluster.gtype"[]
  "MRM sweep live parameters FGV cluster out": "MRM Sweep Live Parameters FGV Cluster.gtype"
panel indicators:
  "Refresh now": bool
  "All Cell Measurements": T1[]
  "IV Current Selected Cell Plot": "SRM Single Plot Cluster.gtype"[]
  "Counter": f64
types:
  "General FGV Instructions.gtype" = enum{"Read State", "Set State", "Reset State"}
  "SRM Single Plot Cluster.gtype" = cluster{"Voltage (V)": f64[], "Current Density (A/m^2)": f64[]}
  "XZ Stage Cell.gtype" = enum{"L.01", "L.02", "L.03", "L.04", "L.05", "L.06", "L.07", "L.08", "L.09", "L.10", "L.11", "L.12", "R.01", "R.02", "R.03", "R.04", "R.05", "R.06", "R.07", "R.08", "R.09", "R.10", "R.11", "R.12"}
  T1 = cluster{"IV Single Measurement Array": "IV Single Measurement.gtype"[], "IV Single Measurement Plot Array": "SRM Single Plot Cluster.gtype"[], "Full IV Data Array": "IV Full Raw Data.gtype"[], "Measured Cell": "XZ Stage Cell.gtype"}
  "MRM Sweep Live Parameters FGV Cluster.gtype" = cluster{"Refresh now": bool, "All Cell Measurements": T1[], "IV Current Selected Cell Plot": "SRM Single Plot Cluster.gtype"[], "Counter": f64}
  "Full Reference Cluster.gtype" = cluster{"Enum Reference Cluster": "Enum Control Reference Cluster.gtype", "Boolean Reference Cluster": "Boolean Control Reference Cluster.gtype", "Numeric Reference Cluster": "Numeric Control Reference Cluster.gtype", "Numeric Cluster Reference Cluster": "Numeric Cluster Reference Cluster.gtype", "Path Reference Cluster": "Path Reference Cluster.gtype", "Cluster Reference Cluster": "Cluster Reference Cluster.gtype", "XZ Stage Controls Reference Cluster": "XZ Stage Controls Reference Cluster.gtype"}
  "Cell Naming Cluster.gtype" = cluster{"Cell Label": string, "Sample Prefix": string, "Author Initials": string, "Current Date": string, "Batch Name": string}
  T2 = cluster{"X Coordinate (mm)": f64, "Z Coordinate (mm)": f64}
  T3 = cluster{"X Coordinate (mm)": f64, "Z Coordinate (mm)": f64, "Vertical Spacing (mm)": f64}
  "XZ All Position Cluster.gtype" = cluster{"Diffusor Coordinates": T2, "Photodetector Coordinates": T2, "Cell R.01 Coordinates": T3}
  T4 = cluster{"Thorlabs Motor Serial Number File Path": path, "Default Data Saving Location": path}
  "Misc Data Mega Cluster.gtype" = cluster{"Full Reference Cluster": "Full Reference Cluster.gtype", "Cell Naming Cluster": "Cell Naming Cluster.gtype", "All XZ Position Cluster": "XZ All Position Cluster.gtype", "All Paths": T4}
  "IV Single Measurement.gtype" = cluster{"Voltage (V)": f64[], "Current (A)": f64[], "Current Density (A/m^2)": f64[], "Dividing Wavelength (nm)": f64, "Light Power Density (W/m^2)": f64, "Total Light Power Density (W/m^2)": f64}
  "Rainbow Sweep Types.gtype" = enum{"Red Sweep Closing", "Red Sweep Opening", "Blue Sweep Closing", "Blue Sweep Opening"}
  "IV Full Raw Data.gtype" = cluster{"Rainbow Sweep Types": "Rainbow Sweep Types.gtype", "IV Raw Data Array": "IV Single Measurement.gtype"[]}
uses:
  Rainbow Measurement Setup::Main Functions::Rainbow Measurement::Cell Multiple Rainbow Measurement::MRM Live Parameters::MRM Sweep Live Parameters Extractor.gvi
  Rainbow Measurement Setup::Main Functions::Rainbow Measurement::Cell Multiple Rainbow Measurement::MRM Live Parameters::MRM FGV Read Handler.gvi
diagram:
  # This FGV Stores the SRM live parameters and the plots so that
  # they can be updated live while being measured. It also sets the name
  # of the plots so that you know which color corresponds to each dividing wavelength
  case ($"Error In") {
    frame Error, Default {
      w1 = $"Error In"
    }
    frame No Error {
      s1 = $"Error In"  # shift register
      s2 = uninitialised  # shift register
      s3 = uninitialised  # shift register
      while {
        Property Node(instance in=s2) -> ("Refresh now"=w2, "All Cell Measurements"=w3, "IV Current Selected Cell Plot"=w4, "Counter"=w5, instance out=w6)
        case ($"FGV Instructions") {
          frame "Read State", Default {
            call "MRM Sweep Live Parameters Extractor.gvi"(MRM sweep live parameters FGV Cluster New State=$"MRM sweep live parameters FGV Cluster In", MRM sweep live parameters FGV Cluster Previous State=w6, Misc Data Mega Cluster In=s3, Error In=s1) -> (MRM sweep live parameters FGV Cluster Out=w10, Misc Data Mega Cluster Out=w11, Error Out=w12)
            call "MRM FGV Read Handler.gvi"(MRM sweep live parameters FGV Cluster In=w10, Misc Data Mega Cluster In=w11, Error In=w12) -> (MRM sweep live parameters FGV Cluster Out=w13, Misc Data Mega Cluster Out=w9, Error Out=w7)
            Property Node(instance in=w13) -> ("IV Current Selected Cell Plot"=w14, instance out=w8)
            $"MRM sweep live parameters FGV cluster out" <- w8
            $"IV Plot Out" <- w14
          }
          frame "Set State" {
            call "MRM Sweep Live Parameters Extractor.gvi"(MRM sweep live parameters FGV Cluster New State=$"MRM sweep live parameters FGV Cluster In", MRM sweep live parameters FGV Cluster Previous State=w6, Misc Data Mega Cluster In=s3, Error In=s1) -> (MRM sweep live parameters FGV Cluster Out=w8, Misc Data Mega Cluster Out=w9, Error Out=w7)
          }
          frame "Reset State" {
            w7 = s1
            w8 = default
            w9 = $"Misc Data Mega Cluster In"
          }
        }
        $"Refresh now" <- w2
        $"All Cell Measurements" <- w3
        $"IV Current Selected Cell Plot" <- w4
        $Counter <- w5
        next s1 = w7
        next s2 = w8
        next s3 = w9
        stop if TRUE
      }
      w1 = s1
    }
  }
  $"Error Out" <- w1
