vi "MRM Operation Translator.gvi"   [LabVIEW NXG 5.0.0]
inputs:
  "Error In": error
  "Acquire Multiple Rainbow Button": bool
  "Load Multiple Measurement": bool
  "Save Multiple Measurement": bool
outputs:
  "Error Out": error
uses:
  Rainbow Measurement Setup::Main Functions::Rainbow Measurement::Cell Multiple Rainbow Measurement::MRM Operation FGV.gvi
diagram:
  # This SubVI Checks which button has been pressed and
  # decides the operation that needs to be done.
  # If more than one button was pressed it prompts the user
  # to not press so many buttons at the same time.
  # It also stores the desired output on an FGV For further use
  # on other independent subVIs
  case ($"Error In") {
    frame Error, Default {
      w1 = $"Error In"
    }
    frame No Error {
      Logical And($"Save Multiple Measurement", $"Acquire Multiple Rainbow Button") -> w2
      Logical And($"Acquire Multiple Rainbow Button", $"Load Multiple Measurement") -> w3
      Logical And($"Save Multiple Measurement", $"Load Multiple Measurement") -> w4
      Logical Or(w2, w3, w4) -> w5
      case (w5) {
        frame False, Default {
          Select(s=$"Save Multiple Measurement", t="Save Measurement", f="Load Measurement") -> w7
          Select(s=$"Acquire Multiple Rainbow Button", t="New Measurement", f=w7) -> w6
        }
        frame True {
          w8 = "Please do not Press all the buttons\nat once, otherwise I do not know what\nyou want me to do first :("
          w9 = "Oh, sorry I will press them\none by one, while waiting for\nyou to finish."
          One Button Dialog(button name ("OK")=w9, message=w8)
          w6 = "Load Measurement"
        }
      }
      call "MRM Operation FGV.gvi"(FGV Instructions="Set State", MRM Operation Control In=w6, Error In=$"Error In") -> (Error Out=w1)
    }
  }
  $"Error Out" <- w1
