vi "MRM Rainbow Sweep.gvi"   [LabVIEW NXG 5.0.0]
inputs:
  "Error In": error
  "Instrument Control Mega Cluster In": "Instrument Control Mega Cluster.gtype"
  "LPC Mega Cluster In": "LPC Mega Cluster.gtype"
  "MRM Mega Cluster In": "MRM Mega Cluster.gtype" = {"MRM Specific Parameters"={"V Points"=1, "Current Avg"=1, "Sweep Speed"="Smart Sweep"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}, "Cell Selector"={FALSE, FALSE, FALSE, FALSE, FALSE, FALSE, FALSE, FALSE, FALSE, FALSE, FALSE, FALSE, FALSE, FALSE, FALSE, FALSE, FALSE, FALSE, FALSE, FALSE, FALSE, FALSE, FALSE, FALSE, FALSE, FALSE, FALSE, FALSE}, "Cells to Measure Array"=[], "Rainbow Sweep Parameters MRM"={0, 900, 400, 1, 1, 0}, "MRM Data Array"=[]}
  "Misc Data Mega Cluster In": "Misc Data Mega Cluster.gtype"
outputs:
  "Error Out": error
  "Instrument Control Mega Cluster Out": "Instrument Control Mega Cluster.gtype"
  "MRM Mega Cluster Out": "MRM Mega Cluster.gtype"
panel indicators:
  "output array": T3[]
types:
  "Instrument Coms Info.gtype" = cluster{"Arduino Coms Info": "Arduino Detection cluster control.gtype", "Photodetector Names": string[], "Keythley Address": "VISA Instr", "Photodetector Detected?": bool, "Thorlabs Motors Detected?": bool, "Keithley Detected?": bool, "Thorlabs Motors Serial Number": "Thorlabs Motors Serial Number In.gtype", "Photodetector IVI session": "Ivi IviDefault", "Flame ID": string, "Flame Detected?": bool, "Flame Wrapper ID": u64}
  "Debugging Cluster.gtype" = cluster{"Debugging mode?": bool, "Initialize App": bool, "Insturment Debugging": "Insturment Debugging Cluster.gtype"}
  "Instrument Control Mega Cluster.gtype" = cluster{"Instruments Coms Info": "Instrument Coms Info.gtype", "Debugging Cluster": "Debugging Cluster.gtype"}
  "Raibow Sweep Selector.gtype" = enum{"Red Sweep", "Blue Sweep", "Full Sweep Red First", "Full Sweep Blue First"}
  "Rainbow Sweep Param Selector.gtype" = cluster{"Raibow Sweep Selector": "Raibow Sweep Selector.gtype", "Max Wavelength (nm)": f64, "Min Wavelength (nm)": f64, "Wavelength Step (nm)": f64, "Rainbow Sweep Type Selector": "Rainbow Sweep Type Selector.gtype"}
  "Light power Calibration Parameters.gtype" = cluster{"Powermeter Averages": u32, "Photodtctr Area (m^2)": f64, "Only Full Spectrum": bool}
  T1 = cluster{"Dividing Wavelength Array": f64[], "Measured Power Array": f64[], "Power Density Array": f64[]}
  "Rainbow Sweep Types.gtype" = enum{"Red Sweep Closing", "Red Sweep Opening", "Blue Sweep Closing", "Blue Sweep Opening"}
  "Light Power Calibration Data.gtype" = cluster{"Single Light Calibration": T1, "Rainbow Sweep Types": "Rainbow Sweep Types.gtype", "Total Light Power Density (W/m^2)": f64}
  "LPC Mega Cluster.gtype" = cluster{"Rainbow Sweep Parameters LPC": "Rainbow Sweep Param Selector.gtype", "LPC Specific Parameters": "Light power Calibration Parameters.gtype", "Light Power Calibration Data": "Light Power Calibration Data.gtype"[]}
  T2 = cluster{"Isc (A)": f64, "Voc (V)": f64, "FF (%)": f64, "Rs (Ω)": f64, "Rsh (Ω)": f64}
  "IV Single Measurement.gtype" = cluster{"Voltage (V)": f64[], "Current (A)": f64[], "Current Density (A/m^2)": f64[], "Dividing Wavelength (nm)": f64, "Light Power Density (W/m^2)": f64, "Total Light Power Density (W/m^2)": f64, "Smart Sweep Data": T2}
  "SRM Single Plot Cluster.gtype" = cluster{"Voltage (V)": f64[], "Current Density (A/m^2)": f64[]}
  "IV Full Raw Data.gtype" = cluster{"Rainbow Sweep Types": "Rainbow Sweep Types.gtype", "IV Raw Data Array": "IV Single Measurement.gtype"[]}
  "XZ Stage Cell.gtype" = enum{"L.01", "L.02", "L.03", "L.04", "L.05", "L.06", "L.07", "L.08", "L.09", "L.10", "L.11", "L.12", "R.01", "R.02", "R.03", "R.04", "R.05", "R.06", "R.07", "R.08", "R.09", "R.10", "R.11", "R.12"}
  T3 = cluster{"IV Single Measurement Array": "IV Single Measurement.gtype"[], "IV Single Measurement Plot Array": "SRM Single Plot Cluster.gtype"[], "Full IV Data Array": "IV Full Raw Data.gtype"[], "Measured Cell": "XZ Stage Cell.gtype"}
  T4 = cluster{"SRM Light Power Density Ref": "NumericTextBoxDouble reference", "Rainbow Sweep Parameters RSM": "Cluster reference", "SRM Refined Plot Rainbow Sweep Types": "ComboBoxSelector reference", "Sweep Live Parameters RSM": "Cluster reference", "SRM Raw Plot Rainbow Sweep Selector": "ComboBoxSelector reference", "SRM Plot Parameter Selector Ref": "EnumSelector reference", "IV Plot Out Ref": "Graph reference", "SRM Specific Parameters": "Cluster reference"}
  T5 = cluster{"Calibration Files Path": "PathSelector reference", "Default Data Saving Location": "PathSelector reference"}
  T6 = cluster{"Main Tab": "TabControl reference", "Rainbow Measurement tab": "TabControl reference", "Configuration tab": "TabControl reference", "Light Calibration tab": "TabControl reference"}
  T7 = cluster{"Custom date": "CheckBox reference", "Batch Name": "StringControl reference", "Author Initials": "ComboBoxSelector reference", "Cell Number": "StringControl reference", "Current Date": "StringControl reference", "Sample Comments": "StringControl reference", "Sample Prefix": "StringControl reference", "Label Info Missing Error": "BooleanControl reference", "Label Info Error Label": "StringControl reference"}
  T8 = cluster{"Beam Power Density": "IntensityGraph reference"[][], "Irradiance Calibration": "Graph reference"[], "MSpot Spectrum Calibration Parameters": "Cluster reference", "Rainbow Sweep Param Selector MSpot": "Cluster reference"}
  T9 = cluster{"LPC Parameters Ref": "Cluster reference", "Sweep Live Parameters LPC ref": "Cluster reference", "Light Power Calibration": "Graph reference", "Light Power Calibration Data Ref": "ArrayViewer reference", "Rainbow Sweep Parameters LPC": "Cluster reference"}
  T10 = cluster{"Current State Ref": "EnumSelector reference", "Substate": "StringControl reference", "State": "StringControl reference", "Current Substate": "StringControl reference"}
  T11 = cluster{"Custom Position": "BooleanControl reference", "Set Position": "BooleanControl reference", "XZ Stage Active": "BooleanControl reference", "Release XZ Stage": "BooleanControl reference", "XZ Coordinates": "Cluster reference", "Activate XZ Stage": "BooleanControl reference", "XZ Stage Cell Reference": "EnumSelector reference", "XZ All Position Cluster Ref": "Cluster reference"}
  T12 = cluster{"IV Extracted Parameter Plot ": "Graph reference", "MRM Cell Selector Ref": "Cluster reference", "IV Plot Out Multiple Reference": "Graph reference", "Rainbow Sweep Parameters MRM Ref": "Cluster reference", "MRM Cell Refined Plot Selector ref": "ComboBoxSelector reference", "MRM Current Raw Cell Plot": "ComboBoxSelector reference", "MRM Raw Plot Rainbow Sweep Relector Ref": "ComboBoxSelector reference", "MRM Specific Parameters Ref": "Cluster reference"}
  T13 = cluster{"Smart Sweep Mega Cluster Ref": "Cluster reference"}
  "Full Reference Cluster.gtype" = cluster{"SRM Reference Cluster": T4, "Path Reference Cluster": T5, "Tab Reference Cluster": T6, "Cell Naming Parameters Ref Cluster": T7, "One Time Calibrations Ref Cluster": T8, "LPC Controls Reference Cluster": T9, "System Parameters Ref Cluster": T10, "XZ Stage Controls Reference Cluster": T11, "MRM Reference Cluster": T12, "Other Parameters Cluster": T13}
  T14 = cluster{"X Coordinate (mm)": f64, "Z Coordinate (mm)": f64, "Aprch Distance (mm)": f64}
  T15 = cluster{"X Coordinate (mm)": f64, "Z Coordinate (mm)": f64, "Vertical Spacing (mm)": f64, "Aprch Distance (mm)": f64, "Aprch Dstnc L.12 (mm)": f64}
  "XZ All Position Cluster.gtype" = cluster{"Diffusor Coordinates": T14, "Photodetector Coordinates": T14, "Cell R.01 Coordinates": T15}
  T16 = cluster{"Thorlabs Motor Serial Number File Path": path, "Default Data Saving Location": path}
  "Cell Naming Cluster.gtype" = cluster{"Cell Label": string, "Sample Prefix": string, "Author Initials": string, "Current Date": string, "Batch Name": string}
  "Misc Data Mega Cluster.gtype" = cluster{"Full Reference Cluster": "Full Reference Cluster.gtype", "All XZ Position Cluster": "XZ All Position Cluster.gtype", "All Paths": T16, "Cell Naming Cluster": "Cell Naming Cluster.gtype"}
  "Sweep Speed Selector.gtype" = enum{"Smart Sweep", "Fast Sweep", "Normal Sweep"}
  "MRM Specific Parameters.gtype" = cluster{"Max (V)": f64, "Min (V)": f64, "V Points": u32, "Curr Range (A)": f64, "Sweep Dir": bool, "Current Avg": u32, "Max (A)": f64, "PLC Speed": f64, "Cell Area (m^2)": f64, "Autorange": bool, "Full Spctr Ref": bool, "Sweep Speed": "Sweep Speed Selector.gtype"}
  T17 = cluster{"L.01": bool, "R.01": bool, "L.02": bool, "R.02": bool, "L.03": bool, "R.03": bool, "L.04": bool, "R.04": bool, "L.05": bool, "R.05": bool, "L.06": bool, "R.06": bool, "L.07": bool, "R.07": bool, "L.08": bool, "R.08": bool, "L.09": bool, "R.09": bool, "L.10": bool, "R.10": bool, "L.11": bool, "R.11": bool, "L.12": bool, "R.12": bool}
  "MRM Cell Selector.gtype" = cluster{"All": bool, "Left": bool, "Right": bool, "Cell Cluster": T17, "Reset": bool}
  "Selected Cells Array.gtype" = "XZ Stage Cell.gtype"[]
  T18 = enum{"L.01", "L.02", "L.03", "L.04", "L.05", "L.06", "L.07", "L.08", "L.09", "L.10", "L.11", "L.12", "R.01", "R.02", "R.03", "R.04", "R.05", "R.06", "R.07", "R.08", "R.09", "R.10", "R.11", "R.12"}
  "MRM Full Data From SRM Cluster.gtype" = cluster{"SRM Mega Cluster": "SRM Mega Cluster.gtype", "Cell Label": T18}
  "MRM Mega Cluster.gtype" = cluster{"MRM Specific Parameters": "MRM Specific Parameters.gtype", "Cell Selector": "MRM Cell Selector.gtype", "Cells to Measure Array": "Selected Cells Array.gtype", "Rainbow Sweep Parameters MRM": "Rainbow Sweep Param Selector.gtype", "MRM Data Array": "MRM Full Data From SRM Cluster.gtype"[]}
  "SRM Sweep Live Parameters.gtype" = cluster{"Current Wavelength (nm)": f64, "Rainbow Sweep Types": "Rainbow Sweep Types.gtype", "Finished Measurement?": bool}
uses:
  Rainbow Measurement Setup::Side Functions::Messages And Prompts::FGV Cancel Prompts until Finished Routine.gvi
  Rainbow Measurement Setup::Main Functions::XZ Stage Movements::MRM Move To Cell Safely.gvi
  Rainbow Measurement Setup::Side Functions::Rainbow Sweep::Rainbow Sweep Param Generator.gvi
  Rainbow Measurement Setup::Side Functions::Instrument Control::Keithley::Keithley Reset Subroutine.gvi
  Rainbow Measurement Setup::Side Functions::Instrument Control::Keithley::Keithley Set Constant Parameters.gvi
  Rainbow Measurement Setup::Side Functions::Instrument Control::Thorlabs Motors::Dividing Wavelength Control::Dividing Wavelength Calibration Data FGV.gvi
  Rainbow Measurement Setup::Main Functions::Rainbow Measurement::Cell Single Rainbow Measurement::SRM Extract Correct Calibration Data.gvi
  Rainbow Measurement Setup::Side Functions::Global Abort::FGV Global Abort.gvi
  Rainbow Measurement Setup::Side Functions::Instrument Control::Thorlabs Motors::Dividing Wavelength Control::KCube Dividing Wavelength Translator.gvi
  Rainbow Measurement Setup::Main Functions::Rainbow Measurement::Cell Single Rainbow Measurement::SRM Extract Measured Power.gvi
  Rainbow Measurement Setup::Side Functions::Instrument Control::Keithley::Keithley Sweep Subroutine.gvi
  Rainbow Measurement Setup::Main Functions::Rainbow Measurement::Cell Single Rainbow Measurement::IV Calculations::IV to IJV Data.gvi
  Rainbow Measurement Setup::Main Functions::Rainbow Measurement::Cell Multiple Rainbow Measurement::MRM Live Parameters::MRM Sweep Live Parameters FGV.gvi
  Rainbow Measurement Setup::Main Functions::Rainbow Measurement::Cell Multiple Rainbow Measurement::MRM Data Array::MRM Array Replace If it Exists.gvi
  Rainbow Measurement Setup::Side Functions::Utilities::Progress Handling::Progress General Calculator.gvi
  Rainbow Measurement Setup::Side Functions::Utilities::Progress Handling::Progress FGV.gvi
  Rainbow Measurement Setup::Side Functions::Instrument Control::Thorlabs Motors::Movement::KCube Move to 0 or Home.gvi
  Rainbow Measurement Setup::Side Functions::Instrument Control::Arduino::XZ Stage Arduino::XZ Y Safe Approach and Retract.gvi
  Rainbow Measurement Setup::Main Functions::Rainbow Measurement::Cell Multiple Rainbow Measurement::MRM Data Array::MRM Data Array IV Processor.gvi
  Rainbow Measurement Setup::Main Functions::Rainbow Measurement::Cell Multiple Rainbow Measurement::File Handling::MRM Single File Save.gvi
diagram:
  # This SubVI Takes the specified Parameters both for the sweep types and for the keithley electrical sweep and performs all the measurements while storing them on their
  # corresponding clusters, before outputing all the information within the Full IV Curve Data array.
  case ($"Error In") {
    frame Error, Default {
      w1 = $"Error In"
      w2 = $"Instrument Control Mega Cluster In"
      w3 = $"MRM Mega Cluster In"
    }
    frame No Error {
      Property Node(instance in=$"MRM Mega Cluster In") -> ("MRM Data Array"=w4, instance out=w5)
      s1 = $"Instrument Control Mega Cluster In"  # shift register
      s2 = $"Error In"  # shift register
      s3 = 0  # shift register
      for (N -> w6) (iteration -> i1) {
        w7 = each element of w4
        Property Node(instance in=w7) -> ("SRM Mega Cluster:Rainbow Sweep Parameters SRM"=w9, "SRM Mega Cluster"=w10, "Cell Label"=w11, instance out=w12)
        call "FGV Cancel Prompts until Finished Routine.gvi"(Error In=s2, FGV Instructions="Reset State") -> (Error Out=w13)
        call "MRM Move To Cell Safely.gvi"(Instrument Control Mega Cluster In=s1, Misc Data Mega Cluster In=$"Misc Data Mega Cluster In", Error In=w13, Cell Label=w11) -> (Instrument Control Mega Cluster Out=w14, Error Out=w15)
        call "Rainbow Sweep Param Generator.gvi"(Rainbow Sweep Parameters=w9, Error In=w15) -> (Rainbow Sweep Parameters Array=w16, Error Out=w17)
        call "Keithley Reset Subroutine.gvi"(Instrument Control Mega Cluster In=w14, Error In=w17) -> (Instrument Control Mega Cluster Out=w18, Error Out=w19)
        call "Keithley Set Constant Parameters.gvi"(Instrument Control Mega Cluster In=w18, SRM Mega Cluster In=w10, Error In=w19) -> (Instrument Control Mega Cluster Out=w20, SRM Mega Cluster Out=w21, Error Out=w22)
        call "Dividing Wavelength Calibration Data FGV.gvi"(Div Wavelength FGV Instructions="Read Loaded Data", Error In=w22) -> (Dividing Wavelength Calibration Data Out=w23, Error Out=w24)
        s4 = w24  # shift register
        s5 = w20  # shift register
        s6 = "IV Full Raw Data.gtype"[] []  # shift register
        s7 = s3  # shift register
        s8 = w21  # shift register
        s9 = $"Misc Data Mega Cluster In"  # shift register
        for (N -> w25) (iteration -> i2) {
          w26 = each element of w16
          Property Node(instance in=w26) -> ("Dividing Wavelength Array"=w27, "Rainbow Sweep Types"=w28)
          call "SRM Extract Correct Calibration Data.gvi"(LPC Mega Cluster In=$"LPC Mega Cluster In", Rainbow Sweep Type=w28, Error In=s4) -> (Extracted Light Power Calibration Data=w29, Error Out=w30)
          s10 = w30  # shift register
          s11 = s5  # shift register
          s12 = "IV Single Measurement.gtype"[] []  # shift register
          s13 = s7  # shift register
          s14 = s8  # shift register
          for (N -> w31) (iteration -> i3) {
            w32 = each element of w27
            Increment(x=s13) -> w33
            Multiply(w6, w31, w25) -> w34
            call "FGV Global Abort.gvi"(Global Abort Instructions="Read Current State", Error In=s10) -> (Local Abort Out=w35, Global Abort Out=w36, Error Out=w37)
            call "KCube Dividing Wavelength Translator.gvi"(Dividing Wavelength=w32, Instrument Control Mega Cluster In=s11, Dividing Wavelength Calibration Data In=w23, Error In=w37, Rainbow Sweep Types=w28) -> (Instrument Control Mega Cluster Out=w38, Error Out=w39)
            call "SRM Extract Measured Power.gvi"(Dividing Wavelength In=w32, Light Power Calibration Data In=w29, SRM Mega Cluster In=s14, Error In=w39) -> (IV Single Measurement Out=w40, Error Out=w41)
            call "Keithley Sweep Subroutine.gvi"(Instrument Control Mega Cluster In=w38, SRM Mega Cluster In=s14, IV Single Measurement In=w40, Error In=w41) -> (Instrument Control Mega Cluster Out=w42, SRM Mega Cluster Out=w43, IV Single Measurement Out=w44, Error Out=w45)
            call "IV to IJV Data.gvi"(SRM Mega Cluster In=w43, IV Single Measurement In=w44, Error In=w45) -> (SRM Mega Cluster Out=w46, IV Single Measurement Out=w47, Error Out=w48)
            call "MRM Sweep Live Parameters FGV.gvi"(FGV Instructions="Read State", Error In=w48) -> (MRM sweep live parameters FGV cluster out=w49, Error Out=w50)
            Property Node(instance in=w49) -> ("All Cell Measurements"=w51, instance out=w52)
            Insert Into Array(inArray=s12, index0=i3, new=w47) -> w53
            Array Index(array=w51) -> (out0[i1]=w54)
            Property Node(instance in=w54, "IV Single Measurement Array"=w53, "Measured Cell"=w11) -> (instance out=w55)
            call "MRM Array Replace If it Exists.gvi"(All Cell Measurements In=w51, Array Index=i1, New Element=w55, Error In=w50) -> (All Cell Measurements Out=w56, Error Out=w57)
            Property Node(instance in=w52, "All Cell Measurements"=w56) -> (instance out=w58)
            call "MRM Sweep Live Parameters FGV.gvi"(FGV Instructions="Set State", MRM sweep live parameters FGV Cluster In=w58, Error In=w57) -> (Error Out=w59)
            call "Progress General Calculator.gvi"(Starting Value=40, Ending Value=80, Number Of Steps=w34, Current Step=s13, Error In=w59) -> (Current Progress=w60, Error Out=w61)
            call "Progress FGV.gvi"(FGV Instructions="Set State", Progress In=w60, Error In=w61) -> (Error Out=w62)
            Logical Or(w35, w36) -> w63
            w64 = "SRM Sweep Live Parameters.gtype" {"Current Wavelength (nm)"=0, "Rainbow Sweep Types"="Red Sweep Closing", "Finished Measurement?"=TRUE}
            Property Node(instance in=w64, "Current Wavelength (nm)"=w32, "Rainbow Sweep Types"=w28, "Finished Measurement?"=FALSE)
            Wait Until Next Multiple(multiple to wait=10)
            next s10 = w62
            next s11 = w42
            next s12 = w53
            next s13 = w33
            next s14 = w46
            stop if w63
          }
          call "MRM Sweep Live Parameters FGV.gvi"(FGV Instructions="Read State", Error In=s10) -> (MRM sweep live parameters FGV cluster out=w65, Error Out=w66)
          Property Node(instance in=w65) -> ("All Cell Measurements"=w67, instance out=w68)
          Property Node(instance in="IV Full Raw Data.gtype" {all zero or empty}, "IV Raw Data Array"=s12, "Rainbow Sweep Types"=w28) -> (instance out=w69)
          Insert Into Array(inArray=s6, index0=i2, new=w69) -> w70
          Array Index(array=w67) -> (out0[i1]=w71)
          Property Node(instance in=w71, "Full IV Data Array"=w70, "Measured Cell"=w11) -> (instance out=w72)
          Replace Array Subset(inArray=w67, index=i1, new=w72) -> w73
          $"output array" <- w73
          Property Node(instance in=w68, "All Cell Measurements"=w73, "Refresh now"=TRUE) -> (instance out=w74)
          call "MRM Sweep Live Parameters FGV.gvi"(FGV Instructions="Set State", MRM sweep live parameters FGV Cluster In=w74, Error In=w66) -> (Error Out=w75)
          call "KCube Move to 0 or Home.gvi"(Instrument Control Mega Cluster In=s11, Error In=w75) -> (Instrument Control Mega Cluster Out=w76, Error Out=w77)
          call "XZ Y Safe Approach and Retract.gvi"(Instrument Control Mega Cluster In=w76, Error In=w77, Approach Operation="Retract", Misc Data Mega Cluster=s9) -> (Instrument Control Mega Cluster Out=w78, Error Out=w79)
          next s4 = w79
          next s5 = w78
          next s6 = w70
          next s7 = s13
          next s8 = s14
          stop if w63
        }
        Property Node(instance in=s8, "Full IV Curve Raw Data"=s6) -> (instance out=w80)
        Property Node(instance in=w12, "SRM Mega Cluster"=w80) -> (instance out=w81)
        call "KCube Move to 0 or Home.gvi"(Instrument Control Mega Cluster In=s5, Error In=s4) -> (Instrument Control Mega Cluster Out=w82, Error Out=w83)
        call "XZ Y Safe Approach and Retract.gvi"(Instrument Control Mega Cluster In=w82, Error In=w83, Approach Operation="Retract") -> (Instrument Control Mega Cluster Out=w84, Error Out=w85)
        call "MRM Data Array IV Processor.gvi"(MRM Data Cluster In=w81, Error In=w85) -> (MRM Data Cluster Out=w86, Error Out=w87)
        call "MRM Single File Save.gvi"(Misc Data Mega Cluster In=s9, MRM Data Cluster In=w86, Error In=w87) -> (Error Out=w88)
        call "MRM Single File Save.gvi"()
        append w86 to w8
        next s1 = w84
        next s2 = w88
        next s3 = s7
        stop if w63
      }
      Property Node(instance in=w5, "MRM Data Array"=w8) -> (instance out=w3)
      w1 = s2
      w2 = s1
    }
  }
  $"Instrument Control Mega Cluster Out" <- w2
  $"Error Out" <- w1
  $"MRM Mega Cluster Out" <- w3
