vi "MRM Raw Data Graph Adapter.gvi"   [LabVIEW NXG 5.0.0]
inputs:
  "Error In": error
  "All Cell Measurements": T1[]
  "IV Single Measurement Array": "IV Single Measurement.gtype"[]
  "Latest Measurement?": bool
outputs:
  "Error Out": error
  "IV Plot Out": "SRM Single Plot Cluster.gtype"[]
types:
  "SRM Single Plot Cluster.gtype" = cluster{"Voltage (V)": f64[], "Current Density (A/m^2)": f64[]}
  "IV Single Measurement.gtype" = cluster{"Voltage (V)": f64[], "Current (A)": f64[], "Current Density (A/m^2)": f64[], "Dividing Wavelength (nm)": f64, "Light Power Density (W/m^2)": f64, "Total Light Power Density (W/m^2)": f64}
  "Rainbow Sweep Types.gtype" = enum{"Red Sweep Closing", "Red Sweep Opening", "Blue Sweep Closing", "Blue Sweep Opening"}
  "IV Full Raw Data.gtype" = cluster{"Rainbow Sweep Types": "Rainbow Sweep Types.gtype", "IV Raw Data Array": "IV Single Measurement.gtype"[]}
  "XZ Stage Cell.gtype" = enum{"L.01", "L.02", "L.03", "L.04", "L.05", "L.06", "L.07", "L.08", "L.09", "L.10", "L.11", "L.12", "R.01", "R.02", "R.03", "R.04", "R.05", "R.06", "R.07", "R.08", "R.09", "R.10", "R.11", "R.12"}
  T1 = cluster{"IV Single Measurement Array": "IV Single Measurement.gtype"[], "IV Single Measurement Plot Array": "SRM Single Plot Cluster.gtype"[], "Full IV Data Array": "IV Full Raw Data.gtype"[], "Measured Cell": "XZ Stage Cell.gtype"}
diagram:
  # This SubVI checks the selected cell button on the main window and it Adapts the IV Raw data array
  #  so that it can be plotted.
  case ($"Error In") {
    frame Error, Default {
      w1 = $"Error In"
      w2 = default
    }
    frame No Error {
      Array Size(array=$"All Cell Measurements") -> (size(s)=w3)
      Decrement(x=w3) -> w4
      Array Index(array=$"All Cell Measurements") -> (out0[w4]=w5)
      Property Node(instance in=w5) -> ("IV Single Measurement Array"=w6)
      Select(s=$"Latest Measurement?", t=w6, f=$"IV Single Measurement Array") -> w7
      for {
        w8 = each element of w7
        Property Node(instance in=w8) -> ("Voltage (V)"=w9, "Current Density (A/m^2)"=w10)
        Property Node(instance in="SRM Single Plot Cluster.gtype" {all zero or empty}, "Voltage (V)"=w9, "Current Density (A/m^2)"=w10) -> (instance out=w11)
        append w11 to w2
      }
      w1 = $"Error In"
    }
  }
  $"Error Out" <- w1
  $"IV Plot Out" <- w2
