vi "MRM Sweep Refined Data FGV.gvi"   [LabVIEW NXG 5.0.0]
inputs:
  "Error In": error
  "FGV Instructions": "General FGV Instructions.gtype" = "Read State"
  "MRM Mega Cluster In": "MRM Mega Cluster.gtype" = {"MRM Specific Parameters"={"V Points"=1, "Current Avg"=1, "Sweep Speed"="Smart Sweep"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}, "Cell Selector"={FALSE, FALSE, FALSE, FALSE, FALSE, FALSE, FALSE, FALSE, FALSE, FALSE, FALSE, FALSE, FALSE, FALSE, FALSE, FALSE, FALSE, FALSE, FALSE, FALSE, FALSE, FALSE, FALSE, FALSE, FALSE, FALSE, FALSE, FALSE}, "Cells to Measure Array"=[], "Rainbow Sweep Parameters MRM"={0, 900, 400, 1, 1, 0}, "MRM Data Array"=[]}
  "Misc Data Mega Cluster In": "Misc Data Mega Cluster.gtype"
outputs:
  "Error Out": error
  "IV Extracted Parameters Plot": T1
types:
  "General FGV Instructions.gtype" = enum{"Read State", "Set State", "Reset State"}
  T1 = cluster{"Dividing Wavelength (nm)": f64[], "Element 2": f64[]}
  "Sweep Speed Selector.gtype" = enum{"Smart Sweep", "Fast Sweep", "Normal Sweep"}
  "MRM Specific Parameters.gtype" = cluster{"Max (V)": f64, "Min (V)": f64, "V Points": u32, "Curr Range (A)": f64, "Sweep Dir": bool, "Current Avg": u32, "Max (A)": f64, "PLC Speed": f64, "Cell Area (m^2)": f64, "Autorange": bool, "Full Spctr Ref": bool, "Sweep Speed": "Sweep Speed Selector.gtype"}
  T2 = cluster{"L.01": bool, "R.01": bool, "L.02": bool, "R.02": bool, "L.03": bool, "R.03": bool, "L.04": bool, "R.04": bool, "L.05": bool, "R.05": bool, "L.06": bool, "R.06": bool, "L.07": bool, "R.07": bool, "L.08": bool, "R.08": bool, "L.09": bool, "R.09": bool, "L.10": bool, "R.10": bool, "L.11": bool, "R.11": bool, "L.12": bool, "R.12": bool}
  "MRM Cell Selector.gtype" = cluster{"All": bool, "Left": bool, "Right": bool, "Cell Cluster": T2, "Reset": bool}
  "XZ Stage Cell.gtype" = enum{"L.01", "L.02", "L.03", "L.04", "L.05", "L.06", "L.07", "L.08", "L.09", "L.10", "L.11", "L.12", "R.01", "R.02", "R.03", "R.04", "R.05", "R.06", "R.07", "R.08", "R.09", "R.10", "R.11", "R.12"}
  "Selected Cells Array.gtype" = "XZ Stage Cell.gtype"[]
  "Raibow Sweep Selector.gtype" = enum{"Red Sweep", "Blue Sweep", "Full Sweep Red First", "Full Sweep Blue First"}
  "Rainbow Sweep Param Selector.gtype" = cluster{"Raibow Sweep Selector": "Raibow Sweep Selector.gtype", "Max Wavelength (nm)": f64, "Min Wavelength (nm)": f64, "Wavelength Step (nm)": f64, "Rainbow Sweep Type Selector": "Rainbow Sweep Type Selector.gtype"}
  T3 = enum{"L.01", "L.02", "L.03", "L.04", "L.05", "L.06", "L.07", "L.08", "L.09", "L.10", "L.11", "L.12", "R.01", "R.02", "R.03", "R.04", "R.05", "R.06", "R.07", "R.08", "R.09", "R.10", "R.11", "R.12"}
  "MRM Full Data From SRM Cluster.gtype" = cluster{"SRM Mega Cluster": "SRM Mega Cluster.gtype", "Cell Label": T3}
  "MRM Mega Cluster.gtype" = cluster{"MRM Specific Parameters": "MRM Specific Parameters.gtype", "Cell Selector": "MRM Cell Selector.gtype", "Cells to Measure Array": "Selected Cells Array.gtype", "Rainbow Sweep Parameters MRM": "Rainbow Sweep Param Selector.gtype", "MRM Data Array": "MRM Full Data From SRM Cluster.gtype"[]}
  T4 = cluster{"SRM Light Power Density Ref": "NumericTextBoxDouble reference", "Rainbow Sweep Parameters RSM": "Cluster reference", "SRM Refined Plot Rainbow Sweep Types": "ComboBoxSelector reference", "Sweep Live Parameters RSM": "Cluster reference", "SRM Raw Plot Rainbow Sweep Selector": "ComboBoxSelector reference", "SRM Plot Parameter Selector Ref": "EnumSelector reference", "IV Plot Out Ref": "Graph reference", "SRM Specific Parameters": "Cluster reference"}
  T5 = cluster{"Calibration Files Path": "PathSelector reference", "Default Data Saving Location": "PathSelector reference"}
  T6 = cluster{"Main Tab": "TabControl reference", "Rainbow Measurement tab": "TabControl reference", "Configuration tab": "TabControl reference", "Light Calibration tab": "TabControl reference"}
  T7 = cluster{"Custom date": "CheckBox reference", "Batch Name": "StringControl reference", "Author Initials": "ComboBoxSelector reference", "Cell Number": "StringControl reference", "Current Date": "StringControl reference", "Sample Comments": "StringControl reference", "Sample Prefix": "StringControl reference", "Label Info Missing Error": "BooleanControl reference", "Label Info Error Label": "StringControl reference"}
  T8 = cluster{"Beam Power Density": "IntensityGraph reference"[][], "Irradiance Calibration": "Graph reference"[], "MSpot Spectrum Calibration Parameters": "Cluster reference", "Rainbow Sweep Param Selector MSpot": "Cluster reference"}
  T9 = cluster{"LPC Parameters Ref": "Cluster reference", "Sweep Live Parameters LPC ref": "Cluster reference", "Light Power Calibration": "Graph reference", "Light Power Calibration Data Ref": "ArrayViewer reference", "Rainbow Sweep Parameters LPC": "Cluster reference"}
  T10 = cluster{"Current State Ref": "EnumSelector reference", "Substate": "StringControl reference", "State": "StringControl reference", "Current Substate": "StringControl reference"}
  T11 = cluster{"Custom Position": "BooleanControl reference", "Set Position": "BooleanControl reference", "XZ Stage Active": "BooleanControl reference", "Release XZ Stage": "BooleanControl reference", "XZ Coordinates": "Cluster reference", "Activate XZ Stage": "BooleanControl reference", "XZ Stage Cell Reference": "EnumSelector reference", "XZ All Position Cluster Ref": "Cluster reference"}
  T12 = cluster{"IV Extracted Parameter Plot ": "Graph reference", "MRM Cell Selector Ref": "Cluster reference", "IV Plot Out Multiple Reference": "Graph reference", "Rainbow Sweep Parameters MRM Ref": "Cluster reference", "MRM Cell Refined Plot Selector ref": "ComboBoxSelector reference", "MRM Current Raw Cell Plot": "ComboBoxSelector reference", "MRM Raw Plot Rainbow Sweep Relector Ref": "ComboBoxSelector reference", "MRM Specific Parameters Ref": "Cluster reference"}
  T13 = cluster{"Smart Sweep Mega Cluster Ref": "Cluster reference"}
  "Full Reference Cluster.gtype" = cluster{"SRM Reference Cluster": T4, "Path Reference Cluster": T5, "Tab Reference Cluster": T6, "Cell Naming Parameters Ref Cluster": T7, "One Time Calibrations Ref Cluster": T8, "LPC Controls Reference Cluster": T9, "System Parameters Ref Cluster": T10, "XZ Stage Controls Reference Cluster": T11, "MRM Reference Cluster": T12, "Other Parameters Cluster": T13}
  T14 = cluster{"X Coordinate (mm)": f64, "Z Coordinate (mm)": f64, "Aprch Distance (mm)": f64}
  T15 = cluster{"X Coordinate (mm)": f64, "Z Coordinate (mm)": f64, "Vertical Spacing (mm)": f64, "Aprch Distance (mm)": f64, "Aprch Dstnc L.12 (mm)": f64}
  "XZ All Position Cluster.gtype" = cluster{"Diffusor Coordinates": T14, "Photodetector Coordinates": T14, "Cell R.01 Coordinates": T15}
  T16 = cluster{"Thorlabs Motor Serial Number File Path": path, "Default Data Saving Location": path}
  "Cell Naming Cluster.gtype" = cluster{"Cell Label": string, "Sample Prefix": string, "Author Initials": string, "Current Date": string, "Batch Name": string}
  "Misc Data Mega Cluster.gtype" = cluster{"Full Reference Cluster": "Full Reference Cluster.gtype", "All XZ Position Cluster": "XZ All Position Cluster.gtype", "All Paths": T16, "Cell Naming Cluster": "Cell Naming Cluster.gtype"}
uses:
  Rainbow Measurement Setup::Main Functions::Rainbow Measurement::Cell Multiple Rainbow Measurement::Plotting::MRM Sweep Refined FGV Read Handler.gvi
  Rainbow Measurement Setup::Main Functions::Rainbow Measurement::Cell Multiple Rainbow Measurement::Plotting::MRM Sweep Refined FGV Set State.gvi
diagram:
  # This FGV Stores the SRM live parameters and the plots so that
  # they can be updated live while being measured. It also sets the name
  # of the plots so that you know which color corresponds to each dividing wavelength
  case ($"Error In") {
    frame Error, Default {
      w1 = $"Error In"
    }
    frame No Error {
      s1 = $"Error In"  # shift register
      s2 = uninitialised  # shift register
      s3 = uninitialised  # shift register
      s4 = uninitialised  # shift register
      s5 = uninitialised  # shift register
      while {
        case ($"FGV Instructions") {
          frame "Read State", Default {
            call "MRM Sweep Refined FGV Read Handler.gvi"(Misc Data Mega Cluster In=$"Misc Data Mega Cluster In", IV Multi Cell Refined Plot Data Out=s2, Error In=s1) -> (Misc Data Mega Cluster Out=w6, IV Extracted Parameters Plot=w5, Error Out=w3)
            $"IV Extracted Parameters Plot" <- w5
            w2 = s3
            w4 = s2
          }
          frame "Set State" {
            call "MRM Sweep Refined FGV Set State.gvi"(Misc Data Mega Cluster In=s5, MRM Mega Cluster In=$"MRM Mega Cluster In", Error In=s1) -> (Misc Data Mega Cluster Out=w6, IV Multi Cell Refined Plot Data Out=w4, Error Out=w3)
            w2 = $"MRM Mega Cluster In"
            w5 = s4
          }
          frame "Reset State" {
            w2 = default
            w3 = s1
            w4 = default
            w5 = default
            w6 = default
          }
        }
        next s1 = w3
        next s2 = w4
        next s3 = w2
        next s4 = w5
        next s5 = w6
        stop if TRUE
      }
      w1 = s1
    }
  }
  $"Error Out" <- w1
