vi "MRM Sweep Refined FGV Read Handler.gvi"   [LabVIEW NXG 5.0.0]
inputs:
  "Misc Data Mega Cluster In": "Misc Data Mega Cluster.gtype"
  "IV Multi Cell Refined Plot Data Out": T22[]
  "Error In": error
outputs:
  "Misc Data Mega Cluster Out": "Misc Data Mega Cluster.gtype"
  "IV Extracted Parameters Plot": T1
  "Error Out": error
types:
  T1 = cluster{"Dividing Wavelength (nm)": f64[], "Element 2": f64[]}
  T2 = cluster{"IV Extracted Parameter Plot ": "Graph reference", "MRM Cell Selector Ref": "Cluster reference", "IV Plot Out Multiple Reference": "Graph reference", "Rainbow Sweep Parameters MRM Ref": "Cluster reference", "MRM Specific Parameters Ref": "Cluster reference", "MRM Cell Refined Plot Selector ref": "ComboBoxSelector reference", "MRM Current Raw Cell Plot": "ComboBoxSelector reference", "MRM Raw Plot Rainbow Sweep Relector Ref": "ComboBoxSelector reference"}
  T3 = cluster{"SRM Light Power Density Ref": "NumericTextBoxDouble reference", "Rainbow Sweep Parameters RSM": "Cluster reference", "SRM Refined Plot Rainbow Sweep Types": "ComboBoxSelector reference", "SRM Specific Parameters": "Cluster reference", "Sweep Live Parameters RSM": "Cluster reference", "SRM Raw Plot Rainbow Sweep Selector": "ComboBoxSelector reference", "SRM Plot Parameter Selector Ref": "EnumSelector reference", "IV Plot Out Ref": "Graph reference"}
  T4 = cluster{"Calibration Files Path": "PathSelector reference", "Default Data Saving Location": "PathSelector reference"}
  T5 = cluster{"Main Tab": "TabControl reference", "Rainbow Measurement tab": "TabControl reference", "Configuration tab": "TabControl reference", "Light Calibration tab": "TabControl reference"}
  T6 = cluster{"Custom date": "CheckBox reference", "Batch Name": "StringControl reference", "Author Initials": "ComboBoxSelector reference", "Cell Number": "StringControl reference", "Current Date": "StringControl reference", "Sample Comments": "StringControl reference", "Sample Prefix": "StringControl reference", "Label Info Missing Error": "BooleanControl reference", "Label Info Error Label": "StringControl reference"}
  T7 = cluster{"Beam Power Density": "IntensityGraph reference"[][], "Irradiance Calibration": "Graph reference"[], "MSpot Spectrum Calibration Parameters": "Cluster reference", "Rainbow Sweep Param Selector MSpot": "Cluster reference"}
  T8 = cluster{"LPC Parameters Ref": "Cluster reference", "Sweep Live Parameters LPC ref": "Cluster reference", "Light Power Calibration": "Graph reference", "Light Power Calibration Data Ref": "ArrayViewer reference", "Rainbow Sweep Parameters LPC": "Cluster reference"}
  T9 = cluster{"Current State Ref": "EnumSelector reference", "Substate": "StringControl reference", "State": "StringControl reference", "Current Substate": "StringControl reference"}
  T10 = cluster{"Custom Position": "BooleanControl reference", "Set Position": "BooleanControl reference", "XZ Stage Active": "BooleanControl reference", "Release XZ Stage": "BooleanControl reference", "XZ Coordinates": "Cluster reference", "Activate XZ Stage": "BooleanControl reference", "XZ Stage Cell Reference": "EnumSelector reference", "XZ All Position Cluster Ref": "Cluster reference"}
  "Full Reference Cluster.gtype" = cluster{"MRM Reference Cluster": T2, "SRM Reference Cluster": T3, "Path Reference Cluster": T4, "Tab Reference Cluster": T5, "Cell Naming Parameters Ref Cluster": T6, "One Time Calibrations Ref Cluster": T7, "LPC Controls Reference Cluster": T8, "System Parameters Ref Cluster": T9, "XZ Stage Controls Reference Cluster": T10}
  T11 = cluster{"X Coordinate (mm)": f64, "Z Coordinate (mm)": f64, "Aprch Distance (mm)": f64}
  T12 = cluster{"X Coordinate (mm)": f64, "Z Coordinate (mm)": f64, "Vertical Spacing (mm)": f64, "Aprch Distance (mm)": f64, "Aprch Dstnc L.12 (mm)": f64}
  "XZ All Position Cluster.gtype" = cluster{"Diffusor Coordinates": T11, "Photodetector Coordinates": T11, "Cell R.01 Coordinates": T12}
  T13 = cluster{"Thorlabs Motor Serial Number File Path": path, "Default Data Saving Location": path}
  "Cell Naming Cluster.gtype" = cluster{"Cell Label": string, "Sample Prefix": string, "Author Initials": string, "Current Date": string, "Batch Name": string}
  "Misc Data Mega Cluster.gtype" = cluster{"Full Reference Cluster": "Full Reference Cluster.gtype", "All XZ Position Cluster": "XZ All Position Cluster.gtype", "All Paths": T13, "Cell Naming Cluster": "Cell Naming Cluster.gtype"}
  T14 = cluster{"Dividing Wavelength (nm)": f64[], "Efficiency (%)": f64[]}
  T15 = cluster{"Dividing Wavelength (nm)": f64[], "Jsc (A/m^2)": f64[]}
  T16 = cluster{"Dividing Wavelength (nm)": f64[], "Voc (V)": f64[]}
  T17 = cluster{"Dividing Wavelength (nm)": f64[], "Light Power Density (W/m^2)": f64[]}
  T18 = cluster{"Dividing Wavelength (nm)": f64[], "FF (%)": f64[]}
  T19 = cluster{"Dividing Wavelength (nm)": f64[], "Rs (Ω · m^2)": f64[]}
  T20 = cluster{"Dividing Wavelength (nm)": f64[], "Rsh (Ω · m^2)": f64[]}
  "Rainbow Sweep Types.gtype" = enum{"Red Sweep Closing", "Red Sweep Opening", "Blue Sweep Closing", "Blue Sweep Opening"}
  "SRM IV Refined Data Plot.gtype" = cluster{"Efficiency Plot": T14, "Jsc Plot": T15, "Voc Plot": T16, "Light Power Density Plot": T17, "FF Plot": T18, "Rs Plot": T19, "Rsh Plot": T20, "Rainbow Sweep Types": "Rainbow Sweep Types.gtype", "Total Light Power Density (W/m^2)": f64}
  T21 = enum{"L.01", "L.02", "L.03", "L.04", "L.05", "L.06", "L.07", "L.08", "L.09", "L.10", "L.11", "L.12", "R.01", "R.02", "R.03", "R.04", "R.05", "R.06", "R.07", "R.08", "R.09", "R.10", "R.11", "R.12"}
  T22 = cluster{"IV Full Data To Plot": "SRM IV Refined Data Plot.gtype"[], "Cell Label": T21}
diagram:
  # This SubVI Takes all the sweep types and scans for the selected one, It also scans both for the selected Cell, and once it finds it
  # it outputs the selected data to the IV Extracted Parameters plot so that it can be correctly
  # plotted.
  case ($"Error In") {
    frame Error, Default {
      w1 = default
      w2 = $"Error In"
      w3 = $"Misc Data Mega Cluster In"
    }
    frame No Error {
      Property Node(instance in=$"Misc Data Mega Cluster In") -> ("Full Reference Cluster:SRM Reference Cluster:SRM Refined Plot Rainbow Sweep Types"=w4, "Full Reference Cluster:SRM Reference Cluster:SRM Plot Parameter Selector Ref"=w5, "Full Reference Cluster:SRM Reference Cluster:SRM Light Power Density Ref"=w6, "Full Reference Cluster:MRM Reference Cluster:MRM Cell Refined Plot Selector ref"=w7, instance out=w3)
      Property Node(instance in=w7, error in=$"Error In") -> ("Value"=w8, error out=w9)
      Property Node(instance in=w5, error in=w9) -> ("Value"=w10, error out=w11)
      Property Node(instance in=w4, error in=w11) -> ("Value"=w12, error out=w13)
      s1 = w13  # shift register
      for {
        w14 = each element of $"IV Multi Cell Refined Plot Data Out"
        Property Node(instance in=w14) -> ("Cell Label"=w16, "IV Full Data To Plot"=w17)
        Format Into String(errIn=s1, w16) -> (outString=w18, errOut=w19)
        Is Equal(x=w8, y=w18) -> w20
        w15 = w17 if w20
        next s1 = w19
        stop if w20
      }
      s2 = s1  # shift register
      for {
        w21 = each element of w15
        Property Node(instance in=w21) -> ("Rainbow Sweep Types"=w24, "Total Light Power Density (W/m^2)"=w25, instance out=w26)
        Format Into String(w24) -> w27
        Is Equal(x=w27, y=w12) -> w28
        w22 = w26 if w28
        w23 = w25 if w28
      }
      case (w10) {
        frame "Efficiency (%)", Default {
          Property Node(instance in=w22) -> ("Efficiency Plot"=w1)
        }
        frame "Jsc (A / m^2)" {
          Property Node(instance in=w22) -> ("Jsc Plot"=w1)
        }
        frame "Voc (V)" {
          Property Node(instance in=w22) -> ("Voc Plot"=w1)
        }
        frame "Light Power Density (W/m^2)" {
          Property Node(instance in=w22) -> ("Light Power Density Plot"=w1)
        }
        frame "FF (%)" {
          Property Node(instance in=w22) -> ("FF Plot"=w1)
        }
        frame "Rs (Ω · m^2)" {
          Property Node(instance in=w22) -> ("Rs Plot"=w1)
        }
        frame "Rsh (Ω · m^2)" {
          Property Node(instance in=w22) -> ("Rsh Plot"=w1)
        }
      }
      Property Node(instance in=w6, "Value"=w23, error in=s2) -> (error out=w2)
    }
  }
  $"IV Extracted Parameters Plot" <- w1
  $"Error Out" <- w2
  $"Misc Data Mega Cluster Out" <- w3
