vi "SRM file handling.gvi"   [LabVIEW NXG 5.0.0]
inputs:
  "Error In": error
  "Default Data Saving Location": path
  "Modify File Operation": "Modify File Operation.gtype" = "Save TXT"
  "IV Full Data Cluster": "IV Full Data Cluster.gtype"[]
  "Cell Naming Cluster": "Cell Naming Cluster.gtype"
outputs:
  "Error Out": error
  "IV Full Raw Data Out": "IV Full Raw Data.gtype"[]
  "Found Any Folder?": bool
  "Canceled Loading?": bool
  "Loaded Files": string[]
  "Duplicate Measurement Files?": bool
  "Found Files Within all Folders?": bool
types:
  "Modify File Operation.gtype" = enum{"Save TXT", "Load TXT"}
  "Cell Naming Cluster.gtype" = cluster{"Cell Label": string, "Sample Prefix": string, "Author Initials": string, "Current Date": string, "Batch Name": string}
  "IV Single Measurement.gtype" = cluster{"Voltage": f64[], "Current": f64[], "Current Density": f64[], "Dividing Wavelength": f64, "Light Power": f64}
  "Rainbow Sweep Types.gtype" = enum{"Red Sweep Closing", "Red Sweep Opening", "Blue Sweep Closing", "Blue Sweep Opening"}
  "IV Refined Full Sweep Data.gtype" = cluster{"Rs (Ω/m^2)": f64[], "Rsh (Ω/m^2)": f64[], "Jsc (A/m^2)": f64[], "Voc (V)": f64[], "FF (%)": f64[], "Efficiency (%)": f64[], "Dividing Wavelength (nm)": f64[], "Light Power (W)": f64[]}
  "IV Full Data Cluster.gtype" = cluster{"IV Measurements Array": "IV Single Measurement.gtype"[], "Rainbow Sweep Types": "Rainbow Sweep Types.gtype", "IV Refined Data": "IV Refined Full Sweep Data.gtype"}
  "IV Full Raw Data.gtype" = cluster{"Rainbow Sweep Types": "Rainbow Sweep Types.gtype", "IV Raw Data Array": "IV Single Measurement.gtype"[]}
uses:
  Rainbow Measurement Setup::Side Functions::Messages And Prompts::Select path prompt.gvi
  Rainbow Measurement Setup::Side Functions::Path Manipulation::File_FolderName Scan For Sweep.gvi
  Rainbow Measurement Setup::Main Functions::Modify TXT file::Modify Measurement TXT File.gvi
  Rainbow Measurement Setup::Main Functions::Rainbow Measurement::Cell Rainbow Single Measurement::File Handling::SRM Header Info Extractor.gvi
  Rainbow Measurement Setup::Side Functions::Utilities::Array Detect Duplicates.gvi
diagram:
  # This subVI Handles the Saving of all the Single Rainbow Measurement files. It can both save and load the files from a specified folder and to the user folder respectively
  case ($"Error In") {
    frame Error, Default {
      w1 = $"Error In"
      w2 = default
      w3 = default
      w4 = default
      w5 = default
      w6 = default
      w7 = default
    }
    frame No Error {
      case ($"Modify File Operation") {
        frame "Load TXT" {
          w8 = "Please Select the folder with the Rainbow Measurement Files you want to Load. "
          w9 = "Please select the cell folder within the device you want to analyze (i.e. L12)"
          call "Select path prompt.gvi"(Main Message=w8, Sub message=w9, Error In=$"Error In", Cancel Available?=TRUE) -> (New Path=w10, Cancelled?=w11, Error Out=w12)
          case (w11) {
            frame True {
              w7 = default
              w1 = w12
              w3 = TRUE
              w4 = default
              w2 = TRUE
              w5 = default
              w6 = default
            }
            frame False {
              List Folder(error in=w12, path=w10) -> (error out=w13, folder names=w14, path out=w15)
              s1 = w13  # shift register
              s2 = 0  # shift register
              s3 = "IV Full Raw Data.gtype"[] []  # shift register
              for {
                w16 = each element of w14
                Build Path(base path=w15, name or relative path=w16) -> (appended path=w20)
                Search And Replace String(error in (no error)=s1, input string=w16, search string="Raw IV Curves") -> (error out=w21, number of replacements=w22)
                call "File_FolderName Scan For Sweep.gvi"(FileName/FolderName In=w16, Error In=w21) -> (Is File/Folder sweep type?=w23, Sweep Type=w24, Error Out=w25)
                Is Not Equal To 0(x=w22) -> w26
                Logical And(w26, w23) -> w27
                case (w27) {
                  frame False, Default {
                    w28 = s2
                    w29 = s3
                    w30 = w25
                    w31 = default
                    w32 = "Red Sweep Closing"
                    w33 = default
                  }
                  frame True {
                    Array Index(array=s3) -> (out0[s2]=w34)
                    Property Node(instance in=w34) -> ("IV Raw Data Array"=w35)
                    List Folder(error in=w25, path=w20) -> (error out=w36, file names=w37, path out=w38)
                    s4 = w36  # shift register
                    s5 = w35  # shift register
                    s6 = 0  # shift register
                    for {
                      w39 = each element of w37
                      Build Path(base path=w38, name or relative path=w39) -> (appended path=w41)
                      Search And Replace String(input string=w39, search string=".txt") -> (number of replacements=w42)
                      Is Not Equal To 0(x=w42) -> w43
                      case (w43) {
                        frame False, Default {
                          w44 = s4
                          w45 = s5
                          w46 = s6
                          w47 = default
                        }
                        frame True {
                          Increment(x=s6) -> w46
                          call "Modify Measurement TXT File.gvi"(Filename to load/save=w41, Modify File Operation="Load TXT", Error In=s4, Measurement File Type="Single Cell Rainbow Raw") -> (Loaded Data=w48, Header Data=w49, Error Out=w50)
                          Array Index(array=w48) -> (out0[_, 0]=w51, out1[_, 1]=w52, out2[_, 2]=w53)
                          call "SRM Header Info Extractor.gvi"(Header Data=w49, Error In=w50) -> (Dividing Wavelength=w54, Light Power=w55, Error Out=w44)
                          Property Node(instance in="IV Single Measurement.gtype" {all zero or empty}, "Voltage"=w51, "Current"=w52, "Current Density"=w53, "Dividing Wavelength"=w54, "Light Power"=w55) -> (instance out=w56)
                          Insert Into Array(inArray=s5, index0=s6, new=w56) -> w45
                          w47 = TRUE
                        }
                      }
                      append w47 to w40
                      next s4 = w44
                      next s5 = w45
                      next s6 = w46
                    }
                    Or Array Elements(Boolean array=w40) -> (logical OR=w33)
                    Property Node(instance in=w34, "IV Raw Data Array"=s5, "Rainbow Sweep Types"=w24) -> (instance out=w57)
                    Insert Into Array(inArray=s3, new=w57) -> w29
                    Increment(x=s2) -> w28
                    w30 = s4
                    w31 = TRUE
                    w32 = w24
                  }
                }
                append w31 to w17
                append w16 to w4 if w27
                append w32 to w18 if w27
                append w33 to w19
                next s1 = w30
                next s2 = w28
                next s3 = w29
              }
              Or Array Elements(Boolean array=w17) -> (logical OR=w2)
              Or Array Elements(Boolean array=w19) -> (logical OR=w6)
              call "Array Detect Duplicates.gvi"(Array In=w18, Error In=s1) -> (Repeated?=w5, Error Out=w1)
              w7 = s3
              w3 = default
            }
          }
        }
        frame "Save TXT", Default {
          s7 = $"Error In"  # shift register
          for {
            w58 = each element of $"IV Full Data Cluster"
            Property Node(instance in=w58) -> ("IV Measurements Array"=w59, "Rainbow Sweep Types"=w60, "IV Refined Data"=w61)
            s8 = s7  # shift register
            for {
              w62 = each element of w59
              Property Node(instance in=$"Cell Naming Cluster") -> ("Sample Prefix"=w63, instance out=w64)
              Property Node(instance in=w62) -> ("Voltage"=w65, "Current"=w66, "Current Density"=w67, "Dividing Wavelength"=w68, "Light Power"=w69)
              Format Into String(formatString="%d", errIn=s8, w68) -> (outString=w70, errOut=w71)
              Concatenate Strings(w63, ".", w70, "nm") -> w72
              Property Node(instance in=w64, "Sample Prefix"=w72) -> (instance out=w73)
              Concatenate Strings(" Dividing Wavelength (nm) = ", w70, "  Light Power (W) = ") -> w74
              Format Into String(initString=w74, errIn=w71, w69) -> (outString=w75, errOut=w76)
              Build Array(w65, w66, w67) -> w77
              Transpose 2D Array(2D array=w77) -> (transposed array=w78)
              call "Modify Measurement TXT File.gvi"(Variable Header Info=w75, Rainbow Sweep Types=w60, Default Data Saving Location=$"Default Data Saving Location", Modify File Operation="Save TXT", Data To Save=w78, Error In=w76, Cell Naming Cluster=w73, Measurement File Type="Single Cell Rainbow Raw") -> (Error Out=w79)
              next s8 = w79
            }
            Property Node(instance in=w61) -> ("Dividing Wavelength (nm)"=w80, "Light Power (W)"=w81, "Jsc (A/m^2)"=w82, "Voc (V)"=w83, "FF (%)"=w84, "Efficiency (%)"=w85, "Rs (Ω/m^2)"=w86, "Rsh (Ω/m^2)"=w87)
            Build Array(w80, w81, w82, w83, w84, w85, w86, w87) -> w88
            Transpose 2D Array(2D array=w88) -> (transposed array=w89)
            call "Modify Measurement TXT File.gvi"(Rainbow Sweep Types=w60, Default Data Saving Location=$"Default Data Saving Location", Modify File Operation="Save TXT", Data To Save=w89, Error In=s8, Cell Naming Cluster=$"Cell Naming Cluster", Measurement File Type="Single Cell Rainbow Refined") -> (Error Out=w90)
            next s7 = w90
          }
          w1 = s7
          w2 = default
          w3 = default
          w4 = default
          w5 = default
          w6 = default
          w7 = default
        }
      }
    }
  }
  $"Canceled Loading?" <- w3
  $"Found Any Folder?" <- w2
  $"Error Out" <- w1
  $"Found Files Within all Folders?" <- w6
  $"IV Full Raw Data Out" <- w7
  $"Duplicate Measurement Files?" <- w5
  $"Loaded Files" <- w4
