vi "Single Measurement Save Graphs Prompt.gvi"   [LabVIEW NXG 5.0.0]
inputs:
  "Error In": error
outputs:
  "Desired State": "SRM States.gtype"
  "Error Out": error
types:
  "SRM States.gtype" = enum{"Start App", "Detect Instruments", "Initialize Instruments", "Rainbow Sweep", "Close Coms", "Load Measurement", "Save Graphs", "Stop App"}
diagram:
  # This subVI Prompts the user to save or discard the calibration files in case
  # the operation was new calibration. Otherwise it does not
  case ($"Error In") {
    frame Error, Default {
      w1 = "Stop App"
      w2 = $"Error In"
    }
    frame No Error {
      w3 = "Do you wish to save the current\nMeasurement files?\nThey will be saved on your Personal\nFolder with the current date."
      Two Button Dialog(F button name ("Cancel")="Oh, don't bother\nI was just testing.", T button name ("OK")="Yes please save \nthe calibration files :D", message=w3) -> (T Button?=w4)
      Select(s=w4, t="Save Graphs", f="Stop App") -> w1
      w2 = $"Error In"
    }
  }
  $"Error Out" <- w2
  $"Desired State" <- w1
