vi "IV to IJV Data.gvi"   [LabVIEW NXG 5.0.0]
inputs:
  "Error In": error
  "SRM Specific Parameters": "SRM Specific Parameters.gtype"
  "IV Single Measurement In": "IV Single Measurement.gtype"
outputs:
  "Error Out": error
  "IV Single Measurement Out": "IV Single Measurement.gtype"
types:
  "SRM Specific Parameters.gtype" = cluster{"Max Voltage (V)": f64, "Min Voltage (V)": f64, "Voltage Points": u32, "Current Range (A)": f64, "Autorange": bool, "Sweep Direction": bool, "Current Averages": u32, "Max Current (A)": f64, "Integration Time": f64, "Cell Area (m^2)": f64}
  "IV Single Measurement.gtype" = cluster{"Voltage": f64[], "Current": f64[], "Current Density": f64[], "Dividing Wavelength": f64, "Light Power": f64}
diagram:
  # This SubVI takes the cell area and the current and converts
  # the current array into current density
  case ($"Error In") {
    frame Error, Default {
      w1 = $"Error In"
      w2 = $"IV Single Measurement In"
    }
    frame No Error {
      Property Node(instance in=$"IV Single Measurement In") -> ("Current"=w3, instance out=w4)
      Property Node(instance in=$"SRM Specific Parameters") -> ("Cell Area (m^2)"=w5)
      Divide(x=w3, y=w5) -> w6
      Property Node(instance in=w4, "Current Density"=w6) -> (instance out=w2)
      w1 = $"Error In"
    }
  }
  $"Error Out" <- w1
  $"IV Single Measurement Out" <- w2
