vi "Jsc and Voc.gvi"   [LabVIEW NXG 5.0.0]
inputs:
  "Error In": error
  "IV Single Measurement": "IV Single Measurement.gtype"
  "Points For Average": i32
outputs:
  "Error Out": error
  "IV Sweep Data Out": "IV Refined Single Sweep Data.gtype"
types:
  "IV Refined Single Sweep Data.gtype" = cluster{"Rs (Ω/m^2)": f64, "Rsh (Ω/m^2)": f64, "Jsc (A/m^2)": f64, "Voc (V)": f64, "FF (%)": f64, "Efficiency (%)": f64, "Dividing Wavelength": f64, "Light Power": f64}
  "IV Single Measurement.gtype" = cluster{"Voltage": f64[], "Current": f64[], "Current Density": f64[], "Dividing Wavelength": f64, "Light Power": f64}
uses:
  Rainbow Measurement Setup::Side Functions::Messages And Prompts::FGV Cancel Prompts until Finished Routine.gvi
  Rainbow Measurement Setup::Side Functions::Utilities::Find Closest In Array.gvi
  NI::Analysis::Fitting::Linear Fit.gvi
diagram:
  # This SubVI Takes the Voltage and the current data arrays and searches for the places where they cross both the x and the y axis. If found within tolerance we then obtain the suroulding
  # points for average and we perform a linear fit around those points to extract the parameters of the fitting line around those regions. With the parameters we extract the intersection points
  # for the Jsc and the Voc and we also extract the slopes for the Rs and the Rsh
  case ($"Error In") {
    frame Error, Default {
      w1 = $"Error In"
      w2 = default
    }
    frame No Error {
      Property Node(instance in=$"IV Single Measurement") -> ("Voltage"=w3, "Current Density"=w4, "Dividing Wavelength"=w5, "Light Power"=w6)
      call "FGV Cancel Prompts until Finished Routine.gvi"(Error In=$"Error In", FGV Instructions="Read State") -> (Prompt? Out=w7, Error Out=w8)
      call "Find Closest In Array.gvi"(Array In=w3, Desired Value=0, Tolerance=0.2, Error In=w8) -> (Closest Value Index=w9, Within Tolerance?=w10, Error Out=w11)
      call "Find Closest In Array.gvi"(Array In=w4, Desired Value=0, Tolerance=0.1, Error In=w11) -> (Closest Value Index=w12, Within Tolerance?=w13, Error Out=w14)
      To Double Precision Float(number=$"Points For Average") -> w15
      To Double Precision Float(number=2) -> w16
      Divide(x=w15, y=w16) -> w17
      Round Toward Negative Infinity(x=w17) -> w18
      To Signed 32 Bit Integer(number=w18) -> w19
      Array Size(array=w3) -> (size(s)=w20)
      Add(w12, w19) -> w21
      Is Greater(x=w20, y=w21) -> w22
      Subtract(x=w12, y=w19) -> w23
      Is Greater Than 0(x=w23) -> w24
      Logical And(w22, w24) -> w25
      Array Size(array=w4) -> (size(s)=w26)
      Add(w9, w19) -> w27
      Is Greater(x=w26, y=w27) -> w28
      Subtract(x=w9, y=w19) -> w29
      Is Greater Than 0(x=w29) -> w30
      Logical And(w28, w30) -> w31
      Is Greater Than 0(x=w12) -> w32
      Is Greater Than 0(x=w9) -> w33
      Logical And(w25, w32, w31, w33, w10, w13) -> w34
      case (w34) {
        frame False, Default {
          w39 = "There have been some problems with the calculations of the Jsc and the Voc:"
          Concatenate Strings(w39, "\r", "\r") -> w40
          w41 = "The amount of points close to the J=0 region is insuficient. Try Extending the Electrical Sweep Range."
          Concatenate Strings(w41, "\r", "\r") -> w42
          Select(s=w25, t="", f=w42) -> w43
          w44 = "The amount of points close to the V=0 region is insuficient. Try Extending the Electrical Sweep Range."
          Concatenate Strings(w44, "\r", "\r") -> w45
          Select(s=w31, t="", f=w45) -> w46
          Logical And(w13, w32) -> w47
          w48 = "Could not find a point where J = 0 A. (J<0.01 A) Please make sure that the selected max and min Voltages are correct."
          Concatenate Strings(w48, "\r", "\r") -> w49
          Select(s=w47, t="", f=w49) -> w50
          Logical And(w10, w33) -> w51
          w52 = "Could not find a point where V = 0 V. (V<0.2 V) Please make sure that the selected max and min Voltages are correct."
          Concatenate Strings(w52, "\r", "\r") -> w53
          Select(s=w51, t="", f=w53) -> w54
          Concatenate Strings(w40, w43, w46, w50, w54) -> w55
          case (w7) {
            frame False, Default {
              w1 = w14
            }
            frame True {
              Two Button Dialog(F button name ("Cancel")="Okay you can stop\ntelling me this, thanks.", T button name ("OK")="Okay Sorry", message=w55) -> (T Button?=w56)
              call "FGV Cancel Prompts until Finished Routine.gvi"(Error In=w14, FGV Instructions="Set State", Prompt? In=w56) -> (Error Out=w1)
            }
          }
          w35 = default
          w36 = default
          w37 = default
          w38 = default
        }
        frame True {
          # w9: Jsc Index
          Subtract(x=w9, y=w19) -> w57
          Array Subset(array=w4, index0=w57, length0=$"Points For Average") -> w58
          # w3: Voltage Values
          # w4: Current Values
          Array Subset(array=w3, index0=w57, length0=$"Points For Average") -> w59
          # w12: Voc Index
          Subtract(x=w12, y=w19) -> w60
          Array Subset(array=w4, index0=w60, length0=$"Points For Average") -> w61
          Array Subset(array=w3, index0=w60, length0=$"Points For Average") -> w62
          call "Linear Fit.gvi"(method="Least Square"(0), y=w61, x=w62, error in=w14) -> (slope=w36, intercept=w63, error out=w64)
          call "Linear Fit.gvi"(method="Least Square"(0), y=w58, x=w59, error in=w64) -> (slope=w35, intercept=w37, error out=w1)
          Multiply(w63, -1) -> w65
          Divide(x=w65, y=w36) -> w38
        }
      }
      Property Node(instance in="IV Refined Single Sweep Data.gtype" {all zero or empty}, "Rs (Ω/m^2)"=w35, "Rsh (Ω/m^2)"=w36, "Jsc (A/m^2)"=w37, "Voc (V)"=w38, "Dividing Wavelength"=w5, "Light Power"=w6) -> (instance out=w2)
    }
  }
  $"IV Sweep Data Out" <- w2
  $"Error Out" <- w1
