vi "SRM IV Parameters Calculator.gvi"   [LabVIEW NXG 5.0.0]
inputs:
  "Error In": error
  "IV Raw Data Array": "IV Full Raw Data.gtype"[]
outputs:
  "Error Out": error
  "IV Full Data Cluster Array": "IV Full Data Cluster.gtype"[]
types:
  "Rainbow Sweep Types.gtype" = enum{"Red Sweep Closing", "Red Sweep Opening", "Blue Sweep Closing", "Blue Sweep Opening"}
  "IV Single Measurement.gtype" = cluster{"Voltage": f64[], "Current": f64[], "Current Density": f64[], "Dividing Wavelength": f64, "Light Power": f64}
  "IV Full Raw Data.gtype" = cluster{"Rainbow Sweep Types": "Rainbow Sweep Types.gtype", "IV Raw Data Array": "IV Single Measurement.gtype"[]}
  "IV Refined Full Sweep Data.gtype" = cluster{"Rs (Ω/m^2)": f64[], "Rsh (Ω/m^2)": f64[], "Jsc (A/m^2)": f64[], "Voc (V)": f64[], "FF (%)": f64[], "Efficiency (%)": f64[], "Dividing Wavelength (nm)": f64[], "Light Power (W)": f64[]}
  "IV Full Data Cluster.gtype" = cluster{"IV Measurements Array": "IV Single Measurement.gtype"[], "Rainbow Sweep Types": "Rainbow Sweep Types.gtype", "IV Refined Data": "IV Refined Full Sweep Data.gtype"}
uses:
  Rainbow Measurement Setup::Main Functions::Rainbow Measurement::Cell Rainbow Single Measurement::IV Calculations::Jsc and Voc.gvi
  Rainbow Measurement Setup::Main Functions::Rainbow Measurement::Cell Rainbow Single Measurement::IV Calculations::FF and Efficiency.gvi
diagram:
  # This SubVI takes raw IV Data in and transforms it into computed
  # IV Sweep data with all the calculated parameters. Then it stores it all
  # into an array with all the information so that it can be later saved and processed
  case ($"Error In") {
    frame Error, Default {
      w1 = $"Error In"
      w2 = default
    }
    frame No Error {
      s1 = $"Error In"  # shift register
      for {
        w3 = each element of $"IV Raw Data Array"
        Property Node(instance in=w3) -> ("Rainbow Sweep Types"=w4, "IV Raw Data Array"=w5)
        s2 = s1  # shift register
        for {
          w6 = each element of w5
          call "Jsc and Voc.gvi"(IV Single Measurement=w6, Points For Average=5, Error In=s2) -> (IV Sweep Data Out=w15, Error Out=w16)
          call "FF and Efficiency.gvi"(IV Sweep Data In=w15, IV Single Measurement=w6, Error In=w16) -> (IV Sweep Data Out=w17, Error Out=w18)
          Property Node(instance in=w17) -> ("Rs (Ω/m^2)"=w19, "Rsh (Ω/m^2)"=w20, "Jsc (A/m^2)"=w21, "Voc (V)"=w22, "FF (%)"=w23, "Efficiency (%)"=w24, "Dividing Wavelength"=w25, "Light Power"=w26)
          append w26 to w7
          append w25 to w8
          append w24 to w9
          append w23 to w10
          append w22 to w11
          append w21 to w12
          append w20 to w13
          append w19 to w14
          next s2 = w18
        }
        Property Node(instance in="IV Refined Full Sweep Data.gtype" {all zero or empty}, "Rs (Ω/m^2)"=w14, "Rsh (Ω/m^2)"=w13, "Jsc (A/m^2)"=w12, "Voc (V)"=w11, "FF (%)"=w10, "Efficiency (%)"=w9, "Dividing Wavelength (nm)"=w8, "Light Power (W)"=w7) -> (instance out=w27)
        Property Node(instance in="IV Full Data Cluster.gtype" {all zero or empty}, "IV Measurements Array"=w5, "Rainbow Sweep Types"=w4, "IV Refined Data"=w27) -> (instance out=w28)
        append w28 to w2
        next s1 = s2
      }
      w1 = s1
    }
  }
  $"Error Out" <- w1
  $"IV Full Data Cluster Array" <- w2
