vi "SRM Sweep parameter Mismatch.gvi"   [LabVIEW NXG 5.0.0]
inputs:
  "Wavelength Step Equal?": bool
  "Wavelength Step (nm)": f64
  "Mismatch?": bool
  "Constant Steps?": bool
  "In Range?": bool
  "Wavelenght Array": f64[]
  "Rainbow Sweep Types": "Rainbow Sweep Types.gtype" = "Red Sweep Closing"
  "Error In": error
outputs:
  "Error Out": error
  "Desired Operation": "SRM Wrong Sweep Parameters Operation.gtype"
types:
  "Rainbow Sweep Types.gtype" = enum{"Red Sweep Closing", "Red Sweep Opening", "Blue Sweep Closing", "Blue Sweep Opening"}
  "SRM Wrong Sweep Parameters Operation.gtype" = enum{"Change Parameters", "Cancel Measurement", "Continue"}
diagram:
  # This SubVI Prompts the user with the problems that have been encountered within the current loaded calibration file
  # and prompts it to decide what to do about it. It outputs the users decision as an enum.
  case ($"Error In") {
    frame Error, Default {
      w1 = "Cancel Measurement"
      w2 = $"Error In"
    }
    frame No Error {
      case ($"Mismatch?") {
        frame False, Default {
          w3 = "Your Calibration file seems to have non constant wavelength steps, please remake the light power calibration."
          Select(s=$"Constant Steps?", t="", f=w3) -> w4
          Concatenate Strings(w4, "\r", "\r") -> w5
          w6 = """The Wavelength step you selected is not equal to the one on your calibration file:
Calibration file                Wavelength Step
"""
          Format Into String(initString=w6, errIn=$"Error In", $"Rainbow Sweep Types") -> (outString=w7, errOut=w8)
          Concatenate Strings(w7, "\t") -> w9
          Format Into String(formatString="%d", initString=w9, errIn=w8, $"Wavelength Step (nm)") -> (outString=w10, errOut=w11)
          Concatenate Strings(w10, " nm") -> w12
          Concatenate Strings(w12, "\r", "\r") -> w13
          Select(s=$"Wavelength Step Equal?", t="", f=w13) -> w14
          Array Max And Min(array=$"Wavelenght Array") -> (max value=w15, min value=w16)
          w17 = """The Wavelength range you selected is not in range with the one on your calibration file:
Calibration file                Wavelength Range
"""
          Format Into String(initString=w17, errIn=w11, $"Rainbow Sweep Types") -> (outString=w18, errOut=w19)
          Concatenate Strings(w18, "\t") -> w20
          Format Into String(formatString="%d", initString=w20, errIn=w19, w16) -> (outString=w21, errOut=w22)
          Concatenate Strings(w21, " nm  ") -> w23
          Format Into String(formatString="%d", initString=w23, errIn=w22, w15) -> (outString=w24, errOut=w2)
          Concatenate Strings(w24, " nm  ") -> w25
          Concatenate Strings(w25, "\r", "\r") -> w26
          Select(s=$"In Range?", t="", f=w26) -> w27
          w28 = "There is at least one problem with your light power calibration files:"
          Concatenate Strings(w28, "\r", w14, w27, w5) -> w29
          case ($"Constant Steps?") {
            frame False, Default {
              w30 = "Okay I will change the\ncalibration file or remake\nthe light power calibration"
              One Button Dialog(button name ("OK")=w30, message=w29)
              w1 = "Cancel Measurement"
            }
            frame True {
              w31 = "Change The Rainbow\nParameters so that they\nmatch the ones in the \nCalibration file."
              Two Button Dialog(F button name ("Cancel")="Cancel The \nMeasurement", T button name ("OK")=w31, message=w29) -> (T Button?=w32)
              case (w32) {
                frame False, Default {
                  w1 = "Cancel Measurement"
                }
                frame True {
                  w1 = "Change Parameters"
                }
              }
            }
          }
        }
        frame True {
          w2 = $"Error In"
          w1 = "Continue"
        }
      }
    }
  }
  $"Desired Operation" <- w1
  $"Error Out" <- w2
