vi "SRM FGV Read Handler.gvi"   [LabVIEW NXG 5.0.0]
inputs:
  "SRM sweep live parameters FGV Cluster In": "SRM Sweep Live Parameters FGV Cluster.gtype"
  "Error In": error
outputs:
  "SRM sweep live parameters FGV Cluster Out": "SRM Sweep Live Parameters FGV Cluster.gtype"
  "Error Out": error
types:
  "IV Single Measurement.gtype" = cluster{"Voltage": f64[], "Current": f64[], "Current Density": f64[], "Dividing Wavelength": f64, "Light Power": f64}
  "SRM Single Plot Cluster.gtype" = cluster{"Voltage": f64[], "Current Density": f64[]}
  "Rainbow Sweep Types.gtype" = enum{"Red Sweep Closing", "Red Sweep Opening", "Blue Sweep Closing", "Blue Sweep Opening"}
  "SRM Sweep Live Parameters.gtype" = cluster{"Current Wavelength (nm)": f64, "Rainbow Sweep Types": "Rainbow Sweep Types.gtype", "Finished Measurement?": bool}
  "IV Full Raw Data.gtype" = cluster{"Rainbow Sweep Types": "Rainbow Sweep Types.gtype", "IV Raw Data Array": "IV Single Measurement.gtype"[]}
  "SRM Sweep Live Parameters FGV Cluster.gtype" = cluster{"IV Single Measurement Array": "IV Single Measurement.gtype"[], "SRM Sweep type combo box selction": string, "IV Single Measurement Plot Array": "SRM Single Plot Cluster.gtype"[], "SRM Live Parameters": "SRM Sweep Live Parameters.gtype", "Counter": i32, "Full IV Data Array": "IV Full Raw Data.gtype"[], "Combobox Reference": "ComboBoxSelector reference", "Graph Reference": "Graph reference", "Refresh now": bool}
uses:
  Rainbow Measurement Setup::Main Functions::Rainbow Measurement::Cell Rainbow Single Measurement::Plotting::SRM Raw Data Graph Adapter.gvi
diagram:
  # This SubVI Takes care of selecting the right set of data to plot from the SRM Sweep Raw Data and it also sets both the name of the available plots and the dividing wavelength that corresponds to each and
  # every plot within the graph. It does so every now and then to prevent being too wasteful on resources.
  case ($"Error In") {
    frame Error, Default {
      w1 = $"Error In"
      w2 = $"SRM sweep live parameters FGV Cluster In"
    }
    frame No Error {
      Property Node(instance in=$"SRM sweep live parameters FGV Cluster In") -> ("Graph Reference"=w3, "Combobox Reference"=w4, "SRM Live Parameters:Finished Measurement?"=w5, "Full IV Data Array"=w6, "Counter"=w7, "SRM Sweep type combo box selction"=w8, "IV Single Measurement Plot Array"=w9, "IV Single Measurement Array"=w10, "Refresh now"=w11, instance out=w12)
      Not(x=w5) -> w13
      Property Node(instance in=w4, "Disabled"=w13, error in=$"Error In") -> ("Value"=w14, error out=w15, instance out=w16)
      Is Not Equal(x=w14, y=w8) -> w17
      Logical Or(w17, w11) -> w18
      case (w18) {
        frame False, Default {
          w19 = w9
          w20 = w15
          w21 = w10
        }
        frame True {
          for {
            w22 = each element of w6
            Property Node(instance in=w22) -> ("Rainbow Sweep Types"=w23, "IV Raw Data Array"=w24)
            Format Into String(w23) -> w25
            Is Equal(x=w14, y=w25) -> w26
            w21 = w24 if w26
          }
          call "SRM Raw Data Graph Adapter.gvi"(IV Raw Data Array=w21, Error In=w15) -> (IV Plot Out=w19, Error Out=w20)
        }
      }
      Increment(x=w7) -> w27
      Is Greater(x=w27, y=50) -> w28
      Logical Or(w28, w17, w11) -> w29
      case (w29) {
        frame False, Default {
          w1 = w20
          w30 = w27
          w31 = FALSE
        }
        frame True {
          for {
            w32 = each element of w6
            Property Node(instance in=w32) -> ("Rainbow Sweep Types"=w34)
            Format Into String(w34) -> w35
            append w35 to w33
          }
          s1 = w20  # shift register
          for (iteration -> i1) {
            w36 = each element of w21
            Property Node(instance in=w3, "ActivePlot"=i1, error in=s1) -> ("Plot"=w37, error out=w38)
            Property Node(instance in=w36) -> ("Dividing Wavelength"=w39)
            Format Into String(formatString="%d", w39) -> w40
            Concatenate Strings(w40, " nm") -> w41
            Property Node(instance in=w37, "Name"=w41, error in=w38) -> (error out=w42, instance out=w43)
            next s1 = w42
          }
          Property Node(instance in=w16, "Items"=w33, error in=s1) -> (error out=w44, instance out=w45)
          case (w11) {
            frame False, Default {
              w1 = w44
            }
            frame True {
              Property Node(instance in=w45, "ValueSignaling"=w35, error in=w44) -> (error out=w1)
            }
          }
          w30 = 0
          w31 = FALSE
        }
      }
      Property Node(instance in=w12, "Counter"=w30, "SRM Sweep type combo box selction"=w14, "IV Single Measurement Plot Array"=w19, "Refresh now"=w31) -> (instance out=w2)
    }
  }
  $"SRM sweep live parameters FGV Cluster Out" <- w2
  $"Error Out" <- w1
