vi "SRM Refined Data Graph Adapter.gvi"   [LabVIEW NXG 5.0.0]
inputs:
  "Error In": error
  "IV Full Data Cluster Array In": "IV Full Data Cluster.gtype"[]
outputs:
  "Error Out": error
  "IV Full Data To Plot": "SRM IV Refined Data Plot.gtype"[]
types:
  "IV Single Measurement.gtype" = cluster{"Voltage": f64[], "Current": f64[], "Current Density": f64[], "Dividing Wavelength": f64, "Light Power": f64}
  "Rainbow Sweep Types.gtype" = enum{"Red Sweep Closing", "Red Sweep Opening", "Blue Sweep Closing", "Blue Sweep Opening"}
  "IV Refined Full Sweep Data.gtype" = cluster{"Rs (Ω/m^2)": f64[], "Rsh (Ω/m^2)": f64[], "Jsc (A/m^2)": f64[], "Voc (V)": f64[], "FF (%)": f64[], "Efficiency (%)": f64[], "Dividing Wavelength (nm)": f64[], "Light Power (W)": f64[]}
  "IV Full Data Cluster.gtype" = cluster{"IV Measurements Array": "IV Single Measurement.gtype"[], "Rainbow Sweep Types": "Rainbow Sweep Types.gtype", "IV Refined Data": "IV Refined Full Sweep Data.gtype"}
  T1 = cluster{"Dividing Wavelength (nm)": f64[], "Efficiency (%)": f64[]}
  T2 = cluster{"Dividing Wavelength (nm)": f64[], "Jsc (A/m^2)": f64[]}
  T3 = cluster{"Dividing Wavelength (nm)": f64[], "Voc (V)": f64[]}
  T4 = cluster{"Dividing Wavelength (nm)": f64[], "Light Power (W)": f64[]}
  T5 = cluster{"Dividing Wavelength (nm)": f64[], "FF (%)": f64[]}
  T6 = cluster{"Dividing Wavelength (nm)": f64[], "Rs (Ω/m^2)": f64[]}
  T7 = cluster{"Dividing Wavelength (nm)": f64[], "Rsh (Ω/m^2)": f64[]}
  "SRM IV Refined Data Plot.gtype" = cluster{"Efficiency Plot": T1, "Jsc Plot": T2, "Voc Plot": T3, "Light Power Plot": T4, "FF Plot": T5, "Rs Plot": T6, "Rsh Plot": T7, "Rainbow Sweep Types": "Rainbow Sweep Types.gtype"}
diagram:
  case ($"Error In") {
    frame Error, Default {
      w1 = $"Error In"
      w2 = default
    }
    frame No Error {
      for {
        w3 = each element of $"IV Full Data Cluster Array In"
        Property Node(instance in=w3) -> ("IV Refined Data"=w4, "Rainbow Sweep Types"=w5)
        Property Node(instance in=w4) -> ("Efficiency (%)"=w6, "Jsc (A/m^2)"=w7, "Voc (V)"=w8, "Light Power (W)"=w9, "FF (%)"=w10, "Rs (Ω/m^2)"=w11, "Rsh (Ω/m^2)"=w12, "Dividing Wavelength (nm)"=w13)
        Property Node(instance in=T1 {all zero or empty}, "Dividing Wavelength (nm)"=w13, "Efficiency (%)"=w6) -> (instance out=w14)
        Property Node(instance in=T2 {all zero or empty}, "Dividing Wavelength (nm)"=w13, "Jsc (A/m^2)"=w7) -> (instance out=w15)
        Property Node(instance in=T3 {all zero or empty}, "Dividing Wavelength (nm)"=w13, "Voc (V)"=w8) -> (instance out=w16)
        Property Node(instance in=T4 {all zero or empty}, "Dividing Wavelength (nm)"=w13, "Light Power (W)"=w9) -> (instance out=w17)
        Property Node(instance in=T5 {all zero or empty}, "Dividing Wavelength (nm)"=w13, "FF (%)"=w10) -> (instance out=w18)
        Property Node(instance in=T6 {all zero or empty}, "Dividing Wavelength (nm)"=w13, "Rs (Ω/m^2)"=w11) -> (instance out=w19)
        Property Node(instance in=T7 {all zero or empty}, "Dividing Wavelength (nm)"=w13, "Rsh (Ω/m^2)"=w12) -> (instance out=w20)
        Property Node(instance in="SRM IV Refined Data Plot.gtype" {all zero or empty}, "Efficiency Plot"=w14, "Jsc Plot"=w15, "Voc Plot"=w16, "Light Power Plot"=w17, "FF Plot"=w18, "Rs Plot"=w19, "Rsh Plot"=w20, "Rainbow Sweep Types"=w5) -> (instance out=w21)
        append w21 to w2
      }
      w1 = $"Error In"
    }
  }
  $"Error Out" <- w1
  $"IV Full Data To Plot" <- w2
