vi "SRM Sweep Refined Data FGV.gvi"   [LabVIEW NXG 5.0.0]
inputs:
  "Error In": error
  "FGV Instructions": "General FGV Instructions.gtype" = "Read State"
  "IV Full Data Cluster Array In": "IV Full Data Cluster.gtype"[]
  "Parameter Selector": "SRM Refined Plot Parameter Selector.gtype" = "Efficiency (%)"
  "SRM Refined Plot Rainbow Sweep Types Selector": "ComboBoxSelector reference"
outputs:
  "Error Out": error
  "IV Extracted Parameters Plot": T1
types:
  "General FGV Instructions.gtype" = enum{"Read State", "Set State", "Reset State"}
  "SRM Refined Plot Parameter Selector.gtype" = enum{"Efficiency (%)", "Jsc (A)", "Voc (V)", "Light Power (W)", "FF (%)", "Rs (Ω/m^2)", "Rsh (Ω/m^2)"}
  "IV Single Measurement.gtype" = cluster{"Voltage": f64[], "Current": f64[], "Current Density": f64[], "Dividing Wavelength": f64, "Light Power": f64}
  "Rainbow Sweep Types.gtype" = enum{"Red Sweep Closing", "Red Sweep Opening", "Blue Sweep Closing", "Blue Sweep Opening"}
  "IV Refined Full Sweep Data.gtype" = cluster{"Rs (Ω/m^2)": f64[], "Rsh (Ω/m^2)": f64[], "Jsc (A/m^2)": f64[], "Voc (V)": f64[], "FF (%)": f64[], "Efficiency (%)": f64[], "Dividing Wavelength (nm)": f64[], "Light Power (W)": f64[]}
  "IV Full Data Cluster.gtype" = cluster{"IV Measurements Array": "IV Single Measurement.gtype"[], "Rainbow Sweep Types": "Rainbow Sweep Types.gtype", "IV Refined Data": "IV Refined Full Sweep Data.gtype"}
  T1 = cluster{"Dividing Wavelength (nm)": f64[], "Element 2": f64[]}
uses:
  Rainbow Measurement Setup::Main Functions::Rainbow Measurement::Cell Rainbow Single Measurement::Plotting::SRM Refined Data Graph Adapter.gvi
diagram:
  # This FGV Stores the SRM live parameters and the plots so that
  # they can be updated live while being measured. It also sets the name
  # of the plots so that you know which color corresponds to each dividing wavelength
  case ($"Error In") {
    frame Error, Default {
      w1 = $"Error In"
    }
    frame No Error {
      s1 = $"Error In"  # shift register
      s2 = uninitialised  # shift register
      s3 = uninitialised  # shift register
      s4 = uninitialised  # shift register
      s5 = uninitialised  # shift register
      while {
        case ($"FGV Instructions") {
          frame "Read State", Default {
            Property Node(instance in=$"SRM Refined Plot Rainbow Sweep Types Selector", error in=s1) -> ("Value"=w7, error out=w3, instance out=w6)
            for {
              w8 = each element of s2
              Property Node(instance in=w8) -> ("Rainbow Sweep Types"=w10, instance out=w11)
              Format Into String(w10) -> w12
              Is Equal(x=w12, y=w7) -> w13
              w9 = w11 if w13
            }
            case ($"Parameter Selector") {
              frame "Efficiency (%)", Default {
                Property Node(instance in=w9) -> ("Efficiency Plot"=w5)
              }
              frame "Jsc (A)" {
                Property Node(instance in=w9) -> ("Jsc Plot"=w5)
              }
              frame "Voc (V)" {
                Property Node(instance in=w9) -> ("Voc Plot"=w5)
              }
              frame "Light Power (W)" {
                Property Node(instance in=w9) -> ("Light Power Plot"=w5)
              }
              frame "FF (%)" {
                Property Node(instance in=w9) -> ("FF Plot"=w5)
              }
              frame "Rs (Ω/m^2)" {
                Property Node(instance in=w9) -> ("Rsh Plot"=w5)
              }
              frame "Rsh (Ω/m^2)" {
                Property Node(instance in=w9) -> ("Rsh Plot"=w5)
              }
            }
            $"IV Extracted Parameters Plot" <- w5
            w2 = s3
            w4 = s2
          }
          frame "Set State" {
            call "SRM Refined Data Graph Adapter.gvi"(IV Full Data Cluster Array In=$"IV Full Data Cluster Array In", Error In=s1) -> (IV Full Data To Plot=w4, Error Out=w14)
            s6 = w14  # shift register
            for {
              w15 = each element of $"IV Full Data Cluster Array In"
              Property Node(instance in=w15) -> ("Rainbow Sweep Types"=w17)
              Format Into String(w17) -> w18
              append w18 to w16
            }
            Property Node(instance in=s5, "Items"=w16, error in=s6) -> (error out=w3, instance out=w6)
            w2 = $"IV Full Data Cluster Array In"
            w5 = s4
          }
          frame "Reset State" {
            w2 = default
            w3 = s1
            w4 = default
            w5 = default
            w6 = default
          }
        }
        next s1 = w3
        next s2 = w4
        next s3 = w2
        next s4 = w5
        next s5 = w6
        stop if TRUE
      }
      w1 = s1
    }
  }
  $"Error Out" <- w1
