vi "SRM Check Light Power Data.gvi"   [LabVIEW NXG 5.0.0]
inputs:
  "Error In": error
outputs:
  "Error Out": error
panel controls:
  "Light Power Calibration Data": "Light Power Calibration Data.gtype"[]
  "Rainbow Sweep Param Selector": "Rainbow Sweep Param Selector.gtype" = {0, 1100, 300, 1, 1, 0}
panel indicators:
  "Do I have the current calibration sweep type?": bool
types:
  T1 = cluster{"Dividing Wavelength Array": f64[], "Measured Power Array": f64[]}
  "Rainbow Sweep Types.gtype" = enum{"Red Sweep Closing", "Red Sweep Opening", "Blue Sweep Closing", "Blue Sweep Opening"}
  "Light Power Calibration Data.gtype" = cluster{"Single Light Calibration": T1, "Rainbow Sweep Types": "Rainbow Sweep Types.gtype"}
  "Raibow Sweep Selector.gtype" = enum{"Red Sweep", "Blue Sweep", "Full Sweep Red First", "Full Sweep Blue First"}
  T2 = enum{"Red Sweep Closing", "Red Sweep Opening", "Red Sweep Both Ways"}
  T3 = enum{"Blue Sweep Opening", "Blue Sweep Closing", "Blue Sweep Both Ways"}
  "Rainbow Sweep Type Selector.gtype" = cluster{"Red Sweep Mode": T2, "Blue Sweep Mode": T3}
  "Rainbow Sweep Param Selector.gtype" = cluster{"Raibow Sweep Selector": "Raibow Sweep Selector.gtype", "Max Wavelength (nm)": f64, "Min Wavelength (nm)": f64, "Wavelength Step (nm)": f64, "Rainbow Sweep Type Selector": "Rainbow Sweep Type Selector.gtype"}
uses:
  Rainbow Measurement Setup::Side Functions::Rainbow Sweep::Rainbow Sweep Param Generator.gvi
diagram:
  w1 = $"Light Power Calibration Data"
  w2 = $"Rainbow Sweep Param Selector"
  case ($"Error In") {
    frame Error, Default {
      w3 = $"Error In"
    }
    frame No Error {
      Is Empty Array(array=w1) -> w4
      case (w4) {
        frame False, Default {
          call "Rainbow Sweep Param Generator.gvi"(Rainbow Sweep Parameters=w2, Error In=$"Error In") -> (Rainbow Sweep Parameters Array=w5)
          for {
            w6 = each element of w5
            Property Node(instance in=w6) -> ("Rainbow Sweep Types"=w7)
            for {
              w8 = each element of w1
              Property Node(instance in=w8) -> ("Rainbow Sweep Types"=w10)
              Is Equal(x=w10, y=w7) -> w11
              append w11 to w9
            }
            Or Array Elements(Boolean array=w9) -> (logical OR=w12)
            $"Do I have the current calibration sweep type?" <- w12
            Property Node(instance in=w2)
          }
        }
        frame True { }
      }
      w3 = _
    }
  }
  $"Error Out" <- w3
