vi "SRM Rainbow Sweep.gvi"   [LabVIEW NXG 5.0.0]
inputs:
  "Error In": error
  "SRM Specific Parameters": "SRM Specific Parameters.gtype"
  "Rainbow Sweep Param Selector": "Rainbow Sweep Param Selector.gtype" = {0, 1100, 300, 1, 1, 0}
  "Debugging Cluster In": "Debugging Cluster.gtype"
  "Instrument Coms Info In": "Instrument Coms Info.gtype"
  "Light Power Calibration Data": "Light Power Calibration Data.gtype"[]
outputs:
  "Error Out": error
  "Instrument Coms Info Out": "Instrument Coms Info.gtype"
  "Debugging Cluster Out": "Debugging Cluster.gtype"
  "Full IV Curve Raw Data": "IV Full Raw Data.gtype"[]
types:
  "SRM Specific Parameters.gtype" = cluster{"Max Voltage (V)": f64, "Min Voltage (V)": f64, "Voltage Points": u32, "Current Range (A)": f64, "Autorange": bool, "Sweep Direction": bool, "Current Averages": u32, "Max Current (A)": f64, "Integration Time": f64, "Cell Area (m^2)": f64}
  "Raibow Sweep Selector.gtype" = enum{"Red Sweep", "Blue Sweep", "Full Sweep Red First", "Full Sweep Blue First"}
  T1 = enum{"Red Sweep Closing", "Red Sweep Opening", "Red Sweep Both Ways"}
  T2 = enum{"Blue Sweep Opening", "Blue Sweep Closing", "Blue Sweep Both Ways"}
  "Rainbow Sweep Type Selector.gtype" = cluster{"Red Sweep Mode": T1, "Blue Sweep Mode": T2}
  "Rainbow Sweep Param Selector.gtype" = cluster{"Raibow Sweep Selector": "Raibow Sweep Selector.gtype", "Max Wavelength (nm)": f64, "Min Wavelength (nm)": f64, "Wavelength Step (nm)": f64, "Rainbow Sweep Type Selector": "Rainbow Sweep Type Selector.gtype"}
  "Insturment Debugging Cluster.gtype" = cluster{"Keithley": bool, "Arduinos": bool, "Thorlabs Motors": bool, "Photodetector": bool, "Flame Spectr": bool}
  "Debugging Cluster.gtype" = cluster{"Debugging mode?": bool, "Initialize App": bool, "Insturment Debugging": "Insturment Debugging Cluster.gtype"}
  T3 = cluster{"Element 1": "VISA Instr", "Element 2": string}
  "Arduino Detection cluster control.gtype" = cluster{"XZ Stage Arduino Address": "VISA Instr", "XZ Stage Arduino Detected?": bool, "Multiplexer Arduino Detected?": bool, "Multiplexer Arduino Address": "VISA Instr", "Arduinos List": T3[], "XZ Stage Log": string, "Multiplexer Log": string}
  "Thorlabs Motors Serial Number In.gtype" = cluster{"Thorlabs Blue Motor": string, "Thorlabs Red Motor": string, "Blue Motor Homed?": bool, "Red Motor Homed?": bool}
  "Instrument Coms Info.gtype" = cluster{"Arduino Coms Info": "Arduino Detection cluster control.gtype", "Photodetector Names": string[], "Keythley Address": "VISA Instr", "Photodetector Detected?": bool, "Thorlabs Motors Detected?": bool, "Keithley Detected?": bool, "Thorlabs Motors Serial Number": "Thorlabs Motors Serial Number In.gtype", "Photodetector IVI session": "Ivi IviDefault", "Flame ID": string, "Flame Detected?": bool, "Flame Wrapper ID": u64}
  T4 = cluster{"Dividing Wavelength Array": f64[], "Measured Power Array": f64[]}
  "Rainbow Sweep Types.gtype" = enum{"Red Sweep Closing", "Red Sweep Opening", "Blue Sweep Closing", "Blue Sweep Opening"}
  "Light Power Calibration Data.gtype" = cluster{"Single Light Calibration": T4, "Rainbow Sweep Types": "Rainbow Sweep Types.gtype"}
  "IV Single Measurement.gtype" = cluster{"Voltage": f64[], "Current": f64[], "Current Density": f64[], "Dividing Wavelength": f64, "Light Power": f64}
  "IV Full Raw Data.gtype" = cluster{"Rainbow Sweep Types": "Rainbow Sweep Types.gtype", "IV Raw Data Array": "IV Single Measurement.gtype"[]}
  "SRM Sweep Live Parameters.gtype" = cluster{"Current Wavelength (nm)": f64, "Rainbow Sweep Types": "Rainbow Sweep Types.gtype"}
uses:
  Rainbow Measurement Setup::Side Functions::Messages And Prompts::FGV Cancel Prompts until Finished Routine.gvi
  Rainbow Measurement Setup::Side Functions::Rainbow Sweep::Rainbow Sweep Param Generator.gvi
  Rainbow Measurement Setup::Side Functions::Instrument Control::Keithley::Keithley Set Constant Parameters.gvi
  Rainbow Measurement Setup::Main Functions::Rainbow Measurement::Cell Rainbow Single Measurement::SRM Extract Correct Calibration Data.gvi
  Rainbow Measurement Setup::Side Functions::Global Abort::FGV Global Abort.gvi
  Rainbow Measurement Setup::Main Functions::Rainbow Measurement::Cell Rainbow Single Measurement::SRM Extract Measured Power.gvi
  Rainbow Measurement Setup::Side Functions::Instrument Control::Keithley::Keithley Sweep Subroutine.gvi
  Rainbow Measurement Setup::Main Functions::Rainbow Measurement::Cell Rainbow Single Measurement::IV Calculations::IV to IJV Data.gvi
  Rainbow Measurement Setup::Main Functions::Rainbow Measurement::Cell Rainbow Single Measurement::SRM Raw Data Graph Adapter.gvi
  Rainbow Measurement Setup::Main Functions::Rainbow Measurement::Cell Rainbow Single Measurement::SRM Sweep Live Parameters FGV.gvi
  Rainbow Measurement Setup::Side Functions::Utilities::Progress Handling::Progress General Calculator.gvi
  Rainbow Measurement Setup::Side Functions::Utilities::Progress Handling::Progress FGV.gvi
diagram:
  # This SubVI Takes the specified Parameters both for the sweep types and for the keithley electrical sweep and performs all the measurements while storing them on their
  # corresponding clusters, before outputing all the information within the Full IV Curve Data array.
  case ($"Error In") {
    frame Error, Default {
      w1 = $"Error In"
      w2 = default
      w3 = $"Instrument Coms Info In"
      w4 = $"Debugging Cluster In"
    }
    frame No Error {
      call "FGV Cancel Prompts until Finished Routine.gvi"(Error In=$"Error In", FGV Instructions="Reset State") -> (Error Out=w5)
      call "Rainbow Sweep Param Generator.gvi"(Rainbow Sweep Parameters=$"Rainbow Sweep Param Selector", Error In=w5) -> (Rainbow Sweep Parameters Array=w6, Error Out=w7)
      call "Keithley Set Constant Parameters.gvi"(Instrument Coms Info In=$"Instrument Coms Info In", Debugging Cluster In=$"Debugging Cluster In", SRM Specific Parameters In=$"SRM Specific Parameters", Error In=w7) -> (Instrument Coms Info Out=w8, Debugging Cluster Out=w9, SRM Specific Parameters Out=w10, Error Out=w11)
      s1 = w11  # shift register
      s2 = w8  # shift register
      s3 = w9  # shift register
      s4 = "IV Full Raw Data.gtype"[] []  # shift register
      s5 = 0  # shift register
      for (N -> w12) (iteration -> i1) {
        w13 = each element of w6
        Property Node(instance in=w13) -> ("Dividing Wavelength Array"=w14, "Rainbow Sweep Types"=w15)
        call "SRM Extract Correct Calibration Data.gvi"(Light Power Calibration Data In=$"Light Power Calibration Data", Rainbow Param Selector In=w13, Error In=s1) -> (Extracted Light Power Calibration Data=w16, Error Out=w17)
        s6 = w17  # shift register
        s7 = s2  # shift register
        s8 = s3  # shift register
        s9 = "IV Single Measurement.gtype"[] []  # shift register
        s10 = s5  # shift register
        for (N -> w18) (iteration -> i2) {
          w19 = each element of w14
          Multiply(w18, w12) -> w20
          Property Node(instance in="SRM Sweep Live Parameters.gtype" {all zero or empty}, "Current Wavelength (nm)"=w19, "Rainbow Sweep Types"=w15) -> (instance out=w21)
          call "FGV Global Abort.gvi"(Global Abort Instructions="Read Current State", Error In=s6) -> (Local Abort Out=w22, Global Abort Out=w23, Error Out=w24)
          call "SRM Extract Measured Power.gvi"(Dividing Wavelength In=w19, Light Power Calibration Data In=w16, Error In=w24) -> (IV Single Measurement Out=w25, Error Out=w26)
          call "Keithley Sweep Subroutine.gvi"(Instrument Coms Info In=s7, Debugging Cluster In=s8, IV Single Measurement In=w25, Error In=w26, SRM Specific Parameters In=w10) -> (Instrument Coms Info Out=w27, Debugging Cluster Out=w28, IV Single Measurement Out=w29, Error Out=w30)
          call "IV to IJV Data.gvi"(SRM Specific Parameters=w10, IV Single Measurement In=w29, Error In=w30) -> (IV Single Measurement Out=w31, Error Out=w32)
          Insert Into Array(inArray=s9, index0=i2, new=w31) -> w33
          call "SRM Raw Data Graph Adapter.gvi"(IV Raw Data Array=w33, Error In=w32) -> (IV Plot=w34, Error Out=w35)
          call "SRM Sweep Live Parameters FGV.gvi"(FGV Instructions="Set State", IV Plot=w34, SRM Live Parameters In=w21, Error In=w35) -> (Error Out=w36)
          call "Progress General Calculator.gvi"(Starting Value=40, Ending Value=80, Number Of Steps=w20, Current Step=s10, Error In=w36) -> (Current Progress=w37, Error Out=w38)
          call "Progress FGV.gvi"(FGV Instructions="Set State", Progress In=w37, Error In=w38) -> (Error Out=w39)
          Logical Or(w22, w23) -> w40
          Increment(x=s10) -> w41
          next s6 = w39
          next s7 = w27
          next s8 = w28
          next s9 = w33
          next s10 = w41
          stop if w40
        }
        Property Node(instance in="IV Full Raw Data.gtype" {all zero or empty}, "IV Raw Data Array"=s9, "Rainbow Sweep Types"=w15) -> (instance out=w42)
        Insert Into Array(inArray=s4, index0=i1, new=w42) -> w43
        next s1 = s6
        next s2 = s7
        next s3 = s8
        next s4 = w43
        next s5 = s10
        stop if w40
      }
      w1 = s1
      w2 = s4
      w3 = s2
      w4 = s3
    }
  }
  $"Instrument Coms Info Out" <- w3
  $"Debugging Cluster Out" <- w4
  $"Full IV Curve Raw Data" <- w2
  $"Error Out" <- w1
