vi "SRM Raw Data Graph Adapter.gvi"   [LabVIEW NXG 5.0.0]
inputs:
  "Error In": error
  "IV Raw Data Array": "IV Single Measurement.gtype"[]
outputs:
  "Error Out": error
  "IV Plot": cluster{"Element 1": f64[], "Element 2": f64[]}[]
types:
  "IV Single Measurement.gtype" = cluster{"Voltage": f64[], "Current": f64[], "Current Density": f64[], "Dividing Wavelength": f64, "Light Power": f64}
diagram:
  # This SubVI Adapts the IV Raw data array
  #  so that it can be plotted
  case ($"Error In") {
    frame Error, Default {
      w1 = $"Error In"
      w2 = cluster{"Element 1": f64[], "Element 2": f64[]}[] []
    }
    frame No Error {
      for {
        w3 = each element of $"IV Raw Data Array"
        Property Node(instance in=w3) -> ("Voltage"=w4, "Current Density"=w5)
        Build Cluster(w4, w5) -> w6
        append w6 to w2
      }
      w1 = $"Error In"
    }
  }
  $"Error Out" <- w1
  $"IV Plot" <- w2
