vi "SRM Refined Data Graph Adapter.gvi"   [LabVIEW NXG 5.0.0]
inputs:
  "Error In": error
outputs:
  "Error Out": error
panel controls:
  "IV Full Data Cluster Array In": "IV Full Data Cluster.gtype"[]
types:
  "IV Single Measurement.gtype" = cluster{"Voltage": f64[], "Current": f64[], "Current Density": f64[], "Dividing Wavelength": f64, "Light Power": f64}
  "Rainbow Sweep Types.gtype" = enum{"Red Sweep Closing", "Red Sweep Opening", "Blue Sweep Closing", "Blue Sweep Opening"}
  "IV Refined Full Sweep Data.gtype" = cluster{"Rs (Ω/m^2)": f64[], "Rsh (Ω/m^2)": f64[], "Jsc (A/m^2)": f64[], "Voc (V)": f64[], "FF (%)": f64[], "Efficiency (%)": f64[], "Dividing Wavelength (nm)": f64[], "Light Power (W)": f64[]}
  "IV Full Data Cluster.gtype" = cluster{"IV Measurements Array": "IV Single Measurement.gtype"[], "Rainbow Sweep Types": "Rainbow Sweep Types.gtype", "IV Refined Data": "IV Refined Full Sweep Data.gtype"}
  T1 = cluster{"Dividing Wavelength (nm)": f64[], "Efficiency (%)": f64[]}
  T2 = cluster{"Dividing Wavelength (nm)": f64[], "Jsc (A/m^2)": f64[]}
  T3 = cluster{"Dividing Wavelength (nm)": f64[], "Voc (V)": f64[]}
  T4 = cluster{"Dividing Wavelength (nm)": f64[], "Light Power (W)": f64[]}
  T5 = cluster{"Dividing Wavelength (nm)": f64[], "FF (%)": f64[]}
  T6 = cluster{"Dividing Wavelength (nm)": f64[], "Rs (Ω/m^2)": f64[]}
  T7 = cluster{"Dividing Wavelength (nm)": f64[], "Rsh (Ω/m^2)": f64[]}
  "SRM IV Refined Data Plot.gtype" = cluster{"Efficiency Plot": T1, "Jsc Plot": T2, "Voc Plot": T3, "Light Power Plot": T4, "FF Plot": T5, "Rs Plot": T6, "Rsh Plot": T7, "Rainbow Sweep Types": "Rainbow Sweep Types.gtype"}
diagram:
  case ($"Error In") {
    frame Error, Default {
      w1 = $"Error In"
    }
    frame No Error {
      for {
        w2 = each element of $"IV Full Data Cluster Array In"
        Property Node(instance in=w2) -> ("IV Refined Data"=w3, "Rainbow Sweep Types"=w4)
        Property Node(instance in=w3) -> ("Efficiency (%)"=w5, "Jsc (A/m^2)"=w6, "Voc (V)"=w7, "Light Power (W)"=w8, "FF (%)"=w9, "Rs (Ω/m^2)"=w10, "Rsh (Ω/m^2)"=w11, "Dividing Wavelength (nm)"=w12)
        Build Cluster(w12, w5) -> w13
        Build Cluster(w12, w6) -> w14
        Build Cluster(w12, w7) -> w15
        Build Cluster(w12, w8) -> w16
        Build Cluster(w12, w9) -> w17
        Build Cluster(w12, w10) -> w18
        Build Cluster(w12, w11) -> w19
        Property Node(instance in="SRM IV Refined Data Plot.gtype" {all zero or empty}, "Efficiency Plot"=w13, "Jsc Plot"=w14, "Voc Plot"=w15, "Light Power Plot"=w16, "FF Plot"=w17, "Rs Plot"=w18, "Rsh Plot"=w19, "Rainbow Sweep Types"=w4)
      }
      w1 = _
    }
  }
  $"Error Out" <- w1
