vi "SRM Sweep Live Parameters Extractor.gvi"   [LabVIEW NXG 5.0.0]
inputs:
  "Error In": error
  "SRM sweep live parameters Previous State": "SRM Sweep Live Parameters FGV Cluster.gtype"
  "SRM sweep live parameters New State": "SRM Sweep Live Parameters FGV Cluster.gtype"
outputs:
  "Error Out": error
  "SRM sweep live parameters Out": "SRM Sweep Live Parameters FGV Cluster.gtype"
types:
  "IV Single Measurement.gtype" = cluster{"Voltage": f64[], "Current": f64[], "Current Density": f64[], "Dividing Wavelength": f64, "Light Power": f64}
  "SRM Single Plot Cluster.gtype" = cluster{"Voltage": f64[], "Current Density": f64[]}
  "Rainbow Sweep Types.gtype" = enum{"Red Sweep Closing", "Red Sweep Opening", "Blue Sweep Closing", "Blue Sweep Opening"}
  "SRM Sweep Live Parameters.gtype" = cluster{"Current Wavelength (nm)": f64, "Rainbow Sweep Types": "Rainbow Sweep Types.gtype", "Finished Measurement?": bool}
  "IV Full Raw Data.gtype" = cluster{"Rainbow Sweep Types": "Rainbow Sweep Types.gtype", "IV Raw Data Array": "IV Single Measurement.gtype"[]}
  "SRM Sweep Live Parameters FGV Cluster.gtype" = cluster{"IV Single Measurement Array": "IV Single Measurement.gtype"[], "SRM Sweep type combo box selction": string, "IV Single Measurement Plot Array": "SRM Single Plot Cluster.gtype"[], "SRM Live Parameters": "SRM Sweep Live Parameters.gtype", "Counter": i32, "Full IV Data Array": "IV Full Raw Data.gtype"[], "Combobox Reference": "ComboBoxSelector reference", "Graph Reference": "Graph reference", "Refresh now": bool}
uses:
  Rainbow Measurement Setup::Main Functions::Rainbow Measurement::Cell Rainbow Single Measurement::Plotting::SRM Raw Data Graph Adapter.gvi
diagram:
  # This SubVI Checks if the input cluster has some empty values and for each empty value it keeps the value it had before.
  # Otherwise it changes to the new value
  case ($"Error In") {
    frame Error, Default {
      w1 = $"Error In"
      w2 = $"SRM sweep live parameters Previous State"
    }
    frame No Error {
      Property Node(instance in=$"SRM sweep live parameters New State") -> ("Full IV Data Array"=w3, "IV Single Measurement Array"=w4, "SRM Live Parameters"=w5, "Combobox Reference"=w6, "Graph Reference"=w7, "Refresh now"=w8)
      Property Node(instance in=$"SRM sweep live parameters Previous State") -> ("Full IV Data Array"=w9, "IV Single Measurement Array"=w10, "SRM Live Parameters"=w11, instance out=w12)
      Is Empty Array(array=w3) -> w13
      Select(s=w13, t=w9, f=w3) -> w14
      Is Empty Array(array=w4) -> w15
      Select(s=w15, t=w10, f=w4) -> w16
      Property Node(instance in=w5) -> ("Current Wavelength (nm)"=w17)
      Is Equal To 0(x=w17) -> w18
      Select(s=w18, t=w11, f=w5) -> w19
      call "SRM Raw Data Graph Adapter.gvi"(IV Raw Data Array=w16, Error In=$"Error In") -> (IV Plot Out=w20, Error Out=w1)
      Property Node(instance in=w12, "Full IV Data Array"=w14, "IV Single Measurement Array"=w16, "IV Single Measurement Plot Array"=w20, "SRM Live Parameters"=w19, "Combobox Reference"=w6, "Graph Reference"=w7, "Refresh now"=w8) -> (instance out=w2)
    }
  }
  $"SRM sweep live parameters Out" <- w2
  $"Error Out" <- w1
