vi "Single Rainbow Measurement Start Calculator.gvi"   [LabVIEW NXG 5.0.0]
inputs:
  "SRM Operation Control": "SRM Operation Control.gtype" = "New Measurement"
  "Stand Alone?": bool
outputs:
  "Desired State": "SRM States.gtype"
types:
  "SRM Operation Control.gtype" = enum{"New Measurement", "Load Measurement", "Save Measurement"}
  "SRM States.gtype" = enum{"Start App", "Detect Instruments", "Initialize Instruments", "Rainbow Sweep", "Close Coms", "Load Measurement", "Save Graphs", "Stop App"}
diagram:
  Select(s=$"Stand Alone?", t="Detect Instruments", f="Initialize Instruments") -> w1
  Is Equal(x="Save Measurement", y=$"SRM Operation Control") -> w2
  Select(s=w2, t="Save Graphs", f=w1) -> w3
  Is Equal(x="New Measurement", y=$"SRM Operation Control") -> w4
  Select(s=w4, t="Load Measurement", f=w3) -> w5
  $"Desired State" <- w5
