vi "SRM Header Info Extractor.gvi"   [LabVIEW NXG 5.0.0]
inputs:
  "Error In": error
  "Header Data": string
outputs:
  "Error Out": error
  "Dividing Wavelength": f64
  "Light Power Density": f64
  "Total Light Power Density": f64
diagram:
  # Ths SubVI Takes the header of a single Raw IV Curve and
  # extracts the dividing wavelength and the Light power measured
  # at that dividing wavelength
  case ($"Error In") {
    frame Error, Default {
      w1 = $"Error In"
      w2 = default
      w3 = default
      w4 = default
    }
    frame No Error {
      Search Or Split String(search string/char="Dividing Wavelength (nm) = ", string=$"Header Data") -> (match + rest of string=w5)
      Search And Replace String(error in (no error)=$"Error In", input string=w5, replace string ("")="", search string="Dividing Wavelength (nm) = ") -> (error out=w6, result string=w7)
      Floating Point String To Number(string=w7, use system decimal point (T)=FALSE) -> (number=w3)
      Search Or Split String(search string/char="Light Power (W) = ", string=$"Header Data") -> (match + rest of string=w8)
      Search And Replace String(error in (no error)=w6, input string=w8, replace string ("")="", search string="Light Power Density (W/m^2) =") -> (error out=w9, result string=w10)
      Floating Point String To Number(string=w10, use system decimal point (T)=FALSE) -> (number=w11)
      Search Or Split String(search string/char="Total Light Power Density (W/m^2) =", string=$"Header Data") -> (match + rest of string=w12)
      Search And Replace String(error in (no error)=w9, input string=w12, replace string ("")="", search string="Total Light Power Density (W/m^2) =") -> (error out=w1, result string=w13)
      Floating Point String To Number(string=w13, use system decimal point (T)=FALSE) -> (number=w4)
      Is Equal To 0(x=w11) -> w14
      Select(s=w14, t=w4, f=w11) -> w2
    }
  }
  $"Dividing Wavelength" <- w3
  $"Light Power Density" <- w2
  $"Total Light Power Density" <- w4
  $"Error Out" <- w1
