vi "SRM Load Prompt.gvi"   [LabVIEW NXG 5.0.0]
inputs:
  "Boolean Handler In": "SRM Load Boolean Handler.gtype"
  "Error In": error
  "Loaded Files": string[]
outputs:
  "Desired State": "SRM States.gtype"
  "Error Out": error
types:
  "SRM States.gtype" = enum{"Start App", "Load Light Power Calibration", "Detect Instruments", "Initialize Instruments", "Rainbow Sweep", "Close Coms", "Process IV Data", "Load Measurement", "Save Graphs", "Enqueue Light Calibration", "Stop App"}
  "SRM Load Boolean Handler.gtype" = cluster{"Canceled Loading?": bool, "Found Any Folder?": bool, "Found Files Within all Folders?": bool, "Duplicate Measurement Files?": bool}
diagram:
  # This SubVI Prompts the user in case it does not find any measurement file and asks if . It also checks if the loading process got cancelled
  # and if it did it poompts the user accordingly. It also tells the user the files that have been loaded
  case ($"Error In") {
    frame Error, Default {
      w1 = $"Error In"
      w2 = "Stop App"
    }
    frame No Error {
      Property Node(instance in=$"Boolean Handler In") -> ("Canceled Loading?"=w3, "Found Any Folder?"=w4, "Found Files Within all Folders?"=w5, "Duplicate Measurement Files?"=w6)
      Logical And(w4, not w3) -> w7
      case (w7) {
        frame False { }
        frame True {
          w8 = "Your Files have been succesfully\nloaded. They are the Following:\n\n"
          s1 = w8  # shift register
          for {
            w9 = each element of $"Loaded Files"
            Concatenate Strings(s1, w9, "\r\n") -> w10
            next s1 = w10
          }
          Concatenate Strings(s1, "\nThey Might take a while to appear, please be patient.") -> w11
          One Button Dialog(button name ("OK")="Okay Thanks :)", message=w11)
        }
      }
      case (w3) {
        frame False {
          w12 = "Process IV Data"
        }
        frame True {
          Select(s=w3, t="Stop App", f="Process IV Data") -> w12
          w13 = "I Cannot load any file if you do \nnot specify a propper path ¯\\_(ツ)_/¯"
          One Button Dialog(button name ("OK")="Oops, Sorry", message=w13)
        }
      }
      Logical And(not w3, w5) -> w14
      case (w14) {
        frame True {
          w15 = w12
        }
        frame False {
          Select(s=w14, t="Stop App", f=w12) -> w15
          w16 = "Some of the folders you provided seem to be empty, please make sure to delete all empty folders before trying to load a measurement."
          One Button Dialog(button name ("OK")="Oops, Sorry", message=w16)
        }
      }
      case (w6) {
        frame False {
          w2 = w15
        }
        frame True {
          Select(s=w6, t="Stop App", f=w15) -> w2
          w17 = "It seems that you have duplicate folders, that meaning that for one cell label you have multiple times the same sweep type. Please make sure to only have one type of sweep for each cell"
          One Button Dialog(button name ("OK")="Oops, Sorry", message=w17)
        }
      }
      w1 = $"Error In"
    }
  }
  $"Error Out" <- w1
  $"Desired State" <- w2
