vi "SRM Save Graphs Prompt.gvi"   [LabVIEW NXG 5.0.0]
inputs:
  "Previous State": "SRM States.gtype" = "Detect Instruments"
  "Error In": error
outputs:
  "Desired State": "SRM States.gtype"
  "Error Out": error
types:
  "SRM States.gtype" = enum{"Start App", "Load Light Power Calibration", "Detect Instruments", "Initialize Instruments", "Rainbow Sweep", "Close Coms", "Process IV Data", "Load Measurement", "Save Graphs", "Enqueue Light Calibration", "Stop App"}
diagram:
  # This subVI Prompts the user to save or discard the measurement files in case
  # the operation was a new measurement. Otherwise it does not
  case ($"Error In") {
    frame Error, Default {
      w1 = $"Error In"
      w2 = "Stop App"
    }
    frame No Error {
      Is Equal(x=$"Previous State", y="Close Coms") -> w3
      case (w3) {
        frame False, Default {
          w2 = "Stop App"
        }
        frame True {
          w4 = "Do you wish to save the current\nMeasurement files?\nThey will be saved on your Personal\nFolder with the current date."
          Two Button Dialog(F button name ("Cancel")="Oh, don't bother\nI was just testing.", T button name ("OK")="Yes please save \nthe measurement files :D", message=w4) -> (T Button?=w5)
          Select(s=w5, t="Save Graphs", f="Stop App") -> w2
        }
      }
      w1 = $"Error In"
    }
  }
  $"Error Out" <- w1
  $"Desired State" <- w2
