vi "FF and Efficiency.gvi"   [LabVIEW NXG 5.0.0]
inputs:
  "Error In": error
  "IV Sweep Data In": "IV Refined Single Sweep Data.gtype"
  "IV Single Measurement": "IV Single Measurement.gtype"
  "Full Spectrum Reference?": bool
outputs:
  "Error Out": error
  "IV Sweep Data Out": "IV Refined Single Sweep Data.gtype"
panel controls:
  "SRM mega cluster In": "SRM Mega Cluster.gtype"
types:
  "IV Refined Single Sweep Data.gtype" = cluster{"Rs (Ω · m^2)": f64, "Rsh (Ω · m^2)": f64, "Jsc (A/m^2)": f64, "Voc (V)": f64, "FF (%)": f64, "Efficiency (%)": f64, "Dividing Wavelength (nm)": f64, "Light Power Density (W/m^2)": f64, "Total Light Power Density (W/m^2)": f64}
  T1 = cluster{"Isc (A)": f64, "Voc (V)": f64, "FF (%)": f64, "Rs (Ω)": f64, "Rsh (Ω)": f64}
  "IV Single Measurement.gtype" = cluster{"Voltage (V)": f64[], "Current (A)": f64[], "Current Density (A/m^2)": f64[], "Dividing Wavelength (nm)": f64, "Light Power Density (W/m^2)": f64, "Total Light Power Density (W/m^2)": f64, "Smart Sweep Data": T1}
  "Sweep Speed Selector.gtype" = enum{"Smart Sweep", "Fast Sweep", "Normal Sweep"}
  "SRM Specific Parameters.gtype" = cluster{"Max (V)": f64, "Min (V)": f64, "V Points": u32, "Current Range (A)": f64, "Autorange": bool, "Sweep Dir": bool, "Current Averages": u32, "Max (A)": f64, "PLC Speed": f64, "Cell Area (m^2)": f64, "Full Spctr Ref": bool, "Sweep Speed": "Sweep Speed Selector.gtype"}
  "Raibow Sweep Selector.gtype" = enum{"Red Sweep", "Blue Sweep", "Full Sweep Red First", "Full Sweep Blue First"}
  "Rainbow Sweep Param Selector.gtype" = cluster{"Raibow Sweep Selector": "Raibow Sweep Selector.gtype", "Max Wavelength (nm)": f64, "Min Wavelength (nm)": f64, "Wavelength Step (nm)": f64, "Rainbow Sweep Type Selector": "Rainbow Sweep Type Selector.gtype"}
  "Rainbow Sweep Types.gtype" = enum{"Red Sweep Closing", "Red Sweep Opening", "Blue Sweep Closing", "Blue Sweep Opening"}
  "IV Full Data Cluster.gtype" = cluster{"IV Measurements Array": "IV Single Measurement.gtype"[], "Rainbow Sweep Types": "Rainbow Sweep Types.gtype", "IV Refined Data": "IV Refined Full Sweep Data.gtype", "Total Light Power Density (W/m^2)": f64}
  "IV Full Raw Data.gtype" = cluster{"Rainbow Sweep Types": "Rainbow Sweep Types.gtype", "IV Raw Data Array": "IV Single Measurement.gtype"[]}
  "SRM Mega Cluster.gtype" = cluster{"SRM Specific Parameters": "SRM Specific Parameters.gtype", "Rainbow Sweep Parameters SRM": "Rainbow Sweep Param Selector.gtype", "SRM Full IV data Array": "IV Full Data Cluster.gtype"[], "Full IV Curve Raw Data": "IV Full Raw Data.gtype"[]}
diagram:
  # This SubVI Calculates the point of maximum generated power
  # and calculates the filling factor taking into account the previously
  # calculated Jsc and Voc.
  case ($"Error In") {
    frame Error, Default {
      w1 = $"Error In"
      w2 = $"IV Sweep Data In"
    }
    frame No Error {
      Property Node(instance in=$"IV Single Measurement") -> ("Voltage (V)"=w3, "Current Density (A/m^2)"=w4, "Total Light Power Density (W/m^2)"=w5, "Light Power Density (W/m^2)"=w6)
      Property Node(instance in=$"IV Sweep Data In") -> ("Voc (V)"=w7, "Jsc (A/m^2)"=w8, instance out=w9)
      Multiply(w7, w8) -> w10
      Absolute Value(x=w10) -> w11
      Multiply(w3, w4) -> w12
      Array Max And Min(array=w12) -> (min value=w13)
      Absolute Value(x=w13) -> w14
      Multiply(w14, 100) -> w15
      Divide(x=w15, y=w11) -> w16
      In Range And Coerce(lower limit=0, upper limit=100, x=w16) -> (In Range?=w17, coerced(x)=w18)
      Select(s=w17, t=w18, f=0) -> w19
      Multiply(w3, w4) -> w20
      Array Max And Min(array=w20) -> (min value=w21)
      Absolute Value(x=w21) -> w22
      case ($"Full Spectrum Reference?") {
        frame False, Default {
          Divide(x=w22, y=w6) -> w23
        }
        frame True {
          Divide(x=w22, y=w5) -> w23
        }
      }
      Multiply(w23, 100) -> w24
      Property Node(instance in=w9, "FF (%)"=w19, "Efficiency (%)"=w24, "Total Light Power Density (W/m^2)"=w5, "Light Power Density (W/m^2)"=w6) -> (instance out=w2)
      w1 = $"Error In"
    }
  }
  $"Error Out" <- w1
  $"IV Sweep Data Out" <- w2
