vi "IV Max light power Extractor.gvi"   [LabVIEW NXG 5.0.0]
inputs:
  "Error In": error
  "IV Raw Data Array": "IV Single Measurement.gtype"[]
outputs:
  "Error Out": error
  "Max Light Power": f64
types:
  "IV Single Measurement.gtype" = cluster{"Voltage": f64[], "Current": f64[], "Current Density": f64[], "Dividing Wavelength": f64, "Light Power": f64}
diagram:
  # This SubVI Extracts the maximum light power value
  # and outputs it
  case ($"Error In") {
    frame Error, Default {
      w1 = $"Error In"
      w2 = default
    }
    frame No Error {
      s1 = 0  # shift register
      for {
        w3 = each element of $"IV Raw Data Array"
        Property Node(instance in=w3) -> ("Light Power"=w4)
        Is Greater(x=w4, y=s1) -> w5
        Select(s=w5, t=w4, f=s1) -> w6
        next s1 = w6
      }
      w1 = $"Error In"
      w2 = s1
    }
  }
  $"Error Out" <- w1
  $"Max Light Power" <- w2
