vi "IV to IJV Data.gvi"   [LabVIEW NXG 5.0.0]
inputs:
  "Error In": error
  "SRM Mega Cluster In": "SRM Mega Cluster.gtype"
  "IV Single Measurement In": "IV Single Measurement.gtype"
outputs:
  "Error Out": error
  "IV Single Measurement Out": "IV Single Measurement.gtype"
  "SRM Mega Cluster Out": "SRM Mega Cluster.gtype"
types:
  "IV Single Measurement.gtype" = cluster{"Voltage (V)": f64[], "Current (A)": f64[], "Current Density (A/m^2)": f64[], "Dividing Wavelength (nm)": f64, "Light Power Density (W/m^2)": f64, "Total Light Power Density (W/m^2)": f64}
  "SRM Specific Parameters.gtype" = cluster{"Max (V)": f64, "Min (V)": f64, "V Points": u32, "Current Range (A)": f64, "Autorange": bool, "Sweep Dir": bool, "Current Averages": u32, "Max (A)": f64, "Integration Time": f64, "Cell Area (m^2)": f64, "Full Spctr Ref": bool}
  "Raibow Sweep Selector.gtype" = enum{"Red Sweep", "Blue Sweep", "Full Sweep Red First", "Full Sweep Blue First"}
  "Rainbow Sweep Param Selector.gtype" = cluster{"Raibow Sweep Selector": "Raibow Sweep Selector.gtype", "Max Wavelength (nm)": f64, "Min Wavelength (nm)": f64, "Wavelength Step (nm)": f64, "Rainbow Sweep Type Selector": "Rainbow Sweep Type Selector.gtype"}
  "Rainbow Sweep Types.gtype" = enum{"Red Sweep Closing", "Red Sweep Opening", "Blue Sweep Closing", "Blue Sweep Opening"}
  "IV Full Data Cluster.gtype" = cluster{"IV Measurements Array": "IV Single Measurement.gtype"[], "Rainbow Sweep Types": "Rainbow Sweep Types.gtype", "IV Refined Data": "IV Refined Full Sweep Data.gtype", "Total Light Power Density (W/m^2)": f64}
  "IV Full Raw Data.gtype" = cluster{"Rainbow Sweep Types": "Rainbow Sweep Types.gtype", "IV Raw Data Array": "IV Single Measurement.gtype"[]}
  "SRM Mega Cluster.gtype" = cluster{"SRM Specific Parameters": "SRM Specific Parameters.gtype", "Rainbow Sweep Parameters SRM": "Rainbow Sweep Param Selector.gtype", "SRM Full IV data Array": "IV Full Data Cluster.gtype"[], "Full IV Curve Raw Data": "IV Full Raw Data.gtype"[]}
diagram:
  # This SubVI takes the cell area and the current and converts
  # the current array into current density
  case ($"Error In") {
    frame Error, Default {
      w1 = $"Error In"
      w2 = $"IV Single Measurement In"
      w3 = $"SRM Mega Cluster In"
    }
    frame No Error {
      Property Node(instance in=$"IV Single Measurement In") -> ("Current (A)"=w4, instance out=w5)
      Property Node(instance in=$"SRM Mega Cluster In") -> ("SRM Specific Parameters:Cell Area (m^2)"=w6, instance out=w3)
      Divide(x=w4, y=w6) -> w7
      Property Node(instance in=w5, "Current Density (A/m^2)"=w7) -> (instance out=w2)
      w1 = $"Error In"
    }
  }
  $"Error Out" <- w1
  $"SRM Mega Cluster Out" <- w3
  $"IV Single Measurement Out" <- w2
