vi "Jsc and Voc.gvi"   [LabVIEW NXG 5.0.0]
inputs:
  "Error In": error
  "IV Single Measurement": "IV Single Measurement.gtype"
  "Points For Average": i32
  "SRM mega cluster In": "SRM Mega Cluster.gtype"
outputs:
  "Error Out": error
  "IV Sweep Data Out": "IV Refined Single Sweep Data.gtype"
types:
  "IV Refined Single Sweep Data.gtype" = cluster{"Rs (Ω · m^2)": f64, "Rsh (Ω · m^2)": f64, "Jsc (A/m^2)": f64, "Voc (V)": f64, "FF (%)": f64, "Efficiency (%)": f64, "Dividing Wavelength (nm)": f64, "Light Power Density (W/m^2)": f64, "Total Light Power Density (W/m^2)": f64}
  T1 = cluster{"Isc (A)": f64, "Voc (V)": f64, "FF (%)": f64, "Rs (Ω)": f64, "Rsh (Ω)": f64}
  "IV Single Measurement.gtype" = cluster{"Voltage (V)": f64[], "Current (A)": f64[], "Current Density (A/m^2)": f64[], "Dividing Wavelength (nm)": f64, "Light Power Density (W/m^2)": f64, "Total Light Power Density (W/m^2)": f64, "Smart Sweep Data": T1}
  "Sweep Speed Selector.gtype" = enum{"Smart Sweep", "Fast Sweep", "Normal Sweep"}
  "SRM Specific Parameters.gtype" = cluster{"Max (V)": f64, "Min (V)": f64, "V Points": u32, "Current Range (A)": f64, "Autorange": bool, "Sweep Dir": bool, "Current Averages": u32, "Max (A)": f64, "PLC Speed": f64, "Cell Area (m^2)": f64, "Full Spctr Ref": bool, "Sweep Speed": "Sweep Speed Selector.gtype"}
  "Raibow Sweep Selector.gtype" = enum{"Red Sweep", "Blue Sweep", "Full Sweep Red First", "Full Sweep Blue First"}
  "Rainbow Sweep Param Selector.gtype" = cluster{"Raibow Sweep Selector": "Raibow Sweep Selector.gtype", "Max Wavelength (nm)": f64, "Min Wavelength (nm)": f64, "Wavelength Step (nm)": f64, "Rainbow Sweep Type Selector": "Rainbow Sweep Type Selector.gtype"}
  "Rainbow Sweep Types.gtype" = enum{"Red Sweep Closing", "Red Sweep Opening", "Blue Sweep Closing", "Blue Sweep Opening"}
  "IV Full Data Cluster.gtype" = cluster{"IV Measurements Array": "IV Single Measurement.gtype"[], "Rainbow Sweep Types": "Rainbow Sweep Types.gtype", "IV Refined Data": "IV Refined Full Sweep Data.gtype", "Total Light Power Density (W/m^2)": f64}
  "IV Full Raw Data.gtype" = cluster{"Rainbow Sweep Types": "Rainbow Sweep Types.gtype", "IV Raw Data Array": "IV Single Measurement.gtype"[]}
  "SRM Mega Cluster.gtype" = cluster{"SRM Specific Parameters": "SRM Specific Parameters.gtype", "Rainbow Sweep Parameters SRM": "Rainbow Sweep Param Selector.gtype", "SRM Full IV data Array": "IV Full Data Cluster.gtype"[], "Full IV Curve Raw Data": "IV Full Raw Data.gtype"[]}
uses:
  Rainbow Measurement Setup::Side Functions::Messages And Prompts::FGV Cancel Prompts until Finished Routine.gvi
  Rainbow Measurement Setup::Side Functions::Utilities::Array Operations::Find Closest In Array.gvi
  NI::Analysis::Fitting::Linear Fit.gvi
diagram:
  # This SubVI Takes the Voltage and the current data arrays and searches for the places where they cross both the x and the y axis. If found within tolerance we then obtain the surrounding
  # points for average and we perform a linear fit around those points to extract the parameters of the fitting line around those regions. With the parameters we extract the intersection points
  # for the Jsc and the Voc and we also extract the slopes for the Rs and the Rsh
  case ($"Error In") {
    frame Error, Default {
      w1 = $"Error In"
      w2 = default
    }
    frame No Error {
      Property Node(instance in=$"IV Single Measurement") -> ("Voltage (V)"=w3, "Current Density (A/m^2)"=w4, "Dividing Wavelength (nm)"=w5, "Light Power Density (W/m^2)"=w6, instance out=w7)
      Property Node(instance in=$"SRM mega cluster In") -> ("SRM Specific Parameters:Sweep Speed"=w8, instance out=w9)
      To Double Precision Float(number=$"Points For Average") -> w10
      Is Equal(x=w8, y="Smart Sweep") -> w11
      case (w11) {
        frame True {
          Property Node(instance in=w9) -> ("SRM Specific Parameters:Cell Area (m^2)"=w16)
          Property Node(instance in=w7) -> ("Smart Sweep Data:Isc (A)"=w17, "Smart Sweep Data:Voc (V)"=w13, "Smart Sweep Data:Rs (Ω)"=w18, "Smart Sweep Data:Rsh (Ω)"=w19)
          Multiply(w18, w16) -> w14
          Multiply(w19, w16) -> w15
          Divide(x=w17, y=w16) -> w12
          w1 = $"Error In"
        }
        frame False {
          call "FGV Cancel Prompts until Finished Routine.gvi"(Error In=$"Error In", FGV Instructions="Read State") -> (Prompt? Out=w20, Error Out=w21)
          Array Max And Min(array=w3) -> (max value=w22, min value=w23)
          Subtract(x=w22, y=w23) -> w24
          Divide(x=w24, y=6) -> w25
          call "Find Closest In Array.gvi"(Array In=w3, Desired Value=0, Tolerance=w25, Error In=w21) -> (Closest Value Index=w26, Within Tolerance?=w27, Error Out=w28)
          Array Max And Min(array=w4) -> (max value=w29, min value=w30)
          Subtract(x=w29, y=w30) -> w31
          Divide(x=w31, y=6) -> w32
          call "Find Closest In Array.gvi"(Array In=w4, Desired Value=0, Tolerance=w32, Error In=w28) -> (Closest Value Index=w33, Within Tolerance?=w34, Error Out=w35)
          To Double Precision Float(number=2) -> w36
          Divide(x=w10, y=w36) -> w37
          Round Toward Negative Infinity(x=w37) -> w38
          To Signed 32 Bit Integer(number=w38) -> w39
          Array Size(array=w3) -> (size(s)=w40)
          Add(w33, w39) -> w41
          Is Greater(x=w40, y=w41) -> w42
          Subtract(x=w33, y=w39) -> w43
          Is Greater Than 0(x=w43) -> w44
          Logical And(w42, w44) -> w45
          Array Size(array=w4) -> (size(s)=w46)
          Add(w26, w39) -> w47
          Is Greater(x=w46, y=w47) -> w48
          Subtract(x=w26, y=w39) -> w49
          Is Greater Than 0(x=w49) -> w50
          Logical And(w48, w50) -> w51
          Is Greater Than 0(x=w33) -> w52
          Is Greater Than 0(x=w26) -> w53
          Logical And(w45, w52, w51, w53, w27, w34) -> w54
          case (w54) {
            frame False, Default {
              w55 = "There have been some problems with the calculations of the Jsc and the Voc:"
              Concatenate Strings(w55, "\r", "\r") -> w56
              w57 = "The amount of points close to the J=0 region is insuficient. Try Extending the Electrical Sweep Range."
              Concatenate Strings(w57, "\r", "\r") -> w58
              Select(s=w45, t="", f=w58) -> w59
              w60 = "The amount of points close to the V=0 region is insuficient. Try Extending the Electrical Sweep Range."
              Concatenate Strings(w60, "\r", "\r") -> w61
              Select(s=w51, t="", f=w61) -> w62
              Logical And(w34, w52) -> w63
              w64 = "Could not find a point where J = 0 A. (J<0.01 A) Please make sure that the selected max and min Voltages are correct."
              Concatenate Strings(w64, "\r", "\r") -> w65
              Select(s=w63, t="", f=w65) -> w66
              Logical And(w27, w53) -> w67
              w68 = "Could not find a point where V = 0 V. (V<0.2 V) Please make sure that the selected max and min Voltages are correct."
              Concatenate Strings(w68, "\r", "\r") -> w69
              Select(s=w67, t="", f=w69) -> w70
              Concatenate Strings(w56, w59, w62, w66, w70) -> w71
              case (w20) {
                frame False, Default {
                  w1 = w35
                }
                frame True {
                  Two Button Dialog(F button name ("Cancel")="Okay you can stop\ntelling me this, thanks.", T button name ("OK")="Okay Sorry", message=w71) -> (T Button?=w72)
                  call "FGV Cancel Prompts until Finished Routine.gvi"(Error In=w35, FGV Instructions="Set State", Prompt? In=w72) -> (Error Out=w1)
                }
              }
              w14 = default
              w12 = default
              w13 = default
              w15 = default
            }
            frame True {
              # w33: Voc Index
              # w3: Voltage Values
              Subtract(x=w33, y=w39) -> w73
              Array Subset(array=w4, index0=w73, length0=$"Points For Average") -> w74
              Array Subset(array=w3, index0=w73, length0=$"Points For Average") -> w75
              call "Linear Fit.gvi"(method="Least Square"(0), y=w74, x=w75, error in=w35) -> (slope=w76, intercept=w77, error out=w78)
              Reciprocal(x=w76) -> w79
              In Range And Coerce(lower limit=-0.001, upper limit=1000000, x=w79) -> (coerced(x)=w14)
              # w26: Jsc Index
              # w4: Current Density Values
              Subtract(x=w26, y=w39) -> w80
              Array Subset(array=w4, index0=w80, length0=$"Points For Average") -> w81
              Array Subset(array=w3, index0=w80, length0=$"Points For Average") -> w82
              call "Linear Fit.gvi"(method="Least Square"(0), y=w81, x=w82, error in=w78) -> (slope=w83, intercept=w12, error out=w1)
              Reciprocal(x=w83) -> w84
              In Range And Coerce(lower limit=-0.001, upper limit=1000000, x=w84) -> (coerced(x)=w15)
              Negate(x=w77) -> w85
              Divide(x=w85, y=w76) -> w13
            }
          }
        }
      }
      Property Node(instance in="IV Refined Single Sweep Data.gtype" {all zero or empty}, "Rs (Ω · m^2)"=w14, "Rsh (Ω · m^2)"=w15, "Jsc (A/m^2)"=w12, "Voc (V)"=w13, "Dividing Wavelength (nm)"=w5, "Light Power Density (W/m^2)"=w6) -> (instance out=w2)
    }
  }
  $"IV Sweep Data Out" <- w2
  $"Error Out" <- w1
