vi "SRM IV Parameters Calculator.gvi"   [LabVIEW NXG 5.0.0]
inputs:
  "Error In": error
  "SRM Mega Cluster In": "SRM Mega Cluster.gtype"
outputs:
  "Error Out": error
  "SRM Mega Cluster Out": "SRM Mega Cluster.gtype"
  "SRM sweep live parameters FGV Cluster Out": "SRM Sweep Live Parameters FGV Cluster.gtype"
types:
  "Sweep Speed Selector.gtype" = enum{"Smart Sweep", "Fast Sweep", "Normal Sweep"}
  "SRM Specific Parameters.gtype" = cluster{"Max (V)": f64, "Min (V)": f64, "V Points": u32, "Current Range (A)": f64, "Autorange": bool, "Sweep Dir": bool, "Current Averages": u32, "Max (A)": f64, "PLC Speed": f64, "Cell Area (m^2)": f64, "Full Spctr Ref": bool, "Sweep Speed": "Sweep Speed Selector.gtype"}
  "Raibow Sweep Selector.gtype" = enum{"Red Sweep", "Blue Sweep", "Full Sweep Red First", "Full Sweep Blue First"}
  "Rainbow Sweep Param Selector.gtype" = cluster{"Raibow Sweep Selector": "Raibow Sweep Selector.gtype", "Max Wavelength (nm)": f64, "Min Wavelength (nm)": f64, "Wavelength Step (nm)": f64, "Rainbow Sweep Type Selector": "Rainbow Sweep Type Selector.gtype"}
  "Rainbow Sweep Types.gtype" = enum{"Red Sweep Closing", "Red Sweep Opening", "Blue Sweep Closing", "Blue Sweep Opening"}
  "IV Full Data Cluster.gtype" = cluster{"IV Measurements Array": "IV Single Measurement.gtype"[], "Rainbow Sweep Types": "Rainbow Sweep Types.gtype", "IV Refined Data": "IV Refined Full Sweep Data.gtype", "Total Light Power Density (W/m^2)": f64}
  "IV Full Raw Data.gtype" = cluster{"Rainbow Sweep Types": "Rainbow Sweep Types.gtype", "IV Raw Data Array": "IV Single Measurement.gtype"[]}
  "SRM Mega Cluster.gtype" = cluster{"SRM Specific Parameters": "SRM Specific Parameters.gtype", "Rainbow Sweep Parameters SRM": "Rainbow Sweep Param Selector.gtype", "SRM Full IV data Array": "IV Full Data Cluster.gtype"[], "Full IV Curve Raw Data": "IV Full Raw Data.gtype"[]}
  T1 = cluster{"Isc (A)": f64, "Voc (V)": f64, "FF (%)": f64, "Rs (Ω)": f64, "Rsh (Ω)": f64}
  "IV Single Measurement.gtype" = cluster{"Voltage (V)": f64[], "Current (A)": f64[], "Current Density (A/m^2)": f64[], "Dividing Wavelength (nm)": f64, "Light Power Density (W/m^2)": f64, "Total Light Power Density (W/m^2)": f64, "Smart Sweep Data": T1}
  "SRM Single Plot Cluster.gtype" = cluster{"Voltage (V)": f64[], "Current Density (A/m^2)": f64[]}
  "SRM Sweep Live Parameters.gtype" = cluster{"Current Wavelength (nm)": f64, "Rainbow Sweep Types": "Rainbow Sweep Types.gtype", "Finished Measurement?": bool}
  "SRM Sweep Live Parameters FGV Cluster.gtype" = cluster{"IV Single Measurement Array": "IV Single Measurement.gtype"[], "SRM Sweep type combo box selction": string, "IV Single Measurement Plot Array": "SRM Single Plot Cluster.gtype"[], "SRM Live Parameters": "SRM Sweep Live Parameters.gtype", "Counter": i32, "Full IV Data Array": "IV Full Raw Data.gtype"[], "Combobox Reference": "ComboBoxSelector reference", "Refresh now": bool, "Graph Reference": "Graph reference"}
  "IV Refined Full Sweep Data.gtype" = cluster{"Rs (Ω · m^2)": f64[], "Rsh (Ω · m^2)": f64[], "Jsc (A/m^2)": f64[], "Voc (V)": f64[], "FF (%)": f64[], "Efficiency (%)": f64[], "Dividing Wavelength (nm)": f64[], "Light Power Density (W/m^2)": f64[]}
uses:
  Rainbow Measurement Setup::Main Functions::Rainbow Measurement::Cell Single Rainbow Measurement::IV Calculations::Jsc and Voc.gvi
  Rainbow Measurement Setup::Main Functions::Rainbow Measurement::Cell Single Rainbow Measurement::IV Calculations::FF and Efficiency.gvi
diagram:
  # This SubVI takes raw IV Data in and transforms it into computed
  # IV Sweep data with all the calculated parameters. Then it stores it all
  # into an array with all the information so that it can be later saved and processed
  case ($"Error In") {
    frame Error, Default {
      w1 = $"Error In"
      w2 = $"SRM Mega Cluster In"
      w3 = default
    }
    frame No Error {
      Property Node(instance in=$"SRM Mega Cluster In") -> ("Full IV Curve Raw Data"=w4, "SRM Specific Parameters:Full Spctr Ref"=w5, instance out=w6)
      w7 = "SRM Sweep Live Parameters FGV Cluster.gtype" {all zero or empty}
      Property Node(instance in=w7, "Full IV Data Array"=w4, "Refresh now"=TRUE, "SRM Live Parameters:Finished Measurement?"=TRUE) -> (instance out=w3)
      s1 = $"Error In"  # shift register
      s2 = w6  # shift register
      for {
        w8 = each element of w4
        Property Node(instance in=w8) -> ("Rainbow Sweep Types"=w10, "IV Raw Data Array"=w11)
        s3 = s1  # shift register
        s4 = s2  # shift register
        for {
          w12 = each element of w11
          call "Jsc and Voc.gvi"(IV Single Measurement=w12, Points For Average=5, Error In=s3, SRM mega cluster In=s4) -> (IV Sweep Data Out=w21, Error Out=w22)
          call "FF and Efficiency.gvi"(IV Sweep Data In=w21, IV Single Measurement=w12, Full Spectrum Reference?=w5, Error In=w22) -> (IV Sweep Data Out=w23, Error Out=w24)
          Property Node(instance in=w23) -> ("Rs (Ω · m^2)"=w25, "Rsh (Ω · m^2)"=w26, "Jsc (A/m^2)"=w27, "Voc (V)"=w28, "FF (%)"=w29, "Efficiency (%)"=w30, "Dividing Wavelength (nm)"=w31, "Light Power Density (W/m^2)"=w32)
          Property Node(instance in=w12) -> ("Total Light Power Density (W/m^2)"=w33)
          append w32 to w13
          append w31 to w14
          append w30 to w15
          append w29 to w16
          append w28 to w17
          append w27 to w18
          append w26 to w19
          append w25 to w20
          next s3 = w24
        }
        Property Node(instance in="IV Refined Full Sweep Data.gtype" {all zero or empty}, "Rs (Ω · m^2)"=w20, "Rsh (Ω · m^2)"=w19, "Jsc (A/m^2)"=w18, "Voc (V)"=w17, "FF (%)"=w16, "Efficiency (%)"=w15, "Dividing Wavelength (nm)"=w14, "Light Power Density (W/m^2)"=w13) -> (instance out=w34)
        Property Node(instance in="IV Full Data Cluster.gtype" {all zero or empty}, "IV Measurements Array"=w11, "Rainbow Sweep Types"=w10, "IV Refined Data"=w34, "Total Light Power Density (W/m^2)"=w33) -> (instance out=w35)
        append w35 to w9
        next s1 = s3
        next s2 = s4
      }
      Property Node(instance in=s2, "SRM Full IV data Array"=w9) -> (instance out=w2)
      w1 = s1
    }
  }
  $"SRM sweep live parameters FGV Cluster Out" <- w3
  $"SRM Mega Cluster Out" <- w2
  $"Error Out" <- w1
