vi "Light Power calibration data check subroutine.gvi"   [LabVIEW NXG 5.0.0]
inputs:
  "LPC Mega cluster In": "LPC Mega Cluster.gtype" = {"Rainbow Sweep Parameters LPC"={0, 0, 0, 0, 0, 0}, "LPC Specific Parameters"={"Powermeter Averages"=3, "Photodtctr Area (m^2)"=0, "Only Full Spectrum"=FALSE}, "Light Power Calibration Data"=[]}
  "SRM Megacluster In": "SRM Mega Cluster.gtype"
  "Misc Data Mega Cluster In": "Misc Data Mega Cluster.gtype"
  "Error In": error
outputs:
  "Operation Control": T1
  "LPC Mega Cluster Out": "LPC Mega Cluster.gtype"
  "SRM Mega Cluster Out": "SRM Mega Cluster.gtype"
  "Cancelled Measurement?": bool
  "Error Out": error
panel controls:
  "MRM Measurement?": bool
types:
  "SRM Specific Parameters.gtype" = cluster{"Max (V)": f64, "Min (V)": f64, "V Points": u32, "Current Range (A)": f64, "Autorange": bool, "Sweep Dir": bool, "Current Averages": u32, "Max (A)": f64, "Integration Time": f64, "Cell Area (m^2)": f64, "Full Spctr Ref": bool}
  "Raibow Sweep Selector.gtype" = enum{"Red Sweep", "Blue Sweep", "Full Sweep Red First", "Full Sweep Blue First"}
  "Rainbow Sweep Param Selector.gtype" = cluster{"Raibow Sweep Selector": "Raibow Sweep Selector.gtype", "Max Wavelength (nm)": f64, "Min Wavelength (nm)": f64, "Wavelength Step (nm)": f64, "Rainbow Sweep Type Selector": "Rainbow Sweep Type Selector.gtype"}
  "Rainbow Sweep Types.gtype" = enum{"Red Sweep Closing", "Red Sweep Opening", "Blue Sweep Closing", "Blue Sweep Opening"}
  "IV Full Data Cluster.gtype" = cluster{"IV Measurements Array": "IV Single Measurement.gtype"[], "Rainbow Sweep Types": "Rainbow Sweep Types.gtype", "IV Refined Data": "IV Refined Full Sweep Data.gtype", "Total Light Power Density (W/m^2)": f64}
  "IV Full Raw Data.gtype" = cluster{"Rainbow Sweep Types": "Rainbow Sweep Types.gtype", "IV Raw Data Array": "IV Single Measurement.gtype"[]}
  "SRM Mega Cluster.gtype" = cluster{"SRM Specific Parameters": "SRM Specific Parameters.gtype", "Rainbow Sweep Parameters SRM": "Rainbow Sweep Param Selector.gtype", "SRM Full IV data Array": "IV Full Data Cluster.gtype"[], "Full IV Curve Raw Data": "IV Full Raw Data.gtype"[]}
  T1 = enum{"left button", "center button", "right button", "window close"}
  "Full Reference Cluster.gtype" = cluster{"Enum Reference Cluster": "Enum Control Reference Cluster.gtype", "Boolean Reference Cluster": "Boolean Control Reference Cluster.gtype", "Numeric Reference Cluster": "Numeric Control Reference Cluster.gtype", "Numeric Cluster Reference Cluster": "Numeric Cluster Reference Cluster.gtype", "Path Reference Cluster": "Path Reference Cluster.gtype", "Cluster Reference Cluster": "Cluster Reference Cluster.gtype", "XZ Stage Controls Reference Cluster": "XZ Stage Controls Reference Cluster.gtype"}
  "Cell Naming Cluster.gtype" = cluster{"Cell Label": string, "Sample Prefix": string, "Author Initials": string, "Current Date": string, "Batch Name": string}
  T2 = cluster{"X Coordinate (mm)": f64, "Z Coordinate (mm)": f64}
  T3 = cluster{"X Coordinate (mm)": f64, "Z Coordinate (mm)": f64, "Vertical Spacing (mm)": f64}
  "XZ All Position Cluster.gtype" = cluster{"Diffusor Coordinates": T2, "Photodetector Coordinates": T2, "Cell R.01 Coordinates": T3}
  T4 = cluster{"Thorlabs Motor Serial Number File Path": path, "Default Data Saving Location": path}
  "Misc Data Mega Cluster.gtype" = cluster{"Full Reference Cluster": "Full Reference Cluster.gtype", "Cell Naming Cluster": "Cell Naming Cluster.gtype", "All XZ Position Cluster": "XZ All Position Cluster.gtype", "All Paths": T4}
  "Light power Calibration Parameters.gtype" = cluster{"Powermeter Averages": u32, "Photodtctr Area (m^2)": f64, "Only Full Spectrum": bool}
  T5 = cluster{"Dividing Wavelength Array": f64[], "Measured Power Array": f64[], "Power Density Array": f64[]}
  "Light Power Calibration Data.gtype" = cluster{"Single Light Calibration": T5, "Rainbow Sweep Types": "Rainbow Sweep Types.gtype", "Total Light Power Density (W/m^2)": f64}
  "LPC Mega Cluster.gtype" = cluster{"Rainbow Sweep Parameters LPC": "Rainbow Sweep Param Selector.gtype", "LPC Specific Parameters": "Light power Calibration Parameters.gtype", "Light Power Calibration Data": "Light Power Calibration Data.gtype"[]}
uses:
  Rainbow Measurement Setup::Main Functions::Rainbow Measurement::Cell Single Rainbow Measurement::LPC Check::SRM Update Rainbow Sweep Parameters.gvi
  Rainbow Measurement Setup::Side Functions::Rainbow Sweep::Rainbow Sweep Param Generator.gvi
  Rainbow Measurement Setup::Main Functions::Rainbow Measurement::Cell Single Rainbow Measurement::LPC Check::SRM Wrong Calibration Files Prompt.gvi
  Rainbow Measurement Setup::Main Functions::Rainbow Measurement::Cell Single Rainbow Measurement::LPC Check::SRM Sweep Type check prompt.gvi
diagram:
  # This subvi checks if we want to perform a full reference spectrum and if so it checks that we have the propper light power calibrated or
  # otherwise it checks if the parameters of the sweep to be performed match those of the calibration that has been performed.
  case ($"Error In") {
    frame Error, Default {
      w1 = $"LPC Mega cluster In"
      w2 = $"SRM Megacluster In"
      w3 = default
      w4 = "window close"
      w5 = $"Error In"
    }
    frame No Error {
      Property Node(instance in=$"SRM Megacluster In") -> ("SRM Specific Parameters:Full Spctr Ref"=w6, instance out=w7)
      case (FALSE) {
        frame True {
          Property Node(instance in=$"LPC Mega cluster In") -> ("Light Power Calibration Data"=w8, instance out=w9)
          for {
            w10 = each element of w8
            Property Node(instance in=w10) -> ("Total Light Power Density (W/m^2)"=w12)
            Is Equal To 0(x=w12) -> w13
            append w13 to w11
          }
          Or Array Elements(Boolean array=w11) -> (logical OR=w14)
          case (w14) {
            frame False, Default {
              w4 = "window close"
            }
            frame True {
              w15 = "It looks like there are some Full Spectrum light power values you are missing to perform the current measurement, do you want to perform a new light calibration?"
              Three Button Dialog(Allow user to close window? (TRUE)=FALSE, Center Button Text ("No")="Load Light Power\nCalibration files.", Left Button Text ("Yes")="New Light Power\nCalibration Now", Right Button Text ("Cancel")="Cancel\nMeasurement", Window Title (" ")="Missing Light power Calibration files", message=w15) -> (Which Button?=w4)
            }
          }
          call "SRM Update Rainbow Sweep Parameters.gvi"(LPC Mega Cluster In=w9, SRM Mega Cluster In=w7, Error In=$"Error In", Operation Control=w4) -> (LPC Mega Cluster Out=w1, SRM Mega Cluster Out=w2, Error Out=w5)
          w3 = FALSE
        }
        frame False {
          Property Node(instance in=w7) -> ("Rainbow Sweep Parameters SRM"=w16, instance out=w17)
          Property Node(instance in=$"LPC Mega cluster In") -> ("Light Power Calibration Data"=w18, instance out=w19)
          call "Rainbow Sweep Param Generator.gvi"(Rainbow Sweep Parameters=w16, Error In=$"Error In") -> (Rainbow Sweep Parameters Array=w20, Error Out=w21)
          Property Node(instance in=$"Misc Data Mega Cluster In") -> ("Full Reference Cluster"=w22, instance out=w23)
          s1 = w21  # shift register
          s2 = w16  # shift register
          s3 = w17  # shift register
          s4 = w19  # shift register
          for {
            w24 = each element of w20
            Property Node(instance in=w24) -> ("Rainbow Sweep Types"=w28)
            for {
              w29 = each element of w18
              Property Node(instance in=w29) -> ("Rainbow Sweep Types"=w31)
              Is Equal(x=w31, y=w28) -> w32
              append w32 to w30
            }
            Or Array Elements(Boolean array=w30) -> (logical OR=w33)
            Not(x=w33) -> w34
            case (w6) {
              frame True {
                w35 = default
                w36 = s2
                w37 = s1
                w38 = s3
                w39 = s4
              }
              frame False {
                Property Node(instance in=s4) -> ("Light Power Calibration Data"=w40, instance out=w39)
                s5 = s1  # shift register
                s6 = s2  # shift register
                for {
                  w41 = each element of w40
                  call "SRM Wrong Calibration Files Prompt.gvi"(Rainbow Sweep Param Selector In=s6, Light Power Calibration Data In=w41, Full Reference Cluster=w22, Error In=s5) -> (Rainbow Sweep Parameters Selector Out=w43, Cancelled Measurement?=w44, Error Out=w45)
                  append w44 to w42
                  next s5 = w45
                  next s6 = w43
                }
                Or Array Elements(Boolean array=w42) -> (logical OR=w35)
                w36 = s6
                w37 = s5
                w38 = s3
              }
            }
            append w28 to w25 if w34
            append w34 to w26
            append w35 to w27
            next s1 = w37
            next s2 = w36
            next s3 = w38
            next s4 = w39
          }
          Or Array Elements(Boolean array=w27) -> (logical OR=w3)
          Property Node(instance in=s3, "Rainbow Sweep Parameters SRM"=s2) -> (instance out=w46)
          Or Array Elements(Boolean array=w26) -> (logical OR=w47)
          call "SRM Sweep Type check prompt.gvi"(Missing Calibration Files=w25, Missing Calibration Files?=w47, Error In=s1) -> (User selected option=w4, Error Out=w48)
          call "SRM Update Rainbow Sweep Parameters.gvi"(LPC Mega Cluster In=s4, SRM Mega Cluster In=w46, Misc Data Mega Cluster In=w23, Error In=w48, Operation Control=w4) -> (LPC Mega Cluster Out=w1, SRM Mega Cluster Out=w2, Error Out=w5)
        }
      }
    }
  }
  $"Operation Control" <- w4
  $"Cancelled Measurement?" <- w3
  $"LPC Mega Cluster Out" <- w1
  $"SRM Mega Cluster Out" <- w2
  $"Error Out" <- w5
