vi "SRM Rainbow Parameter Rewritter.gvi"   [LabVIEW NXG 5.0.0]
inputs:
  "Light Power Calibration Data In": "Light Power Calibration Data.gtype"
  "Rainbow Sweep Parameters Selector In": "Rainbow Sweep Param Selector.gtype" = {0, 1100, 300, 1, 1, 0}
  "Desired Operation": "SRM Wrong Sweep Parameters Operation.gtype" = "Change Parameters"
  "Full Reference Cluster": "Full Reference Cluster.gtype"
  "Error In": error
outputs:
  "Error Out": error
  "Rainbow Sweep Parameters Selector Out": "Rainbow Sweep Param Selector.gtype"
  "Light Power Calibration Data Out": "Light Power Calibration Data.gtype"
  "Cancelled Measurement?": bool
types:
  "Raibow Sweep Selector.gtype" = enum{"Red Sweep", "Blue Sweep", "Full Sweep Red First", "Full Sweep Blue First"}
  T1 = enum{"Red Sweep Closing", "Red Sweep Opening", "Red Sweep Both Ways"}
  T2 = enum{"Blue Sweep Opening", "Blue Sweep Closing", "Blue Sweep Both Ways"}
  "Rainbow Sweep Type Selector.gtype" = cluster{"Red Sweep Mode": T1, "Blue Sweep Mode": T2}
  "Rainbow Sweep Param Selector.gtype" = cluster{"Raibow Sweep Selector": "Raibow Sweep Selector.gtype", "Max Wavelength (nm)": f64, "Min Wavelength (nm)": f64, "Wavelength Step (nm)": f64, "Rainbow Sweep Type Selector": "Rainbow Sweep Type Selector.gtype"}
  T3 = cluster{"Dividing Wavelength Array": f64[], "Measured Power Array": f64[], "Power Density Array": f64[]}
  "Rainbow Sweep Types.gtype" = enum{"Red Sweep Closing", "Red Sweep Opening", "Blue Sweep Closing", "Blue Sweep Opening"}
  "Light Power Calibration Data.gtype" = cluster{"Single Light Calibration": T3, "Rainbow Sweep Types": "Rainbow Sweep Types.gtype", "Total Light Power Density (W/m^2)": f64}
  "SRM Wrong Sweep Parameters Operation.gtype" = enum{"Change Parameters", "Cancel Measurement", "Continue"}
  T4 = cluster{"SRM Light Power Density Ref": "NumericTextBoxDouble reference", "Rainbow Sweep Parameters RSM": "Cluster reference", "SRM Refined Plot Rainbow Sweep Types": "ComboBoxSelector reference", "SRM Specific Parameters": "Cluster reference", "Sweep Live Parameters RSM": "Cluster reference", "SRM Raw Plot Rainbow Sweep Selector": "ComboBoxSelector reference", "SRM Plot Parameter Selector Ref": "EnumSelector reference", "IV Plot Out Ref": "Graph reference"}
  T5 = cluster{"Calibration Files Path": "PathSelector reference", "Default Data Saving Location": "PathSelector reference"}
  T6 = cluster{"Main Tab": "TabControl reference", "Rainbow Measurement tab": "TabControl reference", "Configuration tab": "TabControl reference", "Light Calibration tab": "TabControl reference"}
  T7 = cluster{"Custom date": "CheckBox reference", "Batch Name": "StringControl reference", "Author Initials": "ComboBoxSelector reference", "Cell Number": "StringControl reference", "Current Date": "StringControl reference", "Sample Comments": "StringControl reference", "Sample Prefix": "StringControl reference", "Label Info Missing Error": "BooleanControl reference", "Label Info Error Label": "StringControl reference"}
  T8 = cluster{"Beam Power Density": "IntensityGraph reference"[][], "Irradiance Calibration": "Graph reference"[], "MSpot Spectrum Calibration Parameters": "Cluster reference", "Rainbow Sweep Param Selector MSpot": "Cluster reference"}
  T9 = cluster{"LPC Parameters Ref": "Cluster reference", "Sweep Live Parameters LPC ref": "Cluster reference", "Light Power Calibration": "Graph reference", "Light Power Calibration Data Ref": "ArrayViewer reference", "Rainbow Sweep Parameters LPC": "Cluster reference"}
  T10 = cluster{"Current State Ref": "EnumSelector reference", "Substate": "StringControl reference", "State": "StringControl reference", "Current Substate": "StringControl reference"}
  T11 = cluster{"Custom Position": "BooleanControl reference", "Set Position": "BooleanControl reference", "XZ Stage Active": "BooleanControl reference", "Release XZ Stage": "BooleanControl reference", "XZ Coordinates": "Cluster reference", "Activate XZ Stage": "BooleanControl reference", "XZ Stage Cell Reference": "EnumSelector reference", "XZ All Position Cluster Ref": "Cluster reference"}
  T12 = cluster{"IV Extracted Parameter Plot ": "Graph reference", "MRM Cell Selector Ref": "Cluster reference", "IV Plot Out Multiple Reference": "Graph reference", "Rainbow Sweep Parameters MRM Ref": "Cluster reference", "MRM Cell Refined Plot Selector ref": "ComboBoxSelector reference", "MRM Current Raw Cell Plot": "ComboBoxSelector reference", "MRM Raw Plot Rainbow Sweep Relector Ref": "ComboBoxSelector reference", "MRM Specific Parameters Ref": "Cluster reference"}
  "Full Reference Cluster.gtype" = cluster{"SRM Reference Cluster": T4, "Path Reference Cluster": T5, "Tab Reference Cluster": T6, "Cell Naming Parameters Ref Cluster": T7, "One Time Calibrations Ref Cluster": T8, "LPC Controls Reference Cluster": T9, "System Parameters Ref Cluster": T10, "XZ Stage Controls Reference Cluster": T11, "MRM Reference Cluster": T12}
uses:
  Rainbow Measurement Setup::Side Functions::Utilities::Array Operations::Array Parameters Calculation.gvi
diagram:
  # This SubVI Extracts the parameters from the Light power calibration array, and if we asked to it changes the current Rainbow Sweep parameters SRM
  # for the ones in the light calibration so that they match. Also it changes the front panel values to fit the current selected rainbow parameter values.
  case ($"Error In") {
    frame Error, Default {
      w1 = $"Error In"
      w2 = $"Rainbow Sweep Parameters Selector In"
      w3 = $"Light Power Calibration Data In"
      w4 = default
    }
    frame No Error {
      case ($"Desired Operation") {
        frame "Change Parameters", Default {
          Property Node(instance in=$"Full Reference Cluster") -> ("LPC Controls Reference Cluster:Rainbow Sweep Parameters LPC"=w5, "SRM Reference Cluster:Rainbow Sweep Parameters RSM"=w6)
          Property Node(instance in=$"Light Power Calibration Data In") -> ("Single Light Calibration:Dividing Wavelength Array"=w7, instance out=w3)
          Property Node(instance in=$"Rainbow Sweep Parameters Selector In") -> ("Max Wavelength (nm)"=w8, "Min Wavelength (nm)"=w9, instance out=w10)
          call "Array Parameters Calculation.gvi"(Input Array 1D=w7, Range Value 1=w8, Range Value 2=w9, Error In=$"Error In") -> (Coerced Min Wavelenght=w11, Coerced Max Wavelenght=w12, Step Value=w13, Error Out=w14)
          Property Node(instance in=w5, error in=w14) -> ("Value"=w15, error out=w16, instance out=w17)
          Property Node(instance in=w6, error in=w16) -> ("Value"=w18, error out=w19, instance out=w20)
          Property Node(instance in=w18, "Max Wavelength (nm)"=w12, "Min Wavelength (nm)"=w11, "Wavelength Step (nm)"=w13) -> (instance out=w21)
          Property Node(instance in=w15, "Max Wavelength (nm)"=w12, "Min Wavelength (nm)"=w11, "Wavelength Step (nm)"=w13) -> (instance out=w22)
          Property Node(instance in=w17, "Value"=w22, error in=w19) -> (error out=w23)
          Property Node(instance in=w20, "Value"=w21, error in=w23) -> (error out=w1)
          Property Node(instance in=w10, "Max Wavelength (nm)"=w12, "Min Wavelength (nm)"=w11, "Wavelength Step (nm)"=w13) -> (instance out=w2)
          w4 = default
        }
        frame "Cancel Measurement" {
          w1 = $"Error In"
          w2 = $"Rainbow Sweep Parameters Selector In"
          w3 = $"Light Power Calibration Data In"
          w4 = TRUE
        }
        frame "Continue" {
          w1 = $"Error In"
          w2 = $"Rainbow Sweep Parameters Selector In"
          w3 = $"Light Power Calibration Data In"
          w4 = default
        }
      }
    }
  }
  $"Light Power Calibration Data Out" <- w3
  $"Cancelled Measurement?" <- w4
  $"Error Out" <- w1
  $"Rainbow Sweep Parameters Selector Out" <- w2
