vi "SRM Sweep Type check prompt.gvi"   [LabVIEW NXG 5.0.0]
inputs:
  "Error In": error
  "Missing Calibration Files": "Rainbow Sweep Types.gtype"[]
  "Missing Calibration Files?": bool
outputs:
  "Error Out": error
  "User selected option": T1
types:
  "Rainbow Sweep Types.gtype" = enum{"Red Sweep Closing", "Red Sweep Opening", "Blue Sweep Closing", "Blue Sweep Opening"}
  T1 = enum{"left button", "center button", "right button", "window close"}
diagram:
  # This VI prompts the user if there are any missing light power calibration files
  # to perform the current measurement and then the user decides what to do.
  case ($"Error In") {
    frame Error, Default {
      w1 = $"Error In"
      w2 = "window close"
    }
    frame No Error {
      case ($"Missing Calibration Files?") {
        frame False, Default {
          w1 = $"Error In"
          w2 = "window close"
        }
        frame True {
          s1 = "\r"  # shift register
          s2 = $"Error In"  # shift register
          for {
            w3 = each element of $"Missing Calibration Files"
            Format Into String(initString=s1, errIn=s2, w3) -> (outString=w4, errOut=w5)
            Concatenate Strings(w4, "\r") -> w6
            next s1 = w6
            next s2 = w5
          }
          w7 = "I'm missing some light calibration files. In order to measure for the selected rainbow sweeps you need the following light power calibration files:"
          w8 = "Do you want to perform the Needed Light power Calibrations now, or do you want to load some light power calibration files?"
          Concatenate Strings(w7, "\r", s1, "\r", w8) -> w9
          Three Button Dialog(Allow user to close window? (TRUE)=FALSE, Center Button Text ("No")="Load Light Power\nCalibration files.", Left Button Text ("Yes")="New Light Power\nCalibration Now", Right Button Text ("Cancel")="Cancel\nMeasurement", Window Title (" ")="Missing Light power Calibration files", message=w9) -> (Which Button?=w2)
          w1 = s2
        }
      }
    }
  }
  $"Error Out" <- w1
  $"User selected option" <- w2
