vi "SRM Update Rainbow Sweep Parameters.gvi"   [LabVIEW NXG 5.0.0]
inputs:
  "Error In": error
  "LPC Mega Cluster In": "LPC Mega Cluster.gtype"
  "SRM Mega Cluster In": "SRM Mega Cluster.gtype"
  "Operation Control": T1 = "left button"
  "Misc Data Mega Cluster In": "Misc Data Mega Cluster.gtype"
outputs:
  "Error Out": error
  "SRM Mega Cluster Out": "SRM Mega Cluster.gtype"
  "LPC Mega Cluster Out": "LPC Mega Cluster.gtype"
types:
  "SRM Specific Parameters.gtype" = cluster{"Max (V)": f64, "Min (V)": f64, "V Points": u32, "Current Range (A)": f64, "Autorange": bool, "Sweep Dir": bool, "Current Averages": u32, "Max (A)": f64, "Integration Time": f64, "Cell Area (m^2)": f64, "Full Spctr Ref": bool, "Smart Scan": bool, "Fast Scan": bool}
  "Raibow Sweep Selector.gtype" = enum{"Red Sweep", "Blue Sweep", "Full Sweep Red First", "Full Sweep Blue First"}
  "Rainbow Sweep Param Selector.gtype" = cluster{"Raibow Sweep Selector": "Raibow Sweep Selector.gtype", "Max Wavelength (nm)": f64, "Min Wavelength (nm)": f64, "Wavelength Step (nm)": f64, "Rainbow Sweep Type Selector": "Rainbow Sweep Type Selector.gtype"}
  "Rainbow Sweep Types.gtype" = enum{"Red Sweep Closing", "Red Sweep Opening", "Blue Sweep Closing", "Blue Sweep Opening"}
  "IV Full Data Cluster.gtype" = cluster{"IV Measurements Array": "IV Single Measurement.gtype"[], "Rainbow Sweep Types": "Rainbow Sweep Types.gtype", "IV Refined Data": "IV Refined Full Sweep Data.gtype", "Total Light Power Density (W/m^2)": f64}
  "IV Full Raw Data.gtype" = cluster{"Rainbow Sweep Types": "Rainbow Sweep Types.gtype", "IV Raw Data Array": "IV Single Measurement.gtype"[]}
  "SRM Mega Cluster.gtype" = cluster{"SRM Specific Parameters": "SRM Specific Parameters.gtype", "Rainbow Sweep Parameters SRM": "Rainbow Sweep Param Selector.gtype", "SRM Full IV data Array": "IV Full Data Cluster.gtype"[], "Full IV Curve Raw Data": "IV Full Raw Data.gtype"[]}
  T1 = enum{"left button", "center button", "right button", "window close"}
  T2 = cluster{"SRM Light Power Density Ref": "NumericTextBoxDouble reference", "Rainbow Sweep Parameters RSM": "Cluster reference", "SRM Refined Plot Rainbow Sweep Types": "ComboBoxSelector reference", "SRM Specific Parameters": "Cluster reference", "Sweep Live Parameters RSM": "Cluster reference", "SRM Raw Plot Rainbow Sweep Selector": "ComboBoxSelector reference", "SRM Plot Parameter Selector Ref": "EnumSelector reference", "IV Plot Out Ref": "Graph reference"}
  T3 = cluster{"Calibration Files Path": "PathSelector reference", "Default Data Saving Location": "PathSelector reference"}
  T4 = cluster{"Main Tab": "TabControl reference", "Rainbow Measurement tab": "TabControl reference", "Configuration tab": "TabControl reference", "Light Calibration tab": "TabControl reference"}
  T5 = cluster{"Custom date": "CheckBox reference", "Batch Name": "StringControl reference", "Author Initials": "ComboBoxSelector reference", "Cell Number": "StringControl reference", "Current Date": "StringControl reference", "Sample Comments": "StringControl reference", "Sample Prefix": "StringControl reference", "Label Info Missing Error": "BooleanControl reference", "Label Info Error Label": "StringControl reference"}
  T6 = cluster{"Beam Power Density": "IntensityGraph reference"[][], "Irradiance Calibration": "Graph reference"[], "MSpot Spectrum Calibration Parameters": "Cluster reference", "Rainbow Sweep Param Selector MSpot": "Cluster reference"}
  T7 = cluster{"LPC Parameters Ref": "Cluster reference", "Sweep Live Parameters LPC ref": "Cluster reference", "Light Power Calibration": "Graph reference", "Light Power Calibration Data Ref": "ArrayViewer reference", "Rainbow Sweep Parameters LPC": "Cluster reference"}
  T8 = cluster{"Current State Ref": "EnumSelector reference", "Substate": "StringControl reference", "State": "StringControl reference", "Current Substate": "StringControl reference"}
  T9 = cluster{"Custom Position": "BooleanControl reference", "Set Position": "BooleanControl reference", "XZ Stage Active": "BooleanControl reference", "Release XZ Stage": "BooleanControl reference", "XZ Coordinates": "Cluster reference", "Activate XZ Stage": "BooleanControl reference", "XZ Stage Cell Reference": "EnumSelector reference", "XZ All Position Cluster Ref": "Cluster reference"}
  T10 = cluster{"IV Extracted Parameter Plot ": "Graph reference", "MRM Cell Selector Ref": "Cluster reference", "IV Plot Out Multiple Reference": "Graph reference", "Rainbow Sweep Parameters MRM Ref": "Cluster reference", "MRM Cell Refined Plot Selector ref": "ComboBoxSelector reference", "MRM Current Raw Cell Plot": "ComboBoxSelector reference", "MRM Raw Plot Rainbow Sweep Relector Ref": "ComboBoxSelector reference", "MRM Specific Parameters Ref": "Cluster reference"}
  "Full Reference Cluster.gtype" = cluster{"SRM Reference Cluster": T2, "Path Reference Cluster": T3, "Tab Reference Cluster": T4, "Cell Naming Parameters Ref Cluster": T5, "One Time Calibrations Ref Cluster": T6, "LPC Controls Reference Cluster": T7, "System Parameters Ref Cluster": T8, "XZ Stage Controls Reference Cluster": T9, "MRM Reference Cluster": T10}
  T11 = cluster{"X Coordinate (mm)": f64, "Z Coordinate (mm)": f64, "Aprch Distance (mm)": f64}
  T12 = cluster{"X Coordinate (mm)": f64, "Z Coordinate (mm)": f64, "Vertical Spacing (mm)": f64, "Aprch Distance (mm)": f64, "Aprch Dstnc L.12 (mm)": f64}
  "XZ All Position Cluster.gtype" = cluster{"Diffusor Coordinates": T11, "Photodetector Coordinates": T11, "Cell R.01 Coordinates": T12}
  T13 = cluster{"Thorlabs Motor Serial Number File Path": path, "Default Data Saving Location": path}
  "Cell Naming Cluster.gtype" = cluster{"Cell Label": string, "Sample Prefix": string, "Author Initials": string, "Current Date": string, "Batch Name": string}
  "Misc Data Mega Cluster.gtype" = cluster{"Full Reference Cluster": "Full Reference Cluster.gtype", "All XZ Position Cluster": "XZ All Position Cluster.gtype", "All Paths": T13, "Cell Naming Cluster": "Cell Naming Cluster.gtype"}
  "Light power Calibration Parameters.gtype" = cluster{"Powermeter Averages": u32, "Photodtctr Area (m^2)": f64, "Only Full Spectrum": bool}
  T14 = cluster{"Dividing Wavelength Array": f64[], "Measured Power Array": f64[], "Power Density Array": f64[]}
  "Light Power Calibration Data.gtype" = cluster{"Single Light Calibration": T14, "Rainbow Sweep Types": "Rainbow Sweep Types.gtype", "Total Light Power Density (W/m^2)": f64}
  "LPC Mega Cluster.gtype" = cluster{"Rainbow Sweep Parameters LPC": "Rainbow Sweep Param Selector.gtype", "LPC Specific Parameters": "Light power Calibration Parameters.gtype", "Light Power Calibration Data": "Light Power Calibration Data.gtype"[]}
diagram:
  # This subVI Sets the minimum sweep so that the light calibration is only to measure the fully open spectrum in case we have selected the option full spectrum
  # othewise it updates the values of the LPC with the currently rainbow parameters SRM
  case ($"Error In") {
    frame Error, Default {
      w1 = $"Error In"
      w2 = $"SRM Mega Cluster In"
      w3 = $"LPC Mega Cluster In"
    }
    frame No Error {
      Property Node(instance in=$"SRM Mega Cluster In") -> ("SRM Specific Parameters:Full Spctr Ref"=w4, instance out=w5)
      case (w4) {
        frame False, Default {
          Property Node(instance in=w5) -> ("Rainbow Sweep Parameters SRM"=w6, instance out=w2)
          case ($"Operation Control") {
            frame "left button" {
              Property Node(instance in=$"Misc Data Mega Cluster In") -> ("Full Reference Cluster:LPC Controls Reference Cluster:Rainbow Sweep Parameters LPC"=w7)
              Property Node(instance in=w7, "Value"=w6, error in=$"Error In") -> (error out=w1)
              Property Node(instance in=$"LPC Mega Cluster In", "Rainbow Sweep Parameters LPC"=w6) -> (instance out=w3)
            }
            frame "center button", Default {
              w3 = $"LPC Mega Cluster In"
              w1 = $"Error In"
            }
          }
        }
        frame True {
          case ($"Operation Control") {
            frame "center button", Default {
              w2 = w5
              w3 = $"LPC Mega Cluster In"
              w1 = $"Error In"
            }
            frame "left button" {
              Property Node(instance in=$"Misc Data Mega Cluster In") -> ("Full Reference Cluster:LPC Controls Reference Cluster:Rainbow Sweep Parameters LPC"=w8)
              Property Node(instance in=w5) -> ("Rainbow Sweep Parameters SRM"=w9, instance out=w2)
              Property Node(instance in=w8, "Value"=w9, error in=$"Error In") -> (error out=w1)
              Property Node(instance in=$"LPC Mega Cluster In", "Rainbow Sweep Parameters LPC"=w9, "LPC Specific Parameters:Only Full Spectrum"=w4) -> (instance out=w3)
            }
          }
        }
      }
    }
  }
  $"SRM Mega Cluster Out" <- w2
  $"Error Out" <- w1
  $"LPC Mega Cluster Out" <- w3
