vi "SRM Wrong Calibration Files Prompt.gvi"   [LabVIEW NXG 5.0.0]
inputs:
  "Error In": error
  "Full Reference Cluster": "Full Reference Cluster.gtype"
  "Rainbow Sweep Param Selector In": "Rainbow Sweep Param Selector.gtype" = {0, 1100, 300, 1, 1, 0}
  "Light Power Calibration Data In": "Light Power Calibration Data.gtype"
outputs:
  "Error Out": error
  "Rainbow Sweep Parameters Selector Out": "Rainbow Sweep Param Selector.gtype"
  "Cancelled Measurement?": bool
panel indicators:
  "Light Power Calibration Data Out": "Light Power Calibration Data.gtype"
types:
  "Raibow Sweep Selector.gtype" = enum{"Red Sweep", "Blue Sweep", "Full Sweep Red First", "Full Sweep Blue First"}
  T1 = enum{"Red Sweep Closing", "Red Sweep Opening", "Red Sweep Both Ways"}
  T2 = enum{"Blue Sweep Opening", "Blue Sweep Closing", "Blue Sweep Both Ways"}
  "Rainbow Sweep Type Selector.gtype" = cluster{"Red Sweep Mode": T1, "Blue Sweep Mode": T2}
  "Rainbow Sweep Param Selector.gtype" = cluster{"Raibow Sweep Selector": "Raibow Sweep Selector.gtype", "Max Wavelength (nm)": f64, "Min Wavelength (nm)": f64, "Wavelength Step (nm)": f64, "Rainbow Sweep Type Selector": "Rainbow Sweep Type Selector.gtype"}
  T3 = cluster{"Dividing Wavelength Array": f64[], "Measured Power Array": f64[], "Power Density Array": f64[]}
  "Rainbow Sweep Types.gtype" = enum{"Red Sweep Closing", "Red Sweep Opening", "Blue Sweep Closing", "Blue Sweep Opening"}
  "Light Power Calibration Data.gtype" = cluster{"Single Light Calibration": T3, "Rainbow Sweep Types": "Rainbow Sweep Types.gtype", "Total Light Power Density (W/m^2)": f64}
  "Enum Control Reference Cluster.gtype" = cluster{"Main Tab": "TabControl reference", "Rainbow Measurement tab": "TabControl reference", "Configuration tab": "TabControl reference", "Light Calibration tab": "TabControl reference", "Current State": "EnumSelector reference", "SRM Plot Parameter Selector Ref": "EnumSelector reference"}
  "Boolean Control Reference Cluster.gtype" = cluster{"Custom date": "CheckBox reference", "Label Info Missing Error": "BooleanControl reference"}
  "Numeric Control Reference Cluster.gtype" = cluster{"Beam Power Density": "IntensityGraph reference"[][], "Irradiance Calibration": "Graph reference"[], "SRM Light Power Density Ref": "NumericTextBoxDouble reference"}
  "Numeric Cluster Reference Cluster.gtype" = cluster{"LPC Parameters Ref": "Cluster reference", "Sweep Live Parameters LPC ref": "Cluster reference"}
  "Path Reference Cluster.gtype" = cluster{"Calibration Files Path": "PathSelector reference", "Default Data Saving Location": "PathSelector reference"}
  "Cluster Reference Cluster.gtype" = cluster{"Light Power Calibration": "Graph reference", "Rainbow Sweep Parameters RSM": "Cluster reference", "Rainbow Sweep Param Selector MSpot": "Cluster reference", "MSpot Spectrum Calibration Parameters": "Cluster reference", "SRM Raw Plot Rainbow Sweep Selector": "ComboBoxSelector reference", "SRM Refined Plot Rainbow Sweep Types": "ComboBoxSelector reference", "SRM Specific Parameters": "Cluster reference", "Label Info Error Label": "StringControl reference", "Sample Comments": "StringControl reference", "Cell Number": "StringControl reference", "Author Initials": "ComboBoxSelector reference", "Batch Name": "StringControl reference", "Sweep Live Parameters RSM": "Cluster reference", "Rainbow Sweep Parameters LPC": "Cluster reference", "XZ All Position Cluster": "Cluster reference", "State": "StringControl reference", "Current Substate": "StringControl reference", "Substate": "StringControl reference", "Current Date": "StringControl reference", "Sample Prefix": "StringControl reference", "IV Extracted Parameter Plot ": "Graph reference", "Light Power Calibration Data Ref": "ArrayViewer reference", "IV Plot Out Ref": "Graph reference", "MRM Cell Selector Ref": "Cluster reference"}
  "XZ Stage Controls Reference Cluster.gtype" = cluster{"Custom Position": "BooleanControl reference", "Set Position": "BooleanControl reference", "XZ Stage Active": "BooleanControl reference", "Release XZ Stage": "BooleanControl reference", "XZ Coordinates": "Cluster reference", "Activate XZ Stage": "BooleanControl reference", "XZ Stage Cell Reference": "EnumSelector reference"}
  "Full Reference Cluster.gtype" = cluster{"Enum Reference Cluster": "Enum Control Reference Cluster.gtype", "Boolean Reference Cluster": "Boolean Control Reference Cluster.gtype", "Numeric Reference Cluster": "Numeric Control Reference Cluster.gtype", "Numeric Cluster Reference Cluster": "Numeric Cluster Reference Cluster.gtype", "Path Reference Cluster": "Path Reference Cluster.gtype", "Cluster Reference Cluster": "Cluster Reference Cluster.gtype", "XZ Stage Controls Reference Cluster": "XZ Stage Controls Reference Cluster.gtype"}
uses:
  Rainbow Measurement Setup::Side Functions::Utilities::Array Operations::Array Parameters Calculation.gvi
  Rainbow Measurement Setup::Main Functions::Rainbow Measurement::Cell Single Rainbow Measurement::LPC Check::SRM Sweep parameter Mismatch.gvi
  Rainbow Measurement Setup::Main Functions::Rainbow Measurement::Cell Single Rainbow Measurement::LPC Check::SRM Rainbow Parameter Rewritter.gvi
diagram:
  case ($"Error In") {
    frame Error, Default {
      w1 = $"Error In"
      w2 = $"Light Power Calibration Data In"
      w3 = $"Rainbow Sweep Param Selector In"
      w4 = default
    }
    frame No Error {
      Property Node(instance in=$"Light Power Calibration Data In") -> ("Single Light Calibration:Dividing Wavelength Array"=w5, "Rainbow Sweep Types"=w6, instance out=w7)
      Property Node(instance in=$"Rainbow Sweep Param Selector In") -> ("Wavelength Step (nm)"=w8, "Max Wavelength (nm)"=w9, "Min Wavelength (nm)"=w10, instance out=w11)
      call "Array Parameters Calculation.gvi"(Input Array 1D=w5, Range Value 1=w9, Range Value 2=w10, Error In=$"Error In") -> (Constant Steps?=w12, Step Value=w13, In Range?=w14, Error Out=w15)
      Is Equal(x=w13, y=w8) -> w16
      Logical And(w16, w14, w12) -> w17
      call "SRM Sweep parameter Mismatch.gvi"(Wavelength Step (nm)=w13, Mismatch?=w17, Rainbow Sweep Types=w6, Wavelenght Array=w5, Error In=w15, Wavelength Step Equal?=w16, In Range?=w14, Constant Steps?=w12) -> (Desired Operation=w18, Error Out=w19)
      call "SRM Rainbow Parameter Rewritter.gvi"(Light Power Calibration Data In=w7, Rainbow Sweep Parameters Selector In=w11, Full Reference Cluster=$"Full Reference Cluster", Error In=w19, Desired Operation=w18) -> (Light Power Calibration Data Out=w2, Rainbow Sweep Parameters Selector Out=w3, Cancelled Measurement?=w4, Error Out=w1)
    }
  }
  $"Light Power Calibration Data Out" <- w2
  $"Rainbow Sweep Parameters Selector Out" <- w3
  $"Cancelled Measurement?" <- w4
  $"Error Out" <- w1
