vi "Update Rainbow Sweep Parameters.gvi"   [LabVIEW NXG 5.0.0]
inputs:
  "Error In": error
  "LPC Mega Cluster In": "LPC Mega Cluster.gtype"
  "SRM Mega Cluster In": "SRM Mega Cluster.gtype"
  "Operation Control": T1 = "left button"
  "Misc Data Mega Cluster In": "Misc Data Mega Cluster.gtype"
outputs:
  "Error Out": error
  "SRM Mega Cluster Out": "SRM Mega Cluster.gtype"
  "LPC Mega Cluster Out": "LPC Mega Cluster.gtype"
types:
  "SRM Specific Parameters.gtype" = cluster{"Max (V)": f64, "Min (V)": f64, "V Points": u32, "Current Range (A)": f64, "Autorange": bool, "Sweep Dir": bool, "Current Averages": u32, "Max (A)": f64, "Integration Time": f64, "Cell Area (m^2)": f64, "Full Spctr Ref": bool}
  "Raibow Sweep Selector.gtype" = enum{"Red Sweep", "Blue Sweep", "Full Sweep Red First", "Full Sweep Blue First"}
  "Rainbow Sweep Param Selector.gtype" = cluster{"Raibow Sweep Selector": "Raibow Sweep Selector.gtype", "Max Wavelength (nm)": f64, "Min Wavelength (nm)": f64, "Wavelength Step (nm)": f64, "Rainbow Sweep Type Selector": "Rainbow Sweep Type Selector.gtype"}
  "Rainbow Sweep Types.gtype" = enum{"Red Sweep Closing", "Red Sweep Opening", "Blue Sweep Closing", "Blue Sweep Opening"}
  "IV Full Data Cluster.gtype" = cluster{"IV Measurements Array": "IV Single Measurement.gtype"[], "Rainbow Sweep Types": "Rainbow Sweep Types.gtype", "IV Refined Data": "IV Refined Full Sweep Data.gtype"}
  "IV Full Raw Data.gtype" = cluster{"Rainbow Sweep Types": "Rainbow Sweep Types.gtype", "IV Raw Data Array": "IV Single Measurement.gtype"[]}
  "SRM Mega Cluster.gtype" = cluster{"SRM Specific Parameters": "SRM Specific Parameters.gtype", "Rainbow Sweep Parameters SRM": "Rainbow Sweep Param Selector.gtype", "SRM Full IV data Array": "IV Full Data Cluster.gtype"[], "Full IV Curve Raw Data": "IV Full Raw Data.gtype"[]}
  T1 = enum{"left button", "center button", "right button", "window close"}
  "Full Reference Cluster.gtype" = cluster{"Enum Reference Cluster": "Enum Control Reference Cluster.gtype", "Boolean Reference Cluster": "Boolean Control Reference Cluster.gtype", "Numeric Reference Cluster": "Numeric Control Reference Cluster.gtype", "Numeric Cluster Reference Cluster": "Numeric Cluster Reference Cluster.gtype", "Path Reference Cluster": "Path Reference Cluster.gtype", "Cluster Reference Cluster": "Cluster Reference Cluster.gtype", "XZ Stage Controls Reference Cluster": "XZ Stage Controls Reference Cluster.gtype"}
  "Cell Naming Cluster.gtype" = cluster{"Cell Label": string, "Sample Prefix": string, "Author Initials": string, "Current Date": string, "Batch Name": string}
  T2 = cluster{"X Coordinate (mm)": f64, "Z Coordinate (mm)": f64}
  T3 = cluster{"X Coordinate (mm)": f64, "Z Coordinate (mm)": f64, "Vertical Spacing (mm)": f64}
  "XZ All Position Cluster.gtype" = cluster{"Diffusor Coordinates": T2, "Photodetector Coordinates": T2, "Cell R.01 Coordinates": T3}
  T4 = cluster{"Thorlabs Motor Serial Number File Path": path, "Default Data Saving Location": path}
  "Misc Data Mega Cluster.gtype" = cluster{"Full Reference Cluster": "Full Reference Cluster.gtype", "Cell Naming Cluster": "Cell Naming Cluster.gtype", "All XZ Position Cluster": "XZ All Position Cluster.gtype", "All Paths": T4}
  "Light power Calibration Parameters.gtype" = cluster{"Powermeter Averages": u32, "Photodtctr Area (m^2)": f64}
  T5 = cluster{"Dividing Wavelength Array": f64[], "Measured Power Array": f64[]}
  "Light Power Calibration Data.gtype" = cluster{"Single Light Calibration": T5, "Rainbow Sweep Types": "Rainbow Sweep Types.gtype", "Total Light Power Density": f64}
  "LPC Mega Cluster.gtype" = cluster{"Rainbow Sweep Parameters LPC": "Rainbow Sweep Param Selector.gtype", "LPC Specific Parameters": "Light power Calibration Parameters.gtype", "Light Power Calibration Data": "Light Power Calibration Data.gtype"[]}
diagram:
  # This subVI Sets the minimum sweep so that the light calibration is only to measure the fully open spectrum in case we have selected the option full spectrum
  # othewise it updates the values of the LPC with the currently rainbow parameters SRM
  case ($"Error In") {
    frame Error, Default {
      w1 = $"Error In"
      w2 = $"SRM Mega Cluster In"
      w3 = $"LPC Mega Cluster In"
    }
    frame No Error {
      Property Node(instance in=$"SRM Mega Cluster In") -> ("SRM Specific Parameters:Full Spctr Ref"=w4, instance out=w5)
      case (w4) {
        frame False, Default {
          Property Node(instance in=w5) -> ("Rainbow Sweep Parameters SRM"=w6, instance out=w2)
          case ($"Operation Control") {
            frame "left button" {
              Property Node(instance in=$"LPC Mega Cluster In", "Rainbow Sweep Parameters LPC"=w6) -> (instance out=w3)
              Property Node(instance in=$"Misc Data Mega Cluster In") -> ("Full Reference Cluster:Cluster Reference Cluster:Rainbow Sweep Parameters LPC"=w7)
              Property Node(instance in=w7, "Value"=w6, error in=$"Error In") -> (error out=w1)
            }
            frame "center button", Default {
              w3 = $"LPC Mega Cluster In"
              w1 = $"Error In"
            }
          }
        }
        frame True {
          case ($"Operation Control") {
            frame "center button", Default {
              w2 = w5
              w3 = $"LPC Mega Cluster In"
              w1 = $"Error In"
            }
            frame "left button" {
              Property Node(instance in=w5) -> ("Rainbow Sweep Parameters SRM"=w8, instance out=w2)
              Property Node(instance in=w8, "Max Wavelength (nm)"=500, "Min Wavelength (nm)"=500, "Wavelength Step (nm)"=1) -> (instance out=w9)
              Property Node(instance in=$"LPC Mega Cluster In", "Rainbow Sweep Parameters LPC"=w9) -> (instance out=w3)
              Property Node(instance in=$"Misc Data Mega Cluster In") -> ("Full Reference Cluster:Cluster Reference Cluster:Rainbow Sweep Parameters LPC"=w10)
              Property Node(instance in=w10, "Value"=w9, error in=$"Error In") -> (error out=w1)
            }
          }
        }
      }
    }
  }
  $"SRM Mega Cluster Out" <- w2
  $"LPC Mega Cluster Out" <- w3
  $"Error Out" <- w1
