vi "SRM FGV Read Handler.gvi"   [LabVIEW NXG 5.0.0]
inputs:
  "SRM sweep live parameters FGV Cluster In": "SRM Sweep Live Parameters FGV Cluster.gtype"
  "Error In": error
outputs:
  "SRM sweep live parameters FGV Cluster Out": "SRM Sweep Live Parameters FGV Cluster.gtype"
  "Error Out": error
types:
  "IV Single Measurement.gtype" = cluster{"Voltage (V)": f64[], "Current (A)": f64[], "Current Density (A/m^2)": f64[], "Dividing Wavelength (nm)": f64, "Light Power Density (W/m^2)": f64, "Total Light Power Density (W/m^2)": f64}
  "SRM Single Plot Cluster.gtype" = cluster{"Voltage (V)": f64[], "Current Density (A/m^2)": f64[]}
  "Rainbow Sweep Types.gtype" = enum{"Red Sweep Closing", "Red Sweep Opening", "Blue Sweep Closing", "Blue Sweep Opening"}
  "SRM Sweep Live Parameters.gtype" = cluster{"Current Wavelength (nm)": f64, "Rainbow Sweep Types": "Rainbow Sweep Types.gtype", "Finished Measurement?": bool}
  "IV Full Raw Data.gtype" = cluster{"Rainbow Sweep Types": "Rainbow Sweep Types.gtype", "IV Raw Data Array": "IV Single Measurement.gtype"[]}
  "SRM Sweep Live Parameters FGV Cluster.gtype" = cluster{"IV Single Measurement Array": "IV Single Measurement.gtype"[], "SRM Sweep type combo box selction": string, "IV Single Measurement Plot Array": "SRM Single Plot Cluster.gtype"[], "SRM Live Parameters": "SRM Sweep Live Parameters.gtype", "Counter": i32, "Full IV Data Array": "IV Full Raw Data.gtype"[], "Combobox Reference": "ComboBoxSelector reference", "Refresh now": bool, "Graph Reference": "Graph reference"}
uses:
  Rainbow Measurement Setup::Main Functions::Rainbow Measurement::Cell Single Rainbow Measurement::Plotting::SRM Raw Data Graph Adapter.gvi
diagram:
  # This SubVI Takes care of selecting the right set of data to plot from the SRM Sweep Raw Data and it also sets both the name of the available plots and the dividing wavelength that corresponds to each and
  # every plot within the graph. It does so every now and then to prevent being too wasteful on resources.
  case ($"Error In") {
    frame Error, Default {
      w1 = $"Error In"
      w2 = $"SRM sweep live parameters FGV Cluster In"
    }
    frame No Error {
      Property Node(instance in=$"SRM sweep live parameters FGV Cluster In") -> ("Graph Reference"=w3, "Combobox Reference"=w4, "SRM Live Parameters:Finished Measurement?"=w5, "Full IV Data Array"=w6, "Counter"=w7, "SRM Sweep type combo box selction"=w8, "IV Single Measurement Plot Array"=w9, "IV Single Measurement Array"=w10, "Refresh now"=w11, instance out=w12)
      Not(x=w5) -> w13
      Property Node(instance in=w4, "Disabled"=w13, error in=$"Error In") -> ("Value"=w14, error out=w15, instance out=w16)
      Is Not Equal(x=w14, y=w8) -> w17
      Logical Or(w17, w11) -> w18
      case (w18) {
        frame False, Default {
          w19 = w9
          w20 = w15
          w21 = w10
          w22 = w16
          w23 = default
        }
        frame True {
          for {
            w24 = each element of w6
            Property Node(instance in=w24) -> ("Rainbow Sweep Types"=w25, "IV Raw Data Array"=w26)
            Format Into String(w25) -> w27
            Is Equal(x=w14, y=w27) -> w28
            w21 = w26 if w28
          }
          call "SRM Raw Data Graph Adapter.gvi"(IV Raw Data Array=w21, Error In=w15) -> (IV Plot Out=w19, Error Out=w20)
          w22 = w16
          w23 = TRUE
        }
      }
      Increment(x=w7) -> w29
      Is Greater(x=w29, y=50) -> w30
      Logical Or(w30, w17, w11) -> w31
      case (w31) {
        frame False, Default {
          w1 = w20
          w32 = w29
          w33 = default
        }
        frame True {
          s1 = w20  # shift register
          for (iteration -> i1) {
            w34 = each element of w21
            Property Node(instance in=w3, "ActivePlot"=i1, error in=s1) -> ("Plot"=w35, error out=w36)
            Property Node(instance in=w34) -> ("Dividing Wavelength (nm)"=w37)
            Format Into String(formatString="%d", w37) -> w38
            Concatenate Strings(w38, " nm") -> w39
            Property Node(instance in=w35, "Name"=w39, error in=w36) -> (error out=w40, instance out=w41)
            next s1 = w40
          }
          for {
            w42 = each element of w6
            Property Node(instance in=w42) -> ("Rainbow Sweep Types"=w44)
            Format Into String(w44) -> w45
            append w45 to w43
          }
          Property Node(instance in=w22, "Items"=w43, error in=s1) -> (error out=w1)
          w32 = 0
          w33 = TRUE
        }
      }
      Logical And[output inverted](w33, w23) -> w46
      Select(s=w11, t=w46, f=FALSE) -> w47
      Property Node(instance in=w12, "Counter"=w32, "SRM Sweep type combo box selction"=w14, "IV Single Measurement Plot Array"=w19, "Refresh now"=w47) -> (instance out=w2)
    }
  }
  $"SRM sweep live parameters FGV Cluster Out" <- w2
  $"Error Out" <- w1
