vi "SRM Raw Data Graph Adapter.gvi"   [LabVIEW NXG 5.0.0]
inputs:
  "Error In": error
  "IV Raw Data Array": "IV Single Measurement.gtype"[]
outputs:
  "Error Out": error
  "IV Plot Out": "SRM Single Plot Cluster.gtype"[]
types:
  "IV Single Measurement.gtype" = cluster{"Voltage (V)": f64[], "Current (A)": f64[], "Current Density (A/m^2)": f64[], "Dividing Wavelength (nm)": f64, "Light Power Density (W/m^2)": f64, "Total Light Power Density (W/m^2)": f64}
  "SRM Single Plot Cluster.gtype" = cluster{"Voltage (V)": f64[], "Current Density (A/m^2)": f64[]}
diagram:
  # This SubVI Adapts the IV Raw data array
  #  so that it can be plotted
  case ($"Error In") {
    frame Error, Default {
      w1 = $"Error In"
      w2 = default
    }
    frame No Error {
      for {
        w3 = each element of $"IV Raw Data Array"
        Property Node(instance in=w3) -> ("Voltage (V)"=w4, "Current Density (A/m^2)"=w5)
        Property Node(instance in="SRM Single Plot Cluster.gtype" {all zero or empty}, "Voltage (V)"=w4, "Current Density (A/m^2)"=w5) -> (instance out=w6)
        append w6 to w2
      }
      w1 = $"Error In"
    }
  }
  $"Error Out" <- w1
  $"IV Plot Out" <- w2
