vi "SRM Refined Data Graph Adapter.gvi"   [LabVIEW NXG 5.0.0]
inputs:
  "Error In": error
  "IV Full Data Cluster Array In": "IV Full Data Cluster.gtype"[]
outputs:
  "Error Out": error
  "IV Full Data To Plot": "SRM IV Refined Data Plot.gtype"[]
types:
  "IV Single Measurement.gtype" = cluster{"Voltage (V)": f64[], "Current (A)": f64[], "Current Density (A/m^2)": f64[], "Dividing Wavelength (nm)": f64, "Light Power Density (W/m^2)": f64, "Total Light Power Density (W/m^2)": f64}
  "Rainbow Sweep Types.gtype" = enum{"Red Sweep Closing", "Red Sweep Opening", "Blue Sweep Closing", "Blue Sweep Opening"}
  "IV Refined Full Sweep Data.gtype" = cluster{"Rs (Ω · m^2)": f64[], "Rsh (Ω · m^2)": f64[], "Jsc (A/m^2)": f64[], "Voc (V)": f64[], "FF (%)": f64[], "Efficiency (%)": f64[], "Dividing Wavelength (nm)": f64[], "Light Power Density (W/m^2)": f64[]}
  "IV Full Data Cluster.gtype" = cluster{"IV Measurements Array": "IV Single Measurement.gtype"[], "Rainbow Sweep Types": "Rainbow Sweep Types.gtype", "IV Refined Data": "IV Refined Full Sweep Data.gtype", "Total Light Power Density (W/m^2)": f64}
  T1 = cluster{"Dividing Wavelength (nm)": f64[], "Efficiency (%)": f64[]}
  T2 = cluster{"Dividing Wavelength (nm)": f64[], "Jsc (A/m^2)": f64[]}
  T3 = cluster{"Dividing Wavelength (nm)": f64[], "Voc (V)": f64[]}
  T4 = cluster{"Dividing Wavelength (nm)": f64[], "Light Power Density (W/m^2)": f64[]}
  T5 = cluster{"Dividing Wavelength (nm)": f64[], "FF (%)": f64[]}
  T6 = cluster{"Dividing Wavelength (nm)": f64[], "Rs (Ω · m^2)": f64[]}
  T7 = cluster{"Dividing Wavelength (nm)": f64[], "Rsh (Ω · m^2)": f64[]}
  "SRM IV Refined Data Plot.gtype" = cluster{"Efficiency Plot": T1, "Jsc Plot": T2, "Voc Plot": T3, "Light Power Density Plot": T4, "FF Plot": T5, "Rs Plot": T6, "Rsh Plot": T7, "Rainbow Sweep Types": "Rainbow Sweep Types.gtype", "Total Light Power Density (W/m^2)": f64}
diagram:
  case ($"Error In") {
    frame Error, Default {
      w1 = $"Error In"
      w2 = default
    }
    frame No Error {
      for {
        w3 = each element of $"IV Full Data Cluster Array In"
        Property Node(instance in=w3) -> ("IV Refined Data"=w4, "Rainbow Sweep Types"=w5, "Total Light Power Density (W/m^2)"=w6)
        Property Node(instance in=w4) -> ("Efficiency (%)"=w7, "Jsc (A/m^2)"=w8, "Voc (V)"=w9, "Light Power Density (W/m^2)"=w10, "FF (%)"=w11, "Rs (Ω · m^2)"=w12, "Rsh (Ω · m^2)"=w13, "Dividing Wavelength (nm)"=w14)
        Property Node(instance in=T1 {all zero or empty}, "Dividing Wavelength (nm)"=w14, "Efficiency (%)"=w7) -> (instance out=w15)
        Property Node(instance in=T2 {all zero or empty}, "Dividing Wavelength (nm)"=w14, "Jsc (A/m^2)"=w8) -> (instance out=w16)
        Property Node(instance in=T3 {all zero or empty}, "Dividing Wavelength (nm)"=w14, "Voc (V)"=w9) -> (instance out=w17)
        Property Node(instance in=T4 {all zero or empty}, "Dividing Wavelength (nm)"=w14, "Light Power Density (W/m^2)"=w10) -> (instance out=w18)
        Property Node(instance in=T5 {all zero or empty}, "Dividing Wavelength (nm)"=w14, "FF (%)"=w11) -> (instance out=w19)
        Property Node(instance in=T6 {all zero or empty}, "Dividing Wavelength (nm)"=w14, "Rs (Ω · m^2)"=w12) -> (instance out=w20)
        Property Node(instance in=T7 {all zero or empty}, "Dividing Wavelength (nm)"=w14, "Rsh (Ω · m^2)"=w13) -> (instance out=w21)
        Property Node(instance in="SRM IV Refined Data Plot.gtype" {all zero or empty}, "Efficiency Plot"=w15, "Jsc Plot"=w16, "Voc Plot"=w17, "Light Power Density Plot"=w18, "FF Plot"=w19, "Rs Plot"=w20, "Rsh Plot"=w21, "Rainbow Sweep Types"=w5, "Total Light Power Density (W/m^2)"=w6) -> (instance out=w22)
        append w22 to w2
      }
      w1 = $"Error In"
    }
  }
  $"Error Out" <- w1
  $"IV Full Data To Plot" <- w2
