vi "SRM Sweep Refined Data FGV.gvi"   [LabVIEW NXG 5.0.0]
inputs:
  "Error In": error
  "FGV Instructions": "General FGV Instructions.gtype" = "Read State"
  "SRM Mega Cluster In": "SRM Mega Cluster.gtype"
  "Full Reference Cluster": "Full Reference Cluster.gtype"
outputs:
  "Error Out": error
  "IV Extracted Parameters Plot": T1
types:
  "General FGV Instructions.gtype" = enum{"Read State", "Set State", "Reset State"}
  T1 = cluster{"Dividing Wavelength (nm)": f64[], "Element 2": f64[]}
  "Enum Control Reference Cluster.gtype" = cluster{"Main Tab": "TabControl reference", "Rainbow Measurement tab": "TabControl reference", "Configuration tab": "TabControl reference", "Light Calibration tab": "TabControl reference", "SRM Plot Parameter Selector": "EnumSelector reference", "Current State": "EnumSelector reference"}
  "Boolean Control Reference Cluster.gtype" = cluster{"Custom date": "CheckBox reference", "Label Info Missing Error": "BooleanControl reference"}
  "Numeric Control Reference Cluster.gtype" = cluster{"Beam Power Density": "IntensityGraph reference"[][], "Irradiance Calibration": "Graph reference"[]}
  "Numeric Cluster Reference Cluster.gtype" = cluster{"LPC Parameters": "Cluster reference", "Sweep Live Parameters LPC": "Cluster reference"}
  "Path Reference Cluster.gtype" = cluster{"Calibration Files Path": "PathSelector reference", "Default Data Saving Location": "PathSelector reference"}
  "Cluster Reference Cluster.gtype" = cluster{"Light Power Calibration": "Graph reference", "Rainbow Sweep Parameters RSM": "Cluster reference", "Rainbow Sweep Param Selector MSpot": "Cluster reference", "MSpot Spectrum Calibration Parameters": "Cluster reference", "SRM Raw Plot Rainbow Sweep Selector": "ComboBoxSelector reference", "SRM Refined Plot Rainbow Sweep Types": "ComboBoxSelector reference", "SRM Specific Parameters": "Cluster reference", "Label Info Error Label": "StringControl reference", "Sample Comments": "StringControl reference", "Cell Number": "StringControl reference", "Author Initials": "ComboBoxSelector reference", "Batch Name": "StringControl reference", "IV Plot Out ": "Graph reference", "Sweep Live Parameters RSM": "Cluster reference", "Rainbow Sweep Parameters LPC": "Cluster reference", "XZ All Position Cluster": "Cluster reference", "State": "StringControl reference", "Current Substate": "StringControl reference", "Substate": "StringControl reference", "Current Date": "StringControl reference", "Sample Prefix": "StringControl reference", "IV Extracted Parameter Plot ": "Graph reference", "Light Power Calibration Data": "ArrayViewer reference"}
  "XZ Stage Controls Reference Cluster.gtype" = cluster{"Cell Label": "EnumSelector reference", "Custom Position": "BooleanControl reference", "Set Position": "BooleanControl reference", "XZ Stage Active": "BooleanControl reference", "Release XZ Stage": "BooleanControl reference", "XZ Coordinates": "Cluster reference", "Activate XZ Stage": "BooleanControl reference"}
  "Full Reference Cluster.gtype" = cluster{"Enum Reference Cluster": "Enum Control Reference Cluster.gtype", "Boolean Reference Cluster": "Boolean Control Reference Cluster.gtype", "Numeric Reference Cluster": "Numeric Control Reference Cluster.gtype", "Numeric Cluster Reference Cluster": "Numeric Cluster Reference Cluster.gtype", "Path Reference Cluster": "Path Reference Cluster.gtype", "Cluster Reference Cluster": "Cluster Reference Cluster.gtype", "XZ Stage Controls Reference Cluster": "XZ Stage Controls Reference Cluster.gtype"}
  "SRM Specific Parameters.gtype" = cluster{"Max (V)": f64, "Min (V)": f64, "V Points": u32, "Current Range (A)": f64, "Autorange": bool, "Sweep Dir": bool, "Current Averages": u32, "Max (A)": f64, "Integration Time": f64, "Cell Area (m^2)": f64, "Full Spctr Ref": bool}
  "Raibow Sweep Selector.gtype" = enum{"Red Sweep", "Blue Sweep", "Full Sweep Red First", "Full Sweep Blue First"}
  "Rainbow Sweep Param Selector.gtype" = cluster{"Raibow Sweep Selector": "Raibow Sweep Selector.gtype", "Max Wavelength (nm)": f64, "Min Wavelength (nm)": f64, "Wavelength Step (nm)": f64, "Rainbow Sweep Type Selector": "Rainbow Sweep Type Selector.gtype"}
  "Rainbow Sweep Types.gtype" = enum{"Red Sweep Closing", "Red Sweep Opening", "Blue Sweep Closing", "Blue Sweep Opening"}
  "IV Full Data Cluster.gtype" = cluster{"IV Measurements Array": "IV Single Measurement.gtype"[], "Rainbow Sweep Types": "Rainbow Sweep Types.gtype", "IV Refined Data": "IV Refined Full Sweep Data.gtype"}
  "IV Full Raw Data.gtype" = cluster{"Rainbow Sweep Types": "Rainbow Sweep Types.gtype", "IV Raw Data Array": "IV Single Measurement.gtype"[]}
  "SRM Mega Cluster.gtype" = cluster{"SRM Specific Parameters": "SRM Specific Parameters.gtype", "Rainbow Sweep Parameters SRM": "Rainbow Sweep Param Selector.gtype", "SRM Full IV data Array": "IV Full Data Cluster.gtype"[], "Full IV Curve Raw Data": "IV Full Raw Data.gtype"[]}
uses:
  Rainbow Measurement Setup::Main Functions::Rainbow Measurement::Cell Single Rainbow Measurement::Plotting::SRM Sweep Refined FGV Read Handler.gvi
  Rainbow Measurement Setup::Main Functions::Rainbow Measurement::Cell Single Rainbow Measurement::Plotting::SRM Sweep Refined FGV Set State.gvi
diagram:
  # This FGV Stores the SRM live parameters and the plots so that
  # they can be updated live while being measured. It also sets the name
  # of the plots so that you know which color corresponds to each dividing wavelength
  case ($"Error In") {
    frame Error, Default {
      w1 = $"Error In"
    }
    frame No Error {
      s1 = $"Error In"  # shift register
      s2 = uninitialised  # shift register
      s3 = uninitialised  # shift register
      s4 = uninitialised  # shift register
      s5 = uninitialised  # shift register
      while {
        case ($"FGV Instructions") {
          frame "Read State", Default {
            Property Node(instance in=$"Full Reference Cluster") -> ("Cluster Reference Cluster:SRM Refined Plot Rainbow Sweep Types"=w7, "Enum Reference Cluster:SRM Plot Parameter Selector"=w8)
            Property Node(instance in=w8, error in=s1) -> ("Value"=w9, error out=w10)
            call "SRM Sweep Refined FGV Read Handler.gvi"(SRM Refined Plot Rainbow Sweep Types Selector In=w7, Parameter Selector=w9, IV Refined Data Plot=s2, Error In=w10) -> (SRM Refined Plot Rainbow Sweep Types Selector Out=w6, IV Extracted Parameters Plot=w5, Error Out=w3)
            $"IV Extracted Parameters Plot" <- w5
            w2 = s3
            w4 = s2
          }
          frame "Set State" {
            Property Node(instance in=$"SRM Mega Cluster In") -> ("SRM Full IV data Array"=w2)
            call "SRM Sweep Refined FGV Set State.gvi"(Combo Box Reference In=s5, IV Full Data Cluster Array In=w2, Error In=s1) -> (Combo Box Reference Out=w6, IV Refined Plot Data Out=w4, Error Out=w3)
            w5 = s4
          }
          frame "Reset State" {
            w2 = default
            w3 = s1
            w4 = default
            w5 = default
            w6 = default
          }
        }
        next s1 = w3
        next s2 = w4
        next s3 = w2
        next s4 = w5
        next s5 = w6
        stop if TRUE
      }
      w1 = s1
    }
  }
  $"Error Out" <- w1
