vi "SRM Sweep Refined FGV Set State.gvi"   [LabVIEW NXG 5.0.0]
inputs:
  "Full Reference Cluster In": "Full Reference Cluster.gtype"
  "IV Full Data Cluster Array In": "IV Full Data Cluster.gtype"[]
  "Error In": error
outputs:
  "Full Reference Cluster Out": "Full Reference Cluster.gtype"
  "IV Refined Plot Data Out": "SRM IV Refined Data Plot.gtype"[]
  "Error Out": error
types:
  T1 = cluster{"Dividing Wavelength (nm)": f64[], "Efficiency (%)": f64[]}
  T2 = cluster{"Dividing Wavelength (nm)": f64[], "Jsc (A/m^2)": f64[]}
  T3 = cluster{"Dividing Wavelength (nm)": f64[], "Voc (V)": f64[]}
  T4 = cluster{"Dividing Wavelength (nm)": f64[], "Light Power Density (W/m^2)": f64[]}
  T5 = cluster{"Dividing Wavelength (nm)": f64[], "FF (%)": f64[]}
  T6 = cluster{"Dividing Wavelength (nm)": f64[], "Rs (Ω · m^2)": f64[]}
  T7 = cluster{"Dividing Wavelength (nm)": f64[], "Rsh (Ω · m^2)": f64[]}
  "Rainbow Sweep Types.gtype" = enum{"Red Sweep Closing", "Red Sweep Opening", "Blue Sweep Closing", "Blue Sweep Opening"}
  "SRM IV Refined Data Plot.gtype" = cluster{"Efficiency Plot": T1, "Jsc Plot": T2, "Voc Plot": T3, "Light Power Density Plot": T4, "FF Plot": T5, "Rs Plot": T6, "Rsh Plot": T7, "Rainbow Sweep Types": "Rainbow Sweep Types.gtype", "Total Light Power Density (W/m^2)": f64}
  "IV Single Measurement.gtype" = cluster{"Voltage (V)": f64[], "Current (A)": f64[], "Current Density (A/m^2)": f64[], "Dividing Wavelength (nm)": f64, "Light Power Density (W/m^2)": f64, "Total Light Power Density (W/m^2)": f64}
  "IV Refined Full Sweep Data.gtype" = cluster{"Rs (Ω · m^2)": f64[], "Rsh (Ω · m^2)": f64[], "Jsc (A/m^2)": f64[], "Voc (V)": f64[], "FF (%)": f64[], "Efficiency (%)": f64[], "Dividing Wavelength (nm)": f64[], "Light Power Density (W/m^2)": f64[]}
  "IV Full Data Cluster.gtype" = cluster{"IV Measurements Array": "IV Single Measurement.gtype"[], "Rainbow Sweep Types": "Rainbow Sweep Types.gtype", "IV Refined Data": "IV Refined Full Sweep Data.gtype", "Total Light Power Density (W/m^2)": f64}
  T8 = cluster{"IV Extracted Parameter Plot ": "Graph reference", "MRM Cell Selector Ref": "Cluster reference", "IV Plot Out Multiple Reference": "Graph reference", "Rainbow Sweep Parameters MRM Ref": "Cluster reference", "MRM Specific Parameters Ref": "Cluster reference", "MRM Cell Refined Plot Selector ref": "ComboBoxSelector reference", "MRM Current Raw Cell Plot": "ComboBoxSelector reference", "MRM Raw Plot Rainbow Sweep Relector Ref": "ComboBoxSelector reference"}
  T9 = cluster{"SRM Light Power Density Ref": "NumericTextBoxDouble reference", "Rainbow Sweep Parameters RSM": "Cluster reference", "SRM Refined Plot Rainbow Sweep Types": "ComboBoxSelector reference", "SRM Specific Parameters": "Cluster reference", "Sweep Live Parameters RSM": "Cluster reference", "SRM Raw Plot Rainbow Sweep Selector": "ComboBoxSelector reference", "SRM Plot Parameter Selector Ref": "EnumSelector reference", "IV Plot Out Ref": "Graph reference"}
  T10 = cluster{"Calibration Files Path": "PathSelector reference", "Default Data Saving Location": "PathSelector reference"}
  T11 = cluster{"Main Tab": "TabControl reference", "Rainbow Measurement tab": "TabControl reference", "Configuration tab": "TabControl reference", "Light Calibration tab": "TabControl reference"}
  T12 = cluster{"Custom date": "CheckBox reference", "Batch Name": "StringControl reference", "Author Initials": "ComboBoxSelector reference", "Cell Number": "StringControl reference", "Current Date": "StringControl reference", "Sample Comments": "StringControl reference", "Sample Prefix": "StringControl reference", "Label Info Missing Error": "BooleanControl reference", "Label Info Error Label": "StringControl reference"}
  T13 = cluster{"Beam Power Density": "IntensityGraph reference"[][], "Irradiance Calibration": "Graph reference"[], "MSpot Spectrum Calibration Parameters": "Cluster reference", "Rainbow Sweep Param Selector MSpot": "Cluster reference"}
  T14 = cluster{"LPC Parameters Ref": "Cluster reference", "Sweep Live Parameters LPC ref": "Cluster reference", "Light Power Calibration": "Graph reference", "Light Power Calibration Data Ref": "ArrayViewer reference", "Rainbow Sweep Parameters LPC": "Cluster reference"}
  T15 = cluster{"Current State Ref": "EnumSelector reference", "Substate": "StringControl reference", "State": "StringControl reference", "Current Substate": "StringControl reference"}
  T16 = cluster{"Custom Position": "BooleanControl reference", "Set Position": "BooleanControl reference", "XZ Stage Active": "BooleanControl reference", "Release XZ Stage": "BooleanControl reference", "XZ Coordinates": "Cluster reference", "Activate XZ Stage": "BooleanControl reference", "XZ Stage Cell Reference": "EnumSelector reference", "XZ All Position Cluster Ref": "Cluster reference"}
  "Full Reference Cluster.gtype" = cluster{"MRM Reference Cluster": T8, "SRM Reference Cluster": T9, "Path Reference Cluster": T10, "Tab Reference Cluster": T11, "Cell Naming Parameters Ref Cluster": T12, "One Time Calibrations Ref Cluster": T13, "LPC Controls Reference Cluster": T14, "System Parameters Ref Cluster": T15, "XZ Stage Controls Reference Cluster": T16}
uses:
  Rainbow Measurement Setup::Main Functions::Rainbow Measurement::Cell Single Rainbow Measurement::Plotting::SRM Refined Data Graph Adapter.gvi
diagram:
  # This SubVI takes the IV Data and extracts the values of the rainbow sweep types
  # to set the Combobox values to all the available sweep types
  case ($"Error In") {
    frame Error, Default {
      w1 = default
      w2 = $"Error In"
      w3 = $"Full Reference Cluster In"
    }
    frame No Error {
      call "SRM Refined Data Graph Adapter.gvi"(IV Full Data Cluster Array In=$"IV Full Data Cluster Array In", Error In=$"Error In") -> (IV Full Data To Plot=w1, Error Out=w4)
      s1 = w4  # shift register
      for {
        w5 = each element of $"IV Full Data Cluster Array In"
        Property Node(instance in=w5) -> ("Rainbow Sweep Types"=w7)
        Format Into String(w7) -> w8
        append w8 to w6
      }
      Property Node(instance in=$"Full Reference Cluster In") -> ("SRM Reference Cluster:SRM Refined Plot Rainbow Sweep Types"=w9, instance out=w3)
      Property Node(instance in=w9, "Items"=w6, "ValueSignaling"=w8, error in=s1) -> (error out=w2)
    }
  }
  $"Full Reference Cluster Out" <- w3
  $"IV Refined Plot Data Out" <- w1
  $"Error Out" <- w2
