vi "SRM Extract Measured Power.gvi"   [LabVIEW NXG 5.0.0]
inputs:
  "Error In": error
  "Dividing Wavelength In": f64
  "Light Power Calibration Data In": "Light Power Calibration Data.gtype"
  "SRM Mega Cluster In": "SRM Mega Cluster.gtype"
outputs:
  "Error Out": error
  "IV Single Measurement Out": "IV Single Measurement.gtype"
types:
  T1 = cluster{"Dividing Wavelength Array": f64[], "Measured Power Array": f64[], "Power Density Array": f64[]}
  "Rainbow Sweep Types.gtype" = enum{"Red Sweep Closing", "Red Sweep Opening", "Blue Sweep Closing", "Blue Sweep Opening"}
  "Light Power Calibration Data.gtype" = cluster{"Single Light Calibration": T1, "Rainbow Sweep Types": "Rainbow Sweep Types.gtype", "Total Light Power Density (W/m^2)": f64}
  "IV Single Measurement.gtype" = cluster{"Voltage (V)": f64[], "Current (A)": f64[], "Current Density (A/m^2)": f64[], "Dividing Wavelength (nm)": f64, "Light Power Density (W/m^2)": f64, "Total Light Power Density (W/m^2)": f64}
  "SRM Specific Parameters.gtype" = cluster{"Max (V)": f64, "Min (V)": f64, "V Points": u32, "Current Range (A)": f64, "Autorange": bool, "Sweep Dir": bool, "Current Averages": u32, "Max (A)": f64, "Integration Time": f64, "Cell Area (m^2)": f64, "Full Spctr Ref": bool}
  "Raibow Sweep Selector.gtype" = enum{"Red Sweep", "Blue Sweep", "Full Sweep Red First", "Full Sweep Blue First"}
  "Rainbow Sweep Param Selector.gtype" = cluster{"Raibow Sweep Selector": "Raibow Sweep Selector.gtype", "Max Wavelength (nm)": f64, "Min Wavelength (nm)": f64, "Wavelength Step (nm)": f64, "Rainbow Sweep Type Selector": "Rainbow Sweep Type Selector.gtype"}
  "IV Full Data Cluster.gtype" = cluster{"IV Measurements Array": "IV Single Measurement.gtype"[], "Rainbow Sweep Types": "Rainbow Sweep Types.gtype", "IV Refined Data": "IV Refined Full Sweep Data.gtype", "Total Light Power Density (W/m^2)": f64}
  "IV Full Raw Data.gtype" = cluster{"Rainbow Sweep Types": "Rainbow Sweep Types.gtype", "IV Raw Data Array": "IV Single Measurement.gtype"[]}
  "SRM Mega Cluster.gtype" = cluster{"SRM Specific Parameters": "SRM Specific Parameters.gtype", "Rainbow Sweep Parameters SRM": "Rainbow Sweep Param Selector.gtype", "SRM Full IV data Array": "IV Full Data Cluster.gtype"[], "Full IV Curve Raw Data": "IV Full Raw Data.gtype"[]}
uses:
  Rainbow Measurement Setup::Side Functions::Messages And Prompts::FGV Cancel Prompts until Finished Routine.gvi
  Rainbow Measurement Setup::Side Functions::Utilities::Array Operations::Find Closest In Array.gvi
diagram:
  # This SubVI Finds the closest value to the desired dividing wavelength and outputs
  # both the closest value and the power of the beam at that measured value and stores them within
  # the IV Sweep Data Cluster
  # It also prompts the user in case the Dividing wavelength is too far from the calibration one
  # In case we are performing a full spectrum reference it does not try to find the closest value to
  # the dividing wavelength and it gives out the light power as the total light power.
  case ($"Error In") {
    frame Error, Default {
      w1 = $"Error In"
      w2 = "IV Single Measurement.gtype" {all zero or empty}
    }
    frame No Error {
      Property Node(instance in=$"Light Power Calibration Data In") -> ("Single Light Calibration:Dividing Wavelength Array"=w3, "Single Light Calibration:Measured Power Array"=w4, "Total Light Power Density (W/m^2)"=w5)
      Property Node(instance in=$"SRM Mega Cluster In") -> ("SRM Specific Parameters:Full Spctr Ref"=w6)
      case (w6) {
        frame True {
          w7 = FALSE
          w8 = $"Error In"
          w9 = w5
          w10 = $"Dividing Wavelength In"
        }
        frame False {
          call "FGV Cancel Prompts until Finished Routine.gvi"(Error In=$"Error In", FGV Instructions="Read State") -> (Prompt? Out=w11, Error Out=w12)
          call "Find Closest In Array.gvi"(Array In=w3, Desired Value=$"Dividing Wavelength In", Tolerance=10, Error In=w12) -> (Closest Value Index=w13, Closest Value=w10, Within Tolerance?=w14, Error Out=w8)
          Array Index(array=w4) -> (out0[w13]=w9)
          Logical And(w11, not w14) -> w7
        }
      }
      Property Node(instance in="IV Single Measurement.gtype" {all zero or empty}, "Light Power Density (W/m^2)"=w9, "Dividing Wavelength (nm)"=w10, "Total Light Power Density (W/m^2)"=w5) -> (instance out=w2)
      case (w7) {
        frame True {
          w15 = """There has been some sort of problem with the calibration file
please reset the software. If the error persists contact Martí.
Error message: Error on the SRM Rainbow Sweep. Dividing 
wavelength not close enough to calibration div Wav."""
          Two Button Dialog(F button name ("Cancel")="Okay Do not ask\nme again please.", T button name ("OK")="Okay I'll do that.", message=w15) -> (T Button?=w16)
          call "FGV Cancel Prompts until Finished Routine.gvi"(Error In=w8, FGV Instructions="Set State", Prompt? In=w16) -> (Error Out=w1)
        }
        frame False {
          w1 = w8
        }
      }
    }
  }
  $"IV Single Measurement Out" <- w2
  $"Error Out" <- w1
