vi "SRM Sweep Live Parameters Extractor.gvi"   [LabVIEW NXG 5.0.0]
inputs:
  "Error In": error
  "SRM sweep live parameters Previous State": "SRM Sweep Live Parameters FGV Cluster.gtype"
  "SRM sweep live parameters New State": "SRM Sweep Live Parameters FGV Cluster.gtype"
outputs:
  "Error Out": error
  "SRM sweep live parameters Out": "SRM Sweep Live Parameters FGV Cluster.gtype"
types:
  "IV Single Measurement.gtype" = cluster{"Voltage": f64[], "Current": f64[], "Current Density": f64[], "Dividing Wavelength": f64, "Light Power": f64}
  "SRM Single Plot Cluster.gtype" = cluster{"Voltage": f64[], "Current Density": f64[]}
  "Rainbow Sweep Types.gtype" = enum{"Red Sweep Closing", "Red Sweep Opening", "Blue Sweep Closing", "Blue Sweep Opening"}
  "SRM Sweep Live Parameters.gtype" = cluster{"Current Wavelength (nm)": f64, "Rainbow Sweep Types": "Rainbow Sweep Types.gtype", "Finished Measurement?": bool}
  "IV Full Raw Data.gtype" = cluster{"Rainbow Sweep Types": "Rainbow Sweep Types.gtype", "IV Raw Data Array": "IV Single Measurement.gtype"[]}
  "SRM Sweep Live Parameters FGV Cluster.gtype" = cluster{"IV Single Measurement Array": "IV Single Measurement.gtype"[], "SRM Sweep type combo box selction": string, "IV Single Measurement Plot Array": "SRM Single Plot Cluster.gtype"[], "SRM Live Parameters": "SRM Sweep Live Parameters.gtype", "Counter": i32, "Full IV Data Array": "IV Full Raw Data.gtype"[], "Combobox Reference": "ComboBoxSelector reference", "Refresh now": bool, "Graph Reference": "Graph reference"}
uses:
  Rainbow Measurement Setup::Main Functions::Rainbow Measurement::Cell Single Rainbow Measurement::Plotting::SRM Raw Data Graph Adapter.gvi
diagram:
  # This SubVI Checks if the input cluster has some empty values and for each empty value it keeps the value it had before.
  # Otherwise it changes to the new value
  case ($"Error In") {
    frame Error, Default {
      w1 = $"Error In"
      w2 = $"SRM sweep live parameters Previous State"
    }
    frame No Error {
      Property Node(instance in=$"SRM sweep live parameters Previous State") -> ("Full IV Data Array"=w3, "IV Single Measurement Array"=w4, "SRM Live Parameters"=w5, "Combobox Reference"=w6, "Graph Reference"=w7, "IV Single Measurement Plot Array"=w8, instance out=w9)
      Property Node(instance in=$"SRM sweep live parameters New State") -> ("Full IV Data Array"=w10, "IV Single Measurement Array"=w11, "SRM Live Parameters"=w12, "Combobox Reference"=w13, "Graph Reference"=w14, "Refresh now"=w15)
      Is Empty Array(array=w10) -> w16
      Select(s=w16, t=w3, f=w10) -> w17
      Is Empty Array(array=w11) -> w18
      Select(s=w18, t=w4, f=w11) -> w19
      Is Not A Number Or Path Or Refnum(number=w13) -> w20
      Select(s=w20, t=w6, f=w13) -> w21
      Is Not A Number Or Path Or Refnum(number=w14) -> w22
      Select(s=w22, t=w7, f=w14) -> w23
      Property Node(instance in=w12) -> ("Current Wavelength (nm)"=w24)
      Is Equal To 0(x=w24) -> w25
      Select(s=w25, t=w5, f=w12) -> w26
      call "SRM Raw Data Graph Adapter.gvi"(IV Raw Data Array=w19, Error In=$"Error In") -> (IV Plot Out=w27, Error Out=w28)
      case (w15) {
        frame False, Default {
          w1 = w28
          w29 = w15
        }
        frame True {
          for {
            w30 = each element of w17
            Property Node(instance in=w30) -> ("Rainbow Sweep Types"=w31)
            Format Into String(w31) -> w32
          }
          Property Node(instance in=w21, "Value"=w32, error in=w28) -> (error out=w1)
          w29 = w15
        }
      }
      Is Empty Array(array=w27) -> w33
      Select(s=w33, t=w8, f=w27) -> w34
      Property Node(instance in=w9, "Full IV Data Array"=w17, "IV Single Measurement Array"=w19, "IV Single Measurement Plot Array"=w34, "SRM Live Parameters"=w26, "Combobox Reference"=w21, "Graph Reference"=w23, "Refresh now"=w29) -> (instance out=w2)
    }
  }
  $"Error Out" <- w1
  $"SRM sweep live parameters Out" <- w2
