vi "SRM Sweep Live Parameters FGV.gvi"   [LabVIEW NXG 5.0.0]
inputs:
  "Error In": error
  "FGV Instructions": "General FGV Instructions.gtype" = "Read State", required
  "SRM sweep live parameters FGV Cluster In": "SRM Sweep Live Parameters FGV Cluster.gtype"
outputs:
  "Error Out": error
  "IV Plot Out": "SRM Single Plot Cluster.gtype"[]
  "SRM Live Parameters": "SRM Sweep Live Parameters.gtype"
types:
  "General FGV Instructions.gtype" = enum{"Read State", "Set State", "Reset State"}
  "SRM Single Plot Cluster.gtype" = cluster{"Voltage (V)": f64[], "Current Density (A/m^2)": f64[]}
  "IV Single Measurement.gtype" = cluster{"Voltage (V)": f64[], "Current (A)": f64[], "Current Density (A/m^2)": f64[], "Dividing Wavelength (nm)": f64, "Light Power Density (W/m^2)": f64, "Total Light Power Density (W/m^2)": f64}
  "Rainbow Sweep Types.gtype" = enum{"Red Sweep Closing", "Red Sweep Opening", "Blue Sweep Closing", "Blue Sweep Opening"}
  "SRM Sweep Live Parameters.gtype" = cluster{"Current Wavelength (nm)": f64, "Rainbow Sweep Types": "Rainbow Sweep Types.gtype", "Finished Measurement?": bool}
  "IV Full Raw Data.gtype" = cluster{"Rainbow Sweep Types": "Rainbow Sweep Types.gtype", "IV Raw Data Array": "IV Single Measurement.gtype"[]}
  "SRM Sweep Live Parameters FGV Cluster.gtype" = cluster{"IV Single Measurement Array": "IV Single Measurement.gtype"[], "SRM Sweep type combo box selction": string, "IV Single Measurement Plot Array": "SRM Single Plot Cluster.gtype"[], "SRM Live Parameters": "SRM Sweep Live Parameters.gtype", "Counter": i32, "Full IV Data Array": "IV Full Raw Data.gtype"[], "Combobox Reference": "ComboBoxSelector reference", "Refresh now": bool, "Graph Reference": "Graph reference"}
uses:
  Rainbow Measurement Setup::Main Functions::Rainbow Measurement::Cell Single Rainbow Measurement::SRM Live Parameters::SRM Sweep Live Parameters Extractor.gvi
  Rainbow Measurement Setup::Main Functions::Rainbow Measurement::Cell Single Rainbow Measurement::Plotting::SRM FGV Read Handler.gvi
diagram:
  # This FGV Stores the SRM live parameters and the plots so that
  # they can be updated live while being measured. It also sets the name
  # of the plots so that you know which color corresponds to each dividing wavelength
  case ($"Error In") {
    frame Error, Default {
      w1 = $"Error In"
    }
    frame No Error {
      s1 = $"Error In"  # shift register
      s2 = uninitialised  # shift register
      while {
        case ($"FGV Instructions") {
          frame "Read State", Default {
            call "SRM Sweep Live Parameters Extractor.gvi"(SRM sweep live parameters Previous State=s2, SRM sweep live parameters New State=$"SRM sweep live parameters FGV Cluster In", Error In=s1) -> (SRM sweep live parameters Out=w4, Error Out=w5)
            call "SRM FGV Read Handler.gvi"(SRM sweep live parameters FGV Cluster In=w4, Error In=w5) -> (SRM sweep live parameters FGV Cluster Out=w6, Error Out=w2)
            Property Node(instance in=w6) -> ("IV Single Measurement Plot Array"=w7, "SRM Live Parameters"=w8, instance out=w3)
            $"IV Plot Out" <- w7
            $"SRM Live Parameters" <- w8
          }
          frame "Set State" {
            call "SRM Sweep Live Parameters Extractor.gvi"(SRM sweep live parameters Previous State=s2, SRM sweep live parameters New State=$"SRM sweep live parameters FGV Cluster In", Error In=s1) -> (SRM sweep live parameters Out=w3, Error Out=w2)
          }
          frame "Reset State" {
            w2 = s1
            w3 = default
          }
        }
        next s1 = w2
        next s2 = w3
        stop if TRUE
      }
      w1 = s1
    }
  }
  $"Error Out" <- w1
