vi "SRM Rainbow Sweep.gvi"   [LabVIEW NXG 5.0.0]
inputs:
  "Error In": error
  "Instrument Control Mega Cluster In": "Instrument Control Mega Cluster.gtype"
  "LPC Mega Cluster In": "LPC Mega Cluster.gtype"
  "SRM Mega Cluster In": "SRM Mega Cluster.gtype"
outputs:
  "Error Out": error
  "Instrument Control Mega Cluster Out": "Instrument Control Mega Cluster.gtype"
  "SRM Mega Cluster Out": "SRM Mega Cluster.gtype"
types:
  "Instrument Coms Info.gtype" = cluster{"Arduino Coms Info": "Arduino Detection cluster control.gtype", "Photodetector Names": string[], "Keythley Address": "VISA Instr", "Photodetector Detected?": bool, "Thorlabs Motors Detected?": bool, "Keithley Detected?": bool, "Thorlabs Motors Serial Number": "Thorlabs Motors Serial Number In.gtype", "Photodetector IVI session": "Ivi IviDefault", "Flame ID": string, "Flame Detected?": bool, "Flame Wrapper ID": u64}
  "Debugging Cluster.gtype" = cluster{"Debugging mode?": bool, "Initialize App": bool, "Insturment Debugging": "Insturment Debugging Cluster.gtype"}
  "Instrument Control Mega Cluster.gtype" = cluster{"Instruments Coms Info": "Instrument Coms Info.gtype", "Debugging Cluster": "Debugging Cluster.gtype"}
  "Raibow Sweep Selector.gtype" = enum{"Red Sweep", "Blue Sweep", "Full Sweep Red First", "Full Sweep Blue First"}
  "Rainbow Sweep Param Selector.gtype" = cluster{"Raibow Sweep Selector": "Raibow Sweep Selector.gtype", "Max Wavelength (nm)": f64, "Min Wavelength (nm)": f64, "Wavelength Step (nm)": f64, "Rainbow Sweep Type Selector": "Rainbow Sweep Type Selector.gtype"}
  "Light power Calibration Parameters.gtype" = cluster{"Powermeter Averages": u32, "Photodtctr Area (m^2)": f64, "Only Full Spectrum": bool}
  T1 = cluster{"Dividing Wavelength Array": f64[], "Measured Power Array": f64[], "Power Density Array": f64[]}
  "Rainbow Sweep Types.gtype" = enum{"Red Sweep Closing", "Red Sweep Opening", "Blue Sweep Closing", "Blue Sweep Opening"}
  "Light Power Calibration Data.gtype" = cluster{"Single Light Calibration": T1, "Rainbow Sweep Types": "Rainbow Sweep Types.gtype", "Total Light Power Density (W/m^2)": f64}
  "LPC Mega Cluster.gtype" = cluster{"Rainbow Sweep Parameters LPC": "Rainbow Sweep Param Selector.gtype", "LPC Specific Parameters": "Light power Calibration Parameters.gtype", "Light Power Calibration Data": "Light Power Calibration Data.gtype"[]}
  "SRM Specific Parameters.gtype" = cluster{"Max (V)": f64, "Min (V)": f64, "V Points": u32, "Current Range (A)": f64, "Autorange": bool, "Sweep Dir": bool, "Current Averages": u32, "Max (A)": f64, "Integration Time": f64, "Cell Area (m^2)": f64, "Full Spctr Ref": bool}
  "IV Full Data Cluster.gtype" = cluster{"IV Measurements Array": "IV Single Measurement.gtype"[], "Rainbow Sweep Types": "Rainbow Sweep Types.gtype", "IV Refined Data": "IV Refined Full Sweep Data.gtype", "Total Light Power Density (W/m^2)": f64}
  "IV Full Raw Data.gtype" = cluster{"Rainbow Sweep Types": "Rainbow Sweep Types.gtype", "IV Raw Data Array": "IV Single Measurement.gtype"[]}
  "SRM Mega Cluster.gtype" = cluster{"SRM Specific Parameters": "SRM Specific Parameters.gtype", "Rainbow Sweep Parameters SRM": "Rainbow Sweep Param Selector.gtype", "SRM Full IV data Array": "IV Full Data Cluster.gtype"[], "Full IV Curve Raw Data": "IV Full Raw Data.gtype"[]}
  "IV Single Measurement.gtype" = cluster{"Voltage (V)": f64[], "Current (A)": f64[], "Current Density (A/m^2)": f64[], "Dividing Wavelength (nm)": f64, "Light Power Density (W/m^2)": f64, "Total Light Power Density (W/m^2)": f64}
  "SRM Sweep Live Parameters.gtype" = cluster{"Current Wavelength (nm)": f64, "Rainbow Sweep Types": "Rainbow Sweep Types.gtype", "Finished Measurement?": bool}
  "SRM Single Plot Cluster.gtype" = cluster{"Voltage (V)": f64[], "Current Density (A/m^2)": f64[]}
  "SRM Sweep Live Parameters FGV Cluster.gtype" = cluster{"IV Single Measurement Array": "IV Single Measurement.gtype"[], "SRM Sweep type combo box selction": string, "IV Single Measurement Plot Array": "SRM Single Plot Cluster.gtype"[], "SRM Live Parameters": "SRM Sweep Live Parameters.gtype", "Counter": i32, "Full IV Data Array": "IV Full Raw Data.gtype"[], "Combobox Reference": "ComboBoxSelector reference", "Refresh now": bool, "Graph Reference": "Graph reference"}
uses:
  Rainbow Measurement Setup::Side Functions::Messages And Prompts::FGV Cancel Prompts until Finished Routine.gvi
  Rainbow Measurement Setup::Side Functions::Rainbow Sweep::Rainbow Sweep Param Generator.gvi
  Rainbow Measurement Setup::Side Functions::Instrument Control::Keithley::Keithley Set Constant Parameters.gvi
  Rainbow Measurement Setup::Side Functions::Instrument Control::Thorlabs Motors::Dividing Wavelength Control::Dividing Wavelength Calibration Data FGV.gvi
  Rainbow Measurement Setup::Main Functions::Rainbow Measurement::Cell Single Rainbow Measurement::SRM Extract Correct Calibration Data.gvi
  Rainbow Measurement Setup::Side Functions::Global Abort::FGV Global Abort.gvi
  Rainbow Measurement Setup::Side Functions::Instrument Control::Thorlabs Motors::Dividing Wavelength Control::KCube Dividing Wavelength Translator.gvi
  Rainbow Measurement Setup::Main Functions::Rainbow Measurement::Cell Single Rainbow Measurement::SRM Extract Measured Power.gvi
  Rainbow Measurement Setup::Side Functions::Instrument Control::Keithley::Keithley Sweep Subroutine.gvi
  Rainbow Measurement Setup::Main Functions::Rainbow Measurement::Cell Single Rainbow Measurement::IV Calculations::IV to IJV Data.gvi
  Rainbow Measurement Setup::Main Functions::Rainbow Measurement::Cell Single Rainbow Measurement::SRM Live Parameters::SRM Sweep Live Parameters FGV.gvi
  Rainbow Measurement Setup::Side Functions::Utilities::Progress Handling::Progress General Calculator.gvi
  Rainbow Measurement Setup::Side Functions::Utilities::Progress Handling::Progress FGV.gvi
  Rainbow Measurement Setup::Side Functions::Instrument Control::Thorlabs Motors::Movement::KCube Move to 0 or Home.gvi
diagram:
  # This SubVI Takes the specified Parameters both for the sweep types and for the keithley electrical sweep and performs all the measurements while storing them on their
  # corresponding clusters, before outputing all the information within the Full IV Curve Data array.
  case ($"Error In") {
    frame Error, Default {
      w1 = $"Error In"
      w2 = $"Instrument Control Mega Cluster In"
      w3 = $"SRM Mega Cluster In"
    }
    frame No Error {
      Property Node(instance in=$"SRM Mega Cluster In") -> ("Rainbow Sweep Parameters SRM"=w4, instance out=w5)
      call "FGV Cancel Prompts until Finished Routine.gvi"(Error In=$"Error In", FGV Instructions="Reset State") -> (Error Out=w6)
      call "Rainbow Sweep Param Generator.gvi"(Rainbow Sweep Parameters=w4, Error In=w6) -> (Rainbow Sweep Parameters Array=w7, Error Out=w8)
      call "Keithley Set Constant Parameters.gvi"(Instrument Control Mega Cluster In=$"Instrument Control Mega Cluster In", SRM Mega Cluster In=w5, Error In=w8) -> (Instrument Control Mega Cluster Out=w9, SRM Mega Cluster Out=w10, Error Out=w11)
      call "Dividing Wavelength Calibration Data FGV.gvi"(Div Wavelength FGV Instructions="Read Loaded Data", Error In=w11) -> (Dividing Wavelength Calibration Data Out=w12, Error Out=w13)
      s1 = w13  # shift register
      s2 = w9  # shift register
      s3 = "IV Full Raw Data.gtype"[] []  # shift register
      s4 = 0  # shift register
      s5 = w10  # shift register
      for (N -> w14) (iteration -> i1) {
        w15 = each element of w7
        Property Node(instance in=w15) -> ("Dividing Wavelength Array"=w16, "Rainbow Sweep Types"=w17)
        call "SRM Extract Correct Calibration Data.gvi"(LPC Mega Cluster In=$"LPC Mega Cluster In", Rainbow Sweep Type=w17, Error In=s1) -> (Extracted Light Power Calibration Data=w18, Error Out=w19)
        s6 = w19  # shift register
        s7 = s2  # shift register
        s8 = "IV Single Measurement.gtype"[] []  # shift register
        s9 = s4  # shift register
        s10 = s5  # shift register
        for (N -> w20) (iteration -> i2) {
          w21 = each element of w16
          Multiply(w20, w14) -> w22
          call "FGV Global Abort.gvi"(Global Abort Instructions="Read Current State", Error In=s6) -> (Local Abort Out=w23, Global Abort Out=w24, Error Out=w25)
          call "KCube Dividing Wavelength Translator.gvi"(Dividing Wavelength=w21, Instrument Control Mega Cluster In=s7, Dividing Wavelength Calibration Data In=w12, Error In=w25, Rainbow Sweep Types=w17) -> (Instrument Control Mega Cluster Out=w26, Error Out=w27)
          call "SRM Extract Measured Power.gvi"(Dividing Wavelength In=w21, Light Power Calibration Data In=w18, SRM Mega Cluster In=s10, Error In=w27) -> (IV Single Measurement Out=w28, Error Out=w29)
          call "Keithley Sweep Subroutine.gvi"(Instrument Control Mega Cluster In=w26, SRM Mega Cluster In=s10, IV Single Measurement In=w28, Error In=w29) -> (Instrument Control Mega Cluster Out=w30, SRM Mega Cluster Out=w31, IV Single Measurement Out=w32, Error Out=w33)
          call "IV to IJV Data.gvi"(SRM Mega Cluster In=w31, IV Single Measurement In=w32, Error In=w33) -> (SRM Mega Cluster Out=w34, IV Single Measurement Out=w35, Error Out=w36)
          w37 = "SRM Sweep Live Parameters.gtype" {"Current Wavelength (nm)"=0, "Rainbow Sweep Types"="Red Sweep Closing", "Finished Measurement?"=TRUE}
          Property Node(instance in=w37, "Current Wavelength (nm)"=w21, "Rainbow Sweep Types"=w17, "Finished Measurement?"=FALSE) -> (instance out=w38)
          Insert Into Array(inArray=s8, index0=i2, new=w35) -> w39
          w40 = "SRM Sweep Live Parameters FGV Cluster.gtype" {all zero or empty}
          Property Node(instance in=w40, "IV Single Measurement Array"=w39, "SRM Live Parameters"=w38) -> (instance out=w41)
          call "SRM Sweep Live Parameters FGV.gvi"(FGV Instructions="Set State", SRM sweep live parameters FGV Cluster In=w41, Error In=w36) -> (Error Out=w42)
          call "Progress General Calculator.gvi"(Starting Value=40, Ending Value=80, Number Of Steps=w22, Current Step=s9, Error In=w42) -> (Current Progress=w43, Error Out=w44)
          call "Progress FGV.gvi"(FGV Instructions="Set State", Progress In=w43, Error In=w44) -> (Error Out=w45)
          Increment(x=s9) -> w46
          Logical Or(w23, w24) -> w47
          Wait Until Next Multiple(multiple to wait=10)
          next s6 = w45
          next s7 = w30
          next s8 = w39
          next s9 = w46
          next s10 = w34
          stop if w47
        }
        Property Node(instance in="IV Full Raw Data.gtype" {all zero or empty}, "IV Raw Data Array"=s8, "Rainbow Sweep Types"=w17) -> (instance out=w48)
        Insert Into Array(inArray=s3, index0=i1, new=w48) -> w49
        w50 = "SRM Sweep Live Parameters FGV Cluster.gtype" {all zero or empty}
        Property Node(instance in=w50, "Full IV Data Array"=w49, "Refresh now"=TRUE) -> (instance out=w51)
        call "SRM Sweep Live Parameters FGV.gvi"(FGV Instructions="Set State", SRM sweep live parameters FGV Cluster In=w51, Error In=s6) -> (Error Out=w52)
        call "KCube Move to 0 or Home.gvi"(Instrument Control Mega Cluster In=s7, Error In=w52) -> (Instrument Control Mega Cluster Out=w53, Error Out=w54)
        next s1 = w54
        next s2 = w53
        next s3 = w49
        next s4 = s9
        next s5 = s10
        stop if w47
      }
      Property Node(instance in=s5, "Full IV Curve Raw Data"=s3) -> (instance out=w3)
      w55 = "SRM Sweep Live Parameters FGV Cluster.gtype" {"SRM Live Parameters"={"Current Wavelength (nm)"=-1, "Rainbow Sweep Types"="Red Sweep Closing", "Finished Measurement?"=TRUE}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}
      call "SRM Sweep Live Parameters FGV.gvi"(FGV Instructions="Set State", SRM sweep live parameters FGV Cluster In=w55, Error In=s1) -> (Error Out=w56)
      call "KCube Move to 0 or Home.gvi"(Instrument Control Mega Cluster In=s2, Error In=w56) -> (Instrument Control Mega Cluster Out=w2, Error Out=w1)
    }
  }
  $"SRM Mega Cluster Out" <- w3
  $"Instrument Control Mega Cluster Out" <- w2
  $"Error Out" <- w1
