vi "Single Rainbow Measurement Subroutine.gvi"   [LabVIEW NXG 5.0.0]
inputs:
  "Error In": error
  "Instruction Queue In": Queue<"Queue Instructions Control.gtype">
  "Instrument Control Mega Cluster In": "Instrument Control Mega Cluster.gtype"
  "LPC Mega Cluster In": "LPC Mega Cluster.gtype"
  "Stand Alone?": bool
  "Misc Data Mega Cluster In": "Misc Data Mega Cluster.gtype"
  "SRM Operation Control": "S_MRM Operation Control.gtype" = "New Measurement"
  "SRM Mega Cluster In": "SRM Mega Cluster.gtype"
outputs:
  "Error Out": error
  "Instrument Control Mega Cluster Out": "Instrument Control Mega Cluster.gtype"
  "Misc Data Mega Cluster Out": "Misc Data Mega Cluster.gtype"
  "Instruction Queue Out": Queue<"Queue Instructions Control.gtype">
  "LPC Mega Cluster Out": "LPC Mega Cluster.gtype"
  "SRM Mega Cluster Out": "SRM Mega Cluster.gtype"
types:
  "Queue Instructions Control.gtype" = enum{"Undefined State", "Debug Check", "Initialize App", "Idle", "Light Power Calibration", "Rainbow Single Measurement", "Rainbow Multiple Measurement", "Light Calibration Irradiance", "Light Calibration Spectral Density", "Light Calibration Power Density", "Stand Alone Photodetector Measurement", "MSpot Spectrum Calibration", "Move XZ Stage", "Mask Calibration", "Change Cell", "Update All Info Meta Cluster", "Access TXT File", "Stop App", "State 2 ", "State 3 ", "State 4"}
  "S_MRM Operation Control.gtype" = enum{"New Measurement", "Load Measurement", "Save Measurement"}
  T1 = cluster{"SRM Light Power Density Ref": "NumericTextBoxDouble reference", "Rainbow Sweep Parameters RSM": "Cluster reference", "SRM Refined Plot Rainbow Sweep Types": "ComboBoxSelector reference", "Sweep Live Parameters RSM": "Cluster reference", "SRM Raw Plot Rainbow Sweep Selector": "ComboBoxSelector reference", "SRM Plot Parameter Selector Ref": "EnumSelector reference", "IV Plot Out Ref": "Graph reference", "SRM Specific Parameters": "Cluster reference"}
  T2 = cluster{"Calibration Files Path": "PathSelector reference", "Default Data Saving Location": "PathSelector reference"}
  T3 = cluster{"Main Tab": "TabControl reference", "Rainbow Measurement tab": "TabControl reference", "Configuration tab": "TabControl reference", "Light Calibration tab": "TabControl reference"}
  T4 = cluster{"Custom date": "CheckBox reference", "Batch Name": "StringControl reference", "Author Initials": "ComboBoxSelector reference", "Cell Number": "StringControl reference", "Current Date": "StringControl reference", "Sample Comments": "StringControl reference", "Sample Prefix": "StringControl reference", "Label Info Missing Error": "BooleanControl reference", "Label Info Error Label": "StringControl reference"}
  T5 = cluster{"Beam Power Density": "IntensityGraph reference"[][], "Irradiance Calibration": "Graph reference"[], "MSpot Spectrum Calibration Parameters": "Cluster reference", "Rainbow Sweep Param Selector MSpot": "Cluster reference"}
  T6 = cluster{"LPC Parameters Ref": "Cluster reference", "Sweep Live Parameters LPC ref": "Cluster reference", "Light Power Calibration": "Graph reference", "Light Power Calibration Data Ref": "ArrayViewer reference", "Rainbow Sweep Parameters LPC": "Cluster reference"}
  T7 = cluster{"Current State Ref": "EnumSelector reference", "Substate": "StringControl reference", "State": "StringControl reference", "Current Substate": "StringControl reference"}
  T8 = cluster{"Custom Position": "BooleanControl reference", "Set Position": "BooleanControl reference", "XZ Stage Active": "BooleanControl reference", "Release XZ Stage": "BooleanControl reference", "XZ Coordinates": "Cluster reference", "Activate XZ Stage": "BooleanControl reference", "XZ Stage Cell Reference": "EnumSelector reference", "XZ All Position Cluster Ref": "Cluster reference"}
  T9 = cluster{"IV Extracted Parameter Plot ": "Graph reference", "MRM Cell Selector Ref": "Cluster reference", "IV Plot Out Multiple Reference": "Graph reference", "Rainbow Sweep Parameters MRM Ref": "Cluster reference", "MRM Cell Refined Plot Selector ref": "ComboBoxSelector reference", "MRM Current Raw Cell Plot": "ComboBoxSelector reference", "MRM Raw Plot Rainbow Sweep Relector Ref": "ComboBoxSelector reference", "MRM Specific Parameters Ref": "Cluster reference"}
  "Full Reference Cluster.gtype" = cluster{"SRM Reference Cluster": T1, "Path Reference Cluster": T2, "Tab Reference Cluster": T3, "Cell Naming Parameters Ref Cluster": T4, "One Time Calibrations Ref Cluster": T5, "LPC Controls Reference Cluster": T6, "System Parameters Ref Cluster": T7, "XZ Stage Controls Reference Cluster": T8, "MRM Reference Cluster": T9}
  T10 = cluster{"X Coordinate (mm)": f64, "Z Coordinate (mm)": f64, "Aprch Distance (mm)": f64}
  T11 = cluster{"X Coordinate (mm)": f64, "Z Coordinate (mm)": f64, "Vertical Spacing (mm)": f64, "Aprch Distance (mm)": f64, "Aprch Dstnc L.12 (mm)": f64}
  "XZ All Position Cluster.gtype" = cluster{"Diffusor Coordinates": T10, "Photodetector Coordinates": T10, "Cell R.01 Coordinates": T11}
  T12 = cluster{"Thorlabs Motor Serial Number File Path": path, "Default Data Saving Location": path}
  "Cell Naming Cluster.gtype" = cluster{"Cell Label": string, "Sample Prefix": string, "Author Initials": string, "Current Date": string, "Batch Name": string}
  "Misc Data Mega Cluster.gtype" = cluster{"Full Reference Cluster": "Full Reference Cluster.gtype", "All XZ Position Cluster": "XZ All Position Cluster.gtype", "All Paths": T12, "Cell Naming Cluster": "Cell Naming Cluster.gtype"}
  "Instrument Coms Info.gtype" = cluster{"Arduino Coms Info": "Arduino Detection cluster control.gtype", "Photodetector Names": string[], "Keythley Address": "VISA Instr", "Photodetector Detected?": bool, "Thorlabs Motors Detected?": bool, "Keithley Detected?": bool, "Thorlabs Motors Serial Number": "Thorlabs Motors Serial Number In.gtype", "Photodetector IVI session": "Ivi IviDefault", "Flame ID": string, "Flame Detected?": bool, "Flame Wrapper ID": u64}
  "Debugging Cluster.gtype" = cluster{"Debugging mode?": bool, "Initialize App": bool, "Insturment Debugging": "Insturment Debugging Cluster.gtype"}
  "Instrument Control Mega Cluster.gtype" = cluster{"Instruments Coms Info": "Instrument Coms Info.gtype", "Debugging Cluster": "Debugging Cluster.gtype"}
  "Raibow Sweep Selector.gtype" = enum{"Red Sweep", "Blue Sweep", "Full Sweep Red First", "Full Sweep Blue First"}
  "Rainbow Sweep Param Selector.gtype" = cluster{"Raibow Sweep Selector": "Raibow Sweep Selector.gtype", "Max Wavelength (nm)": f64, "Min Wavelength (nm)": f64, "Wavelength Step (nm)": f64, "Rainbow Sweep Type Selector": "Rainbow Sweep Type Selector.gtype"}
  "Light power Calibration Parameters.gtype" = cluster{"Powermeter Averages": u32, "Photodtctr Area (m^2)": f64, "Only Full Spectrum": bool}
  T13 = cluster{"Dividing Wavelength Array": f64[], "Measured Power Array": f64[], "Power Density Array": f64[]}
  "Rainbow Sweep Types.gtype" = enum{"Red Sweep Closing", "Red Sweep Opening", "Blue Sweep Closing", "Blue Sweep Opening"}
  "Light Power Calibration Data.gtype" = cluster{"Single Light Calibration": T13, "Rainbow Sweep Types": "Rainbow Sweep Types.gtype", "Total Light Power Density (W/m^2)": f64}
  "LPC Mega Cluster.gtype" = cluster{"Rainbow Sweep Parameters LPC": "Rainbow Sweep Param Selector.gtype", "LPC Specific Parameters": "Light power Calibration Parameters.gtype", "Light Power Calibration Data": "Light Power Calibration Data.gtype"[]}
  "Sweep Speed Selector.gtype" = enum{"Smart Sweep", "Fast Sweep", "Normal Sweep"}
  "SRM Specific Parameters.gtype" = cluster{"Max (V)": f64, "Min (V)": f64, "V Points": u32, "Current Range (A)": f64, "Autorange": bool, "Sweep Dir": bool, "Current Averages": u32, "Max (A)": f64, "PLC Speed": f64, "Cell Area (m^2)": f64, "Full Spctr Ref": bool, "Sweep Speed": "Sweep Speed Selector.gtype"}
  "IV Full Data Cluster.gtype" = cluster{"IV Measurements Array": "IV Single Measurement.gtype"[], "Rainbow Sweep Types": "Rainbow Sweep Types.gtype", "IV Refined Data": "IV Refined Full Sweep Data.gtype", "Total Light Power Density (W/m^2)": f64}
  "IV Full Raw Data.gtype" = cluster{"Rainbow Sweep Types": "Rainbow Sweep Types.gtype", "IV Raw Data Array": "IV Single Measurement.gtype"[]}
  "SRM Mega Cluster.gtype" = cluster{"SRM Specific Parameters": "SRM Specific Parameters.gtype", "Rainbow Sweep Parameters SRM": "Rainbow Sweep Param Selector.gtype", "SRM Full IV data Array": "IV Full Data Cluster.gtype"[], "Full IV Curve Raw Data": "IV Full Raw Data.gtype"[]}
  "XZ Coordinate Cluster In.gtype" = cluster{"X Coordinate (mm)": f64, "Z Coordinate (mm)": f64}
uses:
  Rainbow Measurement Setup::Main Functions::Rainbow Measurement::Cell Single Rainbow Measurement::SRM Operation FGV.gvi
  Rainbow Measurement Setup::Main Functions::Instruction Queue::Current State::FGV Current State.gvi
  Rainbow Measurement Setup::Side Functions::Global Abort::FGV Global Abort.gvi
  Rainbow Measurement Setup::Main Functions::Rainbow Measurement::Cell Single Rainbow Measurement::S_MRM Start Calculator.gvi
  Rainbow Measurement Setup::Main Functions::Rainbow Measurement::Cell Single Rainbow Measurement::LPC Check::SRM Check Light Power Data.gvi
  Rainbow Measurement Setup::Side Functions::Instrument Control::Thorlabs Motors::Dividing Wavelength Control::Dividing Wavelength Calibration Data FGV.gvi
  Rainbow Measurement Setup::Side Functions::Instrument Control::Debug Cluster Instrument Extractor.gvi
  Rainbow Measurement Setup::Main Functions::One Time Calibrations::Beam Power Density::Specific Detect Instruments Subroutine.gvi
  Rainbow Measurement Setup::Side Functions::Instrument Control::Thorlabs Motors::Movement::KCube Move to 0 or Home.gvi
  Rainbow Measurement Setup::Side Functions::Instrument Control::Arduino::XZ Stage Arduino::XZ Stage Initialize And Home.gvi
  Rainbow Measurement Setup::Side Functions::Provisional Cell Selection FGV.gvi
  Rainbow Measurement Setup::Side Functions::Instrument Control::Arduino::XZ Stage Arduino::XZ Stage Label to Coordinates.gvi
  Rainbow Measurement Setup::Side Functions::Instrument Control::Arduino::XZ Stage Arduino::XZ Stage Move to Position.gvi
  Rainbow Measurement Setup::Side Functions::Instrument Control::Keithley::Keithley Initialize Subroutine.gvi
  Rainbow Measurement Setup::Main Functions::Rainbow Measurement::Cell Single Rainbow Measurement::SRM Rainbow Sweep.gvi
  Rainbow Measurement Setup::Side Functions::Instrument Control::Thorlabs Motors::Movement::KCube Motors Close.gvi
  Rainbow Measurement Setup::Side Functions::Instrument Control::Arduino::XZ Stage Arduino::XZ Stage Close Coms.gvi
  Rainbow Measurement Setup::Side Functions::Instrument Control::Keithley::Keithley Close Subroutine.gvi
  Rainbow Measurement Setup::Main Functions::Rainbow Measurement::Cell Single Rainbow Measurement::IV Calculations::SRM IV Parameters Calculator.gvi
  Rainbow Measurement Setup::Main Functions::Rainbow Measurement::Cell Single Rainbow Measurement::SRM Live Parameters::SRM Sweep Live Parameters FGV.gvi
  Rainbow Measurement Setup::Main Functions::Rainbow Measurement::Cell Single Rainbow Measurement::Plotting::SRM Sweep Refined Data FGV.gvi
  Rainbow Measurement Setup::Main Functions::Rainbow Measurement::Cell Single Rainbow Measurement::File Handling::SRM Save Graphs Prompt.gvi
  Rainbow Measurement Setup::Main Functions::Rainbow Measurement::Cell Single Rainbow Measurement::File Handling::SRM file handling.gvi
  Rainbow Measurement Setup::Main Functions::Rainbow Measurement::Cell Single Rainbow Measurement::File Handling::SRM Load Prompt.gvi
  Rainbow Measurement Setup::Side Functions::Messages And Prompts::General Simple Prompt.gvi
  Rainbow Measurement Setup::Main Functions::Rainbow Measurement::Cell Single Rainbow Measurement::LPC Check::New Light Calibration Enqueue.gvi
  Rainbow Measurement Setup::Main Functions::Rainbow Measurement::Single Multiple Measurement Utilities::FGV Last Measurement Type.gvi
  Rainbow Measurement Setup::Side Functions::Utilities::Progress Handling::Progress FGV.gvi
diagram:
  # This SubVI Measures the Light power for each motor position for each sweep type and outputs the data so that it can be plotted
  # on the main window for checking and for calibration purposes
  case ($"Error In") {
    frame Error, Default {
      w1 = $"Error In"
      w2 = $"Instruction Queue In"
      w3 = $"Instrument Control Mega Cluster In"
      w4 = $"SRM Mega Cluster In"
      w5 = $"Misc Data Mega Cluster In"
      w6 = $"LPC Mega Cluster In"
    }
    frame No Error {
      call "SRM Operation FGV.gvi"(FGV Instructions="Read State", Error In=$"Error In") -> (SRM Operation Control Out=w7, Error Out=w8)
      Select(s=$"Stand Alone?", t=$"SRM Operation Control", f=w7) -> w9
      case (w7) {
        frame "Load Measurement" {
          Property Node(instance in=$"SRM Mega Cluster In", "SRM Full IV data Array"="IV Full Data Cluster.gtype"[] [], "Full IV Curve Raw Data"="IV Full Raw Data.gtype"[] []) -> (instance out=w10)
        }
        frame "Save Measurement" {
          w10 = $"SRM Mega Cluster In"
        }
        frame "New Measurement", Default {
          Property Node(instance in=$"SRM Mega Cluster In", "SRM Full IV data Array"="IV Full Data Cluster.gtype"[] [], "Full IV Curve Raw Data"="IV Full Raw Data.gtype"[] []) -> (instance out=w10)
        }
      }
      call "FGV Current State.gvi"(Current State Instructions="Set Current State and Substate", Current State="Rainbow Single Measurement", Current Substate="", Error In=w8) -> (Error Out=w11)
      s1 = w11  # shift register
      s2 = "Start App"  # shift register
      s2.prev1 = uninitialised  # shift register
      s3 = $"Instruction Queue In"  # shift register
      s4 = $"Instrument Control Mega Cluster In"  # shift register
      s5 = $"Misc Data Mega Cluster In"  # shift register
      s6 = $"LPC Mega Cluster In"  # shift register
      s7 = w10  # shift register
      while {
        call "FGV Global Abort.gvi"(Global Abort Instructions="Read Current State", Error In=s1) -> (Local Abort Out=w12, Global Abort Out=w13, Error Out=w14)
        Is Not Equal(x=s2, y="Stop App") -> w15
        Logical And(w15, w12) -> w16
        Select(s=w16, t="Close Coms", f=s2) -> w17
        case (w17) {
          frame "Start App", Default {
            call "FGV Current State.gvi"(Current State Instructions="Set Current Substate", Current Substate="Starting Light Power Calibration", Error In=w14) -> (Error Out=w18)
            w19 = "Load Light Power Calibration"
            w20 = default
            w21 = s3
            w22 = s7
            w23 = s4
            w24 = s6
            w25 = s5
          }
          frame "Load Light Power Calibration" {
            call "S_MRM Start Calculator.gvi"(Rainbow Measurement Operation Control=w9, Stand Alone?=$"Stand Alone?") -> (Desired State=w26)
            call "SRM Check Light Power Data.gvi"(SRM Mega Cluster In=s7, Misc Data Mega Cluster In=s5, LPC Mega Cluster In=s6, Error In=w14, Input State=w26) -> (SRM Mega Cluster Out=w22, LPC Mega Cluster Out=w24, Next State=w19, Error Out=w18)
            w20 = default
            w21 = s3
            w23 = s4
            w25 = s5
          }
          frame "Detect Instruments" {
            call "FGV Current State.gvi"(Current State Instructions="Set Current Substate", Current Substate="Detecting Instruments", Error In=w14) -> (Error Out=w27)
            call "Dividing Wavelength Calibration Data FGV.gvi"(Div Wavelength FGV Instructions="Load Data", Error In=w27) -> (Error Out=w28)
            call "Debug Cluster Instrument Extractor.gvi"(Instrument Control Mega Cluster In=s4, Error In=w28) -> (Instrument Control Mega Cluster Out=w29, Instruments to Detect=w30, Error Out=w31)
            call "Specific Detect Instruments Subroutine.gvi"(Instrument Control Mega Cluster In=w29, Error In=w31, Instruments To Detect Array=w30, Stand Alone?=$"Stand Alone?") -> (Instrument Control Mega Cluster Out=w23, Error Out=w18)
            w19 = "Initialize Instruments"
            w20 = default
            w21 = s3
            w22 = s7
            w24 = s6
            w25 = s5
          }
          frame "Initialize Instruments" {
            call "FGV Current State.gvi"(Current State Instructions="Set Current Substate", Current Substate="Initializing Instruments", Error In=w14) -> (Error Out=w32)
            call "KCube Move to 0 or Home.gvi"(Instrument Control Mega Cluster In=s4, Error In=w32) -> (Instrument Control Mega Cluster Out=w33, Error Out=w34)
            call "XZ Stage Initialize And Home.gvi"(Instrument Control Mega Cluster In=w33, Error In=w34) -> (Instrument Control Mega Cluster Out=w35, Error Out=w36)
            call "Provisional Cell Selection FGV.gvi"(FGV Instructions="Read State", Error In=w36) -> (Desired Cell String=w37, Error Out=w38)
            call "XZ Stage Label to Coordinates.gvi"(Cell Label=w37, Misc Data Mega Cluster In=s5, Error In=w38) -> (XZ Coordinate Out=w39, Error Out=w40)
            call "XZ Stage Move to Position.gvi"(Instrument Control Mega Cluster In=w35, Error In=w40, XZ Coordinate Cluster In=w39) -> (Instrument Control Mega Cluster Out=w41, Error Out=w42)
            call "Keithley Initialize Subroutine.gvi"(Instrument Control Mega Cluster In=w41, Error In=w42) -> (Instrument Control Mega Cluster Out=w23, Error Out=w18)
            w19 = "Rainbow Sweep"
            w20 = default
            w21 = s3
            w22 = s7
            w24 = s6
            w25 = s5
          }
          frame "Rainbow Sweep" {
            call "FGV Current State.gvi"(Current State Instructions="Set Current Substate", Current Substate="Acquiring Spectra", Error In=w14) -> (Error Out=w43)
            call "SRM Rainbow Sweep.gvi"(Instrument Control Mega Cluster In=s4, SRM Mega Cluster In=s7, LPC Mega Cluster In=s6, Error In=w43) -> (Instrument Control Mega Cluster Out=w23, SRM Mega Cluster Out=w22, Error Out=w18)
            w19 = "Close Coms"
            w20 = default
            w21 = s3
            w24 = s6
            w25 = s5
          }
          frame "Close Coms" {
            Select(s=w12, t="Stop App", f="Process IV Data") -> w19
            call "FGV Current State.gvi"(Current State Instructions="Set Current Substate", Current Substate="Closing Coms", Error In=w14) -> (Error Out=w44)
            call "KCube Motors Close.gvi"(Instrument Control Mega Cluster In=s4, Error In=w44) -> (Instrument Control Mega Cluster Out=w45, Error Out=w46)
            call "XZ Stage Move to Position.gvi"(Instrument Control Mega Cluster In=w45, Error In=w46, XZ Coordinate Cluster In="XZ Coordinate Cluster In.gtype" {all zero or empty}) -> (Instrument Control Mega Cluster Out=w47, Error Out=w48)
            call "XZ Stage Close Coms.gvi"(Instrument Control Mega Cluster In=w47, Error In=w48) -> (Instrument Control Mega Cluster Out=w49, Error Out=w50)
            call "Keithley Close Subroutine.gvi"(Instrument Control Mega Cluster In=w49, Error In=w50) -> (Instrument Control Mega Cluster Out=w23, Error Out=w18)
            w20 = default
            w21 = s3
            w22 = s7
            w24 = s6
            w25 = s5
          }
          frame "Process IV Data" {
            call "SRM IV Parameters Calculator.gvi"(SRM Mega Cluster In=s7, Error In=w14) -> (SRM Mega Cluster Out=w22, SRM sweep live parameters FGV Cluster Out=w51, Error Out=w52)
            call "SRM Sweep Live Parameters FGV.gvi"(FGV Instructions="Read State", SRM sweep live parameters FGV Cluster In=w51, Error In=w52) -> (Error Out=w53)
            call "SRM Sweep Refined Data FGV.gvi"(SRM Mega Cluster In=w22, Error In=w53, FGV Instructions="Set State") -> (Error Out=w54)
            call "SRM Save Graphs Prompt.gvi"(Previous State=s2.prev1, Error In=w54) -> (Desired State=w19, Error Out=w18)
            w20 = default
            w21 = s3
            w23 = s4
            w24 = s6
            w25 = s5
          }
          frame "Load Measurement" {
            call "FGV Current State.gvi"(Current State Instructions="Set Current Substate", Current Substate="Loading Calibration", Error In=w14) -> (Error Out=w55)
            call "SRM file handling.gvi"(SRM Mega Cluster In=s7, Misc Data Mega Cluster In=s5, Error In=w55, Modify File Operation="Load TXT") -> (SRM Mega Cluster Out=w22, Boolean Handler Out=w56, Loaded Files=w57, Error Out=w58)
            call "SRM Load Prompt.gvi"(Boolean Handler In=w56, Loaded Files=w57, Error In=w58) -> (Desired State=w19, Error Out=w18)
            w20 = default
            w21 = s3
            w23 = s4
            w24 = s6
            w25 = s5
          }
          frame "Save Graphs" {
            call "FGV Current State.gvi"(Current State Instructions="Set Current Substate", Current Substate="Saving Graphs", Error In=w14) -> (Error Out=w59)
            call "SRM file handling.gvi"(SRM Mega Cluster In=s7, Misc Data Mega Cluster In=s5, Error In=w59, Modify File Operation="Save TXT") -> (SRM Mega Cluster Out=w22, Error Out=w60)
            w61 = "Your Measurement Files Have been saved\npropperly on your personal data folder."
            call "General Simple Prompt.gvi"(Prompt Message=w61, Okay Button Message="Perfect Thanks :)", Error In=w60, Prompt?=TRUE) -> (Error Out=w18)
            w19 = "Stop App"
            w20 = default
            w21 = s3
            w23 = s4
            w24 = s6
            w25 = s5
          }
          frame "Enqueue Light Calibration" {
            call "New Light Calibration Enqueue.gvi"(Queue In=s3, Misc Data Mega Cluster In=s5, Error In=w14) -> (Queue Out=w21, Error Out=w18)
            w19 = "Stop App"
            w20 = default
            w22 = s7
            w23 = s4
            w24 = s6
            w25 = s5
          }
          frame "Stop App" {
            call "FGV Last Measurement Type.gvi"(FGV Instructions="Set State", Last Measurement Type="Rainbow Single Measurement", Error In=w14) -> (Error Out=w62)
            call "FGV Current State.gvi"(Current State Instructions="Set Current Substate", Current Substate="Stopping Apps", Error In=w62) -> (Error Out=w18)
            w19 = "Start App"
            w20 = TRUE
            w21 = s3
            w22 = s7
            w23 = s4
            w24 = s6
            w25 = s5
          }
        }
        call "Progress FGV.gvi"(FGV Instructions="Set State", Progress In=0, Error In=w18) -> (Error Out=w63)
        Logical Or(w13, w63, w20) -> w64
        next s1 = w63
        next s2 = w19
        next s3 = w21
        next s4 = w23
        next s5 = w25
        next s6 = w24
        next s7 = w22
        stop if w64
      }
      w1 = s1
      w2 = s3
      w3 = s4
      w4 = s7
      w5 = s5
      w6 = s6
    }
  }
  $"Instruction Queue Out" <- w2
  $"Instrument Control Mega Cluster Out" <- w3
  $"Misc Data Mega Cluster Out" <- w5
  $"LPC Mega Cluster Out" <- w6
  $"Error Out" <- w1
  $"SRM Mega Cluster Out" <- w4
