vi "LPC Header Data Extractor.gvi"   [LabVIEW NXG 5.0.0]
inputs:
  "Error In": error
  "Header Data In": string
outputs:
  "Error Out": error
  "Total Light Power": f64
diagram:
  # This SubVI Extracts the total light power from the header of the calibration
  # file and outputs it as a double
  case ($"Error In") {
    frame Error, Default {
      w1 = $"Error In"
      w2 = default
    }
    frame No Error {
      Search And Replace String(error in (no error)=$"Error In", input string=$"Header Data In", replace string ("")="", search string="W/m^2") -> (error out=w3, result string=w4)
      Search And Replace String(error in (no error)=w3, input string=w4, search string="Total Light Power Density = ") -> (error out=w1, offset past replacement=w5)
      String Length(string="Total Light Power Density = ") -> (length=w6)
      Add(w5, w6) -> w7
      String Subset(offset (0)=w7, string=$"Header Data In") -> w8
      Floating Point String To Number(string=w8, use system decimal point (T)=FALSE) -> (number=w2)
    }
  }
  $"Total Light Power" <- w2
  $"Error Out" <- w1
