vi "Light Calibration file handling.gvi"   [LabVIEW NXG 5.0.0]
inputs:
  "Error In": error
  "Modify File Operation": "Modify File Operation.gtype" = "Save TXT"
  "LPC Mega Cluster In": "LPC Mega Cluster.gtype"
  "Misc Data Mega Cluster In": "Misc Data Mega Cluster.gtype"
outputs:
  "Error Out": error
  "LPC Mega Cluster Out": "LPC Mega Cluster.gtype"
  "File Handling Boolean Cluster Out": "File Handling Boolean Cluster.gtype"
  "Loaded Files": string[]
types:
  "Modify File Operation.gtype" = enum{"Save TXT", "Load TXT"}
  "Raibow Sweep Selector.gtype" = enum{"Red Sweep", "Blue Sweep", "Full Sweep Red First", "Full Sweep Blue First"}
  "Rainbow Sweep Param Selector.gtype" = cluster{"Raibow Sweep Selector": "Raibow Sweep Selector.gtype", "Max Wavelength (nm)": f64, "Min Wavelength (nm)": f64, "Wavelength Step (nm)": f64, "Rainbow Sweep Type Selector": "Rainbow Sweep Type Selector.gtype"}
  "Light power Calibration Parameters.gtype" = cluster{"Powermeter Averages": u32, "Photodtctr Area (m^2)": f64, "Only Full Spectrum": bool}
  T1 = cluster{"Dividing Wavelength Array": f64[], "Measured Power Array": f64[], "Power Density Array": f64[]}
  "Rainbow Sweep Types.gtype" = enum{"Red Sweep Closing", "Red Sweep Opening", "Blue Sweep Closing", "Blue Sweep Opening"}
  "Light Power Calibration Data.gtype" = cluster{"Single Light Calibration": T1, "Rainbow Sweep Types": "Rainbow Sweep Types.gtype", "Total Light Power Density (W/m^2)": f64}
  "LPC Mega Cluster.gtype" = cluster{"Rainbow Sweep Parameters LPC": "Rainbow Sweep Param Selector.gtype", "LPC Specific Parameters": "Light power Calibration Parameters.gtype", "Light Power Calibration Data": "Light Power Calibration Data.gtype"[]}
  "Full Reference Cluster.gtype" = cluster{"Enum Reference Cluster": "Enum Control Reference Cluster.gtype", "Boolean Reference Cluster": "Boolean Control Reference Cluster.gtype", "Numeric Reference Cluster": "Numeric Control Reference Cluster.gtype", "Numeric Cluster Reference Cluster": "Numeric Cluster Reference Cluster.gtype", "Path Reference Cluster": "Path Reference Cluster.gtype", "Cluster Reference Cluster": "Cluster Reference Cluster.gtype", "XZ Stage Controls Reference Cluster": "XZ Stage Controls Reference Cluster.gtype"}
  "Cell Naming Cluster.gtype" = cluster{"Cell Label": string, "Sample Prefix": string, "Author Initials": string, "Current Date": string, "Batch Name": string}
  T2 = cluster{"X Coordinate (mm)": f64, "Z Coordinate (mm)": f64}
  T3 = cluster{"X Coordinate (mm)": f64, "Z Coordinate (mm)": f64, "Vertical Spacing (mm)": f64}
  "XZ All Position Cluster.gtype" = cluster{"Diffusor Coordinates": T2, "Photodetector Coordinates": T2, "Cell R.01 Coordinates": T3}
  T4 = cluster{"Thorlabs Motor Serial Number File Path": path, "Default Data Saving Location": path}
  "Misc Data Mega Cluster.gtype" = cluster{"Full Reference Cluster": "Full Reference Cluster.gtype", "Cell Naming Cluster": "Cell Naming Cluster.gtype", "All XZ Position Cluster": "XZ All Position Cluster.gtype", "All Paths": T4}
  "File Handling Boolean Cluster.gtype" = cluster{"Canceled Loading?": bool, "Found Any File?": bool, "Duplicate Calibration Files?": bool}
uses:
  Rainbow Measurement Setup::Side Functions::Messages And Prompts::Select path prompt.gvi
  Rainbow Measurement Setup::Side Functions::Path Manipulation::File_FolderName Scan For Sweep.gvi
  Rainbow Measurement Setup::Main Functions::Modify TXT file::Modify Measurement TXT File.gvi
  Rainbow Measurement Setup::Main Functions::Rainbow Measurement::Light Power Calibration::File Handling::LPC Header Data Extractor.gvi
  Rainbow Measurement Setup::Side Functions::Utilities::Array Operations::Array Detect Duplicates.gvi
  Rainbow Measurement Setup::Side Functions::Messages And Prompts::FGV Repeat Operation for all following files.gvi
diagram:
  # This subVI Handles the Saving of all the Light Power Calibration Spectra Calibration Files. It can both save and load the files from a specified folder and to the user folder respectively
  case ($"Error In") {
    frame Error, Default {
      w1 = $"Error In"
      w2 = default
      w3 = $"LPC Mega Cluster In"
      w4 = default
    }
    frame No Error {
      case ($"Modify File Operation") {
        frame "Load TXT" {
          w9 = "Please Select the folder with all the Light Power Calibration Files you want to Load. "
          w10 = "Select the \"TXT Files\" folder, all calibration files inside will be loaded."
          call "Select path prompt.gvi"(Main Message=w9, Sub message=w10, Error In=$"Error In", Cancel Available?=TRUE) -> (New Path=w11, Cancelled?=w12, Error Out=w13)
          case (w12) {
            frame True {
              w14 = default
              w5 = w13
              w7 = TRUE
              w2 = default
              w6 = TRUE
              w8 = default
            }
            frame False {
              List Folder(error in=w13, path=w11) -> (error out=w15, file names=w16, path out=w17)
              s1 = w15  # shift register
              s2 = 0  # shift register
              s3 = "Light Power Calibration Data.gtype"[] []  # shift register
              for {
                w18 = each element of w16
                Build Path(base path=w17, name or relative path=w18) -> (appended path=w21)
                Search And Replace String(error in (no error)=s1, input string=w18, search string="Power_Calibration") -> (error out=w22, number of replacements=w23)
                call "File_FolderName Scan For Sweep.gvi"(FileName/FolderName In=w18, Error In=w22) -> (Is File/Folder sweep type?=w24, Sweep Type=w25, Error Out=w26)
                Is Not Equal To 0(x=w23) -> w27
                Logical And(w27, w24) -> w28
                case (w28) {
                  frame False, Default {
                    w29 = s2
                    w30 = s3
                    w31 = w26
                    w32 = default
                    w33 = "Red Sweep Closing"
                  }
                  frame True {
                    Array Index(array=s3) -> (out0[s2]=w34)
                    call "Modify Measurement TXT File.gvi"(Filename to load/save=w21, Modify File Operation=$"Modify File Operation", Error In=w26, Measurement File Type="Light Calibration Power") -> (Loaded Data=w35, Header Data=w36, Error Out=w37)
                    Array Index(array=w35) -> (out0[_, 0]=w38, out1[_, 1]=w39, out2[_, 2]=w40)
                    call "LPC Header Data Extractor.gvi"(Header Data In=w36, Error In=w37) -> (Total Light Power=w41, Error Out=w31)
                    Property Node(instance in=w34, "Single Light Calibration:Dividing Wavelength Array"=w38, "Single Light Calibration:Measured Power Array"=w39, "Single Light Calibration:Power Density Array"=w40, "Rainbow Sweep Types"=w25, "Total Light Power Density (W/m^2)"=w41) -> (instance out=w42)
                    Insert Into Array(inArray=s3, new=w42) -> w30
                    Increment(x=s2) -> w29
                    w32 = TRUE
                    w33 = w25
                  }
                }
                append w32 to w19
                append w18 to w2 if w28
                append w33 to w20 if w28
                next s1 = w31
                next s2 = w29
                next s3 = w30
              }
              call "Array Detect Duplicates.gvi"(Array In=w20, Error In=s1) -> (Repeated?=w8, Error Out=w5)
              Or Array Elements(Boolean array=w19) -> (logical OR=w6)
              w14 = s3
              w7 = default
            }
          }
          Property Node(instance in=$"LPC Mega Cluster In", "Light Power Calibration Data"=w14) -> (instance out=w3)
        }
        frame "Save TXT", Default {
          Property Node(instance in=$"LPC Mega Cluster In") -> ("Light Power Calibration Data"=w43, instance out=w3)
          s4 = $"Error In"  # shift register
          for {
            w44 = each element of w43
            Property Node(instance in=w44) -> ("Single Light Calibration"=w45, "Rainbow Sweep Types"=w46, "Total Light Power Density (W/m^2)"=w47)
            Property Node(instance in=w45) -> ("Dividing Wavelength Array"=w48, "Measured Power Array"=w49, "Power Density Array"=w50)
            Build Array(w48, w49, w50) -> w51
            Transpose 2D Array(2D array=w51) -> (transposed array=w52)
            Number To Fractional String(number=w47, use system decimal point (T)=FALSE) -> (F-format string=w53)
            Concatenate Strings("  Total Light Power Density = ", w53, " W/m^2") -> w54
            call "Modify Measurement TXT File.gvi"(Variable Header Info=w54, Rainbow Sweep Types=w46, Misc Data Mega Cluster In=$"Misc Data Mega Cluster In", Modify File Operation=$"Modify File Operation", Data To Save=w52, Error In=s4, Measurement File Type="Light Calibration Power") -> (Error Out=w55)
            next s4 = w55
          }
          w5 = s4
          w6 = default
          w7 = default
          w2 = default
          w8 = default
        }
      }
      call "FGV Repeat Operation for all following files.gvi"(FGV Instructions="Reset State", Error In=w5) -> (Error Out=w1)
      Property Node(instance in="File Handling Boolean Cluster.gtype" {all zero or empty}, "Canceled Loading?"=w7, "Found Any File?"=w6, "Duplicate Calibration Files?"=w8) -> (instance out=w4)
    }
  }
  $"LPC Mega Cluster Out" <- w3
  $"Error Out" <- w1
  $"File Handling Boolean Cluster Out" <- w4
  $"Loaded Files" <- w2
