vi "Light Power Calibration Load Prompt.gvi"   [LabVIEW NXG 5.0.0]
inputs:
  "LPC Mega Cluster In": "LPC Mega Cluster.gtype"
  "Stand Alone": bool
  "Error In": error
  "File Handling Boolean Cluster In": "File Handling Boolean Cluster.gtype"
  "Loaded Files": string[]
outputs:
  "Desired State": "Light Power Calibration States.gtype"
  "Error Out": error
types:
  "Light Power Calibration States.gtype" = enum{"Start App", "Detect Instruments", "Initialize Instruments", "Rainbow Sweep", "Close Coms", "Load Calibration", "Save Graphs", "Stop App"}
  "File Handling Boolean Cluster.gtype" = cluster{"Canceled Loading?": bool, "Found Any File?": bool, "Duplicate Calibration Files?": bool}
  "Raibow Sweep Selector.gtype" = enum{"Red Sweep", "Blue Sweep", "Full Sweep Red First", "Full Sweep Blue First"}
  "Rainbow Sweep Param Selector.gtype" = cluster{"Raibow Sweep Selector": "Raibow Sweep Selector.gtype", "Max Wavelength (nm)": f64, "Min Wavelength (nm)": f64, "Wavelength Step (nm)": f64, "Rainbow Sweep Type Selector": "Rainbow Sweep Type Selector.gtype"}
  T1 = cluster{"Dividing Wavelength Array": f64[], "Measured Power Array": f64[]}
  "Rainbow Sweep Types.gtype" = enum{"Red Sweep Closing", "Red Sweep Opening", "Blue Sweep Closing", "Blue Sweep Opening"}
  "Light Power Calibration Data.gtype" = cluster{"Single Light Calibration": T1, "Rainbow Sweep Types": "Rainbow Sweep Types.gtype"}
  "LPC Mega Cluster.gtype" = cluster{"Rainbow Sweep Parameters LPC": "Rainbow Sweep Param Selector.gtype", "Light Power Calibration Data": "Light Power Calibration Data.gtype"[]}
uses:
  Rainbow Measurement Setup::Side Functions::Graphing::Multiple Page Graph Adapter.gvi
  Rainbow Measurement Setup::Main Functions::Rainbow Measurement::Light Power Calibration::Light Calibration Live Parameters FGV.gvi
diagram:
  # This SubVI Prompts the user in case it does not find any calibration file and asks if it
  # wants to perform a new calibration. It also checks if the loading process got cancelled
  # and if it did it poompts the user accordingly. It also tells the user the files that have been loaded.
  # It also prompts the user in case there are any duplicate files because that would lead to an error
  # when loading the files afterwards.
  # It also updates the graph on the GUI If everything went alright.
  case ($"Error In") {
    frame Error, Default {
      w1 = $"Error In"
      w2 = "Stop App"
    }
    frame No Error {
      Property Node(instance in=$"File Handling Boolean Cluster In") -> ("Canceled Loading?"=w3, "Found Any File?"=w4, "Duplicate Calibration Files?"=w5)
      case (w4) {
        frame False, Default {
          Select(s=$"Stand Alone", t="Detect Instruments", f="Initialize Instruments") -> w7
          w8 = "I could not find any Light Power calibration file\non the specified folder. \nDo you want to perform a new calibration?"
          Two Button Dialog(F button name ("Cancel")="Nah, I'm feeling lazy", T button name ("OK")="Okay, let's do it", message=w8) -> (T Button?=w9)
          Select(s=w9, t=w7, f="Stop App") -> w6
        }
        frame True {
          w6 = "Stop App"
        }
      }
      case (w3) {
        frame False {
          w10 = w6
        }
        frame True {
          Select(s=w3, t="Stop App", f=w6) -> w10
          w11 = "I Cannot load any file if you do \nnot specify a propper path ¯\\_(ツ)_/¯"
          One Button Dialog(button name ("OK")="Oops, Sorry", message=w11)
        }
      }
      case (w5) {
        frame False {
          w2 = w10
        }
        frame True {
          Select(s=w5, t="Stop App", f=w10) -> w2
          w12 = """It looks like you have more than one light power calibration file for the 
same sweep type. Please make sure you only have one file for each type
of light power calibraton file (for example one file for the red sweep 
opening and one file for the blue sweep closing) within each device folder."""
          One Button Dialog(button name ("OK")="Oops, Sorry", message=w12)
        }
      }
      Logical And(w4, not w3) -> w13
      case (w13) {
        frame False { }
        frame True {
          w14 = "Your Files have been succesfully\nloaded. They are the Following:\n\n"
          s1 = w14  # shift register
          for {
            w15 = each element of $"Loaded Files"
            Concatenate Strings(s1, w15, "\r\n") -> w16
            next s1 = w16
          }
          w17 = "\nRemember: This means you can only \nperform these types of sweeps!"
          Concatenate Strings(s1, w17) -> w18
          One Button Dialog(button name ("OK")="Okay Thanks :)", message=w18)
        }
      }
      Property Node(instance in=$"LPC Mega Cluster In") -> ("Light Power Calibration Data"=w19)
      Logical And(w4, not w3, not w5) -> w20
      case (w20) {
        frame False, Default {
          w1 = $"Error In"
        }
        frame True {
          call "Multiple Page Graph Adapter.gvi"(Full Data Array=w19, Error In=$"Error In") -> (Output Bundled Data=w21, Output Graph Ready Data=w22, Error Out=w23)
          call "Light Calibration Live Parameters FGV.gvi"(FGV Instructions="Set State", Output Graph Ready Data=w22, Error In=w23, Graph Bundled data=w21) -> (Error Out=w1)
        }
      }
    }
  }
  $"Desired State" <- w2
  $"Error Out" <- w1
