vi "Light power Calibration Save Graphs Prompt.gvi"   [LabVIEW NXG 5.0.0]
inputs:
  "Error In": error
outputs:
  "Desired State": "Light Power Calibration States.gtype"
  "Error Out": error
types:
  "Light Power Calibration States.gtype" = enum{"Start App", "Detect Instruments", "Initialize Instruments", "Rainbow Sweep", "Close Coms", "Load Calibration", "Save Graphs", "Stop App"}
diagram:
  # This subVI Prompts the user to save or discard the calibration files in case
  # the operation was new calibration. Otherwise it does not
  case ($"Error In") {
    frame Error, Default {
      w1 = "Stop App"
      w2 = $"Error In"
    }
    frame No Error {
      w3 = "Do you wish to save the current\ncalibration files?\nThey will be saved on your Personal\nFolder with the current date."
      Two Button Dialog(F button name ("Cancel")="Oh, don't bother\nI was just testing.", T button name ("OK")="Yes please save \nthe calibration files :D", message=w3) -> (T Button?=w4)
      Select(s=w4, t="Save Graphs", f="Stop App") -> w1
      w2 = $"Error In"
    }
  }
  $"Desired State" <- w1
  $"Error Out" <- w2
