vi "Light Calibration Start Calculator.gvi"   [LabVIEW NXG 5.0.0]
inputs:
  "Operation Control": "Light Power Operation Control.gtype" = "Save Calibration"
  "Stand Alone?": bool
outputs:
  "Output": "Light Power Calibration States.gtype"
types:
  "Light Power Calibration States.gtype" = enum{"Start App", "Detect Instruments", "Initialize Instruments", "Rainbow Sweep", "Close Coms", "Load Calibration", "Save Graphs", "Stop App"}
  "Light Power Operation Control.gtype" = enum{"Save Calibration", "Load Calibration", "New Calibration"}
diagram:
  Select(s=$"Stand Alone?", t="Detect Instruments", f="Initialize Instruments") -> w1
  Is Equal(x="Save Calibration", y=$"Operation Control") -> w2
  Select(s=w2, t="Save Graphs", f=w1) -> w3
  Is Equal(x="Load Calibration", y=$"Operation Control") -> w4
  Select(s=w4, t="Load Calibration", f=w3) -> w5
  $Output <- w5
