vi "Light Power Calibration Subroutine.gvi"   [LabVIEW NXG 5.0.0]
inputs:
  "Error In": error
  "Light Calibration Operation": "Light Power Operation Control.gtype" = "Save Calibration"
  "Instrument Control Mega Cluster In": "Instrument Control Mega Cluster.gtype"
  "Misc Data Mega Cluster In": "Misc Data Mega Cluster.gtype"
  "LPC Mega Cluster In": "LPC Mega Cluster.gtype"
  "Stand Alone?": bool
outputs:
  "Error Out": error
  "Instrument Control Mega Cluster Out": "Instrument Control Mega Cluster.gtype"
  "Misc Data Mega Cluster Out": "Misc Data Mega Cluster.gtype"
  "LPC Mega Cluster Out": "LPC Mega Cluster.gtype"
types:
  "Light Power Operation Control.gtype" = enum{"Save Calibration", "Load Calibration", "New Calibration"}
  "Full Reference Cluster.gtype" = cluster{"Enum Reference Cluster": "Enum Control Reference Cluster.gtype", "Boolean Reference Cluster": "Boolean Control Reference Cluster.gtype", "Numeric Reference Cluster": "Numeric Control Reference Cluster.gtype", "Numeric Cluster Reference Cluster": "Numeric Cluster Reference Cluster.gtype", "Path Reference Cluster": "Path Reference Cluster.gtype", "Cluster Reference Cluster": "Cluster Reference Cluster.gtype", "XZ Stage Controls Reference Cluster": "XZ Stage Controls Reference Cluster.gtype"}
  "Cell Naming Cluster.gtype" = cluster{"Cell Label": string, "Sample Prefix": string, "Author Initials": string, "Current Date": string, "Batch Name": string}
  T1 = cluster{"X Coordinate (mm)": f64, "Z Coordinate (mm)": f64}
  T2 = cluster{"X Coordinate (mm)": f64, "Z Coordinate (mm)": f64, "Vertical Spacing (mm)": f64}
  "XZ All Position Cluster.gtype" = cluster{"Diffusor Coordinates": T1, "Photodetector Coordinates": T1, "Cell R.01 Coordinates": T2, "Approach Distance (mm)": f64}
  T3 = cluster{"Thorlabs Motor Serial Number File Path": path, "Default Data Saving Location": path}
  "Misc Data Mega Cluster.gtype" = cluster{"Full Reference Cluster": "Full Reference Cluster.gtype", "Cell Naming Cluster": "Cell Naming Cluster.gtype", "All XZ Position Cluster": "XZ All Position Cluster.gtype", "All Paths": T3}
  "Instrument Coms Info.gtype" = cluster{"Arduino Coms Info": "Arduino Detection cluster control.gtype", "Photodetector Names": string[], "Keythley Address": "VISA Instr", "Photodetector Detected?": bool, "Thorlabs Motors Detected?": bool, "Keithley Detected?": bool, "Thorlabs Motors Serial Number": "Thorlabs Motors Serial Number In.gtype", "Photodetector IVI session": "Ivi IviDefault", "Flame ID": string, "Flame Detected?": bool, "Flame Wrapper ID": u64}
  "Debugging Cluster.gtype" = cluster{"Debugging mode?": bool, "Initialize App": bool, "Insturment Debugging": "Insturment Debugging Cluster.gtype"}
  "Instrument Control Mega Cluster.gtype" = cluster{"Instruments Coms Info": "Instrument Coms Info.gtype", "Debugging Cluster": "Debugging Cluster.gtype"}
  "Raibow Sweep Selector.gtype" = enum{"Red Sweep", "Blue Sweep", "Full Sweep Red First", "Full Sweep Blue First"}
  "Rainbow Sweep Param Selector.gtype" = cluster{"Raibow Sweep Selector": "Raibow Sweep Selector.gtype", "Max Wavelength (nm)": f64, "Min Wavelength (nm)": f64, "Wavelength Step (nm)": f64, "Rainbow Sweep Type Selector": "Rainbow Sweep Type Selector.gtype"}
  "Light power Calibration Parameters.gtype" = cluster{"Powermeter Averages": u32, "Photodtctr Area (m^2)": f64, "Only Full Spectrum": bool}
  T4 = cluster{"Dividing Wavelength Array": f64[], "Measured Power Array": f64[], "Power Density Array": f64[]}
  "Rainbow Sweep Types.gtype" = enum{"Red Sweep Closing", "Red Sweep Opening", "Blue Sweep Closing", "Blue Sweep Opening"}
  "Light Power Calibration Data.gtype" = cluster{"Single Light Calibration": T4, "Rainbow Sweep Types": "Rainbow Sweep Types.gtype", "Total Light Power Density (W/m^2)": f64}
  "LPC Mega Cluster.gtype" = cluster{"Rainbow Sweep Parameters LPC": "Rainbow Sweep Param Selector.gtype", "LPC Specific Parameters": "Light power Calibration Parameters.gtype", "Light Power Calibration Data": "Light Power Calibration Data.gtype"[]}
  "XZ Coordinate Cluster In.gtype" = cluster{"X Coordinate (mm)": f64, "Z Coordinate (mm)": f64}
uses:
  Rainbow Measurement Setup::Main Functions::Rainbow Measurement::Light Power Calibration::Light Power Operation FGV.gvi
  Rainbow Measurement Setup::Main Functions::Instruction Queue::Current State::FGV Current State.gvi
  Rainbow Measurement Setup::Side Functions::Global Abort::FGV Global Abort.gvi
  Rainbow Measurement Setup::Main Functions::Rainbow Measurement::Light Power Calibration::Light Calibration Start Calculator.gvi
  Rainbow Measurement Setup::Side Functions::Instrument Control::Thorlabs Motors::Dividing Wavelength Control::Dividing Wavelength Calibration Data FGV.gvi
  Rainbow Measurement Setup::Side Functions::Instrument Control::Debug Cluster Instrument Extractor.gvi
  Rainbow Measurement Setup::Main Functions::One Time Calibrations::Beam Power Density::Specific Detect Instruments Subroutine.gvi
  Rainbow Measurement Setup::Side Functions::Instrument Control::Thorlabs Motors::Movement::KCube Move to 0 or Home.gvi
  Rainbow Measurement Setup::Side Functions::Instrument Control::Arduino::XZ Stage Arduino::XZ Stage Initialize And Home.gvi
  Rainbow Measurement Setup::Main Functions::XZ Stage Movements::MRM Move To Coordinate Safely.gvi
  Rainbow Measurement Setup::Side Functions::Instrument Control::Photodetector::Photodetector Initialize.gvi
  Rainbow Measurement Setup::Main Functions::Rainbow Measurement::Light Power Calibration::Light Power Calibration Sweep.gvi
  Rainbow Measurement Setup::Side Functions::Instrument Control::Photodetector::Photodetector Close Coms.gvi
  Rainbow Measurement Setup::Side Functions::Instrument Control::Arduino::XZ Stage Arduino::XZ Y Safe Approach and Retract.gvi
  Rainbow Measurement Setup::Side Functions::Instrument Control::Arduino::XZ Stage Arduino::XZ Stage Move to Position.gvi
  Rainbow Measurement Setup::Side Functions::Instrument Control::Arduino::XZ Stage Arduino::XZ Stage Close Coms.gvi
  Rainbow Measurement Setup::Side Functions::Instrument Control::Thorlabs Motors::Movement::KCube Motors Close.gvi
  Rainbow Measurement Setup::Main Functions::Rainbow Measurement::Light Power Calibration::File Handling::Light power Calibration Save Graphs Prompt.gvi
  Rainbow Measurement Setup::Main Functions::Rainbow Measurement::Light Power Calibration::File Handling::Light Calibration file handling.gvi
  Rainbow Measurement Setup::Main Functions::Rainbow Measurement::Light Power Calibration::File Handling::Light Power Calibration Load Prompt.gvi
  Rainbow Measurement Setup::Main Functions::Rainbow Measurement::Light Power Calibration::Light Calibration Live Parameters FGV.gvi
  Rainbow Measurement Setup::Side Functions::Messages And Prompts::General Simple Prompt.gvi
  Rainbow Measurement Setup::Side Functions::Utilities::Progress Handling::Progress FGV.gvi
diagram:
  # This SubVI Measures the Light power for each motor position for each sweep type and outputs the data so that it can be plotted
  # on the main window for checking and for calibration purposes
  case ($"Error In") {
    frame Error, Default {
      w1 = $"Error In"
      w2 = $"Misc Data Mega Cluster In"
      w3 = $"LPC Mega Cluster In"
      w4 = $"Instrument Control Mega Cluster In"
    }
    frame No Error {
      call "Light Power Operation FGV.gvi"(FGV Instructions="Read State", Error In=$"Error In") -> (Light Power Operation Out=w5, Error Out=w6)
      Select(s=$"Stand Alone?", t=$"Light Calibration Operation", f=w5) -> w7
      call "FGV Current State.gvi"(Current State Instructions="Set Current State and Substate", Current State="Light Power Calibration", Current Substate="", Error In=w6) -> (Error Out=w8)
      s1 = w8  # shift register
      s2 = "Start App"  # shift register
      s3 = $"Instrument Control Mega Cluster In"  # shift register
      s4 = $"Misc Data Mega Cluster In"  # shift register
      s5 = $"LPC Mega Cluster In"  # shift register
      while {
        call "FGV Global Abort.gvi"(Global Abort Instructions="Read Current State", Error In=s1) -> (Local Abort Out=w9, Global Abort Out=w10, Error Out=w11)
        Select(s=w9, t="Close Coms", f=s2) -> w12
        case (w12) {
          frame "Start App", Default {
            call "Light Calibration Start Calculator.gvi"(Operation Control=w7, Stand Alone?=$"Stand Alone?") -> (Output=w14)
            call "FGV Current State.gvi"(Current State Instructions="Set Current Substate", Current Substate="Starting Light Power Calibration", Error In=w11) -> (Error Out=w13)
            w15 = default
            w16 = 0
            w17 = s3
            w18 = s5
            w19 = s4
          }
          frame "Detect Instruments" {
            call "FGV Current State.gvi"(Current State Instructions="Set Current Substate", Current Substate="Detecting Instruments", Error In=w11) -> (Error Out=w20)
            call "Dividing Wavelength Calibration Data FGV.gvi"(Div Wavelength FGV Instructions="Load Data", Error In=w20) -> (Error Out=w21)
            call "Debug Cluster Instrument Extractor.gvi"(Instrument Control Mega Cluster In=s3, Error In=w21) -> (Instrument Control Mega Cluster Out=w22, Instruments to Detect=w23, Error Out=w24)
            call "Specific Detect Instruments Subroutine.gvi"(Instrument Control Mega Cluster In=w22, Error In=w24, Instruments To Detect Array=w23) -> (Instrument Control Mega Cluster Out=w17, Error Out=w13)
            w14 = "Initialize Instruments"
            w15 = default
            w16 = 20
            w18 = s5
            w19 = s4
          }
          frame "Initialize Instruments" {
            Property Node(instance in=s4) -> ("All XZ Position Cluster:Photodetector Coordinates"=w25, instance out=w19)
            call "FGV Current State.gvi"(Current State Instructions="Set Current Substate", Current Substate="Initializing Instruments", Error In=w11) -> (Error Out=w26)
            call "KCube Move to 0 or Home.gvi"(Instrument Control Mega Cluster In=s3, Error In=w26) -> (Instrument Control Mega Cluster Out=w27, Error Out=w28)
            call "XZ Stage Initialize And Home.gvi"(Instrument Control Mega Cluster In=w27, Error In=w28) -> (Instrument Control Mega Cluster Out=w29, Error Out=w30)
            call "MRM Move To Coordinate Safely.gvi"(Instrument Control Mega Cluster In=w29, Misc Data Mega Cluster In=s4, Error In=w30, XZ Coordinate Cluster In=w25) -> (Instrument Control Mega Cluster Out=w31, Error Out=w32)
            call "Photodetector Initialize.gvi"(Instrument Control Mega Cluster In=w31, Error In=w32) -> (Instrument Control Mega Cluster Out=w17, Error Out=w13)
            w14 = "Rainbow Sweep"
            w15 = default
            w16 = 40
            w18 = s5
          }
          frame "Rainbow Sweep" {
            call "FGV Current State.gvi"(Current State Instructions="Set Current Substate", Current Substate="Acquiring Spectra", Error In=w11) -> (Error Out=w33)
            call "Light Power Calibration Sweep.gvi"(Instrument Control Mega Cluster In=s3, LPC Mega Cluster In=s5, Error In=w33) -> (Instrument Control Mega Cluster Out=w17, LPC Mega Cluster Out=w18, Error Out=w13)
            w14 = "Close Coms"
            w15 = default
            w16 = 80
            w19 = s4
          }
          frame "Close Coms" {
            call "FGV Current State.gvi"(Current State Instructions="Set Current Substate", Current Substate="Closing Coms", Error In=w11) -> (Error Out=w34)
            call "KCube Move to 0 or Home.gvi"(Instrument Control Mega Cluster In=s3, Error In=w34) -> (Instrument Control Mega Cluster Out=w35, Error Out=w36)
            call "Photodetector Close Coms.gvi"(Instrument Control Mega Cluster In=w35, Error In=w36) -> (Instrument Control Mega Cluster Out=w37, Error Out=w38)
            call "XZ Y Safe Approach and Retract.gvi"(Instrument Control Mega Cluster In=w37, Error In=w38, Approach Operation="Retract", Misc Data Mega Cluster=s4) -> (Instrument Control Mega Cluster Out=w39, Error Out=w40)
            call "XZ Stage Move to Position.gvi"(Instrument Control Mega Cluster In=w39, Error In=w40, XZ Coordinate Cluster In="XZ Coordinate Cluster In.gtype" {all zero or empty}) -> (Instrument Control Mega Cluster Out=w41, Error Out=w42)
            call "XZ Stage Close Coms.gvi"(Instrument Control Mega Cluster In=w41, Error In=w42) -> (Instrument Control Mega Cluster Out=w43, Error Out=w44)
            call "KCube Motors Close.gvi"(Instrument Control Mega Cluster In=w43, Error In=w44) -> (Instrument Control Mega Cluster Out=w17, Error Out=w45)
            call "Light power Calibration Save Graphs Prompt.gvi"(Error In=w45) -> (Desired State=w46, Error Out=w13)
            Select(s=w9, t="Stop App", f=w46) -> w14
            w15 = default
            w16 = 90
            w18 = s5
            w19 = s4
          }
          frame "Load Calibration" {
            call "FGV Current State.gvi"(Current State Instructions="Set Current Substate", Current Substate="Loading Calibration", Error In=w11) -> (Error Out=w47)
            call "Light Calibration file handling.gvi"(LPC Mega Cluster In=s5, Misc Data Mega Cluster In=s4, Error In=w47, Modify File Operation="Load TXT") -> (LPC Mega Cluster Out=w18, File Handling Boolean Cluster Out=w48, Loaded Files=w49, Error Out=w50)
            call "Light Power Calibration Load Prompt.gvi"(LPC Mega Cluster In=w18, File Handling Boolean Cluster In=w48, Loaded Files=w49, Error In=w50, Stand Alone=$"Stand Alone?") -> (Desired State=w14, Error Out=w51)
            call "Light Calibration Live Parameters FGV.gvi"(FGV Instructions="Set State", Error In=w51) -> (Error Out=w13)
            w15 = default
            w16 = 40
            w17 = s3
            w19 = s4
          }
          frame "Save Graphs" {
            call "FGV Current State.gvi"(Current State Instructions="Set Current Substate", Current Substate="Saving Graphs", Error In=w11) -> (Error Out=w52)
            call "Light Calibration file handling.gvi"(LPC Mega Cluster In=s5, Misc Data Mega Cluster In=s4, Error In=w52, Modify File Operation="Save TXT") -> (Error Out=w53)
            w54 = "Your Calibration Files Have been saved\npropperly on your personal data folder."
            call "General Simple Prompt.gvi"(Prompt Message=w54, Okay Button Message="Perfect Thanks :)", Error In=w53, Prompt?=TRUE) -> (Error Out=w13)
            w14 = "Stop App"
            w15 = default
            w16 = 95
            w17 = s3
            w18 = s5
            w19 = s4
          }
          frame "Stop App" {
            call "FGV Current State.gvi"(Current State Instructions="Set Current Substate", Current Substate="Stopping Apps", Error In=w11) -> (Error Out=w13)
            w14 = "Start App"
            w15 = TRUE
            w16 = 100
            w17 = s3
            w18 = s5
            w19 = s4
          }
        }
        call "Progress FGV.gvi"(FGV Instructions="Set State", Progress In=w16, Error In=w13) -> (Error Out=w55)
        Logical Or(w10, w55, w15) -> w56
        next s1 = w55
        next s2 = w14
        next s3 = w17
        next s4 = w19
        next s5 = w18
        stop if w56
      }
      w1 = s1
      w2 = s4
      w3 = s5
      w4 = s3
    }
  }
  $"Instrument Control Mega Cluster Out" <- w4
  $"Misc Data Mega Cluster Out" <- w2
  $"LPC Mega Cluster Out" <- w3
  $"Error Out" <- w1
