vi "Light Power Calibration Sweep.gvi"   [LabVIEW NXG 5.0.0]
inputs:
  "Error In": error
  "Instrument Control Mega Cluster In": "Instrument Control Mega Cluster.gtype"
  "LPC Mega Cluster In": "LPC Mega Cluster.gtype"
outputs:
  "Error Out": error
  "LPC Mega Cluster Out": "LPC Mega Cluster.gtype"
  "Instrument Control Mega Cluster Out": "Instrument Control Mega Cluster.gtype"
types:
  "Instrument Coms Info.gtype" = cluster{"Arduino Coms Info": "Arduino Detection cluster control.gtype", "Photodetector Names": string[], "Keythley Address": "VISA Instr", "Photodetector Detected?": bool, "Thorlabs Motors Detected?": bool, "Keithley Detected?": bool, "Thorlabs Motors Serial Number": "Thorlabs Motors Serial Number In.gtype", "Photodetector IVI session": "Ivi IviDefault", "Flame ID": string, "Flame Detected?": bool, "Flame Wrapper ID": u64}
  "Debugging Cluster.gtype" = cluster{"Debugging mode?": bool, "Initialize App": bool, "Insturment Debugging": "Insturment Debugging Cluster.gtype"}
  "Instrument Control Mega Cluster.gtype" = cluster{"Instruments Coms Info": "Instrument Coms Info.gtype", "Debugging Cluster": "Debugging Cluster.gtype"}
  "Raibow Sweep Selector.gtype" = enum{"Red Sweep", "Blue Sweep", "Full Sweep Red First", "Full Sweep Blue First"}
  "Rainbow Sweep Param Selector.gtype" = cluster{"Raibow Sweep Selector": "Raibow Sweep Selector.gtype", "Max Wavelength (nm)": f64, "Min Wavelength (nm)": f64, "Wavelength Step (nm)": f64, "Rainbow Sweep Type Selector": "Rainbow Sweep Type Selector.gtype"}
  "Light power Calibration Parameters.gtype" = cluster{"Powermeter Averages": u32, "Photodtctr Area (m^2)": f64, "Only Full Spectrum": bool}
  T1 = cluster{"Dividing Wavelength Array": f64[], "Measured Power Array": f64[], "Power Density Array": f64[]}
  "Rainbow Sweep Types.gtype" = enum{"Red Sweep Closing", "Red Sweep Opening", "Blue Sweep Closing", "Blue Sweep Opening"}
  "Light Power Calibration Data.gtype" = cluster{"Single Light Calibration": T1, "Rainbow Sweep Types": "Rainbow Sweep Types.gtype", "Total Light Power Density (W/m^2)": f64}
  "LPC Mega Cluster.gtype" = cluster{"Rainbow Sweep Parameters LPC": "Rainbow Sweep Param Selector.gtype", "LPC Specific Parameters": "Light power Calibration Parameters.gtype", "Light Power Calibration Data": "Light Power Calibration Data.gtype"[]}
  "LPC Sweep Live Parameters.gtype" = cluster{"Light Power Density (W/m^2) ": f64, "Current Wavelength (nm)": f64, "Rainbow Sweep Types": "Rainbow Sweep Types.gtype"}
uses:
  Rainbow Measurement Setup::Side Functions::Messages And Prompts::FGV Cancel Prompts until Finished Routine.gvi
  Rainbow Measurement Setup::Side Functions::Instrument Control::Photodetector::Photodetector Guarantee Measurement.gvi
  Rainbow Measurement Setup::Main Functions::Rainbow Measurement::Light Power Calibration::Photodetector Wait Calculator.gvi
  Rainbow Measurement Setup::Side Functions::Rainbow Sweep::Rainbow Sweep Param Generator.gvi
  Rainbow Measurement Setup::Side Functions::Instrument Control::Thorlabs Motors::Dividing Wavelength Control::Dividing Wavelength Calibration Data FGV.gvi
  Rainbow Measurement Setup::Side Functions::Global Abort::FGV Global Abort.gvi
  Rainbow Measurement Setup::Side Functions::Instrument Control::Thorlabs Motors::Dividing Wavelength Control::KCube Dividing Wavelength Translator.gvi
  Rainbow Measurement Setup::Side Functions::Utilities::Time Related Operations::Wait ms.gvi
  Rainbow Measurement Setup::Side Functions::Instrument Control::Photodetector::Photodetector Measure Power.gvi
  Rainbow Measurement Setup::Side Functions::Graphing::Multiple Page Graph Adapter.gvi
  Rainbow Measurement Setup::Main Functions::Rainbow Measurement::Light Power Calibration::Light Calibration Live Parameters FGV.gvi
  Rainbow Measurement Setup::Side Functions::Utilities::Progress Handling::Progress General Calculator.gvi
  Rainbow Measurement Setup::Side Functions::Utilities::Progress Handling::Progress FGV.gvi
  Rainbow Measurement Setup::Side Functions::Instrument Control::Thorlabs Motors::Movement::KCube Move to 0 or Home.gvi
diagram:
  # This SubVI Performs a sweep moving the motors and measuring the power that reaches the detector and then it stores everything on an array so that it can be later saved.
  case ($"Error In") {
    frame Error, Default {
      w1 = $"Error In"
      w2 = $"Instrument Control Mega Cluster In"
      w3 = $"LPC Mega Cluster In"
    }
    frame No Error {
      Property Node(instance in=$"LPC Mega Cluster In") -> ("Rainbow Sweep Parameters LPC"=w4, "LPC Specific Parameters:Photodtctr Area (m^2)"=w5, "LPC Specific Parameters:Only Full Spectrum"=w6, instance out=w7)
      call "FGV Cancel Prompts until Finished Routine.gvi"(Error In=$"Error In", FGV Instructions="Reset State") -> (Error Out=w8)
      call "Photodetector Guarantee Measurement.gvi"(Instrument Control Mega Cluster In=$"Instrument Control Mega Cluster In", Stabilization time (ms)=20000, Timeout (s)=30, Error In=w8) -> (Instrument Control Mega Cluster Out=w9, Measured Power=w10, Error Out=w11)
      call "Photodetector Wait Calculator.gvi"(Instrument Control Mega Cluster In=w9, Rainbow Sweep Parameters LPC In=w4, Error In=w11) -> (Instrument Control Mega Cluster Out=w12, Rainbow Sweep Parameters LPC Out=w13, Step ms wait=w14, Error Out=w15)
      call "Rainbow Sweep Param Generator.gvi"(Rainbow Sweep Parameters=w13, Only Full Spectrum?=w6, Error In=w15) -> (Rainbow Sweep Parameters Array=w16, Initialized Light Power Calibration Data Array=w17, Error Out=w18)
      call "Dividing Wavelength Calibration Data FGV.gvi"(Div Wavelength FGV Instructions="Read Loaded Data", Error In=w18) -> (Dividing Wavelength Calibration Data Out=w19, Error Out=w20)
      case (w6) {
        frame False {
          s1 = w20  # shift register
          s2 = w12  # shift register
          s3 = w17  # shift register
          s4 = 0  # shift register
          for (N -> w25) (iteration -> i1) {
            w26 = each element of w16
            Property Node(instance in=w26) -> ("Dividing Wavelength Array"=w27, "Rainbow Sweep Types"=w28)
            s5 = s1  # shift register
            s6 = s2  # shift register
            s7 = s4  # shift register
            s8 = s3  # shift register
            for (N -> w29) {
              w30 = each element of w27
              Multiply(w29, w25) -> w31
              call "FGV Global Abort.gvi"(Global Abort Instructions="Read Current State", Error In=s5) -> (Local Abort Out=w32, Global Abort Out=w33, Error Out=w34)
              call "KCube Dividing Wavelength Translator.gvi"(Dividing Wavelength=w30, Instrument Control Mega Cluster In=s6, Dividing Wavelength Calibration Data In=w19, Error In=w34, Rainbow Sweep Types=w28) -> (Real Dividing Wavelength=w35, Instrument Control Mega Cluster Out=w36, Error Out=w37)
              call "Wait ms.gvi"(Error In=w37, Milliseconds to Wait=w14) -> (Error Out=w38)
              call "Photodetector Measure Power.gvi"(Instrument Control Mega Cluster In=w36, Error In=w38) -> (Instrument Control Mega Cluster Out=w39, Measured Power=w40, Error Out=w41)
              Divide(x=w40, y=w5) -> w42
              Property Node(instance in="LPC Sweep Live Parameters.gtype" {all zero or empty}, "Light Power Density (W/m^2) "=w42, "Current Wavelength (nm)"=w35, "Rainbow Sweep Types"=w28) -> (instance out=w21)
              Divide(x=w10, y=w5) -> w43
              Array Index(array=s8) -> (out0[i1]=w44)
              Property Node(instance in=w44) -> ("Single Light Calibration"=w45, instance out=w46)
              Property Node(instance in=w45) -> ("Dividing Wavelength Array"=w47, "Measured Power Array"=w48, "Power Density Array"=w49, instance out=w50)
              Build Array(w47, w35) -> w51
              Build Array(w48, w40) -> w52
              Build Array(w49, w42) -> w53
              Property Node(instance in=w50, "Dividing Wavelength Array"=w51, "Measured Power Array"=w52, "Power Density Array"=w53) -> (instance out=w54)
              Property Node(instance in=w46, "Single Light Calibration"=w54, "Rainbow Sweep Types"=w28, "Total Light Power Density (W/m^2)"=w43) -> (instance out=w55)
              Replace Array Subset(inArray=s8, index=i1, new=w55) -> w56
              call "Multiple Page Graph Adapter.gvi"(Full Data Array=w56, Error In=w41) -> (Output Bundled Data=w57, Output Graph Ready Data=w58, Error Out=w59)
              call "Light Calibration Live Parameters FGV.gvi"(FGV Instructions="Set State", Light Calibration Live Parameters In=w21, Output Graph Ready Data=w58, Error In=w59, Graph Bundled data=w57) -> (Error Out=w60)
              call "Progress General Calculator.gvi"(Starting Value=40, Ending Value=80, Number Of Steps=w31, Current Step=s7, Error In=w60) -> (Current Progress=w61, Error Out=w62)
              call "Progress FGV.gvi"(FGV Instructions="Set State", Progress In=w61, Error In=w62) -> (Error Out=w63)
              Increment(x=s7) -> w64
              Logical Or(w32, w33) -> w65
              next s5 = w63
              next s6 = w39
              next s7 = w64
              next s8 = w56
              stop if w65
            }
            call "Multiple Page Graph Adapter.gvi"(Full Data Array=s8, Error In=s5) -> (Output Bundled Data=w66, Output Graph Ready Data=w67, Error Out=w68)
            call "Light Calibration Live Parameters FGV.gvi"(FGV Instructions="Set State", Light Calibration Live Parameters In=w21, Output Graph Ready Data=w67, Error In=w68, Graph Bundled data=w66) -> (Error Out=w69)
            call "KCube Move to 0 or Home.gvi"(Instrument Control Mega Cluster In=s6, Error In=w69) -> (Instrument Control Mega Cluster Out=w70, Error Out=w71)
            next s1 = w71
            next s2 = w70
            next s3 = s8
            next s4 = s7
            stop if w65
          }
          w22 = s1
          w23 = s3
          w24 = s2
        }
        frame True {
          s9 = w20  # shift register
          s10 = w12  # shift register
          s11 = w17  # shift register
          s12 = 0  # shift register
          for (N -> w72) (iteration -> i2) {
            w73 = each element of w16
            Property Node(instance in=w73) -> ("Rainbow Sweep Types"=w74)
            Divide(x=w10, y=w5) -> w75
            Array Index(array=s11) -> (out0[i2]=w76)
            Property Node(instance in=w76, "Rainbow Sweep Types"=w74, "Total Light Power Density (W/m^2)"=w75) -> (instance out=w77)
            Replace Array Subset(inArray=s11, index=i2, new=w77) -> w78
            Increment(x=s12) -> w79
            call "Progress General Calculator.gvi"(Starting Value=60, Ending Value=80, Number Of Steps=w72, Current Step=w79, Error In=s9) -> (Error Out=w80)
            call "FGV Global Abort.gvi"(Global Abort Instructions="Read Current State", Error In=w80) -> (Local Abort Out=w81, Global Abort Out=w82, Error Out=w83)
            Logical Or(w81, w82) -> w84
            next s9 = w83
            next s11 = w78
            next s12 = w79
            stop if w84
          }
          w21 = default
          w22 = s9
          w23 = s11
          w24 = s10
        }
      }
      Property Node(instance in=w7, "Light Power Calibration Data"=w23) -> (instance out=w3)
      call "Multiple Page Graph Adapter.gvi"(Full Data Array=w23, Error In=w22) -> (Output Bundled Data=w85, Output Graph Ready Data=w86, Error Out=w87)
      call "Light Calibration Live Parameters FGV.gvi"(FGV Instructions="Set State", Light Calibration Live Parameters In=w21, Output Graph Ready Data=w86, Error In=w87, Graph Bundled data=w85) -> (Error Out=w88)
      call "KCube Move to 0 or Home.gvi"(Instrument Control Mega Cluster In=w24, Error In=w88) -> (Instrument Control Mega Cluster Out=w2, Error Out=w1)
    }
  }
  $"LPC Mega Cluster Out" <- w3
  $"Instrument Control Mega Cluster Out" <- w2
  $"Error Out" <- w1
