vi "Photodetector Wait Calculator.gvi"   [LabVIEW NXG 5.0.0]
inputs:
  "Rainbow Sweep Parameters LPC In": "Rainbow Sweep Param Selector.gtype" = {0, 1100, 300, 1, 1, 0}
  "Instrument Control Mega Cluster In": "Instrument Control Mega Cluster.gtype"
  "Error In": error
outputs:
  "Instrument Control Mega Cluster Out": "Instrument Control Mega Cluster.gtype"
  "Step ms wait": f64
  "Error Out": error
  "Rainbow Sweep Parameters LPC Out": "Rainbow Sweep Param Selector.gtype"
types:
  "Instrument Coms Info.gtype" = cluster{"Arduino Coms Info": "Arduino Detection cluster control.gtype", "Photodetector Names": string[], "Keythley Address": "VISA Instr", "Photodetector Detected?": bool, "Thorlabs Motors Detected?": bool, "Keithley Detected?": bool, "Thorlabs Motors Serial Number": "Thorlabs Motors Serial Number In.gtype", "Photodetector IVI session": "Ivi IviDefault", "Flame ID": string, "Flame Detected?": bool, "Flame Wrapper ID": u64}
  "Debugging Cluster.gtype" = cluster{"Debugging mode?": bool, "Initialize App": bool, "Insturment Debugging": "Insturment Debugging Cluster.gtype"}
  "Instrument Control Mega Cluster.gtype" = cluster{"Instruments Coms Info": "Instrument Coms Info.gtype", "Debugging Cluster": "Debugging Cluster.gtype"}
  "Raibow Sweep Selector.gtype" = enum{"Red Sweep", "Blue Sweep", "Full Sweep Red First", "Full Sweep Blue First"}
  T1 = enum{"Red Sweep Closing", "Red Sweep Opening", "Red Sweep Both Ways"}
  T2 = enum{"Blue Sweep Opening", "Blue Sweep Closing", "Blue Sweep Both Ways"}
  "Rainbow Sweep Type Selector.gtype" = cluster{"Red Sweep Mode": T1, "Blue Sweep Mode": T2}
  "Rainbow Sweep Param Selector.gtype" = cluster{"Raibow Sweep Selector": "Raibow Sweep Selector.gtype", "Max Wavelength (nm)": f64, "Min Wavelength (nm)": f64, "Wavelength Step (nm)": f64, "Rainbow Sweep Type Selector": "Rainbow Sweep Type Selector.gtype"}
diagram:
  # This subVI Calculates the aproximate ammount of time
  # to wait for each photodetector step depending on the wavelength
  # step of the light calibration.
  case ($"Error In") {
    frame Error, Default {
      w1 = $"Instrument Control Mega Cluster In"
      w2 = default
      w3 = $"Error In"
      w4 = $"Rainbow Sweep Parameters LPC In"
    }
    frame No Error {
      Property Node(instance in=$"Instrument Control Mega Cluster In") -> ("Debugging Cluster:Insturment Debugging:Photodetector"=w5, "Debugging Cluster:Debugging mode?"=w6, instance out=w1)
      Logical And[output inverted](not w5, w6) -> w7
      Property Node(instance in=$"Rainbow Sweep Parameters LPC In") -> ("Wavelength Step (nm)"=w8, instance out=w4)
      Multiply(w8, 1000) -> w9
      Select(s=w7, t=w9, f=1) -> w2
      w3 = $"Error In"
    }
  }
  $"Error Out" <- w3
  $"Rainbow Sweep Parameters LPC Out" <- w4
  $"Instrument Control Mega Cluster Out" <- w1
  $"Step ms wait" <- w2
