vi "Enable and Disable XZ Controls.gvi"   [LabVIEW NXG 5.0.0]
inputs:
  "Full Reference Cluster In": "Full Reference Cluster.gtype"
  "Error In": error
  "Activate Arduino?": bool
outputs:
  "Full Reference Cluster Out": "Full Reference Cluster.gtype"
  "Error Out": error
types:
  "Enum Control Reference Cluster.gtype" = cluster{"Main Tab": "TabControl reference", "Rainbow Measurement tab": "TabControl reference", "Configuration tab": "TabControl reference", "Light Calibration tab": "TabControl reference", "SRM Plot Parameter Selector": "EnumSelector reference"}
  "Boolean Control Reference Cluster.gtype" = cluster{"Custem date": "CheckBox reference", "Label Info Missing Error": "BooleanControl reference"}
  "Numeric Control Reference Cluster.gtype" = cluster{"Beam Power Density": "IntensityGraph reference"[][], "Irradiance Calibration": "Graph reference"[]}
  "Numeric Cluster Reference Cluster.gtype" = cluster{"LPC Parameters": "Cluster reference", "Sweep Live Parameters LPC": "Cluster reference"}
  "Path Reference Cluster.gtype" = cluster{"Calibration Files Path": "PathSelector reference", "Default Data Saving Location": "PathSelector reference"}
  "Cluster Reference Cluster.gtype" = cluster{"Light Power Calibration": "Graph reference", "Light Power Calibration Data": "ArrayViewer reference", "Rainbow Sweep Parameters RSM": "Cluster reference", "Rainbow Sweep Param Selector MSpot": "Cluster reference", "MSpot Spectrum Calibration Parameters": "Cluster reference", "SRM Raw Plot Rainbow Sweep Selector": "ComboBoxSelector reference", "SRM Refined Plot Rainbow Sweep Types": "ComboBoxSelector reference", "SRM Specific Parameters": "Cluster reference", "Label Info Error Label": "StringControl reference", "Sample Comments": "StringControl reference", "Cell Number": "StringControl reference", "Author Initials": "ComboBoxSelector reference", "Batch Name": "StringControl reference", "IV Plot Out ": "Graph reference", "Sweep Live Parameters RSM": "Cluster reference", "Rainbow Sweep Parameters LPC": "Cluster reference", "XZ All Position Cluster": "Cluster reference"}
  "XZ Stage Controls Reference Cluster.gtype" = cluster{"Cell Label": "EnumSelector reference", "Activate XZ Stage": "BooleanControl reference", "Custom Position": "BooleanControl reference", "Set Position": "BooleanControl reference", "XZ Stage Active": "BooleanControl reference", "Release XZ Stage": "BooleanControl reference", "XZ Coordinates": "Cluster reference"}
  "Full Reference Cluster.gtype" = cluster{"Enum Reference Cluster": "Enum Control Reference Cluster.gtype", "Boolean Reference Cluster": "Boolean Control Reference Cluster.gtype", "Numeric Reference Cluster": "Numeric Control Reference Cluster.gtype", "Numeric Cluster Reference Cluster": "Numeric Cluster Reference Cluster.gtype", "Path Reference Cluster": "Path Reference Cluster.gtype", "Cluster Reference Cluster": "Cluster Reference Cluster.gtype", "XZ Stage Controls Reference Cluster": "XZ Stage Controls Reference Cluster.gtype"}
diagram:
  case ($"Error In") {
    frame Error, Default {
      w1 = $"Full Reference Cluster In"
      w2 = $"Error In"
    }
    frame No Error {
      case ($"Activate Arduino?") {
        frame True {
          Property Node(instance in=$"Full Reference Cluster In") -> ("XZ Stage Controls Reference Cluster:XZ Stage Active"=w3, "XZ Stage Controls Reference Cluster:Activate XZ Stage"=w4, "XZ Stage Controls Reference Cluster:Set Position"=w5, "XZ Stage Controls Reference Cluster:Cell Label"=w6, "XZ Stage Controls Reference Cluster:Release XZ Stage"=w7, "XZ Stage Controls Reference Cluster:XZ Coordinates"=w8, "XZ Stage Controls Reference Cluster:Custom Position"=w9, instance out=w1)
          Property Node(instance in=w3, "Value"=TRUE, error in=$"Error In") -> (error out=w10)
          Property Node(instance in=w4, "Disabled"=TRUE, error in=w10) -> (error out=w11)
          Property Node(instance in=w5, "Disabled"=FALSE, error in=w11) -> (error out=w12)
          Property Node(instance in=w6, "Disabled"=FALSE, error in=w12) -> (error out=w13)
          Property Node(instance in=w7, "Disabled"=FALSE, error in=w13) -> (error out=w14)
          Property Node(instance in=w9, "Disabled"=FALSE, error in=w14) -> ("Value"=w15, error out=w16)
          Not(x=w15) -> w17
          Property Node(instance in=w8, "Disabled"=w17, error in=w16) -> (error out=w2)
        }
        frame False {
          Property Node(instance in=$"Full Reference Cluster In") -> ("XZ Stage Controls Reference Cluster:XZ Stage Active"=w18, "XZ Stage Controls Reference Cluster:Activate XZ Stage"=w19, "XZ Stage Controls Reference Cluster:Set Position"=w20, "XZ Stage Controls Reference Cluster:Cell Label"=w21, "XZ Stage Controls Reference Cluster:Release XZ Stage"=w22, "XZ Stage Controls Reference Cluster:XZ Coordinates"=w23, "XZ Stage Controls Reference Cluster:Custom Position"=w24, instance out=w1)
          Property Node(instance in=w18, "Value"=FALSE, error in=$"Error In") -> (error out=w25)
          Property Node(instance in=w19, "Disabled"=FALSE, error in=w25) -> (error out=w26)
          Property Node(instance in=w20, "Disabled"=TRUE, error in=w26) -> (error out=w27)
          Property Node(instance in=w21, "Disabled"=TRUE, error in=w27) -> (error out=w28)
          Property Node(instance in=w22, "Disabled"=TRUE, error in=w28) -> (error out=w29)
          Property Node(instance in=w23, "Disabled"=TRUE, error in=w29) -> (error out=w30)
          Property Node(instance in=w24, "Disabled"=TRUE, error in=w30) -> (error out=w2)
        }
      }
    }
  }
  $"Error Out" <- w2
  $"Full Reference Cluster Out" <- w1
