vi "MRM Move To Cell Safely.gvi"   [LabVIEW NXG 5.0.0]
inputs:
  "Error In": error
  "Instrument Control Mega Cluster In": "Instrument Control Mega Cluster.gtype"
  "Cell Label": "XZ Stage Cell.gtype" = "L.01"
  "Misc Data Mega Cluster In": "Misc Data Mega Cluster.gtype"
outputs:
  "Error Out": error
  "Instrument Control Mega Cluster Out": "Instrument Control Mega Cluster.gtype"
types:
  "XZ Stage Cell.gtype" = enum{"L.01", "L.02", "L.03", "L.04", "L.05", "L.06", "L.07", "L.08", "L.09", "L.10", "L.11", "L.12", "R.01", "R.02", "R.03", "R.04", "R.05", "R.06", "R.07", "R.08", "R.09", "R.10", "R.11", "R.12"}
  "Full Reference Cluster.gtype" = cluster{"Enum Reference Cluster": "Enum Control Reference Cluster.gtype", "Boolean Reference Cluster": "Boolean Control Reference Cluster.gtype", "Numeric Reference Cluster": "Numeric Control Reference Cluster.gtype", "Numeric Cluster Reference Cluster": "Numeric Cluster Reference Cluster.gtype", "Path Reference Cluster": "Path Reference Cluster.gtype", "Cluster Reference Cluster": "Cluster Reference Cluster.gtype", "XZ Stage Controls Reference Cluster": "XZ Stage Controls Reference Cluster.gtype"}
  "Cell Naming Cluster.gtype" = cluster{"Cell Label": string, "Sample Prefix": string, "Author Initials": string, "Current Date": string, "Batch Name": string}
  T1 = cluster{"X Coordinate (mm)": f64, "Z Coordinate (mm)": f64, "Aprch Distance (mm)": f64}
  T2 = cluster{"X Coordinate (mm)": f64, "Z Coordinate (mm)": f64, "Vertical Spacing (mm)": f64, "Aprch Distance (mm)": f64, "Aprch Dstnc L.12 (mm)": f64}
  "XZ All Position Cluster.gtype" = cluster{"Diffusor Coordinates": T1, "Photodetector Coordinates": T1, "Cell R.01 Coordinates": T2}
  T3 = cluster{"Thorlabs Motor Serial Number File Path": path, "Default Data Saving Location": path}
  "Misc Data Mega Cluster.gtype" = cluster{"Full Reference Cluster": "Full Reference Cluster.gtype", "Cell Naming Cluster": "Cell Naming Cluster.gtype", "All XZ Position Cluster": "XZ All Position Cluster.gtype", "All Paths": T3}
  "Instrument Coms Info.gtype" = cluster{"Arduino Coms Info": "Arduino Detection cluster control.gtype", "Photodetector Names": string[], "Keythley Address": "VISA Instr", "Photodetector Detected?": bool, "Thorlabs Motors Detected?": bool, "Keithley Detected?": bool, "Thorlabs Motors Serial Number": "Thorlabs Motors Serial Number In.gtype", "Photodetector IVI session": "Ivi IviDefault", "Flame ID": string, "Flame Detected?": bool, "Flame Wrapper ID": u64}
  "Debugging Cluster.gtype" = cluster{"Debugging mode?": bool, "Initialize App": bool, "Insturment Debugging": "Insturment Debugging Cluster.gtype"}
  "Instrument Control Mega Cluster.gtype" = cluster{"Instruments Coms Info": "Instrument Coms Info.gtype", "Debugging Cluster": "Debugging Cluster.gtype"}
uses:
  Rainbow Measurement Setup::Side Functions::Instrument Control::Arduino::XZ Stage Arduino::XZ Y Safe Approach and Retract.gvi
  Rainbow Measurement Setup::Side Functions::Instrument Control::Arduino::XZ Stage Arduino::XZ Stage Label to Coordinates.gvi
  Rainbow Measurement Setup::Main Functions::Instruction Queue::Current State::FGV Current State.gvi
  Rainbow Measurement Setup::Side Functions::Instrument Control::Arduino::XZ Stage Arduino::XZ Stage Move to Position.gvi
  Rainbow Measurement Setup::Side Functions::Instrument Control::Arduino::Multiplexer Arduino::Set Cell Low level.gvi
diagram:
  case ($"Error In") {
    frame Error, Default {
      w1 = $"Error In"
      w2 = $"Instrument Control Mega Cluster In"
    }
    frame No Error {
      call "XZ Y Safe Approach and Retract.gvi"(Instrument Control Mega Cluster In=$"Instrument Control Mega Cluster In", Error In=$"Error In", Approach Operation="Retract", Misc Data Mega Cluster=$"Misc Data Mega Cluster In") -> (Instrument Control Mega Cluster Out=w3, Error Out=w4)
      Format Into String(errIn=w4, $"Cell Label") -> (outString=w5, errOut=w6)
      call "XZ Stage Label to Coordinates.gvi"(Cell Label=w5, Misc Data Mega Cluster In=$"Misc Data Mega Cluster In", Error In=w6) -> (XZ Coordinate Out=w7, Error Out=w8)
      Concatenate Strings("Moving Arduino to ", w5) -> w9
      call "FGV Current State.gvi"(Current State Instructions="Set Current Substate", Current Substate=w9, Error In=w8) -> (Error Out=w10)
      call "XZ Stage Move to Position.gvi"(Instrument Control Mega Cluster In=w3, Error In=w10, XZ Coordinate Cluster In=w7) -> (Instrument Control Mega Cluster Out=w11, Error Out=w12)
      call "XZ Y Safe Approach and Retract.gvi"(Instrument Control Mega Cluster In=w11, Cell Label=w5, Error In=w12, Approach Operation="Approach Cell", Misc Data Mega Cluster=$"Misc Data Mega Cluster In") -> (Instrument Control Mega Cluster Out=w13, Error Out=w14)
      call "Set Cell Low level.gvi"(Instrument Control Mega Cluster In=w13, Cell Label=w5, Error In=w14) -> (Instrument Control Mega Cluster Out=w2, Error Out=w1)
    }
  }
  $"Instrument Control Mega Cluster Out" <- w2
  $"Error Out" <- w1
