vi "MRM Move To Coordinate Safely.gvi"   [LabVIEW NXG 5.0.0]
inputs:
  "Error In": error
  "Instrument Control Mega Cluster In": "Instrument Control Mega Cluster.gtype"
  "Approach Operation": "XZ Approach Operation.gtype" = "Approach Cell"
  "Misc Data Mega Cluster In": "Misc Data Mega Cluster.gtype"
outputs:
  "Error Out": error
  "Instrument Control Mega Cluster Out": "Instrument Control Mega Cluster.gtype"
types:
  "Full Reference Cluster.gtype" = cluster{"Enum Reference Cluster": "Enum Control Reference Cluster.gtype", "Boolean Reference Cluster": "Boolean Control Reference Cluster.gtype", "Numeric Reference Cluster": "Numeric Control Reference Cluster.gtype", "Numeric Cluster Reference Cluster": "Numeric Cluster Reference Cluster.gtype", "Path Reference Cluster": "Path Reference Cluster.gtype", "Cluster Reference Cluster": "Cluster Reference Cluster.gtype", "XZ Stage Controls Reference Cluster": "XZ Stage Controls Reference Cluster.gtype"}
  "Cell Naming Cluster.gtype" = cluster{"Cell Label": string, "Sample Prefix": string, "Author Initials": string, "Current Date": string, "Batch Name": string}
  T1 = cluster{"X Coordinate (mm)": f64, "Z Coordinate (mm)": f64, "Aprch Distance (mm)": f64}
  T2 = cluster{"X Coordinate (mm)": f64, "Z Coordinate (mm)": f64, "Vertical Spacing (mm)": f64, "Aprch Distance (mm)": f64, "Aprch Dstnc L.12 (mm)": f64}
  "XZ All Position Cluster.gtype" = cluster{"Diffusor Coordinates": T1, "Photodetector Coordinates": T1, "Cell R.01 Coordinates": T2}
  T3 = cluster{"Thorlabs Motor Serial Number File Path": path, "Default Data Saving Location": path}
  "Misc Data Mega Cluster.gtype" = cluster{"Full Reference Cluster": "Full Reference Cluster.gtype", "Cell Naming Cluster": "Cell Naming Cluster.gtype", "All XZ Position Cluster": "XZ All Position Cluster.gtype", "All Paths": T3}
  "Instrument Coms Info.gtype" = cluster{"Arduino Coms Info": "Arduino Detection cluster control.gtype", "Photodetector Names": string[], "Keythley Address": "VISA Instr", "Photodetector Detected?": bool, "Thorlabs Motors Detected?": bool, "Keithley Detected?": bool, "Thorlabs Motors Serial Number": "Thorlabs Motors Serial Number In.gtype", "Photodetector IVI session": "Ivi IviDefault", "Flame ID": string, "Flame Detected?": bool, "Flame Wrapper ID": u64}
  "Debugging Cluster.gtype" = cluster{"Debugging mode?": bool, "Initialize App": bool, "Insturment Debugging": "Insturment Debugging Cluster.gtype"}
  "Instrument Control Mega Cluster.gtype" = cluster{"Instruments Coms Info": "Instrument Coms Info.gtype", "Debugging Cluster": "Debugging Cluster.gtype"}
  "XZ Approach Operation.gtype" = enum{"Retract", "Approach Cell", "Approach Photodetector", "Approach Diffusor"}
  "XZ Coordinate Cluster In.gtype" = cluster{"X Coordinate (mm)": f64, "Z Coordinate (mm)": f64}
uses:
  Rainbow Measurement Setup::Side Functions::Instrument Control::Arduino::XZ Stage Arduino::XZ Y Safe Approach and Retract.gvi
  Rainbow Measurement Setup::Main Functions::Instruction Queue::Current State::FGV Current State.gvi
  Rainbow Measurement Setup::Side Functions::Instrument Control::Arduino::XZ Stage Arduino::XZ Stage Move to Position.gvi
diagram:
  # This subVI moves the arduino to a selected location
  # first performing a retract and then an approach to prevent
  # the light pipe from being smashed
  case ($"Error In") {
    frame Error, Default {
      w1 = $"Error In"
      w2 = $"Instrument Control Mega Cluster In"
    }
    frame No Error {
      case ($"Approach Operation") {
        frame "Retract", Default {
          w3 = "XZ Coordinate Cluster In.gtype" {all zero or empty}
        }
        frame "Approach Photodetector" {
          Property Node(instance in=$"Misc Data Mega Cluster In") -> ("All XZ Position Cluster:Photodetector Coordinates:X Coordinate (mm)"=w4, "All XZ Position Cluster:Photodetector Coordinates:Z Coordinate (mm)"=w5)
          Property Node(instance in="XZ Coordinate Cluster In.gtype" {all zero or empty}, "X Coordinate (mm)"=w4, "Z Coordinate (mm)"=w5) -> (instance out=w3)
        }
        frame "Approach Diffusor" {
          Property Node(instance in=$"Misc Data Mega Cluster In") -> ("All XZ Position Cluster:Diffusor Coordinates:X Coordinate (mm)"=w6, "All XZ Position Cluster:Diffusor Coordinates:Z Coordinate (mm)"=w7)
          Property Node(instance in="XZ Coordinate Cluster In.gtype" {all zero or empty}, "X Coordinate (mm)"=w6, "Z Coordinate (mm)"=w7) -> (instance out=w3)
        }
      }
      call "XZ Y Safe Approach and Retract.gvi"(Instrument Control Mega Cluster In=$"Instrument Control Mega Cluster In", Error In=$"Error In", Approach Operation="Retract", Misc Data Mega Cluster=$"Misc Data Mega Cluster In") -> (Instrument Control Mega Cluster Out=w8, Error Out=w9)
      call "FGV Current State.gvi"(Current State Instructions="Set Current Substate", Current Substate="Moving Arduino to photodetector", Error In=w9) -> (Error Out=w10)
      call "XZ Stage Move to Position.gvi"(Instrument Control Mega Cluster In=w8, Error In=w10, XZ Coordinate Cluster In=w3) -> (Instrument Control Mega Cluster Out=w11, Error Out=w12)
      call "XZ Y Safe Approach and Retract.gvi"(Instrument Control Mega Cluster In=w11, Error In=w12, Approach Operation=$"Approach Operation", Misc Data Mega Cluster=$"Misc Data Mega Cluster In") -> (Instrument Control Mega Cluster Out=w2, Error Out=w1)
    }
  }
  $"Instrument Control Mega Cluster Out" <- w2
  $"Error Out" <- w1
