vi "XZ Locking Movement Subroutine.gvi"   [LabVIEW NXG 5.0.0]
inputs:
  "Error In": error
  "Instrument Coms Info": "Instrument Coms Info.gtype"
  "Debugging Cluster In": "Debugging Cluster.gtype"
  "Full Reference Cluster": "Full Reference Cluster.gtype"
  "XZ All Position Cluster": "XZ All Position Cluster.gtype" = {188, 30, 39, 70, 146, 32.6, 0}
outputs:
  "Error Out": error
  "Instrument Coms Out": "Instrument Coms Info.gtype"
  "Debugging Cluster Out": "Debugging Cluster.gtype"
types:
  T1 = cluster{"Element 1": "VISA Instr", "Element 2": string}
  "Arduino Detection cluster control.gtype" = cluster{"XZ Stage Arduino Address": "VISA Instr", "XZ Stage Arduino Detected?": bool, "Multiplexer Arduino Detected?": bool, "Multiplexer Arduino Address": "VISA Instr", "Arduinos List": T1[], "XZ Stage Log": string, "Multiplexer Log": string}
  "Thorlabs Motors Serial Number In.gtype" = cluster{"Thorlabs Blue Motor": string, "Thorlabs Red Motor": string, "Blue Motor Homed?": bool, "Red Motor Homed?": bool}
  "Instrument Coms Info.gtype" = cluster{"Arduino Coms Info": "Arduino Detection cluster control.gtype", "Photodetector Names": string[], "Keythley Address": "VISA Instr", "Photodetector Detected?": bool, "Thorlabs Motors Detected?": bool, "Keithley Detected?": bool, "Thorlabs Motors Serial Number": "Thorlabs Motors Serial Number In.gtype", "Photodetector IVI session": "Ivi IviDefault", "Flame ID": string, "Flame Detected?": bool, "Flame Wrapper ID": u64}
  "Insturment Debugging Cluster.gtype" = cluster{"Keithley": bool, "Arduinos": bool, "Thorlabs Motors": bool, "Photodetector": bool, "Flame Spectr": bool}
  "Debugging Cluster.gtype" = cluster{"Debugging mode?": bool, "Initialize App": bool, "Insturment Debugging": "Insturment Debugging Cluster.gtype"}
  "Enum Control Reference Cluster.gtype" = cluster{"Main Tab": "TabControl reference", "Rainbow Measurement tab": "TabControl reference", "Configuration tab": "TabControl reference", "Light Calibration tab": "TabControl reference", "SRM Plot Parameter Selector": "EnumSelector reference"}
  "Boolean Control Reference Cluster.gtype" = cluster{"Custem date": "CheckBox reference", "Label Info Missing Error": "BooleanControl reference"}
  "Numeric Control Reference Cluster.gtype" = cluster{"Beam Power Density": "IntensityGraph reference"[][], "Irradiance Calibration": "Graph reference"[]}
  "Numeric Cluster Reference Cluster.gtype" = cluster{"LPC Parameters": "Cluster reference", "Sweep Live Parameters LPC": "Cluster reference"}
  "Path Reference Cluster.gtype" = cluster{"Calibration Files Path": "PathSelector reference", "Default Data Saving Location": "PathSelector reference"}
  "Cluster Reference Cluster.gtype" = cluster{"Light Power Calibration": "Graph reference", "Light Power Calibration Data": "ArrayViewer reference", "Rainbow Sweep Parameters RSM": "Cluster reference", "Rainbow Sweep Param Selector MSpot": "Cluster reference", "MSpot Spectrum Calibration Parameters": "Cluster reference", "SRM Raw Plot Rainbow Sweep Selector": "ComboBoxSelector reference", "SRM Refined Plot Rainbow Sweep Types": "ComboBoxSelector reference", "SRM Specific Parameters": "Cluster reference", "Label Info Error Label": "StringControl reference", "Sample Comments": "StringControl reference", "Cell Number": "StringControl reference", "Author Initials": "ComboBoxSelector reference", "Batch Name": "StringControl reference", "IV Plot Out ": "Graph reference", "Sweep Live Parameters RSM": "Cluster reference", "Rainbow Sweep Parameters LPC": "Cluster reference", "XZ All Position Cluster": "Cluster reference"}
  "XZ Stage Controls Reference Cluster.gtype" = cluster{"Cell Label": "EnumSelector reference", "Custom Position": "BooleanControl reference", "Set Position": "BooleanControl reference", "XZ Stage Active": "BooleanControl reference", "Release XZ Stage": "BooleanControl reference", "XZ Coordinates": "Cluster reference", "Activate XZ Stage": "BooleanControl reference"}
  "Full Reference Cluster.gtype" = cluster{"Enum Reference Cluster": "Enum Control Reference Cluster.gtype", "Boolean Reference Cluster": "Boolean Control Reference Cluster.gtype", "Numeric Reference Cluster": "Numeric Control Reference Cluster.gtype", "Numeric Cluster Reference Cluster": "Numeric Cluster Reference Cluster.gtype", "Path Reference Cluster": "Path Reference Cluster.gtype", "Cluster Reference Cluster": "Cluster Reference Cluster.gtype", "XZ Stage Controls Reference Cluster": "XZ Stage Controls Reference Cluster.gtype"}
  T2 = cluster{"X Coordinate (mm)": f64, "Z Coordinate (mm)": f64}
  T3 = cluster{"X Coordinate (mm)": f64, "Z Coordinate (mm)": f64, "Vertical Spacing (mm)": f64}
  "XZ All Position Cluster.gtype" = cluster{"Diffusor Coordinates": T2, "Photodetector Coordinates": T2, "Cell R.01 Coordinates": T3}
uses:
  Rainbow Measurement Setup::Main Functions::Instruction Queue::Current State::FGV Current State.gvi
  Rainbow Measurement Setup::Side Functions::Instrument Control::Arduino::XZ Stage Arduino::XZ Stage Initialize And Home.gvi
  Rainbow Measurement Setup::Main Functions::XZ Stage Movements::Enable and Disable XZ Controls.gvi
  Rainbow Measurement Setup::Main Functions::XZ Stage Movements::Check Current tab is XZ Stage.gvi
  Rainbow Measurement Setup::Side Functions::Instrument Control::Arduino::XZ Stage Arduino::XZ Stage Label to Coordinates.gvi
  Rainbow Measurement Setup::Side Functions::Instrument Control::Arduino::XZ Stage Arduino::XZ Stage Move to Position.gvi
  Rainbow Measurement Setup::Side Functions::Global Abort::FGV Global Abort.gvi
diagram:
  # This SubVI Moves the XZ Stage to the desired position, which can be either a predetermined cell or a set of custom coordinates.
  case ($"Error In") {
    frame Error, Default {
      w1 = $"Error In"
      w2 = $"Instrument Coms Info"
      w3 = $"Debugging Cluster In"
    }
    frame No Error {
      call "FGV Current State.gvi"(Current State Instructions="Set Current State", Current State="Move XZ Stage", Error In=$"Error In") -> (Error Out=w4)
      call "XZ Stage Initialize And Home.gvi"(Instrument Coms Info In=$"Instrument Coms Info", Debugging Cluster In=$"Debugging Cluster In", Error In=w4) -> (Instrument Coms Info Out=w5, Debugging Cluster Out=w6, Error Out=w7)
      call "Enable and Disable XZ Controls.gvi"(Full Reference Cluster In=$"Full Reference Cluster", Error In=w7, Activate Arduino?=TRUE) -> (Full Reference Cluster Out=w8, Error Out=w9)
      s1 = w5  # shift register
      s2 = w6  # shift register
      s3 = w9  # shift register
      while {
        call "Check Current tab is XZ Stage.gvi"(Full Reference Cluster=w8, Error In=s3) -> (Full Reference Cluster Out=w10, Not in tab?=w11, Error Out=w12)
        Property Node(instance in=w10) -> ("XZ Stage Controls Reference Cluster:Set Position"=w13, "XZ Stage Controls Reference Cluster:Custom Position"=w14, "XZ Stage Controls Reference Cluster:Cell Label"=w15, "XZ Stage Controls Reference Cluster:XZ Coordinates"=w16, "XZ Stage Controls Reference Cluster:Release XZ Stage"=w17, instance out=w18)
        Property Node(instance in=w13, error in=w12) -> ("Value"=w19, error out=w20, instance out=w21)
        Property Node(instance in=w21, "Value"=FALSE, error in=w20) -> (error out=w22)
        Property Node(instance in=w17, error in=w22) -> ("Value"=w23, error out=w24, instance out=w25)
        Property Node(instance in=w25, "Value"=FALSE, error in=w24) -> (error out=w26)
        Property Node(instance in=w14, error in=w26) -> ("Value"=w27, error out=w28)
        Not(x=w27) -> w29
        Property Node(instance in=w16, "Disabled"=w29, error in=w28) -> ("Value"=w30, error out=w31)
        case (w19) {
          frame False, Default {
            w32 = s1
            w33 = s2
            w34 = w31
          }
          frame True {
            case (w27) {
              frame False, Default {
                Property Node(instance in=w15) -> ("Value"=w38)
                Format Into String(errIn=w31, w38) -> (outString=w39, errOut=w40)
                Concatenate Strings("Moving Arduino to ", w39) -> w37
                call "XZ Stage Label to Coordinates.gvi"(Cell Label=w39, XZ All Position Cluster=$"XZ All Position Cluster", Error In=w40) -> (XZ Coordinate Out=w36, Error Out=w35)
              }
              frame True {
                Property Node(instance in=w30) -> ("X Coordinate (mm)"=w41, "Z Coordinate (mm)"=w42, instance out=w36)
                Number To Fractional String(number=w41, precision (6)=1, use system decimal point (T)=FALSE) -> (F-format string=w43)
                Number To Fractional String(number=w42, precision (6)=1, use system decimal point (T)=FALSE) -> (F-format string=w44)
                Concatenate Strings("Moving Arduino to X =  ", w43, " mm, Z = ", w44, " mm") -> w37
                w35 = w31
              }
            }
            call "FGV Current State.gvi"(Current State Instructions="Set Current Substate", Current Substate=w37, Error In=w35) -> (Error Out=w45)
            call "XZ Stage Move to Position.gvi"(Instrument Coms Info In=s1, Debugging Cluster In=s2, Error In=w45, XZ Coordinate Cluster In=w36) -> (Instrument Coms Info Out=w32, Debugging Cluster Out=w33, Error Out=w34)
          }
        }
        call "FGV Global Abort.gvi"(Global Abort Instructions="Read Current State", Error In=w34) -> (Local Abort Out=w46, Global Abort Out=w47, Error Out=w48)
        Logical Or(w11, w46, w47, w23) -> w49
        Wait Until Next Multiple(multiple to wait=50)
        next s1 = w32
        next s2 = w33
        next s3 = w48
        stop if w49
      }
      call "Enable and Disable XZ Controls.gvi"(Full Reference Cluster In=w18, Error In=s3, Activate Arduino?=FALSE) -> (Error Out=w1)
      w2 = s1
      w3 = s2
    }
  }
  $"Instrument Coms Out" <- w2
  $"Debugging Cluster Out" <- w3
  $"Error Out" <- w1
