vi "Main Window.gvi"   [LabVIEW NXG 5.0.0]
panel controls:
  "Main Tab": i32
  "Light Calibration Tab": i32
  "New Spectrum Calibration": bool
  "Load Spectrum Calibration": bool
  "Save Spectrum Calibration": bool
  "Configuration Tab": i32
  "Abort Button": bool
  "Exit App Button": bool
  "Debugging Cluster": "Debugging Cluster.gtype"
  "Rainbow Measurement tab": i32
  "Instrument Coms Info": "Instrument Coms Info.gtype"
  "Rainbow Sweep Param Selector MSpot": "Rainbow Sweep Param Selector.gtype" = {0, 1100, 300, 1, 1, 0}
  "Check Dividing Wavelength Calibration": bool
  "New Dividing Wavelength Calibration": bool
  "Load Dividing Wavelength Calibration": bool
  "Desired MSpot Calibration Operation": "Calibration Operation Control.gtype" = "Check Calibration"
  "MSpot Sperctrum Calibration Parameters": "MSpot Spectrum Calibration Parameters.gtype" = {"Min Position (mm)"=0, "Max Position (mm)"=50, "Position step size (mm)"=0.1, "Manual Spectra?"=FALSE, "Flame Integration Time (us)"=1000, "Flame Scans to Average"=1000}
  "New Light Power Calibration": bool
  "Load Light Power Calibration": bool
  "Save Light Power Calibration": bool
  "Rainbow Sweep Parameters LPC": "Rainbow Sweep Param Selector.gtype" = {0, 900, 400, 1, 1, 0}
  "Default Data Saving Location": path = path "D:\\Rainbow Measurements"
  "Light Power Calibration Data": "Light Power Calibration Data.gtype"[]
  "Custom date": bool
  "Author Initials": string
  "Batch Name": string
  "Cell Number": string
  "Sample Comments": string
  "Label Info Error Label": string
  "Label Info Missing Error": bool
  "Acquire Single Rainbow Button": bool
  "Save Single Measurement": bool
  "Rainbow Sweep Parameters SRM": "Rainbow Sweep Param Selector.gtype" = {2, 810, 395, 10, 1, 0}
  "LPC Parameters": "Light power Calibration Parameters.gtype" = {"Powermeter Averages"=3, "Photodtctr Area (m^2)"=5.543e-05, "Only Full Spectrum"=TRUE}
  "SRM Raw Plot Rainbow Sweep Selector": string
  "SRM Refined Plot Rainbow Sweep Types": string
  "Save Coordinates": bool
  "Main Tab": i32 = 1
  "SRM Plot Parameter Selector": "SRM Refined Plot Parameter Selector.gtype" = "Efficiency (%)"
  "SRM Specific Parameters": "SRM Specific Parameters.gtype" = {"Max (V)"=0.6, "Min (V)"=-0.2, "V Points"=100, "Current Range (A)"=1, "Autorange"=TRUE, "Sweep Dir"=FALSE, "Current Averages"=3, "Max (A)"=1, "PLC Speed"=1, "Cell Area (m^2)"=5.8e-06, "Full Spctr Ref"=TRUE, "Sweep Speed"="Normal Sweep"}
  "Full Reference Cluster": "Full Reference Cluster.gtype"
  "Full Beam Multispectral Data Array": "Full MSpot Multispectral Data.gtype"[]
  "Activate XZ Stage": bool
  "Set Postion": bool
  "Release XZ Stage": bool
  "XZ Stage Active": bool
  "XZ Stage Cell": "XZ Stage Cell.gtype" = "L.01"
  "Custom Position": bool
  "Acquire Multiple Rainbow Button": bool
  "Load Multiple Measurement": bool
  "Save Multiple Measurement": bool
  "Rainbow Sweep Parameters MRM": "Rainbow Sweep Param Selector.gtype" = {0, 810, 400, 10, 1, 0}
  "MRM Current Raw Cell Plot": string
  "MRM Specific Parameters": "MRM Specific Parameters.gtype" = {"Max (V)"=1, "Min (V)"=-0.2, "V Points"=120, "Curr Range (A)"=0.1, "Sweep Dir"=FALSE, "Current Avg"=3, "Max (A)"=1, "PLC Speed"=1, "Cell Area (m^2)"=8e-06, "Autorange"=TRUE, "Full Spctr Ref"=TRUE, "Sweep Speed"="Normal Sweep"}
  "XZ All Position Cluster": "XZ All Position Cluster.gtype" = {159.5, 31, 29, 14, 64.5, 29.5, 71.8, 27.7, 5.6, 25, 25.5}
  "XZ Coordinate": "XZ Coordinate Cluster In.gtype"
  "Misc Data Mega Cluster": "Misc Data Mega Cluster.gtype" = {"Full Reference Cluster"={1751121935, 1715470411, 1721761855, 1729101873, 1717567559, 1696596006, 1728053299, 1723859003, 1719664707, 1702887450, 1684013118, 1694498858, 0, 1697644580, 1675624526, 1673527378, 1688207413, 1671430229, 1743781910, 1680867396, 1744830485, 1679818822, 1699741727, 1690304562, 1692401709, 1711276115, 1712324689, 1707081843, 1725956151, 1709178991, 1704984693, 1735393317, 1750073360, 1742733335, 1741684761, 1745879060, 1738539040, 1734344743, 1732247595, 1736441891, 1739587613, 1740636187, 1747976210, 1737490466, 1746927635, 1752170510, 1753219085, 1754267660, 1756364810, 1757413385, 1758461960, 1755316235, 1677721674}, "All XZ Position Cluster"={159.5, 31, 30.5, 13.9, 64.1, 31, 71.8, 27.7, 5.6, 26, 26.5}, "All Paths"={"Thorlabs Motor Serial Number File Path"=path "", "Default Data Saving Location"=path "D:\\Rainbow Measurements"}, "Cell Naming Cluster"={"Cell Label"="", "Sample Prefix"="test.210921.test.", "Author Initials"="test", "Current Date"="210921", "Batch Name"="test"}}
  "Instrument Control Mega Cluster": "Instrument Control Mega Cluster.gtype"
  "MSpot Mega Cluster": "MSpot Mega Cluster.gtype"
  "LPC Mega Cluster": "LPC Mega Cluster.gtype"
  "SRM Mega Cluster": "SRM Mega Cluster.gtype"
  "Photodetector Start Measurement": bool
  "Load Dividing Wavelength Fitted Data": bool
  "Set Cell": bool
  "Desired Cell": "XZ Stage Cell.gtype" = "L.01"
  "Cell to Measure": "XZ Stage Cell.gtype" = "L.01"
  "Rainbow Sweep Param Selector Beam PD": "Rainbow Sweep Param Selector.gtype" = {0, 1100, 300, 1, 1, 0}
  "Load Single Measurement": bool
  "MRM Cell Selector": "MRM Cell Selector.gtype"
  "MRM Cell Refined Plot Selector": string
  "MRM Raw Plot Rainbow Sweep Selector": string
  "Mask Calibration Start Measurement": bool
  "Smart Sweep Mega Cluster": "Smart Sweep Mega Cluster.gtype" = {"Sweep Parameters"={"Isc Rsh Sweep Points"=10, "Voc Rs Sweep Points"=10, "VImpp Rough Sweep Points"=20, "VImpp Fine Sweep Points"=20, "Isc Rsh Sweep Direction"=FALSE, "Voc Rs Sweep Direction"=FALSE, "VImpp Rough Sweep Direction"=FALSE, "VImpp Fine Sweep Direction"=FALSE, "Isc Sweep Width (1=Voc)"=0.1, "Voc Sweep Height (1=Isc)"=0.1, "Vmpp Sweep Width Above (1=Voc)"=0.15, "Vmpp Sweep Width Below (1=Voc)"=0.2}, "Measurement Speed (1 PLC)"=1, "High Speed"=TRUE, "IV Data"={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}, "Rough Readings"={"Rough Vmpp (V)"=0, "Rough Isc (A)"=0, "Rough Voc (V)"=0, "Rough Jmpp (V)"=0, "Averages Rough Isc (A)"=10, "Averages Rough Voc (V)"=10}}
  "MRM Mega Cluster": "MRM Mega Cluster.gtype" = {"MRM Specific Parameters"={"V Points"=1, "Current Avg"=1, "Sweep Speed"="Smart Sweep"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}, "Cell Selector"={FALSE, FALSE, FALSE, FALSE, FALSE, FALSE, FALSE, FALSE, FALSE, FALSE, FALSE, FALSE, FALSE, FALSE, FALSE, FALSE, FALSE, FALSE, FALSE, FALSE, FALSE, FALSE, FALSE, FALSE, FALSE, FALSE, FALSE, FALSE}, "Cells to Measure Array"=[], "Rainbow Sweep Parameters MRM"={0, 900, 400, 1, 1, 0}, "MRM Data Array"=[]}
panel indicators:
  "Irradiance Calibration": f64[]
  "Current State": "Queue Instructions Control.gtype"
  "Current Sub State": string
  "Beam Power Density": f64[][]
  "Path Where the Calibration Files Will Be Stored (Can't Be Changed)": path
  "Light Power Calibration": cluster{"Wavelength": f64[], "Power": f64[]}[]
  "Current Date": string
  "Progress %": f64
  "Progress counter": f64
  "State": string
  "Substate": string
  "IV Plot Out": "SRM Single Plot Cluster.gtype"[]
  "SRM Full IV data Array": "IV Full Data Cluster.gtype"[]
  "IV Extracted Parameter Plot": T6
  "Sweep Live Parameters LPC": "LPC Sweep Live Parameters.gtype"
  "Sweep Live Parameters SRM": "SRM Sweep Live Parameters.gtype"
  "IV Plot Out Multiple": "SRM Single Plot Cluster.gtype"[]
  "Sample Prefix": string
  "Start": bool
  "SRM Light Power Density (W/m^2)": f64
  "Error Out": error
types:
  "Queue Instructions Control.gtype" = enum{"Undefined State", "Debug Check", "Initialize App", "Idle", "Light Power Calibration", "Rainbow Single Measurement", "Rainbow Multiple Measurement", "Light Calibration Irradiance", "Light Calibration Spectral Density", "Light Calibration Power Density", "Stand Alone Photodetector Measurement", "MSpot Spectrum Calibration", "Move XZ Stage", "Mask Calibration", "Change Cell", "Update All Info Meta Cluster", "Access TXT File", "Stop App", "State 2 ", "State 3 ", "State 4"}
  "Insturment Debugging Cluster.gtype" = cluster{"Keithley": bool, "Arduinos": bool, "Thorlabs Motors": bool, "Photodetector": bool, "Flame Spectr": bool}
  "Debugging Cluster.gtype" = cluster{"Debugging mode?": bool, "Initialize App": bool, "Insturment Debugging": "Insturment Debugging Cluster.gtype"}
  T1 = cluster{"Element 1": "VISA Instr", "Element 2": string}
  "Arduino Detection cluster control.gtype" = cluster{"XZ Stage Arduino Address": "VISA Instr", "XZ Stage Arduino Detected?": bool, "Multiplexer Arduino Detected?": bool, "Multiplexer Arduino Address": "VISA Instr", "Arduinos List": T1[], "XZ Stage Log": string, "Multiplexer Log": string, "XZ Homed?": bool}
  "Thorlabs Motors Serial Number In.gtype" = cluster{"Thorlabs Blue Motor": string, "Thorlabs Red Motor": string, "Blue Motor Homed?": bool, "Red Motor Homed?": bool}
  "Instrument Coms Info.gtype" = cluster{"Arduino Coms Info": "Arduino Detection cluster control.gtype", "Photodetector Names": string[], "Keythley Address": "VISA Instr", "Photodetector Detected?": bool, "Thorlabs Motors Detected?": bool, "Keithley Detected?": bool, "Thorlabs Motors Serial Number": "Thorlabs Motors Serial Number In.gtype", "Photodetector IVI session": "Ivi IviDefault", "Flame ID": string, "Flame Detected?": bool, "Flame Wrapper ID": u64}
  "Raibow Sweep Selector.gtype" = enum{"Red Sweep", "Blue Sweep", "Full Sweep Red First", "Full Sweep Blue First"}
  T2 = enum{"Red Sweep Closing", "Red Sweep Opening", "Red Sweep Both Ways"}
  T3 = enum{"Blue Sweep Opening", "Blue Sweep Closing", "Blue Sweep Both Ways"}
  "Rainbow Sweep Type Selector.gtype" = cluster{"Red Sweep Mode": T2, "Blue Sweep Mode": T3}
  "Rainbow Sweep Param Selector.gtype" = cluster{"Raibow Sweep Selector": "Raibow Sweep Selector.gtype", "Max Wavelength (nm)": f64, "Min Wavelength (nm)": f64, "Wavelength Step (nm)": f64, "Rainbow Sweep Type Selector": "Rainbow Sweep Type Selector.gtype"}
  "Calibration Operation Control.gtype" = enum{"Check Calibration", "Load Calibration", "New Calibration", "Load Fityc Data"}
  "MSpot Spectrum Calibration Parameters.gtype" = cluster{"Min Position (mm)": f64, "Max Position (mm)": f64, "Position step size (mm)": f64, "Manual Spectra?": bool, "Flame Integration Time (us)": f64, "Flame Scans to Average": u32}
  T4 = cluster{"Dividing Wavelength Array": f64[], "Measured Power Array": f64[], "Power Density Array": f64[]}
  "Rainbow Sweep Types.gtype" = enum{"Red Sweep Closing", "Red Sweep Opening", "Blue Sweep Closing", "Blue Sweep Opening"}
  "Light Power Calibration Data.gtype" = cluster{"Single Light Calibration": T4, "Rainbow Sweep Types": "Rainbow Sweep Types.gtype", "Total Light Power Density (W/m^2)": f64}
  "SRM Single Plot Cluster.gtype" = cluster{"Voltage (V)": f64[], "Current Density (A/m^2)": f64[]}
  "Light power Calibration Parameters.gtype" = cluster{"Powermeter Averages": u32, "Photodtctr Area (m^2)": f64, "Only Full Spectrum": bool}
  T5 = cluster{"Isc (A)": f64, "Voc (V)": f64, "FF (%)": f64, "Rs (Ω)": f64, "Rsh (Ω)": f64}
  "IV Single Measurement.gtype" = cluster{"Voltage (V)": f64[], "Current (A)": f64[], "Current Density (A/m^2)": f64[], "Dividing Wavelength (nm)": f64, "Light Power Density (W/m^2)": f64, "Total Light Power Density (W/m^2)": f64, "Smart Sweep Data": T5}
  "IV Refined Full Sweep Data.gtype" = cluster{"Rs (Ω · m^2)": f64[], "Rsh (Ω · m^2)": f64[], "Jsc (A/m^2)": f64[], "Voc (V)": f64[], "FF (%)": f64[], "Efficiency (%)": f64[], "Dividing Wavelength (nm)": f64[], "Light Power Density (W/m^2)": f64[]}
  "IV Full Data Cluster.gtype" = cluster{"IV Measurements Array": "IV Single Measurement.gtype"[], "Rainbow Sweep Types": "Rainbow Sweep Types.gtype", "IV Refined Data": "IV Refined Full Sweep Data.gtype", "Total Light Power Density (W/m^2)": f64}
  T6 = cluster{"Dividing Wavelength (nm)": f64[], "Element 2": f64[]}
  "LPC Sweep Live Parameters.gtype" = cluster{"Light Power Density (W/m^2) ": f64, "Current Wavelength (nm)": f64, "Rainbow Sweep Types": "Rainbow Sweep Types.gtype"}
  "SRM Refined Plot Parameter Selector.gtype" = enum{"Efficiency (%)", "Jsc (A / m^2)", "Voc (V)", "Light Power Density (W/m^2)", "FF (%)", "Rs (Ω · m^2)", "Rsh (Ω · m^2)"}
  "Sweep Speed Selector.gtype" = enum{"Smart Sweep", "Fast Sweep", "Normal Sweep"}
  "SRM Specific Parameters.gtype" = cluster{"Max (V)": f64, "Min (V)": f64, "V Points": u32, "Current Range (A)": f64, "Autorange": bool, "Sweep Dir": bool, "Current Averages": u32, "Max (A)": f64, "PLC Speed": f64, "Cell Area (m^2)": f64, "Full Spctr Ref": bool, "Sweep Speed": "Sweep Speed Selector.gtype"}
  T7 = cluster{"SRM Light Power Density Ref": "NumericTextBoxDouble reference", "Rainbow Sweep Parameters RSM": "Cluster reference", "SRM Refined Plot Rainbow Sweep Types": "ComboBoxSelector reference", "Sweep Live Parameters RSM": "Cluster reference", "SRM Raw Plot Rainbow Sweep Selector": "ComboBoxSelector reference", "SRM Plot Parameter Selector Ref": "EnumSelector reference", "IV Plot Out Ref": "Graph reference", "SRM Specific Parameters": "Cluster reference"}
  T8 = cluster{"Calibration Files Path": "PathSelector reference", "Default Data Saving Location": "PathSelector reference"}
  T9 = cluster{"Main Tab": "TabControl reference", "Rainbow Measurement tab": "TabControl reference", "Configuration tab": "TabControl reference", "Light Calibration tab": "TabControl reference"}
  T10 = cluster{"Custom date": "CheckBox reference", "Batch Name": "StringControl reference", "Author Initials": "ComboBoxSelector reference", "Cell Number": "StringControl reference", "Current Date": "StringControl reference", "Sample Comments": "StringControl reference", "Sample Prefix": "StringControl reference", "Label Info Missing Error": "BooleanControl reference", "Label Info Error Label": "StringControl reference"}
  T11 = cluster{"Beam Power Density": "IntensityGraph reference"[][], "Irradiance Calibration": "Graph reference"[], "MSpot Spectrum Calibration Parameters": "Cluster reference", "Rainbow Sweep Param Selector MSpot": "Cluster reference"}
  T12 = cluster{"LPC Parameters Ref": "Cluster reference", "Sweep Live Parameters LPC ref": "Cluster reference", "Light Power Calibration": "Graph reference", "Light Power Calibration Data Ref": "ArrayViewer reference", "Rainbow Sweep Parameters LPC": "Cluster reference"}
  T13 = cluster{"Current State Ref": "EnumSelector reference", "Substate": "StringControl reference", "State": "StringControl reference", "Current Substate": "StringControl reference"}
  T14 = cluster{"Custom Position": "BooleanControl reference", "Set Position": "BooleanControl reference", "XZ Stage Active": "BooleanControl reference", "Release XZ Stage": "BooleanControl reference", "XZ Coordinates": "Cluster reference", "Activate XZ Stage": "BooleanControl reference", "XZ Stage Cell Reference": "EnumSelector reference", "XZ All Position Cluster Ref": "Cluster reference"}
  T15 = cluster{"IV Extracted Parameter Plot ": "Graph reference", "MRM Cell Selector Ref": "Cluster reference", "IV Plot Out Multiple Reference": "Graph reference", "Rainbow Sweep Parameters MRM Ref": "Cluster reference", "MRM Cell Refined Plot Selector ref": "ComboBoxSelector reference", "MRM Current Raw Cell Plot": "ComboBoxSelector reference", "MRM Raw Plot Rainbow Sweep Relector Ref": "ComboBoxSelector reference", "MRM Specific Parameters Ref": "Cluster reference"}
  T16 = cluster{"Smart Sweep Mega Cluster Ref": "Cluster reference"}
  "Full Reference Cluster.gtype" = cluster{"SRM Reference Cluster": T7, "Path Reference Cluster": T8, "Tab Reference Cluster": T9, "Cell Naming Parameters Ref Cluster": T10, "One Time Calibrations Ref Cluster": T11, "LPC Controls Reference Cluster": T12, "System Parameters Ref Cluster": T13, "XZ Stage Controls Reference Cluster": T14, "MRM Reference Cluster": T15, "Other Parameters Cluster": T16}
  "SRM Sweep Live Parameters.gtype" = cluster{"Current Wavelength (nm)": f64, "Rainbow Sweep Types": "Rainbow Sweep Types.gtype", "Finished Measurement?": bool}
  "MSpot Spectrum Data.gtype" = cluster{"M Spot Spectrum": cluster{"Wavelength": f64[], "Counts": f64[]}, "Blue Motor Position (mm)": f64, "Red Motor Position (mm)": f64, "Dividing Wavelength (nm)": f64}
  "Full MSpot Multispectral Data.gtype" = cluster{"MSpot Spectrum Data Array": "MSpot Spectrum Data.gtype"[], "Rainbow Sweep Types": "Rainbow Sweep Types.gtype"}
  "XZ Stage Cell.gtype" = enum{"L.01", "L.02", "L.03", "L.04", "L.05", "L.06", "L.07", "L.08", "L.09", "L.10", "L.11", "L.12", "R.01", "R.02", "R.03", "R.04", "R.05", "R.06", "R.07", "R.08", "R.09", "R.10", "R.11", "R.12"}
  "MRM Specific Parameters.gtype" = cluster{"Max (V)": f64, "Min (V)": f64, "V Points": u32, "Curr Range (A)": f64, "Sweep Dir": bool, "Current Avg": u32, "Max (A)": f64, "PLC Speed": f64, "Cell Area (m^2)": f64, "Autorange": bool, "Full Spctr Ref": bool, "Sweep Speed": "Sweep Speed Selector.gtype"}
  T17 = cluster{"X Coordinate (mm)": f64, "Z Coordinate (mm)": f64, "Aprch Distance (mm)": f64}
  T18 = cluster{"X Coordinate (mm)": f64, "Z Coordinate (mm)": f64, "Vertical Spacing (mm)": f64, "Aprch Distance (mm)": f64, "Aprch Dstnc L.12 (mm)": f64}
  "XZ All Position Cluster.gtype" = cluster{"Diffusor Coordinates": T17, "Photodetector Coordinates": T17, "Cell R.01 Coordinates": T18}
  "XZ Coordinate Cluster In.gtype" = cluster{"X Coordinate (mm)": f64, "Z Coordinate (mm)": f64}
  T19 = cluster{"Thorlabs Motor Serial Number File Path": path, "Default Data Saving Location": path}
  "Cell Naming Cluster.gtype" = cluster{"Cell Label": string, "Sample Prefix": string, "Author Initials": string, "Current Date": string, "Batch Name": string}
  "Misc Data Mega Cluster.gtype" = cluster{"Full Reference Cluster": "Full Reference Cluster.gtype", "All XZ Position Cluster": "XZ All Position Cluster.gtype", "All Paths": T19, "Cell Naming Cluster": "Cell Naming Cluster.gtype"}
  "Instrument Control Mega Cluster.gtype" = cluster{"Instruments Coms Info": "Instrument Coms Info.gtype", "Debugging Cluster": "Debugging Cluster.gtype"}
  "MSpot Mega Cluster.gtype" = cluster{"Rainbow Sweep Parameters MSpot": "Rainbow Sweep Param Selector.gtype", "MSpot Sperctrum Calibration Parameters": "MSpot Spectrum Calibration Parameters.gtype", "Full Beam Multispectral Data Array": "Full MSpot Multispectral Data.gtype"[]}
  "LPC Mega Cluster.gtype" = cluster{"Rainbow Sweep Parameters LPC": "Rainbow Sweep Param Selector.gtype", "LPC Specific Parameters": "Light power Calibration Parameters.gtype", "Light Power Calibration Data": "Light Power Calibration Data.gtype"[]}
  "IV Full Raw Data.gtype" = cluster{"Rainbow Sweep Types": "Rainbow Sweep Types.gtype", "IV Raw Data Array": "IV Single Measurement.gtype"[]}
  "SRM Mega Cluster.gtype" = cluster{"SRM Specific Parameters": "SRM Specific Parameters.gtype", "Rainbow Sweep Parameters SRM": "Rainbow Sweep Param Selector.gtype", "SRM Full IV data Array": "IV Full Data Cluster.gtype"[], "Full IV Curve Raw Data": "IV Full Raw Data.gtype"[]}
  T20 = cluster{"L.01": bool, "R.01": bool, "L.02": bool, "R.02": bool, "L.03": bool, "R.03": bool, "L.04": bool, "R.04": bool, "L.05": bool, "R.05": bool, "L.06": bool, "R.06": bool, "L.07": bool, "R.07": bool, "L.08": bool, "R.08": bool, "L.09": bool, "R.09": bool, "L.10": bool, "R.10": bool, "L.11": bool, "R.11": bool, "L.12": bool, "R.12": bool}
  "MRM Cell Selector.gtype" = cluster{"All": bool, "Left": bool, "Right": bool, "Cell Cluster": T20, "Reset": bool}
  T21 = cluster{"Isc Rsh Sweep Points": u32, "Voc Rs Sweep Points": u32, "VImpp Rough Sweep Points": u32, "VImpp Fine Sweep Points": u32, "Isc Rsh Sweep Direction": bool, "Voc Rs Sweep Direction": bool, "VImpp Rough Sweep Direction": bool, "VImpp Fine Sweep Direction": bool, "Isc Sweep Width (1=Voc)": f64, "Voc Sweep Height (1=Isc)": f64, "Vmpp Sweep Width Above (1=Voc)": f64, "Vmpp Sweep Width Below (1=Voc)": f64}
  T22 = cluster{"Isc (A)": f64, "Voc (V)": f64, "FF (%)": f64, "Rs (Ω)": f64, "Rsh (Ω)": f64, "Voltage Array (V)": f64[], "Current Array (A)": f64[]}
  T23 = cluster{"Rough Vmpp (V)": f64, "Rough Isc (A)": f64, "Rough Voc (V)": f64, "Rough Jmpp (V)": f64, "Averages Rough Isc (A)": u32, "Averages Rough Voc (V)": u32}
  "Smart Sweep Mega Cluster.gtype" = cluster{"Sweep Parameters": T21, "Measurement Speed (1 PLC)": f64, "High Speed": bool, "IV Data": T22, "Rough Readings": T23}
  "Selected Cells Array.gtype" = "XZ Stage Cell.gtype"[]
  T24 = enum{"L.01", "L.02", "L.03", "L.04", "L.05", "L.06", "L.07", "L.08", "L.09", "L.10", "L.11", "L.12", "R.01", "R.02", "R.03", "R.04", "R.05", "R.06", "R.07", "R.08", "R.09", "R.10", "R.11", "R.12"}
  "MRM Full Data From SRM Cluster.gtype" = cluster{"SRM Mega Cluster": "SRM Mega Cluster.gtype", "Cell Label": T24}
  "MRM Mega Cluster.gtype" = cluster{"MRM Specific Parameters": "MRM Specific Parameters.gtype", "Cell Selector": "MRM Cell Selector.gtype", "Cells to Measure Array": "Selected Cells Array.gtype", "Rainbow Sweep Parameters MRM": "Rainbow Sweep Param Selector.gtype", "MRM Data Array": "MRM Full Data From SRM Cluster.gtype"[]}
uses:
  Rainbow Measurement Setup::Main Functions::Initialize App::Reference Clusters::Cell Naming Reference Bundle.gvi
  Rainbow Measurement Setup::Main Functions::Initialize App::Reference Clusters::LPC Controls Reference Bundle.gvi
  Rainbow Measurement Setup::Main Functions::Initialize App::Reference Clusters::MRM Reference Bundle.gvi
  Rainbow Measurement Setup::Main Functions::Initialize App::Reference Clusters::One Time Calibration Reference Bundle.gvi
  Rainbow Measurement Setup::Main Functions::Initialize App::Reference Clusters::Path Reference Bundle.gvi
  Rainbow Measurement Setup::Main Functions::Initialize App::Reference Clusters::SRM Reference Bundle.gvi
  Rainbow Measurement Setup::Main Functions::Initialize App::Reference Clusters::System Parameters Reference Bundle.gvi
  Rainbow Measurement Setup::Main Functions::Initialize App::Reference Clusters::Tab Reference Bundle.gvi
  Rainbow Measurement Setup::Main Functions::Initialize App::Reference Clusters::XZ Stage Reference Bundle.gvi
  Rainbow Measurement Setup::Side Functions::Global Abort::FGV Global Abort.gvi
  Rainbow Measurement Setup::Main Functions::Instruction Queue::Current State::FGV Current State.gvi
  Rainbow Measurement Setup::Main Functions::Debugging::Debugging Prompt.gvi
  Rainbow Measurement Setup::Main Functions::Initialize App::Initialize app subroutine.gvi
  Rainbow Measurement Setup::Side Functions::Utilities::Progress Handling::Progress FGV.gvi
  Rainbow Measurement Setup::Main Functions::One Time Calibrations::MSpot Spectrum::MSpot Spectrum Calibration Subroutine.gvi
  Rainbow Measurement Setup::Main Functions::Rainbow Measurement::Light Power Calibration::Light Power Calibration Subroutine.gvi
  Rainbow Measurement Setup::Main Functions::XZ Stage Movements::XZ Locking Movement Subroutine.gvi
  Rainbow Measurement Setup::Side Functions::Instrument Control::Arduino::Multiplexer Arduino::Mux Set Cell Subroutine.gvi
  Rainbow Measurement Setup::Side Functions::Instrument Control::Photodetector::Photodetector Stand Alone Subroutine.gvi
  Rainbow Measurement Setup::Main Functions::One Time Calibrations::MSpot Spectrum::Mask calibration::Mask Calibration Subroutine Debug Check.gvi
  Rainbow Measurement Setup::Main Functions::Rainbow Measurement::Cell Single Rainbow Measurement::Single Rainbow Measurement Subroutine.gvi
  Rainbow Measurement Setup::Main Functions::Rainbow Measurement::Cell Multiple Rainbow Measurement::Multiple Rainbow Measurement Subroutine.gvi
  NI::G Core::Error::Is Error.gvi
  Rainbow Measurement Setup::Side Functions::Global Abort::Global Abort Sequence.gvi
  Rainbow Measurement Setup::Side Functions::Timeout Subroutines::Timeout Sequence.gvi
  Rainbow Measurement Setup::Side Functions::Timeout Subroutines::Timeout Read FGV Data Subroutine.gvi
  Rainbow Measurement Setup::Side Functions::Exit App Sequence.gvi
  Rainbow Measurement Setup::Main Functions::Instruction Queue::Check Queue And Label.gvi
  Rainbow Measurement Setup::Main Functions::Instruction Queue::Conditional Enqueue.gvi
  Rainbow Measurement Setup::Main Functions::One Time Calibrations::MSpot Spectrum::MSpot Calibration Operation Translator.gvi
  Rainbow Measurement Setup::Side Functions::Sample Naming::Sample Name Checkup Subroutine.gvi
  Rainbow Measurement Setup::Side Functions::Sample Naming::Sample Prefix FGV.gvi
  Rainbow Measurement Setup::Main Functions::Rainbow Measurement::Light Power Calibration::Light Power Calibration Operation Translator.gvi
  Rainbow Measurement Setup::Main Functions::Rainbow Measurement::Cell Single Rainbow Measurement::SRM Operation Translator.gvi
  Rainbow Measurement Setup::Main Functions::Rainbow Measurement::Cell Multiple Rainbow Measurement::MRM Cell Selector::MRM Check any cell selected.gvi
  Rainbow Measurement Setup::Main Functions::Rainbow Measurement::Cell Multiple Rainbow Measurement::MRM Operation Translator.gvi
  Rainbow Measurement Setup::Side Functions::Instrument Control::Arduino::XZ Stage Arduino::XZ Move Requisites.gvi
  Rainbow Measurement Setup::Side Functions::Timeout Subroutines::Update Controls Subroutine.gvi
  Rainbow Measurement Setup::Side Functions::Instrument Control::Arduino::Multiplexer Arduino::Set Cell Requisites.gvi
  Rainbow Measurement Setup::Side Functions::Provisional Cell Selection FGV.gvi
  Rainbow Measurement Setup::Main Functions::Rainbow Measurement::Cell Multiple Rainbow Measurement::MRM Cell Selector::MRM Cell Updater.gvi
  Rainbow Measurement Setup::Side Functions::Timeout Subroutines::Update MRM Controls.gvi
  Rainbow Measurement Setup::Side Functions::Instrument Control::Keithley::Smart Sweep::FGV Smart Sweep Parameters.gvi
  NI::G Core::Error::Multiplex Errors.gvi
  NI::G Core::Error::Display Error.gvi
diagram:
  case (TRUE) {
    frame False, Default {
      w1 = no error
    }
    frame True {
      w2 = reference to "Path Where the Calibration Files Will Be Stored (Can't Be Changed)"
      call "Cell Naming Reference Bundle.gvi"(Custom date=reference to "Custom date", Batch Name=reference to "Batch Name", Author Initials=reference to "Author Initials", Cell Number=reference to "Cell Number", Current Date=reference to "Current Date", Sample Comments=reference to "Sample Comments", Sample Prefix=reference to "Sample Prefix", Label Info Missing Error=reference to "Label Info Missing Error", Label Info Error Label=reference to "Label Info Error Label", Full Reference Cluster In="Full Reference Cluster.gtype" {all zero or empty}) -> (Error Out=w3, Full Reference Cluster Out=w4)
      call "LPC Controls Reference Bundle.gvi"(LPC Parameters Ref=reference to "LPC Parameters", Sweep Live Parameters LPC ref=reference to "Sweep Live Parameters LPC", Light Power Calibration=reference to "Light Power Calibration", Light Power Calibration Data Ref=reference to "Light Power Calibration Data", Rainbow Sweep Parameters LPC=reference to "Rainbow Sweep Parameters LPC", Error In=w3, Full Reference Cluster In=w4) -> (Error Out=w5, Full Reference Cluster Out=w6)
      call "MRM Reference Bundle.gvi"(IV Extracted Parameter Plot=reference to "IV Extracted Parameter Plot", MRM Cell Selector Ref=reference to "MRM Cell Selector", IV Plot Out Multiple Reference=reference to "IV Plot Out Multiple", Rainbow Sweep Parameters MRM Ref=reference to "Rainbow Sweep Parameters MRM", MRM Specific Parameters Ref=reference to "MRM Specific Parameters", MRM Cell Refined Plot Selector ref=reference to "MRM Cell Refined Plot Selector", MRM Current Raw Cell Plot=reference to "MRM Current Raw Cell Plot", MRM Raw Plot Rainbow Sweep Relector Ref=reference to "MRM Raw Plot Rainbow Sweep Selector", Error In=w5, Full Reference Cluster In=w6) -> (Error Out=w7, Full Reference Cluster Out=w8)
      call "One Time Calibration Reference Bundle.gvi"(Beam Power Density=reference to "Beam Power Density", Irradiance Calibration=reference to "Irradiance Calibration", MSpot Spectrum Calibration Parameters=reference to "MSpot Sperctrum Calibration Parameters", Rainbow Sweep Param Selector MSpot=reference to "Rainbow Sweep Param Selector MSpot", Error In=w7, Full Reference Cluster In=w8) -> (Error Out=w9, Full Reference Cluster Out=w10)
      call "Path Reference Bundle.gvi"(Calibration Files Path=w2, Default Data Saving Location=reference to "Default Data Saving Location", Error In=w9, Full Reference Cluster In=w10) -> (Error Out=w11, Full Reference Cluster Out=w12)
      call "SRM Reference Bundle.gvi"(SRM Light Power Density Ref=reference to "SRM Light Power Density (W/m^2)", Rainbow Sweep Parameters RSM=reference to "Rainbow Sweep Parameters SRM", SRM Refined Plot Rainbow Sweep Types=reference to "SRM Refined Plot Rainbow Sweep Types", SRM Specific Parameters=reference to "SRM Specific Parameters", Sweep Live Parameters RSM=reference to "Sweep Live Parameters SRM", SRM Raw Plot Rainbow Sweep Selector=reference to "SRM Raw Plot Rainbow Sweep Selector", SRM Plot Parameter Selector Ref=reference to "SRM Plot Parameter Selector", IV Plot Out Ref=reference to "IV Plot Out", Error In=w11, Full Reference Cluster In=w12) -> (Error Out=w13, Full Reference Cluster Out=w14)
      call "System Parameters Reference Bundle.gvi"(Current State Ref=reference to "Current State", Substate=reference to "Substate", State=reference to "State", Current Substate=reference to "Current Sub State", Error In=w13, Full Reference Cluster In=w14) -> (Error Out=w15, Full Reference Cluster Out=w16)
      call "Tab Reference Bundle.gvi"(Main Tab=reference to "Main Tab", Rainbow Measurement Tab=reference to "Rainbow Measurement tab", Configuration Tab=reference to "Configuration Tab", Light Calibration Tab=reference to "Light Calibration Tab", Error In=w15, Full Reference Cluster In=w16) -> (Error Out=w17, Full Reference Cluster Out=w18)
      call "XZ Stage Reference Bundle.gvi"(Custom Position=reference to "Custom Position", Set Position=reference to "Set Postion", XZ Stage Active=reference to "XZ Stage Active", Release XZ Stage=reference to "Release XZ Stage", XZ Coordinates=reference to "XZ Coordinate", Activate XZ Stage=reference to "Activate XZ Stage", XZ Stage Cell Reference=reference to "XZ Stage Cell", XZ All Position Cluster Ref=reference to "XZ All Position Cluster", Error In=w17, Full Reference Cluster In=w18) -> (Error Out=w19, Full Reference Cluster Out=w20)
      Property Node(instance in=w20, "Other Parameters Cluster:Smart Sweep Mega Cluster Ref"=reference to "Smart Sweep Mega Cluster") -> (instance out=w21)
      Property Node(instance in=$"Misc Data Mega Cluster", "Full Reference Cluster"=w21) -> (instance out=w22)
      $"Misc Data Mega Cluster" <- w22
      Property Node(instance in=reference to "Start", "ValueSignaling"=TRUE, error in=w19) -> (error out=w1)
    }
  }
  call "FGV Global Abort.gvi"(Global Abort Instructions="Reset State", Error In=w1) -> (Error Out=w23)
  call "FGV Current State.gvi"(Current State Instructions="Set Current State and Substate", Current State="Undefined State", Current Substate="Starting Up", Error In=w23) -> (Error Out=w24)
  Obtain Queue(create if not found=TRUE, element data type="Queue Instructions Control.gtype" "Undefined State", error in=w24, name="Instruction Queue") -> (error out=w25, queue out=w26)
  Enqueue Element(element="Debug Check", error in=w25, queue=w26) -> (error out=w27, queue out=w28)
  # This is the main window it takes instructions from the main pannel introduced by the user and
  # performs the corresponding necessary actions
  s1 = w28  # shift register
  s2 = w27  # shift register
  while {
    # This is the consumer loop, it takes enqueued instructions and performs the ne required actions
    case (s2) {
      frame Error, Default {
        w29 = s2
        w30 = s1
        w31 = TRUE
      }
      frame No Error {
        Dequeue Element(error in=s2, queue=s1) -> (element=w32, error out=w33, queue out=w34)
        case (w32) {
          frame "Undefined State", Default {
            w29 = w33
            w30 = w34
            w31 = default
          }
          frame "Debug Check" {
            call "Debugging Prompt.gvi"(Instrument Control Mega Cluster In=$"Instrument Control Mega Cluster", Error In=w33) -> (Instrument Control Mega Cluster Out=w35, Error Out=w36)
            Enqueue Element(element="Initialize App", error in=w36, queue=w34) -> (error out=w29, queue out=w30)
            $"Instrument Control Mega Cluster" <- w35
            w31 = default
          }
          frame "Initialize App" {
            call "Initialize app subroutine.gvi"(Instrument Control Mega Cluster In=$"Instrument Control Mega Cluster", Misc Data Mega Cluster In=$"Misc Data Mega Cluster", Error In=w33) -> (Instrument Control Mega Cluster Out=w37, Misc Data Mega Cluster Out=w38, Error Out=w39)
            $"Instrument Control Mega Cluster" <- w37
            $"Misc Data Mega Cluster" <- w38
            Enqueue Element(element="Idle", error in=w39, queue=w34) -> (error out=w29, queue out=w30)
            w31 = default
          }
          frame "Idle" {
            call "FGV Global Abort.gvi"(Global Abort Instructions="Reset State", Error In=w33) -> (Error Out=w40)
            call "FGV Current State.gvi"(Current State Instructions="Set Current State and Substate", Current State="Idle", Current Substate="Idle", Error In=w40) -> (Error Out=w41)
            call "Progress FGV.gvi"(FGV Instructions="Reset State", Error In=w41) -> (Error Out=w29)
            w30 = w34
            w31 = default
          }
          frame "MSpot Spectrum Calibration" {
            call "MSpot Spectrum Calibration Subroutine.gvi"(Instrument Control Mega Cluster In=$"Instrument Control Mega Cluster", Misc Data Mega Cluster In=$"Misc Data Mega Cluster", MSpot Mega Cluster In=$"MSpot Mega Cluster", Error In=w33) -> (Instrument Control Mega Cluster Out=w42, Misc Data Mega Cluster Out=w43, MSpot Mega Cluster Out=w44, Error Out=w45)
            $"Instrument Control Mega Cluster" <- w42
            $"Misc Data Mega Cluster" <- w43
            $"MSpot Mega Cluster" <- w44
            Enqueue Element(element="Idle", error in=w45, queue=w34) -> (error out=w29, queue out=w30)
            w31 = default
          }
          frame "Light Power Calibration" {
            call "Light Power Calibration Subroutine.gvi"(Instrument Control Mega Cluster In=$"Instrument Control Mega Cluster", Misc Data Mega Cluster In=$"Misc Data Mega Cluster", LPC Mega Cluster In=$"LPC Mega Cluster", Error In=w33) -> (Instrument Control Mega Cluster Out=w46, Misc Data Mega Cluster Out=w47, LPC Mega Cluster Out=w48, Error Out=w49)
            $"Instrument Control Mega Cluster" <- w46
            $"Misc Data Mega Cluster" <- w47
            $"LPC Mega Cluster" <- w48
            Enqueue Element(element="Idle", error in=w49, queue=w34) -> (error out=w29, queue out=w30)
            w31 = default
          }
          frame "Move XZ Stage" {
            call "XZ Locking Movement Subroutine.gvi"(Instrument Control Mega Cluster In=$"Instrument Control Mega Cluster", Misc Data Mega Cluster In=$"Misc Data Mega Cluster", Error In=w33) -> (Instrument Control Mega Cluster Out=w50, Error Out=w51)
            Enqueue Element(element="Idle", error in=w51, queue=w34) -> (error out=w29, queue out=w30)
            $"Instrument Control Mega Cluster" <- w50
            w31 = default
          }
          frame "Change Cell" {
            call "Mux Set Cell Subroutine.gvi"(Instrument Control Mega Cluster In=$"Instrument Control Mega Cluster", Desired Cell=$"Desired Cell", Error In=w33) -> (Instrument Control Mega Cluster Out=w52, Error Out=w53)
            Enqueue Element(element="Idle", error in=w53, queue=w34) -> (error out=w29, queue out=w30)
            $"Instrument Control Mega Cluster" <- w52
            w31 = default
          }
          frame "Stand Alone Photodetector Measurement" {
            call "Photodetector Stand Alone Subroutine.gvi"(Instrument Control Mega Cluster In=$"Instrument Control Mega Cluster", Error In=w33) -> (Error Out=w54)
            Enqueue Element(element="Idle", error in=w54, queue=w34) -> (error out=w29, queue out=w30)
            w31 = default
          }
          frame "Mask Calibration" {
            call "Mask Calibration Subroutine Debug Check.gvi"(Instrument Control Mega Cluster In=$"Instrument Control Mega Cluster", Error In=w33) -> (Error Out=w29)
            w30 = w34
            w31 = default
          }
          frame "Rainbow Single Measurement" {
            call "Single Rainbow Measurement Subroutine.gvi"(Instruction Queue In=w34, Instrument Control Mega Cluster In=$"Instrument Control Mega Cluster", Misc Data Mega Cluster In=$"Misc Data Mega Cluster", LPC Mega Cluster In=$"LPC Mega Cluster", SRM Mega Cluster In=$"SRM Mega Cluster", Error In=w33, Stand Alone?=FALSE) -> (Instruction Queue Out=w55, Instrument Control Mega Cluster Out=w56, Misc Data Mega Cluster Out=w57, LPC Mega Cluster Out=w58, SRM Mega Cluster Out=w59, Error Out=w60)
            $"Instrument Control Mega Cluster" <- w56
            $"Misc Data Mega Cluster" <- w57
            $"LPC Mega Cluster" <- w58
            Enqueue Element(element="Idle", error in=w60, queue=w55) -> (error out=w29, queue out=w30)
            $"SRM Mega Cluster" <- w59
            w31 = default
          }
          frame "Rainbow Multiple Measurement" {
            call "Multiple Rainbow Measurement Subroutine.gvi"(Instruction Queue In=w34, Instrument Control Mega Cluster In=$"Instrument Control Mega Cluster", Misc Data Mega Cluster In=$"Misc Data Mega Cluster", LPC Mega Cluster In=$"LPC Mega Cluster", MRM Mega Cluster In=$"MRM Mega Cluster", Error In=w33) -> (Instruction Queue Out=w61, Instrument Control Mega Cluster Out=w62, Misc Data Mega Cluster Out=w63, LPC Mega Cluster Out=w64, MRM Mega Cluster Out=w65, Error Out=w66)
            $"Instrument Control Mega Cluster" <- w62
            $"Misc Data Mega Cluster" <- w63
            $"LPC Mega Cluster" <- w64
            Enqueue Element(element="Idle", error in=w66, queue=w61) -> (error out=w29, queue out=w30)
            $"MRM Mega Cluster" <- w65
            w31 = default
          }
          frame "Stop App" {
            call "FGV Current State.gvi"(Current State Instructions="Set Current State and Substate", Current State="Stop App", Current Substate="Bye Bye :D", Error In=w33) -> (Error Out=w29)
            w30 = w34
            w31 = TRUE
          }
        }
      }
    }
    call "Is Error.gvi"(error in=w29) -> (error?=w67)
    Logical Or(w67, w31) -> w68
    call "FGV Global Abort.gvi"(Global Abort Instructions="Set State", Global Abort=w68, Error In=w29) -> (Error Out=w69)
    next s1 = w30
    next s2 = w69
    stop if w68
  }
  s3 = w28  # shift register
  s4 = w27  # shift register
  while {
    event (timeout = 100) {
      on "Timeout" {
        call "FGV Global Abort.gvi"(Global Abort Instructions="Read Current State", Error In=s4) -> (Global Abort Out=w73, Error Out=w74)
        Preview Queue Element(error in=w74, queue=s3, timeout in ms=100) -> (element=w75, error out=w70, queue out=w71)
        Is Equal(x=w75, y="Stop App") -> w76
        Logical Or(w76, w73) -> w72
      }
      on "Abort Button" Value changed {
        call "Global Abort Sequence.gvi"(Queue In=s3, Global Abort=$"Abort Button", Error In=s4) -> (Queue Out=w71, Error Out=w70)
        w72 = default
      }
    }
    next s3 = w71
    next s4 = w70
    stop if w72
  }
  Enqueue Element(element="Stop App", error in=s4, queue=s3) -> (error out=w77)
  s5 = w28  # shift register
  s6 = w27  # shift register
  while {
    # This is the producer loop that takes the commands and if possible enqueues them so that the
    # slave loop can perform the corresponding actions
    event (timeout = 100) {
      on "Timeout" {
        call "Progress FGV.gvi"(FGV Instructions="Read State", Error In=s6) -> (Progress Out=w81, Error Out=w82)
        call "Timeout Sequence.gvi"(Queue In=s5, Misc Data Mega Cluster In=$"Misc Data Mega Cluster", Error In=w82) -> (Stop App?=w80, Queue Out=w78, Misc Data Mega Cluster Out=w83, Error Out=w84)
        call "Timeout Read FGV Data Subroutine.gvi"(Misc Data Mega Cluster In=w83, Error In=w84) -> (Misc Data Mega Cluster Out=w85, Error Out=w79)
        $"Misc Data Mega Cluster" <- w85
        $"Progress %" <- w81
        $"Progress counter" <- w81
      }
      on "Exit App Button" Value changed {
        call "Exit App Sequence.gvi"(Queue In=s5, Exit App=$"Exit App Button", Error In=s6) -> (Queue Out=w78, Error Out=w79)
        w80 = default
      }
      on "Check Dividing Wavelength Calibration" Value changed; "Load Dividing Wavelength Calibration" Value changed; "Load Dividing Wavelength Fitted Data" Value changed; "New Dividing Wavelength Calibration" Value changed {
        call "Check Queue And Label.gvi"(Error In=s6) -> (Proceed to enqueue=w86, Error Out=w87)
        call "Conditional Enqueue.gvi"(Queue In=s5, Queue Instruction In="MSpot Spectrum Calibration", Error Out=w87, Equeue?=w86) -> (Queue Out=w78, Error In=w88)
        call "MSpot Calibration Operation Translator.gvi"(Load Dividing Wavelength Fitted Data=$"Load Dividing Wavelength Fitted Data", Check Dividing Wavelength Calibration=$"Check Dividing Wavelength Calibration", New Dividing Wavelength Calibration=$"New Dividing Wavelength Calibration", Load Dividing Wavelength Calibration=$"Load Dividing Wavelength Calibration", Error In=w88) -> (Error Out=w79)
        w80 = default
      }
      on "Author Initials" Value changed; "Batch Name" Value changed; "Cell Number" Value changed; "Current Date" Value changed; "Custom date" Value changed; "Main Tab" Value changed; "Rainbow Measurement tab" Value changed; "Sample Comments" Value changed; "Sample Prefix" Value changed {
        call "Sample Name Checkup Subroutine.gvi"(Misc Data Mega Cluster In=$"Misc Data Mega Cluster", Error In=s6) -> (Misc Data Mega Cluster Out=w89, Error Out=w90)
        $"Misc Data Mega Cluster" <- w89
        call "Sample Prefix FGV.gvi"(FGV Instructions="Set State", Misc Data Mega Cluster=w89, Error In=w90) -> (Error Out=w79)
        w78 = s5
        w80 = default
      }
      on "New Light Power Calibration" Value changed; "Save Light Power Calibration" Value changed {
        call "Check Queue And Label.gvi"(Label Info Missing Error=$"Label Info Missing Error", Label Info Error Label=$"Label Info Error Label", Error In=s6, Is Label Necessary?=TRUE) -> (Proceed to enqueue=w91, Error Out=w92)
        call "Conditional Enqueue.gvi"(Queue In=s5, Queue Instruction In="Light Power Calibration", Error Out=w92, Equeue?=w91) -> (Queue Out=w78, Error In=w93)
        call "Light Power Calibration Operation Translator.gvi"(New Light Power Calibration=$"New Light Power Calibration", Load Light Power Calibration=FALSE, Save Light Power Calibration=$"Save Light Power Calibration", Error In=w93) -> (Error Out=w79)
        w80 = default
      }
      on "Load Light Power Calibration" Value changed {
        call "Check Queue And Label.gvi"(Label Info Missing Error=$"Label Info Missing Error", Label Info Error Label=$"Label Info Error Label", Error In=s6, Is Label Necessary?=FALSE) -> (Proceed to enqueue=w94, Error Out=w95)
        call "Conditional Enqueue.gvi"(Queue In=s5, Queue Instruction In="Light Power Calibration", Error Out=w95, Equeue?=w94) -> (Queue Out=w78, Error In=w96)
        call "Light Power Calibration Operation Translator.gvi"(New Light Power Calibration=FALSE, Load Light Power Calibration=$"Load Light Power Calibration", Save Light Power Calibration=FALSE, Error In=w96) -> (Error Out=w79)
        w80 = default
      }
      on "Acquire Single Rainbow Button" Value changed; "Save Single Measurement" Value changed {
        call "Check Queue And Label.gvi"(Label Info Missing Error=$"Label Info Missing Error", Label Info Error Label=$"Label Info Error Label", Error In=s6, Is Label Necessary?=TRUE) -> (Proceed to enqueue=w97, Error Out=w98)
        call "Conditional Enqueue.gvi"(Queue In=s5, Queue Instruction In="Rainbow Single Measurement", Error Out=w98, Equeue?=w97) -> (Queue Out=w78, Error In=w99)
        call "SRM Operation Translator.gvi"(Acquire Single Rainbow Button=$"Acquire Single Rainbow Button", Load Single Measurement=FALSE, Save Single Measurement=$"Save Single Measurement", Error In=w99) -> (Error Out=w79)
        w80 = default
      }
      on "Acquire Multiple Rainbow Button" Value changed; "Save Multiple Measurement" Value changed {
        call "Check Queue And Label.gvi"(Label Info Missing Error=$"Label Info Missing Error", Label Info Error Label=$"Label Info Error Label", Error In=s6, Is Label Necessary?=TRUE) -> (Proceed to enqueue=w100, Error Out=w101)
        call "MRM Check any cell selected.gvi"(MRM Mega Cluster=$"MRM Mega Cluster", Proceed to enqueue In=w100, Error In=w101) -> (Proceed to enqueue Out=w102, Error Out=w103)
        call "Conditional Enqueue.gvi"(Queue In=s5, Queue Instruction In="Rainbow Multiple Measurement", Error Out=w103, Equeue?=w102) -> (Queue Out=w78, Error In=w104)
        call "MRM Operation Translator.gvi"(Acquire Multiple Rainbow Button=$"Acquire Multiple Rainbow Button", Load Multiple Measurement=FALSE, Save Multiple Measurement=$"Save Multiple Measurement", Error In=w104) -> (Error Out=w79)
        w80 = default
      }
      on "Load Single Measurement" Value changed {
        call "Check Queue And Label.gvi"(Label Info Missing Error=$"Label Info Missing Error", Label Info Error Label=$"Label Info Error Label", Error In=s6, Is Label Necessary?=FALSE) -> (Proceed to enqueue=w105, Error Out=w106)
        call "Conditional Enqueue.gvi"(Queue In=s5, Queue Instruction In="Rainbow Single Measurement", Error Out=w106, Equeue?=w105) -> (Queue Out=w78, Error In=w107)
        call "SRM Operation Translator.gvi"(Acquire Single Rainbow Button=FALSE, Load Single Measurement=$"Load Single Measurement", Save Single Measurement=FALSE, Error In=w107) -> (Error Out=w79)
        w80 = default
      }
      on "Load Multiple Measurement" Value changed {
        call "Check Queue And Label.gvi"(Label Info Missing Error=$"Label Info Missing Error", Label Info Error Label=$"Label Info Error Label", Error In=s6, Is Label Necessary?=FALSE) -> (Proceed to enqueue=w108, Error Out=w109)
        call "Conditional Enqueue.gvi"(Queue In=s5, Queue Instruction In="Rainbow Multiple Measurement", Error Out=w109, Equeue?=w108) -> (Queue Out=w78, Error In=w110)
        call "MRM Operation Translator.gvi"(Acquire Multiple Rainbow Button=FALSE, Load Multiple Measurement=$"Load Multiple Measurement", Save Multiple Measurement=FALSE, Error In=w110) -> (Error Out=w79)
        w80 = default
      }
      on "Activate XZ Stage" Value changed {
        call "XZ Move Requisites.gvi"(Queue In=s5, Activate XZ Stage=$"Activate XZ Stage", Instrument Control Mega Cluster=$"Instrument Control Mega Cluster", Error In=s6) -> (Queue Out=w78, Error Out=w79)
        w80 = default
      }
      on "LPC Parameters" Value changed; "MSpot Sperctrum Calibration Parameters" Value changed; "Rainbow Sweep Param Selector MSpot" Value changed; "Rainbow Sweep Parameters LPC" Value changed; "Rainbow Sweep Parameters MRM" Value changed; "Rainbow Sweep Parameters SRM" Value changed; "SRM Specific Parameters" Value changed; "Start" Value changed; "XZ All Position Cluster" Value changed {
        call "Update Controls Subroutine.gvi"(Misc Data Mega Cluster In=$"Misc Data Mega Cluster", MSpot Mega Cluster In=$"MSpot Mega Cluster", LPC Mega Cluster In=$"LPC Mega Cluster", SRM Mega Cluster In=$"SRM Mega Cluster", MRM Mega Cluster In=$"MRM Mega Cluster", Error In=s6) -> (Misc Data Mega Cluster Out=w111, MSpot Mega Cluster Out=w112, LPC Mega Cluster Out=w113, SRM Mega Cluster Out=w114, MRM Mega Cluster Out=w115, Error Out=w79)
        $"Misc Data Mega Cluster" <- w111
        $"MSpot Mega Cluster" <- w112
        $"MRM Mega Cluster" <- w115
        $"LPC Mega Cluster" <- w113
        $"SRM Mega Cluster" <- w114
        w78 = s5
        w80 = default
      }
      on "Photodetector Start Measurement" Value changed {
        call "Check Queue And Label.gvi"(Error In=s6) -> (Proceed to enqueue=w116, Error Out=w117)
        call "Conditional Enqueue.gvi"(Queue In=s5, Queue Instruction In="Stand Alone Photodetector Measurement", Error Out=w117, Equeue?=w116) -> (Queue Out=w78, Error In=w79)
        w80 = default
      }
      on "Set Cell" Value changed {
        call "Set Cell Requisites.gvi"(Queue In=s5, Set Cell=$"Set Cell", Instrument Control Mega Cluster=$"Instrument Control Mega Cluster", Error In=s6) -> (Queue Out=w78, Error Out=w79)
        w80 = default
      }
      on "Cell to Measure" Value changed {
        call "Provisional Cell Selection FGV.gvi"(FGV Instructions="Set State", XZ Stage Cell=$"Cell to Measure", Error In=s6) -> (Error Out=w79)
        w78 = s5
        w80 = default
      }
      on "MRM Cell Selector" Value changed {
        call "MRM Cell Updater.gvi"(Misc Data Mega Cluster In=$"Misc Data Mega Cluster", Error In=s6) -> (Error Out=w118)
        call "Update MRM Controls.gvi"(Misc Data Mega Cluster In=$"Misc Data Mega Cluster", MRM Mega Cluster In=$"MRM Mega Cluster", Error In=w118) -> (MRM Mega Cluster Out=w119, Error Out=w79)
        $"MRM Mega Cluster" <- w119
        w78 = s5
        w80 = default
      }
      on "Mask Calibration Start Measurement" Value changed {
        call "Check Queue And Label.gvi"(Error In=s6) -> (Proceed to enqueue=w120, Error Out=w121)
        call "Conditional Enqueue.gvi"(Queue In=s5, Queue Instruction In="Mask Calibration", Error Out=w121, Equeue?=w120) -> (Queue Out=w78, Error In=w79)
        w80 = default
      }
      on "Smart Sweep Mega Cluster" Value changed {
        call "FGV Smart Sweep Parameters.gvi"(FGV Instructions="Set State", Smart Sweep Mega Cluster=$"Smart Sweep Mega Cluster", Error In=s6) -> (Error Out=w79)
        w78 = s5
        w80 = default
      }
    }
    call "Is Error.gvi"(error in=w79) -> (error?=w122)
    Logical Or(w122, w80) -> w123
    next s5 = w78
    next s6 = w79
    stop if w123
  }
  Enqueue Element(element="Stop App", error in=s6, queue=s5) -> (error out=w124)
  call "Multiplex Errors.gvi"(error in 1=w124, error in 2=s2, error in 3=w77) -> (error out=w125)
  Flush Queue(error in=w125, queue=s1) -> (error out=w126, queue out=w127)
  Release Queue(error in=w126, queue=w127) -> (error out=w128)
  case (w128) {
    frame Error, Default {
      # In case there is an error
      # put out an error handler
      call "Display Error.gvi"(error in=w128)
      $"Error Out" <- w128
    }
    frame No Error { }
  }
