vi "Error Check STOP.gvi"   [LabVIEW NXG 5.0.0]
inputs:
  "Error In": error
  "Queue In": Queue<"Queue Instructions Control.gtype">
outputs:
  "Error Out": error
  "Stop Master Loop": bool
  "Queue Out": Queue<"Queue Instructions Control.gtype">
types:
  "Queue Instructions Control.gtype" = enum{"Undefined State", "Initialize App", "Idle", "Light Calibration Irradiance", "Light Calibration Spectral Density", "Light Calibration Power Density", "Access TXT File", "Stop App"}
uses:
  Rainbow Measurement Setup::Side Functions::Global Abort::FGV Global Abort.gvi
diagram:
  case ($"Error In") {
    frame Error, Default {
      w1 = $"Error In"
    }
    frame No Error {
      case ($"Error In") {
        frame Error, Default {
          Enqueue Element At Opposite End(element="Stop App", error in=$"Error In", queue=$"Queue In") -> (error out=w2, queue out=w3)
        }
        frame No Error {
          w2 = $"Error In"
          w3 = $"Queue In"
        }
      }
      $"Queue Out" <- w3
      call "FGV Global Abort.gvi"(Global Abort Instructions="Read Current State", Error In=w2) -> (Global Abort Out=w4, Error Out=w1)
      Logical Or(w1, w4) -> w5
      $"Stop Master Loop" <- w5
    }
  }
  $"Error Out" <- w1
