vi "Misc Error Eraser.gvi"   [LabVIEW NXG 5.0.0]
inputs:
  "Error In": error
outputs:
  "Error Out": error
panel indicators:
  "description": string
uses:
  NI::G Core::Error::Clear Error Cluster.gvi
  NI::G Core::Error::Read Description.gvi
  NI::G Core::Error::Display Error.gvi
diagram:
  # This SubVI Erases the miscelaneous error
  # sometimes caused by the arduino comunication protocol
  case ($"Error In") {
    frame Error, Default {
      call "Clear Error Cluster.gvi"(error in=$"Error In") -> (error out=w2)
      call "Read Description.gvi"(error in=$"Error In") -> (description=w3)
      Search And Replace String(input string=w3, search string="miscellaneous") -> (number of replacements=w4)
      Is Not Equal To 0(x=w4) -> w5
      Select(s=w5, t=w2, f=$"Error In") -> w1
      call "Display Error.gvi"(error in=$"Error In")
      $description <- w3
    }
    frame No Error {
      w1 = $"Error In"
    }
  }
  $"Error Out" <- w1
