vi "Global Abort Sequence.gvi"   [LabVIEW NXG 5.0.0]
inputs:
  "Error In": error
  "Queue In": Queue<"Queue Instructions Control.gtype">
  "Global Abort": bool  # Force exit either the current process or the entire app (you will be prompted)
outputs:
  "Error Out": error
  "Queue Out": Queue<"Queue Instructions Control.gtype">
types:
  "Queue Instructions Control.gtype" = enum{"Undefined State", "Initialize App", "Idle", "Light Calibration Irradiance", "Light Calibration Spectral Density", "Light Calibration Power Density", "Access TXT File", "Stop App"}
uses:
  Rainbow Measurement Setup::Side Functions::Global Abort::FGV Global Abort.gvi
diagram:
  case ($"Error In") {
    frame Error, Default {
      w1 = $"Error In"
    }
    frame No Error {
      w2 = """Do you want to abort the current measurement or do
you want to close the app? (Warning, everything not 
saved will be lost) """
      w3 = "No please do not\nclose the app just\nabort the current\nmeasurement."
      w4 = "Oh my god, please\ncontinue, I pressed\nglobal abort by mistake!"
      Three Button Dialog(Allow user to close window? (TRUE)=FALSE, Center Button Text ("No")="Close everything,\nI'm outta here!", Left Button Text ("Yes")=w3, Right Button Text ("Cancel")=w4, Window Title (" ")="Are you Sure?", message=w2) -> (Which Button?=w5)
      case (w5) {
        frame "left button" {
          call "FGV Global Abort.gvi"(Global Abort Instructions="Set State", Local Abort=TRUE, Global Abort=FALSE, Error In=$"Error In") -> (Error Out=w7)
          Flush Queue(error in=w7, queue=$"Queue In") -> (error out=w8, queue out=w9)
          Enqueue Element At Opposite End(element="Idle", error in=w8, queue=w9) -> (error out=w1, queue out=w6)
        }
        frame "center button" {
          call "FGV Global Abort.gvi"(Global Abort Instructions="Set State", Local Abort=FALSE, Global Abort=TRUE, Error In=$"Error In") -> (Error Out=w10)
          Enqueue Element At Opposite End(element="Stop App", error in=w10, queue=$"Queue In") -> (error out=w1, queue out=w6)
        }
        frame "right button", Default {
          w6 = $"Queue In"
          w1 = $"Error In"
        }
      }
      $"Queue Out" <- w6
    }
  }
  $"Error Out" <- w1
