vi "Multiple Page Graph Adapter.gvi"   [LabVIEW NXG 5.0.0]
inputs:
  "Error In": error
  "Full Data Array": "Light Power Calibration Data.gtype"[]
outputs:
  "Error Out": error
  "Output Bundled Data": T1[]
  "Output Graph Ready Data": cluster{"Element 1": f64[], "Element 2": f64[]}[]
types:
  "Rainbow Sweep Types.gtype" = enum{"Red Sweep Closing", "Red Sweep Opening", "Blue Sweep Closing", "Blue Sweep Opening"}
  T1 = cluster{"Element 1": f64[], "Element 2": f64[], "Element 3": "Rainbow Sweep Types.gtype"}
  T2 = cluster{"Dividing Wavelength Array": f64[], "Measured Power Array": f64[]}
  "Light Power Calibration Data.gtype" = cluster{"Single Light Calibration": T2, "Rainbow Sweep Types": "Rainbow Sweep Types.gtype", "Total Light Power": f64}
diagram:
  # This SubVI Takes a 3 dimensional array as an input and outputs
  # graph multicurve plot data so that it can be easily represented.
  # It also bundles the sweep type information so that it can be extracted from
  # the array afterwards
  case ($"Error In") {
    frame Error, Default {
      w1 = $"Error In"
      w2 = default
      w3 = default
    }
    frame No Error {
      for {
        w4 = each element of $"Full Data Array"
        Property Node(instance in=w4) -> ("Single Light Calibration"=w5, "Rainbow Sweep Types"=w6)
        Property Node(instance in=w5) -> ("Dividing Wavelength Array"=w7, "Measured Power Array"=w8)
        for {
          w9 = each element of w7
          w10 = each element of w8
          Is Not Equal To 0(x=w9) -> w13
          append w9 to w11 if w13
          append w10 to w12 if w13
        }
        Build Cluster(w11, w12) -> w14
        Build Cluster(w11, w12, w6) -> w15
        append w14 to w3
        append w15 to w2
      }
      w1 = $"Error In"
    }
  }
  $"Error Out" <- w1
  $"Output Graph Ready Data" <- w3
  $"Output Bundled Data" <- w2
