vi "Arduino Detection Subroutine.gvi"   [LabVIEW NXG 5.0.0]
inputs:
  "Error In": error
  "Prompt Arduinos?": bool = TRUE
outputs:
  "Error Out": error
  "Arduino Detection Cluster Info Out": "Arduino Detection cluster control.gtype"
  "Detected All?": bool
types:
  T1 = cluster{"Element 1": "VISA Instr", "Element 2": string}
  "Arduino Detection cluster control.gtype" = cluster{"XZ Stage Arduino Address": "VISA Instr", "XZ Stage Arduino Detected?": bool, "Multiplexer Arduino Detected?": bool, "Multiplexer Arduino Address": "VISA Instr", "Arduinos List": T1[], "XZ Stage Log": string, "Multiplexer Log": string}
uses:
  Rainbow Measurement Setup::Side Functions::Global Abort::FGV Global Abort.gvi
  Rainbow Measurement Setup::Side Functions::Instrument Control::Arduino::Arduino Detector.gvi
  Rainbow Measurement Setup::Side Functions::Instrument Control::Arduino::Arduino initialize prompt gen.gvi
diagram:
  # This is the subroutine to detect all the arduinos. It basically scans for arduinos and prompts the
  # user to reconnect them in case they have not been detected.
  case ($"Error In") {
    frame Error, Default {
      w1 = $"Error In"
      w2 = default
      w3 = default
    }
    frame No Error {
      while (iteration -> i1) {
        call "FGV Global Abort.gvi"(Global Abort Instructions="Read Current State", Error In=$"Error In") -> (Global Abort Out=w4, Error Out=w5)
        call "Arduino Detector.gvi"(Error In=w5) -> (Arduino Detection info Out=w3, Error Out=w6)
        Logical And($"Prompt Arduinos?", not w4) -> w7
        call "Arduino initialize prompt gen.gvi"(Arduino Detection Cluster Info In=w3, Loop iteration=i1, Error In=w6, Prompt Arduinos?=w7) -> (Detected All?=w2, Proceed?=w8, Error Out=w1)
        Logical Or(w8, w4) -> w9
        stop if w9
      }
    }
  }
  $"Arduino Detection Cluster Info Out" <- w3
  $"Detected All?" <- w2
  $"Error Out" <- w1
