vi "Arduino Detector.gvi"   [LabVIEW NXG 5.0.0]
inputs:
  "Error In": error
outputs:
  "Error Out": error
  "Arduino Detection info Out": "Arduino Detection cluster control.gtype"
panel indicators:
  "Found Resources": string[]
types:
  T1 = cluster{"Element 1": "VISA Instr", "Element 2": string}
  "Arduino Detection cluster control.gtype" = cluster{"XZ Stage Arduino Address": "VISA Instr", "XZ Stage Arduino Detected?": bool, "Multiplexer Arduino Detected?": bool, "Multiplexer Arduino Address": "VISA Instr", "Arduinos List": T1[], "XZ Stage Log": string, "Multiplexer Log": string}
uses:
  NI::VISA::Find Resource (Search Resources).gvi
  Rainbow Measurement Setup::Main Functions::Instruction Queue::Current State::FGV Current State.gvi
  Rainbow Measurement Setup::Side Functions::Global Abort::FGV Global Abort.gvi
  NI::VISA::Open (Instr).gvi
  NI::VISA::Clear (Instr).gvi
  NI::VISA::Read (Instr, String).gvi
  NI::VISA::Close (Instr).gvi
  NI::G Core::Error::Clear Error Cluster.gvi
diagram:
  # This loop scans all the VISA found sources and queries them in search for the arduino VISA addresses.
  # Once it finds the desired arduino it outputs the address into the Predefined cluster and the program finishes.
  case ($"Error In") {
    frame Error, Default {
      w1 = $"Error In"
      w2 = default
    }
    frame No Error {
      s1 = $"Error In"  # shift register
      for {
        w3 = each element of [9600, 115200]
        call "Find Resource (Search Resources).gvi"() -> (found resources=w4)
        $"Found Resources" <- w4
        call "FGV Current State.gvi"(Current State Instructions="Set Current Substate", Current Substate="Detecting Arduinos", Error In=s1) -> (Error Out=w5)
        for {
          w6 = each element of w4
          call "FGV Global Abort.gvi"(Global Abort Instructions="Read Current State", Error In=w5) -> (Global Abort Out=w12, Error Out=w13)
          Search And Replace String(error in (no error)=w13, input string=w6, search string="ASRL") -> (error out=w14, number of replacements=w15)
          Is Not Equal To 0(x=w15) -> w16
          case (w16) {
            frame False, Default {
              w17 = w14
              w18 = ""
              w19 = ""
            }
            frame True {
              call "Open (Instr).gvi"(resource name=w6, error in=w14, open timeout=300) -> (session out=w20, error out=w21)
              Property Node(instance in=w20, "ASRL Baud"=w3, error in=w21) -> (error out=w22, instance out=w23)
              call "Clear (Instr).gvi"(session in=w23, error in=w22) -> (session out=w24, error out=w25)
              call "Read (Instr, String).gvi"(session in=w24, error in=w25, byte count=50) -> (session out=w19, error out=w26, read buffer=w18)
              call "Close (Instr).gvi"(session in=w19, error in=w26) -> (error out=w27)
              call "Clear Error Cluster.gvi"(error in=w27) -> (error out=w17)
            }
          }
          Build Cluster(w19, w18) -> w28
          Search And Replace String(error in (no error)=w17, input string=w18, search string="Arduin") -> (error out=w29, number of replacements=w30)
          Is Not Equal To 0(x=w30) -> w31
          Logical And(w31, w16) -> w32
          Search And Replace String(error in (no error)=w29, input string=w18, search string="XZ") -> (error out=w33, number of replacements=w34)
          Is Not Equal To 0(x=w34) -> w35
          Search And Replace String(error in (no error)=w33, input string=w18, search string="Multiplex") -> (error out=w36, number of replacements=w37)
          Is Not Equal To 0(x=w37) -> w38
          append w28 to w7 if w32
          append w35 to w8
          append w38 to w9
          w10 = w19 if w35
          w11 = w19 if w38
          stop if w12
        }
        Or Array Elements(Boolean array=w8) -> (logical OR=w39)
        Or Array Elements(Boolean array=w9) -> (logical OR=w40)
        w41 = "Arduino Detection cluster control.gtype" {all zero or empty}
        Property Node(instance in=w41, "XZ Stage Arduino Address"=w10, "XZ Stage Arduino Detected?"=w39, "Multiplexer Arduino Detected?"=w40, "Multiplexer Arduino Address"=w11, "Arduinos List"=w7) -> (instance out=w2)
        Logical And(w39, w40) -> w42
        Logical Or(w42, w12) -> w43
        next s1 = w36
        stop if w43
      }
      w1 = s1
    }
  }
  $"Arduino Detection info Out" <- w2
  $"Error Out" <- w1
