vi "Arduino initialize prompt gen.gvi"   [LabVIEW NXG 5.0.0]
inputs:
  "Error In": error
  "Arduino Detection Cluster Info In": "Arduino Detection cluster control.gtype", required
  "Prompt Arduinos?": bool
  "Loop iteration": i32
outputs:
  "Error Out": error
  "Detected All?": bool
  "Proceed?": bool
types:
  T1 = cluster{"Element 1": "VISA Instr", "Element 2": string}
  "Arduino Detection cluster control.gtype" = cluster{"XZ Stage Arduino Address": "VISA Instr", "XZ Stage Arduino Detected?": bool, "Multiplexer Arduino Detected?": bool, "Multiplexer Arduino Address": "VISA Instr", "Arduinos List": T1[]}
diagram:
  # This loop prompts the user in case some of the arduinos have not been correctly connected. After some attempts it
  # prompts the user with the option to skip the detection with a warning that some functionalities might be compromised.
  case ($"Error In") {
    frame Error, Default {
      w1 = $"Error In"
    }
    frame No Error {
      Property Node(instance in=$"Arduino Detection Cluster Info In") -> ("Multiplexer Arduino Detected?"=w2, "XZ Stage Arduino Detected?"=w3)
      Logical And(w3, w2) -> w4
      $"Detected All?" <- w4
      Logical Or(w4, not $"Prompt Arduinos?") -> w5
      case (w5) {
        frame False, Default {
          case (w3) {
            frame False, Default {
              w8 = """It looks like the XZ Stage Arduino is not
connected or the connection is failing,
please connect it and make sure no other
software is using the connection (i.e. the 
arduino software, cura ...)"""
              One Button Dialog(button name ("OK")="Okay I will Reconnect it", message=w8)
            }
            frame True { }
          }
          case (w2) {
            frame False, Default {
              w9 = """It looks like the Multiplexer Arduino is not
connected or the connection is failing,
please connect it and make sure no other
software is using the connection (i.e. the 
arduino software, cura ...)"""
              One Button Dialog(button name ("OK")="Okay I will Reconnect it", message=w9)
            }
            frame True { }
          }
          Wait Until Next Multiple(multiple to wait=500)
          w6 = default
          w7 = $"Error In"
        }
        frame True {
          w6 = TRUE
          w7 = $"Error In"
        }
      }
      Is Greater Or Equal(x=$"Loop iteration", y=2) -> w10
      case (w10) {
        frame False, Default {
          w11 = FALSE
          w1 = w7
        }
        frame True {
          w12 = """Seems you're having some trouble
connecting some of the arduinos, do you 
want to proceed without connecting it
and hope for the best?
(WARNING: some functionalities might
be compromized)"""
          Two Button Dialog(F button name ("Cancel")="Oh dear no, I'd rather ask for help", T button name ("OK")="Yes please, I like to live dangerously", message=w12) -> (T Button?=w11)
          w1 = w7
        }
      }
      Logical Or(w11, w6) -> w13
      $"Proceed?" <- w13
    }
  }
  $"Error Out" <- w1
