vi "Mux Set Cell Subroutine.gvi"   [LabVIEW NXG 5.0.0]
inputs:
  "Error In": error
  "Instrument Control Mega Cluster In": "Instrument Control Mega Cluster.gtype"
  "Desired Cell": "XZ Stage Cell.gtype" = "L.01"
outputs:
  "Error Out": error
  "Instrument Control Mega Cluster Out": "Instrument Control Mega Cluster.gtype"
types:
  "Instrument Coms Info.gtype" = cluster{"Arduino Coms Info": "Arduino Detection cluster control.gtype", "Photodetector Names": string[], "Keythley Address": "VISA Instr", "Photodetector Detected?": bool, "Thorlabs Motors Detected?": bool, "Keithley Detected?": bool, "Thorlabs Motors Serial Number": "Thorlabs Motors Serial Number In.gtype", "Photodetector IVI session": "Ivi IviDefault", "Flame ID": string, "Flame Detected?": bool, "Flame Wrapper ID": u64}
  "Debugging Cluster.gtype" = cluster{"Debugging mode?": bool, "Initialize App": bool, "Insturment Debugging": "Insturment Debugging Cluster.gtype"}
  "Instrument Control Mega Cluster.gtype" = cluster{"Instruments Coms Info": "Instrument Coms Info.gtype", "Debugging Cluster": "Debugging Cluster.gtype"}
  "XZ Stage Cell.gtype" = enum{"L.01", "L.02", "L.03", "L.04", "L.05", "L.06", "L.07", "L.08", "L.09", "L.10", "L.11", "L.12", "R.01", "R.02", "R.03", "R.04", "R.05", "R.06", "R.07", "R.08", "R.09", "R.10", "R.11", "R.12"}
uses:
  Rainbow Measurement Setup::Main Functions::Instruction Queue::Current State::FGV Current State.gvi
  Rainbow Measurement Setup::Side Functions::Instrument Control::Arduino::Multiplexer Arduino::Set Cell Low level.gvi
diagram:
  # This subVI Checks that the arduino is allowed to switch cells by the debugging module
  # and if it is it converts the Desired cell into a string and feeds it to the low level set cell
  # subVI
  case ($"Error In") {
    frame Error, Default {
      w1 = $"Error In"
      w2 = $"Instrument Control Mega Cluster In"
    }
    frame No Error {
      Property Node(instance in=$"Instrument Control Mega Cluster In") -> ("Debugging Cluster:Debugging mode?"=w3, "Debugging Cluster:Insturment Debugging:Arduinos"=w4, instance out=w5)
      call "FGV Current State.gvi"(Current State Instructions="Set Current State", Current State="Change Cell", Error In=$"Error In") -> (Error Out=w6)
      Format Into String(errIn=w6, $"Desired Cell") -> (outString=w7, errOut=w8)
      Logical And[output inverted](w3, not w4) -> w9
      case (w9) {
        frame False, Default {
          w1 = w8
          w2 = w5
        }
        frame True {
          call "Set Cell Low level.gvi"(Instrument Control Mega Cluster In=w5, Cell Label=w7, Error In=w8) -> (Instrument Control Mega Cluster Out=w2, Error Out=w1)
        }
      }
    }
  }
  $"Instrument Control Mega Cluster Out" <- w2
  $"Error Out" <- w1
