vi "Set Cell Low level.gvi"   [LabVIEW NXG 5.0.0]
inputs:
  "Error In": error
  "Instrument Control Mega Cluster In": "Instrument Control Mega Cluster.gtype"
  "Cell Label": string
outputs:
  "Error Out": error
  "Instrument Control Mega Cluster Out": "Instrument Control Mega Cluster.gtype"
panel indicators:
  "Arduino Multiplexer Log": string
types:
  "Instrument Coms Info.gtype" = cluster{"Arduino Coms Info": "Arduino Detection cluster control.gtype", "Photodetector Names": string[], "Keythley Address": "VISA Instr", "Photodetector Detected?": bool, "Thorlabs Motors Detected?": bool, "Keithley Detected?": bool, "Thorlabs Motors Serial Number": "Thorlabs Motors Serial Number In.gtype", "Photodetector IVI session": "Ivi IviDefault", "Flame ID": string, "Flame Detected?": bool, "Flame Wrapper ID": u64}
  "Debugging Cluster.gtype" = cluster{"Debugging mode?": bool, "Initialize App": bool, "Insturment Debugging": "Insturment Debugging Cluster.gtype"}
  "Instrument Control Mega Cluster.gtype" = cluster{"Instruments Coms Info": "Instrument Coms Info.gtype", "Debugging Cluster": "Debugging Cluster.gtype"}
uses:
  NI::VISA::Open (Instr).gvi
  Rainbow Measurement Setup::Main Functions::Instruction Queue::Current State::FGV Current State.gvi
  NI::VISA::Read (Instr, String).gvi
  NI::VISA::Write (Instr, String).gvi
  Rainbow Measurement Setup::Side Functions::Instrument Control::Arduino::XZ Stage Arduino::Low Level::XZ Stage Read Serial.gvi
  NI::VISA::Close (Instr).gvi
diagram:
  # This subVI Sets the desired cell in the arduino demultiplexer by writting the cell label on the arduino.
  # The possible cell labels are L or R followed by a dot and then two digits from 01 to 12 (i.e. L.08)
  case ($"Error In") {
    frame Error, Default {
      w1 = $"Error In"
      w2 = $"Instrument Control Mega Cluster In"
    }
    frame No Error {
      Property Node(instance in=$"Instrument Control Mega Cluster In") -> ("Instruments Coms Info:Arduino Coms Info:Multiplexer Arduino Detected?"=w3, instance out=w4)
      case (w3) {
        frame False, Default {
          w5 = "Multiplexer arduino not detected :(\nYou might have to restart the software\nfor this problem to be fixed."
          One Button Dialog(button name ("OK")="Okay I'll try", message=w5)
          w2 = w4
          w1 = $"Error In"
        }
        frame True {
          Property Node(instance in=w4) -> ("Instruments Coms Info:Arduino Coms Info:Multiplexer Arduino Address"=w6, "Instruments Coms Info:Arduino Coms Info:Multiplexer Log"=w7, instance out=w8)
          call "Open (Instr).gvi"(resource name=w6, error in=$"Error In", open timeout=1000) -> (session out=w9, error out=w10)
          call "FGV Current State.gvi"(Current State Instructions="Set Current Substate", Current Substate="Initializing Multiplexer Arduino", Error In=w10) -> (Error Out=w11)
          call "Read (Instr, String).gvi"(session in=w9, error in=w11, byte count=50) -> (session out=w12, error out=w13)
          call "Write (Instr, String).gvi"(session in=w12, error in=w13, write buffer=$"Cell Label") -> (session out=w14, error out=w15)
          s1 = w15  # shift register
          s2 = w14  # shift register
          s3 = w7  # shift register
          while (iteration -> i1) {
            call "XZ Stage Read Serial.gvi"(XZ Carriage Arduino open Visa session In=s2, Error In=s1) -> (XZ Carriage Arduino open Visa session Out=w16, Read Output=w17, Error Out=w18)
            Concatenate Strings(s3, w17) -> w19
            $"Arduino Multiplexer Log" <- w19
            Is Empty String Or Path(string/path=w17) -> w20
            Is Greater(x=i1, y=5) -> w21
            Logical Or(w21, not w20) -> w22
            call "FGV Current State.gvi"(Current State Instructions="Set Current Substate", Current Substate="Writing Cell to Multiplexer Arduino", Error In=w18) -> (Error Out=w23)
            Wait Until Next Multiple(multiple to wait=50)
            next s1 = w23
            next s2 = w16
            next s3 = w19
            stop if w22
          }
          call "FGV Current State.gvi"(Current State Instructions="Set Current Substate", Current Substate="Closing Multiplexer Arduino", Error In=s1) -> (Error Out=w24)
          call "Close (Instr).gvi"(session in=s2, error in=w24) -> (error out=w1)
          Property Node(instance in=w8, "Instruments Coms Info:Arduino Coms Info:Multiplexer Log"=s3) -> (instance out=w2)
        }
      }
    }
  }
  $"Error Out" <- w1
  $"Instrument Control Mega Cluster Out" <- w2
