vi "Serial Jibberish Eraser.gvi"   [LabVIEW NXG 5.0.0]
inputs:
  "Error In": error
  "Dirty String": string
outputs:
  "Error Out": error
  "Clean String": string
uses:
  NI::G Core::Error::Is Error.gvi
  NI::G Core::Error::Clear Error Cluster.gvi
diagram:
  case ($"Error In") {
    frame Error, Default {
      w1 = $"Error In"
      w2 = $"Dirty String"
    }
    frame No Error {
      s1 = $"Dirty String"  # shift register
      s2 = $"Error In"  # shift register
      while {
        Search And Replace String(error in (no error)=s2, input string=s1, search string="test") -> (error out=w3)
        call "Is Error.gvi"(error in=w3) -> (error?=w4)
        case (w4) {
          frame False, Default {
            w5 = s1
            w6 = w3
            w7 = TRUE
          }
          frame True {
            call "Clear Error Cluster.gvi"(error in=w3) -> (error out=w6)
            w5 = _
            w7 = default
          }
        }
        next s1 = w5
        next s2 = w6
        stop if w7
      }
      w1 = s2
      w2 = s1
    }
  }
  $"Clean String" <- w2
  $"Error Out" <- w1
