vi "XZ Stage Coordinate to Gcode.gvi"   [LabVIEW NXG 5.0.0]
inputs:
  "Error In": error
  "XZ Coordinate Cluster In": "XZ Coordinate Cluster In.gtype"
outputs:
  "Error Out": error
  "Gcode Instruction": string
types:
  "XZ Coordinate Cluster In.gtype" = cluster{"X Coordinate (mm)": f64, "Z Coordinate (mm)": f64}
diagram:
  # This SubVI converts an XZ Coordinate cluster into the command needed to
  # move to the required coordinate and it stores the gcode as the third element
  # of the XZ Coordinates cluster.
  case ($"Error In") {
    frame Error, Default {
      w1 = $"Error In"
      w2 = ""
    }
    frame No Error {
      Property Node(instance in=$"XZ Coordinate Cluster In") -> ("X Coordinate (mm)"=w3, "Z Coordinate (mm)"=w4)
      Number To Fractional String(number=w3, precision (6)=1, use system decimal point (T)=FALSE) -> (F-format string=w5)
      Search And Replace String(error in (no error)=$"Error In", input string=w5, replace string ("")=".", search string=",") -> (error out=w1, result string=w6)
      Number To Fractional String(number=w4, precision (6)=1, use system decimal point (T)=FALSE) -> (F-format string=w7)
      Search And Replace String(input string=w7, replace string ("")=".", search string=",") -> (result string=w8)
      Concatenate Strings("G1 X", w6, " Z", w8) -> w2
    }
  }
  $"Error Out" <- w1
  $"Gcode Instruction" <- w2
