vi "XZ Stage Home Sequence.gvi"   [LabVIEW NXG 5.0.0]
inputs:
  "Error In": error
  "XZ Carriage Arduino Open Visa Session In": "VISA Instr"
  "XZ Carriage Arduino Log In": string
outputs:
  "Error Out": error
  "XZ Carriage Arduino Open Visa Session Out": "VISA Instr"
  "XZ Carriage Arduino Log Out": string
  "XZ Stage Homed?": bool
panel controls:
  "Abort Homing": bool
panel indicators:
  "XZ Carriage Arduino Log While": string
uses:
  Rainbow Measurement Setup::Main Functions::Instruction Queue::Current State::FGV Current State.gvi
  Rainbow Measurement Setup::Side Functions::Global Abort::FGV Global Abort.gvi
  Rainbow Measurement Setup::Side Functions::Instrument Control::Arduino::XZ Stage Arduino::Low Level::XZ Stage Homing Low Level.gvi
diagram:
  # This SubVI tries to home the arduino using the XZ Stage Homing Low level SubVI. If it the homing fails
  # it prompts the user to reconnect everything and if it keeps failing it gives the user the oportunity to continue
  # without homing for testing purposes only.
  case ($"Error In") {
    frame Error, Default {
      w1 = $"Error In"
      w2 = $"XZ Carriage Arduino Open Visa Session In"
      w3 = $"XZ Carriage Arduino Log In"
      w4 = default
    }
    frame No Error {
      call "FGV Current State.gvi"(Current State Instructions="Set Current Substate", Current Substate="Homing XZ Stage", Error In=$"Error In") -> (Error Out=w5)
      s1 = w5  # shift register
      s2 = $"XZ Carriage Arduino Open Visa Session In"  # shift register
      s3 = $"XZ Carriage Arduino Log In"  # shift register
      while (iteration -> i1) {
        call "FGV Global Abort.gvi"(Global Abort Instructions="Read Current State", Error In=s1) -> (Local Abort Out=w6, Global Abort Out=w7, Error Out=w8)
        call "XZ Stage Homing Low Level.gvi"(XZ Carriage Arduino open Visa session In=s2, XZ Carriage Arduino Log In=s3, Error In=w8) -> (Homed?=w9, XZ Carriage Arduino open Visa Session Out=w10, XZ Carriage Arduino Log Out=w11, Error Out=w12)
        Logical Or($"Abort Homing", w6, w7) -> w13
        Logical And(w9, not w13) -> w4
        $"XZ Carriage Arduino Log While" <- w11
        Is Greater Or Equal(x=i1, y=1) -> w14
        case (w9) {
          frame True {
            w15 = TRUE
            w16 = w12
          }
          frame False {
            case (w14) {
              frame True {
                w17 = """The arduino Could not home
propperly, please make sure 
that the motors can move freely
and that the motor power supply 
is correctly connected"""
                Two Button Dialog(F button name ("Cancel")="Okay I will connect everything", T button name ("OK")="Continue without homing\n(TESTING ONLY!!!)", message=w17) -> (T Button?=w15)
              }
              frame False {
                w18 = """The arduino Could not home
propperly, please make sure 
that the motors can move freely
and that the motor power supply 
is correctly connected"""
                One Button Dialog(button name ("OK")="Okay I will make sure\neverything is allright", message=w18)
                w15 = default
              }
            }
            w16 = w12
          }
        }
        Logical Or(w15, $"Abort Homing", w6, w7) -> w19
        Wait Until Next Multiple(multiple to wait=50)
        next s1 = w16
        next s2 = w10
        next s3 = w11
        stop if w19
      }
      w1 = s1
      w2 = s2
      w3 = s3
    }
  }
  $"XZ Stage Homed?" <- w4
  $"XZ Carriage Arduino Open Visa Session Out" <- w2
  $"XZ Carriage Arduino Log Out" <- w3
  $"Error Out" <- w1
