vi "XZ Stage Initialize.gvi"   [LabVIEW NXG 5.0.0]
inputs:
  "Error In": error
  "XZ Carriage Arduino Adress In": "VISA Instr"
outputs:
  "Error Out": error
  "XZ Carriage Arduino Visa Session Out": "VISA Instr"
  "XZ Carriage Arduino Log": string
uses:
  Rainbow Measurement Setup::Main Functions::Instruction Queue::Current State::FGV Current State.gvi
  NI::VISA::Open (Instr).gvi
  NI::VISA::Read (Instr, String).gvi
  Rainbow Measurement Setup::Side Functions::Global Abort::FGV Global Abort.gvi
diagram:
  # This SubVI initializes the XZ Stage Arduino basically reading on the serial so that
  # the welcome message can be flushed.
  case ($"Error In") {
    frame Error, Default {
      w1 = $"Error In"
      w2 = default
      w3 = $"XZ Carriage Arduino Adress In"
    }
    frame No Error {
      call "FGV Current State.gvi"(Current State Instructions="Set Current Substate", Current Substate="Initializing XZ Stage", Error In=$"Error In") -> (Error Out=w4)
      call "Open (Instr).gvi"(resource name=$"XZ Carriage Arduino Adress In", error in=w4, access mode="VISA Defaults"(0), open timeout=1000) -> (session out=w5, error out=w6)
      Property Node(instance in=w5, "ASRL Baud"=115200, error in=w6) -> (error out=w7, instance out=w8)
      s1 = ""  # shift register
      while (iteration -> i1) {
        Wait Until Next Multiple(multiple to wait=100)
        Property Node(instance in=w8, error in=w7) -> ("ASRL Bytes at Port"=w9, error out=w10, instance out=w11)
        call "Read (Instr, String).gvi"(session in=w11, error in=w10, byte count=w9) -> (session out=w3, error out=w12, read buffer=w13)
        Concatenate Strings(s1, w13) -> w14
        call "FGV Global Abort.gvi"(Global Abort Instructions="Read Current State", Error In=w12) -> (Local Abort Out=w15, Global Abort Out=w16, Error Out=w1)
        Is Greater(x=i1, y=50) -> w17
        Logical Or(w15, w16, w17) -> w18
        next s1 = w14
        stop if w18
      }
      w2 = s1
    }
  }
  $"XZ Carriage Arduino Visa Session Out" <- w3
  $"Error Out" <- w1
  $"XZ Carriage Arduino Log" <- w2
