vi "XZ Stage Move To Location.gvi"   [LabVIEW NXG 5.0.0]
inputs:
  "Error In": error
  "XZ Carriage Arduino open Visa session In": "VISA Instr"
  "XZ Carriage Arduino Log In": string
  "Input Command": string = "G1 X100 Z100"
outputs:
  "Error Out": error
  "XZ Carriage Arduino open Visa Session Out": "VISA Instr"
  "XZ Carriage Arduino Log Out": string
uses:
  Rainbow Measurement Setup::Main Functions::Instruction Queue::Current State::FGV Current State.gvi
  NI::VISA::Clear (Instr).gvi
  NI::VISA::Write (Instr, String).gvi
  Rainbow Measurement Setup::Side Functions::Utilities::Time Related Operations::Wait ms.gvi
  Rainbow Measurement Setup::Side Functions::Global Abort::FGV Global Abort.gvi
  Rainbow Measurement Setup::Side Functions::Instrument Control::Arduino::XZ Stage Arduino::Low Level::XZ Stage Read Serial.gvi
  Rainbow Measurement Setup::Side Functions::Instrument Control::Arduino::XZ Stage Arduino::Low Level::XZ Stage Moved Check.gvi
  Rainbow Measurement Setup::Side Functions::Error Handling::Misc Error Eraser.gvi
  Rainbow Measurement Setup::Side Functions::Instrument Control::Arduino::XZ Stage Arduino::Low Level::XZ Stage Movement Failed Prompt.gvi
diagram:
  # This SubVI Sends a command to the XZ stage arduino to move it to a specified location and It waits for the arduino to respond.
  # If the arduino responds with Moved the operation is successful and it continues on without errors. If the arduino responds with
  #  coordinate out of range it prompts the user accordingly. If the arduino just does not respond the reading stops and the software
  #  attempts to write the command again up to 5 times. If the movement has failed after 5 times the software prompts the user
  #  recommending to connect everything
  # correctly and restarting the software.
  case ($"Error In") {
    frame Error, Default {
      w1 = $"Error In"
      w2 = $"XZ Carriage Arduino open Visa session In"
      w3 = $"XZ Carriage Arduino Log In"
    }
    frame No Error {
      Is Empty String Or Path(string/path=$"Input Command") -> w4
      case (w4) {
        frame True {
          w5 = "Tried to move the XZ Stage but\nthe movement command was empty!"
          One Button Dialog(button name ("OK")="Oh sorry I will\nsee what went wrong", message=w5)
          w1 = $"Error In"
          w2 = $"XZ Carriage Arduino open Visa session In"
          w3 = $"XZ Carriage Arduino Log In"
        }
        frame False {
          call "FGV Current State.gvi"(Current State Instructions="Set Current Substate", Current Substate="Moving XZ Stage", Error In=$"Error In") -> (Error Out=w6)
          Concatenate Strings($"Input Command", "\r\n") -> w7
          s1 = $"XZ Carriage Arduino open Visa session In"  # shift register
          s2 = w6  # shift register
          s3 = $"XZ Carriage Arduino Log In"  # shift register
          while (iteration -> i1) {
            call "Clear (Instr).gvi"(session in=s1, error in=s2) -> (session out=w8, error out=w9)
            call "Write (Instr, String).gvi"(session in=w8, error in=w9, write buffer=w7) -> (session out=w10, error out=w11)
            call "Wait ms.gvi"(Error In=w11) -> (Error Out=w12)
            s4 = w10  # shift register
            s5 = w12  # shift register
            s6 = s3  # shift register
            while (iteration -> i2) {
              call "FGV Global Abort.gvi"(Global Abort Instructions="Read Current State", Error In=s5) -> (Local Abort Out=w15, Global Abort Out=w16, Error Out=w17)
              call "XZ Stage Read Serial.gvi"(XZ Carriage Arduino open Visa session In=s4, Error In=w17) -> (XZ Carriage Arduino open Visa session Out=w18, Read Output=w19, Error Out=w20)
              Logical Or(w15, w16) -> w21
              call "XZ Stage Moved Check.gvi"(Serial Read=w19, Global Abort?=w21, XZ Stage Log In=s6, Error In=w20, Loop Iteration=i2) -> (Stop Loop?=w22, Moved?=w23, Coordinate Out Of Range?=w24, XZ Stage Log Out=w25, Error Out=w26)
              Wait Until Next Multiple(multiple to wait=100)
              append w23 to w13
              append w24 to w14
              next s4 = w18
              next s5 = w26
              next s6 = w25
              stop if w22
            }
            call "Misc Error Eraser.gvi"(Error In=s5) -> (Error Out=w27)
            call "XZ Stage Movement Failed Prompt.gvi"(Coordinate Out Of Range?=w14, Moved?=w13, Error In=w27, Loop Iterations=i1) -> (Stop Loop?=w28, Error Out=w29)
            Logical Or(w28, w21) -> w30
            next s1 = s4
            next s2 = w29
            next s3 = s6
            stop if w30
          }
          w1 = s2
          w2 = s1
          w3 = s3
        }
      }
    }
  }
  $"XZ Carriage Arduino open Visa Session Out" <- w2
  $"Error Out" <- w1
  $"XZ Carriage Arduino Log Out" <- w3
