vi "XZ Stage Moved Check.gvi"   [LabVIEW NXG 5.0.0]
inputs:
  "Error In": error
  "Loop Iteration": i32
  "Serial Read": string
  "Global Abort?": bool
  "XZ Stage Log In": string
outputs:
  "Error Out": error
  "XZ Stage Log Out": string
  "Coordinate Out Of Range?": bool
  "Moved?": bool
  "Stop Loop?": bool
diagram:
  Concatenate Strings($"XZ Stage Log In", $"Serial Read") -> w1
  # This SubVI Takes the Serial Read and checks if the XZ Stage has already
  # moved or if the coordinate is out of range. and outputs the corresponding
  # boolean combination
  $"XZ Stage Log Out" <- w1
  Search And Replace String(error in (no error)=$"Error In", input string=$"Serial Read", search string="Coordinate") -> (error out=w2, number of replacements=w3)
  Is Not Equal To 0(x=w3) -> w4
  $"Coordinate Out Of Range?" <- w4
  Search And Replace String(error in (no error)=w2, input string=$"Serial Read", search string="Moved") -> (error out=w5, number of replacements=w6)
  Is Not Equal To 0(x=w6) -> w7
  $"Moved?" <- w7
  $"Error Out" <- w5
  Is Greater(x=$"Loop Iteration", y=30) -> w8
  Logical Or(w7, w8, $"Global Abort?", w5, w4) -> w9
  $"Stop Loop?" <- w9
