vi "XZ Move Requisites.gvi"   [LabVIEW NXG 5.0.0]
inputs:
  "Error In": error
  "Activate XZ Stage": bool
  "Queue In": Queue<"Queue Instructions Control.gtype">
  "Instrument Coms Info": "Instrument Coms Info.gtype"
  "Debugging Cluster": "Debugging Cluster.gtype"
outputs:
  "Error Out": error
  "Queue Out": Queue<"Queue Instructions Control.gtype">
types:
  T1 = cluster{"Element 1": "VISA Instr", "Element 2": string}
  "Arduino Detection cluster control.gtype" = cluster{"XZ Stage Arduino Address": "VISA Instr", "XZ Stage Arduino Detected?": bool, "Multiplexer Arduino Detected?": bool, "Multiplexer Arduino Address": "VISA Instr", "Arduinos List": T1[], "XZ Stage Log": string, "Multiplexer Log": string}
  "Thorlabs Motors Serial Number In.gtype" = cluster{"Thorlabs Blue Motor": string, "Thorlabs Red Motor": string, "Blue Motor Homed?": bool, "Red Motor Homed?": bool}
  "Instrument Coms Info.gtype" = cluster{"Arduino Coms Info": "Arduino Detection cluster control.gtype", "Photodetector Names": string[], "Keythley Address": "VISA Instr", "Photodetector Detected?": bool, "Thorlabs Motors Detected?": bool, "Keithley Detected?": bool, "Thorlabs Motors Serial Number": "Thorlabs Motors Serial Number In.gtype", "Photodetector IVI session": "Ivi IviDefault", "Flame ID": string, "Flame Detected?": bool, "Flame Wrapper ID": u64}
  "Queue Instructions Control.gtype" = enum{"Undefined State", "Debug Check", "Initialize App", "Idle", "Light Power Calibration", "Rainbow Single Measurement", "Light Calibration Irradiance", "Light Calibration Spectral Density", "Light Calibration Power Density", "MSpot Spectrum Calibration", "Move XZ Stage", "Access TXT File", "Stop App"}
  "Insturment Debugging Cluster.gtype" = cluster{"Keithley": bool, "Arduinos": bool, "Thorlabs Motors": bool, "Photodetector": bool, "Flame Spectr": bool}
  "Debugging Cluster.gtype" = cluster{"Debugging mode?": bool, "Initialize App": bool, "Insturment Debugging": "Insturment Debugging Cluster.gtype"}
diagram:
  # This SubVI checks if the XZ Stage is connected, if not
  # it does not allow you to use the XZ Stage Move feature
  # except if we are debugging.
  case ($"Error In") {
    frame Error, Default {
      w1 = $"Error In"
      w2 = $"Queue In"
    }
    frame No Error {
      Property Node(instance in=$"Instrument Coms Info") -> ("Arduino Coms Info:XZ Stage Arduino Detected?"=w3)
      Property Node(instance in=$"Debugging Cluster") -> ("Debugging mode?"=w4)
      Logical Or(w3, w4) -> w5
      case (w5) {
        frame False {
          w6 = "The XZ Stage has not\nbeen detected please connect\nit propperly restart the app\nand try again."
          One Button Dialog(button name ("OK")="Okay I'll do that", message=w6)
          w2 = $"Queue In"
          w1 = $"Error In"
        }
        frame True {
          Enqueue Element(element="Move XZ Stage", error in=$"Error In", queue=$"Queue In") -> (error out=w1, queue out=w2)
        }
      }
    }
  }
  $"Queue Out" <- w2
  $"Error Out" <- w1
