vi "XZ Stage Close Coms.gvi"   [LabVIEW NXG 5.0.0]
inputs:
  "Error In": error
  "Instrument Coms Info In": "Instrument Coms Info.gtype"
outputs:
  "Error Out": error
  "Instrument Coms Info Out": "Instrument Coms Info.gtype"
types:
  T1 = cluster{"Element 1": "VISA Instr", "Element 2": string}
  "Arduino Detection cluster control.gtype" = cluster{"XZ Stage Arduino Address": "VISA Instr", "XZ Stage Arduino Detected?": bool, "Multiplexer Arduino Detected?": bool, "Multiplexer Arduino Address": "VISA Instr", "Arduinos List": T1[], "XZ Stage Log": string, "Multiplexer Log": string}
  "Thorlabs Motors Serial Number In.gtype" = cluster{"Thorlabs Blue Motor": string, "Thorlabs Red Motor": string, "Blue Motor Homed?": bool, "Red Motor Homed?": bool}
  "Instrument Coms Info.gtype" = cluster{"Arduino Coms Info": "Arduino Detection cluster control.gtype", "Photodetector Names": string[], "Keythley Address": "VISA Instr", "Photodetector Detected?": bool, "Thorlabs Motors Detected?": bool, "Keithley Detected?": bool, "Thorlabs Motors Serial Number": "Thorlabs Motors Serial Number In.gtype", "Photodetector IVI session": "Ivi IviDefault"}
uses:
  NI::VISA::Close (Instr).gvi
diagram:
  # This SubVI Checks if the XZ Stage Adress is empty and if not it closes the comunications with the address
  case ($"Error In") {
    frame Error, Default {
      w1 = $"Error In"
      w2 = $"Instrument Coms Info In"
    }
    frame No Error {
      Property Node(instance in=$"Instrument Coms Info In") -> ("Arduino Coms Info:XZ Stage Arduino Address"=w3, instance out=w2)
      Is Empty String Or Path(string/path=w3) -> w4
      case (w4) {
        frame False, Default {
          call "Close (Instr).gvi"(session in=w3, error in=$"Error In") -> (error out=w1)
        }
        frame True {
          w1 = $"Error In"
        }
      }
    }
  }
  $"Instrument Coms Info Out" <- w2
  $"Error Out" <- w1
