vi "XZ Stage Initialize And Home.gvi"   [LabVIEW NXG 5.0.0]
inputs:
  "Instrument Coms Info In": "Instrument Coms Info.gtype"
  "Error In": error
  "Debugging Cluster In": "Debugging Cluster.gtype"
outputs:
  "Instrument Coms Info Out": "Instrument Coms Info.gtype"
  "Error Out": error
  "Debugging Cluster Out": "Debugging Cluster.gtype"
types:
  T1 = cluster{"Element 1": "VISA Instr", "Element 2": string}
  "Arduino Detection cluster control.gtype" = cluster{"XZ Stage Arduino Address": "VISA Instr", "XZ Stage Arduino Detected?": bool, "Multiplexer Arduino Detected?": bool, "Multiplexer Arduino Address": "VISA Instr", "Arduinos List": T1[], "XZ Stage Log": string, "Multiplexer Log": string}
  "Thorlabs Motors Serial Number In.gtype" = cluster{"Thorlabs Blue Motor": string, "Thorlabs Red Motor": string, "Blue Motor Homed?": bool, "Red Motor Homed?": bool}
  "Instrument Coms Info.gtype" = cluster{"Arduino Coms Info": "Arduino Detection cluster control.gtype", "Photodetector Names": string[], "Keythley Address": "VISA Instr", "Photodetector Detected?": bool, "Thorlabs Motors Detected?": bool, "Keithley Detected?": bool, "Thorlabs Motors Serial Number": "Thorlabs Motors Serial Number In.gtype", "Photodetector IVI session": "Ivi IviDefault", "Flame ID": string, "Flame Detected?": bool, "Flame Wrapper ID": u64}
  "Insturment Debugging Cluster.gtype" = cluster{"Keithley": bool, "Arduinos": bool, "Thorlabs Motors": bool, "Photodetector": bool, "Flame Spectr": bool}
  "Debugging Cluster.gtype" = cluster{"Debugging mode?": bool, "Initialize App": bool, "Insturment Debugging": "Insturment Debugging Cluster.gtype"}
uses:
  Rainbow Measurement Setup::Main Functions::Instruction Queue::Current State::FGV Current State.gvi
  Rainbow Measurement Setup::Side Functions::Instrument Control::Arduino::XZ Stage Arduino::Low Level::XZ Stage Initialize.gvi
  Rainbow Measurement Setup::Side Functions::Instrument Control::Arduino::XZ Stage Arduino::Low Level::XZ Stage Home Sequence.gvi
diagram:
  # This SubVI Initializes the XZ stage and homes it while appending the log onto the Instrument Coms Info Cluster
  # It also checks the debugging cluster to see if we want to use the Arduinos or not
  case ($"Error In") {
    frame Error, Default {
      w1 = $"Instrument Coms Info In"
      w2 = $"Error In"
      w3 = $"Debugging Cluster In"
    }
    frame No Error {
      Property Node(instance in=$"Debugging Cluster In") -> ("Debugging mode?"=w4, "Insturment Debugging:Arduinos"=w5, instance out=w3)
      Logical And[output inverted](w4, not w5) -> w6
      case (w6) {
        frame False, Default {
          w2 = $"Error In"
          w1 = $"Instrument Coms Info In"
        }
        frame True {
          Property Node(instance in=$"Instrument Coms Info In") -> ("Arduino Coms Info:XZ Stage Arduino Address"=w7, instance out=w8)
          call "FGV Current State.gvi"(Current State Instructions="Set Current Substate", Current Substate="Initializing Arduino XZ Stage", Error In=$"Error In") -> (Error Out=w9)
          call "XZ Stage Initialize.gvi"(XZ Carriage Arduino Adress In=w7, Error In=w9) -> (XZ Carriage Arduino Visa Session Out=w10, XZ Carriage Arduino Log=w11, Error Out=w12)
          call "XZ Stage Home Sequence.gvi"(XZ Carriage Arduino Open Visa Session In=w10, XZ Carriage Arduino Log In=w11, Error In=w12) -> (XZ Carriage Arduino Log Out=w13, Error Out=w2)
          Property Node(instance in=w8, "Arduino Coms Info:XZ Stage Log"=w13) -> (instance out=w1)
        }
      }
    }
  }
  $"Debugging Cluster Out" <- w3
  $"Instrument Coms Info Out" <- w1
  $"Error Out" <- w2
