vi "XZ Stage Label to Coordinates.gvi"   [LabVIEW NXG 5.0.0]
inputs:
  "Error In": error
  "Cell Label": string
  "Misc Data Mega Cluster In": "Misc Data Mega Cluster.gtype"
outputs:
  "Error Out": error
  "Gcode Instruction Out": string
  "XZ Coordinate Out": "XZ Coordinate Cluster In.gtype"
  "Y coordinate out": f64
panel indicators:
  "X coordinate out": f64
  "Z coordinate out": f64
types:
  "XZ Coordinate Cluster In.gtype" = cluster{"X Coordinate (mm)": f64, "Z Coordinate (mm)": f64}
  "Full Reference Cluster.gtype" = cluster{"Enum Reference Cluster": "Enum Control Reference Cluster.gtype", "Boolean Reference Cluster": "Boolean Control Reference Cluster.gtype", "Numeric Reference Cluster": "Numeric Control Reference Cluster.gtype", "Numeric Cluster Reference Cluster": "Numeric Cluster Reference Cluster.gtype", "Path Reference Cluster": "Path Reference Cluster.gtype", "Cluster Reference Cluster": "Cluster Reference Cluster.gtype", "XZ Stage Controls Reference Cluster": "XZ Stage Controls Reference Cluster.gtype"}
  "Cell Naming Cluster.gtype" = cluster{"Cell Label": string, "Sample Prefix": string, "Author Initials": string, "Current Date": string, "Batch Name": string}
  T1 = cluster{"X Coordinate (mm)": f64, "Z Coordinate (mm)": f64, "Aprch Distance (mm)": f64}
  T2 = cluster{"X Coordinate (mm)": f64, "Z Coordinate (mm)": f64, "Vertical Spacing (mm)": f64, "Aprch Distance (mm)": f64, "Aprch Dstnc L.12 (mm)": f64}
  "XZ All Position Cluster.gtype" = cluster{"Diffusor Coordinates": T1, "Photodetector Coordinates": T1, "Cell R.01 Coordinates": T2}
  T3 = cluster{"Thorlabs Motor Serial Number File Path": path, "Default Data Saving Location": path}
  "Misc Data Mega Cluster.gtype" = cluster{"Full Reference Cluster": "Full Reference Cluster.gtype", "Cell Naming Cluster": "Cell Naming Cluster.gtype", "All XZ Position Cluster": "XZ All Position Cluster.gtype", "All Paths": T3}
diagram:
  # This subVI Takes a cell label (i.e L.03) and converts it into the gcode command for the XZ Stage needed to move to that specific location.
  case ($"Error In") {
    frame Error, Default {
      w1 = $"Error In"
      w2 = default
      w3 = default
      w4 = default
      w5 = default
      w6 = default
    }
    frame No Error {
      Property Node(instance in=$"Misc Data Mega Cluster In") -> ("All XZ Position Cluster:Cell R.01 Coordinates"=w7)
      Search And Replace String(error in (no error)=$"Error In", input string=$"Cell Label", search string="R.") -> (error out=w8, number of replacements=w9)
      Is Not Equal To 0(x=w9) -> w10
      Search And Replace String(error in (no error)=w8, input string=$"Cell Label", search string="L.") -> (error out=w1, number of replacements=w11)
      Is Not Equal To 0(x=w11) -> w12
      Logical Exclusive Or(w10, w12) -> w13
      String Length(string=$"Cell Label") -> (length=w14)
      Is Equal(x=w14, y=4) -> w15
      Logical And(w15, w13) -> w16
      case (w16) {
        frame False, Default {
          Wait Until Next Multiple(multiple to wait=1000)
          w17 = """There was a problem reading
the cell labels on XZ Carriage 
label to Coordinate. Please contact
Martí (minusmages@hotmail.com)
because this error is not supposed
to happen, like, ever."""
          One Button Dialog(button name ("OK")="Okay, but who is Martí?", message=w17)
          w2 = default
          w3 = default
          w4 = default
          w5 = default
          w6 = default
        }
        frame True {
          String Subset(offset (0)=2, string=$"Cell Label") -> w18
          Decimal String To Number(string=w18) -> (number=w19)
          Property Node(instance in=w7) -> ("X Coordinate (mm)"=w20, "Z Coordinate (mm)"=w21, "Vertical Spacing (mm)"=w22, "Aprch Distance (mm)"=w23, "Aprch Dstnc L.12 (mm)"=w24)
          In Range And Coerce(lower limit=1, upper limit=13, x=w19) -> (In Range?=w25)
          case (w25) {
            frame True {
              Decrement(x=w19) -> w26
              To Double Precision Float(number=w26) -> w27
              Multiply(w27, 5.08) -> w28
              Add(w28, w20) -> w4
              Subtract(x=w24, y=w23) -> w29
              Divide(x=w29, y=12) -> w30
              Multiply(w27, w30) -> w31
              Add(w31, w23) -> w6
            }
            frame False {
              w32 = "Cell out of range,\nthere is no R.13\nthe range is from\n1 to 12"
              One Button Dialog(button name ("OK")="Oh, sorry", message=w32)
              w4 = w20
              w6 = 0
            }
          }
          String Subset(length (rest)=1, string=$"Cell Label") -> w33
          case (w33) {
            frame "", Default {
              w34 = """There was a problem reading
the cell labels on XZ Carriage 
label to Coordinate. Please contact
Martí (minusmages@hotmail.com)
because this error is not supposed
to happen, like, ever."""
              One Button Dialog(button name ("OK")="Okay, but who is Martí?", message=w34)
              w3 = w21
            }
            frame "L" {
              Add(w21, w22) -> w3
            }
            frame "R" {
              w3 = w21
            }
          }
          Property Node(instance in="XZ Coordinate Cluster In.gtype" {all zero or empty}, "X Coordinate (mm)"=w4, "Z Coordinate (mm)"=w3) -> (instance out=w5)
          Number To Fractional String(number=w3, precision (6)=2, use system decimal point (T)=FALSE) -> (F-format string=w35)
          Number To Fractional String(number=w4, precision (6)=2, use system decimal point (T)=FALSE) -> (F-format string=w36)
          Concatenate Strings("G1 X", w36, " Z", w35) -> w2
        }
      }
    }
  }
  $"XZ Coordinate Out" <- w5
  $"Gcode Instruction Out" <- w2
  $"X coordinate out" <- w4
  $"Error Out" <- w1
  $"Z coordinate out" <- w3
  $"Y coordinate out" <- w6
