vi "XZ Stage Move To Location.gvi"   [LabVIEW NXG 5.0.0]
inputs:
  "Error In": error
  "XZ Carriage Arduino open Visa session In": "VISA Instr"
  "XZ Carriage Arduino Log In": string
  "Input Command": string = "G1 X100 Z100"
outputs:
  "Error Out": error
  "XZ Carriage Arduino open Visa Session Out": "VISA Instr"
  "XZ Carriage Arduino Log Out": string
uses:
  Rainbow Measurement Setup::Main Functions::Instruction Queue::Current State::FGV Current State.gvi
  NI::VISA::Write (Instr, String).gvi
  Rainbow Measurement Setup::Side Functions::Utilities::Wait ms.gvi
  Rainbow Measurement Setup::Side Functions::Global Abort::FGV Global Abort.gvi
  NI::VISA::Read (Instr, String).gvi
  NI::VISA::Clear (Instr).gvi
  Rainbow Measurement Setup::Side Functions::Error Handling::Misc Error Eraser.gvi
diagram:
  # This SubVI Sends a command to the XZ stage arduino to move it to a specified location and It waits for the arduino to respond. If the arduino responds with Moved the operation
  # is successful and it continues on without errors. If the arduino responds with coordinate out of range it prompts the user accordingly. If the arduino just does not respond the reading
  # stops and the software attempts to write the command again up to 5 times. If the movement has failed after 5 times the software prompts the user recommending to connect everything
  # correctly and restarting the software.
  case ($"Error In") {
    frame Error, Default {
      w1 = $"Error In"
      w2 = $"XZ Carriage Arduino open Visa session In"
      w3 = $"XZ Carriage Arduino Log In"
    }
    frame No Error {
      call "FGV Current State.gvi"(Current State Instructions="Set Current Substate", Current Substate="Moving XZ Stage", Error In=$"Error In") -> (Error Out=w4)
      Concatenate Strings($"Input Command", "\r\n") -> w5
      s1 = $"XZ Carriage Arduino open Visa session In"  # shift register
      s2 = w4  # shift register
      s3 = $"XZ Carriage Arduino Log In"  # shift register
      while (iteration -> i1) {
        call "Write (Instr, String).gvi"(session in=s1, error in=s2, write buffer=w5) -> (session out=w6, error out=w7)
        call "Wait ms.gvi"(Error In=w7) -> (Error Out=w8)
        s4 = w6  # shift register
        s5 = w8  # shift register
        s6 = s3  # shift register
        while (iteration -> i2) {
          call "FGV Global Abort.gvi"(Global Abort Instructions="Read Current State", Error In=s5) -> (Local Abort Out=w11, Global Abort Out=w12, Error Out=w13)
          Property Node(instance in=s4, error in=w13) -> ("ASRL Bytes at Port"=w14, error out=w15, instance out=w16)
          Is Not Equal To 0(x=w14) -> w17
          Is Greater(x=w14, y=300) -> w18
          case (w17) {
            frame False, Default {
              w19 = ""
              w20 = w16
              w21 = w15
            }
            frame True {
              call "Read (Instr, String).gvi"(session in=w16, error in=w15, byte count=w14) -> (session out=w22, error out=w23, read buffer=w19)
              case (w18) {
                frame False, Default {
                  w20 = w22
                  w21 = w23
                }
                frame True {
                  call "Clear (Instr).gvi"(session in=w22, error in=w23) -> (session out=w20, error out=w21)
                }
              }
            }
          }
          Concatenate Strings(s6, w19) -> w24
          Search And Replace String(input string=w19, search string="Moved") -> (number of replacements=w25)
          Is Not Equal To 0(x=w25) -> w26
          Search And Replace String(input string=w19, search string="Coordinate") -> (number of replacements=w27)
          Is Not Equal To 0(x=w27) -> w28
          Logical Or(w26, w28) -> w29
          Logical Or(w11, w12) -> w30
          Is Greater(x=i2, y=30) -> w31
          Logical Or(w26, w31, w30, w21, w28) -> w32
          Wait Until Next Multiple(multiple to wait=100)
          append w29 to w9
          append w28 to w10
          next s4 = w20
          next s5 = w21
          next s6 = w24
          stop if w32
        }
        Or Array Elements(Boolean array=w10) -> (logical OR=w33)
        case (w33) {
          frame False, Default { }
          frame True {
            One Button Dialog(button name ("OK")="Oh Sorry,\nit wasn't my intention", message="The coordinate you requested is \nout of range.")
          }
        }
        Or Array Elements(Boolean array=w9) -> (logical OR=w34)
        Is Greater(x=i1, y=5) -> w35
        Logical And(w35, not w34) -> w36
        case (w36) {
          frame False, Default { }
          frame True {
            w37 = """XZ Stage Movement Mitght 
have Failed Please make sure the 
power cord is connected as 
well as the USB Cable. 
(You might have to restart the 
software)"""
            One Button Dialog(button name ("OK")="Okay I will Check", message=w37)
          }
        }
        Logical Or(w35, w34) -> w38
        call "Misc Error Eraser.gvi"(Error In=s5) -> (Error Out=w39)
        next s1 = s4
        next s2 = w39
        next s3 = s6
        stop if w38
      }
      w1 = s2
      w2 = s1
      w3 = s3
    }
  }
  $"XZ Carriage Arduino Log Out" <- w3
  $"XZ Carriage Arduino open Visa Session Out" <- w2
  $"Error Out" <- w1
