vi "XZ Stage Test.gvi"   [LabVIEW NXG 5.0.0]
inputs:
  "Error In": error
outputs:
  "Error Out": error
panel controls:
  "XZ Scan Parameters In": "XZ Scan Parameters.gtype"
panel indicators:
  "XZ Carriage Arduino Log Out": string
  "XZ Stage Arduino Address": "VISA Instr"
types:
  "XZ Scan Parameters.gtype" = cluster{"X Scan Range (mm)": f64, "Z Scan Range (mm)": f64, "X Steps": f64, "Z Steps": f64, "Center Coordinate X": f64, "Center Coordinate Z": f64, "Z Step size": f64, "X Step size": f64, "Total Steps": f64, "Z Starting Point": f64, "X Starting Point": f64, "Z End Point": f64, "X End Point": f64}
uses:
  Rainbow Measurement Setup::Side Functions::Scanning Calculations::Scan Points Generator.gvi
  Rainbow Measurement Setup::Side Functions::Instrument Control::Arduino::Arduino Detector.gvi
  Rainbow Measurement Setup::Side Functions::Instrument Control::Arduino::XZ Stage Arduino::Low Level::XZ Stage Initialize.gvi
  Rainbow Measurement Setup::Side Functions::Instrument Control::Arduino::XZ Stage Arduino::Low Level::XZ Stage Home Sequence.gvi
  Rainbow Measurement Setup::Side Functions::Instrument Control::Arduino::XZ Stage Arduino::Low Level::XZ Stage Move To Location.gvi
  Rainbow Measurement Setup::Side Functions::Instrument Control::Arduino::XZ Stage Arduino::Low Level::XZ Stage Fast Movement.gvi
  NI::VISA::Close (Instr).gvi
diagram:
  # This VI is used just to test the XZ Stage
  case ($"Error In") {
    frame Error, Default {
      w1 = $"Error In"
    }
    frame No Error {
      call "Scan Points Generator.gvi"(XZ Scan Parameters In=$"XZ Scan Parameters In", Error In=$"Error In") -> (XZ Coordinate Array=w2, Error Out=w3)
      Is Empty String Or Path(string/path=$"XZ Stage Arduino Address") -> w4
      case (w4) {
        frame False, Default {
          w5 = TRUE
          w6 = $"XZ Stage Arduino Address"
          w7 = w3
        }
        frame True {
          call "Arduino Detector.gvi"(Error In=w3) -> (Arduino Detection info Out=w8, Error Out=w7)
          Property Node(instance in=w8) -> ("XZ Stage Arduino Address"=w6, "XZ Stage Arduino Detected?"=w5)
        }
      }
      $"XZ Stage Arduino Address" <- w6
      case (w5) {
        frame False, Default {
          w1 = w7
        }
        frame True {
          Array Index(array=w2) -> (out0[0]=w9)
          Property Node(instance in=w9) -> ("Coordinate Gcode"=w10)
          call "XZ Stage Initialize.gvi"(XZ Carriage Arduino Adress In=w6, Error In=w7) -> (XZ Carriage Arduino Visa Session Out=w11, XZ Carriage Arduino Log=w12, Error Out=w13)
          call "XZ Stage Home Sequence.gvi"(XZ Carriage Arduino Open Visa Session In=w11, XZ Carriage Arduino Log In=w12, Error In=w13) -> (XZ Carriage Arduino Open Visa Session Out=w14, XZ Carriage Arduino Log Out=w15, Error Out=w16)
          call "XZ Stage Move To Location.gvi"(XZ Carriage Arduino open Visa session In=w14, XZ Carriage Arduino Log In=w15, Error In=w16, Input Command=w10) -> (XZ Carriage Arduino open Visa Session Out=w17, XZ Carriage Arduino Log Out=w18, Error Out=w19)
          s1 = w19  # shift register
          s2 = w17  # shift register
          s3 = w18  # shift register
          for {
            w20 = each element of w2
            Property Node(instance in=w20) -> ("Coordinate Gcode"=w21)
            call "XZ Stage Fast Movement.gvi"(XZ Carriage Arduino open Visa session In=s2, XZ Stage Arduino Log In=s3, Error In=s1, Input Command=w21, ms Wait Fast Movement=10) -> (XZ Carriage Arduino open Visa Session Out=w22, XZ Stage Arduino Log Out=w23, Error Out=w24)
            next s1 = w24
            next s2 = w22
            next s3 = w23
          }
          call "Close (Instr).gvi"(session in=s2) -> (error out=w1)
          $"XZ Carriage Arduino Log Out" <- s3
        }
      }
    }
  }
  $"Error Out" <- w1
