vi "XZ Y Safe Approach and Retract.gvi"   [LabVIEW NXG 5.0.0]
inputs:
  "Error In": error
  "Instrument Control Mega Cluster In": "Instrument Control Mega Cluster.gtype"
  "Approach Operation": "XZ Approach Operation.gtype" = "Retract"
  "Misc Data Mega Cluster": "Misc Data Mega Cluster.gtype"
  "Cell Label": string
outputs:
  "Error Out": error
  "Instrument Control Mega Cluster Out": "Instrument Control Mega Cluster.gtype"
types:
  "Instrument Coms Info.gtype" = cluster{"Arduino Coms Info": "Arduino Detection cluster control.gtype", "Photodetector Names": string[], "Keythley Address": "VISA Instr", "Photodetector Detected?": bool, "Thorlabs Motors Detected?": bool, "Keithley Detected?": bool, "Thorlabs Motors Serial Number": "Thorlabs Motors Serial Number In.gtype", "Photodetector IVI session": "Ivi IviDefault", "Flame ID": string, "Flame Detected?": bool, "Flame Wrapper ID": u64}
  "Debugging Cluster.gtype" = cluster{"Debugging mode?": bool, "Initialize App": bool, "Insturment Debugging": "Insturment Debugging Cluster.gtype"}
  "Instrument Control Mega Cluster.gtype" = cluster{"Instruments Coms Info": "Instrument Coms Info.gtype", "Debugging Cluster": "Debugging Cluster.gtype"}
  "XZ Approach Operation.gtype" = enum{"Retract", "Approach Cell", "Approach Photodetector", "Approach Diffusor"}
  "Full Reference Cluster.gtype" = cluster{"Enum Reference Cluster": "Enum Control Reference Cluster.gtype", "Boolean Reference Cluster": "Boolean Control Reference Cluster.gtype", "Numeric Reference Cluster": "Numeric Control Reference Cluster.gtype", "Numeric Cluster Reference Cluster": "Numeric Cluster Reference Cluster.gtype", "Path Reference Cluster": "Path Reference Cluster.gtype", "Cluster Reference Cluster": "Cluster Reference Cluster.gtype", "XZ Stage Controls Reference Cluster": "XZ Stage Controls Reference Cluster.gtype"}
  "Cell Naming Cluster.gtype" = cluster{"Cell Label": string, "Sample Prefix": string, "Author Initials": string, "Current Date": string, "Batch Name": string}
  T1 = cluster{"X Coordinate (mm)": f64, "Z Coordinate (mm)": f64, "Aprch Distance (mm)": f64}
  T2 = cluster{"X Coordinate (mm)": f64, "Z Coordinate (mm)": f64, "Vertical Spacing (mm)": f64, "Aprch Distance (mm)": f64, "Aprch Dstnc L.12 (mm)": f64}
  "XZ All Position Cluster.gtype" = cluster{"Diffusor Coordinates": T1, "Photodetector Coordinates": T1, "Cell R.01 Coordinates": T2}
  T3 = cluster{"Thorlabs Motor Serial Number File Path": path, "Default Data Saving Location": path}
  "Misc Data Mega Cluster.gtype" = cluster{"Full Reference Cluster": "Full Reference Cluster.gtype", "Cell Naming Cluster": "Cell Naming Cluster.gtype", "All XZ Position Cluster": "XZ All Position Cluster.gtype", "All Paths": T3}
uses:
  Rainbow Measurement Setup::Main Functions::Instruction Queue::Current State::FGV Current State.gvi
  Rainbow Measurement Setup::Side Functions::Instrument Control::Arduino::XZ Stage Arduino::Low Level::XZ Stage Approach to Gcode.gvi
  Rainbow Measurement Setup::Side Functions::Instrument Control::Arduino::XZ Stage Arduino::Low Level::XZ Stage Move To Location.gvi
diagram:
  # This SubVI Initializes the XZ stage and homes it while appending the log onto the Instrument Coms Info Cluster
  # It also checks the debugging cluster to see if we want to use the Arduinos or not
  case ($"Error In") {
    frame Error, Default {
      w1 = $"Error In"
      w2 = $"Instrument Control Mega Cluster In"
    }
    frame No Error {
      Property Node(instance in=$"Instrument Control Mega Cluster In") -> ("Debugging Cluster:Debugging mode?"=w3, "Debugging Cluster:Insturment Debugging:Arduinos"=w4, instance out=w5)
      Logical And[output inverted](w3, not w4) -> w6
      case (w6) {
        frame False, Default {
          w1 = $"Error In"
          w2 = w5
        }
        frame True {
          case ($"Approach Operation") {
            frame "Retract", Default {
              Property Node(instance in=w5) -> ("Instruments Coms Info:Arduino Coms Info:XZ Stage Arduino Address"=w7, "Instruments Coms Info:Arduino Coms Info:XZ Stage Log"=w8, instance out=w9)
              call "FGV Current State.gvi"(Current State Instructions="Set Current Substate", Current Substate="Retracting XZ Stage", Error In=$"Error In") -> (Error Out=w10)
              call "XZ Stage Approach to Gcode.gvi"(Misc Data Mega Cluster In=$"Misc Data Mega Cluster", Approach Operation=$"Approach Operation", Error In=w10) -> (Gcode Instruction=w11, Error Out=w12)
              call "XZ Stage Move To Location.gvi"(XZ Carriage Arduino open Visa session In=w7, XZ Carriage Arduino Log In=w8, Error In=w12, Input Command=w11) -> (XZ Carriage Arduino Log Out=w13, Error Out=w1)
              Property Node(instance in=w9, "Instruments Coms Info:Arduino Coms Info:XZ Stage Log"=w13) -> (instance out=w2)
            }
            frame "Approach Cell" {
              Property Node(instance in=w5) -> ("Instruments Coms Info:Arduino Coms Info:XZ Stage Arduino Address"=w14, "Instruments Coms Info:Arduino Coms Info:XZ Stage Log"=w15, instance out=w16)
              call "FGV Current State.gvi"(Current State Instructions="Set Current Substate", Current Substate="Approaching XZ Stage", Error In=$"Error In") -> (Error Out=w17)
              call "XZ Stage Approach to Gcode.gvi"(Misc Data Mega Cluster In=$"Misc Data Mega Cluster", Approach Operation=$"Approach Operation", Error In=w17, Cell Label=$"Cell Label") -> (Gcode Instruction=w18, Error Out=w19)
              call "XZ Stage Move To Location.gvi"(XZ Carriage Arduino open Visa session In=w14, XZ Carriage Arduino Log In=w15, Error In=w19, Input Command=w18) -> (XZ Carriage Arduino Log Out=w20, Error Out=w1)
              Property Node(instance in=w16, "Instruments Coms Info:Arduino Coms Info:XZ Stage Log"=w20) -> (instance out=w2)
            }
          }
        }
      }
    }
  }
  $"Instrument Control Mega Cluster Out" <- w2
  $"Error Out" <- w1
