vi "Debug Cluster Instrument Extractor.gvi"   [LabVIEW NXG 5.0.0]
inputs:
  "Error In": error
  "Instrument Control Mega Cluster In": "Instrument Control Mega Cluster.gtype"
outputs:
  "Error Out": error
  "Instrument Control Mega Cluster Out": "Instrument Control Mega Cluster.gtype"
  "Instruments to Detect": "Instruments To Detect control.gtype"[]
types:
  "Instruments To Detect control.gtype" = enum{"Photodetector", "Keithley", "Arduinos", "Thorlabs Motors", "Flame Spectr"}
  "Instrument Coms Info.gtype" = cluster{"Arduino Coms Info": "Arduino Detection cluster control.gtype", "Photodetector Names": string[], "Keythley Address": "VISA Instr", "Photodetector Detected?": bool, "Thorlabs Motors Detected?": bool, "Keithley Detected?": bool, "Thorlabs Motors Serial Number": "Thorlabs Motors Serial Number In.gtype", "Photodetector IVI session": "Ivi IviDefault", "Flame ID": string, "Flame Detected?": bool, "Flame Wrapper ID": u64}
  "Debugging Cluster.gtype" = cluster{"Debugging mode?": bool, "Initialize App": bool, "Insturment Debugging": "Insturment Debugging Cluster.gtype"}
  "Instrument Control Mega Cluster.gtype" = cluster{"Instruments Coms Info": "Instrument Coms Info.gtype", "Debugging Cluster": "Debugging Cluster.gtype"}
uses:
  Rainbow Measurement Setup::Side Functions::Instrument Control::Instruction Extractor Instruments to Detect.gvi
diagram:
  # This SubVI reads the debugging state of each instrument and appends it or not
  # depending on what the user has specified to detect and initialize.
  case ($"Error In") {
    frame Error, Default {
      w1 = $"Error In"
      w2 = "Instruments To Detect control.gtype"[] []
      w3 = $"Instrument Control Mega Cluster In"
    }
    frame No Error {
      Property Node(instance in=$"Instrument Control Mega Cluster In") -> ("Debugging Cluster:Debugging mode?"=w4, "Debugging Cluster:Insturment Debugging"=w5, instance out=w3)
      w6 = ["Keithley", "Arduinos", "Thorlabs Motors", "Photodetector", "Flame Spectr"]
      Property Node(instance in=w5) -> ("Keithley"=w7, "Arduinos"=w8, "Thorlabs Motors"=w9, "Photodetector"=w10, "Flame Spectr"=w11)
      Build Array(w7, w8, w9, w10, w11) -> w12
      for {
        w13 = each element of w12
        w14 = each element of w6
        append w14 to w15 if w13
      }
      call "Instruction Extractor Instruments to Detect.gvi"(Instruments To Detect control="Photodetector", Error In=$"Error In") -> (Instruments To Detect Array=w16, Error Out=w1)
      Select(s=w4, t=w15, f=w16) -> w2
    }
  }
  $"Error Out" <- w1
  $"Instrument Control Mega Cluster Out" <- w3
  $"Instruments to Detect" <- w2
