vi "Flame Detector.gvi"   [LabVIEW NXG 5.0.0]
inputs:
  "Error In": error
outputs:
  "Error Out": error
  "Spectrometer Name": string
  "Spectrometer Connected?": bool
uses:
  Rainbow Measurement Setup::Side Functions::Global Abort::FGV Global Abort.gvi
  Shared::Wrapper::Wrapper_Create.gvi
  Shared::Wrapper::Wrapper_openAllSpectrometers.gvi
  Shared::Wrapper::Wrapper_getName.gvi
  Shared::Wrapper::Wrapper_closeAllSpectrometers.gvi
  Shared::Wrapper::Wrapper_Destroy.gvi
diagram:
  # This SubVI tries to detect the Flame spectrometer or any spectrometer by ocean optics
  # and if it can't or if there is more than one connected it asks the user to connect only one.
  case ($"Error In") {
    frame Error, Default {
      w1 = $"Error In"
      w2 = ""
      w3 = default
    }
    frame No Error {
      while {
        call "FGV Global Abort.gvi"(Global Abort Instructions="Read Current State", Error In=$"Error In") -> (Global Abort Out=w4, Error Out=w5)
        call "Wrapper_Create.gvi"(Error In=w5) -> (Wrapper Out=w6, Error Out=w7)
        call "Wrapper_openAllSpectrometers.gvi"(Wrapper In=w6, Error In=w7) -> (Wrapper Out=w8, Number of Spectrometers=w9, Error Out=w10)
        Is Equal(x=1, y=w9) -> w11
        case (w11) {
          frame False, Default {
            Number To Decimal String(number=w9) -> (decimal integer string=w15)
            w16 = "Please make sure you have connected exactly one Spectrometer. The current number of connected spectrometers is:\n"
            Concatenate Strings(w16, w15) -> w17
            w18 = "I do not want to use any spectrometer. \n(Some features will be disabled)"
            Two Button Dialog(F button name ("Cancel")=w18, T button name ("OK")="Okay I will connect them.", message=w17) -> (T Button?=w19)
            Not(x=w19) -> w14
            w2 = ""
            w12 = w10
            w13 = w8
            w3 = default
          }
          frame True {
            call "Wrapper_getName.gvi"(Wrapper In=w8, Error In=w10) -> (Wrapper Out=w13, Spectrometer Name=w2, Error Out=w12)
            w14 = TRUE
            w3 = TRUE
          }
        }
        call "Wrapper_closeAllSpectrometers.gvi"(Wrapper In=w13, Error In=w12) -> (Wrapper Out=w20, Error Out=w21)
        call "Wrapper_Destroy.gvi"(Wrapper In=w20, Error In=w21) -> (Error Out=w1)
        Logical Or(w14, w4) -> w22
        Wait Until Next Multiple(multiple to wait=100)
        stop if w22
      }
    }
  }
  $"Spectrometer Connected?" <- w3
  $"Spectrometer Name" <- w2
  $"Error Out" <- w1
