vi "Flame Get Spectra.gvi"   [LabVIEW NXG 5.0.0]
inputs:
  "Error In": error
  "Instrument Coms Info In": "Instrument Coms Info.gtype"
  "Debugging Cluster In": "Debugging Cluster.gtype"
outputs:
  "Error Out": error
  "Instrument Coms Info Out": "Instrument Coms Info.gtype"
  "Debugging Cluster Out": "Debugging Cluster.gtype"
  "Beam Spectrum": cluster{"Wavelength": f64[], "Counts": f64[]}
types:
  T1 = cluster{"Element 1": "VISA Instr", "Element 2": string}
  "Arduino Detection cluster control.gtype" = cluster{"XZ Stage Arduino Address": "VISA Instr", "XZ Stage Arduino Detected?": bool, "Multiplexer Arduino Detected?": bool, "Multiplexer Arduino Address": "VISA Instr", "Arduinos List": T1[], "XZ Stage Log": string, "Multiplexer Log": string}
  "Thorlabs Motors Serial Number In.gtype" = cluster{"Thorlabs Blue Motor": string, "Thorlabs Red Motor": string, "Blue Motor Homed?": bool, "Red Motor Homed?": bool}
  "Instrument Coms Info.gtype" = cluster{"Arduino Coms Info": "Arduino Detection cluster control.gtype", "Photodetector Names": string[], "Keythley Address": "VISA Instr", "Photodetector Detected?": bool, "Thorlabs Motors Detected?": bool, "Keithley Detected?": bool, "Thorlabs Motors Serial Number": "Thorlabs Motors Serial Number In.gtype", "Photodetector IVI session": "Ivi IviDefault", "Flame ID": string, "Flame Detected?": bool, "Flame Wrapper ID": u64}
  "Insturment Debugging Cluster.gtype" = cluster{"Keithley": bool, "Arduinos": bool, "Thorlabs Motors": bool, "Photodetector": bool, "Flame Spectr": bool}
  "Debugging Cluster.gtype" = cluster{"Debugging mode?": bool, "Initialize App": bool, "Insturment Debugging": "Insturment Debugging Cluster.gtype"}
uses:
  Shared::Wrapper::Wrapper_getWavelengths.gvi
  Shared::Wrapper::Wrapper_getSpectrum.gvi
diagram:
  # This SubVI Takes a spectrum, if the debugging allows it to do so and stores it within a cluster so that it can be later used.
  # Unless the Wrapper ID is empty.
  case ($"Error In") {
    frame Error, Default {
      w5 = cluster{"Wavelength": f64[], "Counts": f64[]} {all zero or empty}
      w1 = $"Error In"
      w2 = w5
      w3 = $"Instrument Coms Info In"
      w4 = $"Debugging Cluster In"
    }
    frame No Error {
      Property Node(instance in=$"Debugging Cluster In") -> ("Debugging mode?"=w6, "Insturment Debugging:Flame Spectr"=w7, instance out=w4)
      Logical And[output inverted](w6, not w7) -> w8
      case (w8) {
        frame False, Default {
          w9 = cluster{"Wavelength": f64[], "Counts": f64[]} {all zero or empty}
          w1 = $"Error In"
          w2 = w9
          w3 = $"Instrument Coms Info In"
        }
        frame True {
          Property Node(instance in=$"Instrument Coms Info In") -> ("Flame Wrapper ID"=w10, instance out=w3)
          Is Not Equal To 0(x=w10) -> w11
          case (w11) {
            frame False, Default {
              w12 = cluster{"Wavelength": f64[], "Counts": f64[]} {all zero or empty}
              w2 = w12
              w1 = $"Error In"
            }
            frame True {
              call "Wrapper_getWavelengths.gvi"(Wrapper In=w10, Error In=$"Error In") -> (Wrapper Out=w13, WL Values=w14, Error Out=w15)
              call "Wrapper_getSpectrum.gvi"(Wrapper In=w13, Error In=w15) -> (Spectrum Values=w16, Error Out=w1)
              w17 = cluster{"Wavelength": f64[], "Counts": f64[]} {all zero or empty}
              Property Node(instance in=w17, "Wavelength"=w14, "Counts"=w16) -> (instance out=w2)
            }
          }
        }
      }
    }
  }
  $"Debugging Cluster Out" <- w4
  $"Instrument Coms Info Out" <- w3
  $"Beam Spectrum" <- w2
  $"Error Out" <- w1
