vi "Instruction Extractor Instruments to Detect.gvi"   [LabVIEW NXG 5.0.0]
inputs:
  "Error In": error
  "Instruments To Detect control": "Instruments To Detect control.gtype" = "Photodetector"
outputs:
  "Error Out": error
  "Instruments To Detect Array": "Instruments To Detect control.gtype"[]
  "Instruments To Detect String Array": string[]
types:
  "Instruments To Detect control.gtype" = enum{"Photodetector", "Keithley", "Arduinos", "Thorlabs Motors", "Flame Spectr"}
diagram:
  case ($"Error In") {
    frame Error, Default {
      w1 = $"Error In"
    }
    frame No Error {
      # This loop runs through the enum and extracts all
      # the elements storing them as an array.
      # It also stores the name of the instructions so that
      # they can be displayed afttewards for debugging purposes
      s1 = uninitialised  # shift register
      s2 = $"Error In"  # shift register
      while (iteration -> i1) {
        To Unsigned 16 Bit Integer(number=i1) -> w4
        Type Cast(type=$"Instruments To Detect control", x=w4) -> w5
        Format Into String(errIn=s2, w5) -> (outString=w6, errOut=w7)
        Is Not Equal To 0(x=i1) -> w8
        case (w8) {
          frame False, Default {
            w9 = FALSE
          }
          frame True {
            Is Equal(x=s1, y=w5) -> w9
          }
        }
        Not(x=w9) -> w10
        append w5 to w2 if w10
        append w6 to w3 if w10
        next s1 = w5
        next s2 = w7
        stop if w9
      }
      $"Instruments To Detect String Array" <- w3
      $"Instruments To Detect Array" <- w2
      w1 = s2
    }
  }
  $"Error Out" <- w1
