vi "Instrument Detector.gvi"   [LabVIEW NXG 5.0.0]
inputs:
  "Error In": error
  "Instruments To Detect control": "Instruments To Detect control.gtype" = "Photodetector", required
  "Instrument Control Mega Cluster In": "Instrument Control Mega Cluster.gtype"
  "Stand Alone?": bool
outputs:
  "Error Out": error
  "Instrument Control Mega Cluster Out": "Instrument Control Mega Cluster.gtype"
types:
  "Instruments To Detect control.gtype" = enum{"Photodetector", "Keithley", "Arduinos", "Thorlabs Motors", "Flame Spectr"}
  "Instrument Coms Info.gtype" = cluster{"Arduino Coms Info": "Arduino Detection cluster control.gtype", "Photodetector Names": string[], "Keythley Address": "VISA Instr", "Photodetector Detected?": bool, "Thorlabs Motors Detected?": bool, "Keithley Detected?": bool, "Thorlabs Motors Serial Number": "Thorlabs Motors Serial Number In.gtype", "Photodetector IVI session": "Ivi IviDefault", "Flame ID": string, "Flame Detected?": bool, "Flame Wrapper ID": u64}
  "Debugging Cluster.gtype" = cluster{"Debugging mode?": bool, "Initialize App": bool, "Insturment Debugging": "Insturment Debugging Cluster.gtype"}
  "Instrument Control Mega Cluster.gtype" = cluster{"Instruments Coms Info": "Instrument Coms Info.gtype", "Debugging Cluster": "Debugging Cluster.gtype"}
uses:
  Rainbow Measurement Setup::Main Functions::Instruction Queue::Current State::FGV Current State.gvi
  Rainbow Measurement Setup::Side Functions::Instrument Control::Photodetector::Photodetector Detection Subroutine.gvi
  Rainbow Measurement Setup::Side Functions::Instrument Control::Keithley::Keithley Detection Subroutine.gvi
  Rainbow Measurement Setup::Side Functions::Instrument Control::Arduino::Arduino Detection Subroutine.gvi
  Rainbow Measurement Setup::Side Functions::Instrument Control::Flame Spectrometer::Flame Detector.gvi
  Rainbow Measurement Setup::Side Functions::Instrument Control::Thorlabs Motors::Detection::Thorlabs Serial Number Check.gvi
  Rainbow Measurement Setup::Side Functions::Instrument Control::Thorlabs Motors::Detection::Thorlabs motor Detector.gvi
diagram:
  # This SubVI is a caller subVI that detects any instrument specified by the instruments to detect control and then
  # stores the required information within ghe instrument Addresses Cluster
  case ($"Error In") {
    frame Error, Default {
      w1 = $"Error In"
      w2 = $"Instrument Control Mega Cluster In"
    }
    frame No Error {
      case ($"Instruments To Detect control") {
        frame "Photodetector", Default {
          call "FGV Current State.gvi"(Current State Instructions="Set Current Substate", Current Substate="Detecting Photodetector", Error In=$"Error In") -> (Error Out=w3)
          call "Photodetector Detection Subroutine.gvi"(Error In=w3) -> (Photodetector Names=w4, Detected?=w5, Error Out=w1)
          Property Node(instance in=$"Instrument Control Mega Cluster In", "Instruments Coms Info:Photodetector Names"=w4, "Instruments Coms Info:Photodetector Detected?"=w5) -> (instance out=w2)
        }
        frame "Keithley" {
          call "FGV Current State.gvi"(Current State Instructions="Set Current Substate", Current Substate="Detecting Keithley", Error In=$"Error In") -> (Error Out=w6)
          call "Keithley Detection Subroutine.gvi"(Error In=w6) -> (Keythley Address Out=w7, Detected?=w8, Error Out=w1)
          Property Node(instance in=$"Instrument Control Mega Cluster In", "Instruments Coms Info:Keythley Address"=w7, "Instruments Coms Info:Keithley Detected?"=w8) -> (instance out=w2)
        }
        frame "Arduinos" {
          call "FGV Current State.gvi"(Current State Instructions="Set Current Substate", Current Substate="Detecting Arduinos", Error In=$"Error In") -> (Error Out=w9)
          call "Arduino Detection Subroutine.gvi"(Error In=w9) -> (Arduino Detection Cluster Info Out=w10, Error Out=w1)
          Property Node(instance in=$"Instrument Control Mega Cluster In", "Instruments Coms Info:Arduino Coms Info"=w10) -> (instance out=w2)
        }
        frame "Flame Spectr" {
          call "FGV Current State.gvi"(Current State Instructions="Set Current Substate", Current Substate="Detecting Spectrometer", Error In=$"Error In") -> (Error Out=w11)
          call "Flame Detector.gvi"(Error In=w11) -> (Spectrometer Name=w12, Spectrometer Connected?=w13, Error Out=w1)
          Property Node(instance in=$"Instrument Control Mega Cluster In", "Instruments Coms Info:Flame ID"=w12, "Instruments Coms Info:Flame Detected?"=w13) -> (instance out=w2)
        }
        frame "Thorlabs Motors" {
          Property Node(instance in=$"Instrument Control Mega Cluster In") -> ("Instruments Coms Info:Thorlabs Motors Serial Number"=w14, instance out=w15)
          call "FGV Current State.gvi"(Current State Instructions="Set Current Substate", Current Substate="Detecting Thorlabs Motors", Error In=$"Error In") -> (Error Out=w16)
          case ($"Stand Alone?") {
            frame False, Default {
              w17 = w16
              w18 = w14
            }
            frame True {
              call "Thorlabs Serial Number Check.gvi"(Error In=w16) -> (Thorlabs Motors Serial Number Out=w18, Error Out=w17)
            }
          }
          call "Thorlabs motor Detector.gvi"(Thorlabs Motors Serial Number In=w18, Error In=w17) -> (Detected?=w19, Thorlabs Motors Serial Number Out=w20, Error Out=w1)
          Property Node(instance in=w15, "Instruments Coms Info:Thorlabs Motors Detected?"=w19, "Instruments Coms Info:Thorlabs Motors Serial Number"=w20) -> (instance out=w2)
        }
      }
    }
  }
  $"Instrument Control Mega Cluster Out" <- w2
  $"Error Out" <- w1
