vi "Keithley Detection Subroutine.gvi"   [LabVIEW NXG 5.0.0]
inputs:
  "Error In": error
outputs:
  "Error Out": error
  "Detected?": bool
  "Keythley Address Out": "VISA Instr"
uses:
  NI::VISA::Find Resource (Search Resources).gvi
  NI::G Core::Error::Clear Error Cluster.gvi
diagram:
  # This subVi scans all dhe available resources in search for the keithley and if found returns its address.
  # If not found it prompts the user to connect it propperly.
  case ($"Error In") {
    frame Error, Default {
      w1 = $"Error In"
    }
    frame No Error {
      while (iteration -> i1) {
        call "Find Resource (Search Resources).gvi"(error in=$"Error In") -> (found resources=w2, error out=w3)
        for {
          w4 = each element of w2
          Search And Replace String(error in (no error)=w3, input string=w4, search string="2450") -> (error out=w6, number of replacements=w7)
          Is Greater Than 0(x=w7) -> w8
          append w4 to w5 if w8
        }
        Is Empty Array(array=w5) -> w9
        Array Size(array=w5) -> (size(s)=w10)
        Is Greater(x=w10, y=1) -> w11
        Logical Or(w9, w11) -> w12
        case (w12) {
          frame False, Default {
            Array Index(array=w5) -> (out0[0]=w14)
            w13 = TRUE
            w15 = w6
            w16 = TRUE
          }
          frame True {
            Wait Until Next Multiple(multiple to wait=500)
            call "Clear Error Cluster.gvi"(error in=w6) -> (error out=w15)
            w17 = """Seems like you have connected
either more than one 2450 keithley
to this computer or none at all, 
please disconnect all of them but
one, or connect at least one
and then retry."""
            One Button Dialog(button name ("OK")="Okay, sorry.", message=w17)
            w13 = FALSE
            w14 = ""
            w16 = default
          }
        }
        Type Cast(type="VISA Instr" "", x=w14) -> w18
        Is Greater(x=i1, y=5) -> w19
        case (w19) {
          frame False, Default {
            w20 = FALSE
            w1 = w15
          }
          frame True {
            w21 = """Seems you're having some trouble
connecting the keithley, do you 
want to proceed without connecting it
and hope for the best?
(WARNING: some functionalities might
be compromized, or the entire program 
can crash)"""
            Two Button Dialog(F button name ("Cancel")="Oh dear no, I'd rather ask for help", T button name ("OK")="Yes please, I like to live dangerously", message=w21) -> (T Button?=w20)
            w1 = w15
          }
        }
        Logical Or(w13, w20) -> w22
        stop if w22
      }
      $"Detected?" <- w16
      $"Keythley Address Out" <- w18
    }
  }
  $"Error Out" <- w1
