vi "Fast Low Level Sweep Subroutine.gvi"   [LabVIEW NXG 5.0.0]
inputs:
  "Error In": error
  "VISA resource name in": "VISA Instr"
  "Fast Sweep Mega Cluster In": "Fast Sweep Parameters.gtype"
outputs:
  "Error Out": error
  "VISA resource name out": "VISA Instr"
  "Fast Sweep Mega Cluster Out": "Fast Sweep Parameters.gtype"
types:
  T1 = cluster{"Sweep Direction": bool, "Min Voltage (V)": f64, "Max Voltage (V)": f64, "Measurement Speed (1 PLC)": f64, "Sweep Points": u32}
  T2 = cluster{"Current Array (A)": f64[], "Voltage Array (V)": f64[], "Isc (A)": f64}
  "Fast Sweep Parameters.gtype" = cluster{"Parameters": T1, "Data": T2}
uses:
  NI::VISA::Write (Instr, String).gvi
  Labview_NXG_Keithley_SMU_2450_2460_2461::Data::Low Level::Wait for Operation Complete.gvi
  Labview_NXG_Keithley_SMU_2450_2460_2461::Data::Read (Multiple Points).gvi
  Labview_NXG_Keithley_SMU_2450_2460_2461::Action Status::Enable Output.gvi
  Labview_NXG_Keithley_SMU_2450_2460_2461::Configure::Clear Buffer.gvi
diagram:
  # This SubVI performs a fast sweep given the Isc to properly set the range
  case ($"Error In") {
    frame Error, Default {
      w1 = $"Error In"
      w2 = $"VISA resource name in"
      w3 = $"Fast Sweep Mega Cluster In"
    }
    frame No Error {
      Property Node(instance in=$"Fast Sweep Mega Cluster In") -> ("Data:Voltage Array (V)"=w4, "Data:Current Array (A)"=w5, instance out=w6)
      w7 = ":TRAC:CLE \"defbuffer1\"; :VOLT:RANG:AUTO ON; :CURR:RANG:AUTO ON; :FUNC \"CURR\"; SOUR:SWE:VOLT:LIN -0.2, 0.5, 50, 0, 1, BEST; :OUTP ON; :INIT; "
      call "Write (Instr, String).gvi"(session in=$"VISA resource name in", error in=$"Error In", write buffer=w7) -> (session out=w8, error out=w9)
      call "Wait for Operation Complete.gvi"(VISA resource name=w8, Timeout (10000 ms)=60000, error in (no error)=w9) -> (VISA resource name out=w10, error out=w11)
      call "Read (Multiple Points).gvi"(VISA resource name=w10, Start Index (1)=1, End Index (1)=50, error in (no error)=w11, Buffer Elements="SOUR, READ") -> (VISA resource name out=w12, Data out=w13, error out=w14)
      Spreadsheet String To Array(array type=f64[] [], delimiter=",", format string="%s", spreadsheet string=w13) -> (array=w15)
      Decimate Array(array=w15) -> (out0=w16, out1=w17)
      Build Array(w4, w16) -> w18
      Build Array(w5, w17) -> w19
      Property Node(instance in=w6, "Data:Voltage Array (V)"=w18, "Data:Current Array (A)"=w19) -> (instance out=w3)
      call "Enable Output.gvi"(VISA resource name=w12, Enable Output (T: Enable)=FALSE, error in (no error)=w14) -> (VISA resource name out=w20, error out=w21)
      call "Clear Buffer.gvi"(VISA resource name=w20, error in (no error)=w21) -> (VISA resource name out=w22, error out=w23)
      call "Write (Instr, String).gvi"(session in=w22, error in=w23, write buffer="*CLS;") -> (session out=w2, error out=w1)
    }
  }
  $"Fast Sweep Mega Cluster Out" <- w3
  $"VISA resource name out" <- w2
  $"Error Out" <- w1
