vi "Fast Smart Sweep.gvi"   [LabVIEW NXG 5.0.0]
inputs:
  "Error In": error
  "VISA resource name in": "VISA Instr"
  "Fast Sweep Parameters In": "Fast Sweep Parameters.gtype"
  "High Speed?": bool
outputs:
  "Error Out": error
  "VISA resource name Out": "VISA Instr"
  "Fast Sweep Parameters Out": "Fast Sweep Parameters.gtype"
  "Time Elapsed (ms)": u32
types:
  T1 = cluster{"Sweep Direction": bool, "Min Voltage (V)": f64, "Max Voltage (V)": f64, "Measurement Speed (1 PLC)": f64, "Sweep Points": u32}
  T2 = cluster{"Current Array (A)": f64[], "Voltage Array (V)": f64[], "Isc (A)": f64}
  "Fast Sweep Parameters.gtype" = cluster{"Parameters": T1, "Data": T2}
uses:
  Rainbow Measurement Setup::Side Functions::Utilities::Time Related Operations::Time at Point.gvi
  Labview_NXG_Keithley_SMU_2450_2460_2461::Configure::Turn off Delays and Autozero (High Speed).gvi
  Labview_NXG_Keithley_SMU_2450_2460_2461::Configure::Configure Autozero Once.gvi
  Rainbow Measurement Setup::Side Functions::Instrument Control::Keithley::Fast Sweep::Rough Isc Measurement.gvi
  Rainbow Measurement Setup::Side Functions::Instrument Control::Keithley::Fast Sweep::Fast Sweep Subroutine.gvi
  Labview_NXG_Keithley_SMU_2450_2460_2461::Utility::Reset.gvi
diagram:
  case ($"Error In") {
    frame Error, Default {
      w1 = $"Error In"
      w2 = $"VISA resource name in"
      w3 = $"Fast Sweep Parameters In"
      w4 = default
    }
    frame No Error {
      call "Time at Point.gvi"(Error In=$"Error In") -> (ms Count=w5, Error Out=w6)
      case ($"High Speed?") {
        frame False, Default {
          w7 = w6
          w8 = $"VISA resource name in"
        }
        frame True {
          call "Turn off Delays and Autozero (High Speed).gvi"(Visa Resource Name In=$"VISA resource name in", Error In=w6) -> (VISA Resource Name Out=w9, Error Out=w10)
          call "Configure Autozero Once.gvi"(VISA resource name=w9, error in (no error)=w10) -> (VISA resource name out=w8, error out=w7)
        }
      }
      call "Rough Isc Measurement.gvi"(VISA resource name=w8, Fast Sweep Mega Cluster In=$"Fast Sweep Parameters In", Error In=w7) -> (VISA resource name out=w11, Fast Sweep Mega Cluster Out=w12, Error Out=w13)
      call "Fast Sweep Subroutine.gvi"(VISA resource name in=w11, Fast Sweep Mega Cluster In=w12, Error In=w13) -> (VISA resource name out=w14, Fast Sweep Mega Cluster Out=w3, Error Out=w15)
      call "Reset.gvi"(VISA resource name=w14, error in (no error)=w15) -> (VISA resource name out=w2, error out=w16)
      call "Time at Point.gvi"(Error In=w16) -> (ms Count=w17, Error Out=w1)
      Subtract(x=w17, y=w5) -> w4
    }
  }
  $"Fast Sweep Parameters Out" <- w3
  $"VISA resource name Out" <- w2
  $"Error Out" <- w1
  $"Time Elapsed (ms)" <- w4
