vi "Fast Sweep Subroutine.gvi"   [LabVIEW NXG 5.0.0]
inputs:
  "Error In": error
  "VISA resource name in": "VISA Instr"
  "Fast Sweep Mega Cluster In": "Fast Sweep Parameters.gtype"
outputs:
  "Error Out": error
  "VISA resource name out": "VISA Instr"
  "Fast Sweep Mega Cluster Out": "Fast Sweep Parameters.gtype"
types:
  T1 = cluster{"Sweep Direction": bool, "Min Voltage (V)": f64, "Max Voltage (V)": f64, "Measurement Speed (1 PLC)": f64, "Sweep Points": u32}
  T2 = cluster{"Current Array (A)": f64[], "Voltage Array (V)": f64[], "Isc (A)": f64}
  "Fast Sweep Parameters.gtype" = cluster{"Parameters": T1, "Data": T2}
  T3 = cluster{"Start ": f64, "Stop ": f64, "Number of Points (5)": u32}
uses:
  Rainbow Measurement Setup::Side Functions::Instrument Control::Keithley::Voltage Direction Calculator.gvi
  Labview_NXG_Keithley_SMU_2450_2460_2461::Configure::Clear Buffer.gvi
  Labview_NXG_Keithley_SMU_2450_2460_2461::Configure::Configure Measurement Range.gvi
  Labview_NXG_Keithley_SMU_2450_2460_2461::Configure::Configure Source Function.gvi
  Labview_NXG_Keithley_SMU_2450_2460_2461::Configure::Configure Measurement Function.gvi
  Labview_NXG_Keithley_SMU_2450_2460_2461::Configure::Configure Integration Filter.gvi
  Labview_NXG_Keithley_SMU_2450_2460_2461::Configure::Configure Linear Mode Sweep.gvi
  Labview_NXG_Keithley_SMU_2450_2460_2461::Action Status::Enable Output.gvi
  Labview_NXG_Keithley_SMU_2450_2460_2461::Data::Low Level::Initiate.gvi
  Labview_NXG_Keithley_SMU_2450_2460_2461::Data::Low Level::Wait for Operation Complete.gvi
  Labview_NXG_Keithley_SMU_2450_2460_2461::Data::Read (Multiple Points).gvi
  NI::VISA::Write (Instr, String).gvi
diagram:
  # This SubVI performs a fast sweep given the Isc to properly set the range
  case ($"Error In") {
    frame Error, Default {
      w1 = $"Error In"
      w2 = $"VISA resource name in"
      w3 = $"Fast Sweep Mega Cluster In"
    }
    frame No Error {
      Property Node(instance in=$"Fast Sweep Mega Cluster In") -> ("Data:Isc (A)"=w4, "Parameters:Sweep Points"=w5, "Parameters:Measurement Speed (1 PLC)"=w6, "Parameters:Max Voltage (V)"=w7, "Parameters:Min Voltage (V)"=w8, "Parameters:Sweep Direction"=w9, instance out=w10)
      Property Node(instance in=w10) -> ("Data:Voltage Array (V)"=w11, "Data:Current Array (A)"=w12, instance out=w13)
      call "Voltage Direction Calculator.gvi"(Max Voltage (V)=w7, Min Voltage (V)=w8, Error In=$"Error In", Sweep Direction=w9) -> (Start=w14, End=w15, Error Out=w16)
      Property Node(instance in=T3 {"Start "=0, "Stop "=0, "Number of Points (5)"=1}, "Start "=w14, "Stop "=w15, "Number of Points (5)"=w5) -> (instance out=w17)
      call "Clear Buffer.gvi"(VISA resource name=$"VISA resource name in", error in (no error)=w16) -> (VISA resource name out=w18, error out=w19)
      call "Configure Measurement Range.gvi"(VISA resource name=w18, Function (0: Volts)="Volts"(0), Enable Auto Range (T:Enable)=TRUE, error in (no error)=w19) -> (VISA resource name out=w20, error out=w21)
      Multiply(w4, 0.1) -> w22
      Add(w22, w4) -> w23
      Absolute Value(x=w23) -> w24
      In Range And Coerce(lower limit=1e-08, upper limit=1, x=w24) -> (coerced(x)=w25)
      call "Configure Measurement Range.gvi"(Manual Range (1.0)=w25, VISA resource name=w20, Function (0: Volts)="Current"(1), Enable Auto Range (T:Enable)=FALSE, error in (no error)=w21) -> (VISA resource name out=w26, error out=w27)
      call "Configure Source Function.gvi"(VISA resource name=w26, Function (0: Volts)="Volts"(0), error in (no error)=w27) -> (VISA resource name out=w28, error out=w29)
      call "Configure Measurement Function.gvi"(VISA resource name=w28, Function (0: Volts)="Current"(1), error in (no error)=w29) -> (VISA resource name out=w30, error out=w31)
      call "Configure Integration Filter.gvi"(VISA resource name=w30, Function (0: Volts)="Current"(1), Measurement Speed (1 PLC)=w6, error in (no error)=w31) -> (VISA resource name out=w32, error out=w33)
      call "Configure Linear Mode Sweep.gvi"(VISA resource name=w32, Source Mode (0: Voltage)="Voltage"(0), Sweep Points=w17, Delay (0)=0, error in (no error)=w33, Fail Abort (T:ON)=FALSE) -> (VISA resource name out=w34, error out=w35)
      call "Enable Output.gvi"(VISA resource name=w34, Enable Output (T: Enable)=TRUE, error in (no error)=w35) -> (VISA resource name out=w36, error out=w37)
      call "Initiate.gvi"(VISA resource name=w36, error in (no error)=w37) -> (VISA resource name out=w38, error out=w39)
      call "Wait for Operation Complete.gvi"(VISA resource name=w38, Timeout (10000 ms)=60000, error in (no error)=w39) -> (VISA resource name out=w40, error out=w41)
      call "Read (Multiple Points).gvi"(VISA resource name=w40, Start Index (1)=1, End Index (1)=w5, error in (no error)=w41, Buffer Elements="SOUR, READ") -> (VISA resource name out=w42, Data out=w43, error out=w44)
      Spreadsheet String To Array(array type=f64[] [], delimiter=",", format string="%s", spreadsheet string=w43) -> (array=w45)
      Decimate Array(array=w45) -> (out0=w46, out1=w47)
      Build Array(w11, w46) -> w48
      Build Array(w12, w47) -> w49
      Property Node(instance in=w13, "Data:Voltage Array (V)"=w48, "Data:Current Array (A)"=w49) -> (instance out=w3)
      call "Enable Output.gvi"(VISA resource name=w42, Enable Output (T: Enable)=FALSE, error in (no error)=w44) -> (VISA resource name out=w50, error out=w51)
      call "Clear Buffer.gvi"(VISA resource name=w50, error in (no error)=w51) -> (VISA resource name out=w52, error out=w53)
      call "Write (Instr, String).gvi"(session in=w52, error in=w53, write buffer="*CLS;") -> (session out=w2, error out=w1)
    }
  }
  $"Fast Sweep Mega Cluster Out" <- w3
  $"VISA resource name out" <- w2
  $"Error Out" <- w1
