vi "Fast Sweep Test.gvi"   [LabVIEW NXG 5.0.0]
inputs:
  "Error In": error
outputs:
  "Error Out": error
panel controls:
  "VISA resource name": "VISA Instr"
  "High Speed": bool
  "Fast Sweep Parameters In": "Fast Sweep Parameters.gtype" = {"Parameters"={"Sweep Direction"=FALSE, "Min Voltage (V)"=-0.2, "Max Voltage (V)"=1, "Measurement Speed (1 PLC)"=1, "Sweep Points"=50}, "Data"={"Current Array (A)"=[], "Voltage Array (V)"=[], "Isc (A)"=0}}
panel indicators:
  "Graph": cluster{"Element 1": f64[], "Element 2": f64[]}
  "Sweep Time (ms)": u32
  "Fast Sweep Parameters Out": "Fast Sweep Parameters.gtype"
types:
  T1 = cluster{"Sweep Direction": bool, "Min Voltage (V)": f64, "Max Voltage (V)": f64, "Measurement Speed (1 PLC)": f64, "Sweep Points": u32}
  T2 = cluster{"Current Array (A)": f64[], "Voltage Array (V)": f64[], "Isc (A)": f64}
  "Fast Sweep Parameters.gtype" = cluster{"Parameters": T1, "Data": T2}
uses:
  Labview_NXG_Keithley_SMU_2450_2460_2461::Miscelaneous::Initialize.gvi
  Labview_NXG_Keithley_SMU_2450_2460_2461::Configure::Turn off Delays and Autozero (High Speed).gvi
  Labview_NXG_Keithley_SMU_2450_2460_2461::Configure::Configure Autozero Once.gvi
  Rainbow Measurement Setup::Side Functions::Instrument Control::Keithley::Fast Sweep::Fast Smart Sweep.gvi
  Labview_NXG_Keithley_SMU_2450_2460_2461::Miscelaneous::Close.gvi
diagram:
  case ($"Error In") {
    frame Error, Default {
      w1 = $"Error In"
      w2 = default
    }
    frame No Error {
      call "Initialize.gvi"(VISA resource name=$"VISA resource name", error in (no error)=$"Error In") -> (VISA resource name out=w3, error out=w4)
      case ($"High Speed") {
        frame False, Default {
          w5 = w4
          w6 = w3
        }
        frame True {
          call "Turn off Delays and Autozero (High Speed).gvi"(Visa Resource Name In=w3, Error In=w4) -> (VISA Resource Name Out=w7, Error Out=w8)
          call "Configure Autozero Once.gvi"(VISA resource name=w7, error in (no error)=w8) -> (VISA resource name out=w6, error out=w5)
        }
      }
      case (TRUE) {
        frame False, Default {
          w9 = w5
          w10 = default
        }
        frame True {
          Tick Count() -> (timer value=w10)
          w9 = w5
        }
      }
      call "Fast Smart Sweep.gvi"(VISA resource name in=w6, Fast Sweep Parameters In=$"Fast Sweep Parameters In", Error In=w9) -> (VISA resource name Out=w11, Fast Sweep Parameters Out=w2, Error Out=w12)
      case (TRUE) {
        frame False, Default {
          w13 = w12
          w14 = default
        }
        frame True {
          Tick Count() -> (timer value=w14)
          w13 = w12
        }
      }
      call "Close.gvi"(VISA resource name=w11, error in (no error)=w13) -> (error out=w1)
      Subtract(x=w14, y=w10) -> w15
      $"Sweep Time (ms)" <- w15
    }
  }
  Property Node(instance in=w2) -> ("Data:Voltage Array (V)"=w16, "Data:Current Array (A)"=w17, instance out=w18)
  $"Fast Sweep Parameters Out" <- w18
  Build Cluster(w16, w17) -> w19
  $Graph <- w19
  $"Error Out" <- w1
