vi "Full Fast Smart Sweep.gvi"   [LabVIEW NXG 5.0.0]
inputs:
  "Error In": error
  "VISA resource name in": "VISA Instr"
  "Fast Sweep Parameters In": "Fast Sweep Parameters.gtype"
  "High Speed?": bool
outputs:
  "Error Out": error
  "VISA resource name Out": "VISA Instr"
  "Fast Sweep Parameters Out": "Fast Sweep Parameters.gtype"
  "Time Elapsed (ms)": u32
types:
  T1 = cluster{"Sweep Direction": bool, "Min Voltage (V)": f64, "Max Voltage (V)": f64, "Measurement Speed (1 PLC)": f64, "Sweep Points": u32}
  T2 = cluster{"Current Array (A)": f64[], "Voltage Array (V)": f64[], "Isc (A)": f64}
  "Fast Sweep Parameters.gtype" = cluster{"Parameters": T1, "Data": T2}
uses:
  Rainbow Measurement Setup::Side Functions::Utilities::Time Related Operations::Time at Point.gvi
  Rainbow Measurement Setup::Side Functions::Instrument Control::Keithley::Set Keythley to Fast.gvi
  Rainbow Measurement Setup::Side Functions::Instrument Control::Keithley::Fast Sweep::Fast Sweep Subroutine.gvi
diagram:
  case ($"Error In") {
    frame Error, Default {
      w1 = $"Error In"
      w2 = $"VISA resource name in"
      w3 = $"Fast Sweep Parameters In"
      w4 = default
    }
    frame No Error {
      call "Time at Point.gvi"(Error In=$"Error In") -> (ms Count=w5, Error Out=w6)
      case ($"High Speed?") {
        frame False, Default {
          w7 = w6
          w8 = $"VISA resource name in"
        }
        frame True {
          call "Set Keythley to Fast.gvi"(Input=$"VISA resource name in", Input_2=w6) -> (Output=w8, Output_2=w7)
        }
      }
      call "Fast Sweep Subroutine.gvi"(Fast Sweep Parameters In=$"Fast Sweep Parameters In", VISA resource name in=w8, Error In=w7) -> (Fast Sweep Parameters Out=w3, VISA resource name out=w2, Error Out=w9)
      call "Time at Point.gvi"(Error In=w9) -> (ms Count=w10, Error Out=w1)
      Subtract(x=w10, y=w5) -> w4
    }
  }
  $"Fast Sweep Parameters Out" <- w3
  $"VISA resource name Out" <- w2
  $"Error Out" <- w1
  $"Time Elapsed (ms)" <- w4
