vi "Rough Isc Measurement.gvi"   [LabVIEW NXG 5.0.0]
inputs:
  "Error In": error
  "VISA resource name": "VISA Instr"
  "Fast Sweep Mega Cluster In": "Fast Sweep Parameters.gtype"
outputs:
  "Error Out": error
  "VISA resource name out": "VISA Instr"
  "Fast Sweep Mega Cluster Out": "Fast Sweep Parameters.gtype"
types:
  T1 = cluster{"Sweep Direction": bool, "Min Voltage (V)": f64, "Max Voltage (V)": f64, "Measurement Speed (1 PLC)": f64, "Sweep Points": u32}
  T2 = cluster{"Current Array (A)": f64[], "Voltage Array (V)": f64[], "Isc (A)": f64}
  "Fast Sweep Parameters.gtype" = cluster{"Parameters": T1, "Data": T2}
uses:
  Labview_NXG_Keithley_SMU_2450_2460_2461::Configure::Clear Buffer.gvi
  Labview_NXG_Keithley_SMU_2450_2460_2461::Configure::Configure Measurement Range.gvi
  Labview_NXG_Keithley_SMU_2450_2460_2461::Configure::Configure Source Level.gvi
  Labview_NXG_Keithley_SMU_2450_2460_2461::Configure::Configure Source Limit Level.gvi
  Labview_NXG_Keithley_SMU_2450_2460_2461::Configure::Configure Source Function.gvi
  Labview_NXG_Keithley_SMU_2450_2460_2461::Configure::Configure Measurement Function.gvi
  Labview_NXG_Keithley_SMU_2450_2460_2461::Configure::Set Measurement Count.gvi
  Labview_NXG_Keithley_SMU_2450_2460_2461::Data::Make Reading and Store in Buffer.gvi
  Labview_NXG_Keithley_SMU_2450_2460_2461::Data::Read (Multiple Points).gvi
  NI::Analysis::Statistics::Measures of Mean.gvi
diagram:
  # This SubVI Finds a rough value for the Voc or the Jsc in a fast manner
  case ($"Error In") {
    frame Error, Default {
      w1 = $"Error In"
      w2 = $"VISA resource name"
      w3 = $"Fast Sweep Mega Cluster In"
    }
    frame No Error {
      call "Clear Buffer.gvi"(VISA resource name=$"VISA resource name", error in (no error)=$"Error In") -> (VISA resource name out=w4, error out=w5)
      call "Configure Measurement Range.gvi"(VISA resource name=w4, Function (0: Volts)="Volts"(0), Enable Auto Range (T:Enable)=TRUE, error in (no error)=w5) -> (VISA resource name out=w6, error out=w7)
      call "Configure Measurement Range.gvi"(VISA resource name=w6, Function (0: Volts)="Current"(1), Enable Auto Range (T:Enable)=TRUE, error in (no error)=w7) -> (VISA resource name out=w8, error out=w9)
      call "Configure Source Level.gvi"(VISA resource name=w8, Function (0: Volts)="Volts"(0), Source Level (1.0)=0, error in (no error)=w9) -> (VISA resource name out=w10, error out=w11)
      call "Configure Source Limit Level.gvi"(VISA resource name=w10, Function (0: Volts)="Volts"(0), Source Limit (1.0)=0.1, error in (no error)=w11) -> (VISA resource name out=w12, error out=w13)
      call "Configure Source Function.gvi"(VISA resource name=w12, Function (0: Volts)="Volts"(0), error in (no error)=w13) -> (VISA resource name out=w14, error out=w15)
      call "Configure Measurement Function.gvi"(VISA resource name=w14, Function (0: Volts)="Current"(1), error in (no error)=w15) -> (VISA resource name out=w16, error out=w17)
      call "Set Measurement Count.gvi"(VISA resource name=w16, Measurement Count=10, error in (no error)=w17) -> (VISA resource name out=w18, error out=w19)
      call "Make Reading and Store in Buffer.gvi"(VISA resource name=w18, error in (no error)=w19) -> (VISA resource name out=w20, error out=w21)
      call "Read (Multiple Points).gvi"(VISA resource name=w20, End Index (1)=10, error in (no error)=w21) -> (VISA resource name out=w22, Data out=w23, error out=w24)
      Spreadsheet String To Array(array type=f64[] [], delimiter=",", format string="%s", spreadsheet string=w23) -> (array=w25)
      call "Clear Buffer.gvi"(VISA resource name=w22, error in (no error)=w24) -> (VISA resource name out=w2, error out=w26)
      call "Measures of Mean.gvi"(x=w25, error in=w26) -> (mean value=w27, error out=w1)
      Property Node(instance in=$"Fast Sweep Mega Cluster In", "Data:Isc (A)"=w27) -> (instance out=w3)
    }
  }
  $"Fast Sweep Mega Cluster Out" <- w3
  $"Error Out" <- w1
  $"VISA resource name out" <- w2
