vi "Keithley Close Subroutine.gvi"   [LabVIEW NXG 5.0.0]
inputs:
  "Error In": error
  "Instrument Control Mega Cluster In": "Instrument Control Mega Cluster.gtype"
outputs:
  "Error Out": error
  "Instrument Control Mega Cluster Out": "Instrument Control Mega Cluster.gtype"
types:
  "Instrument Coms Info.gtype" = cluster{"Arduino Coms Info": "Arduino Detection cluster control.gtype", "Photodetector Names": string[], "Keythley Address": "VISA Instr", "Photodetector Detected?": bool, "Thorlabs Motors Detected?": bool, "Keithley Detected?": bool, "Thorlabs Motors Serial Number": "Thorlabs Motors Serial Number In.gtype", "Photodetector IVI session": "Ivi IviDefault", "Flame ID": string, "Flame Detected?": bool, "Flame Wrapper ID": u64}
  "Debugging Cluster.gtype" = cluster{"Debugging mode?": bool, "Initialize App": bool, "Insturment Debugging": "Insturment Debugging Cluster.gtype"}
  "Instrument Control Mega Cluster.gtype" = cluster{"Instruments Coms Info": "Instrument Coms Info.gtype", "Debugging Cluster": "Debugging Cluster.gtype"}
uses:
  Labview_NXG_Keithley_SMU_2450_2460_2461::Miscelaneous::Close.gvi
diagram:
  # This SubVI Initializes the Keithley Comunication In case the debugging allows it to do so
  case ($"Error In") {
    frame Error, Default {
      w1 = $"Error In"
      w2 = $"Instrument Control Mega Cluster In"
    }
    frame No Error {
      Property Node(instance in=$"Instrument Control Mega Cluster In") -> ("Debugging Cluster:Debugging mode?"=w3, "Debugging Cluster:Insturment Debugging:Keithley"=w4, instance out=w5)
      Logical And[output inverted](w3, not w4) -> w6
      case (w6) {
        frame False, Default {
          w2 = w5
          w1 = $"Error In"
        }
        frame True {
          Property Node(instance in=w5) -> ("Instruments Coms Info:Keythley Address"=w7, instance out=w2)
          call "Close.gvi"(VISA resource name=w7, error in (no error)=$"Error In") -> (error out=w1)
        }
      }
    }
  }
  $"Instrument Control Mega Cluster Out" <- w2
  $"Error Out" <- w1
