vi "Keithley Detection Subroutine.gvi"   [LabVIEW NXG 5.0.0]
inputs:
  "Error In": error
outputs:
  "Error Out": error
  "Detected?": bool
  "Keythley Address Out": "VISA Instr"
uses:
  Rainbow Measurement Setup::Side Functions::Global Abort::FGV Global Abort.gvi
  NI::VISA::Find Resource (Search Resources).gvi
  NI::G Core::Error::Clear Error Cluster.gvi
diagram:
  # This subVi scans all dhe available resources in search for the keithley and if found returns its address.
  # If not found it prompts the user to connect it propperly.
  case ($"Error In") {
    frame Error, Default {
      w1 = $"Error In"
      w2 = default
      w3 = default
    }
    frame No Error {
      while (iteration -> i1) {
        call "FGV Global Abort.gvi"(Global Abort Instructions="Read Current State", Error In=$"Error In") -> (Global Abort Out=w4, Error Out=w5)
        call "Find Resource (Search Resources).gvi"(error in=w5) -> (found resources=w6, error out=w7)
        for {
          w8 = each element of w6
          Search And Replace String(error in (no error)=w7, input string=w8, search string="2450") -> (error out=w10, number of replacements=w11)
          Is Greater Than 0(x=w11) -> w12
          append w8 to w9 if w12
        }
        Is Empty Array(array=w9) -> w13
        Array Size(array=w9) -> (size(s)=w14)
        Is Greater(x=w14, y=1) -> w15
        Logical Or(w13, w15) -> w16
        case (w16) {
          frame False, Default {
            Array Index(array=w9) -> (out0[0]=w18)
            w17 = TRUE
            w19 = w10
            w2 = TRUE
          }
          frame True {
            call "Clear Error Cluster.gvi"(error in=w10) -> (error out=w19)
            Wait Until Next Multiple(multiple to wait=500)
            w20 = """Seems like you have connected
either more than one 2450 keithley
to this computer or none at all, 
please disconnect all of them but
one, or connect at least one
and then retry."""
            One Button Dialog(button name ("OK")="Okay, sorry.", message=w20)
            w17 = FALSE
            w18 = ""
            w2 = default
          }
        }
        Type Cast(type="VISA Instr" "", x=w18) -> w3
        Is Greater(x=i1, y=5) -> w21
        case (w21) {
          frame False, Default {
            w22 = FALSE
            w1 = w19
          }
          frame True {
            w23 = """Seems you're having some trouble
connecting the keithley, do you 
want to proceed without connecting it
and hope for the best?
(WARNING: some functionalities might
be compromized, or the entire program 
can crash)"""
            Two Button Dialog(F button name ("Cancel")="Oh dear no, I'd rather ask for help", T button name ("OK")="Yes please, I like to live dangerously", message=w23) -> (T Button?=w22)
            w1 = w19
          }
        }
        Logical Or(w17, w22, w4) -> w24
        stop if w24
      }
    }
  }
  $"Detected?" <- w2
  $"Keythley Address Out" <- w3
  $"Error Out" <- w1
