vi "Keithley Initialize Subroutine.gvi"   [LabVIEW NXG 5.0.0]
inputs:
  "Error In": error
  "Instrument Coms Info In": "Instrument Coms Info.gtype"
  "Debugging Cluster In": "Debugging Cluster.gtype"
outputs:
  "Error Out": error
  "Instrument Coms Info Out": "Instrument Coms Info.gtype"
  "Debugging Cluster Out": "Debugging Cluster.gtype"
types:
  T1 = cluster{"Element 1": "VISA Instr", "Element 2": string}
  "Arduino Detection cluster control.gtype" = cluster{"XZ Stage Arduino Address": "VISA Instr", "XZ Stage Arduino Detected?": bool, "Multiplexer Arduino Detected?": bool, "Multiplexer Arduino Address": "VISA Instr", "Arduinos List": T1[], "XZ Stage Log": string, "Multiplexer Log": string}
  "Thorlabs Motors Serial Number In.gtype" = cluster{"Thorlabs Blue Motor": string, "Thorlabs Red Motor": string, "Blue Motor Homed?": bool, "Red Motor Homed?": bool}
  "Instrument Coms Info.gtype" = cluster{"Arduino Coms Info": "Arduino Detection cluster control.gtype", "Photodetector Names": string[], "Keythley Address": "VISA Instr", "Photodetector Detected?": bool, "Thorlabs Motors Detected?": bool, "Keithley Detected?": bool, "Thorlabs Motors Serial Number": "Thorlabs Motors Serial Number In.gtype", "Photodetector IVI session": "Ivi IviDefault", "Flame ID": string, "Flame Detected?": bool, "Flame Wrapper ID": u64}
  "Insturment Debugging Cluster.gtype" = cluster{"Keithley": bool, "Arduinos": bool, "Thorlabs Motors": bool, "Photodetector": bool, "Flame Spectr": bool}
  "Debugging Cluster.gtype" = cluster{"Debugging mode?": bool, "Initialize App": bool, "Insturment Debugging": "Insturment Debugging Cluster.gtype"}
uses:
  Rainbow Measurement Setup::Main Functions::Instruction Queue::Current State::FGV Current State.gvi
  Labview_NXG_Keithley_SMU_2450_2460_2461::Miscelaneous::Initialize.gvi
diagram:
  # This SubVI Initializes the Keithley Comunication In case the debugging allows it to do so
  case ($"Error In") {
    frame Error, Default {
      w1 = $"Error In"
      w2 = $"Instrument Coms Info In"
      w3 = $"Debugging Cluster In"
    }
    frame No Error {
      Property Node(instance in=$"Debugging Cluster In") -> ("Debugging mode?"=w4, "Insturment Debugging:Keithley"=w5, instance out=w3)
      Logical And[output inverted](w4, not w5) -> w6
      case (w6) {
        frame False, Default {
          w2 = $"Instrument Coms Info In"
          w1 = $"Error In"
        }
        frame True {
          Property Node(instance in=$"Instrument Coms Info In") -> ("Keythley Address"=w7, instance out=w8)
          call "FGV Current State.gvi"(Current State Instructions="Set Current Substate", Current Substate="Initializing Keithley", Error In=$"Error In") -> (Error Out=w9)
          call "Initialize.gvi"(VISA resource name=w7, error in (no error)=w9) -> (VISA resource name out=w10, error out=w1)
          Property Node(instance in=w8, "Keythley Address"=w10) -> (instance out=w2)
        }
      }
    }
  }
  $"Instrument Coms Info Out" <- w2
  $"Error Out" <- w1
  $"Debugging Cluster Out" <- w3
