vi "Keithley Normal Sweep.gvi"   [LabVIEW NXG 5.0.0]
inputs:
  "Error In": error
  "SRM Specific Parameters": "SRM Specific Parameters.gtype" = {"V Points"=1, "Current Averages"=1, "PLC Speed"=0.001, "Sweep Speed"="Smart Sweep"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}
  "VISA resource name": "VISA Instr"
outputs:
  "Error Out": error
  "Visa Resource Name Out": "VISA Instr"
  "IV Measurement Out": "IV Single Measurement.gtype"
  "Elapsed Time": u32
types:
  "Sweep Speed Selector.gtype" = enum{"Smart Sweep", "Fast Sweep", "Normal Sweep"}
  "SRM Specific Parameters.gtype" = cluster{"Max (V)": f64, "Min (V)": f64, "V Points": u32, "Current Range (A)": f64, "Autorange": bool, "Sweep Dir": bool, "Current Averages": u32, "Max (A)": f64, "PLC Speed": f64, "Cell Area (m^2)": f64, "Full Spctr Ref": bool, "Sweep Speed": "Sweep Speed Selector.gtype"}
  T1 = cluster{"Isc (A)": f64, "Voc (V)": f64, "FF (%)": f64, "Rs (Ω)": f64, "Rsh (Ω)": f64}
  "IV Single Measurement.gtype" = cluster{"Voltage (V)": f64[], "Current (A)": f64[], "Current Density (A/m^2)": f64[], "Dividing Wavelength (nm)": f64, "Light Power Density (W/m^2)": f64, "Total Light Power Density (W/m^2)": f64, "Smart Sweep Data": T1}
  "Raibow Sweep Selector.gtype" = enum{"Red Sweep", "Blue Sweep", "Full Sweep Red First", "Full Sweep Blue First"}
  "Rainbow Sweep Param Selector.gtype" = cluster{"Raibow Sweep Selector": "Raibow Sweep Selector.gtype", "Max Wavelength (nm)": f64, "Min Wavelength (nm)": f64, "Wavelength Step (nm)": f64, "Rainbow Sweep Type Selector": "Rainbow Sweep Type Selector.gtype"}
  "Rainbow Sweep Types.gtype" = enum{"Red Sweep Closing", "Red Sweep Opening", "Blue Sweep Closing", "Blue Sweep Opening"}
  "IV Full Data Cluster.gtype" = cluster{"IV Measurements Array": "IV Single Measurement.gtype"[], "Rainbow Sweep Types": "Rainbow Sweep Types.gtype", "IV Refined Data": "IV Refined Full Sweep Data.gtype", "Total Light Power Density (W/m^2)": f64}
  "IV Full Raw Data.gtype" = cluster{"Rainbow Sweep Types": "Rainbow Sweep Types.gtype", "IV Raw Data Array": "IV Single Measurement.gtype"[]}
  "SRM Mega Cluster.gtype" = cluster{"SRM Specific Parameters": "SRM Specific Parameters.gtype", "Rainbow Sweep Parameters SRM": "Rainbow Sweep Param Selector.gtype", "SRM Full IV data Array": "IV Full Data Cluster.gtype"[], "Full IV Curve Raw Data": "IV Full Raw Data.gtype"[]}
uses:
  Rainbow Measurement Setup::Side Functions::Utilities::Time Related Operations::Time at Point.gvi
  Rainbow Measurement Setup::Side Functions::Instrument Control::Keithley::Keithley Sweep Parameters Calculator.gvi
  Labview_NXG_Keithley_SMU_2450_2460_2461::Configure::Configure Measurement Range.gvi
  Labview_NXG_Keithley_SMU_2450_2460_2461::Configure::Configure Output.gvi
  Labview_NXG_Keithley_SMU_2450_2460_2461::Configure::Configure Source Function.gvi
  Labview_NXG_Keithley_SMU_2450_2460_2461::Configure::Configure Measurement Function.gvi
  Labview_NXG_Keithley_SMU_2450_2460_2461::Configure::Configure Integration Filter.gvi
  Labview_NXG_Keithley_SMU_2450_2460_2461::Configure::Configure Linear Mode Sweep.gvi
  Labview_NXG_Keithley_SMU_2450_2460_2461::Configure::Clear Buffer.gvi
  Labview_NXG_Keithley_SMU_2450_2460_2461::Action Status::Enable Output.gvi
  Labview_NXG_Keithley_SMU_2450_2460_2461::Data::Low Level::Initiate.gvi
  Labview_NXG_Keithley_SMU_2450_2460_2461::Data::Low Level::Wait for Operation Complete.gvi
  Labview_NXG_Keithley_SMU_2450_2460_2461::Data::Read (Multiple Points).gvi
  NI::VISA::Write (Instr, String).gvi
diagram:
  case ($"Error In") {
    frame Error, Default {
      w1 = $"Error In"
      w2 = $"VISA resource name"
      w3 = default
      w4 = default
    }
    frame No Error {
      Property Node(instance in="SRM Mega Cluster.gtype" {all zero or empty}, "SRM Specific Parameters"=$"SRM Specific Parameters") -> (instance out=w5)
      call "Time at Point.gvi"(Error In=$"Error In") -> (ms Count=w6, Error Out=w7)
      call "Keithley Sweep Parameters Calculator.gvi"(SRM Mega Cluster In=w5, Error In=w7) -> (Measurement Speed (1 PLC)=w8, SRM Mega Cluster Out=w9, Manual Range (1.0)=w10, Sweep Points=w11, Error Out=w12, Enable Auto Range (T:Enable)=w13)
      Property Node(instance in=w9) -> ("SRM Specific Parameters:V Points"=w14)
      call "Configure Measurement Range.gvi"(VISA resource name=$"VISA resource name", Function (0: Volts)="Volts"(0), Enable Auto Range (T:Enable)=TRUE, error in (no error)=w12) -> (VISA resource name out=w15, error out=w16)
      call "Configure Measurement Range.gvi"(Manual Range (1.0)=w10, VISA resource name=w15, Function (0: Volts)="Current"(1), Enable Auto Range (T:Enable)=w13, error in (no error)=w16) -> (VISA resource name out=w17, error out=w18)
      call "Configure Output.gvi"(VISA resource name=w17, Source Mode (0: Voltage)="Voltage"(0), error in (no error)=w18) -> (VISA resource name out=w19, error out=w20)
      call "Configure Source Function.gvi"(VISA resource name=w19, Function (0: Volts)="Volts"(0), error in (no error)=w20) -> (VISA resource name out=w21, error out=w22)
      call "Configure Measurement Function.gvi"(VISA resource name=w21, Function (0: Volts)="Current"(1), error in (no error)=w22) -> (VISA resource name out=w23, error out=w24)
      call "Configure Integration Filter.gvi"(VISA resource name=w23, Function (0: Volts)="Volts"(0), Measurement Speed (1 PLC)=w8, error in (no error)=w24) -> (VISA resource name out=w25, error out=w26)
      call "Configure Linear Mode Sweep.gvi"(VISA resource name=w25, Source Mode (0: Voltage)="Voltage"(0), Sweep Points=w11, Delay (0)=0, error in (no error)=w26) -> (VISA resource name out=w27, error out=w28)
      call "Clear Buffer.gvi"(VISA resource name=w27, error in (no error)=w28) -> (VISA resource name out=w29, error out=w30)
      call "Enable Output.gvi"(VISA resource name=w29, Enable Output (T: Enable)=TRUE, error in (no error)=w30) -> (VISA resource name out=w31, error out=w32)
      call "Initiate.gvi"(VISA resource name=w31, error in (no error)=w32) -> (VISA resource name out=w33, error out=w34)
      call "Wait for Operation Complete.gvi"(VISA resource name=w33, Timeout (10000 ms)=1000000, error in (no error)=w34) -> (VISA resource name out=w35, error out=w36)
      call "Read (Multiple Points).gvi"(VISA resource name=w35, Start Index (1)=1, End Index (1)=w14, error in (no error)=w36, Buffer Elements="SOUR, READ") -> (VISA resource name out=w37, Data out=w38, error out=w39)
      Spreadsheet String To Array(array type=f64[] [], delimiter=",", format string="%s", spreadsheet string=w38) -> (array=w40)
      Decimate Array(array=w40) -> (out0=w41, out1=w42)
      Property Node(instance in="IV Single Measurement.gtype" {all zero or empty}, "Voltage (V)"=w41, "Current (A)"=w42) -> (instance out=w4)
      call "Enable Output.gvi"(VISA resource name=w37, Enable Output (T: Enable)=FALSE, error in (no error)=w39) -> (VISA resource name out=w43, error out=w44)
      call "Write (Instr, String).gvi"(session in=w43, error in=w44, write buffer="*CLS;") -> (session out=w2, error out=w45)
      call "Time at Point.gvi"(Error In=w45) -> (ms Count=w46, Error Out=w1)
      Subtract(x=w46, y=w6) -> w3
    }
  }
  $"IV Measurement Out" <- w4
  $"Visa Resource Name Out" <- w2
  $"Error Out" <- w1
  $"Elapsed Time" <- w3
