vi "Keithley Sweep Parameters Calculator.gvi"   [LabVIEW NXG 5.0.0]
inputs:
  "SRM Mega Cluster In": "SRM Mega Cluster.gtype"
  "Error In": error
outputs:
  "SRM Mega Cluster Out": "SRM Mega Cluster.gtype"
  "Enable Auto Range (T:Enable)": bool
  "Manual Range (1.0)": f64
  "Measurement Speed (1 PLC)": f64
  "Error Out": error
  "Sweep Points": T1
types:
  T1 = cluster{"Start ": f64, "Stop ": f64, "Number of Points (5)": u32}
  "SRM Specific Parameters.gtype" = cluster{"Max (V)": f64, "Min (V)": f64, "V Points": u32, "Current Range (A)": f64, "Autorange": bool, "Sweep Dir": bool, "Current Averages": u32, "Max (A)": f64, "PLC Speed": f64, "Cell Area (m^2)": f64, "Full Spctr Ref": bool, "Smart Scan": bool, "Fast Scan": bool}
  "Raibow Sweep Selector.gtype" = enum{"Red Sweep", "Blue Sweep", "Full Sweep Red First", "Full Sweep Blue First"}
  "Rainbow Sweep Param Selector.gtype" = cluster{"Raibow Sweep Selector": "Raibow Sweep Selector.gtype", "Max Wavelength (nm)": f64, "Min Wavelength (nm)": f64, "Wavelength Step (nm)": f64, "Rainbow Sweep Type Selector": "Rainbow Sweep Type Selector.gtype"}
  "Rainbow Sweep Types.gtype" = enum{"Red Sweep Closing", "Red Sweep Opening", "Blue Sweep Closing", "Blue Sweep Opening"}
  "IV Full Data Cluster.gtype" = cluster{"IV Measurements Array": "IV Single Measurement.gtype"[], "Rainbow Sweep Types": "Rainbow Sweep Types.gtype", "IV Refined Data": "IV Refined Full Sweep Data.gtype", "Total Light Power Density (W/m^2)": f64}
  "IV Full Raw Data.gtype" = cluster{"Rainbow Sweep Types": "Rainbow Sweep Types.gtype", "IV Raw Data Array": "IV Single Measurement.gtype"[]}
  "SRM Mega Cluster.gtype" = cluster{"SRM Specific Parameters": "SRM Specific Parameters.gtype", "Rainbow Sweep Parameters SRM": "Rainbow Sweep Param Selector.gtype", "SRM Full IV data Array": "IV Full Data Cluster.gtype"[], "Full IV Curve Raw Data": "IV Full Raw Data.gtype"[]}
uses:
  Rainbow Measurement Setup::Side Functions::Instrument Control::Keithley::Voltage Direction Calculator.gvi
  Rainbow Measurement Setup::Side Functions::Utilities::Mathematical Operations::Order of Magnitude Extractor.gvi
diagram:
  # This SubVI Calculates the number of sweep points required for the
  # specified SRM parameters. It also extracts all the parameters so that
  # they can be set correctly on the keithley.
  case ($"Error Out") {
    frame Error, Default {
      w1 = default
      w2 = default
      w3 = $"Error Out"
      w4 = $"SRM Mega Cluster In"
      w5 = default
      w6 = default
    }
    frame No Error {
      Property Node(instance in=$"SRM Mega Cluster In") -> ("SRM Specific Parameters:Current Range (A)"=w7, "SRM Specific Parameters:Autorange"=w1, "SRM Specific Parameters:Max (A)"=w8, "SRM Specific Parameters:PLC Speed"=w6, "SRM Specific Parameters:Max (V)"=w9, "SRM Specific Parameters:Min (V)"=w10, "SRM Specific Parameters:V Points"=w11, "SRM Specific Parameters:Sweep Dir"=w12, instance out=w4)
      In Range And Coerce(lower limit=1e-08, upper limit=1, x=w7) -> (coerced(x)=w13)
      Select(s=w1, t=w8, f=w13) -> w2
      call "Voltage Direction Calculator.gvi"(Max Voltage (V)=w9, Min Voltage (V)=w10, Error In=$"Error Out", Sweep Direction=w12) -> (Start=w14, End=w15, Error Out=w16)
      call "Order of Magnitude Extractor.gvi"(Number to extract order of magnitude=w13, Error In=w16) -> (Error Out=w3)
      Property Node(instance in=T1 {"Start "=1, "Stop "=0, "Number of Points (5)"=5}, "Start "=w14, "Stop "=w15, "Number of Points (5)"=w11) -> (instance out=w5)
    }
  }
  $"Enable Auto Range (T:Enable)" <- w1
  $"Manual Range (1.0)" <- w2
  $"SRM Mega Cluster Out" <- w4
  $"Error In" <- w3
  $"Measurement Speed (1 PLC)" <- w6
  $"Sweep Points" <- w5
