vi "Keithley Sweep Subroutine.gvi"   [LabVIEW NXG 5.0.0]
inputs:
  "Error In": error
  "Instrument Control Mega Cluster In": "Instrument Control Mega Cluster.gtype"
  "SRM Mega Cluster In": "SRM Mega Cluster.gtype"
  "IV Single Measurement In": "IV Single Measurement.gtype"
outputs:
  "Error Out": error
  "Instrument Control Mega Cluster Out": "Instrument Control Mega Cluster.gtype"
  "SRM Mega Cluster Out": "SRM Mega Cluster.gtype"
  "IV Single Measurement Out": "IV Single Measurement.gtype"
types:
  T1 = cluster{"Isc (A)": f64, "Voc (V)": f64, "FF (%)": f64, "Rs (Ω)": f64, "Rsh (Ω)": f64}
  "IV Single Measurement.gtype" = cluster{"Voltage (V)": f64[], "Current (A)": f64[], "Current Density (A/m^2)": f64[], "Dividing Wavelength (nm)": f64, "Light Power Density (W/m^2)": f64, "Total Light Power Density (W/m^2)": f64, "Smart Sweep Data": T1}
  "Sweep Speed Selector.gtype" = enum{"Smart Sweep", "Fast Sweep", "Normal Sweep"}
  "SRM Specific Parameters.gtype" = cluster{"Max (V)": f64, "Min (V)": f64, "V Points": u32, "Current Range (A)": f64, "Autorange": bool, "Sweep Dir": bool, "Current Averages": u32, "Max (A)": f64, "PLC Speed": f64, "Cell Area (m^2)": f64, "Full Spctr Ref": bool, "Sweep Speed": "Sweep Speed Selector.gtype"}
  "Raibow Sweep Selector.gtype" = enum{"Red Sweep", "Blue Sweep", "Full Sweep Red First", "Full Sweep Blue First"}
  "Rainbow Sweep Param Selector.gtype" = cluster{"Raibow Sweep Selector": "Raibow Sweep Selector.gtype", "Max Wavelength (nm)": f64, "Min Wavelength (nm)": f64, "Wavelength Step (nm)": f64, "Rainbow Sweep Type Selector": "Rainbow Sweep Type Selector.gtype"}
  "Rainbow Sweep Types.gtype" = enum{"Red Sweep Closing", "Red Sweep Opening", "Blue Sweep Closing", "Blue Sweep Opening"}
  "IV Full Data Cluster.gtype" = cluster{"IV Measurements Array": "IV Single Measurement.gtype"[], "Rainbow Sweep Types": "Rainbow Sweep Types.gtype", "IV Refined Data": "IV Refined Full Sweep Data.gtype", "Total Light Power Density (W/m^2)": f64}
  "IV Full Raw Data.gtype" = cluster{"Rainbow Sweep Types": "Rainbow Sweep Types.gtype", "IV Raw Data Array": "IV Single Measurement.gtype"[]}
  "SRM Mega Cluster.gtype" = cluster{"SRM Specific Parameters": "SRM Specific Parameters.gtype", "Rainbow Sweep Parameters SRM": "Rainbow Sweep Param Selector.gtype", "SRM Full IV data Array": "IV Full Data Cluster.gtype"[], "Full IV Curve Raw Data": "IV Full Raw Data.gtype"[]}
  "Instrument Coms Info.gtype" = cluster{"Arduino Coms Info": "Arduino Detection cluster control.gtype", "Photodetector Names": string[], "Keythley Address": "VISA Instr", "Photodetector Detected?": bool, "Thorlabs Motors Detected?": bool, "Keithley Detected?": bool, "Thorlabs Motors Serial Number": "Thorlabs Motors Serial Number In.gtype", "Photodetector IVI session": "Ivi IviDefault", "Flame ID": string, "Flame Detected?": bool, "Flame Wrapper ID": u64}
  "Debugging Cluster.gtype" = cluster{"Debugging mode?": bool, "Initialize App": bool, "Insturment Debugging": "Insturment Debugging Cluster.gtype"}
  "Instrument Control Mega Cluster.gtype" = cluster{"Instruments Coms Info": "Instrument Coms Info.gtype", "Debugging Cluster": "Debugging Cluster.gtype"}
  T2 = cluster{"Sweep Direction": bool, "Min Voltage (V)": f64, "Max Voltage (V)": f64, "Measurement Speed (1 PLC)": f64, "Sweep Points": u32}
  T3 = cluster{"Current Array (A)": f64[], "Voltage Array (V)": f64[], "Isc (A)": f64}
  "Fast Sweep Parameters.gtype" = cluster{"Parameters": T2, "Data": T3}
uses:
  Rainbow Measurement Setup::Side Functions::Instrument Control::Keithley::Random IV Curve Generator.gvi
  Rainbow Measurement Setup::Main Functions::Instruction Queue::Current State::FGV Current State.gvi
  Labview_NXG_Keithley_SMU_2450_2460_2461::Configure::Clear Buffer.gvi
  Labview_NXG_Keithley_SMU_2450_2460_2461::Action Status::Enable Output.gvi
  Labview_NXG_Keithley_SMU_2450_2460_2461::Data::Low Level::Initiate.gvi
  Rainbow Measurement Setup::Side Functions::Instrument Control::Keithley::FGV Keithley timeout.gvi
  Labview_NXG_Keithley_SMU_2450_2460_2461::Data::Low Level::Wait for Operation Complete.gvi
  Labview_NXG_Keithley_SMU_2450_2460_2461::Data::Read (Multiple Points).gvi
  Rainbow Measurement Setup::Side Functions::Instrument Control::Keithley::Keithley Timeout Check.gvi
  NI::VISA::Write (Instr, String).gvi
  Rainbow Measurement Setup::Side Functions::Instrument Control::Keithley::Fast Sweep::Fast Sweep Subroutine.gvi
  Rainbow Measurement Setup::Side Functions::Instrument Control::Keithley::Smart Sweep::FGV Smart Sweep Parameters.gvi
  Rainbow Measurement Setup::Side Functions::Instrument Control::Keithley::Smart Sweep::Smart Sweep Subroutine.gvi
  NI::G Core::Error::Clear Error Cluster.gvi
diagram:
  # This SubVI Initializes the Keithley Comunication In case the debugging allows it to do so
  case ($"Error In") {
    frame Error, Default {
      w1 = $"Error In"
      w2 = $"Instrument Control Mega Cluster In"
      w3 = $"IV Single Measurement In"
      w4 = $"SRM Mega Cluster In"
    }
    frame No Error {
      Property Node(instance in=$"Instrument Control Mega Cluster In") -> ("Debugging Cluster:Debugging mode?"=w5, "Debugging Cluster:Insturment Debugging:Keithley"=w6, instance out=w7)
      Logical And[output inverted](w5, not w6) -> w8
      case (w8) {
        frame False, Default {
          call "Random IV Curve Generator.gvi"(SRM Mega Cluster In=$"SRM Mega Cluster In", Intensity Constant=1, Light Intensity=-1.7, Error In=$"Error In") -> (Voltage=w10, Current=w11, Error Out=w9)
          Property Node(instance in=$"IV Single Measurement In", "Voltage (V)"=w10, "Current (A)"=w11) -> (instance out=w3)
          w2 = w7
          w4 = $"SRM Mega Cluster In"
        }
        frame True {
          # Clears all event registers and Error Queue
          Property Node(instance in=w7) -> ("Instruments Coms Info:Keythley Address"=w12, instance out=w13)
          Property Node(instance in=$"SRM Mega Cluster In") -> ("SRM Specific Parameters:Sweep Speed"=w14, instance out=w15)
          call "FGV Current State.gvi"(Current State Instructions="Set Current Substate", Current Substate="Sweeping Keithley", Error In=$"Error In") -> (Error Out=w16)
          case (w14) {
            frame "Normal Sweep" {
              Property Node(instance in=w15) -> ("SRM Specific Parameters:V Points"=w18, instance out=w4)
              call "Clear Buffer.gvi"(VISA resource name=w12, error in (no error)=w16) -> (VISA resource name out=w19, error out=w20)
              call "Enable Output.gvi"(VISA resource name=w19, Enable Output (T: Enable)=TRUE, error in (no error)=w20) -> (VISA resource name out=w21, error out=w22)
              call "Initiate.gvi"(VISA resource name=w21, error in (no error)=w22) -> (VISA resource name out=w23, error out=w24)
              call "FGV Keithley timeout.gvi"(FGV Instructions="Read State", Error In=w24) -> (Timeout in ms Out=w25, Error Out=w26)
              call "Wait for Operation Complete.gvi"(VISA resource name=w23, Timeout (10000 ms)=w25, error in (no error)=w26) -> (VISA resource name out=w27, error out=w28)
              call "Read (Multiple Points).gvi"(VISA resource name=w27, Start Index (1)=1, End Index (1)=w18, error in (no error)=w28, Buffer Elements="SOUR, READ") -> (VISA resource name out=w29, Data out=w30, error out=w31)
              Spreadsheet String To Array(array type=f64[] [], delimiter=",", format string="%s", spreadsheet string=w30) -> (array=w32)
              Decimate Array(array=w32) -> (out0=w33, out1=w34)
              Property Node(instance in=$"IV Single Measurement In", "Voltage (V)"=w33, "Current (A)"=w34) -> (instance out=w3)
              call "Keithley Timeout Check.gvi"(Error In=w31) -> (Error Out=w35)
              call "Enable Output.gvi"(VISA resource name=w29, Enable Output (T: Enable)=FALSE, error in (no error)=w35) -> (VISA resource name out=w36, error out=w37)
              call "Write (Instr, String).gvi"(session in=w36, error in=w37, write buffer="*CLS;") -> (session out=w17, error out=w9)
            }
            frame "Fast Sweep" {
              Property Node(instance in=w15) -> ("SRM Specific Parameters:Max (V)"=w38, "SRM Specific Parameters:Min (V)"=w39, "SRM Specific Parameters:V Points"=w40, "SRM Specific Parameters:Sweep Dir"=w41, "SRM Specific Parameters:PLC Speed"=w42, instance out=w4)
              Property Node(instance in="Fast Sweep Parameters.gtype" {all zero or empty}, "Parameters:Max Voltage (V)"=w38, "Parameters:Min Voltage (V)"=w39, "Parameters:Measurement Speed (1 PLC)"=w42, "Parameters:Sweep Points"=w40, "Parameters:Sweep Direction"=w41) -> (instance out=w43)
              call "Fast Sweep Subroutine.gvi"(Fast Sweep Parameters In=w43, VISA resource name in=w12, Error In=w16) -> (Fast Sweep Parameters Out=w44, VISA resource name out=w17, Error Out=w9)
              Property Node(instance in=w44) -> ("Data:Voltage Array (V)"=w45, "Data:Current Array (A)"=w46)
              Property Node(instance in=$"IV Single Measurement In", "Voltage (V)"=w45, "Current (A)"=w46) -> (instance out=w3)
            }
            frame "Smart Sweep" {
              call "FGV Smart Sweep Parameters.gvi"(FGV Instructions="Read State", Error In=w16) -> (Smart Sweep Mega Cluster Out=w47, Error Out=w48)
              call "Smart Sweep Subroutine.gvi"(Smart Sweep Mega Cluster In=w47, VISA resource name in=w12, Error In=w48) -> (Smart Sweep Mega Cluster Out=w49, VISA resource name out=w17, Error Out=w9)
              Property Node(instance in=w49) -> ("IV Data:Voltage Array (V)"=w50, "IV Data:Current Array (A)"=w51, "IV Data:Isc (A)"=w52, "IV Data:Voc (V)"=w53, "IV Data:FF (%)"=w54, "IV Data:Rs (Ω)"=w55, "IV Data:Rsh (Ω)"=w56)
              Property Node(instance in=$"IV Single Measurement In", "Voltage (V)"=w50, "Current (A)"=w51, "Smart Sweep Data:Isc (A)"=w52, "Smart Sweep Data:Voc (V)"=w53, "Smart Sweep Data:FF (%)"=w54, "Smart Sweep Data:Rs (Ω)"=w55, "Smart Sweep Data:Rsh (Ω)"=w56) -> (instance out=w3)
              w4 = w15
            }
          }
          Property Node(instance in=w13, "Instruments Coms Info:Keythley Address"=w17) -> (instance out=w2)
        }
      }
      call "Clear Error Cluster.gvi"(error in=w9) -> (error out=w1)
    }
  }
  $"IV Single Measurement Out" <- w3
  $"Instrument Control Mega Cluster Out" <- w2
  $"Error Out" <- w1
  $"SRM Mega Cluster Out" <- w4
