vi "Keithley Test.gvi"   [LabVIEW NXG 5.0.0]
inputs:
  "Error In": error
outputs:
  "Error Out": error
panel controls:
  "SRM Specific Parameters In": "SRM Specific Parameters.gtype" = {"Max (V)"=1.2, "Min (V)"=-0.2, "V Points"=100, "Current Range (A)"=0.5, "Autorange"=TRUE, "Sweep Dir"=FALSE, "Current Averages"=3, "Max (A)"=1, "Integration Time"=0.5, "Cell Area (m^2)"=5}
  "Instrument Coms Info In": "Instrument Coms Info.gtype"
  "Debugging Cluster In": "Debugging Cluster.gtype"
panel indicators:
  "Instrument Coms Info Out": "Instrument Coms Info.gtype"
  "Debugging Cluster Out": "Debugging Cluster.gtype"
types:
  T1 = cluster{"Element 1": "VISA Instr", "Element 2": string}
  "Arduino Detection cluster control.gtype" = cluster{"XZ Stage Arduino Address": "VISA Instr", "XZ Stage Arduino Detected?": bool, "Multiplexer Arduino Detected?": bool, "Multiplexer Arduino Address": "VISA Instr", "Arduinos List": T1[], "XZ Stage Log": string, "Multiplexer Log": string}
  "Thorlabs Motors Serial Number In.gtype" = cluster{"Thorlabs Blue Motor": string, "Thorlabs Red Motor": string, "Blue Motor Homed?": bool, "Red Motor Homed?": bool}
  "Instrument Coms Info.gtype" = cluster{"Arduino Coms Info": "Arduino Detection cluster control.gtype", "Photodetector Names": string[], "Keythley Address": "VISA Instr", "Photodetector Detected?": bool, "Thorlabs Motors Detected?": bool, "Keithley Detected?": bool, "Thorlabs Motors Serial Number": "Thorlabs Motors Serial Number In.gtype", "Photodetector IVI session": "Ivi IviDefault", "Flame ID": string, "Flame Detected?": bool, "Flame Wrapper ID": u64}
  "Insturment Debugging Cluster.gtype" = cluster{"Keithley": bool, "Arduinos": bool, "Thorlabs Motors": bool, "Photodetector": bool, "Flame Spectr": bool}
  "Debugging Cluster.gtype" = cluster{"Debugging mode?": bool, "Initialize App": bool, "Insturment Debugging": "Insturment Debugging Cluster.gtype"}
  "SRM Specific Parameters.gtype" = cluster{"Max (V)": f64, "Min (V)": f64, "V Points": u32, "Current Range (A)": f64, "Autorange": bool, "Sweep Dir": bool, "Current Averages": u32, "Max (A)": f64, "Integration Time": f64, "Cell Area (m^2)": f64}
uses:
  Rainbow Measurement Setup::Side Functions::Instrument Control::Keithley::FGV Keithley timeout.gvi
  Rainbow Measurement Setup::Side Functions::Instrument Control::Keithley::Keithley Initialize Subroutine.gvi
  Rainbow Measurement Setup::Side Functions::Instrument Control::Keithley::Keithley Set Constant Parameters.gvi
  Rainbow Measurement Setup::Side Functions::Instrument Control::Keithley::Keithley Sweep Subroutine.gvi
  Rainbow Measurement Setup::Side Functions::Instrument Control::Keithley::Keithley Close Subroutine.gvi
diagram:
  case ($"Error In") {
    frame Error, Default {
      w1 = $"Error In"
      w2 = $"Debugging Cluster In"
      w3 = $"Instrument Coms Info In"
    }
    frame No Error {
      call "FGV Keithley timeout.gvi"(FGV Instructions="Reset State", Error In=$"Error In") -> (Error Out=w4)
      call "Keithley Initialize Subroutine.gvi"(Instrument Coms Info In=$"Instrument Coms Info In", Debugging Cluster In=$"Debugging Cluster In", Error In=w4) -> (Instrument Coms Info Out=w5, Debugging Cluster Out=w6, Error Out=w7)
      call "Keithley Set Constant Parameters.gvi"(Instrument Coms Info In=w5, Debugging Cluster In=w6, SRM Specific Parameters In=$"SRM Specific Parameters In", Error In=w7) -> (Instrument Coms Info Out=w8, Debugging Cluster Out=w9, SRM Specific Parameters Out=w10, Error Out=w11)
      s1 = w11  # shift register
      s2 = uninitialised  # shift register
      for (N = 3) {
        call "Keithley Sweep Subroutine.gvi"(Instrument Coms Info In=w8, Debugging Cluster In=w9, IV Single Measurement In=s2, Error In=s1, SRM Specific Parameters In=w10) -> (Instrument Coms Info Out=w12, Debugging Cluster Out=w13, IV Single Measurement Out=w14, Error Out=w15)
        next s1 = w15
        next s2 = w14
      }
      call "Keithley Close Subroutine.gvi"(Instrument Coms Info In=w12, Debugging Cluster In=w13, Error In=s1) -> (Instrument Coms Info Out=w3, Debugging Cluster Out=w2, Error Out=w1)
    }
  }
  $"Instrument Coms Info Out" <- w3
  $"Debugging Cluster Out" <- w2
  $"Error Out" <- w1
