vi "Random IV Curve Generator.gvi"   [LabVIEW NXG 5.0.0]
inputs:
  "Error In": error
  "SRM Mega Cluster In": "SRM Mega Cluster.gtype"
  "Intensity Constant": f64
  "Light Intensity": f64
outputs:
  "Error Out": error
  "Voltage": f64[]
  "Current": f64[]
types:
  "SRM Specific Parameters.gtype" = cluster{"Max (V)": f64, "Min (V)": f64, "V Points": u32, "Current Range (A)": f64, "Autorange": bool, "Sweep Dir": bool, "Current Averages": u32, "Max (A)": f64, "Integration Time": f64, "Cell Area (m^2)": f64}
  "Raibow Sweep Selector.gtype" = enum{"Red Sweep", "Blue Sweep", "Full Sweep Red First", "Full Sweep Blue First"}
  "Rainbow Sweep Param Selector.gtype" = cluster{"Raibow Sweep Selector": "Raibow Sweep Selector.gtype", "Max Wavelength (nm)": f64, "Min Wavelength (nm)": f64, "Wavelength Step (nm)": f64, "Rainbow Sweep Type Selector": "Rainbow Sweep Type Selector.gtype"}
  "Rainbow Sweep Types.gtype" = enum{"Red Sweep Closing", "Red Sweep Opening", "Blue Sweep Closing", "Blue Sweep Opening"}
  "IV Full Data Cluster.gtype" = cluster{"IV Measurements Array": "IV Single Measurement.gtype"[], "Rainbow Sweep Types": "Rainbow Sweep Types.gtype", "IV Refined Data": "IV Refined Full Sweep Data.gtype"}
  "SRM Mega Cluster.gtype" = cluster{"SRM Specific Parameters": "SRM Specific Parameters.gtype", "Rainbow Sweep Parameters SRM": "Rainbow Sweep Param Selector.gtype", "SRM Full IV data Array": "IV Full Data Cluster.gtype"[]}
uses:
  Rainbow Measurement Setup::Side Functions::Instrument Control::Keithley::Keithley Sweep Parameters Calculator.gvi
  NI::G Core::Numeric::Random Number (Range) DBL.gvi
diagram:
  case ($"Error In") {
    frame Error, Default {
      w1 = $"Error In"
      w2 = f64[] []
      w3 = f64[] []
    }
    frame No Error {
      call "Keithley Sweep Parameters Calculator.gvi"(SRM Mega Cluster In=$"SRM Mega Cluster In", Error In=$"Error In") -> (Sweep Points=w4, Error Out=w1)
      Property Node(instance in=w4) -> ("Start "=w5, "Stop "=w6, "Number of Points (5)"=w7)
      call "Random Number (Range) DBL.gvi"(upper bound=1.2, lower bound=0.8) -> (number=w8)
      Multiply(w8, $"Light Intensity") -> w9
      Multiply($"Intensity Constant", w8) -> w10
      To Signed 32 Bit Integer(number=w7) -> w11
      Subtract(x=w6, y=w5) -> w12
      To Double Precision Float(number=w7) -> w13
      Divide(x=w12, y=w13) -> w14
      for (N = w11) (iteration -> i1) {
        To Double Precision Float(number=i1) -> w15
        Multiply(w14, w15) -> w16
        Add(w5, w16) -> w17
        To Double Precision Float(number=w17) -> w18
        Exponential(x=w17) -> w19
        Multiply(w19, w10) -> w20
        Add(w9, w20) -> w21
        append w18 to w2
        append w21 to w3
      }
    }
  }
  $Voltage <- w2
  $Current <- w3
  $"Error Out" <- w1
