vi "Set Keythley to Fast.gvi"   [LabVIEW NXG 5.0.0]
inputs:
  "Visa Resource Name In": "VISA Instr"
  "Error In": error
outputs:
  "Visa Resource Name Out": "VISA Instr"
  "Error Out": error
uses:
  Labview_NXG_Keithley_SMU_2450_2460_2461::Configure::Turn off Delays and Autozero (High Speed).gvi
  Labview_NXG_Keithley_SMU_2450_2460_2461::Configure::Configure Autozero Once.gvi
diagram:
  call "Turn off Delays and Autozero (High Speed).gvi"(Visa Resource Name In=$"Visa Resource Name In", Error In=$"Error In") -> (VISA Resource Name Out=w1, Error Out=w2)
  call "Configure Autozero Once.gvi"(VISA resource name=w1, error in (no error)=w2) -> (VISA resource name out=w3, error out=w4)
  $"Visa Resource Name Out" <- w3
  $"Error Out" <- w4
