vi "Accurate Sweep VImpp.gvi"   [LabVIEW NXG 5.0.0]
inputs:
  "Error In": error
  "VISA resource name in": "VISA Instr"
  "Smart Sweep Mega Cluster In": "Smart Sweep Mega Cluster.gtype"
outputs:
  "Error Out": error
  "VISA resource name out": "VISA Instr"
  "Smart Sweep Mega Cluster Out": "Smart Sweep Mega Cluster.gtype"
types:
  T1 = cluster{"Rough Vmpp (V)": f64, "Rough Isc (A)": f64, "Rough Voc (V)": f64, "Rough Jmpp (V)": f64, "Averages Rough Isc (A)": u32, "Averages Rough Voc (V)": u32}
  T2 = cluster{"Isc (A)": f64, "Voc (V)": f64, "FF (%)": f64, "Rs (Ω)": f64, "Rsh (Ω)": f64, "Voltage Array (V)": f64[], "Current Array (A)": f64[]}
  T3 = cluster{"Isc Rsh Sweep Points": u32, "Voc Rs Sweep Points": u32, "VImpp Rough Sweep Points": u32, "VImpp Fine Sweep Points": u32, "Isc Rsh Sweep Direction": bool, "Voc Rs Sweep Direction": bool, "VImpp Rough Sweep Direction": bool, "VImpp Fine Sweep Direction": bool, "Isc Sweep Width (1=Isc)": f64, "Voc Sweep Width (1=Voc)": f64, "Vmpp Sweep Width Above (1=Voc)": f64, "Vmpp Sweep Width Below (1=Voc)": f64}
  "Smart Sweep Mega Cluster.gtype" = cluster{"Rough Readings": T1, "IV Data": T2, "Sweep Parameters": T3, "Measurement Speed (1 PLC)": f64}
  T4 = cluster{"Start ": f64, "Stop ": f64, "Number of Points (5)": u32}
uses:
  Rainbow Measurement Setup::Side Functions::Instrument Control::Keithley::Voltage Direction Calculator.gvi
  Labview_NXG_Keithley_SMU_2450_2460_2461::Configure::Clear Buffer.gvi
  Labview_NXG_Keithley_SMU_2450_2460_2461::Configure::Configure Measurement Range.gvi
  Labview_NXG_Keithley_SMU_2450_2460_2461::Configure::Configure Source Limit Level.gvi
  Labview_NXG_Keithley_SMU_2450_2460_2461::Configure::Configure Source Function.gvi
  Labview_NXG_Keithley_SMU_2450_2460_2461::Configure::Configure Measurement Function.gvi
  Labview_NXG_Keithley_SMU_2450_2460_2461::Configure::Configure Integration Filter.gvi
  Labview_NXG_Keithley_SMU_2450_2460_2461::Configure::Configure Linear Mode Sweep.gvi
  Labview_NXG_Keithley_SMU_2450_2460_2461::Action Status::Enable Output.gvi
  Labview_NXG_Keithley_SMU_2450_2460_2461::Data::Low Level::Initiate.gvi
  Labview_NXG_Keithley_SMU_2450_2460_2461::Data::Low Level::Wait for Operation Complete.gvi
  Labview_NXG_Keithley_SMU_2450_2460_2461::Data::Read (Multiple Points).gvi
  NI::VISA::Write (Instr, String).gvi
diagram:
  # This SubVI performs a sweep around the previously determined rough Vmpp point to further pin down the precise Vmpp and Jmpp points
  case ($"Error In") {
    frame Error, Default {
      w1 = $"Error In"
      w2 = $"VISA resource name in"
      w3 = $"Smart Sweep Mega Cluster In"
    }
    frame No Error {
      Property Node(instance in=$"Smart Sweep Mega Cluster In") -> ("Sweep Parameters:Vmpp Sweep Width Above (1=Voc)"=w4, "Sweep Parameters:Vmpp Sweep Width Below (1=Voc)"=w5, "Measurement Speed (1 PLC)"=w6, "IV Data:Isc (A)"=w7, "Rough Readings:Rough Vmpp (V)"=w8, "Sweep Parameters:VImpp Fine Sweep Direction"=w9, "Sweep Parameters:VImpp Fine Sweep Points"=w10, instance out=w11)
      Property Node(instance in=w11) -> ("IV Data:Voltage Array (V)"=w12, "IV Data:Current Array (A)"=w13, "IV Data:Isc (A)"=w14, "IV Data:Voc (V)"=w15, instance out=w16)
      Multiply(w8, w4) -> w17
      Add(w17, w8) -> w18
      Multiply(w8, w5) -> w19
      Subtract(x=w8, y=w19) -> w20
      call "Voltage Direction Calculator.gvi"(Max Voltage (V)=w18, Min Voltage (V)=w20, Error In=$"Error In", Sweep Direction=w9) -> (Start=w21, End=w22, Error Out=w23)
      Property Node(instance in=T4 {"Start "=0, "Stop "=0, "Number of Points (5)"=1}, "Start "=w21, "Stop "=w22, "Number of Points (5)"=w10) -> (instance out=w24)
      Multiply(w7, 0.1) -> w25
      Add(w25, w7) -> w26
      call "Clear Buffer.gvi"(VISA resource name=$"VISA resource name in", error in (no error)=w23) -> (VISA resource name out=w27, error out=w28)
      call "Configure Measurement Range.gvi"(VISA resource name=w27, Function (0: Volts)="Volts"(0), Enable Auto Range (T:Enable)=TRUE, error in (no error)=w28) -> (VISA resource name out=w29, error out=w30)
      call "Configure Measurement Range.gvi"(Manual Range (1.0)=w26, VISA resource name=w29, Function (0: Volts)="Current"(1), Enable Auto Range (T:Enable)=FALSE, error in (no error)=w30) -> (VISA resource name out=w31, error out=w32)
      call "Configure Source Limit Level.gvi"(VISA resource name=w31, Function (0: Volts)="Volts"(0), error in (no error)=w32) -> (VISA resource name out=w33, error out=w34)
      call "Configure Source Function.gvi"(VISA resource name=w33, Function (0: Volts)="Volts"(0), error in (no error)=w34) -> (VISA resource name out=w35, error out=w36)
      call "Configure Measurement Function.gvi"(VISA resource name=w35, Function (0: Volts)="Current"(1), error in (no error)=w36) -> (VISA resource name out=w37, error out=w38)
      call "Configure Integration Filter.gvi"(VISA resource name=w37, Function (0: Volts)="Current"(1), Measurement Speed (1 PLC)=w6, error in (no error)=w38) -> (VISA resource name out=w39, error out=w40)
      call "Configure Linear Mode Sweep.gvi"(VISA resource name=w39, Source Mode (0: Voltage)="Voltage"(0), Sweep Points=w24, Delay (0)=0, error in (no error)=w40, Fail Abort (T:ON)=FALSE) -> (VISA resource name out=w41, error out=w42)
      call "Enable Output.gvi"(VISA resource name=w41, Enable Output (T: Enable)=TRUE, error in (no error)=w42) -> (VISA resource name out=w43, error out=w44)
      call "Initiate.gvi"(VISA resource name=w43, error in (no error)=w44) -> (VISA resource name out=w45, error out=w46)
      call "Wait for Operation Complete.gvi"(VISA resource name=w45, Timeout (10000 ms)=60000, error in (no error)=w46) -> (VISA resource name out=w47, error out=w48)
      call "Read (Multiple Points).gvi"(VISA resource name=w47, Start Index (1)=1, End Index (1)=w10, error in (no error)=w48, Buffer Elements="SOUR, READ") -> (VISA resource name out=w49, Data out=w50, error out=w51)
      Spreadsheet String To Array(array type=f64[] [], delimiter=",", format string="%s", spreadsheet string=w50) -> (array=w52)
      Decimate Array(array=w52) -> (out0=w53, out1=w54)
      Build Array(w12, w53) -> w55
      Build Array(w13, w54) -> w56
      Multiply(w14, w15) -> w57
      Absolute Value(x=w57) -> w58
      Multiply(w53, w54) -> w59
      Array Max And Min(array=w59) -> (min index(es)=w60)
      # w61: Vmpp
      Array Index(array=w53) -> (out0[w60]=w61)
      # w62: Jmpp
      Array Index(array=w54) -> (out0[w60]=w62)
      Multiply(w61, w62) -> w63
      Absolute Value(x=w63) -> w64
      Multiply(w64, 100) -> w65
      Divide(x=w65, y=w58) -> w66
      In Range And Coerce(lower limit=0, upper limit=100, x=w66) -> (In Range?=w67, coerced(x)=w68)
      Select(s=w67, t=w68, f=0) -> w69
      Property Node(instance in=w16, "IV Data:Voltage Array (V)"=w55, "IV Data:Current Array (A)"=w56, "IV Data:FF (%)"=w69) -> (instance out=w3)
      call "Enable Output.gvi"(VISA resource name=w49, Enable Output (T: Enable)=FALSE, error in (no error)=w51) -> (VISA resource name out=w70, error out=w71)
      call "Clear Buffer.gvi"(VISA resource name=w70, error in (no error)=w71) -> (VISA resource name out=w72, error out=w73)
      call "Write (Instr, String).gvi"(session in=w72, error in=w73, write buffer="*CLS;") -> (session out=w2, error out=w1)
    }
  }
  $"Smart Sweep Mega Cluster Out" <- w3
  $"VISA resource name out" <- w2
  $"Error Out" <- w1
