vi "Full Smart Sweep.gvi"   [LabVIEW NXG 5.0.0]
inputs:
  "Error In": error
  "VISA resource name in": "VISA Instr"
  "Smart Sweep Mega Cluster In": "Smart Sweep Mega Cluster.gtype"
  "High Speed": bool
outputs:
  "Error Out": error
  "VISA resource name Out": "VISA Instr"
  "Smart Sweep Mega Cluster Out": "Smart Sweep Mega Cluster.gtype"
  "Elapsed Time (ms)": u32
types:
  T1 = cluster{"Rough Vmpp (V)": f64, "Rough Isc (A)": f64, "Rough Voc (V)": f64, "Rough Jmpp (V)": f64, "Averages Rough Isc (A)": u32, "Averages Rough Voc (V)": u32}
  T2 = cluster{"Isc (A)": f64, "Voc (V)": f64, "FF (%)": f64, "Rs (Ω)": f64, "Rsh (Ω)": f64, "Voltage Array (V)": f64[], "Current Array (A)": f64[]}
  T3 = cluster{"Isc Rsh Sweep Points": u32, "Voc Rs Sweep Points": u32, "VImpp Rough Sweep Points": u32, "VImpp Fine Sweep Points": u32, "Isc Rsh Sweep Direction": bool, "Voc Rs Sweep Direction": bool, "VImpp Rough Sweep Direction": bool, "VImpp Fine Sweep Direction": bool, "Isc Sweep Width (1=Voc)": f64, "Voc Sweep Height (1=Isc)": f64, "Vmpp Sweep Width Above (1=Voc)": f64, "Vmpp Sweep Width Below (1=Voc)": f64}
  "Smart Sweep Mega Cluster.gtype" = cluster{"Rough Readings": T1, "IV Data": T2, "Sweep Parameters": T3, "Measurement Speed (1 PLC)": f64, "High Speed": bool}
uses:
  Rainbow Measurement Setup::Side Functions::Utilities::Time Related Operations::Time at Point.gvi
  Labview_NXG_Keithley_SMU_2450_2460_2461::Configure::Turn off Delays and Autozero (High Speed).gvi
  Labview_NXG_Keithley_SMU_2450_2460_2461::Configure::Configure Autozero Once.gvi
  Rainbow Measurement Setup::Side Functions::Instrument Control::Keithley::Smart Sweep::Rough Voc_Isc Measurement.gvi
  Rainbow Measurement Setup::Side Functions::Instrument Control::Keithley::Smart Sweep::Rs_Voc Rsh_Isc Accurate Sweep.gvi
  Rainbow Measurement Setup::Side Functions::Instrument Control::Keithley::Smart Sweep::Rough Fast Sweep VImpp.gvi
  Rainbow Measurement Setup::Side Functions::Instrument Control::Keithley::Smart Sweep::Accurate Sweep VImpp.gvi
  Labview_NXG_Keithley_SMU_2450_2460_2461::Utility::Reset.gvi
  Rainbow Measurement Setup::Side Functions::Instrument Control::Keithley::Smart Sweep::IV Array Formatter.gvi
diagram:
  # This SubVI Performs a smart sweep that measures the Voc and the Jsc and then sweeps along
  # the entirety of the IV curve to roughly determine the Vmpp, and then repeats with more accuracy
  # around that point.
  case ($"Error In") {
    frame Error, Default {
      w1 = $"Error In"
      w2 = $"VISA resource name in"
      w3 = $"Smart Sweep Mega Cluster In"
      w4 = default
    }
    frame No Error {
      call "Time at Point.gvi"(Error In=$"Error In") -> (ms Count=w5, Error Out=w6)
      Property Node(instance in=$"Smart Sweep Mega Cluster In") -> ("High Speed"=w7, instance out=w8)
      Logical Or(w7, $"High Speed") -> w9
      case (w9) {
        frame False, Default {
          w10 = $"VISA resource name in"
          w11 = w6
        }
        frame True {
          call "Turn off Delays and Autozero (High Speed).gvi"(Visa Resource Name In=$"VISA resource name in", Error In=w6) -> (VISA Resource Name Out=w12, Error Out=w13)
          call "Configure Autozero Once.gvi"(VISA resource name=w12, error in (no error)=w13) -> (VISA resource name out=w10, error out=w11)
        }
      }
      call "Rough Voc_Isc Measurement.gvi"(VISA resource name=w10, Smart Sweep Mega Cluster In=w8, Error In=w11, Voc Isc Operation Control="Voc") -> (VISA resource name out=w14, Smart Sweep Mega Cluster Out=w15, Error Out=w16)
      call "Rough Voc_Isc Measurement.gvi"(VISA resource name=w14, Smart Sweep Mega Cluster In=w15, Error In=w16, Voc Isc Operation Control="Isc") -> (VISA resource name out=w17, Smart Sweep Mega Cluster Out=w18, Error Out=w19)
      call "Rs_Voc Rsh_Isc Accurate Sweep.gvi"(VISA resource name in=w17, Smart Sweep Mega Cluster In=w18, Error In=w19, Voc Jsc Operation Control="Voc") -> (VISA resource name out=w20, Smart Sweep Mega Cluster Out=w21, Error Out=w22)
      call "Rs_Voc Rsh_Isc Accurate Sweep.gvi"(VISA resource name in=w20, Smart Sweep Mega Cluster In=w21, Error In=w22, Voc Jsc Operation Control="Isc") -> (VISA resource name out=w23, Smart Sweep Mega Cluster Out=w24, Error Out=w25)
      call "Rough Fast Sweep VImpp.gvi"(VISA resource name in=w23, Smart Sweep Mega Cluster In=w24, Error In=w25) -> (VISA resource name out=w26, Smart Sweep Mega Cluster Out=w27, Error Out=w28)
      call "Accurate Sweep VImpp.gvi"(VISA resource name in=w26, Smart Sweep Mega Cluster In=w27, Error In=w28) -> (VISA resource name out=w29, Smart Sweep Mega Cluster Out=w30, Error Out=w31)
      call "Reset.gvi"(VISA resource name=w29, error in (no error)=w31) -> (VISA resource name out=w2, error out=w32)
      call "IV Array Formatter.gvi"(Smart Sweep Mega Cluster In=w30, Error In=w32) -> (Smart Sweep Mega Cluster Out=w3, Error Out=w33)
      call "Time at Point.gvi"(Error In=w33) -> (ms Count=w34, Error Out=w1)
      Subtract(x=w34, y=w5) -> w4
    }
  }
  $"Smart Sweep Mega Cluster Out" <- w3
  $"Error Out" <- w1
  $"Elapsed Time (ms)" <- w4
  $"VISA resource name Out" <- w2
