vi "IV Array Formatter.gvi"   [LabVIEW NXG 5.0.0]
inputs:
  "Error In": error
  "Smart Sweep Mega Cluster In": "Smart Sweep Mega Cluster.gtype"
outputs:
  "Error Out": error
  "Smart Sweep Mega Cluster Out": "Smart Sweep Mega Cluster.gtype"
types:
  T1 = cluster{"Rough Vmpp (V)": f64, "Rough Isc (A)": f64, "Rough Voc (V)": f64, "Rough Jmpp (V)": f64, "Averages Rough Isc (A)": u32, "Averages Rough Voc (V)": u32}
  T2 = cluster{"Isc (A)": f64, "Voc (V)": f64, "FF (%)": f64, "Rs (Ω)": f64, "Rsh (Ω)": f64, "Voltage Array (V)": f64[], "Current Array (A)": f64[]}
  T3 = cluster{"Isc Rsh Sweep Points": u32, "Voc Rs Sweep Points": u32, "VImpp Rough Sweep Points": u32, "VImpp Fine Sweep Points": u32, "Isc Rsh Sweep Direction": bool, "Voc Rs Sweep Direction": bool, "VImpp Rough Sweep Direction": bool, "VImpp Fine Sweep Direction": bool, "Isc Sweep Width (1=Isc)": f64, "Voc Sweep Width (1=Voc)": f64, "Vmpp Sweep Width Above (1=Voc)": f64, "Vmpp Sweep Width Below (1=Voc)": f64}
  "Smart Sweep Mega Cluster.gtype" = cluster{"Rough Readings": T1, "IV Data": T2, "Sweep Parameters": T3, "Measurement Speed (1 PLC)": f64}
diagram:
  # This SubVI Simply sorts the IV data arrays according to the voltage
  case ($"Error In") {
    frame Error, Default {
      w1 = $"Error In"
      w2 = $"Smart Sweep Mega Cluster In"
    }
    frame No Error {
      Property Node(instance in=$"Smart Sweep Mega Cluster In") -> ("IV Data:Voltage Array (V)"=w3, "IV Data:Current Array (A)"=w4, instance out=w5)
      for {
        w6 = each element of w3
        w7 = each element of w4
        Build Cluster(w6, w7) -> w9
        append w9 to w8
      }
      Sort 1D Array(array=w8) -> (sorted array=w10)
      for {
        w11 = each element of w10
        Property Node(instance in=w11) -> ("Element 1"=w14, "Element 2"=w15)
        append w14 to w12
        append w15 to w13
      }
      Property Node(instance in=w5, "IV Data:Voltage Array (V)"=w12, "IV Data:Current Array (A)"=w13) -> (instance out=w2)
      w1 = $"Error In"
    }
  }
  $"Error Out" <- w1
  $"Smart Sweep Mega Cluster Out" <- w2
