vi "Keithley 2450 Fast Sweep.gvi"   [LabVIEW NXG 5.0.0]
# Configures a sweep and takes voltage and current readings at each point.
panel controls:
  "VISA resource name": "VISA Instr"
    # Specifies which instrument to use.  Instruments that are powered on and connected to your computer are visible in the VISA resource name pull-down menu.  Select the resource name from the VISA resource name pull-down menu.  If your instrument does not appear in this list, enter the instrument descriptor using the following format:
    # Interface Type[board index]::Address::INSTR.
    # Examples:
    # GPIB:  GPIB::22::INSTR,  GPIB board 0, primary address 22
    # Serial:  COM1
    # VISA Alias:  "SampleInstr" - Alias names are configured in MAX
    # Refer to the LabVIEW Help for more information about specifying a VISA resource name.
  "Sweep Points": T1 = {"Start "=1, "Stop "=0, "Number of Points (5)"=5}
  "Delay (0) in Sec": f64 = 0.001  # The amount of delay between source and measure.
  "Measurement Speed (1 PLC)": f64 = 1  # The number of power line cycles the instrument spends taking a measurement. This setting is global for voltage, current, and resistance measurements. Valid Range: 0.01 to 10 PLC
  "High Speed": bool
  "Manual Range": f64 = 1e-05
  "Source Mode": bool
panel indicators:
  "Waveform Graph": f64[][]
  "Sweep Miliseconds": f64
  "Delay Info Cluster": T2
types:
  T1 = cluster{"Start ": f64, "Stop ": f64, "Number of Points (5)": u32}
  T2 = cluster{"Trigger Delay": f64, "Auto delay Enabled? Volts": bool, "Auto delay Enabled? Curr": bool, "Delay Time Volts": f64, "Delay Time Curr": f64, "Voltage Measure Delay": f64, "Curr Measure Delay": f64, "Auto Zero Enabled? Volts": bool, "Auto Zero Enabled? Curr": bool}
uses:
  Labview_NXG_Keithley_SMU_2450_2460_2461::Miscelaneous::Initialize.gvi
  Labview_NXG_Keithley_SMU_2450_2460_2461::Configure::Configure Measurement Range.gvi
  Labview_NXG_Keithley_SMU_2450_2460_2461::Configure::Configure Source Function.gvi
  Labview_NXG_Keithley_SMU_2450_2460_2461::Configure::Configure Source Range.gvi
  Labview_NXG_Keithley_SMU_2450_2460_2461::Configure::Configure Measurement Function.gvi
  Labview_NXG_Keithley_SMU_2450_2460_2461::Configure::Configure Integration Filter.gvi
  Labview_NXG_Keithley_SMU_2450_2460_2461::Configure::Turn off Delays and Autozero (High Speed).gvi
  Labview_NXG_Keithley_SMU_2450_2460_2461::Configure::Configure Autozero Once.gvi
  Labview_NXG_Keithley_SMU_2450_2460_2461::Configure::Get All Delay Info.gvi
  Labview_NXG_Keithley_SMU_2450_2460_2461::Configure::Configure Linear Mode Sweep.gvi
  Labview_NXG_Keithley_SMU_2450_2460_2461::Action Status::Enable Output.gvi
  Labview_NXG_Keithley_SMU_2450_2460_2461::Data::Low Level::Initiate.gvi
  Labview_NXG_Keithley_SMU_2450_2460_2461::Data::Low Level::Wait for Operation Complete.gvi
  Labview_NXG_Keithley_SMU_2450_2460_2461::Data::Read (Multiple Points).gvi
  Labview_NXG_Keithley_SMU_2450_2460_2461::Miscelaneous::Close.gvi
  NI::G Core::Error::Display Error.gvi
diagram:
  # Read the raw data.
  Property Node(instance in=$"Sweep Points") -> ("Number of Points (5)"=w1)
  call "Initialize.gvi"(VISA resource name=$"VISA resource name") -> (VISA resource name out=w2, error out=w3)
  call "Configure Measurement Range.gvi"(Manual Range (1.0)=$"Manual Range", VISA resource name=w2, Function (0: Volts)="Current"(1), Enable Auto Range (T:Enable)=FALSE, error in (no error)=w3) -> (VISA resource name out=w4, error out=w5)
  Select(s=$"Source Mode", t="Volts"(0), f="Current"(1)) -> w6
  call "Configure Source Function.gvi"(VISA resource name=w4, Function (0: Volts)=w6, error in (no error)=w5) -> (VISA resource name out=w7, error out=w8)
  call "Configure Source Range.gvi"(VISA resource name=w7, Function (0: Volts)="Current"(1), Source Range (1.0)=$"Manual Range", error in (no error)=w8) -> (VISA resource name out=w9, error out=w10)
  Select(s=$"Source Mode", t="Current"(1), f="Volts"(0)) -> w11
  call "Configure Measurement Function.gvi"(VISA resource name=w9, Function (0: Volts)=w11, error in (no error)=w10) -> (VISA resource name out=w12, error out=w13)
  call "Configure Integration Filter.gvi"(VISA resource name=w12, Function (0: Volts)="Current"(1), Measurement Speed (1 PLC)=$"Measurement Speed (1 PLC)", error in (no error)=w13) -> (VISA resource name out=w14, error out=w15)
  # Configure the sweep with the amplitude and source settings.
  case ($"High Speed") {
    frame False, Default {
      w16 = w15
      w17 = w14
    }
    frame True {
      call "Turn off Delays and Autozero (High Speed).gvi"(Visa Resource Name In=w14, Error In=w15) -> (VISA Resource Name Out=w18, Error Out=w19)
      call "Configure Autozero Once.gvi"(VISA resource name=w18, error in (no error)=w19) -> (VISA resource name out=w17, error out=w16)
    }
  }
  call "Get All Delay Info.gvi"(VISA Resource Name In=w17, Error In=w16) -> (VISA resource name out=w20, Delay Info Cluster=w21, Error Out=w22)
  call "Configure Linear Mode Sweep.gvi"(VISA resource name=w20, Sweep Points=$"Sweep Points", Delay (0)=$"Delay (0) in Sec", error in (no error)=w22, Fail Abort (T:ON)=FALSE) -> (VISA resource name out=w23, error out=w24)
  call "Enable Output.gvi"(VISA resource name=w23, Enable Output (T: Enable)=TRUE, error in (no error)=w24) -> (VISA resource name out=w25, error out=w26)
  case (w26) {
    frame Error, Default {
      w27 = w26
      w28 = default
    }
    frame No Error {
      Tick Count[Units=Microseconds]() -> (timer value=w28)
      w27 = w26
    }
  }
  call "Initiate.gvi"(VISA resource name=w25, error in (no error)=w27) -> (VISA resource name out=w29, error out=w30)
  call "Wait for Operation Complete.gvi"(VISA resource name=w29, error in (no error)=w30) -> (VISA resource name out=w31, error out=w32)
  case (w32) {
    frame Error, Default {
      w33 = w32
      w34 = default
    }
    frame No Error {
      Tick Count[Units=Microseconds]() -> (timer value=w34)
      w33 = w32
    }
  }
  Select(s=$"Source Mode", t="SOUR, READ", f="READ, SOUR") -> w35
  call "Read (Multiple Points).gvi"(VISA resource name=w31, Start Index (1)=1, End Index (1)=w1, error in (no error)=w33, Buffer Elements=w35) -> (VISA resource name out=w36, Data out=w37, error out=w38)
  call "Enable Output.gvi"(VISA resource name=w36, Enable Output (T: Enable)=FALSE, error in (no error)=w38) -> (VISA resource name out=w39, error out=w40)
  call "Close.gvi"(VISA resource name=w39, error in (no error)=w40) -> (error out=w41)
  call "Display Error.gvi"(error in=w41)
  Spreadsheet String To Array(array type=f64[] [], delimiter=",", format string="%s", spreadsheet string=w37) -> (array=w42)
  Decimate Array(array=w42) -> (out0=w43, out1=w44)
  Build Array(w43, w44) -> w45
  $"Waveform Graph" <- w45
  $"Delay Info Cluster" <- w21
  Subtract(x=w34, y=w28) -> w46
  Divide(x=w46, y=1000) -> w47
  $"Sweep Miliseconds" <- w47
