vi "Rough Voc_Isc Measurement.gvi"   [LabVIEW NXG 5.0.0]
inputs:
  "Error In": error
  "VISA resource name": "VISA Instr"
  "Voc Isc Operation Control": "Voc Jsc Operation Control.gtype" = "Voc"
  "Smart Sweep Mega Cluster In": "Smart Sweep Mega Cluster.gtype"
outputs:
  "Error Out": error
  "VISA resource name out": "VISA Instr"
  "Smart Sweep Mega Cluster Out": "Smart Sweep Mega Cluster.gtype"
types:
  "Voc Jsc Operation Control.gtype" = enum{"Voc", "Isc"}
  T1 = cluster{"Rough Vmpp (V)": f64, "Rough Isc (A)": f64, "Rough Voc (V)": f64, "Rough Jmpp (V)": f64, "Averages Rough Isc (A)": u32, "Averages Rough Voc (V)": u32}
  T2 = cluster{"Isc (A)": f64, "Voc (V)": f64, "FF (%)": f64, "Rs (Ω)": f64, "Rsh (Ω)": f64, "Voltage Array (V)": f64[], "Current Array (A)": f64[]}
  T3 = cluster{"Isc Rsh Sweep Points": u32, "Voc Rs Sweep Points": u32, "VImpp Rough Sweep Points": u32, "VImpp Fine Sweep Points": u32, "Isc Rsh Sweep Direction": bool, "Voc Rs Sweep Direction": bool, "VImpp Rough Sweep Direction": bool, "VImpp Fine Sweep Direction": bool, "Isc Sweep Width (1=Voc)": f64, "Voc Sweep Height (1=Isc)": f64, "Vmpp Sweep Width Above (1=Voc)": f64, "Vmpp Sweep Width Below (1=Voc)": f64}
  "Smart Sweep Mega Cluster.gtype" = cluster{"Rough Readings": T1, "IV Data": T2, "Sweep Parameters": T3, "Measurement Speed (1 PLC)": f64, "High Speed": bool}
uses:
  Labview_NXG_Keithley_SMU_2450_2460_2461::Configure::Clear Buffer.gvi
  Labview_NXG_Keithley_SMU_2450_2460_2461::Configure::Configure Measurement Range.gvi
  Labview_NXG_Keithley_SMU_2450_2460_2461::Configure::Configure Source Level.gvi
  Labview_NXG_Keithley_SMU_2450_2460_2461::Configure::Configure Source Function.gvi
  Labview_NXG_Keithley_SMU_2450_2460_2461::Configure::Configure Measurement Function.gvi
  Labview_NXG_Keithley_SMU_2450_2460_2461::Configure::Set Measurement Count.gvi
  Labview_NXG_Keithley_SMU_2450_2460_2461::Action Status::Enable Output.gvi
  Labview_NXG_Keithley_SMU_2450_2460_2461::Data::Make Reading and Store in Buffer.gvi
  Labview_NXG_Keithley_SMU_2450_2460_2461::Data::Read (Multiple Points).gvi
  NI::Analysis::Statistics::Measures of Mean.gvi
  Labview_NXG_Keithley_SMU_2450_2460_2461::Configure::Configure Source Limit Level.gvi
diagram:
  # This SubVI Finds a rough value for the Voc or the Jsc in a fast manner
  case ($"Error In") {
    frame Error, Default {
      w1 = $"Error In"
      w2 = $"VISA resource name"
      w3 = $"Smart Sweep Mega Cluster In"
    }
    frame No Error {
      case ($"Voc Isc Operation Control") {
        frame "Voc", Default {
          Property Node(instance in=$"Smart Sweep Mega Cluster In") -> ("Rough Readings:Averages Rough Voc (V)"=w4, instance out=w5)
          call "Clear Buffer.gvi"(VISA resource name=$"VISA resource name", error in (no error)=$"Error In") -> (VISA resource name out=w6, error out=w7)
          call "Configure Measurement Range.gvi"(VISA resource name=w6, Function (0: Volts)="Volts"(0), Enable Auto Range (T:Enable)=TRUE, error in (no error)=w7) -> (VISA resource name out=w8, error out=w9)
          call "Configure Measurement Range.gvi"(VISA resource name=w8, Function (0: Volts)="Current"(1), Enable Auto Range (T:Enable)=TRUE, error in (no error)=w9) -> (VISA resource name out=w10, error out=w11)
          call "Configure Source Level.gvi"(VISA resource name=w10, Function (0: Volts)="Current"(1), Source Level (1.0)=0, error in (no error)=w11) -> (VISA resource name out=w12, error out=w13)
          call "Configure Source Function.gvi"(VISA resource name=w12, Function (0: Volts)="Current"(1), error in (no error)=w13) -> (VISA resource name out=w14, error out=w15)
          call "Configure Measurement Function.gvi"(VISA resource name=w14, Function (0: Volts)="Volts"(0), error in (no error)=w15) -> (VISA resource name out=w16, error out=w17)
          call "Set Measurement Count.gvi"(VISA resource name=w16, Measurement Count=w4, error in (no error)=w17) -> (VISA resource name out=w18, error out=w19)
          call "Enable Output.gvi"(VISA resource name=w18, Enable Output (T: Enable)=TRUE, error in (no error)=w19) -> (VISA resource name out=w20, error out=w21)
          call "Make Reading and Store in Buffer.gvi"(VISA resource name=w20, error in (no error)=w21) -> (VISA resource name out=w22, error out=w23)
          call "Read (Multiple Points).gvi"(VISA resource name=w22, End Index (1)=w4, error in (no error)=w23) -> (VISA resource name out=w24, Data out=w25, error out=w26)
          Spreadsheet String To Array(array type=f64[] [], delimiter=",", format string="%s", spreadsheet string=w25) -> (array=w27)
          call "Enable Output.gvi"(VISA resource name=w24, Enable Output (T: Enable)=FALSE, error in (no error)=w26) -> (VISA resource name out=w28, error out=w29)
          call "Clear Buffer.gvi"(VISA resource name=w28, error in (no error)=w29) -> (VISA resource name out=w2, error out=w30)
          call "Measures of Mean.gvi"(x=w27, error in=w30) -> (mean value=w31, error out=w1)
          Property Node(instance in=w5, "Rough Readings:Rough Voc (V)"=w31) -> (instance out=w3)
        }
        frame "Isc" {
          Property Node(instance in=$"Smart Sweep Mega Cluster In") -> ("Rough Readings:Averages Rough Isc (A)"=w32, instance out=w33)
          call "Clear Buffer.gvi"(VISA resource name=$"VISA resource name", error in (no error)=$"Error In") -> (VISA resource name out=w34, error out=w35)
          call "Configure Measurement Range.gvi"(VISA resource name=w34, Function (0: Volts)="Volts"(0), Enable Auto Range (T:Enable)=TRUE, error in (no error)=w35) -> (VISA resource name out=w36, error out=w37)
          call "Configure Measurement Range.gvi"(VISA resource name=w36, Function (0: Volts)="Current"(1), Enable Auto Range (T:Enable)=TRUE, error in (no error)=w37) -> (VISA resource name out=w38, error out=w39)
          call "Configure Source Level.gvi"(VISA resource name=w38, Function (0: Volts)="Volts"(0), Source Level (1.0)=0, error in (no error)=w39) -> (VISA resource name out=w40, error out=w41)
          call "Configure Source Limit Level.gvi"(VISA resource name=w40, Function (0: Volts)="Volts"(0), Source Limit (1.0)=0.1, error in (no error)=w41) -> (VISA resource name out=w42, error out=w43)
          call "Configure Source Function.gvi"(VISA resource name=w42, Function (0: Volts)="Volts"(0), error in (no error)=w43) -> (VISA resource name out=w44, error out=w45)
          call "Configure Measurement Function.gvi"(VISA resource name=w44, Function (0: Volts)="Current"(1), error in (no error)=w45) -> (VISA resource name out=w46, error out=w47)
          call "Set Measurement Count.gvi"(VISA resource name=w46, Measurement Count=w32, error in (no error)=w47) -> (VISA resource name out=w48, error out=w49)
          call "Enable Output.gvi"(VISA resource name=w48, Enable Output (T: Enable)=TRUE, error in (no error)=w49) -> (VISA resource name out=w50, error out=w51)
          call "Make Reading and Store in Buffer.gvi"(VISA resource name=w50, error in (no error)=w51) -> (VISA resource name out=w52, error out=w53)
          call "Read (Multiple Points).gvi"(VISA resource name=w52, End Index (1)=w32, error in (no error)=w53) -> (VISA resource name out=w54, Data out=w55, error out=w56)
          Spreadsheet String To Array(array type=f64[] [], delimiter=",", format string="%s", spreadsheet string=w55) -> (array=w57)
          call "Enable Output.gvi"(VISA resource name=w54, Enable Output (T: Enable)=FALSE, error in (no error)=w56) -> (VISA resource name out=w58, error out=w59)
          call "Clear Buffer.gvi"(VISA resource name=w58, error in (no error)=w59) -> (VISA resource name out=w2, error out=w60)
          call "Measures of Mean.gvi"(x=w57, error in=w60) -> (mean value=w61, error out=w1)
          Property Node(instance in=w33, "Rough Readings:Rough Isc (A)"=w61) -> (instance out=w3)
        }
      }
    }
  }
  $"Smart Sweep Mega Cluster Out" <- w3
  $"Error Out" <- w1
  $"VISA resource name out" <- w2
