vi "Rs_Voc Rsh_Isc Accurate Sweep.gvi"   [LabVIEW NXG 5.0.0]
inputs:
  "Error In": error
  "VISA resource name in": "VISA Instr"
  "Smart Sweep Mega Cluster In": "Smart Sweep Mega Cluster.gtype"
  "Voc Jsc Operation Control": "Voc Jsc Operation Control.gtype" = "Voc"
outputs:
  "Error Out": error
  "VISA resource name out": "VISA Instr"
  "Smart Sweep Mega Cluster Out": "Smart Sweep Mega Cluster.gtype"
types:
  "Voc Jsc Operation Control.gtype" = enum{"Voc", "Isc"}
  T1 = cluster{"Rough Vmpp (V)": f64, "Rough Isc (A)": f64, "Rough Voc (V)": f64, "Rough Jmpp (V)": f64, "Averages Rough Isc (A)": u32, "Averages Rough Voc (V)": u32}
  T2 = cluster{"Isc (A)": f64, "Voc (V)": f64, "FF (%)": f64, "Rs (Ω)": f64, "Rsh (Ω)": f64, "Voltage Array (V)": f64[], "Current Array (A)": f64[]}
  T3 = cluster{"Isc Rsh Sweep Points": u32, "Voc Rs Sweep Points": u32, "VImpp Rough Sweep Points": u32, "VImpp Fine Sweep Points": u32, "Isc Rsh Sweep Direction": bool, "Voc Rs Sweep Direction": bool, "VImpp Rough Sweep Direction": bool, "VImpp Fine Sweep Direction": bool, "Isc Sweep Width (1=Isc)": f64, "Voc Sweep Width (1=Voc)": f64, "Vmpp Sweep Width Above (1=Voc)": f64, "Vmpp Sweep Width Below (1=Voc)": f64}
  "Smart Sweep Mega Cluster.gtype" = cluster{"Rough Readings": T1, "IV Data": T2, "Sweep Parameters": T3, "Measurement Speed (1 PLC)": f64}
  T4 = cluster{"Start ": f64, "Stop ": f64, "Number of Points (5)": u32}
uses:
  Rainbow Measurement Setup::Side Functions::Instrument Control::Keithley::Voltage Direction Calculator.gvi
  Labview_NXG_Keithley_SMU_2450_2460_2461::Configure::Clear Buffer.gvi
  Labview_NXG_Keithley_SMU_2450_2460_2461::Configure::Configure Measurement Range.gvi
  Labview_NXG_Keithley_SMU_2450_2460_2461::Configure::Configure Source Limit Level.gvi
  Labview_NXG_Keithley_SMU_2450_2460_2461::Configure::Configure Source Function.gvi
  Labview_NXG_Keithley_SMU_2450_2460_2461::Configure::Configure Measurement Function.gvi
  Labview_NXG_Keithley_SMU_2450_2460_2461::Configure::Configure Integration Filter.gvi
  Labview_NXG_Keithley_SMU_2450_2460_2461::Configure::Configure Linear Mode Sweep.gvi
  Labview_NXG_Keithley_SMU_2450_2460_2461::Action Status::Enable Output.gvi
  Labview_NXG_Keithley_SMU_2450_2460_2461::Data::Low Level::Initiate.gvi
  Labview_NXG_Keithley_SMU_2450_2460_2461::Data::Low Level::Wait for Operation Complete.gvi
  Labview_NXG_Keithley_SMU_2450_2460_2461::Data::Read (Multiple Points).gvi
  NI::VISA::Write (Instr, String).gvi
  Rainbow Measurement Setup::Side Functions::Instrument Control::Keithley::Smart Sweep::Voc_Rs Isc_Rsh Calculator.gvi
diagram:
  # This SubVI performs a sweep around the Voc and the Jsc points to more accurately determine these two parameters as well as to determine the
  # Rs and the Rsh through the slope of the curves.
  case ($"Error In") {
    frame Error, Default {
      w1 = $"Error In"
      w2 = $"VISA resource name in"
      w3 = $"Smart Sweep Mega Cluster In"
    }
    frame No Error {
      case ($"Voc Jsc Operation Control") {
        frame "Voc", Default {
          Property Node(instance in=$"Smart Sweep Mega Cluster In") -> ("Sweep Parameters:Voc Rs Sweep Direction"=w8, "Rough Readings:Rough Voc (V)"=w9, "Measurement Speed (1 PLC)"=w10, "Sweep Parameters:Voc Rs Sweep Points"=w11, "Sweep Parameters:Voc Sweep Width (1=Voc)"=w12, instance out=w13)
          Property Node(instance in=w13) -> ("IV Data:Voltage Array (V)"=w14, "IV Data:Current Array (A)"=w15, instance out=w16)
          Multiply(w9, w12) -> w17
          Negate(x=w17) -> w18
          call "Voltage Direction Calculator.gvi"(Max Voltage (V)=w17, Min Voltage (V)=w18, Error In=$"Error In", Sweep Direction=w8) -> (Start=w19, End=w20, Error Out=w21)
          Property Node(instance in=T4 {"Start "=0, "Stop "=0, "Number of Points (5)"=1}, "Start "=w19, "Stop "=w20, "Number of Points (5)"=w11) -> (instance out=w22)
          call "Clear Buffer.gvi"(VISA resource name=$"VISA resource name in", error in (no error)=w21) -> (VISA resource name out=w23, error out=w24)
          call "Configure Measurement Range.gvi"(VISA resource name=w23, Function (0: Volts)="Current"(1), Enable Auto Range (T:Enable)=TRUE, error in (no error)=w24) -> (VISA resource name out=w25, error out=w26)
          call "Configure Measurement Range.gvi"(Manual Range (1.0)=w9, VISA resource name=w25, Function (0: Volts)="Volts"(0), Enable Auto Range (T:Enable)=FALSE, error in (no error)=w26) -> (VISA resource name out=w27, error out=w28)
          call "Configure Source Limit Level.gvi"(VISA resource name=w27, Function (0: Volts)="Current"(1), Source Limit (1.0)=0.1, error in (no error)=w28) -> (VISA resource name out=w29, error out=w30)
          call "Configure Source Function.gvi"(VISA resource name=w29, Function (0: Volts)="Current"(1), error in (no error)=w30) -> (VISA resource name out=w31, error out=w32)
          call "Configure Measurement Function.gvi"(VISA resource name=w31, Function (0: Volts)="Volts"(0), error in (no error)=w32) -> (VISA resource name out=w33, error out=w34)
          call "Configure Integration Filter.gvi"(VISA resource name=w33, Function (0: Volts)="Volts"(0), Measurement Speed (1 PLC)=w10, error in (no error)=w34) -> (VISA resource name out=w35, error out=w36)
          call "Configure Linear Mode Sweep.gvi"(VISA resource name=w35, Source Mode (0: Voltage)="Current"(1), Sweep Points=w22, Delay (0)=0, error in (no error)=w36, Fail Abort (T:ON)=FALSE) -> (VISA resource name out=w37, error out=w38)
          call "Enable Output.gvi"(VISA resource name=w37, Enable Output (T: Enable)=TRUE, error in (no error)=w38) -> (VISA resource name out=w39, error out=w40)
          call "Initiate.gvi"(VISA resource name=w39, error in (no error)=w40) -> (VISA resource name out=w41, error out=w42)
          call "Wait for Operation Complete.gvi"(VISA resource name=w41, Timeout (10000 ms)=60000, error in (no error)=w42) -> (VISA resource name out=w43, error out=w44)
          call "Read (Multiple Points).gvi"(VISA resource name=w43, Start Index (1)=1, End Index (1)=w11, error in (no error)=w44, Buffer Elements="SOUR, READ") -> (VISA resource name out=w45, Data out=w46, error out=w47)
          Spreadsheet String To Array(array type=f64[] [], delimiter=",", format string="%s", spreadsheet string=w46) -> (array=w48)
          Decimate Array(array=w48) -> (out0=w7, out1=w6)
          Build Array(w14, w7) -> w49
          Build Array(w15, w6) -> w50
          Property Node(instance in=w16, "IV Data:Voltage Array (V)"=w49, "IV Data:Current Array (A)"=w50) -> (instance out=w5)
          call "Enable Output.gvi"(VISA resource name=w45, Enable Output (T: Enable)=FALSE, error in (no error)=w47) -> (VISA resource name out=w51, error out=w52)
          call "Clear Buffer.gvi"(VISA resource name=w51, error in (no error)=w52) -> (VISA resource name out=w53, error out=w54)
          call "Write (Instr, String).gvi"(session in=w53, error in=w54, write buffer="*CLS;") -> (session out=w2, error out=w4)
        }
        frame "Isc" {
          Property Node(instance in=$"Smart Sweep Mega Cluster In") -> ("Sweep Parameters:Isc Sweep Width (1=Isc)"=w55, "IV Data:Isc (A)"=w56, "Sweep Parameters:Isc Rsh Sweep Points"=w57, "Sweep Parameters:Isc Rsh Sweep Direction"=w58, "Measurement Speed (1 PLC)"=w59, instance out=w60)
          Multiply(w56, w55) -> w61
          Negate(x=w61) -> w62
          call "Voltage Direction Calculator.gvi"(Max Voltage (V)=w61, Min Voltage (V)=w62, Error In=$"Error In", Sweep Direction=w58) -> (Start=w63, End=w64, Error Out=w65)
          Property Node(instance in=T4 {"Start "=0, "Stop "=0, "Number of Points (5)"=1}, "Start "=w63, "Stop "=w64, "Number of Points (5)"=w57) -> (instance out=w66)
          call "Clear Buffer.gvi"(VISA resource name=$"VISA resource name in", error in (no error)=w65) -> (VISA resource name out=w67, error out=w68)
          call "Configure Measurement Range.gvi"(VISA resource name=w67, Function (0: Volts)="Volts"(0), Enable Auto Range (T:Enable)=TRUE, error in (no error)=w68) -> (VISA resource name out=w69, error out=w70)
          call "Configure Measurement Range.gvi"(Manual Range (1.0)=w56, VISA resource name=w69, Function (0: Volts)="Current"(1), Enable Auto Range (T:Enable)=FALSE, error in (no error)=w70) -> (VISA resource name out=w71, error out=w72)
          call "Configure Source Limit Level.gvi"(VISA resource name=w71, Function (0: Volts)="Volts"(0), Source Limit (1.0)=0.1, error in (no error)=w72) -> (VISA resource name out=w73, error out=w74)
          call "Configure Source Function.gvi"(VISA resource name=w73, Function (0: Volts)="Volts"(0), error in (no error)=w74) -> (VISA resource name out=w75, error out=w76)
          call "Configure Measurement Function.gvi"(VISA resource name=w75, Function (0: Volts)="Current"(1), error in (no error)=w76) -> (VISA resource name out=w77, error out=w78)
          call "Configure Integration Filter.gvi"(VISA resource name=w77, Function (0: Volts)="Current"(1), Measurement Speed (1 PLC)=w59, error in (no error)=w78) -> (VISA resource name out=w79, error out=w80)
          call "Configure Linear Mode Sweep.gvi"(VISA resource name=w79, Source Mode (0: Voltage)="Voltage"(0), Sweep Points=w66, Delay (0)=0, error in (no error)=w80, Fail Abort (T:ON)=FALSE) -> (VISA resource name out=w81, error out=w82)
          call "Enable Output.gvi"(VISA resource name=w81, Enable Output (T: Enable)=TRUE, error in (no error)=w82) -> (VISA resource name out=w83, error out=w84)
          call "Initiate.gvi"(VISA resource name=w83, error in (no error)=w84) -> (VISA resource name out=w85, error out=w86)
          call "Wait for Operation Complete.gvi"(VISA resource name=w85, Timeout (10000 ms)=60000, error in (no error)=w86) -> (VISA resource name out=w87, error out=w88)
          call "Read (Multiple Points).gvi"(VISA resource name=w87, Start Index (1)=1, End Index (1)=w57, error in (no error)=w88, Buffer Elements="SOUR, READ") -> (VISA resource name out=w89, Data out=w90, error out=w91)
          Spreadsheet String To Array(array type=f64[] [], delimiter=",", format string="%s", spreadsheet string=w90) -> (array=w92)
          Decimate Array(array=w92) -> (out0=w6, out1=w7)
          Property Node(instance in=w60) -> ("IV Data:Voltage Array (V)"=w93, "IV Data:Current Array (A)"=w94, instance out=w95)
          Build Array(w93, w7) -> w96
          Build Array(w94, w6) -> w97
          Property Node(instance in=w95, "IV Data:Voltage Array (V)"=w96, "IV Data:Current Array (A)"=w97) -> (instance out=w98)
          call "Enable Output.gvi"(VISA resource name=w89, Enable Output (T: Enable)=FALSE, error in (no error)=w91) -> (VISA resource name out=w99, error out=w100)
          call "Clear Buffer.gvi"(VISA resource name=w99, error in (no error)=w100) -> (VISA resource name out=w101, error out=w102)
          call "Write (Instr, String).gvi"(session in=w101, error in=w102, write buffer="*CLS;") -> (session out=w2, error out=w103)
          call "Voc_Rs Isc_Rsh Calculator.gvi"(Smart Sweep Mega Cluster In=w98, Voltage Array=w7, Current Array=w6, Error In=w103) -> (Smart Sweep Mega Cluster Out=w5, Error Out=w4)
        }
      }
      call "Voc_Rs Isc_Rsh Calculator.gvi"(Smart Sweep Mega Cluster In=w5, Voltage Array=w7, Current Array=w6, Error In=w4, Voc Jsc Operation Control=$"Voc Jsc Operation Control") -> (Smart Sweep Mega Cluster Out=w3, Error Out=w1)
    }
  }
  $"Smart Sweep Mega Cluster Out" <- w3
  $"Error Out" <- w1
  $"VISA resource name out" <- w2
