vi "Smart Sweep Subroutine.gvi"   [LabVIEW NXG 5.0.0]
inputs:
  "Smart Sweep Mega Cluster In": "Smart Sweep Mega Cluster.gtype"
  "VISA resource name in": "VISA Instr"
  "Error In": error
outputs:
  "Smart Sweep Mega Cluster Out": "Smart Sweep Mega Cluster.gtype"
  "VISA resource name out": "VISA Instr"
  "Error Out": error
types:
  T1 = cluster{"Isc Rsh Sweep Points": u32, "Voc Rs Sweep Points": u32, "VImpp Rough Sweep Points": u32, "VImpp Fine Sweep Points": u32, "Isc Rsh Sweep Direction": bool, "Voc Rs Sweep Direction": bool, "VImpp Rough Sweep Direction": bool, "VImpp Fine Sweep Direction": bool, "Isc Sweep Width (1=Voc)": f64, "Voc Sweep Height (1=Isc)": f64, "Vmpp Sweep Width Above (1=Voc)": f64, "Vmpp Sweep Width Below (1=Voc)": f64}
  T2 = cluster{"Isc (A)": f64, "Voc (V)": f64, "FF (%)": f64, "Rs (Ω)": f64, "Rsh (Ω)": f64, "Voltage Array (V)": f64[], "Current Array (A)": f64[]}
  T3 = cluster{"Rough Vmpp (V)": f64, "Rough Isc (A)": f64, "Rough Voc (V)": f64, "Rough Jmpp (V)": f64, "Averages Rough Isc (A)": u32, "Averages Rough Voc (V)": u32}
  "Smart Sweep Mega Cluster.gtype" = cluster{"Sweep Parameters": T1, "Measurement Speed (1 PLC)": f64, "High Speed": bool, "IV Data": T2, "Rough Readings": T3}
uses:
  Rainbow Measurement Setup::Side Functions::Instrument Control::Keithley::Smart Sweep::Rough Voc_Isc Measurement.gvi
  Rainbow Measurement Setup::Side Functions::Instrument Control::Keithley::Smart Sweep::Rs_Voc Rsh_Isc Accurate Sweep.gvi
  Rainbow Measurement Setup::Side Functions::Instrument Control::Keithley::Smart Sweep::Rough Fast Sweep VImpp.gvi
  Rainbow Measurement Setup::Side Functions::Instrument Control::Keithley::Smart Sweep::Accurate Sweep VImpp.gvi
  Labview_NXG_Keithley_SMU_2450_2460_2461::Utility::Reset.gvi
  Rainbow Measurement Setup::Side Functions::Instrument Control::Keithley::Smart Sweep::IV Array Formatter.gvi
diagram:
  # This subVI performs a Smart Sweep. It first measures soughly the Voc and the Jsc, it then measures the slope on around the Voc
  # and the Jsc. From the slope it extracts Rs and Rsh as well as a more accurate measurement of the Voc and Jsc.
  # Finally it performs a rough sweep to find Vmpp and Jmpp and afterwards it performs another finer sweep around that point to more
  # accurately determine Vmpp and Jmpp
  case ($"Error In") {
    frame Error, Default {
      w1 = $"VISA resource name in"
      w2 = $"Error In"
      w3 = $"Smart Sweep Mega Cluster In"
    }
    frame No Error {
      call "Rough Voc_Isc Measurement.gvi"(VISA resource name=$"VISA resource name in", Smart Sweep Mega Cluster In=$"Smart Sweep Mega Cluster In", Error In=$"Error In", Voc Isc Operation Control="Voc") -> (VISA resource name out=w4, Smart Sweep Mega Cluster Out=w5, Error Out=w6)
      call "Rough Voc_Isc Measurement.gvi"(VISA resource name=w4, Smart Sweep Mega Cluster In=w5, Error In=w6, Voc Isc Operation Control="Isc") -> (VISA resource name out=w7, Smart Sweep Mega Cluster Out=w8, Error Out=w9)
      call "Rs_Voc Rsh_Isc Accurate Sweep.gvi"(VISA resource name in=w7, Smart Sweep Mega Cluster In=w8, Error In=w9, Voc Jsc Operation Control="Voc") -> (VISA resource name out=w10, Smart Sweep Mega Cluster Out=w11, Error Out=w12)
      call "Rs_Voc Rsh_Isc Accurate Sweep.gvi"(VISA resource name in=w10, Smart Sweep Mega Cluster In=w11, Error In=w12, Voc Jsc Operation Control="Isc") -> (VISA resource name out=w13, Smart Sweep Mega Cluster Out=w14, Error Out=w15)
      call "Rough Fast Sweep VImpp.gvi"(VISA resource name in=w13, Smart Sweep Mega Cluster In=w14, Error In=w15) -> (VISA resource name out=w16, Smart Sweep Mega Cluster Out=w17, Error Out=w18)
      call "Accurate Sweep VImpp.gvi"(VISA resource name in=w16, Smart Sweep Mega Cluster In=w17, Error In=w18) -> (VISA resource name out=w19, Smart Sweep Mega Cluster Out=w20, Error Out=w21)
      call "Reset.gvi"(VISA resource name=w19, error in (no error)=w21) -> (VISA resource name out=w1, error out=w22)
      call "IV Array Formatter.gvi"(Smart Sweep Mega Cluster In=w20, Error In=w22) -> (Smart Sweep Mega Cluster Out=w3, Error Out=w2)
    }
  }
  $"Smart Sweep Mega Cluster Out" <- w3
  $"Error Out" <- w2
  $"VISA resource name out" <- w1
