vi "Smart Sweep Test.gvi"   [LabVIEW NXG 5.0.0]
inputs:
  "Error In": error
outputs:
  "Error Out": error
panel controls:
  "VISA resource name": "VISA Instr"
  "Smart Sweep Mega Cluster In": "Smart Sweep Mega Cluster.gtype" = {"Rough Readings"={"Rough Vmpp (V)"=0, "Rough Isc (A)"=0, "Rough Voc (V)"=0, "Rough Jmpp (V)"=0, "Averages Rough Isc (A)"=5, "Averages Rough Voc (V)"=5}, "IV Data"={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}, "Sweep Parameters"={"Isc Rsh Sweep Points"=10, "Voc Rs Sweep Points"=10, "VImpp Rough Sweep Points"=10, "VImpp Fine Sweep Points"=10, "Isc Rsh Sweep Direction"=FALSE, "Voc Rs Sweep Direction"=FALSE, "VImpp Rough Sweep Direction"=FALSE, "VImpp Fine Sweep Direction"=FALSE, "Isc Sweep Width (1=Voc)"=0.1, "Voc Sweep Height (1=Isc)"=0.1, "Vmpp Sweep Width Above (1=Voc)"=0.05, "Vmpp Sweep Width Below (1=Voc)"=0.1}, "Measurement Speed (1 PLC)"=1}
  "High Speed": bool
panel indicators:
  "Smart Sweep Mega Cluster Out": "Smart Sweep Mega Cluster.gtype"
  "Graph": cluster{"Element 1": f64[], "Element 2": f64[]}
  "Sweep Time (ms)": u32
types:
  T1 = cluster{"Rough Vmpp (V)": f64, "Rough Isc (A)": f64, "Rough Voc (V)": f64, "Rough Jmpp (V)": f64, "Averages Rough Isc (A)": u32, "Averages Rough Voc (V)": u32}
  T2 = cluster{"Isc (A)": f64, "Voc (V)": f64, "FF (%)": f64, "Rs (Ω)": f64, "Rsh (Ω)": f64, "Voltage Array (V)": f64[], "Current Array (A)": f64[]}
  T3 = cluster{"Isc Rsh Sweep Points": u32, "Voc Rs Sweep Points": u32, "VImpp Rough Sweep Points": u32, "VImpp Fine Sweep Points": u32, "Isc Rsh Sweep Direction": bool, "Voc Rs Sweep Direction": bool, "VImpp Rough Sweep Direction": bool, "VImpp Fine Sweep Direction": bool, "Isc Sweep Width (1=Voc)": f64, "Voc Sweep Height (1=Isc)": f64, "Vmpp Sweep Width Above (1=Voc)": f64, "Vmpp Sweep Width Below (1=Voc)": f64}
  "Smart Sweep Mega Cluster.gtype" = cluster{"Rough Readings": T1, "IV Data": T2, "Sweep Parameters": T3, "Measurement Speed (1 PLC)": f64}
uses:
  Labview_NXG_Keithley_SMU_2450_2460_2461::Miscelaneous::Initialize.gvi
  Labview_NXG_Keithley_SMU_2450_2460_2461::Configure::Turn off Delays and Autozero (High Speed).gvi
  Labview_NXG_Keithley_SMU_2450_2460_2461::Configure::Configure Autozero Once.gvi
  Rainbow Measurement Setup::Side Functions::Instrument Control::Keithley::Smart Sweep::Full Smart Sweep.gvi
  Labview_NXG_Keithley_SMU_2450_2460_2461::Miscelaneous::Close.gvi
diagram:
  case ($"Error In") {
    frame Error, Default {
      w1 = $"Error In"
      w2 = default
    }
    frame No Error {
      call "Initialize.gvi"(VISA resource name=$"VISA resource name", error in (no error)=$"Error In") -> (VISA resource name out=w3, error out=w4)
      case ($"High Speed") {
        frame False, Default {
          w5 = w4
          w6 = w3
        }
        frame True {
          call "Turn off Delays and Autozero (High Speed).gvi"(Visa Resource Name In=w3, Error In=w4) -> (VISA Resource Name Out=w7, Error Out=w8)
          call "Configure Autozero Once.gvi"(VISA resource name=w7, error in (no error)=w8) -> (VISA resource name out=w6, error out=w5)
        }
      }
      case (TRUE) {
        frame False, Default {
          w9 = w5
          w10 = default
        }
        frame True {
          Tick Count() -> (timer value=w10)
          w9 = w5
        }
      }
      call "Full Smart Sweep.gvi"(VISA resource name in=w6, Smart Sweep Mega Cluster In=$"Smart Sweep Mega Cluster In", Error In=w9) -> (VISA resource name Out=w11, Smart Sweep Mega Cluster Out=w2, Error Out=w12)
      case (TRUE) {
        frame False, Default {
          w13 = w12
          w14 = default
        }
        frame True {
          Tick Count() -> (timer value=w14)
          w13 = w12
        }
      }
      call "Close.gvi"(VISA resource name=w11, error in (no error)=w13) -> (error out=w1)
      Subtract(x=w14, y=w10) -> w15
      $"Sweep Time (ms)" <- w15
    }
  }
  Property Node(instance in=w2) -> ("IV Data:Voltage Array (V)"=w16, "IV Data:Current Array (A)"=w17, instance out=w18)
  $"Smart Sweep Mega Cluster Out" <- w18
  Build Cluster(w16, w17) -> w19
  $Graph <- w19
  $"Error Out" <- w1
