vi "Voc_Rs Isc_Rsh Calculator.gvi"   [LabVIEW NXG 5.0.0]
inputs:
  "Error In": error
  "Voc Jsc Operation Control": "Voc Jsc Operation Control.gtype" = "Voc"
  "Smart Sweep Mega Cluster In": "Smart Sweep Mega Cluster.gtype"
  "Voltage Array": f64[]
  "Current Array": f64[]
outputs:
  "Error Out": error
  "Smart Sweep Mega Cluster Out": "Smart Sweep Mega Cluster.gtype"
panel indicators:
  "Voc": f64
types:
  T1 = cluster{"Rough Vmpp (V)": f64, "Rough Isc (A)": f64, "Rough Voc (V)": f64, "Rough Jmpp (V)": f64, "Averages Rough Isc (A)": u32, "Averages Rough Voc (V)": u32}
  T2 = cluster{"Isc (A)": f64, "Voc (V)": f64, "FF (%)": f64, "Rs (Ω)": f64, "Rsh (Ω)": f64, "Voltage Array (V)": f64[], "Current Array (A)": f64[]}
  T3 = cluster{"Isc Rsh Sweep Points": u32, "Voc Rs Sweep Points": u32, "VImpp Rough Sweep Points": u32, "VImpp Fine Sweep Points": u32, "Isc Rsh Sweep Direction": bool, "Voc Rs Sweep Direction": bool, "VImpp Rough Sweep Direction": bool, "VImpp Fine Sweep Direction": bool, "Isc Sweep Width (1=Voc)": f64, "Voc Sweep Height (1=Isc)": f64, "Vmpp Sweep Width Above (1=Voc)": f64, "Vmpp Sweep Width Below (1=Voc)": f64}
  "Smart Sweep Mega Cluster.gtype" = cluster{"Rough Readings": T1, "IV Data": T2, "Sweep Parameters": T3, "Measurement Speed (1 PLC)": f64}
  "Voc Jsc Operation Control.gtype" = enum{"Voc", "Isc"}
uses:
  NI::Analysis::Fitting::Linear Fit.gvi
diagram:
  # This SubVI calculates Rs Voc or Rsh Isc for a given array of points.
  # It is ment to be used in combination with Rs_Voc Rsh_ISC Accurate Sweep.
  case ($"Error In") {
    frame Error, Default {
      w1 = $"Error In"
      w2 = $"Smart Sweep Mega Cluster In"
    }
    frame No Error {
      case ($"Voc Jsc Operation Control") {
        frame "Voc" {
          call "Linear Fit.gvi"(method="Least Square"(0), y=$"Current Array", x=$"Voltage Array", error in=$"Error In") -> (slope=w3, intercept=w4, error out=w1)
          Negate(x=w3) -> w5
          Divide(x=w4, y=w5) -> w6
          $Voc <- w6
          Reciprocal(x=w3) -> w7
          In Range And Coerce(lower limit=-0.001, upper limit=1000000, x=w7) -> (coerced(x)=w8)
          Property Node(instance in=$"Smart Sweep Mega Cluster In", "IV Data:Voc (V)"=w6, "IV Data:Rs (Ω)"=w8) -> (instance out=w2)
        }
        frame Default {
          w2 = $"Smart Sweep Mega Cluster In"
          w1 = $"Error In"
        }
        frame "Isc" {
          call "Linear Fit.gvi"(method="Least Square"(0), y=$"Current Array", x=$"Voltage Array", error in=$"Error In") -> (slope=w9, intercept=w10, error out=w1)
          Reciprocal(x=w9) -> w11
          In Range And Coerce(lower limit=-0.001, upper limit=1000000, x=w11) -> (coerced(x)=w12)
          Property Node(instance in=$"Smart Sweep Mega Cluster In", "IV Data:Isc (A)"=w10, "IV Data:Rsh (Ω)"=w12) -> (instance out=w2)
        }
      }
    }
  }
  $"Smart Sweep Mega Cluster Out" <- w2
  $"Error Out" <- w1
