vi "Sweep Type Comparison.gvi"   [LabVIEW NXG 5.0.0]
inputs:
  "Error In": error
outputs:
  "Error Out": error
panel controls:
  "VISA resource name": "VISA Instr"
  "Smart Sweep Mega Cluster In": "Smart Sweep Mega Cluster.gtype" = {"Sweep Parameters"={"Isc Rsh Sweep Points"=10, "Voc Rs Sweep Points"=10, "VImpp Rough Sweep Points"=20, "VImpp Fine Sweep Points"=20, "Isc Rsh Sweep Direction"=FALSE, "Voc Rs Sweep Direction"=FALSE, "VImpp Rough Sweep Direction"=FALSE, "VImpp Fine Sweep Direction"=FALSE, "Isc Sweep Width (1=Voc)"=0.1, "Voc Sweep Height (1=Isc)"=0.1, "Vmpp Sweep Width Above (1=Voc)"=0.15, "Vmpp Sweep Width Below (1=Voc)"=0.2}, "Measurement Speed (1 PLC)"=1, "High Speed"=FALSE, "IV Data"={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}, "Rough Readings"={"Rough Vmpp (V)"=0, "Rough Isc (A)"=0, "Rough Voc (V)"=0, "Rough Jmpp (V)"=0, "Averages Rough Isc (A)"=5, "Averages Rough Voc (V)"=5}}
  "Fast Sweep Parameters In": "Fast Sweep Parameters.gtype" = {"Parameters"={"Sweep Direction"=FALSE, "Min Voltage (V)"=-0.2, "Max Voltage (V)"=1, "Measurement Speed (1 PLC)"=1, "Sweep Points"=50}, "Data"={"Current Array (A)"=[], "Voltage Array (V)"=[], "Isc (A)"=0}}
  "SRM Specific Parameters": "SRM Specific Parameters.gtype" = {"Max (V)"=1, "Min (V)"=-0.2, "V Points"=100, "Current Range (A)"=0.1, "Autorange"=TRUE, "Sweep Dir"=FALSE, "Current Averages"=3, "Max (A)"=1, "PLC Speed"=1, "Cell Area (m^2)"=8e-06, "Full Spctr Ref"=TRUE, "Sweep Speed"="Normal Sweep"}
panel indicators:
  "Smart Sweep Mega Cluster Out": "Smart Sweep Mega Cluster.gtype"
  "Graph": cluster{"Element 1": f64[], "Element 2": f64[]}[]
  "Slow Smart Sweep Time (s)": u32
  "Fast Smart Sweep Time (s)": u32
  "Fast Fast Sweep": u32
  "Slow Fast Sweep Time (ms)": u32
  "Normal Sweep Time": u32
types:
  T1 = cluster{"Isc Rsh Sweep Points": u32, "Voc Rs Sweep Points": u32, "VImpp Rough Sweep Points": u32, "VImpp Fine Sweep Points": u32, "Isc Rsh Sweep Direction": bool, "Voc Rs Sweep Direction": bool, "VImpp Rough Sweep Direction": bool, "VImpp Fine Sweep Direction": bool, "Isc Sweep Width (1=Voc)": f64, "Voc Sweep Height (1=Isc)": f64, "Vmpp Sweep Width Above (1=Voc)": f64, "Vmpp Sweep Width Below (1=Voc)": f64}
  T2 = cluster{"Isc (A)": f64, "Voc (V)": f64, "FF (%)": f64, "Rs (Ω)": f64, "Rsh (Ω)": f64, "Voltage Array (V)": f64[], "Current Array (A)": f64[]}
  T3 = cluster{"Rough Vmpp (V)": f64, "Rough Isc (A)": f64, "Rough Voc (V)": f64, "Rough Jmpp (V)": f64, "Averages Rough Isc (A)": u32, "Averages Rough Voc (V)": u32}
  "Smart Sweep Mega Cluster.gtype" = cluster{"Sweep Parameters": T1, "Measurement Speed (1 PLC)": f64, "High Speed": bool, "IV Data": T2, "Rough Readings": T3}
  T4 = cluster{"Sweep Direction": bool, "Min Voltage (V)": f64, "Max Voltage (V)": f64, "Measurement Speed (1 PLC)": f64, "Sweep Points": u32}
  T5 = cluster{"Current Array (A)": f64[], "Voltage Array (V)": f64[], "Isc (A)": f64}
  "Fast Sweep Parameters.gtype" = cluster{"Parameters": T4, "Data": T5}
  "Sweep Speed Selector.gtype" = enum{"Smart Sweep", "Fast Sweep", "Normal Sweep"}
  "SRM Specific Parameters.gtype" = cluster{"Max (V)": f64, "Min (V)": f64, "V Points": u32, "Current Range (A)": f64, "Autorange": bool, "Sweep Dir": bool, "Current Averages": u32, "Max (A)": f64, "PLC Speed": f64, "Cell Area (m^2)": f64, "Full Spctr Ref": bool, "Sweep Speed": "Sweep Speed Selector.gtype"}
uses:
  Labview_NXG_Keithley_SMU_2450_2460_2461::Miscelaneous::Initialize.gvi
  Rainbow Measurement Setup::Side Functions::Instrument Control::Keithley::Keithley Normal Sweep.gvi
  Rainbow Measurement Setup::Side Functions::Instrument Control::Keithley::Fast Sweep::Full Fast Smart Sweep.gvi
  Rainbow Measurement Setup::Side Functions::Instrument Control::Keithley::Smart Sweep::Full Smart Sweep.gvi
  Labview_NXG_Keithley_SMU_2450_2460_2461::Miscelaneous::Close.gvi
diagram:
  case ($"Error In") {
    frame Error, Default {
      w1 = $"Error In"
      w2 = default
      w3 = default
      w4 = default
      w5 = default
      w6 = default
    }
    frame No Error {
      call "Initialize.gvi"(VISA resource name=$"VISA resource name", error in (no error)=$"Error In") -> (VISA resource name out=w7, error out=w8)
      call "Keithley Normal Sweep.gvi"(VISA resource name=w7, SRM Specific Parameters=$"SRM Specific Parameters", Error In=w8) -> (Visa Resource Name Out=w9, IV Measurement Out=w6, Elapsed Time=w10, Error Out=w11)
      call "Full Fast Smart Sweep.gvi"(VISA resource name in=w9, Fast Sweep Parameters In=$"Fast Sweep Parameters In", Error In=w11, High Speed?=FALSE) -> (VISA resource name Out=w12, Fast Sweep Parameters Out=w4, Time Elapsed (ms)=w13, Error Out=w14)
      call "Full Smart Sweep.gvi"(VISA resource name in=w12, Smart Sweep Mega Cluster In=$"Smart Sweep Mega Cluster In", Error In=w14, High Speed=FALSE) -> (VISA resource name Out=w15, Smart Sweep Mega Cluster Out=w3, Elapsed Time (ms)=w16, Error Out=w17)
      call "Full Fast Smart Sweep.gvi"(VISA resource name in=w15, Fast Sweep Parameters In=$"Fast Sweep Parameters In", Error In=w17, High Speed?=TRUE) -> (VISA resource name Out=w18, Fast Sweep Parameters Out=w5, Time Elapsed (ms)=w19, Error Out=w20)
      Property Node(instance in=w3, "IV Data"=T2 {all zero or empty}) -> (instance out=w21)
      call "Full Smart Sweep.gvi"(VISA resource name in=w18, Smart Sweep Mega Cluster In=w21, Error In=w20, High Speed=TRUE) -> (VISA resource name Out=w22, Smart Sweep Mega Cluster Out=w2, Elapsed Time (ms)=w23, Error Out=w24)
      call "Close.gvi"(VISA resource name=w22, error in (no error)=w24) -> (error out=w1)
      $"Fast Smart Sweep Time (s)" <- w23
      $"Fast Fast Sweep" <- w19
      $"Slow Smart Sweep Time (s)" <- w16
      $"Slow Fast Sweep Time (ms)" <- w13
      $"Normal Sweep Time" <- w10
    }
  }
  Property Node(instance in=w2) -> ("IV Data:Voltage Array (V)"=w25, "IV Data:Current Array (A)"=w26, instance out=w27)
  $"Smart Sweep Mega Cluster Out" <- w27
  $"Error Out" <- w1
  Build Cluster(w25, w26) -> w28
  Property Node(instance in=w3) -> ("IV Data:Voltage Array (V)"=w29, "IV Data:Current Array (A)"=w30)
  Build Cluster(w29, w30) -> w31
  Property Node(instance in=w4) -> ("Data:Voltage Array (V)"=w32, "Data:Current Array (A)"=w33)
  Build Cluster(w32, w33) -> w34
  Property Node(instance in=w5) -> ("Data:Voltage Array (V)"=w35, "Data:Current Array (A)"=w36)
  Build Cluster(w35, w36) -> w37
  Property Node(instance in=w6) -> ("Voltage (V)"=w38, "Current (A)"=w39)
  Build Cluster(w38, w39) -> w40
  Build Array(w28, w31, w34, w37, w40) -> w41
  $Graph <- w41
