vi "Voltage Direction Calculator.gvi"   [LabVIEW NXG 5.0.0]
inputs:
  "Error In": error
  "Max Voltage (V)": f64
  "Min Voltage (V)": f64
  "Sweep Direction": bool
outputs:
  "Error Out": error
  "Start": f64
  "End": f64
diagram:
  # This subVI Automatically selects the Start
  # and the end voltage based on the sweep
  # direction control state.
  case ($"Error In") {
    frame Error, Default {
      w1 = $"Error In"
      w2 = $"Max Voltage (V)"
      w3 = $"Min Voltage (V)"
    }
    frame No Error {
      case ($"Sweep Direction") {
        frame False, Default {
          Is Greater(x=$"Max Voltage (V)", y=$"Min Voltage (V)") -> w4
          case (w4) {
            frame False, Default {
              w2 = $"Max Voltage (V)"
              w3 = $"Min Voltage (V)"
            }
            frame True {
              w2 = $"Min Voltage (V)"
              w3 = $"Max Voltage (V)"
            }
          }
        }
        frame True {
          Is Greater(x=$"Max Voltage (V)", y=$"Min Voltage (V)") -> w5
          case (w5) {
            frame False, Default {
              w2 = $"Min Voltage (V)"
              w3 = $"Max Voltage (V)"
            }
            frame True {
              w2 = $"Max Voltage (V)"
              w3 = $"Min Voltage (V)"
            }
          }
        }
      }
      w1 = $"Error In"
    }
  }
  $"Error Out" <- w1
  $Start <- w2
  $End <- w3
