vi "Photodetector Detection Subroutine.gvi"   [LabVIEW NXG 5.0.0]
inputs:
  "Error In": error
outputs:
  "Error Out": error
  "Detected?": bool
  "Photodetector Names": string[]
uses:
  LabView_NXG_Thorlabs_PM100::Miscelanous::TLPM Find Resources.gvi
  NI::G Core::Error::Clear Error Cluster.gvi
  LabView_NXG_Thorlabs_PM100::Get Parameters::TLPM Get Resource Name.gvi
  LabView_NXG_Thorlabs_PM100::Miscelanous::TLPM Close.gvi
diagram:
  # This is the photodetector detection subroutine. It scans all the available photodetectors and prompts the user in case none is found.
  case ($"Error In") {
    frame Error, Default {
      w1 = $"Error In"
    }
    frame No Error {
      while (iteration -> i1) {
        call "TLPM Find Resources.gvi"(IVI session in="", error in (no error)=$"Error In") -> (IVI session out=w2, Resource Count=w3, error out=w4)
        Is Greater Or Equal(x=w3, y=1) -> w5
        case (w5) {
          frame False, Default {
            while {
              Wait Until Next Multiple(multiple to wait=500)
              w10 = "Photodetector not detected\nPlease make sure you have \nit connected properly.\nOtherwise the software cannot\nproceed."
              One Button Dialog(button name ("OK")="Okay i will reconnect it", message=w10) -> (true=w11)
              stop if w11
            }
            call "Clear Error Cluster.gvi"(error in=w4) -> (error out=w7)
            w6 = default
            w8 = FALSE
            w9 = default
          }
          frame True {
            for (N = w3) (iteration -> i2) {
              call "TLPM Get Resource Name.gvi"(IVI session in=w2, Index (0)=i2, error in (no error)=w4) -> (IVI session out=w12, error out=w13, Resource Name=w14)
              call "TLPM Close.gvi"(IVI session in=w12, error in (no error)=w13) -> (error out=w7)
              append w14 to w6
            }
            w8 = TRUE
            w9 = TRUE
          }
        }
        $"Photodetector Names" <- w6
        Is Greater(x=i1, y=5) -> w15
        case (w15) {
          frame False, Default {
            w16 = FALSE
            w1 = w7
          }
          frame True {
            w17 = """Seems you're having some trouble
connecting the photodetector, do you 
want to proceed without connecting it
and hope for the best?
(WARNING: some functionalities might
be compromized)"""
            Two Button Dialog(F button name ("Cancel")="Oh dear no, I'd rather ask for help", T button name ("OK")="Yes please, I like to live dangerously", message=w17) -> (T Button?=w16)
            w1 = w7
          }
        }
        Logical Or(w8, w16) -> w18
        stop if w18
      }
      $"Detected?" <- w9
    }
  }
  $"Error Out" <- w1
