vi "Photodetector Detection Subroutine.gvi"   [LabVIEW NXG 5.0.0]
inputs:
  "Error In": error
outputs:
  "Error Out": error
  "Detected?": bool
  "Photodetector Names": string[]
uses:
  Rainbow Measurement Setup::Side Functions::Global Abort::FGV Global Abort.gvi
  LabView_NXG_Thorlabs_PM100::Miscelanous::TLPM Find Resources.gvi
  NI::G Core::Error::Clear Error Cluster.gvi
  LabView_NXG_Thorlabs_PM100::Get Parameters::TLPM Get Resource Name.gvi
  LabView_NXG_Thorlabs_PM100::Miscelanous::TLPM Initialize.gvi
  LabView_NXG_Thorlabs_PM100::Miscelanous::TLPM Close.gvi
diagram:
  # This is the photodetector detection subroutine. It scans all the available photodetectors and prompts the user in case none is found.
  case ($"Error In") {
    frame Error, Default {
      w1 = $"Error In"
      w2 = default
      w3 = default
    }
    frame No Error {
      while (iteration -> i1) {
        call "FGV Global Abort.gvi"(Global Abort Instructions="Read Current State", Error In=$"Error In") -> (Global Abort Out=w4, Error Out=w5)
        call "TLPM Find Resources.gvi"(IVI session in="", error in (no error)=w5) -> (IVI session out=w6, Resource Count=w7, error out=w8)
        Is Greater Or Equal(x=w7, y=1) -> w9
        case (w9) {
          frame False, Default {
            while {
              Wait Until Next Multiple(multiple to wait=500)
              w12 = "Photodetector not detected\nPlease make sure you have \nit connected properly.\nOtherwise the software cannot\nproceed."
              One Button Dialog(button name ("OK")="Okay i will reconnect it", message=w12) -> (true=w13)
              stop if w13
            }
            call "Clear Error Cluster.gvi"(error in=w8) -> (error out=w10)
            w3 = default
            w11 = FALSE
            w2 = default
          }
          frame True {
            for (N = w7) (iteration -> i2) {
              call "TLPM Get Resource Name.gvi"(IVI session in=w6, Index (0)=i2, error in (no error)=w8) -> (IVI session out=w14, error out=w15, Resource Name=w16)
              call "TLPM Initialize.gvi"(IVI session in=w14, resource name=w16, error in (no error)=w15) -> (IVI session out=w17, error out=w18)
              call "TLPM Close.gvi"(IVI session in=w17, error in (no error)=w18) -> (error out=w10)
              append w16 to w3
            }
            w11 = TRUE
            w2 = TRUE
          }
        }
        Is Greater(x=i1, y=5) -> w19
        case (w19) {
          frame False, Default {
            w20 = FALSE
            w1 = w10
          }
          frame True {
            w21 = """Seems you're having some trouble
connecting the photodetector, do you 
want to proceed without connecting it
and hope for the best?
(WARNING: some functionalities might
be compromized)"""
            Two Button Dialog(F button name ("Cancel")="Oh dear no, I'd rather ask for help", T button name ("OK")="Yes please, I like to live dangerously", message=w21) -> (T Button?=w20)
            w1 = w10
          }
        }
        Logical Or(w11, w20, w4) -> w22
        stop if w22
      }
    }
  }
  $"Error Out" <- w1
  $"Photodetector Names" <- w3
  $"Detected?" <- w2
