vi "Photodetector Guarantee Measurement.gvi"   [LabVIEW NXG 5.0.0]
inputs:
  "Error In": error
  "Instrument Control Mega Cluster In": "Instrument Control Mega Cluster.gtype"
  "Timeout (s)": f64
  "Stabilization time (ms)": u32
outputs:
  "Error Out": error
  "Instrument Control Mega Cluster Out": "Instrument Control Mega Cluster.gtype"
  "Measured Power": f64
types:
  "Instrument Coms Info.gtype" = cluster{"Arduino Coms Info": "Arduino Detection cluster control.gtype", "Photodetector Names": string[], "Keythley Address": "VISA Instr", "Photodetector Detected?": bool, "Thorlabs Motors Detected?": bool, "Keithley Detected?": bool, "Thorlabs Motors Serial Number": "Thorlabs Motors Serial Number In.gtype", "Photodetector IVI session": "Ivi IviDefault", "Flame ID": string, "Flame Detected?": bool, "Flame Wrapper ID": u64}
  "Debugging Cluster.gtype" = cluster{"Debugging mode?": bool, "Initialize App": bool, "Insturment Debugging": "Insturment Debugging Cluster.gtype"}
  "Instrument Control Mega Cluster.gtype" = cluster{"Instruments Coms Info": "Instrument Coms Info.gtype", "Debugging Cluster": "Debugging Cluster.gtype"}
uses:
  NI::G Core::Numeric::Random Number (Range) DBL.gvi
  Rainbow Measurement Setup::Side Functions::Utilities::Time Related Operations::Wait ms.gvi
  Rainbow Measurement Setup::Side Functions::Instrument Control::Photodetector::Photodetector Measure Power.gvi
  Rainbow Measurement Setup::Side Functions::Utilities::Progress Handling::Progress General Calculator.gvi
diagram:
  # This SubVI Makes as many photodetector measurements as needed
  # until it exceeds the timeout or the output becomes a real number.
  case ($"Error In") {
    frame Error, Default {
      w1 = $"Error In"
      w2 = $"Instrument Control Mega Cluster In"
      w3 = default
    }
    frame No Error {
      Property Node(instance in=$"Instrument Control Mega Cluster In") -> ("Debugging Cluster:Debugging mode?"=w4, "Debugging Cluster:Insturment Debugging:Photodetector"=w5, instance out=w6)
      Logical And[output inverted](w4, not w5) -> w7
      case (w7) {
        frame False, Default {
          call "Random Number (Range) DBL.gvi"(upper bound=100, lower bound=0) -> (number=w3)
          w1 = $"Error In"
          w2 = w6
        }
        frame True {
          call "Wait ms.gvi"(Error In=$"Error In", Milliseconds to Wait=$"Stabilization time (ms)") -> (Error Out=w8)
          s1 = w6  # shift register
          s2 = w8  # shift register
          while (iteration -> i1) {
            call "Photodetector Measure Power.gvi"(Instrument Control Mega Cluster In=s1, Error In=s2) -> (Instrument Control Mega Cluster Out=w9, Measured Power=w3, Error Out=w10)
            Multiply($"Timeout (s)", 10) -> w11
            call "Progress General Calculator.gvi"(Starting Value=40, Ending Value=60, Number Of Steps=w11, Current Step=i1, Error In=w10) -> (Error Out=w12)
            To Double Precision Float(number=i1) -> w13
            Is Greater(x=w13, y=w11) -> w14
            Is Not A Number Or Path Or Refnum(number=w3) -> w15
            Not(x=w15) -> w16
            Logical Or(w14, w16, w12) -> w17
            Wait Until Next Multiple(multiple to wait=100)
            next s1 = w9
            next s2 = w12
            stop if w17
          }
          w1 = s2
          w2 = s1
        }
      }
    }
  }
  $"Instrument Control Mega Cluster Out" <- w2
  $"Measured Power" <- w3
  $"Error Out" <- w1
