vi "Photodetector Initialize.gvi"   [LabVIEW NXG 5.0.0]
inputs:
  "Instrument Coms Info In": "Instrument Coms Info.gtype"
  "Error In": error
  "Debugging Cluster In": "Debugging Cluster.gtype"
outputs:
  "Instrument Coms Info Out": "Instrument Coms Info.gtype"
  "Error Out": error
  "Debugging Cluster Out": "Debugging Cluster.gtype"
types:
  T1 = cluster{"Element 1": "VISA Instr", "Element 2": string}
  "Arduino Detection cluster control.gtype" = cluster{"XZ Stage Arduino Address": "VISA Instr", "XZ Stage Arduino Detected?": bool, "Multiplexer Arduino Detected?": bool, "Multiplexer Arduino Address": "VISA Instr", "Arduinos List": T1[], "XZ Stage Log": string, "Multiplexer Log": string}
  "Thorlabs Motors Serial Number In.gtype" = cluster{"Thorlabs Blue Motor": string, "Thorlabs Red Motor": string, "Blue Motor Homed?": bool, "Red Motor Homed?": bool}
  "Instrument Coms Info.gtype" = cluster{"Arduino Coms Info": "Arduino Detection cluster control.gtype", "Photodetector Names": string[], "Keythley Address": "VISA Instr", "Photodetector Detected?": bool, "Thorlabs Motors Detected?": bool, "Keithley Detected?": bool, "Thorlabs Motors Serial Number": "Thorlabs Motors Serial Number In.gtype", "Photodetector IVI session": "Ivi IviDefault"}
  "Insturment Debugging Cluster.gtype" = cluster{"Keithley": bool, "Arduinos": bool, "Thorlabs Motors": bool, "Photodetector": bool}
  "Debugging Cluster.gtype" = cluster{"Debugging mode?": bool, "Initialize App": bool, "Insturment Debugging": "Insturment Debugging Cluster.gtype"}
uses:
  LabView_NXG_Thorlabs_PM100::Examples::Photodetector initialization Sequence with prompt.gvi
diagram:
  # This SubVI detects the photodetector and appends it to the Instrument Coms Cluster in case
  # the debugging allows it to do so.
  case ($"Error In") {
    frame Error, Default {
      w1 = $"Error In"
      w2 = $"Instrument Coms Info In"
      w3 = $"Debugging Cluster In"
    }
    frame No Error {
      Property Node(instance in=$"Debugging Cluster In") -> ("Debugging mode?"=w4, "Insturment Debugging:Photodetector"=w5, instance out=w3)
      Logical And[output inverted](w4, not w5) -> w6
      case (w6) {
        frame False, Default {
          w1 = $"Error In"
          w2 = $"Instrument Coms Info In"
        }
        frame True {
          call "Photodetector initialization Sequence with prompt.gvi"(Error In=$"Error In") -> (Photodetector IVI session=w7, Error Out=w1)
          Property Node(instance in=$"Instrument Coms Info In", "Photodetector IVI session"=w7) -> (instance out=w2)
        }
      }
    }
  }
  $"Error Out" <- w1
  $"Instrument Coms Info Out" <- w2
  $"Debugging Cluster Out" <- w3
