vi "Photodetector Measure Power.gvi"   [LabVIEW NXG 5.0.0]
inputs:
  "Error In": error
  "Instrument Coms Info In": "Instrument Coms Info.gtype"
  "Debugging Cluster In": "Debugging Cluster.gtype"
outputs:
  "Error Out": error
  "Debugging Cluster Out": "Debugging Cluster.gtype"
  "Instrument Coms Info Out": "Instrument Coms Info.gtype"
  "Measured Power": f64
types:
  T1 = cluster{"Element 1": "VISA Instr", "Element 2": string}
  "Arduino Detection cluster control.gtype" = cluster{"XZ Stage Arduino Address": "VISA Instr", "XZ Stage Arduino Detected?": bool, "Multiplexer Arduino Detected?": bool, "Multiplexer Arduino Address": "VISA Instr", "Arduinos List": T1[], "XZ Stage Log": string, "Multiplexer Log": string}
  "Thorlabs Motors Serial Number In.gtype" = cluster{"Thorlabs Blue Motor": string, "Thorlabs Red Motor": string, "Blue Motor Homed?": bool, "Red Motor Homed?": bool}
  "Instrument Coms Info.gtype" = cluster{"Arduino Coms Info": "Arduino Detection cluster control.gtype", "Photodetector Names": string[], "Keythley Address": "VISA Instr", "Photodetector Detected?": bool, "Thorlabs Motors Detected?": bool, "Keithley Detected?": bool, "Thorlabs Motors Serial Number": "Thorlabs Motors Serial Number In.gtype", "Photodetector IVI session": "Ivi IviDefault", "Flame ID": string, "Flame Detected?": bool, "Flame Wrapper ID": u64}
  "Insturment Debugging Cluster.gtype" = cluster{"Keithley": bool, "Arduinos": bool, "Thorlabs Motors": bool, "Photodetector": bool, "Flame Spectr": bool}
  "Debugging Cluster.gtype" = cluster{"Debugging mode?": bool, "Initialize App": bool, "Insturment Debugging": "Insturment Debugging Cluster.gtype"}
uses:
  NI::G Core::Numeric::Random Number (Range) DBL.gvi
  LabView_NXG_Thorlabs_PM100::Measure::TLPM Measure Power.gvi
diagram:
  case ($"Error In") {
    frame Error, Default {
      w1 = $"Error In"
      w2 = $"Debugging Cluster In"
      w3 = $"Instrument Coms Info In"
      w4 = -2
    }
    frame No Error {
      Property Node(instance in=$"Debugging Cluster In") -> ("Debugging mode?"=w5, "Insturment Debugging:Photodetector"=w6, instance out=w2)
      Logical And[output inverted](w5, not w6) -> w7
      case (w7) {
        frame False, Default {
          call "Random Number (Range) DBL.gvi"(upper bound=100, lower bound=0) -> (number=w4)
          w3 = $"Instrument Coms Info In"
          w1 = $"Error In"
        }
        frame True {
          Property Node(instance in=$"Instrument Coms Info In") -> ("Photodetector IVI session"=w8, instance out=w3)
          call "TLPM Measure Power.gvi"(IVI session in=w8, error in (no error)=$"Error In") -> (Power=w4, error out=w1)
        }
      }
    }
  }
  $"Instrument Coms Info Out" <- w3
  $"Measured Power" <- w4
  $"Debugging Cluster Out" <- w2
  $"Error Out" <- w1
