vi "Photodetector Set Averages.gvi"   [LabVIEW NXG 5.0.0]
inputs:
  "Error In": error
  "Instrument Coms Info In": "Instrument Coms Info.gtype"
  "Debugging Cluster In": "Debugging Cluster.gtype"
outputs:
  "Error Out": error
  "Debugging Cluster Out": "Debugging Cluster.gtype"
  "Instrument Coms Info Out": "Instrument Coms Info.gtype"
panel controls:
  "Powermeter Average Counts": i16 = 1
types:
  T1 = cluster{"Element 1": "VISA Instr", "Element 2": string}
  "Arduino Detection cluster control.gtype" = cluster{"XZ Stage Arduino Address": "VISA Instr", "XZ Stage Arduino Detected?": bool, "Multiplexer Arduino Detected?": bool, "Multiplexer Arduino Address": "VISA Instr", "Arduinos List": T1[], "XZ Stage Log": string, "Multiplexer Log": string}
  "Thorlabs Motors Serial Number In.gtype" = cluster{"Thorlabs Blue Motor": string, "Thorlabs Red Motor": string, "Blue Motor Homed?": bool, "Red Motor Homed?": bool}
  "Instrument Coms Info.gtype" = cluster{"Arduino Coms Info": "Arduino Detection cluster control.gtype", "Photodetector Names": string[], "Keythley Address": "VISA Instr", "Photodetector Detected?": bool, "Thorlabs Motors Detected?": bool, "Keithley Detected?": bool, "Thorlabs Motors Serial Number": "Thorlabs Motors Serial Number In.gtype", "Photodetector IVI session": "Ivi IviDefault"}
  "Insturment Debugging Cluster.gtype" = cluster{"Keithley": bool, "Arduinos": bool, "Thorlabs Motors": bool, "Photodetector": bool}
  "Debugging Cluster.gtype" = cluster{"Debugging mode?": bool, "Initialize App": bool, "Insturment Debugging": "Insturment Debugging Cluster.gtype"}
uses:
  LabView_NXG_Thorlabs_PM100::Set Parameters::TLPM Set Average Count.gvi
diagram:
  case ($"Error In") {
    frame Error, Default {
      w1 = $"Error In"
      w2 = $"Debugging Cluster In"
      w3 = $"Instrument Coms Info In"
    }
    frame No Error {
      Property Node(instance in=$"Debugging Cluster In") -> ("Debugging mode?"=w4, "Insturment Debugging:Thorlabs Motors"=w5, instance out=w2)
      Logical And[output inverted](w4, not w5) -> w6
      case (w6) {
        frame False, Default {
          w3 = $"Instrument Coms Info In"
          w1 = $"Error In"
        }
        frame True {
          Property Node(instance in=$"Instrument Coms Info In") -> ("Photodetector IVI session"=w7, instance out=w3)
          call "TLPM Set Average Count.gvi"(IVI session in=w7, Average Count (1)=$"Powermeter Average Counts", error in (no error)=$"Error In") -> (error out=w1)
        }
      }
    }
  }
  $"Instrument Coms Info Out" <- w3
  $"Debugging Cluster Out" <- w2
  $"Error Out" <- w1
