vi "Power Meter Sample.gvi"   [LabVIEW NXG 5.0.0]
inputs:
  "Error In": error
outputs:
  "Error Out": error
  "Graph": cluster{"Element 1": f64, "Element 2": f64}[]
panel controls:
  "Reset measurement": bool
  "Parameter to measure": enum{"Photocurrent", "Power"} = "Photocurrent"
  "Stop App": bool
  "Save Graph Data": bool
  "Data Array": f64[][]
panel indicators:
  "Power Value": f64  # This parameter returns the last measured temperature value in °C.
  "Active": bool
  "Current": f64
  "Elapsed Time": f64
  "Stopped?": bool
  "Wait for save?": bool
uses:
  LabView_NXG_Thorlabs_PM100::Miscelanous::TLPM Timer.gvi
  Rainbow Measurement Setup::Side Functions::Global Abort::FGV Global Abort.gvi
  LabView_NXG_Thorlabs_PM100::Miscelanous::TLPM Find Resources.gvi
  LabView_NXG_Thorlabs_PM100::Get Parameters::TLPM Get Resource Name.gvi
  LabView_NXG_Thorlabs_PM100::Miscelanous::TLPM Initialize.gvi
  LabView_NXG_Thorlabs_PM100::Measure::TLPM Measure Power.gvi
  LabView_NXG_Thorlabs_PM100::Measure::TLPM Measure Current.gvi
  LabView_NXG_Thorlabs_PM100::Miscelanous::TLPM Close.gvi
  NI::G Core::Error::Multiplex Errors.gvi
diagram:
  case ($"Error In") {
    frame Error, Default {
      w1 = $"Error In"
    }
    frame No Error {
      case (TRUE) {
        frame False, Default {
          w2 = $"Error In"
        }
        frame True {
          $"Stopped?" <- FALSE
          $"Wait for save?" <- FALSE
          w2 = $"Error In"
        }
      }
      Property Node(instance in=reference to unnamed native front panel, error in=w2) -> ("Window"=w3, error out=w4)
      Open Window(reference in=w3, error in=w4) -> (reference out=w5, error out=w6)
      s1 = w6  # shift register
      while {
        case ($"Save Graph Data") {
          frame False, Default {
            $"Wait for save?" <- FALSE
            call "TLPM Timer.gvi"(Timer Commands="Resume Timer", Error In=s1) -> (Error Out=w7)
          }
          frame True {
            $"Wait for save?" <- TRUE
            Array To Spreadsheet String(array=$"Data Array", format string="%g") -> (spreadsheet string=w8)
            Concatenate Strings("Elapsed Time (s)    Power (W)", "\r\n", w8) -> w9
            call "TLPM Timer.gvi"(Timer Commands="Pause Timer", Error In=s1) -> (Error Out=w10)
            Open Or Create Or Replace File(access (0:read/write)="read/write", error in=w10, operation (0:open)="replace or create") -> (error out=w11, refnum out=w12)
            Write To Text File(error in=w11, file (use dialog)=w12, text=w9) -> (error out=w13, refnum out=w14)
            Close File(error in=w13, refnum=w14) -> (error out=w7)
          }
        }
        call "FGV Global Abort.gvi"(Global Abort Instructions="Read Current State", Error In=w7) -> (Local Abort Out=w15, Global Abort Out=w16, Error Out=w17)
        Logical Or(w17, $"Stopped?", w15, w16) -> w18
        Wait Until Next Multiple(multiple to wait=50)
        next s1 = w17
        stop if w18
      }
      # TLPM LabVIEW Example
      while {
        # Check for TLPM Devices
        # Returns Number of
        # found Devices
        Wait Until Next Multiple(multiple to wait=50)
        $Active <- FALSE
        call "TLPM Find Resources.gvi"(IVI session in="", error in (no error)=w6) -> (Resource Count=w19, error out=w20)
        Is Greater Or Equal(x=w19, y=1) -> w21
        case (w21) {
          frame False, Default {
            w22 = TRUE
            w23 = w20
          }
          frame True {
            # Initialize
            call "TLPM Get Resource Name.gvi"(Index (0)=0, error in (no error)=w20) -> (error out=w24, Resource Name=w25)
            # Select first Device
            # (Device Index 0)
            call "TLPM Initialize.gvi"(resource name=w25, ID Query (Do Query)=FALSE, Reset Device (Reset Device)=FALSE, error in (no error)=w24) -> (IVI session out=w26, error out=w27)
            w28 = $"Parameter to measure"
            s2 = w27  # shift register
            s3 = w26  # shift register
            s4 = cluster{"Element 1": f64, "Element 2": f64}[] []  # shift register
            s5 = uninitialised  # shift register
            s6 = f64[][] []  # shift register
            s7 = "Reset Timer"  # shift register
            s8 = 0  # shift register
            while {
              call "TLPM Timer.gvi"(Timer Commands=s7, Error In=s2) -> (Elapsed Time (Seconds)=w29, Paused?=w30, Error Out=w31)
              case (w28) {
                frame "Power", Default {
                  $Active <- TRUE
                  # Get Power
                  Wait(time to wait=10)
                  call "TLPM Measure Power.gvi"(IVI session in=s3, error in (no error)=w31) -> (IVI session out=w32, Power=w35, error out=w33)
                  $"Power Value" <- w35
                  w34 = FALSE
                }
                frame "Photocurrent" {
                  $Active <- TRUE
                  call "TLPM Measure Current.gvi"(IVI session in=s3, error in (no error)=w31) -> (IVI session out=w32, Current=w35, error out=w33)
                  # Get Current
                  $Current <- w35
                  Wait Until Next Multiple(multiple to wait=10)
                  w34 = FALSE
                }
              }
              Build Cluster(w29, w35) -> w36
              Build Array(w29, w35) -> w37
              case (w30) {
                frame True {
                  w38 = s4
                  w39 = s6
                  w40 = s8
                }
                frame False {
                  Insert Into Array(inArray=s4, index0=s8, new=w36) -> w38
                  Insert Into Array(inArray=s6, index0=s8, new=w37) -> w39
                  Increment(x=s8) -> w40
                }
              }
              $Graph <- w38
              $"Data Array" <- w39
              Property Node(instance in=reference to "Parameter to measure") -> ("Value"=w41)
              Is Not Equal(x=w41, y=s5) -> w42
              call "FGV Global Abort.gvi"(Global Abort Instructions="Read Current State", Error In=w33) -> (Local Abort Out=w43, Global Abort Out=w44, Error Out=w45)
              w46 = $"Stop App"
              Logical Or($"Reset measurement", w46, w42, w43, w44, w45) -> w47
              $"Elapsed Time" <- w29
              next s2 = w45
              next s3 = w32
              next s4 = w38
              next s5 = w41
              next s6 = w39
              next s7 = "Check Timer"
              next s8 = w40
              stop if w47
            }
            # Close
            $Active <- w34
            call "TLPM Close.gvi"(IVI session in=s3, error in (no error)=s2) -> (error out=w23)
            w22 = w46
          }
        }
        $"Stopped?" <- w22
        stop if w22
      }
      Close Window(reference in=w5, error in=w23) -> (error out=w48)
      call "Multiplex Errors.gvi"(error in 1=w48, error in 2=s1) -> (error out=w1)
    }
  }
  $"Error Out" <- w1
