vi "Blue Red Motor Detection.gvi"   [LabVIEW NXG 5.0.0]
inputs:
  "Device ID Array": string[]
  "Thorlabs Motors Serial Number In": "Thorlabs Motors Serial Number In.gtype"
outputs:
  "Blue Motor Detected?": bool
  "Both Motors Detected?": bool
  "Red Motor Detected?": bool
types:
  "Thorlabs Motors Serial Number In.gtype" = cluster{"Thorlabs Blue Motor": string, "Thorlabs Red Motor": string, "Blue Motor Homed?": bool, "Red Motor Homed?": bool}
uses:
  Rainbow Measurement Setup::Side Functions::Instrument Control::Thorlabs Motors::Detection::Blue Red Motor detected prompt.gvi
diagram:
  Property Node(instance in=$"Thorlabs Motors Serial Number In") -> ("Thorlabs Blue Motor"=w1, "Thorlabs Red Motor"=w2)
  # This SubVI detects if the Specified blue and red serial numbers are within the
  # detected ID array and prompts the user if they are not
  s1 = FALSE  # shift register
  s2 = FALSE  # shift register
  for {
    w3 = each element of $"Device ID Array"
    Is Equal(x=w3, y=w1) -> w4
    Select(s=w4, t=TRUE, f=s2) -> w5
    Is Equal(x=w3, y=w2) -> w6
    Select(s=w6, t=TRUE, f=s1) -> w7
    next s1 = w7
    next s2 = w5
  }
  $"Blue Motor Detected?" <- s2
  Logical And(s2, s1) -> w8
  call "Blue Red Motor detected prompt.gvi"(Blue Motor Detected?=s2, Both Detected?=w8, Red Motor Detected?=s1)
  $"Both Motors Detected?" <- w8
  $"Red Motor Detected?" <- s1
