vi "Blue Red Motor detected prompt.gvi"   [LabVIEW NXG 3.1.0]
inputs:
  "Blue Motor Detected?": bool
  "Both Detected?": bool
  "Red Motor Detected?": bool
diagram:
  # This subVI prompts the user if the motors are not detected
  case ($"Both Detected?") {
    frame False, Default {
      Select(s=$"Red Motor Detected?", t="", f=" Red Motor") -> w1
      Select(s=$"Blue Motor Detected?", t="", f=" Blue Motor") -> w2
      Concatenate Strings("This motor has not been detected:", w2, w1) -> w3
      One Button Dialog(button name ("OK")="Okay I wil try to fix it", message=w3)
    }
    frame True { }
  }
