vi "Modify Thorlabs File.gvi"   [LabVIEW NXG 5.0.0]
inputs:
  "Error In": error
  "Path In": path, required
  "Thorlabs Motor Serial Number File Operations": "Thorlabs Motor Serial Number File Operations.gtype" = "Read", required
  "Thorlabs Motors Serial Number In": "Thorlabs Motors Serial Number In.gtype"
outputs:
  "Error Out": error
  "Path Out": path
  "Thorlabs Motors Serial Number Out": "Thorlabs Motors Serial Number In.gtype"
types:
  "Thorlabs Motors Serial Number In.gtype" = cluster{"Thorlabs Blue Motor": string, "Thorlabs Red Motor": string, "Blue Motor Homed?": bool, "Red Motor Homed?": bool}
  "Thorlabs Motor Serial Number File Operations.gtype" = enum{"Read", "Write"}
uses:
  NI::G Core::Strings::Trim Whitespace.gvi
diagram:
  # This is a SubVI that Reads or writes the Thorlabs Motors Serial Number on a txt file so that they can be retrieved when needed.
  case ($"Error In") {
    frame Error, Default {
      w1 = $"Error In"
      w2 = $"Path In"
      w3 = $"Thorlabs Motors Serial Number In"
    }
    frame No Error {
      case ($"Thorlabs Motor Serial Number File Operations") {
        frame "Read", Default {
          Open Or Create Or Replace File(error in=$"Error In", file path (use dialog)=$"Path In", operation (0:open)="open") -> (error out=w4, refnum out=w5)
          Read From Text File(error in=w4, file (use dialog)=w5) -> (error out=w6, refnum out=w7, text=w8)
          Property Node(instance in=$"Thorlabs Motors Serial Number In") -> ("Thorlabs Blue Motor"=w9, "Thorlabs Red Motor"=w10)
          Build Array(w9, w10) -> w11
          Spreadsheet String To Array(array type=w11, format string="%g", spreadsheet string=w8) -> (array=w12)
          Array To Cluster[NumberOfClusterElements=9](array=w12) -> (cluster=w13)
          Property Node(instance in=w13) -> ("Element 1"=w14, "Element 2"=w15)
          call "Trim Whitespace.gvi"(string=w14) -> (trimmed string=w16)
          call "Trim Whitespace.gvi"(string=w15) -> (trimmed string=w17)
          Property Node(instance in=$"Thorlabs Motors Serial Number In", "Thorlabs Blue Motor"=w16, "Thorlabs Red Motor"=w17) -> (instance out=w3)
          Close File(error in=w6, refnum=w7) -> (error out=w1, path=w2)
        }
        frame "Write" {
          Open Or Create Or Replace File(error in=$"Error In", file path (use dialog)=$"Path In", operation (0:open)="replace or create") -> (error out=w18, refnum out=w19)
          Property Node(instance in=$"Thorlabs Motors Serial Number In") -> ("Thorlabs Blue Motor"=w20, "Thorlabs Red Motor"=w21)
          Build Array(w20, w21) -> w22
          Array To Spreadsheet String(array=w22, format string="%g") -> (spreadsheet string=w23)
          Concatenate Strings("Blue Motor Serial Number  Red Motor Serial Number", "\t", "\r\n", w23) -> w24
          Write To Text File(error in=w18, file (use dialog)=w19, text=w24) -> (error out=w25, refnum out=w26)
          Close File(error in=w25, refnum=w26) -> (error out=w1, path=w2)
          w3 = $"Thorlabs Motors Serial Number In"
        }
      }
    }
  }
  $"Thorlabs Motors Serial Number Out" <- w3
  $"Path Out" <- w2
  $"Error Out" <- w1
