vi "Thorlabs Serial Number Check.gvi"   [LabVIEW NXG 5.0.0]
inputs:
  "Error In": error
  "Instrument Control Mega Cluster In": "Instrument Control Mega Cluster.gtype"
  "Misc Data Mega Cluster In": "Misc Data Mega Cluster.gtype"
outputs:
  "Error Out": error
  "Thorlabs Motors Serial Number Out": "Thorlabs Motors Serial Number In.gtype"
  "Instrument Control Mega Cluster Out": "Instrument Control Mega Cluster.gtype"
  "Misc Data Mega Cluster Out": "Misc Data Mega Cluster.gtype"
panel indicators:
  "Thorlabs Motor Serial Number File Path": path
types:
  "Thorlabs Motors Serial Number In.gtype" = cluster{"Thorlabs Blue Motor": string, "Thorlabs Red Motor": string, "Blue Motor Homed?": bool, "Red Motor Homed?": bool}
  "Instrument Coms Info.gtype" = cluster{"Arduino Coms Info": "Arduino Detection cluster control.gtype", "Photodetector Names": string[], "Keythley Address": "VISA Instr", "Photodetector Detected?": bool, "Thorlabs Motors Detected?": bool, "Keithley Detected?": bool, "Thorlabs Motors Serial Number": "Thorlabs Motors Serial Number In.gtype", "Photodetector IVI session": "Ivi IviDefault", "Flame ID": string, "Flame Detected?": bool, "Flame Wrapper ID": u64}
  "Debugging Cluster.gtype" = cluster{"Debugging mode?": bool, "Initialize App": bool, "Insturment Debugging": "Insturment Debugging Cluster.gtype"}
  "Instrument Control Mega Cluster.gtype" = cluster{"Instruments Coms Info": "Instrument Coms Info.gtype", "Debugging Cluster": "Debugging Cluster.gtype"}
  "Full Reference Cluster.gtype" = cluster{"Enum Reference Cluster": "Enum Control Reference Cluster.gtype", "Boolean Reference Cluster": "Boolean Control Reference Cluster.gtype", "Numeric Reference Cluster": "Numeric Control Reference Cluster.gtype", "Numeric Cluster Reference Cluster": "Numeric Cluster Reference Cluster.gtype", "Path Reference Cluster": "Path Reference Cluster.gtype", "Cluster Reference Cluster": "Cluster Reference Cluster.gtype", "XZ Stage Controls Reference Cluster": "XZ Stage Controls Reference Cluster.gtype"}
  "Cell Naming Cluster.gtype" = cluster{"Cell Label": string, "Sample Prefix": string, "Author Initials": string, "Current Date": string, "Batch Name": string}
  T1 = cluster{"X Coordinate (mm)": f64, "Z Coordinate (mm)": f64}
  T2 = cluster{"X Coordinate (mm)": f64, "Z Coordinate (mm)": f64, "Vertical Spacing (mm)": f64}
  "XZ All Position Cluster.gtype" = cluster{"Diffusor Coordinates": T1, "Photodetector Coordinates": T1, "Cell R.01 Coordinates": T2}
  T3 = cluster{"Thorlabs Motor Serial Number File Path": path, "Default Data Saving Location": path}
  "Misc Data Mega Cluster.gtype" = cluster{"Full Reference Cluster": "Full Reference Cluster.gtype", "Cell Naming Cluster": "Cell Naming Cluster.gtype", "All XZ Position Cluster": "XZ All Position Cluster.gtype", "All Paths": T3}
uses:
  Rainbow Measurement Setup::Side Functions::Global Abort::FGV Global Abort.gvi
  NI::G Core::File IO (General)::Check if File or Folder Exists.gvi
  Rainbow Measurement Setup::Side Functions::Messages And Prompts::Select file prompt.gvi
  Rainbow Measurement Setup::Side Functions::Instrument Control::Thorlabs Motors::Detection::Thorlabs motor Detector.gvi
  NI::G Core::Strings::1D String Array to Delimited String.gvi
  NI::G Core::File IO (General)::Create Directory Recursive.gvi
  Rainbow Measurement Setup::Side Functions::Instrument Control::Thorlabs Motors::Detection::Modify Thorlabs File.gvi
diagram:
  # This SubVI Checks if there is any Thorlabs Motor Serial Number reference file. If there is it just reads and outputs the serial numbers for the red and blue motors. If there isn't it prompts the user with various options:
  # They can either create it themselves, they can locate the file elsewhere or a new file can be created with the currently connected motors. It is VERY IMPORTANT that if one chooses the latter option ONLY 2 motors are
  # connected and no active simulations are in place, otherwise the stored serial numbers will be wrong and they will have to be modified.
  case ($"Error In") {
    frame Error, Default {
      w1 = $"Error In"
      w2 = $"Instrument Control Mega Cluster In"
      w3 = $"Misc Data Mega Cluster In"
    }
    frame No Error {
      Get Component Directory() -> (Path=w4)
      Strip Path(path=w4) -> (stripped path=w5)
      Build Path(base path=w5, name or relative path="Extra installers\\Thorlabs_Motors_Serial_Number.txt") -> (appended path=w6)
      s1 = w6  # shift register
      while (iteration -> i1) {
        call "FGV Global Abort.gvi"(Global Abort Instructions="Read Current State", Error In=$"Error In") -> (Global Abort Out=w7, Error Out=w8)
        call "Check if File or Folder Exists.gvi"(file or folder=s1, error in=w8) -> (file or folder exists?=w9, error out=w10)
        case (w9) {
          frame False, Default {
            Path To String(path=s1) -> (string=w14)
            w15 = "I could not find the Thorlabs_Motors_Serial_Number file in \nthis location:\n"
            w16 = """
Please make sure that the file is put back on that
location, provide an alternative path with the file or,
if you want, we can generate a file with the currently
detected Motor Serial Number Values."""
            Concatenate Strings(w15, w14, w16) -> w17
            w18 = "I will make sure\nthe file is placed\nback where it \nbelongs"
            Three Button Dialog(Allow user to close window? (TRUE)=FALSE, Center Button Text ("No")=w18, Left Button Text ("Yes")="I will provide an\nalternative path", Right Button Text ("Cancel")="Create a New File, i\ndo not know where the\nother is.", Window Title (" ")="Thorlabs_Motors_Serial_Number.txt not found", message=w17) -> (Which Button?=w19)
            case (w19) {
              frame "center button" {
                Wait Until Next Multiple(multiple to wait=20000)
                w12 = w10
                w13 = s1
              }
              frame "left button", Default {
                call "Select file prompt.gvi"(Main Message="Please select the Thorlabs_Motors_Serial_Number.txt file.", Sub message="It is usually on the extra installers folder", Error In=w10) -> (New Path=w13, Error Out=w12)
              }
              frame "right button" {
                call "Thorlabs motor Detector.gvi"(First Write Detection=TRUE, Prompt Iterations=2, Error In=w10) -> (Thorlabs Motor Serial Nº Array=w20, Detected?=w21, Error Out=w22)
                case (w21) {
                  frame False, Default {
                    w23 = """We have not detected any
motors, please make sure you
have properly connected them
before asking to create a file with
the currently detected Motor Serial
Number Values."""
                    One Button Dialog(button name ("OK")="Sorry I did not realise", message=w23)
                    w13 = s1
                    w12 = w22
                  }
                  frame True {
                    call "1D String Array to Delimited String.gvi"(string array=w20, delimiter=", ") -> (delimited string=w24)
                    w25 = """
Are you SURE that these are the correct Serial
Numbers and you want to store them for future
use?
(You can always manually modify them in case 
of changing the motors or if they have been reversed)"""
                    Concatenate Strings("These are the connected Motors Serial Number.\n", w24, w25) -> w26
                    Two Button Dialog(F button name ("Cancel")="No please these are not the\ncorrect serial numbers", T button name ("OK")="Yes, I am certain", message=w26) -> (T Button?=w27)
                    case (w27) {
                      frame False, Default {
                        w28 = "Then either create the file yourself \nor connect the right motors please."
                        One Button Dialog(button name ("OK")="Okay sorry.", message=w28)
                        w13 = s1
                        w12 = w22
                      }
                      frame True {
                        Array Index(array=w20) -> (out0[0]=w29, out1[1]=w30)
                        Property Node(instance in="Thorlabs Motors Serial Number In.gtype" {all zero or empty}, "Thorlabs Blue Motor"=w29, "Thorlabs Red Motor"=w30) -> (instance out=w31)
                        Strip Path(path=s1) -> (stripped path=w32)
                        call "Create Directory Recursive.gvi"(folder=w32, error in=w22) -> (error out=w33)
                        call "Modify Thorlabs File.gvi"(Path In=s1, Thorlabs Motor Serial Number File Operations="Write", Thorlabs Motors Serial Number In=w31, Error In=w33) -> (Path Out=w13, Error Out=w12)
                      }
                    }
                  }
                }
              }
            }
            w11 = FALSE
          }
          frame True {
            w11 = TRUE
            w12 = w10
            w13 = s1
          }
        }
        Is Greater(x=i1, y=2) -> w34
        case (w34) {
          frame False, Default {
            w35 = w12
            w36 = FALSE
          }
          frame True {
            w37 = """Seems you're having some trouble
finding the Thorlabs_Motors_Serial_Number.txt
file, do you want to proceed without it
and hope for the best?
(WARNING: some functionalities might
be compromized, or the entire program 
can crash)"""
            Two Button Dialog(F button name ("Cancel")="Oh dear no, I'd rather ask for help", T button name ("OK")="Yes please, I like to live dangerously", message=w37) -> (T Button?=w36)
            w35 = w12
          }
        }
        Logical Or(w36, w11, w7) -> w38
        Wait Until Next Multiple(multiple to wait=500)
        next s1 = w13
        stop if w38
      }
      call "Modify Thorlabs File.gvi"(Path In=s1, Thorlabs Motor Serial Number File Operations="Read", Error In=w35) -> (Path Out=w39, Thorlabs Motors Serial Number Out=w40, Error Out=w1)
      Property Node(instance in=$"Misc Data Mega Cluster In", "All Paths:Thorlabs Motor Serial Number File Path"=w39) -> (instance out=w3)
      $"Thorlabs Motor Serial Number File Path" <- w39
      Property Node(instance in=$"Instrument Control Mega Cluster In") -> ("Instruments Coms Info"=w41)
      Property Node(instance in=w41, "Thorlabs Motors Serial Number"=w40) -> (instance out=w42)
      Property Node(instance in=$"Instrument Control Mega Cluster In", "Instruments Coms Info"=w42) -> (instance out=w2)
      $"Thorlabs Motors Serial Number Out" <- w40
    }
  }
  $"Misc Data Mega Cluster Out" <- w3
  $"Instrument Control Mega Cluster Out" <- w2
  $"Error Out" <- w1
