vi "Thorlabs motor Detector.gvi"   [LabVIEW NXG 5.0.0]
inputs:
  "Error In": error
  "First Write Detection": bool
  "Prompt Iterations": i32 = 3
  "Thorlabs Motors Serial Number In": "Thorlabs Motors Serial Number In.gtype"
outputs:
  "Error Out": error
  "Detected?": bool
  "Thorlabs Motor Serial Nº Array": string[]
  "Thorlabs Motors Serial Number Out": "Thorlabs Motors Serial Number In.gtype"
panel indicators:
  "Blue Motor Detected?": bool
  "Red Motor Detected?": bool
types:
  "Thorlabs Motors Serial Number In.gtype" = cluster{"Thorlabs Blue Motor": string, "Thorlabs Red Motor": string, "Blue Motor Homed?": bool, "Red Motor Homed?": bool}
uses:
  Rainbow Measurement Setup::Side Functions::Global Abort::FGV Global Abort.gvi
  NXG_KCube_DC_Servo_Control::Examples::Scan Available Devices.gvi
  NI::G Core::Error::Clear Error Cluster.gvi
  Rainbow Measurement Setup::Side Functions::Instrument Control::Thorlabs Motors::Detection::Blue Red Motor Detection.gvi
diagram:
  $"Thorlabs Motors Serial Number Out" <- $"Thorlabs Motors Serial Number In"
  # This subVI scans the available thorlabs motors and if there are not 2 connected motors it prompts the user
  # to connect all the motors and retries. After 'n' faild attempts it prompts the user to skip this test.
  # If it is trying to create a new Serial Number File it has to detect ONLY 2 motors to assign them.
  case ($"Error In") {
    frame Error, Default {
      w1 = $"Error In"
      w2 = default
      w3 = default
      w4 = default
      w5 = default
    }
    frame No Error {
      while (iteration -> i1) {
        call "FGV Global Abort.gvi"(Global Abort Instructions="Read Current State", Error In=$"Error In") -> (Global Abort Out=w6, Error Out=w7)
        case (w7) {
          frame Error, Default {
            w8 = w7
          }
          frame No Error {
            $"Blue Motor Detected?" <- FALSE
            $"Red Motor Detected?" <- FALSE
            w8 = w7
          }
        }
        call "Scan Available Devices.gvi"(Error In=w8) -> (Number Of Devices=w9, Device ID array=w10, Error Out=w11)
        Is Equal(x=w9, y=2) -> w12
        Is Greater Or Equal(x=w9, y=2) -> w13
        Select(s=$"First Write Detection", t=w12, f=w13) -> w14
        case (w14) {
          frame False, Default {
            while {
              Number To Decimal String(number=w9) -> (decimal integer string=w17)
              w18 = """ thorlabs motors, 
there should be at least 2 
connected. Please make 
sure that they are
propperly connected and  
that they are powered on.

(If you are trying to create a new
Motor Serial Number File MAKE SURE
you have only connected two Thorlabs
motors to this computer)
"""
              Concatenate Strings("I detected ", w17, w18) -> w19
              One Button Dialog(button name ("OK")="Okay i will fix it", message=w19) -> (true=w20)
              Wait Until Next Multiple(multiple to wait=500)
              stop if w20
            }
            call "Clear Error Cluster.gvi"(error in=w11) -> (error out=w15)
            w16 = FALSE
            w2 = default
            w3 = w10
            w4 = default
            w5 = default
          }
          frame True {
            case ($"First Write Detection") {
              frame False, Default {
                # If it is not the first time, we will want to
                # decide if the connected motors are the ones
                # we need to use (which one is blue and Which
                # one is red) so we compare them with the file
                # we had saved before.
                call "Blue Red Motor Detection.gvi"(Device ID Array=w10, Thorlabs Motors Serial Number In=$"Thorlabs Motors Serial Number In") -> (Blue Motor Detected?=w5, Both Motors Detected?=w16, Red Motor Detected?=w4)
                w3 = w10
                w15 = w11
              }
              frame True {
                # If we are trying to detect the
                # motors for the first time wi will
                # take any serial number there is
                # and set them as the correct ones.
                # Connect ONLY the correct motors
                w3 = w10
                w15 = w11
                w16 = TRUE
                w4 = default
                w5 = default
              }
            }
            w2 = w16
          }
        }
        Is Greater Or Equal(x=i1, y=$"Prompt Iterations") -> w21
        case (w21) {
          frame False, Default {
            w22 = FALSE
            w1 = w15
          }
          frame True {
            w23 = """Seems you're having some trouble
connecting the thorlabs motors, do you 
want to proceed without connecting them
and hope for the best?
(WARNING: some functionalities might
be compromized)"""
            Two Button Dialog(F button name ("Cancel")="Oh dear no, I'd rather ask for help", T button name ("OK")="Yes please, I like to live dangerously", message=w23) -> (T Button?=w22)
            w1 = w15
          }
        }
        Logical Or(w16, w22, w6) -> w24
        stop if w24
      }
    }
  }
  $"Thorlabs Motor Serial Nº Array" <- w3
  $"Blue Motor Detected?" <- w5
  $"Error Out" <- w1
  $"Detected?" <- w2
  $"Red Motor Detected?" <- w4
