vi "Div Wav FGV New Data Handler.gvi"   [LabVIEW NXG 5.0.0]
inputs:
  "Div Wavelength New Data In": "Dividing Wavelength Calibration Data.gtype"
  "Div Wav Old Data In": "Dividing Wavelength Calibration Data.gtype"
  "Error In": error
outputs:
  "Div Wavelength Data Out": "Dividing Wavelength Calibration Data.gtype"
  "Error Out": error
types:
  "Dividing Wavelength Calibration Data.gtype" = cluster{"Dividing Wavelength (nm) Array": f64[], "Blue Motor Position (mm) Array": f64[], "Red Motor Position (mm) Array": f64[]}
diagram:
  # This subVI prevents the old data from being overwritten by empty arrays
  case ($"Error In") {
    frame Error, Default {
      w1 = $"Div Wav Old Data In"
      w2 = $"Error In"
    }
    frame No Error {
      Property Node(instance in=$"Div Wav Old Data In") -> ("Dividing Wavelength (nm) Array"=w3, "Blue Motor Position (mm) Array"=w4, "Red Motor Position (mm) Array"=w5, instance out=w6)
      Property Node(instance in=$"Div Wavelength New Data In") -> ("Dividing Wavelength (nm) Array"=w7, "Blue Motor Position (mm) Array"=w8, "Red Motor Position (mm) Array"=w9)
      Is Empty Array(array=w7) -> w10
      Select(s=w10, t=w3, f=w7) -> w11
      Is Empty Array(array=w8) -> w12
      Select(s=w12, t=w4, f=w8) -> w13
      Is Empty Array(array=w9) -> w14
      Select(s=w14, t=w5, f=w9) -> w15
      Property Node(instance in=w6, "Dividing Wavelength (nm) Array"=w11, "Blue Motor Position (mm) Array"=w13, "Red Motor Position (mm) Array"=w15) -> (instance out=w1)
      w2 = $"Error In"
    }
  }
  $"Error Out" <- w2
  $"Div Wavelength Data Out" <- w1
