vi "Dividing Wavelength Basic Translator.gvi"   [LabVIEW NXG 5.0.0]
inputs:
  "Error In": error
  "Blue Motor Position": f64
  "Dividing Wavelength Calibration Data In": "Dividing Wavelength Calibration Data.gtype"
  "Red Motor Position": f64
outputs:
  "Error Out": error
  "Blue Motor Dividing Wavelength": f64
  "Red Motor Dividing Wavelength": f64
types:
  "Dividing Wavelength Calibration Data.gtype" = cluster{"Dividing Wavelength (nm) Array": f64[], "Blue Motor Position (mm) Array": f64[], "Red Motor Position (mm) Array": f64[]}
uses:
  Rainbow Measurement Setup::Side Functions::Utilities::Array Operations::Find Closest In Array.gvi
diagram:
  # This subVI takes the dividing wavelength calibration data and the motor positions and calculates
  # the corresponding dividing wavelength. It looks for the closest value within
  # the array and gives out that closest value as well as the coordinates for that value.
  case ($"Error In") {
    frame Error, Default {
      w1 = $"Error In"
      w2 = default
      w3 = default
    }
    frame No Error {
      Property Node(instance in=$"Dividing Wavelength Calibration Data In") -> ("Dividing Wavelength (nm) Array"=w4, "Blue Motor Position (mm) Array"=w5, "Red Motor Position (mm) Array"=w6)
      call "Find Closest In Array.gvi"(Array In=w5, Desired Value=$"Blue Motor Position", Tolerance=0.5, Error In=$"Error In") -> (Closest Value Index=w7, Error Out=w8)
      call "Find Closest In Array.gvi"(Array In=w6, Desired Value=$"Red Motor Position", Tolerance=0.5, Error In=w8) -> (Closest Value Index=w9, Error Out=w1)
      Array Index(array=w4) -> (out0[w9]=w2, out1[w7]=w3)
    }
  }
  $"Red Motor Dividing Wavelength" <- w2
  $"Blue Motor Dividing Wavelength" <- w3
  $"Error Out" <- w1
