vi "Dividing Wavelength Calibration Data FGV.gvi"   [LabVIEW NXG 5.0.0]
inputs:
  "Error In": error
  "Div Wavelength FGV Instructions": "Div Wavelength FGV Instructions.gtype" = "Read Loaded Data"
  "Div Wavelength New Data In": "Dividing Wavelength Calibration Data.gtype"
outputs:
  "Error Out": error
  "Dividing Wavelength Calibration Data Out": "Dividing Wavelength Calibration Data.gtype"
types:
  "Dividing Wavelength Calibration Data.gtype" = cluster{"Dividing Wavelength (nm) Array": f64[], "Blue Motor Position (mm) Array": f64[], "Red Motor Position (mm) Array": f64[]}
  "Div Wavelength FGV Instructions.gtype" = enum{"Read Loaded Data", "Load Data", "Unload Data", "Acquire New Data", "File Save Data"}
uses:
  Rainbow Measurement Setup::Side Functions::Instrument Control::Thorlabs Motors::Dividing Wavelength Control::Dividing Wavelength Calibration File Handling.gvi
  Rainbow Measurement Setup::Side Functions::Instrument Control::Thorlabs Motors::Dividing Wavelength Control::Div Wav FGV New Data Handler.gvi
diagram:
  # This FGV SubVI stores the Dividing wavelength to motor position calibration in memory so that it can be easily accessed
  # when needed.
  case ($"Error In") {
    frame Error, Default {
      w1 = $"Error In"
    }
    frame No Error {
      s1 = uninitialised  # shift register
      while {
        case ($"Div Wavelength FGV Instructions") {
          frame "Read Loaded Data", Default {
            $"Dividing Wavelength Calibration Data Out" <- s1
            w2 = s1
            w1 = $"Error In"
          }
          frame "Unload Data" {
            w3 = "Dividing Wavelength Calibration Data.gtype" {all zero or empty}
            w2 = w3
            w1 = $"Error In"
          }
          frame "Load Data" {
            call "Dividing Wavelength Calibration File Handling.gvi"(Error In=$"Error In", Modify File Operation="Load TXT") -> (Dividing Wavelength Calibration Data Out=w2, Error Out=w1)
          }
          frame "Acquire New Data" {
            call "Div Wav FGV New Data Handler.gvi"(Div Wavelength New Data In=$"Div Wavelength New Data In", Div Wav Old Data In=s1, Error In=$"Error In") -> (Div Wavelength Data Out=w2, Error Out=w1)
          }
          frame "File Save Data" {
            call "Dividing Wavelength Calibration File Handling.gvi"(Dividing Wavelength Calibration Data In=s1, Error In=$"Error In", Modify File Operation="Save TXT") -> (Dividing Wavelength Calibration Data Out=w2, Error Out=w1)
          }
        }
        next s1 = w2
        stop if TRUE
      }
    }
  }
  $"Error Out" <- w1
