vi "Dividing Wavelength Calibration File Handling.gvi"   [LabVIEW NXG 5.0.0]
inputs:
  "Error In": error
  "Dividing Wavelength Calibration Data In": "Dividing Wavelength Calibration Data.gtype"
  "Modify File Operation": "Modify File Operation.gtype" = "Save TXT"
outputs:
  "Error Out": error
  "Dividing Wavelength Calibration Data Out": "Dividing Wavelength Calibration Data.gtype"
types:
  "Dividing Wavelength Calibration Data.gtype" = cluster{"Dividing Wavelength (nm) Array": f64[], "Blue Motor Position (mm) Array": f64[], "Red Motor Position (mm) Array": f64[]}
  "Modify File Operation.gtype" = enum{"Save TXT", "Load TXT"}
uses:
  Rainbow Measurement Setup::Side Functions::Sample Naming::txt Extension adder.gvi
  NI::G Core::File IO (General)::Check if File or Folder Exists.gvi
  Rainbow Measurement Setup::Side Functions::Messages And Prompts::Select file prompt.gvi
  Rainbow Measurement Setup::Main Functions::Modify TXT file::Modify Measurement TXT File.gvi
  Rainbow Measurement Setup::Side Functions::Utilities::Array Operations::Array Zero Element Remover.gvi
  Rainbow Measurement Setup::Side Functions::Messages And Prompts::FGV Repeat Operation for all following files.gvi
diagram:
  # This SubVI is in charge of handling the writting and loading of the Dividing Wavelength Calibration file
  # which stores the relation between the guillotine motors position and the measured spectral output.
  case ($"Error In") {
    frame Error, Default {
      w1 = $"Error In"
      w2 = $"Dividing Wavelength Calibration Data In"
    }
    frame No Error {
      case ($"Modify File Operation") {
        frame "Load TXT", Default {
          Get Component Directory() -> (Path=w4)
          Strip Path(path=w4) -> (stripped path=w5)
          Build Path(base path=w5, name or relative path="Extra installers\\Calibration_Files\\Div_Wav_To_Motor_Pos") -> (appended path=w6)
          call "txt Extension adder.gvi"(Name without .txt="Dividing Wavelength To Motor Position Calibration File") -> (Name with .txt=w7)
          Build Path(base path=w6, name or relative path=w7) -> (appended path=w8)
          call "Check if File or Folder Exists.gvi"(file or folder=w8, error in=$"Error In") -> (file or folder exists?=w9, error out=w10)
          Is Empty String Or Path(string/path=w8) -> w11
          Logical Or(w11, not w9) -> w12
          case (w12) {
            frame False {
              w13 = w8
              w14 = w10
            }
            frame True {
              w15 = "Please select the Dividing Wavelength \nto motor position calibration file"
              call "Select file prompt.gvi"(Main Message=w15, Sub message="It Should be on the Extra installers folder", Error In=w10) -> (New Path=w13, Error Out=w14)
            }
          }
          call "Modify Measurement TXT File.gvi"(Filename to load/save=w13, Modify File Operation=$"Modify File Operation", Error In=w14, Measurement File Type="Dividing Wavelength To Motor Position") -> (Loaded Data=w16, Error Out=w3)
          Array Index(array=w16) -> (out0[_, 0]=w17, out1[_, 1]=w18, out2[_, 2]=w19)
          Property Node(instance in=$"Dividing Wavelength Calibration Data In", "Dividing Wavelength (nm) Array"=w17, "Blue Motor Position (mm) Array"=w18, "Red Motor Position (mm) Array"=w19) -> (instance out=w2)
        }
        frame "Save TXT" {
          Property Node(instance in=$"Dividing Wavelength Calibration Data In") -> ("Dividing Wavelength (nm) Array"=w20, "Blue Motor Position (mm) Array"=w21, "Red Motor Position (mm) Array"=w22, instance out=w2)
          Build Array(w20, w21, w22) -> w23
          Transpose 2D Array(2D array=w23) -> (transposed array=w24)
          call "Array Zero Element Remover.gvi"(Input 2d Array=w24, Error In=$"Error In") -> (No Empty Row Output Array 2D=w25, Error Out=w26)
          call "Modify Measurement TXT File.gvi"(Modify File Operation=$"Modify File Operation", Data To Save=w25, Error In=w26, Measurement File Type="Dividing Wavelength To Motor Position") -> (Error Out=w3)
        }
      }
      call "FGV Repeat Operation for all following files.gvi"(FGV Instructions="Reset State", Error In=w3) -> (Error Out=w1)
    }
  }
  $"Dividing Wavelength Calibration Data Out" <- w2
  $"Error Out" <- w1
