vi "KCube Dividing Wavelength Translator.gvi"   [LabVIEW NXG 5.0.0]
inputs:
  "Error In": error
  "Dividing Wavelength": f64
  "Rainbow Sweep Types": "Rainbow Sweep Types.gtype" = "Red Sweep Closing"
  "Dividing Wavelength Calibration Data In": "Dividing Wavelength Calibration Data.gtype"
  "Instrument Coms Info In": "Instrument Coms Info.gtype"
  "Debugging Cluster": "Debugging Cluster.gtype"
outputs:
  "Error Out": error
  "KCube Coordinates": "KCube Coordinates.gtype"
  "Instrument Coms Info Out": "Instrument Coms Info.gtype"
  "Real Dividing Wavelength": f64
types:
  "Rainbow Sweep Types.gtype" = enum{"Red Sweep Closing", "Red Sweep Opening", "Blue Sweep Closing", "Blue Sweep Opening"}
  "KCube Coordinates.gtype" = cluster{"Blue Motor Position to move to (mm)": f64, "Red Motor Position to move to (mm)": f64}
  "Dividing Wavelength Calibration Data.gtype" = cluster{"Dividing Wavelength (nm) Array": f64[], "Blue Motor Position (mm) Array": f64[], "Red Motor Position (mm) Array": f64[]}
  T1 = cluster{"Element 1": "VISA Instr", "Element 2": string}
  "Arduino Detection cluster control.gtype" = cluster{"XZ Stage Arduino Address": "VISA Instr", "XZ Stage Arduino Detected?": bool, "Multiplexer Arduino Detected?": bool, "Multiplexer Arduino Address": "VISA Instr", "Arduinos List": T1[], "XZ Stage Log": string, "Multiplexer Log": string}
  "Thorlabs Motors Serial Number In.gtype" = cluster{"Thorlabs Blue Motor": string, "Thorlabs Red Motor": string, "Blue Motor Homed?": bool, "Red Motor Homed?": bool}
  "Instrument Coms Info.gtype" = cluster{"Arduino Coms Info": "Arduino Detection cluster control.gtype", "Photodetector Names": string[], "Keythley Address": "VISA Instr", "Photodetector Detected?": bool, "Thorlabs Motors Detected?": bool, "Keithley Detected?": bool, "Thorlabs Motors Serial Number": "Thorlabs Motors Serial Number In.gtype", "Photodetector IVI session": "Ivi IviDefault", "Flame ID": string, "Flame Detected?": bool, "Flame Wrapper ID": u64}
  "Insturment Debugging Cluster.gtype" = cluster{"Keithley": bool, "Arduinos": bool, "Thorlabs Motors": bool, "Photodetector": bool, "Flame Spectr": bool}
  "Debugging Cluster.gtype" = cluster{"Debugging mode?": bool, "Initialize App": bool, "Insturment Debugging": "Insturment Debugging Cluster.gtype"}
uses:
  Rainbow Measurement Setup::Side Functions::Utilities::Find Closest In Array.gvi
  Rainbow Measurement Setup::Side Functions::Messages And Prompts::FGV Cancel Prompts until Finished Routine.gvi
  NXG_KCube_DC_Servo_Control::Utilities::Move To Position.gvi
diagram:
  # This subVI takes the dividing wavelength calibration data and the dividing wavelength and calculates
  # the position of the guillotine motors so as to have that exact wavelength. It looks for the closest value within
  # the array and gives out that closest value as well as the coordinates for that value.
  # All that only if the debugging allows for it.
  case ($"Error In") {
    frame Error, Default {
      w1 = $"Error In"
      w2 = default
      w3 = $"Instrument Coms Info In"
      w4 = $"Dividing Wavelength"
    }
    frame No Error {
      Property Node(instance in=$"Dividing Wavelength Calibration Data In") -> ("Dividing Wavelength (nm) Array"=w5, "Blue Motor Position (mm) Array"=w6, "Red Motor Position (mm) Array"=w7)
      Property Node(instance in=$"Debugging Cluster") -> ("Debugging mode?"=w8, "Insturment Debugging:Thorlabs Motors"=w9)
      Logical And[output inverted](w8, not w9) -> w10
      call "Find Closest In Array.gvi"(Array In=w5, Desired Value=$"Dividing Wavelength", Tolerance=20, Error In=$"Error In") -> (Closest Value Index=w11, Closest Value=w4, Within Tolerance?=w12, Error Out=w13)
      Is Less Than 0(x=w11) -> w14
      Logical Or(w14, not w12) -> w15
      case (w10) {
        frame False, Default {
          w1 = w13
          w3 = $"Instrument Coms Info In"
          w2 = default
        }
        frame True {
          case (w15) {
            frame True {
              call "FGV Cancel Prompts until Finished Routine.gvi"(Error In=w13, FGV Instructions="Read State") -> (Prompt? Out=w16, Error Out=w17)
              case (w16) {
                frame False, Default {
                  w1 = w17
                }
                frame True {
                  w18 = """Dividing wavelength not in the calibration file
please extend either the range or the resolution
of the calibration file or contact Martí 
Problem in KCube Dividing Wavelength Translator)"""
                  Two Button Dialog(F button name ("Cancel")="Okay But stop \nthis prompts please", T button name ("OK")="Okay I will", message=w18) -> (T Button?=w19)
                  call "FGV Cancel Prompts until Finished Routine.gvi"(Error In=w17, FGV Instructions="Set State", Prompt? In=w19) -> (Error Out=w1)
                }
              }
              w3 = $"Instrument Coms Info In"
              w2 = default
            }
            frame False {
              case ($"Rainbow Sweep Types") {
                frame "Red Sweep Closing", Default {
                  Array Index(array=w6) -> (out0[w11]=w20)
                  Property Node(instance in="KCube Coordinates.gtype" {all zero or empty}, "Blue Motor Position to move to (mm)"=w20) -> (instance out=w2)
                  Property Node(instance in=$"Instrument Coms Info In") -> ("Thorlabs Motors Serial Number:Thorlabs Blue Motor"=w21, instance out=w3)
                  call "Move To Position.gvi"(Motor Serial Number In=w21, Position to move in mm=w20, Error In=w13) -> (Error Out=w1)
                }
                frame "Red Sweep Opening" {
                  Array Index(array=w6) -> (out0[w11]=w22)
                  Property Node(instance in="KCube Coordinates.gtype" {all zero or empty}, "Blue Motor Position to move to (mm)"=w22) -> (instance out=w2)
                  Property Node(instance in=$"Instrument Coms Info In") -> ("Thorlabs Motors Serial Number:Thorlabs Blue Motor"=w23, instance out=w3)
                  call "Move To Position.gvi"(Motor Serial Number In=w23, Position to move in mm=w22, Error In=w13) -> (Error Out=w1)
                }
                frame "Blue Sweep Closing" {
                  Array Index(array=w7) -> (out0[w11]=w24)
                  Property Node(instance in="KCube Coordinates.gtype" {all zero or empty}, "Red Motor Position to move to (mm)"=w24) -> (instance out=w2)
                  Property Node(instance in=$"Instrument Coms Info In") -> ("Thorlabs Motors Serial Number:Thorlabs Red Motor"=w25, instance out=w3)
                  call "Move To Position.gvi"(Motor Serial Number In=w25, Position to move in mm=w24, Error In=w13) -> (Error Out=w1)
                }
                frame "Blue Sweep Opening" {
                  Array Index(array=w7) -> (out0[w11]=w26)
                  Property Node(instance in="KCube Coordinates.gtype" {all zero or empty}, "Red Motor Position to move to (mm)"=w26) -> (instance out=w2)
                  Property Node(instance in=$"Instrument Coms Info In") -> ("Thorlabs Motors Serial Number:Thorlabs Red Motor"=w27, instance out=w3)
                  call "Move To Position.gvi"(Motor Serial Number In=w27, Position to move in mm=w26, Error In=w13) -> (Error Out=w1)
                }
              }
            }
          }
        }
      }
    }
  }
  $"Instrument Coms Info Out" <- w3
  $"KCube Coordinates" <- w2
  $"Error Out" <- w1
  $"Real Dividing Wavelength" <- w4
