vi "Modify Thorlabs File.gvi"   [LabVIEW NXG 3.1.0]
inputs:
  "Error In": error
  "Path In": path, required
  "Thorlabs Motor Serial Number File Operations": "Thorlabs Motor Serial Number File Operations.gtype" = "Read", required
  "Thorlabs Motors Serial Number In": "Thorlabs Motors Serial Number In.gtype"
outputs:
  "Error Out": error
  "Path Out": path
  "Thorlabs Motors Serial Number Out": "Thorlabs Motors Serial Number In.gtype"
types:
  "Thorlabs Motors Serial Number In.gtype" = cluster{"Thorlabs Blue Motor": string, "Thorlabs Red Motor": string}
  "Thorlabs Motor Serial Number File Operations.gtype" = enum{"Read", "Write"}
uses:
  NI::G Core::Strings::Trim Whitespace.gvi
diagram:
  # This is a SubVI that Reads or writes the Thorlabs Motors Serial Number on a txt file so that they can be retrieved when needed.
  case ($"Error In") {
    frame Error, Default {
      w1 = $"Error In"
    }
    frame No Error {
      case ($"Thorlabs Motor Serial Number File Operations") {
        frame "Read", Default {
          Open Or Create Or Replace File(error in=$"Error In", file path (use dialog)=$"Path In", operation (0:open)="open") -> (error out=w4, refnum out=w5)
          Read From Text File(error in=w4, file (use dialog)=w5) -> (error out=w6, refnum out=w7, text=w8)
          Close File(error in=w6, refnum=w7) -> (error out=w1, path=w2)
          Cluster To Array(cluster=$"Thorlabs Motors Serial Number In") -> (array=w9)
          Spreadsheet String To Array(array type=w9, format string="%g", spreadsheet string=w8) -> (array=w10)
          Array To Cluster[NumberOfClusterElements=9](array=w10) -> (cluster=w11)
          Property Node(instance in=w11) -> ("Element 1"=w12, "Element 2"=w13)
          call "Trim Whitespace.gvi"(string=w12) -> (trimmed string=w14)
          call "Trim Whitespace.gvi"(string=w13) -> (trimmed string=w15)
          Property Node(instance in=$"Thorlabs Motors Serial Number In", "Thorlabs Blue Motor"=w14, "Thorlabs Red Motor"=w15) -> (instance out=w3)
        }
        frame "Write" {
          Open Or Create Or Replace File(error in=$"Error In", file path (use dialog)=$"Path In", operation (0:open)="replace or create") -> (error out=w16, refnum out=w17)
          Cluster To Array(cluster=$"Thorlabs Motors Serial Number In") -> (array=w18)
          Array To Spreadsheet String(array=w18, format string="%g") -> (spreadsheet string=w19)
          Concatenate Strings("Blue Motor Serial Number  Red Motor Serial Number", "\t", "\r\n", w19) -> w20
          Write To Text File(error in=w16, file (use dialog)=w17, text=w20) -> (error out=w21, refnum out=w22)
          Close File(error in=w21, refnum=w22) -> (error out=w1, path=w2)
          w3 = $"Thorlabs Motors Serial Number In"
        }
      }
      $"Path Out" <- w2
      $"Thorlabs Motors Serial Number Out" <- w3
    }
  }
  $"Error Out" <- w1
