vi "KCube Initialize and Home.gvi"   [LabVIEW NXG 5.0.0]
inputs:
  "Instrument Coms Info In": "Instrument Coms Info.gtype"
  "Error In": error
  "KCube Motor Selector": "KCube Motor Selector.gtype" = "Red Motor"
  "Debugging Cluster In": "Debugging Cluster.gtype"
outputs:
  "Instrument Coms Info Out": "Instrument Coms Info.gtype"
  "Debugging Cluster Out": "Debugging Cluster.gtype"
  "Error Out": error
types:
  T1 = cluster{"Element 1": "VISA Instr", "Element 2": string}
  "Arduino Detection cluster control.gtype" = cluster{"XZ Stage Arduino Address": "VISA Instr", "XZ Stage Arduino Detected?": bool, "Multiplexer Arduino Detected?": bool, "Multiplexer Arduino Address": "VISA Instr", "Arduinos List": T1[], "XZ Stage Log": string, "Multiplexer Log": string}
  "Thorlabs Motors Serial Number In.gtype" = cluster{"Thorlabs Blue Motor": string, "Thorlabs Red Motor": string, "Blue Motor Homed?": bool, "Red Motor Homed?": bool}
  "Instrument Coms Info.gtype" = cluster{"Arduino Coms Info": "Arduino Detection cluster control.gtype", "Photodetector Names": string[], "Keythley Address": "VISA Instr", "Photodetector Detected?": bool, "Thorlabs Motors Detected?": bool, "Keithley Detected?": bool, "Thorlabs Motors Serial Number": "Thorlabs Motors Serial Number In.gtype", "Photodetector IVI session": "Ivi IviDefault", "Flame ID": string, "Flame Detected?": bool, "Flame Wrapper ID": u64}
  "Insturment Debugging Cluster.gtype" = cluster{"Keithley": bool, "Arduinos": bool, "Thorlabs Motors": bool, "Photodetector": bool, "Flame Spectr": bool}
  "Debugging Cluster.gtype" = cluster{"Debugging mode?": bool, "Initialize App": bool, "Insturment Debugging": "Insturment Debugging Cluster.gtype"}
  "KCube Motor Selector.gtype" = enum{"Red Motor", "Blue Motor"}
uses:
  NXG_KCube_DC_Servo_Control::Utilities::Initialize Motor and Home.gvi
diagram:
  # This SubVI Initializes and Homes the KCube Thorlabs selected Motor if the Debugging Allows for it
  case ($"Error In") {
    frame Error, Default {
      w1 = $"Error In"
      w2 = $"Instrument Coms Info In"
      w3 = $"Debugging Cluster In"
    }
    frame No Error {
      Property Node(instance in=$"Debugging Cluster In") -> ("Debugging mode?"=w4, "Insturment Debugging:Thorlabs Motors"=w5, instance out=w3)
      Logical And[output inverted](w4, not w5) -> w6
      case (w6) {
        frame False, Default {
          w1 = $"Error In"
          w2 = $"Instrument Coms Info In"
        }
        frame True {
          case ($"KCube Motor Selector") {
            frame "Red Motor" {
              Property Node(instance in=$"Instrument Coms Info In") -> ("Thorlabs Motors Serial Number:Thorlabs Red Motor"=w7, "Thorlabs Motors Serial Number:Red Motor Homed?"=w8, instance out=w9)
              call "Initialize Motor and Home.gvi"(Current Motor Serial nº In=w7, Homed? In=w8, Error In=$"Error In") -> (Homed? Out=w10, Error Out=w1)
              Property Node(instance in=w9, "Thorlabs Motors Serial Number:Red Motor Homed?"=w10) -> (instance out=w2)
            }
            frame "Blue Motor", Default {
              Property Node(instance in=$"Instrument Coms Info In") -> ("Thorlabs Motors Serial Number:Thorlabs Blue Motor"=w11, "Thorlabs Motors Serial Number:Blue Motor Homed?"=w12, instance out=w13)
              call "Initialize Motor and Home.gvi"(Current Motor Serial nº In=w11, Homed? In=w12, Error In=$"Error In") -> (Homed? Out=w14, Error Out=w1)
              Property Node(instance in=w13, "Thorlabs Motors Serial Number:Blue Motor Homed?"=w14) -> (instance out=w2)
            }
          }
        }
      }
    }
  }
  $"Debugging Cluster Out" <- w3
  $"Instrument Coms Info Out" <- w2
  $"Error Out" <- w1
