vi "KCube Motor Single Move to Position.gvi"   [LabVIEW NXG 5.0.0]
inputs:
  "Error In": error
  "KCube Motor Selector": "KCube Motor Selector.gtype" = "Red Motor"
  "Instrument Coms Info In": "Instrument Coms Info.gtype"
  "Motor Position to move to (mm)": f64
  "Debugging Cluster In": "Debugging Cluster.gtype"
outputs:
  "Error Out": error
  "Instrument Coms Info Out": "Instrument Coms Info.gtype"
  "Debugging Cluster Out": "Debugging Cluster.gtype"
types:
  T1 = cluster{"Element 1": "VISA Instr", "Element 2": string}
  "Arduino Detection cluster control.gtype" = cluster{"XZ Stage Arduino Address": "VISA Instr", "XZ Stage Arduino Detected?": bool, "Multiplexer Arduino Detected?": bool, "Multiplexer Arduino Address": "VISA Instr", "Arduinos List": T1[], "XZ Stage Log": string, "Multiplexer Log": string}
  "Thorlabs Motors Serial Number In.gtype" = cluster{"Thorlabs Blue Motor": string, "Thorlabs Red Motor": string, "Blue Motor Homed?": bool, "Red Motor Homed?": bool}
  "Instrument Coms Info.gtype" = cluster{"Arduino Coms Info": "Arduino Detection cluster control.gtype", "Photodetector Names": string[], "Keythley Address": "VISA Instr", "Photodetector Detected?": bool, "Thorlabs Motors Detected?": bool, "Keithley Detected?": bool, "Thorlabs Motors Serial Number": "Thorlabs Motors Serial Number In.gtype", "Photodetector IVI session": "Ivi IviDefault"}
  "Insturment Debugging Cluster.gtype" = cluster{"Keithley": bool, "Arduinos": bool, "Thorlabs Motors": bool, "Photodetector": bool}
  "Debugging Cluster.gtype" = cluster{"Debugging mode?": bool, "Initialize App": bool, "Insturment Debugging": "Insturment Debugging Cluster.gtype"}
  "KCube Motor Selector.gtype" = enum{"Red Motor", "Blue Motor"}
uses:
  NXG_KCube_DC_Servo_Control::Utilities::Move To Position.gvi
diagram:
  # This SubVI Writes the desired position onto the Specified Motor If the Debugging Allows for it
  case ($"Error In") {
    frame Error, Default {
      w1 = $"Error In"
      w2 = $"Instrument Coms Info In"
      w3 = $"Debugging Cluster In"
    }
    frame No Error {
      Property Node(instance in=$"Debugging Cluster In") -> ("Debugging mode?"=w4, "Insturment Debugging:Thorlabs Motors"=w5, instance out=w3)
      Logical And[output inverted](w4, not w5) -> w6
      case (w6) {
        frame False, Default {
          w1 = $"Error In"
          w2 = $"Instrument Coms Info In"
        }
        frame True {
          Property Node(instance in=$"Instrument Coms Info In") -> ("Thorlabs Motors Serial Number:Thorlabs Blue Motor"=w7, "Thorlabs Motors Serial Number:Thorlabs Red Motor"=w8, instance out=w2)
          case ($"KCube Motor Selector") {
            frame "Blue Motor" {
              call "Move To Position.gvi"(Motor Serial Number In=w7, Position to move in mm=$"Motor Position to move to (mm)", Error In=$"Error In") -> (Error Out=w1)
            }
            frame "Red Motor" {
              call "Move To Position.gvi"(Motor Serial Number In=w8, Position to move in mm=$"Motor Position to move to (mm)", Error In=$"Error In") -> (Error Out=w1)
            }
          }
        }
      }
    }
  }
  $"Error Out" <- w1
  $"Instrument Coms Info Out" <- w2
  $"Debugging Cluster Out" <- w3
