vi "KCube Motors Full Movement.gvi"   [LabVIEW NXG 5.0.0]
inputs:
  "Error In": error
  "Instrument Coms Info In": "Instrument Coms Info.gtype"
  "Need Homing?": bool
  "KCube Coordinates": "KCube Coordinates.gtype"
outputs:
  "Error Out": error
  "Instrument Coms Info Out": "Instrument Coms Info.gtype"
types:
  T1 = cluster{"Element 1": "VISA Instr", "Element 2": string}
  "Arduino Detection cluster control.gtype" = cluster{"XZ Stage Arduino Address": "VISA Instr", "XZ Stage Arduino Detected?": bool, "Multiplexer Arduino Detected?": bool, "Multiplexer Arduino Address": "VISA Instr", "Arduinos List": T1[], "XZ Stage Log": string, "Multiplexer Log": string}
  "Thorlabs Motors Serial Number In.gtype" = cluster{"Thorlabs Blue Motor": string, "Thorlabs Red Motor": string}
  "Instrument Coms Info.gtype" = cluster{"Arduino Coms Info": "Arduino Detection cluster control.gtype", "Photodetector Names": string[], "Keythley Address": "VISA Instr", "Photodetector Detected?": bool, "Thorlabs Motors Detected?": bool, "Keithley Detected?": bool, "Thorlabs Motors Serial Number": "Thorlabs Motors Serial Number In.gtype", "Photodetector IVI session": "Ivi IviDefault"}
  "KCube Coordinates.gtype" = cluster{"Blue Motor Position to move to (mm)": f64, "Red Motor Position to move to (mm)": f64}
uses:
  Rainbow Measurement Setup::Side Functions::Instrument Control::Thorlabs Motors::Movement::KCube Motors Initialize.gvi
  Rainbow Measurement Setup::Side Functions::Instrument Control::Thorlabs Motors::Movement::KCube Motors Home sequence.gvi
  Rainbow Measurement Setup::Side Functions::Instrument Control::Thorlabs Motors::Movement::KCube Motors Move to Position.gvi
  Rainbow Measurement Setup::Side Functions::Instrument Control::Thorlabs Motors::Movement::KCube Motors Close.gvi
diagram:
  case ($"Error In") {
    frame Error, Default {
      w1 = $"Error In"
      w2 = $"Instrument Coms Info In"
    }
    frame No Error {
      call "KCube Motors Initialize.gvi"(Instrument Coms Info In=$"Instrument Coms Info In", Error In=$"Error In") -> (Instrument Address Cluster Out=w3, Error Out=w4)
      case ($"Need Homing?") {
        frame False, Default {
          w5 = w4
          w6 = w3
        }
        frame True {
          call "KCube Motors Home sequence.gvi"(Instrument Coms Info In=w3, Error In=w4) -> (Instrument Coms Info Out=w6, Error Out=w5)
        }
      }
      Property Node(instance in=$"KCube Coordinates") -> ("Blue Motor Position to move to (mm)"=w7, "Red Motor Position to move to (mm)"=w8)
      call "KCube Motors Move to Position.gvi"(Instrument Coms Info In=w6, Blue Motor Position to move to (mm)=w7, Red Motor Position to move to (mm)=w8, Error In=w5) -> (Instrument Coms Info Out=w9, Error Out=w10)
      call "KCube Motors Close.gvi"(Instrument Coms Info In=w9, Error In=w10) -> (Instrument Coms Info Out=w2, Error Out=w1)
    }
  }
  $"Instrument Coms Info Out" <- w2
  $"Error Out" <- w1
