vi "KCube Motors Move to Position.gvi"   [LabVIEW NXG 5.0.0]
inputs:
  "Error In": error
  "Blue Motor Position to move to (mm)": f64
  "Instrument Coms Info In": "Instrument Coms Info.gtype"
  "Red Motor Position to move to (mm)": f64
outputs:
  "Error Out": error
  "Instrument Coms Info Out": "Instrument Coms Info.gtype"
types:
  T1 = cluster{"Element 1": "VISA Instr", "Element 2": string}
  "Arduino Detection cluster control.gtype" = cluster{"XZ Stage Arduino Address": "VISA Instr", "XZ Stage Arduino Detected?": bool, "Multiplexer Arduino Detected?": bool, "Multiplexer Arduino Address": "VISA Instr", "Arduinos List": T1[], "XZ Stage Log": string, "Multiplexer Log": string}
  "Thorlabs Motors Serial Number In.gtype" = cluster{"Thorlabs Blue Motor": string, "Thorlabs Red Motor": string, "Blue Motor Homed?": bool, "Red Motor Homed?": bool}
  "Instrument Coms Info.gtype" = cluster{"Arduino Coms Info": "Arduino Detection cluster control.gtype", "Photodetector Names": string[], "Keythley Address": "VISA Instr", "Photodetector Detected?": bool, "Thorlabs Motors Detected?": bool, "Keithley Detected?": bool, "Thorlabs Motors Serial Number": "Thorlabs Motors Serial Number In.gtype", "Photodetector IVI session": "Ivi IviDefault"}
uses:
  NXG_KCube_DC_Servo_Control::Utilities::Move To Position.gvi
diagram:
  # This SubVI Writes the desired position onto the motors
  case ($"Error In") {
    frame Error, Default {
      w1 = $"Error In"
      w2 = $"Instrument Coms Info In"
    }
    frame No Error {
      Property Node(instance in=$"Instrument Coms Info In") -> ("Thorlabs Motors Serial Number:Thorlabs Blue Motor"=w3, "Thorlabs Motors Serial Number:Thorlabs Red Motor"=w4, instance out=w2)
      call "Move To Position.gvi"(Motor Serial Number In=w3, Position to move in mm=$"Blue Motor Position to move to (mm)", Error In=$"Error In") -> (Error Out=w5)
      call "Move To Position.gvi"(Motor Serial Number In=w4, Position to move in mm=$"Red Motor Position to move to (mm)", Error In=w5) -> (Error Out=w1)
    }
  }
  $"Instrument Coms Info Out" <- w2
  $"Error Out" <- w1
