vi "Thorlabs Serial Number Check.gvi"   [LabVIEW NXG 3.1.0]
inputs:
  "Error In": error
outputs:
  "Error Out": error
  "Thorlabs Motors Serial Number Out": "Thorlabs Motors Serial Number In.gtype"
  "Thorlabs Motor Serial Number File Path Out": path
types:
  "Thorlabs Motors Serial Number In.gtype" = cluster{"Thorlabs Blue Motor": string, "Thorlabs Red Motor": string}
uses:
  NI::G Core::File IO (General)::Check if File or Folder Exists.gvi
  Rainbow Measurement Setup::Side Functions::Messages And Prompts::Select file prompt.gvi
  Rainbow Measurement Setup::Side Functions::Instrument Control::Thorlabs Motors::Thorlabs motor Detector.gvi
  NI::G Core::Strings::1D String Array to Delimited String.gvi
  NI::G Core::File IO (General)::Create Directory Recursive.gvi
  Rainbow Measurement Setup::Side Functions::Instrument Control::Thorlabs Motors::Modify Thorlabs File.gvi
diagram:
  # This SubVI Checks if there is any Thorlabs Motor Serial Number reference file. If there is it just reads and outputs the serial numbers for the red and blue motors. If there isn't it prompts the user with various options:
  # They can either create it themselves, they can locate the file elsewhere or a new file can be created with the currently connected motors. It is VERY IMPORTANT that if one chooses the latter option ONLY 2 motors are
  # connected and no active simulations are in place, otherwise the stored serial numbers will be wrong and they will have to be modified.
  case ($"Error In") {
    frame Error, Default {
      w1 = $"Error In"
    }
    frame No Error {
      Get Component Directory() -> (Path=w2)
      Strip Path(path=w2) -> (stripped path=w3)
      Build Path(base path=w3, name or relative path="Extra installers\\Thorlabs_Motors_Serial_Number.txt") -> (appended path=w4)
      s1 = w4  # shift register
      while (iteration -> i1) {
        Wait Until Next Multiple(multiple to wait=500)
        call "Check if File or Folder Exists.gvi"(file or folder=s1, error in=$"Error In") -> (file or folder exists?=w5, error out=w6)
        case (w5) {
          frame False, Default {
            Path To String(path=s1) -> (string=w10)
            w11 = "I could not find the Thorlabs_Motors_Serial_Number file in \nthis location:\n"
            w12 = """
Please make sure that the file is put back on that
location, provide an alternative path with the file or,
if you want, we can generate a file with the currently
detected Motor Serial Number Values."""
            Concatenate Strings(w11, w10, w12) -> w13
            w14 = "I will make sure\nthe file is placed\nback where it \nbelongs"
            Three Button Dialog(Allow user to close window? (TRUE)=FALSE, Center Button Text ("No")=w14, Left Button Text ("Yes")="I will provide an\nalternative path", Right Button Text ("Cancel")="Create a New File, i\ndo not know where the\nother is.", Window Title (" ")="Thorlabs_Motors_Serial_Number.txt not found", message=w13) -> (Which Button?=w15)
            case (w15) {
              frame "center button" {
                Wait Until Next Multiple(multiple to wait=20000)
                w8 = w6
                w9 = s1
              }
              frame "left button", Default {
                call "Select file prompt.gvi"(Main Message="Please select the Thorlabs_Motors_Serial_Number.txt file.", Sub message="It is usually on the extra installers folder", Error In=w6) -> (New Path=w9, Error Out=w8)
              }
              frame "right button" {
                call "Thorlabs motor Detector.gvi"(First Write Detection=TRUE, Prompt Iterations=2, Error In=w6) -> (Thorlabs Motor Serial Nº Array=w16, Detected?=w17, Error Out=w18)
                case (w17) {
                  frame False, Default {
                    w19 = """We have not detected any
motors, please make sure you
have properly connected them
before asking to create a file with
the currently detected Motor Serial
Number Values."""
                    One Button Dialog(button name ("OK")="Sorry I did not realise", message=w19)
                    w9 = s1
                    w8 = w18
                  }
                  frame True {
                    call "1D String Array to Delimited String.gvi"(string array=w16, delimiter=", ") -> (delimited string=w20)
                    w21 = """
Are you SURE that these are the correct Serial
Numbers and you want to store them for future
use?
(You can always manually modify them in case 
of changing the motors or if they have been reversed)"""
                    Concatenate Strings("These are the connected Motors Serial Number.\n", w20, w21) -> w22
                    Two Button Dialog(F button name ("Cancel")="No please these are not the\ncorrect serial numbers", T button name ("OK")="Yes, I am certain", message=w22) -> (T Button?=w23)
                    case (w23) {
                      frame False, Default {
                        w24 = "Then either create the file yourself \nor connect the right motors please."
                        One Button Dialog(button name ("OK")="Okay sorry.", message=w24)
                        w9 = s1
                        w8 = w18
                      }
                      frame True {
                        Array Index(array=w16) -> (out0[0]=w25, out1[1]=w26)
                        Property Node(instance in="Thorlabs Motors Serial Number In.gtype" {all zero or empty}, "Thorlabs Blue Motor"=w25, "Thorlabs Red Motor"=w26) -> (instance out=w27)
                        Strip Path(path=s1) -> (stripped path=w28)
                        call "Create Directory Recursive.gvi"(folder=w28, error in=w18) -> (error out=w29)
                        call "Modify Thorlabs File.gvi"(Path In=s1, Thorlabs Motor Serial Number File Operations="Write", Thorlabs Motors Serial Number In=w27, Error In=w29) -> (Path Out=w9, Error Out=w8)
                      }
                    }
                  }
                }
              }
            }
            w7 = FALSE
          }
          frame True {
            w7 = TRUE
            w8 = w6
            w9 = s1
          }
        }
        Is Greater(x=i1, y=5) -> w30
        case (w30) {
          frame False, Default {
            w31 = w8
            w32 = FALSE
          }
          frame True {
            w33 = """Seems you're having some trouble
finding the Thorlabs_Motors_Serial_Number.txt
file, do you want to proceed without it
and hope for the best?
(WARNING: some functionalities might
be compromized, or the entire program 
can crash)"""
            Two Button Dialog(F button name ("Cancel")="Oh dear no, I'd rather ask for help", T button name ("OK")="Yes please, I like to live dangerously", message=w33) -> (T Button?=w32)
            w31 = w8
          }
        }
        Logical Or(w32, w7) -> w34
        next s1 = w9
        stop if w34
      }
      call "Modify Thorlabs File.gvi"(Path In=s1, Thorlabs Motor Serial Number File Operations="Read", Error In=w31) -> (Path Out=w35, Thorlabs Motors Serial Number Out=w36, Error Out=w1)
      $"Thorlabs Motor Serial Number File Path Out" <- w35
      $"Thorlabs Motors Serial Number Out" <- w36
    }
  }
  $"Error Out" <- w1
