vi "Beating Star.gvi"   [LabVIEW NXG 3.1.0]
inputs:
  "Input": "Path reference"
  "loop iteration": i32
  "Speed Divider": f64 = 10
outputs:
  "sin": f64
diagram:
  w1 = cluster{"Width": f32, "Height": f32} {"Width"=10, "Height"=10}
  Divide(x=$"loop iteration", y=$"Speed Divider") -> w2
  Sine(x=w2) -> w3
  Square(x=w3) -> w4
  Multiply(w4, 20) -> w5
  Add(w5, 10) -> w6
  Property Node(instance in=w1, "Width"=w6, "Height"=w6) -> (instance out=w7)
  Sign(number=w3) -> (-1, 0, 1=w8)
  Is Less Or Equal To 0(x=w8) -> w9
  Select(s=w9, t=30, f=10) -> w10
  Multiply(w4, w10, w8) -> w11
  Add(400, w11) -> w12
  Property Node(instance in=cluster{"Left": f32, "Top": f32} {"Left"=400, "Top"=70}, "Left"=w12) -> (instance out=w13)
  Property Node(instance in=$Input, "Size"=w7, "Position"=w13)
  $sin <- w6
