vi "FGV Repeat Operation for all following files.gvi"   [LabVIEW NXG 5.0.0]
inputs:
  "Error In": error
  "FGV Instructions": "General FGV Instructions.gtype" = "Read State", required
  "Used File Operation": "Existing File Instruction.gtype" = "Replace"
outputs:
  "Error Out": error
  "File Operation": "Existing File Instruction.gtype"
  "Prompt?": bool
types:
  "General FGV Instructions.gtype" = enum{"Read State", "Set State", "Reset State"}
  "Existing File Instruction.gtype" = enum{"Replace", "Rename", "Do not save"}
diagram:
  # This FGV takes the times a person has been prompted and if it is greater than 5 for
  # a single loop it stops prompting and starts using the same operation for all files
  case ($"Error In") {
    frame Error, Default {
      w1 = $"Error In"
    }
    frame No Error {
      s1 = uninitialised  # shift register
      s2 = uninitialised  # shift register
      while {
        case ($"FGV Instructions") {
          frame "Read State", Default {
            Is Less(x=s1, y=5) -> w4
            $"Prompt?" <- w4
            $"File Operation" <- s2
            w2 = s1
            w3 = s2
          }
          frame "Set State" {
            Increment(x=s1) -> w2
            w3 = $"Used File Operation"
          }
          frame "Reset State" {
            w2 = 0
            w3 = "Rename"
          }
        }
        next s1 = w2
        next s2 = w3
        stop if TRUE
      }
      w1 = $"Error In"
    }
  }
  $"Error Out" <- w1
