vi "General Failed Loop Prompt.gvi"   [LabVIEW NXG 5.0.0]
inputs:
  "Error In": error
  "Succesful loop?": bool
  "Failed Loop Message": string = """It seems like the KCube Motors
are having some problems homing.
Make sure the connections are still
okay and they are powered on. 
(You might have to restart the software)"""
  "Failed Loop Messager Response": string = "Okay I will"
  "General Failed Loop Prompt Call to Action Selector": "General Failed Loop Prompt Call to Action Selector.gtype" = "Two Button Action"
  "Call to action Iterations": i32 = 2
  "Loop Iterations": i32 = 2
  "Call to Action Message": string = """Seems you're having some trouble
connecting the thorlabs motors, do you 
want to proceed without connecting them
and hope for the best?
(WARNING: some functionalities might
be compromized)"""
  "Call To Action True / Left Answer": string = "Yes please, I like to live dangerously"
  "Call To Action False / Center Answer": string = "Oh dear no, I'd rather ask for help"
  "Right Answer": string = "Okay I will"
outputs:
  "Error Out": error
  "Call To Action Boolean Answer": bool
  "Call to Action Answer": T1
types:
  "General Failed Loop Prompt Call to Action Selector.gtype" = enum{"Two Button Action", "Three Button Action"}
  T1 = enum{"left button", "center button", "right button", "window close"}
diagram:
  # This subVI is a generalized prompt generator that automatically takes into account if the loop has failed
  # and if it fails multiple times it offers different custom options.
  case ($"Error In") {
    frame Error, Default {
      w1 = $"Error In"
      w2 = FALSE
      w3 = "left button"
    }
    frame No Error {
      case ($"Succesful loop?") {
        frame True { }
        frame False {
          One Button Dialog(button name ("OK")=$"Failed Loop Messager Response", message=$"Failed Loop Message")
        }
      }
      Is Greater(x=$"Loop Iterations", y=$"Call to action Iterations") -> w4
      case ($"General Failed Loop Prompt Call to Action Selector") {
        frame "Two Button Action", Default {
          case (w4) {
            frame False {
              w2 = FALSE
            }
            frame True {
              Two Button Dialog(F button name ("Cancel")=$"Call To Action False / Center Answer", T button name ("OK")=$"Call To Action True / Left Answer", message=$"Call to Action Message") -> (T Button?=w2)
            }
          }
          w3 = "left button"
        }
        frame "Three Button Action" {
          case (w4) {
            frame False {
              w2 = FALSE
              w3 = "left button"
            }
            frame True {
              Three Button Dialog(Allow user to close window? (TRUE)=FALSE, Center Button Text ("No")=$"Call To Action False / Center Answer", Left Button Text ("Yes")=$"Call To Action True / Left Answer", Right Button Text ("Cancel")=$"Right Answer", Window Title (" ")="Huston, We have a problem", message=$"Call to Action Message") -> (Which Button?=w3)
              w2 = FALSE
            }
          }
        }
      }
      w1 = $"Error In"
    }
  }
  $"Error Out" <- w1
  $"Call To Action Boolean Answer" <- w2
  $"Call to Action Answer" <- w3
