vi "Input Value Prompt.gvi"   [LabVIEW NXG 5.0.0]
inputs:
  "Main Message": string = "Please select the required file"
  "Sub message": string = "Somebody forgot to program what file it was :3"
  "Error In": error
  "Old Value": f64
outputs:
  "Error Out": error
  "New Value Out": f64
panel controls:
  "New Value": f64
  "Okay": bool
diagram:
  case ($"Error In") {
    frame Error, Default {
      w1 = $"Error In"
    }
    frame No Error {
      Concatenate Strings($"Sub message", "\r\n") -> w2
      Format Into String(initString=w2, errIn=$"Error In", $"Old Value") -> (errOut=w3)
      Is Empty String Or Path(string/path=$"Sub message") -> w4
      Select(s=w4, t="Somebody forgot to insert the old value.", f=$"Sub message") -> w5
      Property Node(instance in=reference to unnamed text, "Text"=w5, error in=w3) -> (error out=w6)
      Is Empty String Or Path(string/path=$"Main Message") -> w7
      Select(s=w7, t="Please instert the new value for the selected variable.", f=$"Main Message") -> w8
      Property Node(instance in=reference to unnamed text, "Text"=w8, error in=w6) -> (error out=w9)
      Property Node(instance in=reference to unnamed native front panel, error in=w9) -> ("Window"=w10, error out=w11)
      Open Window(reference in=w10, error in=w11) -> (reference out=w12, error out=w13)
      while {
        w14 = $"New Value"
        Is Equal(x=$"Old Value", y=w14) -> w15
        Logical And(w15, $Okay) -> w16
        case (w16) {
          frame False, Default { }
          frame True {
            One Button Dialog(button name ("OK")="Oh sorry", message="The value cannot be the same as before :D")
          }
        }
        Wait Until Next Multiple(multiple to wait=50)
        Not(x=w15) -> w17
        Logical And(w17, $Okay) -> w18
        stop if w18
      }
      $"New Value Out" <- w14
      Close Window(reference in=w12, error in=w13) -> (error out=w1)
    }
  }
  $"Error Out" <- w1
