vi "Select path prompt.gvi"   [LabVIEW NXG 5.0.0]
inputs:
  "Main Message": string = "Please specify a path"
  "Sub message": string = "Somebody forgot to program which path it was"
  "Error In": error
  "Cancel Available?": bool
outputs:
  "Error Out": error
  "New Path": path
  "Cancelled?": bool
panel controls:
  "Path where to save files": path
  "Okay": bool
  "Cancel": bool
diagram:
  # This SubVI Prompts the user to input a generic path, checks if it is empty and does not allow to accept the
  # path as valid if it is empty. It also has the option to cancel the selection if specified and it outputs a cancelled
  # flag as a result.
  case ($"Error In") {
    frame Error, Default {
      w1 = $"Error In"
      w2 = default
    }
    frame No Error {
      Is Empty String Or Path(string/path=$"Main Message") -> w3
      Select(s=w3, t="Please specify a path", f=$"Main Message") -> w4
      Property Node(instance in=reference to "Cancel", "Visible"=$"Cancel Available?", error in=$"Error In") -> (error out=w5)
      Is Empty String Or Path(string/path=$"Sub message") -> w6
      Select(s=w6, t="Somebody forgot to program which path it was", f=$"Sub message") -> w7
      Property Node(instance in=reference to unnamed text, "Text"=w7, error in=w5) -> (error out=w8)
      Property Node(instance in=reference to unnamed text, "Text"=w4, error in=w8) -> (error out=w9)
      Property Node(instance in=reference to unnamed native front panel, error in=w9) -> ("Window"=w10, error out=w11)
      Open Window(reference in=w10, error in=w11) -> (reference out=w12, error out=w13)
      while {
        w14 = $"Path where to save files"
        Is Empty String Or Path(string/path=w14) -> w15
        Not(x=w15) -> w16
        Logical And(w16, $Okay) -> w17
        w18 = $Cancel
        Logical Or(w17, w18) -> w19
        Logical And(w15, $Okay) -> w20
        case (w20) {
          frame False, Default { }
          frame True {
            One Button Dialog(button name ("OK")="Oh sorry, I wanted to save\nmy files in the void of space", message="The path cannot be EMPTY,\nthanks:)")
          }
        }
        Wait Until Next Multiple(multiple to wait=50)
        stop if w19
      }
      $"New Path" <- w14
      Close Window(reference in=w12, error in=w13) -> (error out=w1)
      w2 = w18
    }
  }
  $"Cancelled?" <- w2
  $"Error Out" <- w1
