vi "Check Default Path subroutine.gvi"   [LabVIEW NXG 5.0.0]
inputs:
  "Default Data Saving Location Path In": path
  "Misc Data Mega Cluster In": "Misc Data Mega Cluster.gtype"
  "Error In": error
outputs:
  "Default Data Saving Location Path Out": path
  "Misc Data Mega Cluster Out": "Misc Data Mega Cluster.gtype"
  "Error Out": error
types:
  "Full Reference Cluster.gtype" = cluster{"Enum Reference Cluster": "Enum Control Reference Cluster.gtype", "Boolean Reference Cluster": "Boolean Control Reference Cluster.gtype", "Numeric Reference Cluster": "Numeric Control Reference Cluster.gtype", "Numeric Cluster Reference Cluster": "Numeric Cluster Reference Cluster.gtype", "Path Reference Cluster": "Path Reference Cluster.gtype", "Cluster Reference Cluster": "Cluster Reference Cluster.gtype", "XZ Stage Controls Reference Cluster": "XZ Stage Controls Reference Cluster.gtype"}
  "Cell Naming Cluster.gtype" = cluster{"Cell Label": string, "Sample Prefix": string, "Author Initials": string, "Current Date": string, "Batch Name": string}
  T1 = cluster{"X Coordinate (mm)": f64, "Z Coordinate (mm)": f64}
  T2 = cluster{"X Coordinate (mm)": f64, "Z Coordinate (mm)": f64, "Vertical Spacing (mm)": f64}
  "XZ All Position Cluster.gtype" = cluster{"Diffusor Coordinates": T1, "Photodetector Coordinates": T1, "Cell R.01 Coordinates": T2}
  T3 = cluster{"Thorlabs Motor Serial Number File Path": path, "Default Data Saving Location": path}
  "Misc Data Mega Cluster.gtype" = cluster{"Full Reference Cluster": "Full Reference Cluster.gtype", "Cell Naming Cluster": "Cell Naming Cluster.gtype", "All XZ Position Cluster": "XZ All Position Cluster.gtype", "All Paths": T3}
uses:
  NI::G Core::File IO (General)::Check if File or Folder Exists.gvi
  Rainbow Measurement Setup::Side Functions::Messages And Prompts::FGV Select Default Path Prompt.gvi
  Rainbow Measurement Setup::Side Functions::Messages And Prompts::Select path prompt.gvi
diagram:
  # This SubVI checks if the provided default data path is empty or not a
  # real path and if so it prompts the user to input a new, valid path.
  # If the user has already input a path it uses the value it spored the first
  # time the user has input a new default path.
  case ($"Error In") {
    frame Error, Default {
      w1 = $"Default Data Saving Location Path In"
      w2 = $"Misc Data Mega Cluster In"
      w3 = $"Error In"
    }
    frame No Error {
      call "Check if File or Folder Exists.gvi"(file or folder=$"Default Data Saving Location Path In", error in=$"Error In") -> (file or folder exists?=w4, error out=w5)
      Is Empty String Or Path(string/path=$"Default Data Saving Location Path In") -> w6
      Logical Or(w6, not w4) -> w7
      case (w7) {
        frame False {
          w1 = $"Default Data Saving Location Path In"
          w3 = w5
          w2 = $"Misc Data Mega Cluster In"
        }
        frame True {
          call "FGV Select Default Path Prompt.gvi"(FGV Instructions="Read State", Error In=w5) -> (Already Selected Path? Out=w8, Selected Default Path Out=w9, Error Out=w10)
          case (w8) {
            frame True {
              w3 = w10
              w2 = $"Misc Data Mega Cluster In"
              w1 = w9
            }
            frame False {
              w11 = "Please specify the path where you want to save all your measurements:"
              call "Select path prompt.gvi"(Main Message=w11, Sub message="Sub paths with your name, date and device will be created", Error In=w10) -> (New Path=w1, Error Out=w12)
              Property Node(instance in=$"Misc Data Mega Cluster In", "All Paths:Default Data Saving Location"=w1) -> (instance out=w2)
              call "FGV Select Default Path Prompt.gvi"(FGV Instructions="Set State", Already Selected Path? In=TRUE, Default Selected Path=w1, Error In=w12) -> (Error Out=w3)
            }
          }
        }
      }
    }
  }
  $"Default Data Saving Location Path Out" <- w1
  $"Misc Data Mega Cluster Out" <- w2
  $"Error Out" <- w3
