vi "Create or Open Folder.gvi"   [LabVIEW NXG 5.0.0]
inputs:
  "Error In": error
  "Folder Root Path": path, required
  "Folder Name": string, required
outputs:
  "Error Out": error
  "New Folder's Path": path
uses:
  Rainbow Measurement Setup::Side Functions::Messages And Prompts::FGV Cancel Prompts until Finished Routine.gvi
  NI::G Core::File IO (General)::Check if File or Folder Exists.gvi
diagram:
  # This SubVI Checks if a folder with the provided name exists; If it does it just outputs the path of the folder if it does not exist it creates it and
  # returns the path of the newly created folder
  case ($"Error In") {
    frame Error, Default {
      w1 = $"Error In"
    }
    frame No Error {
      Is Empty String Or Path(string/path=$"Folder Name") -> w2
      case (w2) {
        frame True {
          call "FGV Cancel Prompts until Finished Routine.gvi"(Error In=$"Error In", FGV Instructions="Read State") -> (Prompt? Out=w4, Error Out=w5)
          case (w4) {
            frame False, Default {
              w1 = w5
            }
            frame True {
              w6 = """Somehow one of the folder names
ended up being blank so the files might 
be saved in weird locations, always within
the main data storage folder."""
              Two Button Dialog(F button name ("Cancel")="Okay you can stop\ntelling me this, thanks.", T button name ("OK")="Okay Sorry", message=w6) -> (T Button?=w7)
              call "FGV Cancel Prompts until Finished Routine.gvi"(Error In=w5, FGV Instructions="Set State", Prompt? In=w7) -> (Error Out=w1)
            }
          }
          w3 = $"Folder Root Path"
        }
        frame False {
          Build Path(base path=$"Folder Root Path", name or relative path=$"Folder Name") -> (appended path=w8)
          call "Check if File or Folder Exists.gvi"(file or folder=w8, error in=$"Error In") -> (file or folder exists?=w9, error out=w10)
          case (w9) {
            frame True {
              w1 = w10
              w3 = w8
            }
            frame False {
              Create Folder(error in=w10, path (use dialog)=w8) -> (created path=w3, error out=w1)
            }
          }
        }
      }
      $"New Folder's Path" <- w3
    }
  }
  $"Error Out" <- w1
