vi "File_FolderName Scan For Sweep.gvi"   [LabVIEW NXG 5.0.0]
inputs:
  "Error In": error
  "FileName/FolderName In": string
outputs:
  "Error Out": error
  "Is File/Folder sweep type?": bool
  "Filename/FolderName Out": string
  "Sweep Type": "Rainbow Sweep Types.gtype"
types:
  "Rainbow Sweep Types.gtype" = enum{"Red Sweep Closing", "Red Sweep Opening", "Blue Sweep Closing", "Blue Sweep Opening"}
uses:
  Rainbow Measurement Setup::Side Functions::Rainbow Sweep::Rainbow Types Extract_Compare.gvi
diagram:
  # This subVI takes a folder name and checks if it
  # coincides with any of the sweep type names. If it does
  # it outputs the sweep type and also a true statement.
  case ($"Error In") {
    frame Error, Default {
      w1 = default
      w2 = $"FileName/FolderName In"
      w3 = default
      w4 = $"Error In"
    }
    frame No Error {
      call "Rainbow Types Extract_Compare.gvi"(Rainbow Sweep Types="Red Sweep Closing", Error In=$"Error In") -> (Rainbow Sweep Types Array=w5, Error Out=w6)
      s1 = w6  # shift register
      for {
        w7 = each element of w5
        Format Into String(errIn=s1, w7) -> (outString=w10, errOut=w11)
        Search And Replace String(error in (no error)=w11, input string=$"FileName/FolderName In", search string=w10) -> (error out=w12, number of replacements=w13)
        Is Not Equal To 0(x=w13) -> w14
        append w14 to w8
        append w7 to w9 if w14
        next s1 = w12
      }
      Array Index(array=w9) -> (out0[0]=w1)
      Or Array Elements(Boolean array=w8) -> (logical OR=w3)
      w2 = $"FileName/FolderName In"
      w4 = s1
    }
  }
  $"Sweep Type" <- w1
  $"Filename/FolderName Out" <- w2
  $"Is File/Folder sweep type?" <- w3
  $"Error Out" <- w4
