vi "Header info merger.gvi"   [LabVIEW NXG 5.0.0]
inputs:
  "Error In": error
  "Spreadsheet String": string
  "Column info array": string[]
outputs:
  "Error Out": error
  "Header String": string
  "Spreadsheet String With Header": string
diagram:
  case ($"Error In") {
    frame Error, Default {
      w1 = $"Error In"
    }
    frame No Error {
      s1 = ""  # shift register
      for {
        w2 = each element of $"Column info array"
        Is Empty String Or Path(string/path=w2) -> w3
        case (w3) {
          frame False, Default {
            Concatenate Strings(s1, w2, "\t") -> w4
          }
          frame True {
            w4 = s1
          }
        }
        next s1 = w4
      }
      Concatenate Strings(s1, "\r\n") -> w5
      $"Header String" <- w5
      Concatenate Strings(w5, $"Spreadsheet String") -> w6
      $"Spreadsheet String With Header" <- w6
      w1 = $"Error In"
    }
  }
  $"Error Out" <- w1
