vi "Measurement File Header Generator.gvi"   [LabVIEW NXG 5.0.0]
inputs:
  "Error In": error
  "Measurement File Type": "Measurement File Type.gtype" = "Single Cell Rainbow Raw"
  "Variable Header Info": string
outputs:
  "Error Out": error
  "Header Items": string[]
types:
  "Measurement File Type.gtype" = enum{"Single Cell Rainbow Raw", "Single Cell Rainbow Refined", "Multiple Cell Rainbow Raw", "Multiple Cell Rainbow Refined", "Light Calibration Power", "Light Calibration Spectral Density", "Light Calibration Power Density", "Light Calibration Dividing Wavelength Spectrum", "Dividing Wavelength To Motor Position", "Raw Div Wav to Motr Pos Fitik File"}
diagram:
  # This SubVi generates the headers for the savefiles of each type of measurement file
  case ($"Error In") {
    frame Error, Default {
      w1 = $"Error In"
      w2 = default
    }
    frame No Error {
      case ($"Measurement File Type") {
        frame "Single Cell Rainbow Raw", Default {
          Build Array(["Voltage (V)", "Current (A)", "Current Density (A/m^2)"], $"Variable Header Info") -> w2
        }
        frame "Single Cell Rainbow Refined" {
          w3 = ["Dividing Wavelength (nm)", "Light Power Density (W/m^2)", "Jsc (A/m^2)", "Voc (V)", "FF (%)", "Efficiency (%)", "Rs (Ω · m^2)", "Rsh (Ω · m^2)"]
          w2 = w3
        }
        frame "Multiple Cell Rainbow Raw" {
          w2 = default
        }
        frame "Multiple Cell Rainbow Refined" {
          w2 = default
        }
        frame "Light Calibration Power" {
          Build Array(["Dividing Wavelength (nm)", "Power (W)"], $"Variable Header Info") -> w2
        }
        frame "Light Calibration Spectral Density" {
          w2 = ["Dividing Wavelength (nm)", "", ""]
        }
        frame "Light Calibration Dividing Wavelength Spectrum" {
          Build Array(["Dividing Wavelength (nm)", "Counts (n)"], $"Variable Header Info") -> w2
        }
        frame "Dividing Wavelength To Motor Position" {
          w4 = ["Dividing Wavelength (nm)", "Blue Motor Position (mm)", "Red Motor Position (mm)"]
          w2 = w4
        }
        frame "Light Calibration Power Density" {
          w2 = ["Dividing Wavelength (nm)", "", ""]
        }
      }
      w1 = $"Error In"
    }
  }
  $"Error Out" <- w1
  $"Header Items" <- w2
