vi "Path Already Exists prompt.gvi"   [LabVIEW NXG 5.0.0]
inputs:
  "Error In": error
  "Path to Check": path
outputs:
  "Error Out": error
  "Existing File Instruction out": "Existing File Instruction.gtype"
types:
  "Existing File Instruction.gtype" = enum{"Replace", "Rename", "Do not save"}
uses:
  NI::G Core::File IO (General)::Check if File or Folder Exists.gvi
diagram:
  # This SubVi checks if a file already exists and prompts the
  # user to decide between replacing renaming or not saving the file
  case ($"Error In") {
    frame Error, Default {
      w1 = $"Error In"
    }
    frame No Error {
      call "Check if File or Folder Exists.gvi"(file or folder=$"Path to Check", error in=$"Error In") -> (file or folder exists?=w2, error out=w3)
      case (w2) {
        frame False, Default {
          w1 = w3
          w4 = "left button"
        }
        frame True {
          w5 = "The file you're trying to save already exists, do you want to:"
          Three Button Dialog(Allow user to close window? (TRUE)=FALSE, Center Button Text ("No")="Rename the file \nso that they are both safe", Justify Message (Left)="center", Left Button Text ("Yes")="Replace the already\nexisting file!", Right Button Text ("Cancel")="Do not save the\ncurrent file", Window Title (" ")="Existing File", message=w5) -> (Which Button?=w4)
          w1 = w3
        }
      }
      case (w4) {
        frame "left button" {
          w6 = "Replace"
        }
        frame "center button", Default {
          w6 = "Do not save"
        }
        frame "right button" {
          w6 = "Rename"
        }
      }
      $"Existing File Instruction out" <- w6
    }
  }
  $"Error Out" <- w1
