vi "Path Check & Generation.gvi"   [LabVIEW NXG 5.0.0]
inputs:
  "Error In": error
  "Misc Data Mega Cluster In": "Misc Data Mega Cluster.gtype"
  "Measurement File Type": "Measurement File Type.gtype" = "Single Cell Rainbow Raw"
  "Filename to load/save": path
  "Rainbow Sweep Types": "Rainbow Sweep Types.gtype" = "Red Sweep Closing"
outputs:
  "Error Out": error
  "File path": path
  "Folder to save data": path
  "Misc Data Mega Cluster Out": "Misc Data Mega Cluster.gtype"
types:
  "Measurement File Type.gtype" = enum{"Single Cell Rainbow Raw", "Single Cell Rainbow Refined", "Multiple Cell Rainbow Raw", "Multiple Cell Rainbow Refined", "Light Calibration Power", "Light Calibration Spectral Density", "Light Calibration Power Density", "Light Calibration Dividing Wavelength Spectrum", "Dividing Wavelength To Motor Position", "Raw Div Wav to Motr Pos Fitik File"}
  "Rainbow Sweep Types.gtype" = enum{"Red Sweep Closing", "Red Sweep Opening", "Blue Sweep Closing", "Blue Sweep Opening"}
  "Full Reference Cluster.gtype" = cluster{"Enum Reference Cluster": "Enum Control Reference Cluster.gtype", "Boolean Reference Cluster": "Boolean Control Reference Cluster.gtype", "Numeric Reference Cluster": "Numeric Control Reference Cluster.gtype", "Numeric Cluster Reference Cluster": "Numeric Cluster Reference Cluster.gtype", "Path Reference Cluster": "Path Reference Cluster.gtype", "Cluster Reference Cluster": "Cluster Reference Cluster.gtype", "XZ Stage Controls Reference Cluster": "XZ Stage Controls Reference Cluster.gtype"}
  "Cell Naming Cluster.gtype" = cluster{"Cell Label": string, "Sample Prefix": string, "Author Initials": string, "Current Date": string, "Batch Name": string}
  T1 = cluster{"X Coordinate (mm)": f64, "Z Coordinate (mm)": f64}
  T2 = cluster{"X Coordinate (mm)": f64, "Z Coordinate (mm)": f64, "Vertical Spacing (mm)": f64}
  "XZ All Position Cluster.gtype" = cluster{"Diffusor Coordinates": T1, "Photodetector Coordinates": T1, "Cell R.01 Coordinates": T2}
  T3 = cluster{"Thorlabs Motor Serial Number File Path": path, "Default Data Saving Location": path}
  "Misc Data Mega Cluster.gtype" = cluster{"Full Reference Cluster": "Full Reference Cluster.gtype", "Cell Naming Cluster": "Cell Naming Cluster.gtype", "All XZ Position Cluster": "XZ All Position Cluster.gtype", "All Paths": T3}
uses:
  NI::G Core::File IO (General)::Check if File or Folder Exists.gvi
  Rainbow Measurement Setup::Side Functions::Messages And Prompts::Select path prompt.gvi
  Rainbow Measurement Setup::Side Functions::Path Manipulation::Create or Open Folder.gvi
  Rainbow Measurement Setup::Side Functions::Sample Naming::txt Extension adder.gvi
  NI::G Core::File IO (General)::Create Directory Recursive.gvi
diagram:
  # This SubVI Generates the file paths and filenames for the different types of files that will be saved
  case ($"Error In") {
    frame Error, Default {
      w1 = $"Error In"
      w2 = default
      w3 = default
      w4 = $"Misc Data Mega Cluster In"
    }
    frame No Error {
      Property Node(instance in=$"Misc Data Mega Cluster In") -> ("Cell Naming Cluster"=w5, "All Paths:Default Data Saving Location"=w6, instance out=w7)
      case ($"Measurement File Type") {
        frame "Single Cell Rainbow Raw", Default {
          call "Check if File or Folder Exists.gvi"(file or folder=w6, error in=$"Error In") -> (file or folder exists?=w8, error out=w9)
          Is Empty String Or Path(string/path=w6) -> w10
          Logical Or(w10, not w8) -> w11
          case (w11) {
            frame False {
              w3 = w6
              w12 = w9
              w4 = w7
            }
            frame True {
              w13 = "Please specify the path where you want to save all your measurements:"
              call "Select path prompt.gvi"(Main Message=w13, Sub message="Sub paths with your name, date and device will be created", Error In=w9) -> (New Path=w3, Error Out=w12)
              Property Node(instance in=w7, "All Paths:Default Data Saving Location"=w3) -> (instance out=w4)
            }
          }
          Format Into String(errIn=w12, $"Rainbow Sweep Types") -> (outString=w14, errOut=w15)
          Concatenate Strings(w14, " Raw IV Curves") -> w16
          Property Node(instance in=w5) -> ("Author Initials"=w17, "Current Date"=w18, "Batch Name"=w19, "Sample Prefix"=w20, "Cell Label"=w21)
          Concatenate Strings("Device ", w19) -> w22
          call "Create or Open Folder.gvi"(Folder Root Path=w3, Folder Name=w17, Error In=w15) -> (New Folder's Path=w23, Error Out=w24)
          call "Create or Open Folder.gvi"(Folder Root Path=w23, Folder Name=w18, Error In=w24) -> (New Folder's Path=w25, Error Out=w26)
          call "Create or Open Folder.gvi"(Folder Root Path=w25, Folder Name=w22, Error In=w26) -> (New Folder's Path=w27, Error Out=w28)
          call "Create or Open Folder.gvi"(Folder Root Path=w27, Folder Name="TXT files", Error In=w28) -> (New Folder's Path=w29, Error Out=w30)
          call "Create or Open Folder.gvi"(Folder Root Path=w29, Folder Name=w21, Error In=w30) -> (New Folder's Path=w31, Error Out=w32)
          call "Create or Open Folder.gvi"(Folder Root Path=w31, Folder Name=w16, Error In=w32) -> (New Folder's Path=w33, Error Out=w34)
          call "txt Extension adder.gvi"(Name without .txt=w20, Error In=w34) -> (Name with .txt=w35, Error Out=w1)
          Build Path(base path=w33, name or relative path=w35) -> (appended path=w2)
        }
        frame "Single Cell Rainbow Refined" {
          Property Node(instance in=w5) -> ("Author Initials"=w36, "Current Date"=w37, "Batch Name"=w38, "Cell Label"=w39, "Sample Prefix"=w40)
          call "Check if File or Folder Exists.gvi"(file or folder=w6, error in=$"Error In") -> (file or folder exists?=w41, error out=w42)
          Is Empty String Or Path(string/path=w6) -> w43
          Logical Or(w43, not w41) -> w44
          case (w44) {
            frame False {
              w3 = w6
              w45 = w42
              w4 = w7
            }
            frame True {
              w46 = "Please specify the path where you want to save all your measurements:"
              call "Select path prompt.gvi"(Main Message=w46, Sub message="Sub paths with your name, date and device will be created", Error In=w42) -> (New Path=w3, Error Out=w45)
              Property Node(instance in=w7, "All Paths:Default Data Saving Location"=w3) -> (instance out=w4)
            }
          }
          Format Into String(errIn=w45, $"Rainbow Sweep Types") -> (outString=w47, errOut=w48)
          call "Create or Open Folder.gvi"(Folder Root Path=w3, Folder Name=w36, Error In=w48) -> (New Folder's Path=w49, Error Out=w50)
          call "Create or Open Folder.gvi"(Folder Root Path=w49, Folder Name=w37, Error In=w50) -> (New Folder's Path=w51, Error Out=w52)
          Concatenate Strings("Device ", w38) -> w53
          call "Create or Open Folder.gvi"(Folder Root Path=w51, Folder Name=w53, Error In=w52) -> (New Folder's Path=w54, Error Out=w55)
          call "Create or Open Folder.gvi"(Folder Root Path=w54, Folder Name="TXT files", Error In=w55) -> (New Folder's Path=w56, Error Out=w57)
          call "Create or Open Folder.gvi"(Folder Root Path=w56, Folder Name=w39, Error In=w57) -> (New Folder's Path=w58, Error Out=w59)
          Concatenate Strings(w40, ".", w47) -> w60
          call "txt Extension adder.gvi"(Name without .txt=w60, Error In=w59) -> (Name with .txt=w61, Error Out=w1)
          Build Path(base path=w58, name or relative path=w61) -> (appended path=w2)
        }
        frame "Light Calibration Power" {
          Property Node(instance in=w5) -> ("Author Initials"=w62, "Current Date"=w63, "Batch Name"=w64, "Sample Prefix"=w65)
          call "Check if File or Folder Exists.gvi"(file or folder=w6, error in=$"Error In") -> (file or folder exists?=w66, error out=w67)
          Is Empty String Or Path(string/path=w6) -> w68
          Logical Or(w68, not w66) -> w69
          case (w69) {
            frame False {
              w3 = w6
              w70 = w67
              w4 = w7
            }
            frame True {
              w71 = "Please specify the path where you want to save all your measurements:"
              call "Select path prompt.gvi"(Main Message=w71, Sub message="Sub paths with your name, date and device will be created", Error In=w67) -> (New Path=w3, Error Out=w70)
              Property Node(instance in=w7, "All Paths:Default Data Saving Location"=w3) -> (instance out=w4)
            }
          }
          Format Into String(errIn=w70, $"Rainbow Sweep Types") -> (outString=w72, errOut=w73)
          call "Create or Open Folder.gvi"(Folder Root Path=w3, Folder Name=w62, Error In=w73) -> (New Folder's Path=w74, Error Out=w75)
          call "Create or Open Folder.gvi"(Folder Root Path=w74, Folder Name=w63, Error In=w75) -> (New Folder's Path=w76, Error Out=w77)
          Concatenate Strings("Device ", w64) -> w78
          call "Create or Open Folder.gvi"(Folder Root Path=w76, Folder Name=w78, Error In=w77) -> (New Folder's Path=w79, Error Out=w80)
          call "Create or Open Folder.gvi"(Folder Root Path=w79, Folder Name="TXT files", Error In=w80) -> (New Folder's Path=w81, Error Out=w82)
          Concatenate Strings(w65, "Power_Calibration_", w72) -> w83
          call "txt Extension adder.gvi"(Name without .txt=w83, Error In=w82) -> (Name with .txt=w84, Error Out=w1)
          Build Path(base path=w81, name or relative path=w84) -> (appended path=w2)
        }
        frame "Light Calibration Spectral Density" {
          Get Component Directory() -> (Path=w85)
          Strip Path(path=w85) -> (stripped path=w86)
          Build Path(base path=w86, name or relative path="Extra installers\\Calibration_Files") -> (appended path=w87)
          call "Check if File or Folder Exists.gvi"(file or folder=w87, error in=$"Error In") -> (file or folder exists?=w88, error out=w89)
          Is Empty String Or Path(string/path=w87) -> w90
          Logical Or(w90, not w88) -> w91
          case (w91) {
            frame False {
              w3 = w87
              w92 = w89
            }
            frame True {
              call "Create Directory Recursive.gvi"(folder=w87, error in=w89) -> (error out=w92)
              w3 = w87
            }
          }
          call "txt Extension adder.gvi"(Name without .txt="Spectral_Density_Calibration", Error In=w92) -> (Name with .txt=w93, Error Out=w1)
          Build Path(base path=w3, name or relative path=w93) -> (appended path=w2)
          w4 = w7
        }
        frame "Light Calibration Power Density" {
          Get Component Directory() -> (Path=w94)
          Strip Path(path=w94) -> (stripped path=w95)
          Build Path(base path=w95, name or relative path="Extra installers\\Calibration_Files") -> (appended path=w96)
          call "Check if File or Folder Exists.gvi"(file or folder=w96, error in=$"Error In") -> (file or folder exists?=w97, error out=w98)
          Is Empty String Or Path(string/path=w96) -> w99
          Logical Or(w99, not w97) -> w100
          case (w100) {
            frame False {
              w3 = w96
              w101 = w98
            }
            frame True {
              call "Create Directory Recursive.gvi"(folder=w96, error in=w98) -> (error out=w101)
              w3 = w96
            }
          }
          call "txt Extension adder.gvi"(Name without .txt="Power_Density_Calibration", Error In=w101) -> (Name with .txt=w102, Error Out=w1)
          Build Path(base path=w3, name or relative path=w102) -> (appended path=w2)
          w4 = w7
        }
        frame "Light Calibration Dividing Wavelength Spectrum" {
          Strip Path(path=$"Filename to load/save") -> (stripped path=w3)
          w1 = $"Error In"
          w2 = $"Filename to load/save"
          w4 = w7
        }
        frame "Dividing Wavelength To Motor Position" {
          Get Component Directory() -> (Path=w103)
          Strip Path(path=w103) -> (stripped path=w104)
          Build Path(base path=w104, name or relative path="Extra installers\\Calibration_Files\\Div_Wav_To_Motor_Pos") -> (appended path=w105)
          call "Check if File or Folder Exists.gvi"(file or folder=w105, error in=$"Error In") -> (file or folder exists?=w106, error out=w107)
          Is Empty String Or Path(string/path=w105) -> w108
          Logical Or(w108, not w106) -> w109
          case (w109) {
            frame False {
              w3 = w105
              w110 = w107
            }
            frame True {
              call "Create Directory Recursive.gvi"(folder=w105, error in=w107) -> (error out=w110)
              w3 = w105
            }
          }
          call "txt Extension adder.gvi"(Name without .txt="Dividing Wavelength To Motor Position Calibration File", Error In=w110) -> (Name with .txt=w111, Error Out=w1)
          Build Path(base path=w3, name or relative path=w111) -> (appended path=w2)
          w4 = w7
        }
      }
    }
  }
  $"Misc Data Mega Cluster Out" <- w4
  $"Folder to save data" <- w3
  $"File path" <- w2
  $"Error Out" <- w1
