vi "Rename Window.gvi"   [LabVIEW NXG 5.0.0]
inputs:
  "Error In": error
  "Original Filename": string = "Input your new filename"
outputs:
  "Output": string
  "Error Out": error
panel controls:
  "Filename:": string
  "Okay button": bool
  "Reset Button": bool
diagram:
  # This SubVI Takes a filename and prompts the user to chose a different one because the current one is already in use.
  # It also makes sure that the new filename does not contain forbidden characters and erases those from the name automatically.
  case ($"Error In") {
    frame Error, Default {
      w1 = $"Error In"
    }
    frame No Error {
      # We first open the prompt window separately
      Property Node(instance in=reference to unnamed native front panel, error in=$"Error In") -> ("Window"=w2, error out=w3)
      Open Window(reference in=w2, error in=w3, modal=TRUE) -> (reference out=w4, error out=w5)
      # We store the original filename
      # And set the current one as the
      # original
      Property Node(instance in=reference to "Filename:", "Value"=$"Original Filename", error in=w5) -> (error out=w6)
      while {
        Wait Until Next Multiple(multiple to wait=50)
        s1 = $"Filename:"  # shift register
        for {
          w7 = each element of ["/", "\\", "*", ":", "?", "\"", ">", "<", "|"]
          Search And Replace String(error in (no error)=w6, input string=s1, replace all (F)=TRUE, search string=w7) -> (error out=w9, number of replacements=w10, result string=w11)
          # We erase any non accepted characters before outputting the
          # filename
          Is Not Equal To 0(x=w10) -> w12
          append w12 to w8
          next s1 = w11
        }
        Or Array Elements(Boolean array=w8) -> (logical OR=w13)
        case (w13) {
          frame False, Default { }
          frame True {
            w14 = "Please refrain from using the\nfollowing Characters:\n\\  /  *  :  ?  \"  >  <  |  "
            One Button Dialog(button name ("OK")="Oh sorry, I did not Know they\ncould not be used", message=w14)
          }
        }
        Select(s=$"Reset Button", t=$"Original Filename", f=s1) -> w15
        Is Empty String Or Path(string/path=w15) -> w16
        Logical And($"Okay button", w16) -> w17
        case (w17) {
          frame False, Default { }
          frame True {
            w18 = "Oh sorry, I thought an empty \nfilename was completely acceptable\nand not :O"
            w19 = "Renaming the file means you \nhave to change the name not \ncompletely erase it :')"
            One Button Dialog(button name ("OK")=w18, message=w19)
          }
        }
        Is Not Equal(x=w15, y=$"Original Filename") -> w20
        Not(x=w20) -> w21
        Logical And(w21, $"Okay button") -> w22
        # We prompt the user if the provided filenames are
        # not acceptable
        case (w22) {
          frame False, Default { }
          frame True {
            One Button Dialog(button name ("OK")="Oh sorry, I thought this name\nwas different :O", message="Renaming the file means you \nhave to change the name :')")
          }
        }
        Logical Or($"Okay button", $"Reset Button", w13) -> w23
        case (w23) {
          frame False, Default {
            w24 = w9
          }
          frame True {
            Property Node(instance in=reference to "Filename:", "Value"=w15, error in=w9) -> (error out=w24)
            Wait Until Next Multiple(multiple to wait=2000)
          }
        }
        Logical And($"Okay button", w20) -> w25
        stop if w25
      }
      String Length(string=w15) -> (length=w26)
      Subtract(x=w26, y=4) -> w27
      Replace Substring(length (len. of substring)=4, offset=w27, string=w15) -> (replaced substring=w28)
      Is Not Equal(x=w28, y=".txt") -> w29
      # If the filename does not contain extension
      # we add the extension automatically
      case (w29) {
        frame False, Default {
          w30 = w15
        }
        frame True {
          Concatenate Strings(w15, ".txt") -> w30
        }
      }
      $Output <- w30
      Close Window(reference in=w4, error in=w24) -> (error out=w1)
    }
  }
  $"Error Out" <- w1
