vi "Rainbow Sweep Param Generator.gvi"   [LabVIEW NXG 5.0.0]
inputs:
  "Error In": error
  "Rainbow Sweep Parameters": "Rainbow Sweep Param Selector.gtype" = {0, 1100, 300, 1, 1, 0}
  "Only Full Spectrum?": bool
outputs:
  "Error Out": error
  "Rainbow Sweep Parameters Array": "Rainbow Sweep Parameters.gtype"[]
  "Initialized Light Power Calibration Data Array": "Light Power Calibration Data.gtype"[]
types:
  "Rainbow Sweep Types.gtype" = enum{"Red Sweep Closing", "Red Sweep Opening", "Blue Sweep Closing", "Blue Sweep Opening"}
  "Rainbow Sweep Parameters.gtype" = cluster{"Dividing Wavelength Array": f64[], "Rainbow Sweep Types": "Rainbow Sweep Types.gtype"}
  "Raibow Sweep Selector.gtype" = enum{"Red Sweep", "Blue Sweep", "Full Sweep Red First", "Full Sweep Blue First"}
  T1 = enum{"Red Sweep Closing", "Red Sweep Opening", "Red Sweep Both Ways"}
  T2 = enum{"Blue Sweep Opening", "Blue Sweep Closing", "Blue Sweep Both Ways"}
  "Rainbow Sweep Type Selector.gtype" = cluster{"Red Sweep Mode": T1, "Blue Sweep Mode": T2}
  "Rainbow Sweep Param Selector.gtype" = cluster{"Raibow Sweep Selector": "Raibow Sweep Selector.gtype", "Max Wavelength (nm)": f64, "Min Wavelength (nm)": f64, "Wavelength Step (nm)": f64, "Rainbow Sweep Type Selector": "Rainbow Sweep Type Selector.gtype"}
  T3 = cluster{"Dividing Wavelength Array": f64[], "Measured Power Array": f64[], "Power Density Array": f64[]}
  "Light Power Calibration Data.gtype" = cluster{"Single Light Calibration": T3, "Rainbow Sweep Types": "Rainbow Sweep Types.gtype", "Total Light Power Density": f64}
uses:
  Rainbow Measurement Setup::Side Functions::Rainbow Sweep::Rainbow Sweep Type Extractor.gvi
diagram:
  # This SubVI Takes the desired wavelength range as well as the wavelength steps and the type of Rainbow Sweep that we want to perform and it outputs an array
  # that contains a cluster with the dividing wavelength array as well as the type of Rainbow sweep. It is an array because we might want to perform more than one sweep
  # per measurement.
  case ($"Error In") {
    frame Error, Default {
      w1 = $"Error In"
      w2 = default
      w3 = default
    }
    frame No Error {
      case ($"Only Full Spectrum?") {
        frame False {
          Property Node(instance in=$"Rainbow Sweep Parameters") -> ("Max Wavelength (nm)"=w4, "Min Wavelength (nm)"=w5, "Wavelength Step (nm)"=w6, instance out=w7)
          In Range And Coerce[IncludeHighLimit=True](lower limit=0.1, upper limit=100, x=w6) -> (coerced(x)=w8)
          Subtract(x=w4, y=w5) -> w9
          Absolute Value(x=w9) -> w10
          Divide(x=w10, y=w8) -> w11
          Round Toward Negative Infinity(x=w11) -> w12
          Increment(x=w12) -> w13
          call "Rainbow Sweep Type Extractor.gvi"(Rainbow Sweep Parameters=w7, Error In=$"Error In") -> (Rainbow Sweep Array=w14, Error Out=w15)
          To Signed 32 Bit Integer(number=w13) -> w16
          s1 = w15  # shift register
          for {
            w17 = each element of w14
            # w13: Ammount of Steps
            # w4: Max Wavelength
            # w5: Min Wavelength
            # w8: Wavelength Step
            case (w17) {
              frame "Red Sweep Opening", Default {
                for (N = w16) (iteration -> i1) {
                  To Double Precision Float(number=i1) -> w20
                  Multiply(w8, w20) -> w21
                  Subtract(x=w4, y=w21) -> w22
                  append w22 to w19
                }
                Property Node(instance in="Rainbow Sweep Parameters.gtype" {all zero or empty}, "Dividing Wavelength Array"=w19, "Rainbow Sweep Types"=w17) -> (instance out=w18)
              }
              frame "Red Sweep Closing" {
                for (N = w16) (iteration -> i2) {
                  To Double Precision Float(number=i2) -> w24
                  Multiply(w8, w24) -> w25
                  Add(w5, w25) -> w26
                  append w26 to w23
                }
                Property Node(instance in="Rainbow Sweep Parameters.gtype" {all zero or empty}, "Dividing Wavelength Array"=w23, "Rainbow Sweep Types"=w17) -> (instance out=w18)
              }
              frame "Blue Sweep Closing" {
                for (N = w16) (iteration -> i3) {
                  To Double Precision Float(number=i3) -> w28
                  Multiply(w8, w28) -> w29
                  Subtract(x=w4, y=w29) -> w30
                  append w30 to w27
                }
                Property Node(instance in="Rainbow Sweep Parameters.gtype" {all zero or empty}, "Dividing Wavelength Array"=w27, "Rainbow Sweep Types"=w17) -> (instance out=w18)
              }
              frame "Blue Sweep Opening" {
                for (N = w16) (iteration -> i4) {
                  To Double Precision Float(number=i4) -> w32
                  Multiply(w8, w32) -> w33
                  Add(w5, w33) -> w34
                  append w34 to w31
                }
                Property Node(instance in="Rainbow Sweep Parameters.gtype" {all zero or empty}, "Dividing Wavelength Array"=w31, "Rainbow Sweep Types"=w17) -> (instance out=w18)
              }
            }
            append w18 to w2
          }
          w1 = s1
        }
        frame True {
          w35 = ["Red Sweep Closing", "Red Sweep Opening", "Blue Sweep Closing", "Blue Sweep Opening"]
          s2 = $"Error In"  # shift register
          for {
            w36 = each element of w35
            Property Node(instance in="Rainbow Sweep Parameters.gtype" {all zero or empty}, "Rainbow Sweep Types"=w36) -> (instance out=w37)
            append w37 to w2
          }
          w1 = s2
        }
      }
      Array Size(array=w2) -> (size(s)=w38)
      Initialize Array(element="Light Power Calibration Data.gtype" {all zero or empty}, size=w38) -> w3
    }
  }
  $"Error Out" <- w1
  $"Rainbow Sweep Parameters Array" <- w2
  $"Initialized Light Power Calibration Data Array" <- w3
