vi "Rainbow Sweep Type Extractor.gvi"   [LabVIEW NXG 5.0.0]
inputs:
  "Error In": error
  "Rainbow Sweep Parameters": "Rainbow Sweep Param Selector.gtype"
outputs:
  "Error Out": error
  "Rainbow Sweep Array": "Rainbow Sweep Types.gtype"[]
types:
  "Raibow Sweep Selector.gtype" = enum{"Red Sweep", "Blue Sweep", "Full Sweep Red First", "Full Sweep Blue First"}
  T1 = enum{"Red Sweep Closing", "Red Sweep Opening", "Red Sweep Both Ways"}
  T2 = enum{"Blue Sweep Opening", "Blue Sweep Closing", "Blue Sweep Both Ways"}
  "Rainbow Sweep Type Selector.gtype" = cluster{"Red Sweep Mode": T1, "Blue Sweep Mode": T2}
  "Rainbow Sweep Param Selector.gtype" = cluster{"Raibow Sweep Selector": "Raibow Sweep Selector.gtype", "Max Wavelength (nm)": f64, "Min Wavelength (nm)": f64, "Wavelength Step (nm)": f64, "Rainbow Sweep Type Selector": "Rainbow Sweep Type Selector.gtype"}
  "Rainbow Sweep Types.gtype" = enum{"Red Sweep Closing", "Red Sweep Opening", "Blue Sweep Closing", "Blue Sweep Opening"}
diagram:
  # This SubVI Extracts all the Sweeping Modes From the Rainbow Sweep parameter and assembles an array so that the measurement
  # is performed on the specified order
  case ($"Error In") {
    frame Error, Default {
      w1 = $"Error In"
    }
    frame No Error {
      Property Node(instance in=$"Rainbow Sweep Parameters") -> ("Raibow Sweep Selector"=w2, "Rainbow Sweep Type Selector"=w3)
      Is Equal(x="Red Sweep", y=w2) -> w4
      Is Equal(x=w2, y="Blue Sweep") -> w5
      Is Equal(x=w2, y="Full Sweep Red First") -> w6
      Is Equal(x=w2, y="Full Sweep Blue First") -> w7
      Build Array(w4, w5, w6, w7) -> w8
      Boolean Array To Number(Boolean array=w8) -> (number=w9)
      case (w9) {
        frame 0, Default {
          w10 = "Rainbow Sweep Types.gtype"[] []
        }
        frame 1 {
          Property Node(instance in=w3) -> ("Red Sweep Mode"=w11)
          case (w11) {
            frame "Red Sweep Closing", Default {
              Insert Into Array(inArray="Rainbow Sweep Types.gtype"[] [], index0=0, new="Red Sweep Closing") -> w10
            }
            frame "Red Sweep Opening" {
              Insert Into Array(inArray="Rainbow Sweep Types.gtype"[] [], index0=0, new="Red Sweep Opening") -> w10
            }
            frame "Red Sweep Both Ways" {
              Insert Into Array(inArray="Rainbow Sweep Types.gtype"[] [], index0=0, new="Red Sweep Closing") -> w12
              Insert Into Array(inArray=w12, index0=1, new="Red Sweep Opening") -> w10
            }
          }
        }
        frame 2 {
          Property Node(instance in=w3) -> ("Blue Sweep Mode"=w13)
          case (w13) {
            frame "Blue Sweep Opening", Default {
              Insert Into Array(inArray="Rainbow Sweep Types.gtype"[] [], index0=0, new="Blue Sweep Opening") -> w10
            }
            frame "Blue Sweep Closing" {
              Insert Into Array(inArray="Rainbow Sweep Types.gtype"[] [], index0=0, new="Blue Sweep Closing") -> w10
            }
            frame "Blue Sweep Both Ways" {
              Insert Into Array(inArray="Rainbow Sweep Types.gtype"[] [], index0=0, new="Blue Sweep Closing") -> w14
              Insert Into Array(inArray=w14, index0=1, new="Blue Sweep Opening") -> w10
            }
          }
        }
        frame 4 {
          Property Node(instance in=w3) -> ("Red Sweep Mode"=w15, instance out=w16)
          Property Node(instance in=w16) -> ("Blue Sweep Mode"=w17)
          case (w15) {
            frame "Red Sweep Closing", Default {
              Insert Into Array(inArray="Rainbow Sweep Types.gtype"[] [], index0=0, new="Red Sweep Closing") -> w18
              w19 = 1
              w20 = 2
            }
            frame "Red Sweep Opening" {
              Insert Into Array(inArray="Rainbow Sweep Types.gtype"[] [], index0=0, new="Red Sweep Opening") -> w18
              w19 = 1
              w20 = 2
            }
            frame "Red Sweep Both Ways" {
              Insert Into Array(inArray="Rainbow Sweep Types.gtype"[] [], index0=0, new="Red Sweep Closing") -> w21
              Insert Into Array(inArray=w21, index0=1, new="Red Sweep Opening") -> w18
              w19 = 2
              w20 = 3
            }
          }
          case (w17) {
            frame "Blue Sweep Opening", Default {
              Insert Into Array(inArray=w18, index0=w19, new="Blue Sweep Opening") -> w10
            }
            frame "Blue Sweep Closing" {
              Insert Into Array(inArray=w18, index0=w19, new="Blue Sweep Closing") -> w10
            }
            frame "Blue Sweep Both Ways" {
              Insert Into Array(inArray=w18, index0=w19, new="Blue Sweep Closing") -> w22
              Insert Into Array(inArray=w22, index0=w20, new="Blue Sweep Opening") -> w10
            }
          }
        }
        frame 8 {
          Property Node(instance in=w3) -> ("Red Sweep Mode"=w23, instance out=w24)
          Property Node(instance in=w24) -> ("Blue Sweep Mode"=w25)
          case (w25) {
            frame "Blue Sweep Opening", Default {
              Insert Into Array(inArray="Rainbow Sweep Types.gtype"[] [], index0=0, new="Blue Sweep Opening") -> w26
              w27 = 1
              w28 = 2
            }
            frame "Blue Sweep Closing" {
              Insert Into Array(inArray="Rainbow Sweep Types.gtype"[] [], index0=0, new="Blue Sweep Closing") -> w26
              w27 = 1
              w28 = 2
            }
            frame "Blue Sweep Both Ways" {
              Insert Into Array(inArray="Rainbow Sweep Types.gtype"[] [], index0=0, new="Blue Sweep Closing") -> w29
              Insert Into Array(inArray=w29, index0=1, new="Blue Sweep Opening") -> w26
              w27 = 2
              w28 = 3
            }
          }
          case (w23) {
            frame "Red Sweep Closing", Default {
              Insert Into Array(inArray=w26, index0=w27, new="Red Sweep Closing") -> w10
            }
            frame "Red Sweep Opening" {
              Insert Into Array(inArray=w26, index0=w27, new="Red Sweep Opening") -> w10
            }
            frame "Red Sweep Both Ways" {
              Insert Into Array(inArray=w26, index0=w27, new="Red Sweep Closing") -> w30
              Insert Into Array(inArray=w30, index0=w28, new="Red Sweep Opening") -> w10
            }
          }
        }
      }
      $"Rainbow Sweep Array" <- w10
      w1 = $"Error In"
    }
  }
  $"Error Out" <- w1
