vi "Prefix Generator.gvi"   [LabVIEW NXG 5.0.0]
inputs:
  "Error In": error
  "Misc Data Mega Cluster In": "Misc Data Mega Cluster.gtype"
  "Current Date": string
  "Cell Number": string
  "Cell number required?": bool
outputs:
  "Error Out": error
  "Misc Data Mega Cluster Out": "Misc Data Mega Cluster.gtype"
types:
  T1 = cluster{"IV Extracted Parameter Plot ": "Graph reference", "MRM Cell Selector Ref": "Cluster reference", "IV Plot Out Multiple Reference": "Graph reference", "Rainbow Sweep Parameters MRM Ref": "Cluster reference", "MRM Specific Parameters Ref": "Cluster reference", "MRM Cell Refined Plot Selector ref": "ComboBoxSelector reference", "MRM Current Raw Cell Plot": "ComboBoxSelector reference", "MRM Raw Plot Rainbow Sweep Relector Ref": "ComboBoxSelector reference"}
  T2 = cluster{"SRM Light Power Density Ref": "NumericTextBoxDouble reference", "Rainbow Sweep Parameters RSM": "Cluster reference", "SRM Refined Plot Rainbow Sweep Types": "ComboBoxSelector reference", "SRM Specific Parameters": "Cluster reference", "Sweep Live Parameters RSM": "Cluster reference", "SRM Raw Plot Rainbow Sweep Selector": "ComboBoxSelector reference", "SRM Plot Parameter Selector Ref": "EnumSelector reference", "IV Plot Out Ref": "Graph reference"}
  T3 = cluster{"Calibration Files Path": "PathSelector reference", "Default Data Saving Location": "PathSelector reference"}
  T4 = cluster{"Main Tab": "TabControl reference", "Rainbow Measurement tab": "TabControl reference", "Configuration tab": "TabControl reference", "Light Calibration tab": "TabControl reference"}
  T5 = cluster{"Custom date": "CheckBox reference", "Batch Name": "StringControl reference", "Author Initials": "ComboBoxSelector reference", "Cell Number": "StringControl reference", "Current Date": "StringControl reference", "Sample Comments": "StringControl reference", "Sample Prefix": "StringControl reference", "Label Info Missing Error": "BooleanControl reference", "Label Info Error Label": "StringControl reference"}
  T6 = cluster{"Beam Power Density": "IntensityGraph reference"[][], "Irradiance Calibration": "Graph reference"[], "MSpot Spectrum Calibration Parameters": "Cluster reference", "Rainbow Sweep Param Selector MSpot": "Cluster reference"}
  T7 = cluster{"LPC Parameters Ref": "Cluster reference", "Sweep Live Parameters LPC ref": "Cluster reference", "Light Power Calibration": "Graph reference", "Light Power Calibration Data Ref": "ArrayViewer reference", "Rainbow Sweep Parameters LPC": "Cluster reference"}
  T8 = cluster{"Current State Ref": "EnumSelector reference", "Substate": "StringControl reference", "State": "StringControl reference", "Current Substate": "StringControl reference"}
  T9 = cluster{"Custom Position": "BooleanControl reference", "Set Position": "BooleanControl reference", "XZ Stage Active": "BooleanControl reference", "Release XZ Stage": "BooleanControl reference", "XZ Coordinates": "Cluster reference", "Activate XZ Stage": "BooleanControl reference", "XZ Stage Cell Reference": "EnumSelector reference", "XZ All Position Cluster Ref": "Cluster reference"}
  "Full Reference Cluster.gtype" = cluster{"MRM Reference Cluster": T1, "SRM Reference Cluster": T2, "Path Reference Cluster": T3, "Tab Reference Cluster": T4, "Cell Naming Parameters Ref Cluster": T5, "One Time Calibrations Ref Cluster": T6, "LPC Controls Reference Cluster": T7, "System Parameters Ref Cluster": T8, "XZ Stage Controls Reference Cluster": T9}
  T10 = cluster{"X Coordinate (mm)": f64, "Z Coordinate (mm)": f64, "Aprch Distance (mm)": f64}
  T11 = cluster{"X Coordinate (mm)": f64, "Z Coordinate (mm)": f64, "Vertical Spacing (mm)": f64, "Aprch Distance (mm)": f64, "Aprch Dstnc L.12 (mm)": f64}
  "XZ All Position Cluster.gtype" = cluster{"Diffusor Coordinates": T10, "Photodetector Coordinates": T10, "Cell R.01 Coordinates": T11}
  T12 = cluster{"Thorlabs Motor Serial Number File Path": path, "Default Data Saving Location": path}
  "Cell Naming Cluster.gtype" = cluster{"Cell Label": string, "Sample Prefix": string, "Author Initials": string, "Current Date": string, "Batch Name": string}
  "Misc Data Mega Cluster.gtype" = cluster{"Full Reference Cluster": "Full Reference Cluster.gtype", "All XZ Position Cluster": "XZ All Position Cluster.gtype", "All Paths": T12, "Cell Naming Cluster": "Cell Naming Cluster.gtype"}
diagram:
  # This SubVI takes all the needed Parameters and creates the cell prefix.
  # It also creates an error label in case there is something wrong with the
  # name such as missing labels or forbidden characters
  case ($"Error In") {
    frame Error, Default {
      w1 = $"Error In"
      w2 = $"Misc Data Mega Cluster In"
    }
    frame No Error {
      Property Node(instance in=$"Misc Data Mega Cluster In") -> ("Full Reference Cluster:Cell Naming Parameters Ref Cluster:Author Initials"=w3, "Full Reference Cluster:Cell Naming Parameters Ref Cluster:Batch Name"=w4, "Full Reference Cluster:Cell Naming Parameters Ref Cluster:Sample Comments"=w5, instance out=w6)
      Property Node(instance in=w3) -> ("Value"=w7)
      Property Node(instance in=w4) -> ("Value"=w8)
      Property Node(instance in=w5) -> ("Value"=w9)
      Build Array(w7, $"Current Date", w8, w9, $"Cell Number") -> w10
      s1 = ""  # shift register
      for {
        w11 = each element of w10
        Is Empty String Or Path(string/path=w11) -> w12
        case (w12) {
          frame False, Default {
            Concatenate Strings(s1, w11, ".") -> w13
          }
          frame True {
            w13 = s1
          }
        }
        next s1 = w13
      }
      s2 = $"Error In"  # shift register
      for {
        w14 = each element of ["/", "\\", "*", ":", "?", "\"", ">", "<", "|"]
        Search And Replace String(error in (no error)=s2, input string=s1, replace all (F)=TRUE, search string=w14) -> (error out=w16, number of replacements=w17, result string=w18)
        Is Greater Than 0(x=w17) -> w19
        append w19 to w15
        next s2 = w16
      }
      Property Node(instance in=w6, "Cell Naming Cluster:Cell Label"=$"Cell Number", "Cell Naming Cluster:Author Initials"=w7, "Cell Naming Cluster:Current Date"=$"Current Date", "Cell Naming Cluster:Batch Name"=w8) -> (instance out=w20)
      Property Node(instance in=w20, "Cell Naming Cluster:Sample Prefix"=w18) -> ("Full Reference Cluster:Cell Naming Parameters Ref Cluster:Label Info Missing Error"=w21, "Full Reference Cluster:Cell Naming Parameters Ref Cluster:Label Info Error Label"=w22, "Full Reference Cluster:Cell Naming Parameters Ref Cluster:Sample Prefix"=w23, instance out=w2)
      Is Empty String Or Path(string/path=$"Cell Number") -> w24
      Logical And($"Cell number required?", w24) -> w25
      Is Empty String Or Path(string/path=w7) -> w26
      Is Empty String Or Path(string/path=$"Current Date") -> w27
      Is Empty String Or Path(string/path=w8) -> w28
      Or Array Elements(Boolean array=w15) -> (logical OR=w29)
      Logical Or(w26, w27, w28, w29, w25) -> w30
      Property Node(instance in=w21, "Value"=w30, error in=s2) -> (error out=w31)
      case (w25) {
        frame False, Default {
          w32 = ""
        }
        frame True {
          w32 = "I'm missing the Cell Name.\n"
        }
      }
      case (w26) {
        frame False, Default {
          w33 = ""
        }
        frame True {
          w33 = "I'm missing the author's initials.\n"
        }
      }
      case (w27) {
        frame False, Default {
          w34 = ""
        }
        frame True {
          w34 = "I'm missing the Current Date.\n"
        }
      }
      case (w28) {
        frame False, Default {
          w35 = ""
        }
        frame True {
          w35 = "I'm missing the Batch Name.\n"
        }
      }
      case (w29) {
        frame False, Default {
          w36 = ""
        }
        frame True {
          w37 = """You used one of these characters,
which cannot be used for naming files and folders:
 \ / * : ? " < > |
If you do not fix it, your files will NOT be saved.
"""
          w36 = w37
        }
      }
      Concatenate Strings(w33, w34, w35, w36, w32) -> w38
      Property Node(instance in=w22, "Value"=w38, error in=w31) -> (error out=w39)
      Property Node(instance in=w23, "Value"=w18, error in=w39) -> (error out=w1)
    }
  }
  $"Misc Data Mega Cluster Out" <- w2
  $"Error Out" <- w1
