vi "Sample Name Checkup Subroutine.gvi"   [LabVIEW NXG 5.0.0]
inputs:
  "Error In": error
  "Misc Data Mega Cluster In": "Misc Data Mega Cluster.gtype"
outputs:
  "Error Out": error
  "Misc Data Mega Cluster Out": "Misc Data Mega Cluster.gtype"
types:
  T1 = cluster{"SRM Light Power Density Ref": "NumericTextBoxDouble reference", "Rainbow Sweep Parameters RSM": "Cluster reference", "SRM Refined Plot Rainbow Sweep Types": "ComboBoxSelector reference", "Sweep Live Parameters RSM": "Cluster reference", "SRM Raw Plot Rainbow Sweep Selector": "ComboBoxSelector reference", "SRM Plot Parameter Selector Ref": "EnumSelector reference", "IV Plot Out Ref": "Graph reference", "SRM Specific Parameters": "Cluster reference"}
  T2 = cluster{"Calibration Files Path": "PathSelector reference", "Default Data Saving Location": "PathSelector reference"}
  T3 = cluster{"Main Tab": "TabControl reference", "Rainbow Measurement tab": "TabControl reference", "Configuration tab": "TabControl reference", "Light Calibration tab": "TabControl reference"}
  T4 = cluster{"Custom date": "CheckBox reference", "Batch Name": "StringControl reference", "Author Initials": "ComboBoxSelector reference", "Cell Number": "StringControl reference", "Current Date": "StringControl reference", "Sample Comments": "StringControl reference", "Sample Prefix": "StringControl reference", "Label Info Missing Error": "BooleanControl reference", "Label Info Error Label": "StringControl reference"}
  T5 = cluster{"Beam Power Density": "IntensityGraph reference"[][], "Irradiance Calibration": "Graph reference"[], "MSpot Spectrum Calibration Parameters": "Cluster reference", "Rainbow Sweep Param Selector MSpot": "Cluster reference"}
  T6 = cluster{"LPC Parameters Ref": "Cluster reference", "Sweep Live Parameters LPC ref": "Cluster reference", "Light Power Calibration": "Graph reference", "Light Power Calibration Data Ref": "ArrayViewer reference", "Rainbow Sweep Parameters LPC": "Cluster reference"}
  T7 = cluster{"Current State Ref": "EnumSelector reference", "Substate": "StringControl reference", "State": "StringControl reference", "Current Substate": "StringControl reference"}
  T8 = cluster{"Custom Position": "BooleanControl reference", "Set Position": "BooleanControl reference", "XZ Stage Active": "BooleanControl reference", "Release XZ Stage": "BooleanControl reference", "XZ Coordinates": "Cluster reference", "Activate XZ Stage": "BooleanControl reference", "XZ Stage Cell Reference": "EnumSelector reference", "XZ All Position Cluster Ref": "Cluster reference"}
  T9 = cluster{"IV Extracted Parameter Plot ": "Graph reference", "MRM Cell Selector Ref": "Cluster reference", "IV Plot Out Multiple Reference": "Graph reference", "Rainbow Sweep Parameters MRM Ref": "Cluster reference", "MRM Cell Refined Plot Selector ref": "ComboBoxSelector reference", "MRM Current Raw Cell Plot": "ComboBoxSelector reference", "MRM Raw Plot Rainbow Sweep Relector Ref": "ComboBoxSelector reference", "MRM Specific Parameters Ref": "Cluster reference"}
  T10 = cluster{"Smart Sweep Mega Cluster Ref": "Cluster reference"}
  "Full Reference Cluster.gtype" = cluster{"SRM Reference Cluster": T1, "Path Reference Cluster": T2, "Tab Reference Cluster": T3, "Cell Naming Parameters Ref Cluster": T4, "One Time Calibrations Ref Cluster": T5, "LPC Controls Reference Cluster": T6, "System Parameters Ref Cluster": T7, "XZ Stage Controls Reference Cluster": T8, "MRM Reference Cluster": T9, "Other Parameters Cluster": T10}
  T11 = cluster{"X Coordinate (mm)": f64, "Z Coordinate (mm)": f64, "Aprch Distance (mm)": f64}
  T12 = cluster{"X Coordinate (mm)": f64, "Z Coordinate (mm)": f64, "Vertical Spacing (mm)": f64, "Aprch Distance (mm)": f64, "Aprch Dstnc L.12 (mm)": f64}
  "XZ All Position Cluster.gtype" = cluster{"Diffusor Coordinates": T11, "Photodetector Coordinates": T11, "Cell R.01 Coordinates": T12}
  T13 = cluster{"Thorlabs Motor Serial Number File Path": path, "Default Data Saving Location": path}
  "Cell Naming Cluster.gtype" = cluster{"Cell Label": string, "Sample Prefix": string, "Author Initials": string, "Current Date": string, "Batch Name": string}
  "Misc Data Mega Cluster.gtype" = cluster{"Full Reference Cluster": "Full Reference Cluster.gtype", "All XZ Position Cluster": "XZ All Position Cluster.gtype", "All Paths": T13, "Cell Naming Cluster": "Cell Naming Cluster.gtype"}
uses:
  Rainbow Measurement Setup::Side Functions::Utilities::Time Related Operations::Get date as YYMMDD.gvi
  Rainbow Measurement Setup::Side Functions::Sample Naming::Prefix Generator.gvi
diagram:
  # This SubVI Takes the data from the Sample Naming Variables and it generates the prefix so that the files can be propperly saved
  case ($"Error In") {
    frame Error, Default {
      w1 = $"Error In"
      w2 = $"Misc Data Mega Cluster In"
    }
    frame No Error {
      Property Node(instance in=$"Misc Data Mega Cluster In") -> ("Full Reference Cluster:Cell Naming Parameters Ref Cluster:Custom date"=w3, "Full Reference Cluster:Cell Naming Parameters Ref Cluster:Current Date"=w4, instance out=w5)
      Property Node(instance in=w4, error in=$"Error In") -> ("Value"=w6, error out=w7, instance out=w8)
      Property Node(instance in=w3, error in=w7) -> ("Value"=w9, error out=w10)
      case (w9) {
        frame True {
          Property Node(instance in=w8, "Disabled"=FALSE, error in=w10) -> (error out=w12, instance out=w13)
          w11 = w6
        }
        frame False {
          Property Node(instance in=w8, "Disabled"=TRUE, error in=w10) -> (error out=w14, instance out=w13)
          call "Get date as YYMMDD.gvi"(Error In=w14) -> (Date YYMMDD=w11, Error Out=w12)
        }
      }
      Property Node(instance in=w5) -> ("Full Reference Cluster:Tab Reference Cluster:Main Tab"=w15, "Full Reference Cluster:Tab Reference Cluster:Rainbow Measurement tab"=w16, "Full Reference Cluster:Cell Naming Parameters Ref Cluster:Cell Number"=w17, instance out=w18)
      Property Node(instance in=w13, "Value"=w11, error in=w12) -> (error out=w19)
      Property Node(instance in=w15, error in=w19) -> ("Value"=w20, error out=w21)
      Property Node(instance in=w16, error in=w21) -> ("Value"=w22, error out=w23)
      Property Node(instance in=w17, error in=w23) -> ("Value"=w24, error out=w25, instance out=w26)
      Is Equal(x=w20, y=0) -> w27
      Is Equal(x=w22, y=1) -> w28
      Logical And(w27, w28) -> w29
      case (w29) {
        frame False, Default {
          Property Node(instance in=w26, "Disabled"=TRUE, error in=w25) -> (error out=w32)
          w30 = ""
          w31 = FALSE
        }
        frame True {
          Property Node(instance in=w26, "Disabled"=FALSE, error in=w25) -> (error out=w32)
          w30 = w24
          w31 = TRUE
        }
      }
      call "Prefix Generator.gvi"(Misc Data Mega Cluster In=w18, Current Date=w11, Cell Number=w30, Error In=w32, Cell number required?=w31) -> (Misc Data Mega Cluster Out=w2, Error Out=w1)
    }
  }
  $"Misc Data Mega Cluster Out" <- w2
  $"Error Out" <- w1
