vi "txt Extension adder.gvi"   [LabVIEW NXG 5.0.0]
inputs:
  "Error In": error
  "Name without .txt": string
outputs:
  "Error Out": error
  "Name with .txt": string
diagram:
  # This subvi scans the last character before the extension and if it already has a dot on the end it only adds the txt extension.
  # Othewise it adds the full extension with the dot.
  case ($"Error In") {
    frame Error, Default {
      w1 = $"Error In"
    }
    frame No Error {
      String Length(string=$"Name without .txt") -> (length=w2)
      Decrement(x=w2) -> w3
      String Subset(length (rest)=1, offset (0)=w3, string=$"Name without .txt") -> w4
      Is Equal(x=w4, y=".") -> w5
      Select(s=w5, t="txt", f=".txt") -> w6
      Concatenate Strings($"Name without .txt", w6) -> w7
      $"Name with .txt" <- w7
      w1 = $"Error In"
    }
  }
  $"Error Out" <- w1
