vi "Scan Parameters Calculator.gvi"   [LabVIEW NXG 5.0.0]
inputs:
  "Error In": error
  "XZ Scan Parameters In": "XZ Scan Parameters.gtype"
outputs:
  "Error Out": error
  "XZ Scan Parameters Out": "XZ Scan Parameters.gtype"
types:
  "XZ Scan Parameters.gtype" = cluster{"X Scan Range (mm)": f64, "Z Scan Range (mm)": f64, "X Steps": f64, "Z Steps": f64, "Center Coordinate X": f64, "Center Coordinate Z": f64, "Z Step size": f64, "X Step size": f64, "Total Steps": f64, "Z Starting Point": f64, "X Starting Point": f64, "Z End Point": f64, "X End Point": f64}
diagram:
  # This SubVI takes the desired scan parameters and calculates the required step size as well as the starting and end points
  case ($"Error In") {
    frame Error, Default {
      w1 = $"Error In"
      w2 = $"XZ Scan Parameters In"
    }
    frame No Error {
      Property Node(instance in=$"XZ Scan Parameters In") -> ("X Steps"=w3, "X Scan Range (mm)"=w4, "Center Coordinate X"=w5, "Z Steps"=w6, "Z Scan Range (mm)"=w7, "Center Coordinate Z"=w8, instance out=w9)
      Multiply(w3, w6) -> w10
      Divide(x=w4, y=2) -> w11
      Subtract(x=w5, y=w11) -> w12
      Divide(x=w7, y=2) -> w13
      Subtract(x=w8, y=w13) -> w14
      Decrement(x=w3) -> w15
      Divide(x=w4, y=w15) -> w16
      Multiply(w16, 100) -> w17
      Round Toward Negative Infinity(x=w17) -> w18
      Divide(x=w18, y=100) -> w19
      Decrement(x=w6) -> w20
      Divide(x=w7, y=w20) -> w21
      Multiply(w21, 100) -> w22
      Round Toward Negative Infinity(x=w22) -> w23
      Divide(x=w23, y=100) -> w24
      Multiply(w15, w19) -> w25
      Add(w25, w12) -> w26
      Multiply(w24, w20) -> w27
      Add(w27, w14) -> w28
      Property Node(instance in=w9, "X Step size"=w19, "X Starting Point"=w12, "X End Point"=w26, "Z Step size"=w24, "Z Starting Point"=w14, "Z End Point"=w28, "Total Steps"=w10) -> (instance out=w2)
      w1 = $"Error In"
    }
  }
  $"Error Out" <- w1
  $"XZ Scan Parameters Out" <- w2
