vi "Scan Parameters Check.gvi"   [LabVIEW NXG 5.0.0]
inputs:
  "Error In": error
  "XZ Scan Parameters": "XZ Scan Parameters.gtype"
outputs:
  "Error Out": error
  "All In Range?": bool
types:
  "XZ Scan Parameters.gtype" = cluster{"X Scan Range (mm)": f64, "Z Scan Range (mm)": f64, "X steps": f64, "Z Steps": f64, "Center Coordinate X": f64, "Center Coordinate Z": f64, "Z Step size": f64, "X Step size": f64, "Total Steps": f64, "Z Starting Point": f64, "X Starting Point": f64, "Z End Point": f64, "X End Point": f64}
diagram:
  # This SubVI Checks if all the scanning points are in range and if not it prompts the user to change them
  # so that they are in range.
  case ($"Error In") {
    frame Error, Default {
      w1 = $"Error In"
    }
    frame No Error {
      Property Node(instance in=$"XZ Scan Parameters") -> ("X Starting Point"=w2, "Z Starting Point"=w3, "Z End Point"=w4, "X End Point"=w5)
      w6 = 210  # X Range Upper Limit
      In Range And Coerce(lower limit=0, upper limit=w6, x=w2) -> (In Range?=w7)
      w8 = 122  # Z Range Upper Limit
      In Range And Coerce(lower limit=0, upper limit=w8, x=w3) -> (In Range?=w9)
      In Range And Coerce(lower limit=0, upper limit=w8, x=w4) -> (In Range?=w10)
      In Range And Coerce(lower limit=0, upper limit=w6, x=w5) -> (In Range?=w11)
      Logical And(w7, w9, w10, w11) -> w12
      $"All In Range?" <- w12
      case (w12) {
        frame False, Default {
          Number To Decimal String(number=w2) -> (decimal integer string=w13)
          Number To Decimal String(number=w5) -> (decimal integer string=w14)
          Number To Decimal String(number=w3) -> (decimal integer string=w15)
          Number To Decimal String(number=w4) -> (decimal integer string=w16)
          w17 = "Some of the scanning points are outside\nthe range of the XZ stage. \nScanning Points:"
          w18 = "Please Make change the scanning parameters\nso that the scanning points are all within range."
          Concatenate Strings(w17, "\r\n", "X Start: ", w13, "X End: ", w14, "Z Start: ", w15, "Z End: ", w16, "\r\n", w18) -> w19
          One Button Dialog(button name ("OK")="Okay I will :)", message=w19)
        }
        frame True { }
      }
      w1 = $"Error In"
    }
  }
  $"Error Out" <- w1
