vi "Scan Point Calculator.gvi"   [LabVIEW NXG 5.0.0]
inputs:
  "Error In": error
  "XZ Scan Parameters In": "XZ Scan Parameters.gtype"
  "Scan Type": "Scan Type.gtype" = "Horizontal Scan"
outputs:
  "Error Out": error
  "XZ Coordinate Array": "XZ Coordinate Array.gtype"
types:
  "XZ Scan Parameters.gtype" = cluster{"X Scan Range (mm)": f64, "Z Scan Range (mm)": f64, "X Steps": f64, "Z Steps": f64, "Center Coordinate X": f64, "Center Coordinate Z": f64, "Z Step size": f64, "X Step size": f64, "Total Steps": f64, "Z Starting Point": f64, "X Starting Point": f64, "Z End Point": f64, "X End Point": f64}
  "Scan Type.gtype" = enum{"Vertical Scan", "Horizontal Scan"}
  "XZ Coordinate Cluster.gtype" = cluster{"X Coordinate (mm)": f64, "Z Coordinate (mm)": f64, "Coordinate Gcode": string, "Beam Power (W)": f64}
  "XZ Coordinate Array.gtype" = "XZ Coordinate Cluster.gtype"[]
diagram:
  # This SubVI Calculates the needed coordinates to perform a scan within the
  # specified area parameters and it outputs it in the form of an array.
  case ($"Error In") {
    frame Error, Default {
      w1 = $"Error In"
      w2 = default
    }
    frame No Error {
      Property Node(instance in=$"XZ Scan Parameters In") -> ("X Steps"=w3, "X Starting Point"=w4, "X Step size"=w5, "Z Steps"=w6, "Z Starting Point"=w7, "Z Step size"=w8)
      case ($"Scan Type") {
        frame "Horizontal Scan", Default {
          To Signed 32 Bit Integer(number=w6) -> w9
          s1 = "XZ Coordinate Array.gtype" []  # shift register
          s2 = $"Error In"  # shift register
          for (N = w9) (iteration -> i1) {
            To Signed 32 Bit Integer(number=w3) -> w10
            To Double Precision Float(number=i1) -> w11
            Multiply(w8, w11) -> w12
            Add(w7, w12) -> w13
            s3 = s1  # shift register
            for (N = w10) (iteration -> i2) {
              To Double Precision Float(number=i2) -> w14
              Multiply(w5, w14) -> w15
              Add(w4, w15) -> w16
              Property Node(instance in="XZ Coordinate Cluster.gtype" {all zero or empty}, "X Coordinate (mm)"=w16, "Z Coordinate (mm)"=w13) -> (instance out=w17)
              Build Array(s3, w17) -> w18
              next s3 = w18
            }
            next s1 = s3
          }
          w1 = s2
          w2 = s1
        }
        frame "Vertical Scan" {
          To Signed 32 Bit Integer(number=w3) -> w19
          s4 = "XZ Coordinate Array.gtype" []  # shift register
          s5 = $"Error In"  # shift register
          for (N = w19) (iteration -> i3) {
            To Signed 32 Bit Integer(number=w6) -> w20
            To Double Precision Float(number=i3) -> w21
            Multiply(w5, w21) -> w22
            Add(w4, w22) -> w23
            s6 = s4  # shift register
            for (N = w20) (iteration -> i4) {
              To Double Precision Float(number=i4) -> w24
              Multiply(w8, w24) -> w25
              Add(w7, w25) -> w26
              Property Node(instance in="XZ Coordinate Cluster.gtype" {all zero or empty}, "X Coordinate (mm)"=w23, "Z Coordinate (mm)"=w26) -> (instance out=w27)
              Build Array(s6, w27) -> w28
              next s6 = w28
            }
            next s4 = s6
          }
          w1 = s5
          w2 = s4
        }
      }
    }
  }
  $"Error Out" <- w1
  $"XZ Coordinate Array" <- w2
