vi "Scan Points Generator.gvi"   [LabVIEW NXG 5.0.0]
inputs:
  "Error In": error
  "XZ Scan Parameters In": "XZ Scan Parameters.gtype"
outputs:
  "Error Out": error
  "XZ Coordinate Array": "XZ Coordinate Array.gtype"
  "All In Range?": bool
  "XZ Scan Parameters Out": "XZ Scan Parameters.gtype"
types:
  "XZ Scan Parameters.gtype" = cluster{"X Scan Range (mm)": f64, "Z Scan Range (mm)": f64, "X Steps": f64, "Z Steps": f64, "Center Coordinate X": f64, "Center Coordinate Z": f64, "Z Step size": f64, "X Step size": f64, "Total Steps": f64, "Z Starting Point": f64, "X Starting Point": f64, "Z End Point": f64, "X End Point": f64}
  "XZ Coordinate Cluster.gtype" = cluster{"X Coordinate (mm)": f64, "Z Coordinate (mm)": f64, "Coordinate Gcode": string, "Beam Power (W)": f64}
  "XZ Coordinate Array.gtype" = "XZ Coordinate Cluster.gtype"[]
uses:
  Rainbow Measurement Setup::Side Functions::Scanning Calculations::Scan Parameters Calculator.gvi
  Rainbow Measurement Setup::Side Functions::Scanning Calculations::Scan Parameters Check.gvi
  Rainbow Measurement Setup::Side Functions::Scanning Calculations::Scan Point Calculator.gvi
  Rainbow Measurement Setup::Side Functions::Scanning Calculations::Scan XZ Coordinate to Gcode.gvi
diagram:
  # This subVI takes the XZ Scan Parameters
  # Calculates the needed parameters and also checks
  # if they are within the XZ Stage Range and finally
  # calculates the exact points where the scan will be performed.
  case ($"Error In") {
    frame Error, Default {
      w1 = $"Error In"
      w2 = default
      w3 = default
      w4 = $"XZ Scan Parameters In"
    }
    frame No Error {
      call "Scan Parameters Calculator.gvi"(XZ Scan Parameters In=$"XZ Scan Parameters In", Error In=$"Error In") -> (XZ Scan Parameters Out=w4, Error Out=w5)
      call "Scan Parameters Check.gvi"(XZ Scan Parameters=w4, Error In=w5) -> (All In Range?=w2, Error Out=w6)
      call "Scan Point Calculator.gvi"(XZ Scan Parameters In=w4, Error In=w6, Scan Type="Horizontal Scan") -> (XZ Coordinate Array=w7, Error Out=w8)
      call "Scan XZ Coordinate to Gcode.gvi"(XZ Coordinate Array In=w7, Error In=w8) -> (XZ Coordinate Array Out=w3, Error Out=w1)
    }
  }
  $"XZ Scan Parameters Out" <- w4
  $"XZ Coordinate Array" <- w3
  $"Error Out" <- w1
  $"All In Range?" <- w2
