vi "Scan XZ Coordinate to Gcode.gvi"   [LabVIEW NXG 5.0.0]
inputs:
  "Error In": error
  "XZ Coordinate Array In": "XZ Coordinate Array.gtype"
outputs:
  "Error Out": error
  "XZ Coordinate Array Out": "XZ Coordinate Array.gtype"
types:
  "XZ Coordinate Cluster.gtype" = cluster{"X Coordinate (mm)": f64, "Z Coordinate (mm)": f64, "Coordinate Gcode": string, "Beam Power (W)": f64}
  "XZ Coordinate Array.gtype" = "XZ Coordinate Cluster.gtype"[]
diagram:
  # This SubVI converts an XZ Coordinate cluster array into the commands needed to
  # move to all the required coordinates and it stores the gcode as the third element
  # of the XZ Coordinates array.
  case ($"Error In") {
    frame Error, Default {
      w1 = $"Error In"
      w2 = $"XZ Coordinate Array In"
    }
    frame No Error {
      Array Size(array=$"XZ Coordinate Array In") -> (size(s)=w3)
      s1 = $"Error In"  # shift register
      s2 = $"XZ Coordinate Array In"  # shift register
      for (N = w3) (iteration -> i1) {
        Array Index(array=s2) -> (out0[i1]=w4)
        Property Node(instance in=w4) -> ("X Coordinate (mm)"=w5, "Z Coordinate (mm)"=w6, instance out=w7)
        Number To Fractional String(number=w5, precision (6)=1, use system decimal point (T)=FALSE) -> (F-format string=w8)
        Search And Replace String(error in (no error)=s1, input string=w8, replace string ("")=".", search string=",") -> (error out=w9, result string=w10)
        Number To Fractional String(number=w6, precision (6)=1, use system decimal point (T)=FALSE) -> (F-format string=w11)
        Search And Replace String(input string=w11, replace string ("")=".", search string=",") -> (result string=w12)
        Concatenate Strings("G1 X", w10, " Z", w12) -> w13
        Property Node(instance in=w7, "Coordinate Gcode"=w13) -> (instance out=w14)
        Replace Array Subset(inArray=s2, index=i1, new=w14) -> w15
        next s1 = w9
        next s2 = w15
      }
      w1 = s1
      w2 = s2
    }
  }
  $"Error Out" <- w1
  $"XZ Coordinate Array Out" <- w2
