vi "Timeout Read FGV Data Subroutine.gvi"   [LabVIEW NXG 5.0.0]
inputs:
  "Misc Data Mega Cluster": "Misc Data Mega Cluster.gtype"
  "Error In": error
  "Live And Plot Mega Cluster In": "Live And Plot Mega Cluster.gtype"
  "Current State": "Queue Instructions Control.gtype" = "Undefined State"
outputs:
  "Live And Plot Mega Cluster Out": "Live And Plot Mega Cluster.gtype"
  "Error Out": error
types:
  "Full Reference Cluster.gtype" = cluster{"Enum Reference Cluster": "Enum Control Reference Cluster.gtype", "Boolean Reference Cluster": "Boolean Control Reference Cluster.gtype", "Numeric Reference Cluster": "Numeric Control Reference Cluster.gtype", "Numeric Cluster Reference Cluster": "Numeric Cluster Reference Cluster.gtype", "Path Reference Cluster": "Path Reference Cluster.gtype", "Cluster Reference Cluster": "Cluster Reference Cluster.gtype", "XZ Stage Controls Reference Cluster": "XZ Stage Controls Reference Cluster.gtype"}
  "Cell Naming Cluster.gtype" = cluster{"Cell Label": string, "Sample Prefix": string, "Author Initials": string, "Current Date": string, "Batch Name": string}
  T1 = cluster{"X Coordinate (mm)": f64, "Z Coordinate (mm)": f64}
  T2 = cluster{"X Coordinate (mm)": f64, "Z Coordinate (mm)": f64, "Vertical Spacing (mm)": f64}
  "XZ All Position Cluster.gtype" = cluster{"Diffusor Coordinates": T1, "Photodetector Coordinates": T1, "Cell R.01 Coordinates": T2}
  "Misc Data Mega Cluster.gtype" = cluster{"Full Reference Cluster": "Full Reference Cluster.gtype", "Default Data Saving Location": path, "Cell Naming Cluster": "Cell Naming Cluster.gtype", "All XZ Position Cluster": "XZ All Position Cluster.gtype"}
  "Rainbow Sweep Types.gtype" = enum{"Red Sweep Closing", "Red Sweep Opening", "Blue Sweep Closing", "Blue Sweep Opening"}
  "SRM Sweep Live Parameters.gtype" = cluster{"Current Wavelength (nm)": f64, "Rainbow Sweep Types": "Rainbow Sweep Types.gtype", "Finished Measurement?": bool}
  "SRM Single Plot Cluster.gtype" = cluster{"Voltage": f64[], "Current Density": f64[]}
  T3 = cluster{"Dividing Wavelength (nm)": f64[], "Element 2": f64[]}
  "LPC Sweep Live Parameters.gtype" = cluster{"Light Power (W) ": f64, "Current Wavelength (nm)": f64, "Rainbow Sweep Types": "Rainbow Sweep Types.gtype"}
  "Live And Plot Mega Cluster.gtype" = cluster{"Sweep Live Parameters RSM": "SRM Sweep Live Parameters.gtype", "IV Plot Out": "SRM Single Plot Cluster.gtype"[], "IV Extracted Parameter Plot": T3, "Sweep Live Parameters LPC": "LPC Sweep Live Parameters.gtype", "Light Power Calibration": cluster{"Wavelength": f64[], "Power": f64[]}[]}
  "Queue Instructions Control.gtype" = enum{"Undefined State", "Debug Check", "Initialize App", "Idle", "Light Power Calibration", "Rainbow Single Measurement", "Light Calibration Irradiance", "Light Calibration Spectral Density", "Light Calibration Power Density", "MSpot Spectrum Calibration", "Move XZ Stage", "Update All Info Meta Cluster", "Access TXT File", "Stop App"}
uses:
  Rainbow Measurement Setup::Main Functions::Rainbow Measurement::Cell Single Rainbow Measurement::SRM Live Parameters::SRM Sweep Live Reference Clustering.gvi
  Rainbow Measurement Setup::Main Functions::Rainbow Measurement::Cell Single Rainbow Measurement::SRM Live Parameters::SRM Sweep Live Parameters FGV.gvi
  Rainbow Measurement Setup::Main Functions::Rainbow Measurement::Cell Single Rainbow Measurement::Plotting::SRM Sweep Refined Data FGV.gvi
  Rainbow Measurement Setup::Main Functions::Rainbow Measurement::Light Power Calibration::Light Calibration Live Parameters FGV.gvi
diagram:
  # This SubVI Reads the data stored in the FGVs and outputs it so that
  # the graphs and everything can be populated, but it only does during
  # their respective subroutines so that it does not get overwhelmed
  case ($"Error In") {
    frame Error, Default {
      w1 = $"Error In"
      w2 = $"Live And Plot Mega Cluster In"
    }
    frame No Error {
      Property Node(instance in=$"Misc Data Mega Cluster") -> ("Full Reference Cluster"=w3)
      case ($"Current State") {
        frame "Rainbow Single Measurement" {
          call "SRM Sweep Live Reference Clustering.gvi"(Full Reference Cluster=w3) -> (SRM sweep live parameters FGV Cluster Out=w4)
          call "SRM Sweep Live Parameters FGV.gvi"(FGV Instructions="Read State", SRM sweep live parameters FGV Cluster In=w4, Error In=$"Error In") -> (SRM Live Parameters=w5, IV Plot Out=w6, Error Out=w7)
          call "SRM Sweep Refined Data FGV.gvi"(Full Reference Cluster=w3, Error In=w7, FGV Instructions="Read State") -> (IV Extracted Parameters Plot=w8, Error Out=w1)
          Property Node(instance in=$"Live And Plot Mega Cluster In", "Sweep Live Parameters RSM"=w5, "IV Plot Out"=w6, "IV Extracted Parameter Plot"=w8) -> (instance out=w2)
        }
        frame "Idle", Default {
          Property Node(instance in=w3) -> ("Enum Reference Cluster:Main Tab"=w9, "Enum Reference Cluster:Rainbow Measurement tab"=w10, instance out=w11)
          Property Node(instance in=w9, error in=$"Error In") -> ("Value"=w12, error out=w13)
          Property Node(instance in=w10, error in=w13) -> ("Value"=w14, error out=w15)
          Is Equal To 0(x=w12) -> w16
          Is Equal(x=w14, y=2) -> w17
          Logical And(w16, w17) -> w18
          case (w18) {
            frame False, Default {
              w1 = w15
              w2 = $"Live And Plot Mega Cluster In"
            }
            frame True {
              call "SRM Sweep Refined Data FGV.gvi"(Full Reference Cluster=w11, Error In=w15, FGV Instructions="Read State") -> (IV Extracted Parameters Plot=w19, Error Out=w1)
              Property Node(instance in=$"Live And Plot Mega Cluster In", "IV Extracted Parameter Plot"=w19) -> (instance out=w2)
            }
          }
        }
        frame "Light Power Calibration" {
          call "Light Calibration Live Parameters FGV.gvi"(Full Reference Cluster=w3, FGV Instructions="Read State", Error In=$"Error In") -> (Light Calibration Parameters Out=w20, Light Power Calibration Graph Out=w21, Error Out=w1)
          Property Node(instance in=$"Live And Plot Mega Cluster In", "Light Power Calibration"=w21, "Sweep Live Parameters LPC"=w20) -> (instance out=w2)
        }
      }
    }
  }
  $"Live And Plot Mega Cluster Out" <- w2
  $"Error Out" <- w1
