vi "Timeout Sequence.gvi"   [LabVIEW NXG 5.0.0]
inputs:
  "Error In": error
  "Queue In": Queue<"Queue Instructions Control.gtype">
outputs:
  "Error Out": error
  "Current State Out": "Queue Instructions Control.gtype"
  "Current SubState Out": string
  "Stop App?": bool
  "Queue Out": Queue<"Queue Instructions Control.gtype">
  "State": string
types:
  "Queue Instructions Control.gtype" = enum{"Undefined State", "Debug Check", "Initialize App", "Idle", "Light Power Calibration", "Rainbow Single Measurement", "Light Calibration Irradiance", "Light Calibration Spectral Density", "Light Calibration Power Density", "MSpot Spectrum Calibration", "Move XZ Stage", "Access TXT File", "Stop App"}
uses:
  Rainbow Measurement Setup::Main Functions::Instruction Queue::Current State::FGV Current State.gvi
  Rainbow Measurement Setup::Side Functions::Messages And Prompts::Initializing app prompt.gvi
  Rainbow Measurement Setup::Side Functions::Global Abort::FGV Global Abort.gvi
diagram:
  # This is the sequence that executes every 50 ms to check
  # the current state of the application. It outputs the current
  # state and substate and also shows the Initialization prompt
  # when the application is initializing.
  # Finally it checks if the current state is Stop App and outputs
  # the result to stop the master loop.
  # It also checks for the Global Abort state. In case the local abort is triggered it flushes the Queue
  # and enqueues an Idle instruction. Otherwise if the Global abort is true it flushes the queue and
  # enqueues a Stop App instruction
  case ($"Error In") {
    frame Error, Default {
      w1 = $"Error In"
      w2 = $"Queue In"
      w3 = default
      w4 = default
      w5 = default
      w6 = default
    }
    frame No Error {
      call "FGV Current State.gvi"(Current State Instructions="Read Current State and Substate", Error In=$"Error In") -> (Current State Out=w3, Current SubState Out=w5, Error Out=w7)
      Is Equal(x=w3, y="Stop App") -> w8
      Is Equal(x=w3, y="Initialize App") -> w9
      case (w9) {
        frame False, Default {
          w10 = w7
        }
        frame True {
          call "Initializing app prompt.gvi"(Error In=w7) -> (Error Out=w10)
        }
      }
      call "FGV Global Abort.gvi"(Global Abort Instructions="Read Current State", Error In=w10) -> (Local Abort Out=w11, Global Abort Out=w12, Error Out=w13)
      case (w12) {
        frame True {
          Flush Queue(error in=w13, queue=$"Queue In") -> (error out=w16, queue out=w17)
          Enqueue Element At Opposite End(element="Stop App", error in=w16, queue=w17) -> (error out=w14, queue out=w2)
          w15 = TRUE
        }
        frame False {
          case (w11) {
            frame False, Default {
              w14 = w13
              w2 = $"Queue In"
            }
            frame True {
              Flush Queue(error in=w13, queue=$"Queue In") -> (error out=w18, queue out=w19)
              Enqueue Element At Opposite End(element="Idle", error in=w18, queue=w19) -> (error out=w14, queue out=w2)
            }
          }
          w15 = FALSE
        }
      }
      Logical Or(w15, w8) -> w4
      Format Into String(errIn=w14, w3) -> (outString=w6, errOut=w1)
    }
  }
  $"Current State Out" <- w3
  $"Stop App?" <- w4
  $"Current SubState Out" <- w5
  $"Queue Out" <- w2
  $State <- w6
  $"Error Out" <- w1
