vi "Read FGV Data Changed Idle Control Check.gvi"   [LabVIEW NXG 5.0.0]
inputs:
  "Error In": error
  "Misc Data Mega Cluster In": "Misc Data Mega Cluster.gtype"
outputs:
  "Error Out": error
  "Misc Data Mega Cluster Out": "Misc Data Mega Cluster.gtype"
  "Update IV Plot?": bool
  "Update Refined IV Plot?": bool
types:
  T1 = cluster{"IV Extracted Parameter Plot ": "Graph reference", "MRM Cell Selector Ref": "Cluster reference", "IV Plot Out Multiple Reference": "Graph reference", "Rainbow Sweep Parameters MRM Ref": "Cluster reference", "MRM Specific Parameters Ref": "Cluster reference", "MRM Cell Refined Plot Selector ref": "ComboBoxSelector reference", "MRM Current Raw Cell Plot": "ComboBoxSelector reference", "MRM Raw Plot Rainbow Sweep Relector Ref": "ComboBoxSelector reference"}
  T2 = cluster{"SRM Light Power Density Ref": "NumericTextBoxDouble reference", "Rainbow Sweep Parameters RSM": "Cluster reference", "SRM Refined Plot Rainbow Sweep Types": "ComboBoxSelector reference", "SRM Specific Parameters": "Cluster reference", "Sweep Live Parameters RSM": "Cluster reference", "SRM Raw Plot Rainbow Sweep Selector": "ComboBoxSelector reference", "SRM Plot Parameter Selector Ref": "EnumSelector reference", "IV Plot Out Ref": "Graph reference"}
  T3 = cluster{"Calibration Files Path": "PathSelector reference", "Default Data Saving Location": "PathSelector reference"}
  T4 = cluster{"Main Tab": "TabControl reference", "Rainbow Measurement tab": "TabControl reference", "Configuration tab": "TabControl reference", "Light Calibration tab": "TabControl reference"}
  T5 = cluster{"Custom date": "CheckBox reference", "Batch Name": "StringControl reference", "Author Initials": "ComboBoxSelector reference", "Cell Number": "StringControl reference", "Current Date": "StringControl reference", "Sample Comments": "StringControl reference", "Sample Prefix": "StringControl reference", "Label Info Missing Error": "BooleanControl reference", "Label Info Error Label": "StringControl reference"}
  T6 = cluster{"Beam Power Density": "IntensityGraph reference"[][], "Irradiance Calibration": "Graph reference"[], "MSpot Spectrum Calibration Parameters": "Cluster reference", "Rainbow Sweep Param Selector MSpot": "Cluster reference"}
  T7 = cluster{"LPC Parameters Ref": "Cluster reference", "Sweep Live Parameters LPC ref": "Cluster reference", "Light Power Calibration": "Graph reference", "Light Power Calibration Data Ref": "ArrayViewer reference", "Rainbow Sweep Parameters LPC": "Cluster reference"}
  T8 = cluster{"Current State Ref": "EnumSelector reference", "Substate": "StringControl reference", "State": "StringControl reference", "Current Substate": "StringControl reference"}
  T9 = cluster{"Custom Position": "BooleanControl reference", "Set Position": "BooleanControl reference", "XZ Stage Active": "BooleanControl reference", "Release XZ Stage": "BooleanControl reference", "XZ Coordinates": "Cluster reference", "Activate XZ Stage": "BooleanControl reference", "XZ Stage Cell Reference": "EnumSelector reference", "XZ All Position Cluster Ref": "Cluster reference"}
  "Full Reference Cluster.gtype" = cluster{"MRM Reference Cluster": T1, "SRM Reference Cluster": T2, "Path Reference Cluster": T3, "Tab Reference Cluster": T4, "Cell Naming Parameters Ref Cluster": T5, "One Time Calibrations Ref Cluster": T6, "LPC Controls Reference Cluster": T7, "System Parameters Ref Cluster": T8, "XZ Stage Controls Reference Cluster": T9}
  T10 = cluster{"X Coordinate (mm)": f64, "Z Coordinate (mm)": f64, "Aprch Distance (mm)": f64}
  T11 = cluster{"X Coordinate (mm)": f64, "Z Coordinate (mm)": f64, "Vertical Spacing (mm)": f64, "Aprch Distance (mm)": f64, "Aprch Dstnc L.12 (mm)": f64}
  "XZ All Position Cluster.gtype" = cluster{"Diffusor Coordinates": T10, "Photodetector Coordinates": T10, "Cell R.01 Coordinates": T11}
  T12 = cluster{"Thorlabs Motor Serial Number File Path": path, "Default Data Saving Location": path}
  "Cell Naming Cluster.gtype" = cluster{"Cell Label": string, "Sample Prefix": string, "Author Initials": string, "Current Date": string, "Batch Name": string}
  "Misc Data Mega Cluster.gtype" = cluster{"Full Reference Cluster": "Full Reference Cluster.gtype", "All XZ Position Cluster": "XZ All Position Cluster.gtype", "All Paths": T12, "Cell Naming Cluster": "Cell Naming Cluster.gtype"}
diagram:
  # This SubVI Checks if the controls have changed and if so it outputs a true flag so that the graphs update accordingly
  case ($"Error In") {
    frame Error, Default {
      w1 = $"Error In"
      w2 = $"Misc Data Mega Cluster In"
      w3 = default
      w4 = default
    }
    frame No Error {
      s1 = uninitialised  # shift register
      s2 = $"Error In"  # shift register
      s3 = $"Misc Data Mega Cluster In"  # shift register
      s4 = uninitialised  # shift register
      s5 = uninitialised  # shift register
      s6 = uninitialised  # shift register
      s7 = uninitialised  # shift register
      s8 = uninitialised  # shift register
      while {
        Property Node(instance in=s3) -> ("Full Reference Cluster:Tab Reference Cluster:Main Tab"=w5, "Full Reference Cluster:Tab Reference Cluster:Rainbow Measurement tab"=w6, "Full Reference Cluster:SRM Reference Cluster:SRM Raw Plot Rainbow Sweep Selector"=w7, "Full Reference Cluster:SRM Reference Cluster:SRM Plot Parameter Selector Ref"=w8, "Full Reference Cluster:SRM Reference Cluster:SRM Refined Plot Rainbow Sweep Types"=w9, "Full Reference Cluster:MRM Reference Cluster:MRM Cell Refined Plot Selector ref"=w10, "Full Reference Cluster:MRM Reference Cluster:MRM Current Raw Cell Plot"=w11, "Full Reference Cluster:MRM Reference Cluster:MRM Raw Plot Rainbow Sweep Relector Ref"=w12, instance out=w13)
        Property Node(instance in=w12, error in=s2) -> ("Value"=w14, error out=w15)
        Is Not Equal(x=w14, y=s8) -> w16
        Property Node(instance in=w11, error in=w15) -> ("Value"=w17, error out=w18)
        Is Not Equal(x=w17, y=s7) -> w19
        Property Node(instance in=w10, error in=w18) -> ("Value"=w20, error out=w21)
        Property Node(instance in=w8, error in=w21) -> ("Value"=w22, error out=w23)
        Property Node(instance in=w9, error in=w23) -> ("Value"=w24, error out=w25)
        Property Node(instance in=w5, error in=w25) -> ("Value"=w26, error out=w27)
        Property Node(instance in=w6, error in=w27) -> ("Value"=w28, error out=w29)
        Property Node(instance in=w7, error in=w29) -> ("Value"=w30, error out=w31)
        Is Not Equal(x=s1, y=w30) -> w32
        Logical Or(w32, w19, w16) -> w3
        Is Equal To 0(x=w26) -> w33
        Is Not Equal(x=w20, y=s6) -> w34
        Is Not Equal(x=w22, y=s5) -> w35
        Is Not Equal(x=w24, y=s4) -> w36
        Logical Or(w36, w35, w34) -> w37
        Is Equal(x=w28, y=2) -> w38
        Logical And(w33, w38, w37) -> w4
        next s1 = w30
        next s2 = w31
        next s3 = w13
        next s4 = w24
        next s5 = w22
        next s6 = w20
        next s7 = w17
        next s8 = w14
        stop if TRUE
      }
      w1 = s2
      w2 = s3
    }
  }
  $"Update IV Plot?" <- w3
  $"Update Refined IV Plot?" <- w4
  $"Misc Data Mega Cluster Out" <- w2
  $"Error Out" <- w1
