vi "Update Graphs Control Change.gvi"   [LabVIEW NXG 5.0.0]
inputs:
  "Misc Data Mega Cluster In": "Misc Data Mega Cluster.gtype"
  "Update Refined IV Plot?": bool
  "Error In": error
outputs:
  "Misc Data Mega Cluster Out": "Misc Data Mega Cluster.gtype"
  "Error Out": error
types:
  T1 = cluster{"IV Extracted Parameter Plot ": "Graph reference", "MRM Cell Selector Ref": "Cluster reference", "IV Plot Out Multiple Reference": "Graph reference", "Rainbow Sweep Parameters MRM Ref": "Cluster reference", "MRM Specific Parameters Ref": "Cluster reference", "MRM Cell Refined Plot Selector ref": "ComboBoxSelector reference", "MRM Current Raw Cell Plot": "ComboBoxSelector reference", "MRM Raw Plot Rainbow Sweep Relector Ref": "ComboBoxSelector reference"}
  T2 = cluster{"SRM Light Power Density Ref": "NumericTextBoxDouble reference", "Rainbow Sweep Parameters RSM": "Cluster reference", "SRM Refined Plot Rainbow Sweep Types": "ComboBoxSelector reference", "SRM Specific Parameters": "Cluster reference", "Sweep Live Parameters RSM": "Cluster reference", "SRM Raw Plot Rainbow Sweep Selector": "ComboBoxSelector reference", "SRM Plot Parameter Selector Ref": "EnumSelector reference", "IV Plot Out Ref": "Graph reference"}
  T3 = cluster{"Calibration Files Path": "PathSelector reference", "Default Data Saving Location": "PathSelector reference"}
  T4 = cluster{"Main Tab": "TabControl reference", "Rainbow Measurement tab": "TabControl reference", "Configuration tab": "TabControl reference", "Light Calibration tab": "TabControl reference"}
  T5 = cluster{"Custom date": "CheckBox reference", "Batch Name": "StringControl reference", "Author Initials": "ComboBoxSelector reference", "Cell Number": "StringControl reference", "Current Date": "StringControl reference", "Sample Comments": "StringControl reference", "Sample Prefix": "StringControl reference", "Label Info Missing Error": "BooleanControl reference", "Label Info Error Label": "StringControl reference"}
  T6 = cluster{"Beam Power Density": "IntensityGraph reference"[][], "Irradiance Calibration": "Graph reference"[], "MSpot Spectrum Calibration Parameters": "Cluster reference", "Rainbow Sweep Param Selector MSpot": "Cluster reference"}
  T7 = cluster{"LPC Parameters Ref": "Cluster reference", "Sweep Live Parameters LPC ref": "Cluster reference", "Light Power Calibration": "Graph reference", "Light Power Calibration Data Ref": "ArrayViewer reference", "Rainbow Sweep Parameters LPC": "Cluster reference"}
  T8 = cluster{"Current State Ref": "EnumSelector reference", "Substate": "StringControl reference", "State": "StringControl reference", "Current Substate": "StringControl reference"}
  T9 = cluster{"Custom Position": "BooleanControl reference", "Set Position": "BooleanControl reference", "XZ Stage Active": "BooleanControl reference", "Release XZ Stage": "BooleanControl reference", "XZ Coordinates": "Cluster reference", "Activate XZ Stage": "BooleanControl reference", "XZ Stage Cell Reference": "EnumSelector reference", "XZ All Position Cluster Ref": "Cluster reference"}
  "Full Reference Cluster.gtype" = cluster{"MRM Reference Cluster": T1, "SRM Reference Cluster": T2, "Path Reference Cluster": T3, "Tab Reference Cluster": T4, "Cell Naming Parameters Ref Cluster": T5, "One Time Calibrations Ref Cluster": T6, "LPC Controls Reference Cluster": T7, "System Parameters Ref Cluster": T8, "XZ Stage Controls Reference Cluster": T9}
  T10 = cluster{"X Coordinate (mm)": f64, "Z Coordinate (mm)": f64, "Aprch Distance (mm)": f64}
  T11 = cluster{"X Coordinate (mm)": f64, "Z Coordinate (mm)": f64, "Vertical Spacing (mm)": f64, "Aprch Distance (mm)": f64, "Aprch Dstnc L.12 (mm)": f64}
  "XZ All Position Cluster.gtype" = cluster{"Diffusor Coordinates": T10, "Photodetector Coordinates": T10, "Cell R.01 Coordinates": T11}
  T12 = cluster{"Thorlabs Motor Serial Number File Path": path, "Default Data Saving Location": path}
  "Cell Naming Cluster.gtype" = cluster{"Cell Label": string, "Sample Prefix": string, "Author Initials": string, "Current Date": string, "Batch Name": string}
  "Misc Data Mega Cluster.gtype" = cluster{"Full Reference Cluster": "Full Reference Cluster.gtype", "All XZ Position Cluster": "XZ All Position Cluster.gtype", "All Paths": T12, "Cell Naming Cluster": "Cell Naming Cluster.gtype"}
uses:
  Rainbow Measurement Setup::Main Functions::Rainbow Measurement::Single Multiple Measurement Utilities::FGV Last Measurement Type.gvi
  Rainbow Measurement Setup::Main Functions::Rainbow Measurement::Cell Multiple Rainbow Measurement::Plotting::MRM Sweep Refined Data FGV.gvi
  Rainbow Measurement Setup::Main Functions::Rainbow Measurement::Cell Single Rainbow Measurement::Plotting::SRM Sweep Refined Data FGV.gvi
diagram:
  # This SubVI updates the graphs after a measurement depending on the
  # fact if the measurement has been a single or a multiple measurement.
  case ($"Error In") {
    frame Error, Default {
      w1 = $"Error In"
      w2 = $"Misc Data Mega Cluster In"
    }
    frame No Error {
      case ($"Update Refined IV Plot?") {
        frame False, Default {
          w1 = $"Error In"
          w2 = $"Misc Data Mega Cluster In"
        }
        frame True {
          call "FGV Last Measurement Type.gvi"(FGV Instructions="Read State", Error In=$"Error In") -> (Last Measurement State Out=w3, Error Out=w4)
          case (w3) {
            frame "Rainbow Multiple Measurement" {
              Property Node(instance in=$"Misc Data Mega Cluster In") -> ("Full Reference Cluster:MRM Reference Cluster:MRM Cell Refined Plot Selector ref"=w7, instance out=w8)
              Property Node(instance in=w7, "Disabled"=FALSE, error in=w4) -> (error out=w9)
              call "MRM Sweep Refined Data FGV.gvi"(Misc Data Mega Cluster In=w8, Error In=w9) -> (IV Extracted Parameters Plot=w6, Error Out=w5)
            }
            frame "Rainbow Single Measurement", Default {
              Property Node(instance in=$"Misc Data Mega Cluster In") -> ("Full Reference Cluster:MRM Reference Cluster:MRM Cell Refined Plot Selector ref"=w10, instance out=w11)
              Property Node(instance in=w10, "Disabled"=TRUE, error in=w4) -> (error out=w12)
              call "SRM Sweep Refined Data FGV.gvi"(Misc Data Mega Cluster In=w11, Error In=w12) -> (IV Extracted Parameters Plot=w6, Error Out=w5)
            }
          }
          Property Node(instance in=$"Misc Data Mega Cluster In") -> ("Full Reference Cluster:MRM Reference Cluster:IV Extracted Parameter Plot "=w13, instance out=w2)
          Property Node(instance in=w13, "Value"=w6, error in=w5) -> (error out=w1)
        }
      }
    }
  }
  $"Misc Data Mega Cluster Out" <- w2
  $"Error Out" <- w1
