vi "Update MRM Controls.gvi"   [LabVIEW NXG 5.0.0]
inputs:
  "Error In": error
  "Misc Data Mega Cluster In": "Misc Data Mega Cluster.gtype"
  "MRM Mega Cluster In": "MRM Mega Cluster.gtype" = {"MRM Specific Parameters"={"V Points"=1, "Current Avg"=1, "Sweep Speed"="Smart Sweep"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}, "Cell Selector"={FALSE, FALSE, FALSE, FALSE, FALSE, FALSE, FALSE, FALSE, FALSE, FALSE, FALSE, FALSE, FALSE, FALSE, FALSE, FALSE, FALSE, FALSE, FALSE, FALSE, FALSE, FALSE, FALSE, FALSE, FALSE, FALSE, FALSE, FALSE}, "Cells to Measure Array"=[], "Rainbow Sweep Parameters MRM"={0, 900, 400, 1, 1, 0}, "MRM Data Array"=[]}
outputs:
  "Error Out": error
  "Misc Data Mega Cluster Out": "Misc Data Mega Cluster.gtype"
  "MRM Mega Cluster Out": "MRM Mega Cluster.gtype"
types:
  T1 = cluster{"SRM Light Power Density Ref": "NumericTextBoxDouble reference", "Rainbow Sweep Parameters RSM": "Cluster reference", "SRM Refined Plot Rainbow Sweep Types": "ComboBoxSelector reference", "Sweep Live Parameters RSM": "Cluster reference", "SRM Raw Plot Rainbow Sweep Selector": "ComboBoxSelector reference", "SRM Plot Parameter Selector Ref": "EnumSelector reference", "IV Plot Out Ref": "Graph reference", "SRM Specific Parameters": "Cluster reference"}
  T2 = cluster{"Calibration Files Path": "PathSelector reference", "Default Data Saving Location": "PathSelector reference"}
  T3 = cluster{"Main Tab": "TabControl reference", "Rainbow Measurement tab": "TabControl reference", "Configuration tab": "TabControl reference", "Light Calibration tab": "TabControl reference"}
  T4 = cluster{"Custom date": "CheckBox reference", "Batch Name": "StringControl reference", "Author Initials": "ComboBoxSelector reference", "Cell Number": "StringControl reference", "Current Date": "StringControl reference", "Sample Comments": "StringControl reference", "Sample Prefix": "StringControl reference", "Label Info Missing Error": "BooleanControl reference", "Label Info Error Label": "StringControl reference"}
  T5 = cluster{"Beam Power Density": "IntensityGraph reference"[][], "Irradiance Calibration": "Graph reference"[], "MSpot Spectrum Calibration Parameters": "Cluster reference", "Rainbow Sweep Param Selector MSpot": "Cluster reference"}
  T6 = cluster{"LPC Parameters Ref": "Cluster reference", "Sweep Live Parameters LPC ref": "Cluster reference", "Light Power Calibration": "Graph reference", "Light Power Calibration Data Ref": "ArrayViewer reference", "Rainbow Sweep Parameters LPC": "Cluster reference"}
  T7 = cluster{"Current State Ref": "EnumSelector reference", "Substate": "StringControl reference", "State": "StringControl reference", "Current Substate": "StringControl reference"}
  T8 = cluster{"Custom Position": "BooleanControl reference", "Set Position": "BooleanControl reference", "XZ Stage Active": "BooleanControl reference", "Release XZ Stage": "BooleanControl reference", "XZ Coordinates": "Cluster reference", "Activate XZ Stage": "BooleanControl reference", "XZ Stage Cell Reference": "EnumSelector reference", "XZ All Position Cluster Ref": "Cluster reference"}
  T9 = cluster{"IV Extracted Parameter Plot ": "Graph reference", "MRM Cell Selector Ref": "Cluster reference", "IV Plot Out Multiple Reference": "Graph reference", "Rainbow Sweep Parameters MRM Ref": "Cluster reference", "MRM Cell Refined Plot Selector ref": "ComboBoxSelector reference", "MRM Current Raw Cell Plot": "ComboBoxSelector reference", "MRM Raw Plot Rainbow Sweep Relector Ref": "ComboBoxSelector reference", "MRM Specific Parameters Ref": "Cluster reference"}
  T10 = cluster{"Smart Sweep Mega Cluster Ref": "Cluster reference"}
  "Full Reference Cluster.gtype" = cluster{"SRM Reference Cluster": T1, "Path Reference Cluster": T2, "Tab Reference Cluster": T3, "Cell Naming Parameters Ref Cluster": T4, "One Time Calibrations Ref Cluster": T5, "LPC Controls Reference Cluster": T6, "System Parameters Ref Cluster": T7, "XZ Stage Controls Reference Cluster": T8, "MRM Reference Cluster": T9, "Other Parameters Cluster": T10}
  T11 = cluster{"X Coordinate (mm)": f64, "Z Coordinate (mm)": f64, "Aprch Distance (mm)": f64}
  T12 = cluster{"X Coordinate (mm)": f64, "Z Coordinate (mm)": f64, "Vertical Spacing (mm)": f64, "Aprch Distance (mm)": f64, "Aprch Dstnc L.12 (mm)": f64}
  "XZ All Position Cluster.gtype" = cluster{"Diffusor Coordinates": T11, "Photodetector Coordinates": T11, "Cell R.01 Coordinates": T12}
  T13 = cluster{"Thorlabs Motor Serial Number File Path": path, "Default Data Saving Location": path}
  "Cell Naming Cluster.gtype" = cluster{"Cell Label": string, "Sample Prefix": string, "Author Initials": string, "Current Date": string, "Batch Name": string}
  "Misc Data Mega Cluster.gtype" = cluster{"Full Reference Cluster": "Full Reference Cluster.gtype", "All XZ Position Cluster": "XZ All Position Cluster.gtype", "All Paths": T13, "Cell Naming Cluster": "Cell Naming Cluster.gtype"}
  "Sweep Speed Selector.gtype" = enum{"Smart Sweep", "Fast Sweep", "Normal Sweep"}
  "MRM Specific Parameters.gtype" = cluster{"Max (V)": f64, "Min (V)": f64, "V Points": u32, "Curr Range (A)": f64, "Sweep Dir": bool, "Current Avg": u32, "Max (A)": f64, "PLC Speed": f64, "Cell Area (m^2)": f64, "Autorange": bool, "Full Spctr Ref": bool, "Sweep Speed": "Sweep Speed Selector.gtype"}
  T14 = cluster{"L.01": bool, "R.01": bool, "L.02": bool, "R.02": bool, "L.03": bool, "R.03": bool, "L.04": bool, "R.04": bool, "L.05": bool, "R.05": bool, "L.06": bool, "R.06": bool, "L.07": bool, "R.07": bool, "L.08": bool, "R.08": bool, "L.09": bool, "R.09": bool, "L.10": bool, "R.10": bool, "L.11": bool, "R.11": bool, "L.12": bool, "R.12": bool}
  "MRM Cell Selector.gtype" = cluster{"All": bool, "Left": bool, "Right": bool, "Cell Cluster": T14, "Reset": bool}
  "XZ Stage Cell.gtype" = enum{"L.01", "L.02", "L.03", "L.04", "L.05", "L.06", "L.07", "L.08", "L.09", "L.10", "L.11", "L.12", "R.01", "R.02", "R.03", "R.04", "R.05", "R.06", "R.07", "R.08", "R.09", "R.10", "R.11", "R.12"}
  "Selected Cells Array.gtype" = "XZ Stage Cell.gtype"[]
  "Raibow Sweep Selector.gtype" = enum{"Red Sweep", "Blue Sweep", "Full Sweep Red First", "Full Sweep Blue First"}
  "Rainbow Sweep Param Selector.gtype" = cluster{"Raibow Sweep Selector": "Raibow Sweep Selector.gtype", "Max Wavelength (nm)": f64, "Min Wavelength (nm)": f64, "Wavelength Step (nm)": f64, "Rainbow Sweep Type Selector": "Rainbow Sweep Type Selector.gtype"}
  T15 = enum{"L.01", "L.02", "L.03", "L.04", "L.05", "L.06", "L.07", "L.08", "L.09", "L.10", "L.11", "L.12", "R.01", "R.02", "R.03", "R.04", "R.05", "R.06", "R.07", "R.08", "R.09", "R.10", "R.11", "R.12"}
  "MRM Full Data From SRM Cluster.gtype" = cluster{"SRM Mega Cluster": "SRM Mega Cluster.gtype", "Cell Label": T15}
  "MRM Mega Cluster.gtype" = cluster{"MRM Specific Parameters": "MRM Specific Parameters.gtype", "Cell Selector": "MRM Cell Selector.gtype", "Cells to Measure Array": "Selected Cells Array.gtype", "Rainbow Sweep Parameters MRM": "Rainbow Sweep Param Selector.gtype", "MRM Data Array": "MRM Full Data From SRM Cluster.gtype"[]}
diagram:
  # This SubVI Updates the values of the control for the LPC parameters and stores them in the MRM Mega Cluster so that they can be used afterwards
  case ($"Error In") {
    frame Error, Default {
      w1 = $"Error In"
      w2 = $"Misc Data Mega Cluster In"
      w3 = $"MRM Mega Cluster In"
    }
    frame No Error {
      Property Node(instance in=$"Misc Data Mega Cluster In") -> ("Full Reference Cluster:MRM Reference Cluster:Rainbow Sweep Parameters MRM Ref"=w4, "Full Reference Cluster:MRM Reference Cluster:MRM Specific Parameters Ref"=w5, "Full Reference Cluster:MRM Reference Cluster:MRM Cell Selector Ref"=w6, instance out=w2)
      Property Node(instance in=w6, error in=$"Error In") -> ("Value"=w7, error out=w8)
      Property Node(instance in=w4, error in=w8) -> ("Value"=w9, error out=w10)
      Property Node(instance in=w5, error in=w10) -> ("Value"=w11, error out=w1)
      Property Node(instance in=$"MRM Mega Cluster In", "MRM Specific Parameters"=w11, "Rainbow Sweep Parameters MRM"=w9, "Cell Selector"=w7) -> (instance out=w3)
    }
  }
  $"Misc Data Mega Cluster Out" <- w2
  $"Error Out" <- w1
  $"MRM Mega Cluster Out" <- w3
