vi "Update MSpot Controls.gvi"   [LabVIEW NXG 5.0.0]
inputs:
  "Misc Data Mega Cluster In": "Misc Data Mega Cluster.gtype"
  "MSpot Mega Cluster In": "MSpot Mega Cluster.gtype"
  "Error In": error
outputs:
  "Misc Data Mega Cluster Out": "Misc Data Mega Cluster.gtype"
  "MSpot Mega Cluster Out": "MSpot Mega Cluster.gtype"
  "Error Out": error
types:
  "Raibow Sweep Selector.gtype" = enum{"Red Sweep", "Blue Sweep", "Full Sweep Red First", "Full Sweep Blue First"}
  "Rainbow Sweep Param Selector.gtype" = cluster{"Raibow Sweep Selector": "Raibow Sweep Selector.gtype", "Max Wavelength (nm)": f64, "Min Wavelength (nm)": f64, "Wavelength Step (nm)": f64, "Rainbow Sweep Type Selector": "Rainbow Sweep Type Selector.gtype"}
  "MSpot Spectrum Calibration Parameters.gtype" = cluster{"Min Position (mm)": f64, "Max Position (mm)": f64, "Position step size (mm)": f64, "Manual Spectra?": bool, "Flame Integration Time (us)": f64, "Flame Scans to Average": u32}
  "Rainbow Sweep Types.gtype" = enum{"Red Sweep Closing", "Red Sweep Opening", "Blue Sweep Closing", "Blue Sweep Opening"}
  "Full MSpot Multispectral Data.gtype" = cluster{"MSpot Spectrum Data Array": "MSpot Spectrum Data.gtype"[], "Rainbow Sweep Types": "Rainbow Sweep Types.gtype"}
  "MSpot Mega Cluster.gtype" = cluster{"Rainbow Sweep Parameters MSpot": "Rainbow Sweep Param Selector.gtype", "MSpot Sperctrum Calibration Parameters": "MSpot Spectrum Calibration Parameters.gtype", "Full Beam Multispectral Data Array": "Full MSpot Multispectral Data.gtype"[]}
  T1 = cluster{"IV Extracted Parameter Plot ": "Graph reference", "MRM Cell Selector Ref": "Cluster reference", "IV Plot Out Multiple Reference": "Graph reference", "Rainbow Sweep Parameters MRM Ref": "Cluster reference", "MRM Specific Parameters Ref": "Cluster reference", "MRM Cell Refined Plot Selector ref": "ComboBoxSelector reference", "MRM Current Raw Cell Plot": "ComboBoxSelector reference", "MRM Raw Plot Rainbow Sweep Relector Ref": "ComboBoxSelector reference"}
  T2 = cluster{"SRM Light Power Density Ref": "NumericTextBoxDouble reference", "Rainbow Sweep Parameters RSM": "Cluster reference", "SRM Refined Plot Rainbow Sweep Types": "ComboBoxSelector reference", "SRM Specific Parameters": "Cluster reference", "Sweep Live Parameters RSM": "Cluster reference", "SRM Raw Plot Rainbow Sweep Selector": "ComboBoxSelector reference", "SRM Plot Parameter Selector Ref": "EnumSelector reference", "IV Plot Out Ref": "Graph reference"}
  T3 = cluster{"Calibration Files Path": "PathSelector reference", "Default Data Saving Location": "PathSelector reference"}
  T4 = cluster{"Main Tab": "TabControl reference", "Rainbow Measurement tab": "TabControl reference", "Configuration tab": "TabControl reference", "Light Calibration tab": "TabControl reference"}
  T5 = cluster{"Custom date": "CheckBox reference", "Batch Name": "StringControl reference", "Author Initials": "ComboBoxSelector reference", "Cell Number": "StringControl reference", "Current Date": "StringControl reference", "Sample Comments": "StringControl reference", "Sample Prefix": "StringControl reference", "Label Info Missing Error": "BooleanControl reference", "Label Info Error Label": "StringControl reference"}
  T6 = cluster{"Beam Power Density": "IntensityGraph reference"[][], "Irradiance Calibration": "Graph reference"[], "MSpot Spectrum Calibration Parameters": "Cluster reference", "Rainbow Sweep Param Selector MSpot": "Cluster reference"}
  T7 = cluster{"LPC Parameters Ref": "Cluster reference", "Sweep Live Parameters LPC ref": "Cluster reference", "Light Power Calibration": "Graph reference", "Light Power Calibration Data Ref": "ArrayViewer reference", "Rainbow Sweep Parameters LPC": "Cluster reference"}
  T8 = cluster{"Current State Ref": "EnumSelector reference", "Substate": "StringControl reference", "State": "StringControl reference", "Current Substate": "StringControl reference"}
  T9 = cluster{"Custom Position": "BooleanControl reference", "Set Position": "BooleanControl reference", "XZ Stage Active": "BooleanControl reference", "Release XZ Stage": "BooleanControl reference", "XZ Coordinates": "Cluster reference", "Activate XZ Stage": "BooleanControl reference", "XZ Stage Cell Reference": "EnumSelector reference", "XZ All Position Cluster Ref": "Cluster reference"}
  "Full Reference Cluster.gtype" = cluster{"MRM Reference Cluster": T1, "SRM Reference Cluster": T2, "Path Reference Cluster": T3, "Tab Reference Cluster": T4, "Cell Naming Parameters Ref Cluster": T5, "One Time Calibrations Ref Cluster": T6, "LPC Controls Reference Cluster": T7, "System Parameters Ref Cluster": T8, "XZ Stage Controls Reference Cluster": T9}
  T10 = cluster{"X Coordinate (mm)": f64, "Z Coordinate (mm)": f64, "Aprch Distance (mm)": f64}
  T11 = cluster{"X Coordinate (mm)": f64, "Z Coordinate (mm)": f64, "Vertical Spacing (mm)": f64, "Aprch Distance (mm)": f64, "Aprch Dstnc L.12 (mm)": f64}
  "XZ All Position Cluster.gtype" = cluster{"Diffusor Coordinates": T10, "Photodetector Coordinates": T10, "Cell R.01 Coordinates": T11}
  T12 = cluster{"Thorlabs Motor Serial Number File Path": path, "Default Data Saving Location": path}
  "Cell Naming Cluster.gtype" = cluster{"Cell Label": string, "Sample Prefix": string, "Author Initials": string, "Current Date": string, "Batch Name": string}
  "Misc Data Mega Cluster.gtype" = cluster{"Full Reference Cluster": "Full Reference Cluster.gtype", "All XZ Position Cluster": "XZ All Position Cluster.gtype", "All Paths": T12, "Cell Naming Cluster": "Cell Naming Cluster.gtype"}
diagram:
  # This subVI updates the value of the controls of the front panel and stores their parameters
  # on the MSpot Mega Cluster so that these can be used afterwards
  case ($"Error In") {
    frame Error, Default {
      w1 = $"MSpot Mega Cluster In"
      w2 = $"Error In"
      w3 = $"Misc Data Mega Cluster In"
    }
    frame No Error {
      Property Node(instance in=$"Misc Data Mega Cluster In") -> ("Full Reference Cluster:One Time Calibrations Ref Cluster:MSpot Spectrum Calibration Parameters"=w4, "Full Reference Cluster:One Time Calibrations Ref Cluster:Rainbow Sweep Param Selector MSpot"=w5, instance out=w3)
      Property Node(instance in=w4, error in=$"Error In") -> ("Value"=w6, error out=w7)
      Property Node(instance in=w5, error in=w7) -> ("Value"=w8, error out=w2)
      Property Node(instance in=$"MSpot Mega Cluster In", "Rainbow Sweep Parameters MSpot"=w8, "MSpot Sperctrum Calibration Parameters"=w6) -> (instance out=w1)
    }
  }
  $"Misc Data Mega Cluster Out" <- w3
  $"Error Out" <- w2
  $"MSpot Mega Cluster Out" <- w1
