vi "Array Detect Duplicates.gvi"   [LabVIEW NXG 5.0.0]
inputs:
  "Error In": error
  "Array In": "Rainbow Sweep Types.gtype"[]
outputs:
  "Error Out": error
  "Repeated?": bool
types:
  "Rainbow Sweep Types.gtype" = enum{"Red Sweep Closing", "Red Sweep Opening", "Blue Sweep Closing", "Blue Sweep Opening"}
diagram:
  # This SubVI Takes an array of sweep types and detects if
  # there is any repeated ones.
  case ($"Error In") {
    frame Error, Default {
      w1 = $"Error In"
      w2 = default
    }
    frame No Error {
      for {
        w3 = each element of $"Array In"
        s1 = 0  # shift register
        for {
          w5 = each element of $"Array In"
          Increment(x=s1) -> w6
          Is Equal(x=w3, y=w5) -> w7
          Select(s=w7, t=w6, f=s1) -> w8
          next s1 = w8
        }
        Is Greater(x=s1, y=1) -> w9
        append w9 to w4
      }
      Or Array Elements(Boolean array=w4) -> (logical OR=w2)
      w1 = $"Error In"
    }
  }
  $"Error Out" <- w1
  $"Repeated?" <- w2
