vi "Array Parameters Calculation.gvi"   [LabVIEW NXG 5.0.0]
inputs:
  "Error In": error
  "Input Array 1D": f64[]
  "Range Value 1": f64
  "Range Value 2": f64
outputs:
  "Error Out": error
  "Constant Steps?": bool
  "Step Value": f64
  "In Range?": bool
  "Coerced Max Wavelenght": f64
  "Coerced Min Wavelenght": f64
diagram:
  case ($"Error In") {
    frame Error, Default {
      w1 = $"Error In"
      w2 = default
      w3 = default
      w4 = default
      w5 = default
      w6 = default
    }
    frame No Error {
      Array Index(array=$"Input Array 1D") -> (out0[0]=w7, out1[1]=w8)
      Subtract(x=w8, y=w7) -> w9
      s1 = w7  # shift register
      s2 = w9  # shift register
      for (iteration -> i1) {
        w10 = each element of $"Input Array 1D"
        Is Not Equal To 0(x=i1) -> w12
        case (w12) {
          frame False, Default {
            w13 = s2
            w14 = TRUE
            w15 = w10
          }
          frame True {
            Subtract(x=w10, y=s1) -> w13
            Is Equal(x=w13, y=s2) -> w14
            w15 = w10
          }
        }
        append w14 to w11
        next s1 = w15
        next s2 = w13
      }
      Absolute Value(x=s2) -> w3
      And Array Elements(Boolean array=w11) -> (logical AND=w2)
      Array Max And Min(array=$"Input Array 1D") -> (max value=w16, min value=w17)
      Max And Min(x=$"Range Value 1", y=$"Range Value 2") -> (min(x,y)=w18: f64, max(x,y)=w19: f64)
      In Range And Coerce[IncludeHighLimit=True](lower limit=w18, upper limit=w19, x=w16) -> (In Range?=w20, coerced(x)=w5)
      In Range And Coerce[IncludeHighLimit=True](lower limit=w18, upper limit=w19, x=w17) -> (In Range?=w21, coerced(x)=w6)
      Logical And(w20, w21) -> w4
      w1 = $"Error In"
    }
  }
  $"Error Out" <- w1
  $"Step Value" <- w3
  $"Constant Steps?" <- w2
  $"Coerced Max Wavelenght" <- w5
  $"In Range?" <- w4
  $"Coerced Min Wavelenght" <- w6
