vi "Array Zero Element Remover.gvi"   [LabVIEW NXG 5.0.0]
inputs:
  "Error In": error
  "Input 2d Array": f64[][]
  "Input 1D array": f64[]
outputs:
  "Error Out": error
  "No zero 1D array Out": f64[]
  "No Empty Row Output Array 2D": f64[][]
diagram:
  # This SubVI Erases the Empty Rows of an array
  case ($"Error In") {
    frame Error, Default {
      w1 = $"Error In"
      w2 = $"Input 2d Array"
      w3 = $"Input 1D array"
    }
    frame No Error {
      for {
        w4 = each element of $"Input 1D array"
        Is Not Equal To 0(x=w4) -> w5
        append w4 to w3 if w5
      }
      for {
        w6 = each element of $"Input 2d Array"
        for {
          w7 = each element of w6
          Is Equal To 0(x=w7) -> w9
          append w9 to w8
        }
        And Array Elements(Boolean array=w8) -> (logical AND=w10)
        Not(x=w10) -> w11
        append w6 to w2 if w11
      }
      w1 = $"Error In"
    }
  }
  $"Error Out" <- w1
  $"No zero 1D array Out" <- w3
  $"No Empty Row Output Array 2D" <- w2
