vi "Randomize Duouble Array.gvi"   [LabVIEW NXG 5.0.0]
inputs:
  "Error In": error
  "1D Array In": f64[]
outputs:
  "Error Out": error
  "1D Shuffled Array Out": f64[]
uses:
  NI::G Core::Numeric::Random Number (Range) DBL.gvi
diagram:
  case ($"Error In") {
    frame Error, Default {
      w1 = $"Error In"
      w2 = $"1D Array In"
    }
    frame No Error {
      Array Size(array=$"1D Array In") -> (size(s)=w3)
      for (N = w3) {
        w4 = each element of $"1D Array In"
        call "Random Number (Range) DBL.gvi"(upper bound=w3) -> (number=w6)
        Build Cluster(w6, w4) -> w7
        append w7 to w5
      }
      Sort 1D Array(array=w5) -> (sorted array=w8)
      for {
        w9 = each element of w8
        Property Node(instance in=w9) -> ("Element 2"=w10)
        append w10 to w2
      }
      w1 = $"Error In"
    }
  }
  $"Error Out" <- w1
  $"1D Shuffled Array Out" <- w2
