vi "Array Zero Element Remover.gvi"   [LabVIEW NXG 5.0.0]
inputs:
  "Error In": error
  "Input Array": f64[][]
outputs:
  "Error Out": error
  "No Empty Row Output Array": f64[][]
diagram:
  # This SubVI Erases the Empty Rows of an array
  case ($"Error In") {
    frame Error, Default {
      w1 = $"Error In"
      w2 = $"Input Array"
    }
    frame No Error {
      for {
        w3 = each element of $"Input Array"
        for {
          w4 = each element of w3
          Is Equal To 0(x=w4) -> w6
          append w6 to w5
        }
        And Array Elements(Boolean array=w5) -> (logical AND=w7)
        Not(x=w7) -> w8
        append w3 to w2 if w8
      }
      w1 = $"Error In"
    }
  }
  $"Error Out" <- w1
  $"No Empty Row Output Array" <- w2
