vi "Custom Number Array Generator.gvi"   [LabVIEW NXG 5.0.0]
inputs:
  "Error In": error
  "Start Value": f64
  "End Value": f64
  "Step Value": f64
outputs:
  "Error Out": error
  "Generated Array": f64[]
diagram:
  # This SubVI Generates an array from the value you desire to the value you desire and with the step you desire
  case ($"Error In") {
    frame Error, Default {
      w1 = $"Error In"
      w2 = default
    }
    frame No Error {
      Subtract(x=$"End Value", y=$"Start Value") -> w3
      Absolute Value(x=w3) -> w4
      Divide(x=w4, y=$"Step Value") -> w5
      Increment(x=w5) -> w6
      Round To Nearest(number=w6) -> w7
      To Signed 32 Bit Integer(number=w7) -> w8
      Sign(number=w3) -> (-1, 0, 1=w9)
      for (N = w8) (iteration -> i1) {
        To Double Precision Float(number=i1) -> w10
        Multiply($"Step Value", w10) -> w11
        Multiply(w9, w11) -> w12
        Add($"Start Value", w12) -> w13
        append w13 to w2
      }
      w1 = $"Error In"
    }
  }
  $"Error Out" <- w1
  $"Generated Array" <- w2
