vi "Find Closest In Array.gvi"   [LabVIEW NXG 5.0.0]
inputs:
  "Error In": error
  "Array In": f64[]
  "Desired Value": f64
outputs:
  "Error Out": error
  "Closest Value Index": i32
  "Closest Value": f64
diagram:
  # This SubVI takes an array and a value and
  #  returns the index of the array value which is closest
  # to the Desired Value
  case ($"Error In") {
    frame Error, Default {
      w1 = $"Error In"
      w2 = -1
      w3 = -1
    }
    frame No Error {
      Subtract(x=$"Array In", y=$"Desired Value") -> w4
      Absolute Value(x=w4) -> w5
      Array Max And Min(array=w5) -> (min index(es)=w2)
      Array Index(array=$"Array In") -> (out0[w2]=w3)
      w1 = $"Error In"
    }
  }
  $"Error Out" <- w1
  $"Closest Value Index" <- w2
  $"Closest Value" <- w3
