vi "Generate tanh Function.gvi"   [LabVIEW NXG 5.0.0]
inputs:
  "Error In": error
  "X data array in": f64[]
  "Inflexion Point X Value": f64 = 550
  "Transition Steepness": f64 = 0.05
  "-Infinity Value": f64 = 0.05
  "+Infinity Value": f64 = 0.05
  "X single Value In": f64
outputs:
  "Error Out": error
  "Custom tanh Function Array": f64[]
  "Tanh Single Value Out": f64
diagram:
  # This SubVI Creates a tanh function with the specified parameters
  case ($"Error In") {
    frame Error, Default {
      w1 = $"Error In"
      w2 = $"X data array in"
      w3 = $"X single Value In"
    }
    frame No Error {
      Add($"+Infinity Value", $"-Infinity Value") -> w4
      Divide(x=w4, y=2) -> w5
      Subtract(x=$"+Infinity Value", y=$"-Infinity Value") -> w6
      Subtract(x=$"X data array in", y=$"Inflexion Point X Value") -> w7
      Multiply(w7, $"Transition Steepness") -> w8
      Hyperbolic Tangent(x=w8) -> w9
      Divide(x=w9, y=2) -> w10
      Multiply(w10, w6) -> w11
      Add(w11, w5) -> w2
      Subtract(x=$"+Infinity Value", y=$"-Infinity Value") -> w12
      Subtract(x=$"X single Value In", y=$"Inflexion Point X Value") -> w13
      Multiply(w13, $"Transition Steepness") -> w14
      Hyperbolic Tangent(x=w14) -> w15
      Divide(x=w15, y=2) -> w16
      Multiply(w16, w12) -> w17
      Add($"+Infinity Value", $"-Infinity Value") -> w18
      Divide(x=w18, y=2) -> w19
      Add(w17, w19) -> w3
      w1 = $"Error In"
    }
  }
  $"Error Out" <- w1
  $"Custom tanh Function Array" <- w2
  $"Tanh Single Value Out" <- w3
