vi "Get date as YYMMDD.gvi"   [LabVIEW NXG 5.0.0]
inputs:
  "Error In": error
outputs:
  "Error Out": error
  "Date YYMMDD": string
uses:
  NI::G Core::Strings::Search and Replace Pattern.gvi
diagram:
  case ($"Error In") {
    frame Error, Default {
      w1 = $"Error In"
      w2 = default
    }
    frame No Error {
      Get Current Time() -> (current time=w3)
      Get Date And Time String(time stamp=w3) -> (date string=w4)
      call "Search and Replace Pattern.gvi"(string=w4, pattern="/", replace all=TRUE) -> (result string=w5)
      Replace Substring(length (len. of substring)=2, offset=5, string=w5) -> (result string=w6)
      Replace Substring(length (len. of substring)=2, offset=4, string=w6) -> (replaced substring=w7)
      Replace Substring(length (len. of substring)=2, string=w6) -> (replaced substring=w8)
      Replace Substring(length (len. of substring)=2, offset=2, string=w6) -> (replaced substring=w9)
      Concatenate Strings(w7, w8, w9) -> w2
      w1 = $"Error In"
    }
  }
  $"Error Out" <- w1
  $"Date YYMMDD" <- w2
