vi "Header Extractor.gvi"   [LabVIEW NXG 5.0.0]
inputs:
  "Error In": error
  "Spreadsheet String": string
outputs:
  "Error Out": error
  "Spreadsheet string without header": string
  "Header": string
uses:
  NI::G Core::Strings::Trim Whitespace.gvi
diagram:
  # This SubVi extracts the header of a given spreadsheet string
  case ($"Error In") {
    frame Error, Default {
      w1 = $"Error In"
    }
    frame No Error {
      Pick Line(line index=0, multi-line string=$"Spreadsheet String") -> (output string=w2)
      Search And Replace String(input string=$"Spreadsheet String", replace string ("")="", search string=w2) -> (result string=w3)
      call "Trim Whitespace.gvi"(string=w3) -> (trimmed string=w4)
      $"Spreadsheet string without header" <- w4
      $Header <- w2
      w1 = $"Error In"
    }
  }
  $"Error Out" <- w1
