vi "Order of Magnitude Extractor.gvi"   [LabVIEW NXG 5.0.0]
inputs:
  "Error In": error
  "Number to extract order of magnitude": f64
outputs:
  "Error Out": error
  "Order of magnitude": f64
diagram:
  # This SubVI Takes a number and extracts the order of magnitude or the closest unitary value.
  # For example if you input 5345 it will output 1000 and for 0.004535 it will output 0.001
  case ($"Error In") {
    frame Error, Default {
      w1 = 0
      w2 = $"Error In"
    }
    frame No Error {
      Is Not Equal To 0(x=$"Number to extract order of magnitude") -> w3
      case (w3) {
        frame False, Default {
          w1 = $"Number to extract order of magnitude"
        }
        frame True {
          s1 = $"Number to extract order of magnitude"  # shift register
          s2 = 1  # shift register
          while {
            Is Equal(x=s1, y=1) -> w4
            case (w4) {
              frame True {
                w5 = s2
                w6 = s1
                w7 = TRUE
              }
              frame False {
                Is Greater Or Equal(x=s1, y=10) -> w8
                case (w8) {
                  frame False, Default {
                    w9 = s1
                    w10 = s2
                    w11 = TRUE
                  }
                  frame True {
                    Divide(x=s1, y=10) -> w9
                    Multiply(s2, 10) -> w10
                    w11 = FALSE
                  }
                }
                Is Less(x=w9, y=1) -> w12
                case (w12) {
                  frame True {
                    Multiply(w9, 10) -> w6
                    Divide(x=w10, y=10) -> w5
                    w13 = FALSE
                  }
                  frame False {
                    w6 = w9
                    w5 = w10
                    w13 = TRUE
                  }
                }
                Logical And(w11, w13) -> w7
              }
            }
            next s1 = w6
            next s2 = w5
            stop if w7
          }
          w1 = s2
        }
      }
      w2 = $"Error In"
    }
  }
  $"Error Out" <- w2
  $"Order of magnitude" <- w1
