vi "Progress General Calculator.gvi"   [LabVIEW NXG 5.0.0]
inputs:
  "Error In": error
  "Starting Value": f64
  "Ending Value": f64
  "Number Of Steps": i32
  "Current Step": i32
outputs:
  "Error Out": error
  "Current Progress": f64
diagram:
  # This SubVI Easily calculates the current
  # progress based on 4 very simple parameters
  case ($"Error In") {
    frame Error, Default {
      w1 = $"Error In"
      w2 = 0
    }
    frame No Error {
      Subtract(x=$"Ending Value", y=$"Starting Value") -> w3
      To Double Precision Float(number=$"Current Step") -> w4
      To Double Precision Float(number=$"Number Of Steps") -> w5
      Divide(x=w4, y=w5) -> w6
      Multiply(w3, w6) -> w7
      Add($"Starting Value", w7) -> w2
      w1 = $"Error In"
    }
  }
  $"Error Out" <- w1
  $"Current Progress" <- w2
