vi "Round Number.gvi"   [LabVIEW NXG 5.0.0]
inputs:
  "Number To Round": f64
  "Number Of Decimals": i32
outputs:
  "Rounded Number": f64
panel controls:
  "Error In": error
panel indicators:
  "Error Out": error
diagram:
  # This SubVI Rounds a number to a certain number of decimals
  case ($"Error In") {
    frame Error, Default {
      w1 = $"Error In"
      w2 = $"Number To Round"
    }
    frame No Error {
      s1 = $"Number To Round"  # shift register
      for (N = $"Number Of Decimals") {
        Multiply(s1, 10) -> w3
        next s1 = w3
      }
      Round To Nearest(number=s1) -> w4
      s2 = w4  # shift register
      for (N = $"Number Of Decimals") {
        Divide(x=s2, y=10) -> w5
        next s2 = w5
      }
      w1 = $"Error In"
      w2 = s2
    }
  }
  $"Error Out" <- w1
  $"Rounded Number" <- w2
