vi "Seconds Kronos Calculator.gvi"   [LabVIEW NXG 5.0.0]
inputs:
  "Error In": error
  "Seconds In": f64
  "Kronos In": f64
outputs:
  "Error Out": error
  "Kronos Out": f64
  "Seconds Out": f64
diagram:
  # This SubVI Converts from complicate time to
  # simple time
  case ($"Error In") {
    frame Error, Default {
      w1 = $"Error In"
      w2 = $"Seconds In"
      w3 = $"Kronos In"
    }
    frame No Error {
      Multiply($"Kronos In", 8640) -> w3
      Divide(x=$"Seconds In", y=8640) -> w2
      w1 = $"Error In"
    }
  }
  $"Error Out" <- w1
  $"Seconds Out" <- w3
  $"Kronos Out" <- w2
