vi "Timer.gvi"   [LabVIEW NXG 5.0.0]
inputs:
  "Error In": error
  "Timer Commands": T1 = "Reset Timer"
  "Timer Set Value (Seconds)": u16
outputs:
  "Error Out": error
  "Elapsed Time (Seconds)": f64
  "Expired?": bool
  "Paused?": bool
types:
  T1 = enum{"Reset Timer", "Check Timer", "Pause Timer", "Resume Timer"}
diagram:
  case ($"Error In") {
    frame No Error {
      # Initial Timestamp
      To Double Precision Float(number=$"Timer Set Value (Seconds)") -> w2
      # Time Elapsed
      Get Current Time() -> (current time=w3)
      Timestamp To Double Precision Float(number=w3) -> (double precision float=w4)
      # Timer State
      # Time Target
      s1 = uninitialised  # shift register
      s2 = uninitialised  # shift register
      s3 = uninitialised  # shift register
      s4 = uninitialised  # shift register
      while {
        # Use FGV to implement a timer
        case ($"Timer Commands") {
          frame "Reset Timer", Default {
            # Timer Initialize
            # >> Time Stamp >>
            # >> Elapsed Time >>
            w1 = $"Error In"
            w5 = w4
            w6 = w2
            w7 = TRUE
            w8 = 0
          }
          frame "Check Timer" {
            case (s3) {
              frame False, Default {
                # Timer Not Running
                # >> Elapsed Time >>
                # >> Time Stamp >>
                w6 = s2
                w7 = s3
                w5 = s4
                w8 = s1
              }
              frame True {
                Subtract(x=w4, y=s4) -> w9
                # >> Time Stamp >>
                Add(w9, s1) -> w8
                # >> Elapsed Time >>
                # Timer Running
                Is Less Or Equal(x=s2, y=w8) -> w10
                $"Expired?" <- w10
                w6 = s2
                w7 = s3
                w5 = w4
              }
            }
            w1 = $"Error In"
          }
          frame "Pause Timer" {
            case (s3) {
              frame False, Default {
                # Timer Not Running
                # >> Elapsed Time >>
                # >> Time Stamp >>
                w6 = s2
                w7 = s3
                w5 = s4
                w8 = s1
              }
              frame True {
                # Timer Running
                # >> Time Stamp >>
                Subtract(x=w4, y=s4) -> w11
                # >> Elapsed Time >>
                Add(w11, s1) -> w8
                w6 = s2
                w7 = FALSE
                w5 = w4
              }
            }
            w1 = $"Error In"
          }
          frame "Resume Timer" {
            case (s3) {
              frame False, Default {
                # Timer Running
                # >> Elapsed Time >>
                # >> Time Stamp >>
                w6 = s2
                w7 = TRUE
                w5 = w4
                w8 = s1
              }
              frame True {
                # Timer Not Running
                # >> Elapsed Time >>
                # >> Time Stamp >>
                w6 = s2
                w7 = s3
                w5 = s4
                w8 = s1
              }
            }
            w1 = $"Error In"
          }
        }
        next s1 = w8
        next s2 = w6
        next s3 = w7
        next s4 = w5
        continue if FALSE
      }
      $"Elapsed Time (Seconds)" <- s1
      Not(x=s3) -> w12
      $"Paused?" <- w12
    }
    frame Error {
      w1 = $"Error In"
    }
  }
  $"Error Out" <- w1
