vi "Wait ms.gvi"   [LabVIEW NXG 5.0.0]
inputs:
  "Error In": error
  "Milliseconds to Wait": u32
outputs:
  "Error Out": error
uses:
  Rainbow Measurement Setup::Side Functions::Global Abort::FGV Global Abort.gvi
diagram:
  # This SubVI Waits for a set time of milliseconds, if the time is bigger than 100 ms then
  # it checks periodically the abort state to stop waiting.
  case ($"Error In") {
    frame Error, Default {
      w1 = $"Error In"
    }
    frame No Error {
      Is Greater(x=$"Milliseconds to Wait", y=100) -> w2
      case (w2) {
        frame False, Default {
          Wait(time to wait=$"Milliseconds to Wait")
          w1 = $"Error In"
        }
        frame True {
          Divide(x=$"Milliseconds to Wait", y=100) -> w3
          Round Toward Positive Infinity(x=w3) -> w4
          s1 = $"Error In"  # shift register
          for (N = w4) {
            call "FGV Global Abort.gvi"(Global Abort Instructions="Read Current State", Error In=s1) -> (Local Abort Out=w5, Global Abort Out=w6, Error Out=w7)
            Logical Or(w5, w6) -> w8
            Wait Until Next Multiple(multiple to wait=100)
            next s1 = w7
            stop if w8
          }
          w1 = s1
        }
      }
    }
  }
  $"Error Out" <- w1
